# Grasshopper definition Bark beetle - Laser stream.gh (Grasshopper 0.9.76)
# plug-ins: LocalCode

# Developed by Jens Dyvik / Fellesverkstedet
# 
# License: Creative Commons Attribution ShareAllike (cc-by-sa)
# LASER
enable_laser_stream = BooleanToggle(True)
pipeline = GeometryPipeline(
    GroupByLayer=False,
    GroupByType=False,
    IncludeHidden=True,
    IncludeLocked=True,
    LayerFilter="Laser engrave",
    NameFilter="*",
    TypeFilter=1073741884)
pipeline_2 = GeometryPipeline(
    GroupByLayer=False,
    GroupByType=False,
    IncludeHidden=True,
    IncludeLocked=True,
    LayerFilter="Laser cut",
    NameFilter="*",
    TypeFilter=4)
laser_engrave = Geometry(pipeline)
laser_cut = Curve(pipeline_2)

pt = ConstructPoint(XCoordinate=0, YCoordinate=0, ZCoordinate=0)
pt_2 = ConstructPoint(XCoordinate=0, YCoordinate=0, ZCoordinate="0.01")
ln = Line(StartPoint=pt, EndPoint=pt_2)
short_curve_for_making_empty_layer = Curve(ln)

# ----
# E:\Projects\Toolpaths\BarkBeetle\Networked fabrication\Stream testing\Laser test stream\laserstream_engrave.3dm
panel = Panel("C:\Users\Jens\Dropbox (Fellesverkstedet)\Bark beetle\Laser stream\laserstream_engrave.3dm")
# E:\Projects\Toolpaths\BarkBeetle\Networked fabrication\Stream testing\Laser test stream\laserstream_cut.3dm
panel_2 = Panel("C:\Users\Jens\Dropbox (Fellesverkstedet)\Bark beetle\Laser stream\laserstream_cut.3dm")
swatch = ColourSwatch(SwatchColor=RGB(117, 117, 117))
swatch_2 = ColourSwatch(SwatchColor=RGB(138, 90, 90))
material = CreateMaterial(Diffuse=swatch_2, Specular=RGB(255, 255, 255), Emission=RGB(0, 0, 0), Transparency=0, Shine=0)
material_2 = CreateMaterial(Diffuse=swatch, Specular=RGB(255, 255, 255), Emission=RGB(0, 0, 0), Transparency=0, Shine=0)
localcodeexport = LocalCodeExport(
    DestinationFilePath=panel_2,
    Export=enable_laser_stream,
    LayerNames="Laser cut stream",
    LayerColors=swatch_2,
    GeometryTree=[laser_cut, short_curve_for_making_empty_layer])
localcodeexport_2 = LocalCodeExport(
    DestinationFilePath=panel,
    Export=enable_laser_stream,
    LayerNames="Laser engrave stream",
    LayerColors=swatch,
    GeometryTree=[laser_engrave, short_curve_for_making_empty_layer])
preview = CustomPreview(Geometry=laser_cut, Shader=material)
preview_2 = CustomPreview(Geometry=laser_engrave, Shader=material_2)
panel_3 = Panel(localcodeexport)
panel_4 = Panel(localcodeexport_2)
