# Grasshopper definition Bark beetle - Six axis robot milling.gh (Grasshopper 0.9.76)
# plug-ins: KUKA|prc - Parametric Robot Control for Grasshopper, Firefly.Core

crv = Curve(<curve referenced from the Rhino model>)  # disabled
# Hack. Fix proper reverse list
toggle = BooleanToggle(False)
pocket = Pocket(
    curves_for_raster_pocket=crv,
    cut_depth_pocket="30",
    pass_depth="10",
    tool_diameter="10",
    stepover_0_1="0.8",
    raster_along_y_0_1=toggle)

# ---- group: Center point of spindle collet
# RX 180
# RY 0.00
# RZ 0.00
bit_lenght_at_measure = Panel("55")
flange_thickness = Panel("19")
subtraction = Subtraction(A="-69.76", B=bit_lenght_at_measure)
subtraction_2 = Subtraction(A=subtraction, B=flange_thickness)
pt = ConstructPoint(XCoordinate="797.45", YCoordinate="-675.20", ZCoordinate=subtraction_2)

# ----
extra_cut_depth = Panel("0.3")
material_thickness = Panel("3")
toolpath_reduction_tolerance = Panel("0.1")
build_platfrom_thicknes_distance_from_fl = Panel("24.5")  # "Build platfrom thicknes (distance from flange center to bottom of object)"
maximum_flange_move_speed = Panel("20")
milling_bit_diamter = Panel("6")
safe_z_height = Panel("60")
minium_angle_to_flange_plane = Panel("50")
feed_rate = Panel("15")
plunge_rate = Panel("10")
jog_speed = Panel("200")
glue_application_speed = Panel("80")
glue_plunge_to_stack_speed = Panel("80")
glue_pot_swipe_length = Panel("160")
glue_to_pause_duration = Panel("60")
milling_bit_length = Panel("35")
# Developed by Jens Dyvik / Fellesverkstedet
# 
# License: Creative Commons Attribution ShareAlike (cc-by-sa)
breps_for_robofab = Brep()
meshes_for_robofab = Mesh()
robofab_preview_position = Slider(0.658824, range=0..1)
pipeline = GeometryPipeline(
    GroupByLayer=False,
    GroupByType=False,
    IncludeHidden=True,
    IncludeLocked=True,
    LayerFilter="Robofab",
    NameFilter="*",
    TypeFilter=1073741848)
pipeline_2 = GeometryPipeline(
    GroupByLayer=False,
    GroupByType=False,
    IncludeHidden=True,
    IncludeLocked=True,
    LayerFilter="Robofab",
    NameFilter="*",
    TypeFilter=32)
crv_2 = Curve(pocket)

# ---- group: Material pickup location
# RX 180
# RY 0.00
# RZ 0.00
panel = Panel("901.50")
pt_2 = ConstructPoint(XCoordinate=panel, YCoordinate="128.58", ZCoordinate="-67.00")

# ----
multiplication = Multiplication(A=milling_bit_diamter, B="0.5")

# ---- group: Robofab input geometry
meshes_for_robofab_2 = Mesh([pipeline_2, meshes_for_robofab])
breps_for_robofab_2 = Brep([pipeline, breps_for_robofab])

# ----
Z = UnitZ(Factor=milling_bit_length)
milling_bit_radius = Panel(multiplication)
build_platfrom_thicknes_distance_from_fl_2 = Panel(build_platfrom_thicknes_distance_from_fl)  # "Build platfrom thicknes (distance from flange center to bottom of object)"

# ---- group: Makita tooltip position - long VHF bit
# RX 179.99
# RY 0.00
# RZ 0.03
panel_2 = Panel("396.14")
pt_3 = ConstructPoint(XCoordinate="977.93", YCoordinate=panel_2, ZCoordinate="-188.34")

# ---- group: Torspindel tooltip position - long vhf
# RX 179.99
# RY 0.00
# RZ 0.03
panel_3 = Panel("976.71")
pt_4 = ConstructPoint(XCoordinate=panel_3, YCoordinate="-675.51", ZCoordinate="-1.21")

# ----
flange_thickness_2 = Panel("19")
material_thicknes_material_top_z_zero_po = Panel("63")  # "Material thicknes / material top, Z zero postion"
material_thicknes_material_top_z_zero_po_2 = Panel("49")  # "Material thicknes / material top, Z zero postion"
sunion = SolidUnion(Breps=breps_for_robofab_2)
move = Move(Geometry=pt, Motion=Z)  # -> Geometry, Transform
pt_5 = ConstructPoint(
    XCoordinate=Slider(950, range=0..1000),
    YCoordinate=Slider(-200, range=-500..1000),
    ZCoordinate=Slider(150, range=-500..1000))
neg = Negative(Value=build_platfrom_thicknes_distance_from_fl_2)
xy = XYPlane(Origin=Point(0, 0, 0))
robofab_preview_position_2 = Panel(robofab_preview_position)
neg_2 = Negative(Value=extra_cut_depth)
xy_2 = XYPlane(Origin=pt_2)
xy_3 = XYPlane(Origin=pt_5)
rotate = Rotate(Geometry=xy_3, Angle=degrees(Slider(90, range=0..100)), Plane=xy_3)  # -> Geometry, Transform
rotate_2 = Rotate(Geometry=xy_2, Angle=degrees(Slider(90, range=0..100)), Plane=xy_2)  # -> Geometry, Transform
Z_2 = UnitZ(Factor=neg)
Z_3 = UnitZ(Factor=neg_2)
cir = Circle(Plane=xy, Radius="60")

breps_for_robofab_3 = Brep(sunion)
meshes_for_robofab_3 = Mesh(meshes_for_robofab_2)
smooth = SettingsQuality()
mesh = MeshBrep(Brep=breps_for_robofab_3, Settings=smooth)
merge = Merge(Data1=flatten(mesh), Data2=flatten(meshes_for_robofab_3))
flatten = FlattenTree(Tree=merge, Path="{0}")
mjoin = MeshJoin(Meshes=flatten)
meshes_for_robofab_4 = Mesh(mjoin)

move_2 = Move(Geometry=move.Geometry, Motion=Z_3)  # -> Geometry, Transform
deplane = DeconstructPlane(Plane=xy_3)  # -> Origin, XAxis, YAxis, ZAxis
extr = Extrude(Base=cir, Direction=Z_2)
deplane_2 = DeconstructPlane(Plane=xy_2)  # -> Origin, XAxis, YAxis, ZAxis

flange_top_center = Point(pt_4)
material_thicknes_material_top_z_zero_po_3 = Panel(material_thicknes_material_top_z_zero_po)  # "Material thicknes / material top, Z zero postion"
Z_4 = UnitZ(Factor=material_thicknes_material_top_z_zero_po_3)
move_3 = Move(Geometry=flange_top_center, Motion=Z_4)  # -> Geometry, Transform
pl = ConstructPlane(Origin=move_3.Geometry, XAxis=Vector(1, 0, 0), YAxis=Vector(0, 1, 0))
deplane_3 = DeconstructPlane(Plane=pl)  # -> Origin, XAxis, YAxis, ZAxis
rev = Reverse(Vector=deplane_3.YAxis)
pl_2 = ConstructPlane(Origin=deplane_3.Origin, XAxis=deplane_3.XAxis, YAxis=rev)
# Notes tool orientation:
# regular XY plane orients flange uppwards,
# flipping plane Y axis orients plane downwards.
# 
# Old notes:
# Crossing origo line along  axis makes tool turn 360 degree (fixed)?
# Regular YZ plane makes flange face forwards
# XY switch is good, but it seems intrinsic extrinsic is wrong. Check how to do consectutive rotations
# Rotating YZ plane around YZ plane works untill 89deg. 90deg and more flips orientation in conversion, causing flange to face robot and collide.
# Plane to Rx Ry Rz need fix
# Testing Switching X and Y rotation output
# It seems roatations need to be intrinsic, not extrensic
# Stuck. switch x and y back? use xy start plane for checking?
material_center_plane_torspindel = Plane(pl_2)

xy_4 = XYPlane(Origin=move_2.Geometry)
cap = CapHoles(Brep=extr)
crv_3 = Curve(<curve referenced from the Rhino model>)
rev_2 = Reverse(Vector=deplane_2.YAxis)
rev_3 = Reverse(Vector=deplane.YAxis)
jagged = SettingsSpeed()
custom_mesh_settings = SettingsCustom(
    StitchSeams=True,
    SimplePlanes=False,
    Refine=True,
    MinCount=16,
    MaxCount=400,
    AspectRatio=20,
    MaxDistance=0,
    MaxAngle=20,
    MinEdge=0,
    MaxEdge=Slider(2, range=0..10))
deplane_4 = DeconstructPlane(Plane=xy_4)  # -> Origin, XAxis, YAxis, ZAxis
number_slider = Slider(10, range=0..10)
mesh_2 = MeshBrep(
    Brep=cap,
    Settings={GridMaxCount=0, GridMinCount=16, JaggedSeams=False, MaxEdgeLength=0, MinEdgeLength=0.0001, MinTolerance=0, Refine=True, RefineAngle=0, RelativeTolerance=0.65, SimplePlanes=True, Tolerance=0})
pl_3 = ConstructPlane(Origin=deplane_2.Origin, XAxis=deplane_2.XAxis, YAxis=rev_2)
pl_4 = ConstructPlane(Origin=deplane.Origin, XAxis=deplane.XAxis, YAxis=rev_3)
topoly = CurveToPolyline(Curve=crv_3, ToleranceDistance=".1", ToleranceAngle=0)  # -> Polyline, Segments
rev_4 = Reverse(Vector=deplane_4.YAxis)
robot_build_platform_mesh = Mesh(mesh_2)
material_stack_location_plane = Plane(pl_3)
pl_5 = ConstructPlane(Origin=deplane_4.Origin, XAxis=deplane_4.XAxis, YAxis=rev_4)
glue_pot_location_plane = Plane(pl_4)
cp = ControlPoints(Curve=topoly.Polyline)  # -> Points, Weights, Knots
pt_6 = ConstructPoint(XCoordinate=0, YCoordinate=0, ZCoordinate=Slider(100, range=0..100))
material_thickness_2 = Panel(material_thickness)
milling_bit_target_plane = Plane(pl_5)
xy_5 = XYPlane(Origin=flatten(cp.Points))
xy_6 = XYPlane(Origin=pt_6)
glue_pot_location_plane_2 = Plane(glue_pot_location_plane)
material_stack_location_plane_2 = Plane(material_stack_location_plane)
multiplication_2 = Multiplication(A="160", B="0.5")
merge_2 = Merge(Data1=xy_6, Data2=xy_5, Data3=xy_6)
flatten_2 = FlattenTree(Tree=milling_bit_target_plane, Path="{0}")

glue_pot_swipe_length_2 = Panel(glue_pot_swipe_length)
multiplication_3 = Multiplication(A=glue_pot_swipe_length_2, B="0.5")
deplane_5 = DeconstructPlane(Plane=glue_pot_location_plane)  # -> Origin, XAxis, YAxis, ZAxis
safe_z_height_2 = Panel(safe_z_height)
safe_z_height_3 = Panel(safe_z_height)
amp = Amplitude(Vector=deplane_5.XAxis, Amplitude=multiplication_3)
rev_5 = Reverse(Vector=amp)
Z_5 = UnitZ(Factor=safe_z_height_2)
move_4 = Move(Geometry=glue_pot_location_plane, Motion=amp)  # -> Geometry, Transform
Z_6 = UnitZ(Factor=safe_z_height_3)
move_5 = Move(Geometry=glue_pot_location_plane, Motion=rev_5)  # -> Geometry, Transform
material_stack_location_plane_3 = Plane(material_stack_location_plane)
move_6 = Move(Geometry=move_4.Geometry, Motion=Z_5)  # -> Geometry, Transform
move_7 = Move(Geometry=material_stack_location_plane, Motion=Z_6)  # -> Geometry, Transform
move_8 = Move(Geometry=move_5.Geometry, Motion=Z_5)  # -> Geometry, Transform
merge_3 = Merge(Data1=move_7.Geometry, Data2=material_stack_location_plane_3, Data3=move_7.Geometry)
merge_4 = Merge(Data1=move_6.Geometry, Data2=move_4.Geometry, Data3=move_5.Geometry, Data4=move_8.Geometry)
rev_6 = Reverse(Vector=deplane_5.ZAxis)
gluepot_swipe_planes = Plane(merge_4)
material_stack_planes = Plane(merge_3)
glue_pot_normal = Vector(rev_6)
merge_5 = Merge(Data1=gluepot_swipe_planes, Data2=material_stack_planes)
glue_and_stack_planes = Plane(merge_5)

neg_3 = Negative(Value=multiplication_2)
dom = ConstructDomain(DomainStart=neg_3, DomainEnd=multiplication_2)
deplane_6 = DeconstructPlane(Plane=glue_pot_location_plane_2)  # -> Origin, XAxis, YAxis, ZAxis
rectangle = Rectangle(Plane=material_stack_location_plane_2, XSize=dom, YSize=dom, Radius=0)  # -> Rectangle, Length
xy_7 = XYPlane(Origin=Point(0, 0, 0))
xy_8 = XYPlane(Origin=Point(0, 0, 0))
Z_7 = UnitZ(Factor=material_thickness_2)
pl_6 = ConstructPlane(Origin=deplane_6.Origin, XAxis=deplane_6.XAxis, YAxis=deplane_6.ZAxis)
multiplication_4 = Multiplication(A="180", B="0.5")
rev_7 = Reverse(Vector=Z_7)
deplane_7 = DeconstructPlane(Plane=xy_7)  # -> Origin, XAxis, YAxis, ZAxis
deplane_8 = DeconstructPlane(Plane=merge_2)  # -> Origin, XAxis, YAxis, ZAxis
cyl = Cylinder(Base=pl_6, Radius="8", Length="180")
neg_4 = Negative(Value="0")
amp_2 = Amplitude(Vector=deplane_6.YAxis, Amplitude=multiplication_4)
extr_2 = Extrude(Base=rectangle.Rectangle, Direction=rev_7)
glue_to_pause_duration_2 = Panel(glue_to_pause_duration)
rev_8 = Reverse(Vector=deplane_7.YAxis)
rev_9 = Reverse(Vector=deplane_8.YAxis)
cap_2 = CapHoles(Brep=cyl)
xy_9 = XYPlane(Origin=Point(0, 0, 0))
cap_3 = CapHoles(Brep=extr_2)
material_center_plane_torspindel_2 = Plane(pl_2)
Z_8 = UnitZ(Factor=neg_4)
pl_7 = ConstructPlane(Origin=deplane_7.Origin, XAxis=deplane_7.XAxis, YAxis=rev_8)
pl_8 = ConstructPlane(Origin=deplane_8.Origin, XAxis=deplane_8.XAxis, YAxis=rev_9)
move_9 = Move(Geometry=cap_2, Motion=amp_2)  # -> Geometry, Transform

glue_plunge_to_stack_speed_2 = Panel(glue_plunge_to_stack_speed)
jog_speed_2 = Panel(jog_speed)
jog_speed_3 = Panel(jog_speed)
glue_application_speed_2 = Panel(glue_application_speed)
merge_6 = Merge(Data1=jog_speed_2, Data2=jog_speed_2, Data3=glue_application_speed_2, Data4=jog_speed_2)
merge_7 = Merge(Data1=jog_speed_3, Data2=glue_plunge_to_stack_speed_2, Data3=jog_speed_3)
glue_move_speeds = Panel(merge_6)
stack_plunge_move_speeds = Panel(merge_7)
merge_8 = Merge(Data1=glue_move_speeds, Data2=stack_plunge_move_speeds)
glue_and_stack_move_speeds = Panel(merge_8)

move_10 = Move(Geometry=xy_9, Motion=Z_8)  # -> Geometry, Transform
move_speed_mm_s = Slider(40, range=5..100)
create_start_and_end_position = BooleanToggle(False)
preview = CustomPreview(Geometry=cap_3, Shader=ColourSwatch(SwatchColor=RGB(93, 106, 107)))
preview_2 = CustomPreview(Geometry=move_9.Geometry, Shader=ColourSwatch(SwatchColor=RGB(224, 224, 224)))
xy_10 = XYPlane(Origin=move_10.Geometry)
orient = Orient(Geometry=pl_8, Source=pl_7, Target=material_center_plane_torspindel_2)  # -> Geometry, Transform
current_preview_plane = Plane()  # disabled
use_position_level = BooleanToggle(True)
merge_9 = Merge(Data1=jog_speed_3, Data2="gluetime", Data3=jog_speed_3)
pln = Plane(xy_10)
toolpath_planes = Plane(flatten(current_preview_plane))
stack_plunge_move_speeds_2 = Panel(merge_9)
use_position_level_2 = Panel(use_position_level)
maximum_number_of_positions_per_job = Panel("999")
position_level_0_4_precision_0_is_most_p = Panel("1")  # "Position level 0-4 (precision, 0 is most precise)"
pause_duration = Panel(glue_to_pause_duration_2)
create_start_and_end_position_2 = Panel(create_start_and_end_position)
use_output_bollean = Panel(Toggle(False))
deplane_9 = DeconstructPlane(Plane=pln)  # -> Origin, XAxis, YAxis, ZAxis
X = UnitX(Factor="150")
Z_9 = UnitZ(Factor="450")
Z_10 = UnitZ(Factor="530")
Z_11 = UnitZ(Factor="115")
X_2 = UnitX(Factor="735")
X_3 = UnitX(Factor="95")
tool_center_point_z = Panel("47.64")
tool_center_point_x = Panel("90.33")
tool_center_point_y = Panel("3.21")
deplane_10 = DeconstructPlane(Plane=toolpath_planes)  # -> Origin, XAxis, YAxis, ZAxis
move_11 = Move(Geometry=deplane_9.Origin, Motion=Z_10)  # -> Geometry, Transform
move_12 = Move(Geometry=move_11.Geometry, Motion=X)  # -> Geometry, Transform
move_13 = Move(Geometry=move_12.Geometry, Motion=Z_9)  # -> Geometry, Transform
move_14 = Move(Geometry=move_13.Geometry, Motion=Z_11)  # -> Geometry, Transform
move_15 = Move(Geometry=move_14.Geometry, Motion=X_2)  # -> Geometry, Transform
move_16 = Move(Geometry=move_15.Geometry, Motion=X_3)  # -> Geometry, Transform
merge_10 = Merge(Data1=glue_move_speeds, Data2=stack_plunge_move_speeds_2)
rad = Radians(Degrees=Slider(270, range=0..370))
b_point = Point(move_15.Geometry)
s_point = Point(deplane_9.Origin)
t_point = Point(move_16.Geometry)
r_point = Point(move_14.Geometry)
l_point = Point(move_12.Geometry)
u_point = Point(move_13.Geometry)
meshes_for_robofab_5 = Mesh(meshes_for_robofab_4)

# ---- group: IK solution picker
slider = Slider(2, range=0..7)
panel_4 = Panel("2")

# ----
amp_3 = Amplitude(Vector=deplane_10.ZAxis, Amplitude=tool_center_point_z)
amp_4 = Amplitude(Vector=deplane_10.YAxis, Amplitude=tool_center_point_y)
glue_and_stack_list_for_glue_pause = Panel(merge_10)
amp_5 = Amplitude(Vector=deplane_10.XAxis, Amplitude=tool_center_point_x)
rot3d = Rotate3D(Geometry=toolpath_planes, Angle=rad, Center=deplane_10.Origin, Axis=deplane_10.YAxis)  # -> Geometry, Transform
pt_7 = Point(l_point)
pt_8 = Point(u_point)
pt_9 = Point(t_point)
pt_10 = Point(b_point)
Z_12 = UnitZ(Factor="530")
neg_5 = Negative(Value=amp_3)
neg_6 = Negative(Value=amp_4)
neg_7 = Negative(Value="530")
neg_8 = Negative(Value=amp_5)
yz = YZPlane(Origin=pt_9)
Z_13 = UnitZ(Factor=neg_7)
move_17 = Move(Geometry=rot3d.Geometry, Motion=neg_8)  # -> Geometry, Transform
move_18 = Move(Geometry=move_17.Geometry, Motion=neg_6)  # -> Geometry, Transform
move_19 = Move(Geometry=move_18.Geometry, Motion=neg_5)  # -> Geometry, Transform
pt_11 = ConstructPoint(XCoordinate=0, YCoordinate=0, ZCoordinate=0)
kuka_preiw_orientation_matched_planes = Plane(flatten(rot3d.Geometry))
xy_11 = XYPlane(Origin=pt_11)
mesh_3 = Mesh(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)
mesh_4 = Mesh(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)
mesh_5 = Mesh(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)
mesh_6 = Mesh(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)
mesh_7 = Mesh(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)
mesh_8 = Mesh(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)
mesh_9 = Mesh(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)
cir_2 = Circle(Plane=xy_11, Radius=Slider(9, range=0..100))
Z_14 = UnitZ(Factor=Slider(173, range=0..1000))
move_20 = Move(Geometry=mesh_5, Motion=Z_8)  # -> Geometry, Transform
move_21 = Move(Geometry=mesh_3, Motion=Z_8)  # -> Geometry, Transform
move_22 = Move(Geometry=mesh_9, Motion=Z_8)  # -> Geometry, Transform
move_23 = Move(Geometry=mesh_7, Motion=Z_8)  # -> Geometry, Transform
move_24 = Move(Geometry=mesh_4, Motion=Z_8)  # -> Geometry, Transform
move_25 = Move(Geometry=mesh_8, Motion=Z_8)  # -> Geometry, Transform
move_26 = Move(Geometry=mesh_6, Motion=Z_8)  # -> Geometry, Transform
extr_3 = Extrude(Base=cir_2, Direction=Z_14)
cap_4 = CapHoles(Brep=extr_3)
mesh_10 = Mesh(move_23.Geometry)
mesh_11 = Mesh(move_22.Geometry)
mesh_12 = Mesh(move_26.Geometry)
mesh_13 = Mesh(move_24.Geometry)
mesh_14 = Mesh(move_21.Geometry)
mesh_15 = Mesh(move_20.Geometry)
mesh_16 = Mesh(move_25.Geometry)
mesh_17 = MeshBrep(
    Brep=cap_4,
    Settings={GridMaxCount=0, GridMinCount=16, JaggedSeams=False, MaxEdgeLength=0, MinEdgeLength=0.0001, MinTolerance=0, Refine=True, RefineAngle=0, RelativeTolerance=0.65, SimplePlanes=True, Tolerance=0})
xy_12 = XYPlane(Origin=Point(0, 0, 0))
mesh_18 = Mesh(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)
mesh_19 = Mesh(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)
mesh_20 = Mesh(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)
mesh_21 = Mesh(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)
mesh_22 = Mesh(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)
mesh_23 = Mesh(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)
mesh_24 = Mesh(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)
direction_arrow_length = Slider(5, range=0..100)
direction_arrow_radius = Slider(1, range=0..10)
mesh_25 = Mesh([<mesh referenced from the Rhino model> x11])
kr150_2 = KUKAKR1502Series2000(kr150base=True, kr150l110=False)
lin_move = KUKAPrcLinearMovement(Planes=kuka_preiw_orientation_matched_planes, interpolation="C_DIS", planeenabled=True)
custom_rob = CustomRobot(
    RobotBase=mesh_18,
    RobotJointBetweenA01AndA02=mesh_21,
    RobotJointBetweenA02AndA03=mesh_19,
    RobotJointBetweenA03AndA04=mesh_22,
    RobotJointBetweenA04AndA05=mesh_20,
    RobotJointBetweenA05AndA06=mesh_23,
    RobotFlangeEndeffector=mesh_24,
    a01length=530,
    a01offset=150,
    a02length=450,
    a03length=735,
    a03offset=115,
    a04length=95,
    valuesset=True)
tool_mesh = Mesh(mesh_17)
mjoin_2 = MeshJoin(Meshes=mesh_25)
cir_3 = Circle(Plane=xy_12, Radius=Slider(60, range=0..100))
Z_15 = UnitZ(Factor=Slider(19, range=0..100))
neg_9 = Negative(Value=Z_15)
extr_4 = Extrude(Base=cir_3, Direction=neg_9)
cap_5 = CapHoles(Brep=extr_4)
mesh_26 = MeshBrep(
    Brep=cap_5,
    Settings={GridMaxCount=0, GridMinCount=16, JaggedSeams=False, MaxEdgeLength=0, MinEdgeLength=0.0001, MinTolerance=0, Refine=True, RefineAngle=0, RelativeTolerance=0.65, SimplePlanes=True, Tolerance=0})
tool = KUKAPrcCustomTool(
    CustomToolGeometry=mesh_26,
    toolid=6,
    toolvala=0,
    toolvalb=0,
    toolvalc=0,
    toolvalx=0,
    toolvaly=0,
    toolvalz=0,
    valuesset=True)
kuka_prc_core = KUKAPrcCore(
    SimulationSlider=Slider(0.5, range=0..1),
    KUKAPrcCommand=flatten(lin_move),
    DefaultRobotTool=tool,
    VirtualRobot=custom_rob,
    a01end=5,
    a01max=70,
    a01min=-70,
    a01start=5,
    a02end=-90,
    a02max=360,
    a02min=-360,
    a02start=-90,
    a03end=100,
    a03max=360,
    a03min=-360,
    a03start=100,
    a04end=5,
    a04max=180,
    a04min=-180,
    a04start=5,
    a05end=10,
    a05max=180,
    a05min=-180,
    a05start=10,
    a06end=-5,
    a06max=360,
    a06min=-360,
    a06start=-5,
    abaseval=0,
    basenumber=6,
    bbaseval=0,
    cbaseval=0,
    checkendeffcoll=False,
    e01end=0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)  # -> RobotPositions, AnalysisOutput
material = CreateMaterial(
    Diffuse=ColourSwatch(SwatchColor=RGB(144, 158, 171)),
    Specular=RGB(255, 255, 255),
    Emission=ColourSwatch(SwatchColor=RGB(49, 60, 79)),
    Transparency=Slider(0.543, range=0..1),
    Shine=0)
mesh_27 = Mesh(kuka_prc_core.RobotPositions)
material_2 = CreateMaterial(
    Diffuse=ColourSwatch(SwatchColor=RGB(144, 158, 171)),
    Specular=RGB(255, 255, 255),
    Emission=ColourSwatch(SwatchColor=RGB(49, 60, 79)),
    Transparency=Slider(0.543, range=0..1),
    Shine=0)
preview_3 = CustomPreview(Geometry=mesh_27, Shader=material_2)

# ---- group: Test for method of finding axis flip
disjoint = DisjointMesh(Mesh=mesh_27)
item = ListItem(List=flatten(disjoint), Index=Slider(4, range=0..10), Wrap=True)
item_2 = ListItem(List=flatten(disjoint), Index=Slider(3, range=0..10), Wrap=True)
demesh = DeconstructMesh(Mesh=item_2)  # -> Vertices, Faces, Colours, Normals
volume = Volume(Geometry=item)  # -> Volume, Centroid
volume_2 = Volume(Geometry=item_2)  # -> Volume, Centroid
item_3 = ListItem(List=flatten(demesh.Vertices), Index=Slider(1, range=0..10), Wrap=True)
item_4 = ListItem(List=flatten(demesh.Vertices), Index=Slider(2, range=0..10), Wrap=True)
item_5 = ListItem(List=flatten(demesh.Vertices), Index=Slider(5, range=0..10), Wrap=True)
pl_3pt = Plane3Pt(PointA=item_3, PointB=item_5, PointC=item_4)
vec2pt = Vector2Pt(PointA=item_3, PointB=volume_2.Centroid, Unitize=False)  # -> Vector, Length
move_27 = Move(Geometry=pl_3pt, Motion=vec2pt.Vector)  # -> Geometry, Transform
center_ofb_axis = Point(volume.Centroid)
plane_in_center_of_r_axis = Plane(move_27.Geometry)
xy_13 = XYPlane(Origin=Point(0, 0, 0))
orient_2 = Orient(Geometry=center_ofb_axis, Source=plane_in_center_of_r_axis, Target=xy_13)  # -> Geometry, Transform
pdecon = Deconstruct(Point=orient_2.Geometry)  # -> XComponent, YComponent, ZComponent
panel_5 = Panel(pdecon.ZComponent)

# ----
xy_14 = XYPlane(Origin=Point(0, 0, 0))
pi = Pi(Factor=1)
pi_2 = Pi(Factor=1)
number_slider_2 = Slider(100, range=0..1000)
number_slider_3 = Slider(100, range=0..1000)
number_slider_4 = Slider(100, range=0..1000)
rz_overide = Panel("-90.00")
ry_overide = Panel("90.00")
rx_overide = Panel("-90.00")
maximum_number_positions_per_job = Panel(maximum_number_of_positions_per_job)
series = Series(Start=0, Step=1, Count=maximum_number_positions_per_job)
number_of_digits_in_series = Panel("4")
number_slider_5 = Slider(0, range=0..100)
number_slider_6 = Slider(1000, range=0..1000)
X_4 = UnitX(Factor=1)
int = Integer(use_position_level_2)
int_2 = Integer(position_level_0_4_precision_0_is_most_p)
panel_6 = Panel("TIMER T=12.50")
pause_duration_2 = Panel(pause_duration)
use_position_level_3 = Panel(int)
position_level = Panel(int_2)
join = TextJoin(Text=["TIMER T=", pause_duration_2])
panel_7 = Panel(join)
command_for_analof_signal_from_tcp_speed = Panel("ARATIOF AO#(1)")  # "Command for analof signal from TCP speed - off"
command_for_analof_signal_from_tcp_speed_2 = Panel("ARATION AO#(1)")  # "Command for analof signal from TCP speed - on"
Z_16 = UnitZ(Factor=1)
Z_17 = UnitZ(Factor=1)
Z_18 = UnitZ(Factor=1)
minium_angle_to_flange_plane_2 = Panel(minium_angle_to_flange_plane)
Z_19 = UnitZ(Factor=1)
time = Time("now")
subtraction_3 = Subtraction(A="180", B=minium_angle_to_flange_plane_2)
# DOUT OT#(1) ON
# DOUT OT#(1) OFF
# PULSE OT#(XX)
# PULSE OT#(2) T=0.500
# WAIT IN#(5)=OFF
# Reference start code: /JOB
# //NAME MOTOTEST1
# //POS
# ///NPOS 17,0,0,0,0,0
# ///TOOL 1
# ///POSTYPE ROBOT
# ///RECTAN
# ///RCONF 0,0,0,0,0,0,0,0
analog_voltage_out_from_14_1_to_14_0 = Panel("AOUT AO#(2)12.7")
jbi_toolpath_code_guide_from_web = Panel("""http://www.robot-forum.com/robotforum/yaskawa-motoman-robot-forum/some-help-with-a-little-syntax-please/

I found the info on the Relative Job Manual, here is the whole info.

JOB DATA FORMAT

When a relative job is output via the YASNAC FC1 or FC2 or by data transmission, the output file contents are as follows.

FILE NAME .JBI
/JOB
//NAME <JOB NAME>
//POS
///NPOS <C>,<BC>,<EC>,<P>,<BP>,<EX>
///USER <N>
///TOOL <N>
///POSTYPE <T>
///RECTAN
///RCONF <l>,<m>,<n>,<o>,<p>,<q>
Cxxxx =X,Y,Z,Rx,Ry,Rz
BCxxxx=X0,Y0,Z0
ECxxxx=1,2
//INST
///DATE <YYYY>/<MM>/<DD> <HH>:<TT>
///COMM <COMMENT CHARACTER LINE>
///ATTR <ATTRIBUTE 1>,<ATTRIBUTE 2>,,<ATTRIBUTE 16>
///FRAME <C>
///GROUP1 <m1>,<m2>,<m3>
///GROUP2 <m1>,<m2>,<m3>
NOP
MOVJ Cxxx BCxxx ECxxx VJ=xxx.x
END



A pseudo instruction is distinguished by a single slash (/) at its beginning.
Each level of individual instructions are marked with a double slash (//), a triple slash (///), and a fourfold slash (////).
A pseudo instruction related to the job is made as follows.

JOB NAME
POS
INST
NPOS
USER
TOOL
POSTYPE
PULSE
RECTAN
RCONF
DATE
COMM
ATTR
FRAME
GROUP1
GROUP2
LVARS


JOB

Function : Shows that it is a job.
Format : /JOB


NAME

Function : Represents the job name.
Format : //NAME <Name>
<Name> : up to 8 characters


POS

Function : Represents the position data.
Format : //POS


NPOS

Function : Represents the number of position data items.
Format : ///NPOS <C>,<BC>,<EC>,<P>,<BP>,<EX>
<C> : Number of robot axis teaching positions
<BC>: Number of base axis teaching positions
<EC>: Number of external (station) axis teaching positions
<P> : Number of robot axis position variables
<BP>: Number of base axis position variables
<EX>: Number of external (station) axis position variables


USER

Function : Represents the currently selected user coordinate system No.
Format : ///USER <N>
<N>: User coordinate system No.(0 to 23)


TOOL

Function : Represents the currently selected tool No.
Format : ///TOOL <N>
<N>: Tool No.(0 to 23)


POSTYPE

Function : Represents the position data type.
Format : ///POSTYPE<T>
<T>: |PULSE||BASE||ROBOT||TOOL||USER||MTOOL|
<PULSE>: Pulse data
<BASE> : Cartesian data, base coordinate system
<ROBOT>: Cartesian data, robot coordinate system
<TOOL> : Cartesian data, tool coordinate system
<USER> : Cartesian data, user coordinate system
<MTOOL>: Cartesian data, master tool coordinate system


PULSE

Function : Represents that pulse data is defined during and after this pseudo instruction.
Format : ///PULSE
<Pulse data>:<C>|<BC>|<EC>|<P>|<BP>|<EX>
<C>:<Cxxxx>=<S>,<L>,<U>,<R>,<B>,<T>,<E1>,<E2>
<BC>:<BCxxxx>=<1>,<2>,<3>,<4>,<5>,<6>,<E1>,<E2>
<EC>:<ECxxxx>=<1>,<2>,<3>,<4>,<5>,<6>,<E1>,<E2>
<P>:<Pxxx>=<S>,<L>,<U>,<R>,<B>,<T>,<E1>,<E2>
<BP>:<BPxxx>=<1>,<2>,<3>,<4>,<5>,<6>,<E1>,<E2>
<EX>:<EXxxx>=<1>,<2>,<3>,<4>,<5>,<6>,<E1>,<E2>
<Cxxxx>: Robot axis teaching position
<BCxxxx>: Base axis teaching position
<ECxxxx>: External (station) axis teaching position
<Pxxx>: Robot axis position variables
<BPxxx>: Base axis position variables
<EXxxx>: External (station) axis position variables
<S>: S-axis pulse data
<L>: L-axis pulse data
<U>: U-axis pulse data
<R>: R-axis pulse data
<B>: B-axis pulse data
<T>: T-axis pulse data
<E1>: Not used
<E2>: Not used
xxxx := A number from 0 to 999


RECTAN

Function : Represents that Cartesian data is defined during and after this pseudo instruction.
Format : ///RECTAN
<Cartesian data>: <C>|<BC>|<P>|<BP>
<C> : <Cxxxx> = <X>,<Y>,<Z>,<Rx>,<Ry>,<Rz>
<BC>: <BCxxxx> = <1>,<2>,<3>,<4>,<5>,<6>
<P> : <Pxxx> = <X>,<Y>,<Z>,<Rx>,<Ry>,<Rz>
<BP>: <BPxxx> = <1>,<2>,<3>,<4>,<5>,<6>
<Cxxxx> : Robot axis teaching position
<BCxxxx>: Base axis teaching position
<Pxxx> : Robot axis position variables
<BPxxx> : Base axis position variables
<X> : X-axis Cartesian data
<Y> : Y-axis Cartesian data
<Z> : Z-axis Cartesian data
<Rx> : Rx-axis Cartesian data
<Ry> : Ry-axis Cartesian data
<Rz> : Rz-axis Cartesian data


RCONF

Function : Represents the manipulator type of the Cartesian data defined during and after this pseudo instruction.
Format : ///RCONF <l>,<m>,<n>,<o>,<p>,<q>
<l>: 0: Flip, 1: No-flip
<m>: 0: Upper arm, 1: Lower arm
<n>: 0: Front, 1: Rear
<o>: 0: R < 180, 1: R >= 180
<p>: 0: T < 180, 1: T >= 180
<q>: 0: S < 180, 1: S >= 180


INST

Function : Represents that it is an instruction.
Format : //INST


DATE

Function : Represents the date.
Format : ///DATE <YYYY>/<MM>/<DD> <HH>:<TT>
<YYYY>: Year
<MM>: Month
<DD>: Day
<HH>: Hour
<TT>: Minute


COMM

Function : Represents that it is a job comment.
Format : ///COMM <Comment character line>
<Comment character line> : Up to 32 characters


ATTR

Function : Represents the job attribute.
Format : ///ATTR <Attribute 1>,<Attribute 2>,,<Attribute16>
<Attribute>: JD|DD|SC|{RO|WO|RW}|RJ
<JD>: Job Destroy
<DD>: Directory Destroy
<SC>: Save Complete
{RO|WO|RW}
<RO>: Writing disabled “Edit-lock”(Read Only)
<WO>: Reading disabled(Write Only)
<RW>: Reading/Writing capable(Read/Write)
<RJ>: Relative job


FRAME

Function : Represents relative job teaching coordinate system.
Format : ///FRAME <C>
<C>: BASE|ROBOT|N|
<N>: User coordinate system No.(1 to 24)
<BASE>: Base coordinate system(Cartesian)
<ROBOT>: Robot coordinate system(Cartesian)
<USER>: User coordinate system(Cartesian)


GROUP1

Function : Represents 1st MOVE control group.
Format : ///GROUP1 <m1>,<m2>,<m3>
Add any of the following to<m1>,<m2>, and<m3>.
RE1(robot 1)
RE2(robot 2)
RE2(robot 3)
RE4(robot 4)
BS1(base 1)
BS2(base 2)
BS3(base 3)
BS4(base 4)
ST1(station 1)
ST2(station 2)
ST3(station 3)
ST4(station 4)
ST5(station 5)
ST6(station 6)
ST7(station 7)
ST8(station 8)
ST9(station 9)
ST10(station 10)
ST11(station 11)
ST12(station 12)


GROUP2

Function : Represents 2nd MOVE control group.
Format : ///GROUP2 <m1>,<m2>,<m3>
Add any of the following to<m1>,<m2>, and<m3>.
RE1(robot 1)
RE2(robot 2)
RE3(robot 3)
RE4(robot 4)
BS1(base 1)
BS2(base 2)
BS3(base 3)
BS4(base 4)
ST1(station 1)
ST2(station 2)
ST3(station 3)
ST4(station 4)
ST5(station 5)
ST6(station 6)
ST7(station 7)
ST8(station 8)
ST9(station 9)
ST10(station 10)
ST11(station 11)
ST12(station 12)


GROUP3

Function : Represents 3rd MOVE control group.
Format : ///GROUP3 <m1>,<m2>,<m3>
Add any of the following to<m1>,<m2>, and<m3>.
RE1(robot 1)
RE2(robot 2)
RE3(robot 3)
RE4(robot 4)
BS1(base 1)
BS2(base 2)
BS3(base 3)
BS4(base 4)
ST1(station 1)
ST2(station 2)
ST3(station 3)
ST4(station 4)
ST5(station 5)
ST6(station 6)
ST7(station 7)
ST8(station 8)
ST9(station 9)
ST10(station 10)
ST11(station 11)
ST12(station 12)


GROUP4

Function : Represents 4th MOVE control group.
Format : ///GROUP4 <m1>,<m2>,<m3>
Add any of the following to<m1>,<m2>, and<m3>.
RE1(robot 1)
RE2(robot 2)
RE3(robot 3)
RE4(robot 4)
BS1(base 1)
BS2(base 2)
BS3(base 3)
BS4(base 4)
ST1(station 1)
ST2(station 2)
ST3(station 3)
ST4(station 4)
ST5(station 5)
ST6(station 6)
ST7(station 7)
ST8(station 8)
ST9(station 9)
ST10(station 10)
ST11(station 11)
ST12(station 12)


LVARS

Function : Represents the number of local variables.
Format : ///LVARS <LB>,<LI>,<LD>,<LR>,<LS>,<LP>,<LBP>,<LEX>
<LB>: Number of byte type local variables
<LI>: Number of integer type local variables
<LD>: Number of double-precision type local variables
<LR>: Number of real number type local variables
<LS>: Number of character type local variables
<LP>: Number of robot axis position type local variables
<LBP>: Number of base axis position type local variables
<LEX>: Number of external (station) axis position type local variables""")
number_slider_7 = Slider(200, range=0..1000)
panel_8 = Panel("0")
panel_9 = Panel("""158
159
160
161
162
163""")
number_slider_8 = Slider(6, range=0..10)
Z_20 = UnitZ(Factor=Slider(3, range=0..100))
meshes_for_robofab_6 = Mesh(meshes_for_robofab_4)  # disabled
pshift = ShiftPaths(Offset=-1)
number_slider_9 = Slider(495, range=0..1000)
mcx = MeshCurve(Mesh=meshes_for_robofab_6, Curve=pshift)  # -> Points, Faces
clean = CleanTree(RemoveNulls=True, RemoveInvalid=True, RemoveEmpty=False)
jog_speed_4 = Panel(jog_speed)
plunge_rate_2 = Panel(plunge_rate)
dup = DuplicateData(Data="0", Number="2", Order=True)
jog_speed_5 = Panel(jog_speed_4)
robot_build_platform_mesh_2 = Mesh(robot_build_platform_mesh)
xy_15 = XYPlane(Origin=Point(0, 0, 0))
material_thickness_3 = Panel(material_thickness)
robofab_preview_position_3 = Panel(robofab_preview_position_2)
multiplication_5 = Multiplication(A=material_thickness_3, B="0.5")
neg_10 = Negative(Value=multiplication_5)
pt_12 = ConstructPoint(XCoordinate=0, YCoordinate=0, ZCoordinate=neg_10)
item_6 = ListItem(Index=Slider(0, range=0..10), Wrap=True)
material_thickness_4 = Panel(material_thickness)
build_plate_dimension_x_and_y = Panel("150")
multiplication_6 = Multiplication(A=material_thickness_4, B="0.5")
multiplication_7 = Multiplication(A=build_plate_dimension_x_and_y, B="0.5")
material_3 = CreateMaterial(
    Diffuse=ColourSwatch(SwatchColor=RGB(79, 79, 79)),
    Specular=RGB(255, 255, 255),
    Emission=RGB(0, 0, 0),
    Transparency=Slider(0, range=0..1),
    Shine=0)
material_4 = CreateMaterial(
    Diffuse=ColourSwatch(SwatchColor=RGB(110, 214, 219)),
    Specular=ColourSwatch(SwatchColor=RGB(169, 219, 222)),
    Emission=RGB(0, 0, 0),
    Transparency=0,
    Shine=Slider(7, range=0..100))
material_5 = CreateMaterial(
    Diffuse=ColourSwatch(SwatchColor=RGB(212, 212, 212)),
    Specular=RGB(255, 255, 255),
    Emission=RGB(0, 0, 0),
    Transparency=Slider(0.662, range=0..1),
    Shine=0)
material_6 = CreateMaterial(
    Diffuse=ColourSwatch(SwatchColor=RGB(212, 212, 212)),
    Specular=RGB(255, 255, 255),
    Emission=RGB(0, 0, 0),
    Transparency=Slider(0.662, range=0..1),
    Shine=0)

flange_top_center_2 = Point(pt_3)
material_thicknes_material_top_z_zero_po_4 = Panel(material_thicknes_material_top_z_zero_po_2)  # "Material thicknes / material top, Z zero postion"
Z_21 = UnitZ(Factor=material_thicknes_material_top_z_zero_po_4)
move_28 = Move(Geometry=flange_top_center_2, Motion=Z_21)  # -> Geometry, Transform
pl_9 = ConstructPlane(Origin=move_28.Geometry, XAxis=Vector(1, 0, 0), YAxis=Vector(0, 1, 0))
deplane_11 = DeconstructPlane(Plane=pl_9)  # -> Origin, XAxis, YAxis, ZAxis

rev_10 = Reverse(Vector=deplane_11.YAxis)

pl_10 = ConstructPlane(Origin=deplane_11.Origin, XAxis=deplane_11.XAxis, YAxis=rev_10)
material_center_plane_makita = Plane(pl_10)

material_center_plane_makita_2 = Plane(pl_10)
orient_3 = Orient(Geometry=pl_8, Source=pl_7, Target=material_center_plane_makita_2)  # -> Geometry, Transform
merge_11 = Merge(Data1=orient_3.Geometry, Data2=orient.Geometry)

bbox = BoundingBox(Content=meshes_for_robofab_4, Plane=PlaneXY(0, 0, 0), UnionBox=True)  # -> Box, Box_2
debrep = DeconstructBrep(Brep=bbox.Box)  # -> Faces, Edges, Vertices
material_thickness_5 = Panel(material_thickness)
item_7 = ListItem(List=debrep.Faces, Index="4", Wrap=True)
item_8 = ListItem(List=debrep.Edges, Index="9", Wrap=True)
len = Length(Curve=item_8)
area = Area(Geometry=item_7)  # -> Area, Centroid
xy_16 = XYPlane(Origin=area.Centroid)
division = Division(A=len, B=material_thickness_5)
round = Round(Number=division)  # -> Nearest, Floor, Ceiling
multiplication_8 = Multiplication(A=material_thickness_5, B="0.5")
series_2 = Series(Start=0, Step=material_thickness_5, Count=round.Ceiling)
series_3 = Series(Start=multiplication_8, Step=material_thickness_5, Count=round.Ceiling)
Z_22 = UnitZ(Factor=series_2)
Z_23 = UnitZ(Factor=series_3)

object_base_plane = Plane(xy_16)

object_base_plane_2 = Plane(xy_16)
move_29 = Move(Geometry=object_base_plane_2, Motion=Z_2)  # -> Geometry, Transform
flange_center_plane = Plane(move_29.Geometry)

move_30 = Move(Geometry=object_base_plane, Motion=Z_23)  # -> Geometry, Transform
move_31 = Move(Geometry=object_base_plane, Motion=Z_22)  # -> Geometry, Transform
material_bottom_planes = Plane(move_31.Geometry)
curvature_sample_section_planes = Plane(move_30.Geometry)

contour_planes = Plane(material_bottom_planes)
sec = MeshPlane(Mesh=meshes_for_robofab_5, Plane=contour_planes)
align_curve_direction = AlignCurveDirection(curves_for_aligned_direction=sec)  # disabled
aligned_curves = Curve(align_curve_direction)
material_slices = Curve(sec)  # disabled
contour_planes_2 = Plane(contour_planes)  # disabled
simplify = SimplifyTree(Tree=material_slices, Front=False)
boundary = BoundarySurfaces(Edges=simplify)
mesh_28 = MeshBrep(
    Brep=boundary,
    Settings={GridMaxCount=0, GridMinCount=16, JaggedSeams=False, MaxEdgeLength=0, MinEdgeLength=0.0001, MinTolerance=0, Refine=True, RefineAngle=0, RelativeTolerance=0.65, SimplePlanes=True, Tolerance=0})
bbox_2 = BoundingBox(Content=mesh_28, Plane=PlaneXY(0, 0, 0))  # -> Box, Box_2
debrep_2 = DeconstructBrep(Brep=bbox_2.Box)  # -> Faces, Edges, Vertices
item_9 = ListItem(List=debrep_2.Vertices, Index=0, Wrap=True)
simplify_2 = SimplifyTree(Tree=mesh_28, Front=False)
simplify_3 = SimplifyTree(Tree=item_9, Front=False)
deplane_12 = DeconstructPlane(Plane=contour_planes_2)  # -> Origin, XAxis, YAxis, ZAxis
pdecon_2 = Deconstruct(Point=deplane_12.Origin)  # -> XComponent, YComponent, ZComponent
pdecon_3 = Deconstruct(Point=simplify_3)  # -> XComponent, YComponent, ZComponent
panel_10 = Panel(pdecon_3.ZComponent)
object_base_plane_3 = Plane(object_base_plane)
orient_4 = Orient(Geometry=robot_build_platform_mesh_2, Source=xy_15, Target=object_base_plane_3)  # -> Geometry, Transform
object_base_plane_4 = Plane(object_base_plane)
deplane_13 = DeconstructPlane(Plane=object_base_plane_4)  # -> Origin, XAxis, YAxis, ZAxis
pdecon_4 = Deconstruct(Point=deplane_13.Origin)  # -> XComponent, YComponent, ZComponent
mesh_29 = Mesh(orient_4.Geometry)
preview_4 = CustomPreview(Geometry=mesh_29, Shader=material_3)

# ---- group: Offset toolpath with smoot corner transitions
curvature_sample_section_planes_2 = Plane(flatten(curvature_sample_section_planes))
meshes_for_robofab_7 = Mesh(meshes_for_robofab_4)
corner_sample_angle_threshold = Slider(15, range=0..100)
milling_bit_radius_2 = Panel(milling_bit_radius)
initial_sample_lenght = Panel("0.2")
samples_per_circle = Panel("36")
toolpath_reduction_tolerance_2 = Panel(toolpath_reduction_tolerance)
reduction_tolerance_for_calculation = Panel("0.02")
sec_2 = MeshPlane(Mesh=meshes_for_robofab_7, Plane=curvature_sample_section_planes_2)
align_curve_direction_2 = AlignCurveDirection(curves_for_aligned_direction=sec_2)
flip = FlipCurve(Curve=align_curve_direction_2)  # -> Curve, Flag
join_2 = JoinCurves(Curves=flip.Curve, Preserve=False)
clean_2 = CleanTree(RemoveNulls=True, RemoveInvalid=True, RemoveEmpty=True, Tree=join_2)
simplify_4 = SimplifyTree(Tree=clean_2, Front=False)
redpline = Reduce(Polyline=simplify_4, Tolerance=reduction_tolerance_for_calculation)  # -> Polyline, Reduction
cp_2 = ControlPoints(Curve=redpline.Polyline)  # -> Points, Weights, Knots
crv_4 = Curve(redpline.Polyline)
xy_17 = XYPlane(Origin=cp_2.Points)
cir_4 = Circle(Plane=xy_17, Radius=initial_sample_lenght)
ccx = CurveCurve(CurveA=cir_4, CurveB=graft(crv_4))  # -> Points, ParamsA, ParamsB
ccx_2 = CurveCurve(CurveA=crv_4, CurveB=cir_4)  # -> Points, ParamsA, ParamsB; disabled
pshift_2 = ShiftPaths(Data=ccx.Points, Offset=-1)
crv_5 = Curve(crv_4)
alongcrv = SortAlongCurve(Points=pshift_2, Curve=graft(crv_5))  # -> Points, Indices
pshift_3 = ShiftPaths(Data=alongcrv.Points, Offset=-1)
meshes_for_3d_milling = Mesh(meshes_for_robofab_7)
sample_points_for_offset = Point(pshift_3)
milling_bit_radius_3 = Panel(milling_bit_radius_2)
sample_points_for_offset_2 = Point(sample_points_for_offset)
reduction_tolerance = Panel(reduction_tolerance_for_calculation)
crv_6 = Curve(crv_4)
panel_11 = Panel(corner_sample_angle_threshold)
xy_18 = XYPlane(Origin=Point(0, 0, 0))
rad_2 = Radians(Degrees=panel_11)
samples_per_circle_2 = Panel(samples_per_circle)
cir_5 = Circle(Plane=xy_18, Radius=milling_bit_radius_3)
len_2 = Length(Curve=cir_5)
division_2 = Division(A=len_2, B=samples_per_circle_2)
meshes_for_robofab_8 = Mesh(meshes_for_robofab_7)
toolpath_reduction_tolerance_3 = Panel(toolpath_reduction_tolerance_2)
crv_7 = Curve(sec_2)

meshcp = MeshClosestPoint(Point=sample_points_for_offset_2, Mesh=meshes_for_3d_milling)  # -> Point, Index, Parameter
meval = MeshEval(Mesh=meshes_for_3d_milling, Parameter=meshcp.Parameter)  # -> Point, Normal, Colour
amp_6 = Amplitude(Vector=meval.Normal, Amplitude=milling_bit_radius_3)
move_32 = Move(Geometry=meshcp.Point, Motion=amp_6)  # -> Geometry, Transform

# ----
flatten_3 = FlattenTree(Tree=sec_2, Path="{0}")
end = EndPoints(Curve=flatten_3)  # -> Start, End

direction_arrow_length_2 = Panel(direction_arrow_length)
direction_arrow_radius_2 = Panel(direction_arrow_radius)
yz_2 = YZPlane(Origin=Point(0, 0, 0))
cone = Cone(Base=yz_2, Radius=direction_arrow_radius_2, Length=direction_arrow_length_2)  # -> Cone, Tip
neg_11 = Negative(Value=direction_arrow_length_2)
X_5 = UnitX(Factor=neg_11)
number_slider_10 = Slider(0.001, range=0..1)
move_33 = Move(Geometry=cone.Cone, Motion=X_5)  # -> Geometry, Transform
cap_6 = CapHoles(Brep=move_33.Geometry)
Z_24 = UnitZ(Factor=1)
custom_mesh_settings_2 = SettingsCustom(
    StitchSeams=True,
    SimplePlanes=False,
    Refine=True,
    MinCount=16,
    MaxCount=400,
    AspectRatio=20,
    MaxDistance=0,
    MaxAngle=20,
    MinEdge=Slider(0.744, range=0..1),
    MaxEdge=0)
mesh_30 = MeshBrep(Brep=cap_6, Settings=custom_mesh_settings_2)
xz = XZPlane(Origin=Point(0, 0, 0))
swatch = ColourSwatch(SwatchColor=RGB(255, 0, 179))
material_7 = CreateMaterial(Diffuse=swatch, Specular=RGB(255, 255, 255), Emission=swatch, Transparency=Slider(0.43, range=0..1), Shine=0)
material_8 = CreateMaterial(
    Diffuse=ColourSwatch(SwatchColor=RGB(0, 234, 255)),
    Specular=RGB(255, 255, 255),
    Emission=RGB(0, 0, 0),
    Transparency=Slider(0.359, range=0..1),
    Shine=0)

# ---- group: Offset toolpath with smoot corner transitions (continued)
pt_13 = Point(move_32.Geometry)

meshcp_2 = MeshClosestPoint(Point=pt_13, Mesh=meshes_for_3d_milling)  # -> Point, Index, Parameter
vec2pt_2 = Vector2Pt(PointA=meshcp_2.Point, PointB=pt_13, Unitize=False)  # -> Vector, Length
amp_7 = Amplitude(Vector=vec2pt_2.Vector, Amplitude=milling_bit_radius_3)
move_34 = Move(Geometry=meshcp_2.Point, Motion=amp_7)  # -> Geometry, Transform

# ----
graft = GraftTree(Tree="0", IncludeEmptyLists=True, IncludeNullItems=True)

graft_2 = GraftTree(Tree="0", IncludeEmptyLists=True, IncludeNullItems=True)

# ---- group: Create duble deciaml on every number
graft_3 = GraftTree(Tree="0", IncludeEmptyLists=True, IncludeNullItems=True)

# ---- group: Offset toolpath with smoot corner transitions (continued)
cullpt = CullDuplicates(Points=move_34.Geometry, Tolerance=reduction_tolerance, CullMode=3)  # -> Points, Indices, Valence
alongcrv_2 = SortAlongCurve(Points=cullpt.Points, Curve=graft(crv_6))  # -> Points, Indices
pline = PolyLine(Vertices=alongcrv_2.Points, Closed=True)
redpline_2 = Reduce(Polyline=pline, Tolerance=reduction_tolerance)  # -> Polyline, Reduction
simplify_5 = SimplifyTree(Tree=redpline_2.Polyline, Front=False)
crv_8 = Curve(simplify_5)
cp_3 = ControlPoints(Curve=crv_8)  # -> Points, Weights, Knots
simplify_6 = SimplifyTree(Tree=cp_3.Points, Front=False)
cullpt_2 = CullDuplicates(Points=simplify_6, Tolerance=reduction_tolerance, CullMode=3)  # -> Points, Indices, Valence
pt_14 = Point(cullpt_2.Points)
crv_cp = CurveClosestPoint(Point=pt_14, Curve=crv_8)  # -> Point, Parameter, Distance
eval = EvaluateCurve(Curve=crv_8, Parameter=crv_cp.Parameter)  # -> Point, Tangent, Angle
pt_15 = Point(cullpt_2.Points)
larger = LargerThan(FirstNumber=eval.Angle, SecondNumber=rad_2)  # -> LargerThan, OrEqualTo
p_n_c = PickNChoose(Pattern=larger.LargerThan, Stream1=pt_14)
pt_16 = Point(p_n_c)
cps = ClosestPoints(Point=pt_16, Cloud=pt_16, Count="2")  # -> ClosestPoint, CPIndex, Distance
item_10 = ListItem(List=cps.Distance, Index="1", Wrap=True)
pshift_4 = ShiftPaths(Data=item_10, Offset=-1)
multiplication_9 = Multiplication(A=pshift_4, B="0.49")
division_3 = Division(A=multiplication_9, B=division_2)
round_2 = Round(Number=division_3)  # -> Nearest, Floor, Ceiling
pt_17 = Point(p_n_c)
pt_18 = Point(cullpt_2.Points)
division_4 = Division(A=multiplication_9, B=round_2.Ceiling)
xy_19 = XYPlane(Origin=pt_17)
series_4 = Series(Start=division_4, Step=division_4, Count=round_2.Ceiling)
graft_4 = GraftTree(Tree=xy_19, IncludeEmptyLists=True, IncludeNullItems=True)
sph = Sphere(Base=graft_4, Radius=series_4)
pshift_5 = ShiftPaths(Data=sph, Offset=-1)
bcx = BrepCurve(Brep=pshift_5, Curve=crv_8)  # -> Curves, Points
pshift_6 = ShiftPaths(Data=bcx.Points, Offset=-1)
merge_12 = Merge(Data1=cullpt_2.Points, Data2=pshift_6)
alongcrv_3 = SortAlongCurve(Points=merge_12, Curve=graft(crv_8))  # -> Points, Indices
pline_2 = PolyLine(Vertices=alongcrv_3.Points, Closed=True)
smoothpline = SmoothPolyline(Polyline=pline_2, Strength="1", Times="2")
cp_4 = ControlPoints(Curve=smoothpline)  # -> Points, Weights, Knots
pshift_7 = ShiftPaths(Data=cp_4.Points, Offset=-1)

# ----
panel_12 = Panel(round_2.Ceiling)

# ---- group: Offset toolpath with smoot corner transitions
meshcp_3 = MeshClosestPoint(Point=pshift_7, Mesh=meshes_for_3d_milling)  # -> Point, Index, Parameter
vec2pt_3 = Vector2Pt(PointA=meshcp_3.Point, PointB=pshift_7, Unitize=False)  # -> Vector, Length
amp_8 = Amplitude(Vector=vec2pt_3.Vector, Amplitude=milling_bit_radius_3)
move_35 = Move(Geometry=meshcp_3.Point, Motion=amp_8)  # -> Geometry, Transform

minc = MeshInclusion(Mesh=meshes_for_robofab_8, Point=move_35.Geometry, Strict=True)
dispatch = Dispatch(List=move_35.Geometry, DispatchPattern=minc)  # -> ListA, ListB
pline_3 = PolyLine(Vertices=dispatch.ListB, Closed=True)
simplify_7 = SimplifyTree(Tree=pline_3, Front=False)
redpline_3 = Reduce(Polyline=simplify_7, Tolerance=toolpath_reduction_tolerance_3)  # -> Polyline, Reduction
unflatten = UnflattenTree(Tree=redpline_3.Polyline, Guide=crv_7)
offset_toolpaths = Curve(unflatten)

# ----
offset_toolpaths_2 = Curve(offset_toolpaths)
meshes_for_robofab_9 = Mesh(meshes_for_robofab_4)
milling_bit_radius_4 = Panel(milling_bit_radius)
cp_5 = ControlPoints(Curve=offset_toolpaths_2)  # -> Points, Weights, Knots
meshes_for_robofab_10 = Mesh(meshes_for_robofab_9)
meshcp_4 = MeshClosestPoint(Point=cp_5.Points, Mesh=meshes_for_robofab_10)  # -> Point, Index, Parameter
pt_19 = Point(cp_5.Points)
meshcp_5 = MeshClosestPoint(Point=pt_19, Mesh=meshes_for_robofab_10)  # -> Point, Index, Parameter
milling_bit_radius_5 = Panel(milling_bit_radius_4)
dist = Distance(PointA=pt_19, PointB=meshcp_5.Point)
vec2pt_4 = Vector2Pt(PointA=meshcp_5.Point, PointB=pt_19, Unitize=False)  # -> Vector, Length
subtraction_4 = Subtraction(A=milling_bit_radius_5, B=dist)
amp_9 = Amplitude(Vector=vec2pt_4.Vector, Amplitude=subtraction_4)
vec2pt_5 = Vector2Pt(PointA=meshcp_4.Point, PointB=cp_5.Points, Unitize=False)  # -> Vector, Length
move_36 = Move(Geometry=pt_19, Motion=amp_9)  # -> Geometry, Transform
pl_11 = PlaneNormal(Origin=move_36.Geometry, ZAxis=vec2pt_5.Vector)

align = AlignPlane(Plane=pl_11, Direction=Z_16)  # -> Plane, Angle
simplify_8 = SimplifyTree(Tree=align.Plane, Front=False)
pln_2 = Plane(simplify_8)
deplane_14 = DeconstructPlane(Plane=pln_2)  # -> Origin, XAxis, YAxis, ZAxis
angle = Angle(VectorA=deplane_14.ZAxis, VectorB=Z_17)  # -> Angle, Reflex
deg = Degrees(Radians=angle.Angle)
smaller = SmallerThan(FirstNumber=deg, SecondNumber="0.01")  # -> SmallerThan, OrEqualTo
dispatch_2 = Dispatch(List=pln_2, DispatchPattern=smaller.SmallerThan)  # -> ListA, ListB
pln_3 = Plane(dispatch_2.ListA)
pln_4 = Plane(dispatch_2.ListB)
deplane_15 = DeconstructPlane(Plane=pln_4)  # -> Origin, XAxis, YAxis, ZAxis
angle_2 = Angle(VectorA=deplane_15.ZAxis, VectorB=Z_18)  # -> Angle, Reflex
deg_2 = Degrees(Radians=angle_2.Angle)
larger_2 = LargerThan(FirstNumber=deg_2, SecondNumber="179.99")  # -> LargerThan, OrEqualTo
dispatch_3 = Dispatch(List=pln_4, DispatchPattern=larger_2.LargerThan)  # -> ListA, ListB
pln_5 = Plane(dispatch_3.ListA)
pln_6 = Plane(dispatch_3.ListB)
simplify_9 = SimplifyTree(Tree=pln_6, Front=False)
deplane_16 = DeconstructPlane(Plane=simplify_9)  # -> Origin, XAxis, YAxis, ZAxis
angle_3 = Angle(VectorA=deplane_16.ZAxis, VectorB=Z_19)  # -> Angle, Reflex
deg_3 = Degrees(Radians=angle_3.Angle)
smaller_2 = SmallerThan(FirstNumber=deg_3, SecondNumber=minium_angle_to_flange_plane_2)  # -> SmallerThan, OrEqualTo
smaller_3 = SmallerThan(FirstNumber=deg_3, SecondNumber=subtraction_3)  # -> SmallerThan, OrEqualTo
dispatch_4 = Dispatch(List=deg_3, DispatchPattern=smaller_2.SmallerThan)  # -> ListA, ListB
subtraction_5 = Subtraction(A=minium_angle_to_flange_plane_2, B=dispatch_4.ListA)
lng = ListLength(List=dispatch_4.ListB)
panel_13 = Panel(subtraction_5)
dup_2 = DuplicateData(Data="0", Number=lng, Order=True)
subtraction_6 = Subtraction(A=deg_3, B=subtraction_5)
neg_12 = Negative(Value=panel_13)
weave = Weave(Pattern=smaller_2.SmallerThan, Stream0=dup_2, Stream1=neg_12, NullGaps=False)
panel_14 = Panel(subtraction_6)
rad_3 = Radians(Degrees=weave)
rot3d_2 = Rotate3D(Geometry=simplify_9, Angle=rad_3, Center=deplane_16.Origin, Axis=deplane_16.YAxis)  # -> Geometry, Transform
dispatch_5 = Dispatch(List=deg_3, DispatchPattern=smaller_3.SmallerThan)  # -> ListA, ListB
subtraction_7 = Subtraction(A=dispatch_5.ListB, B=subtraction_3)
lng_2 = ListLength(List=dispatch_5.ListA)
dup_3 = DuplicateData(Data="0", Number=lng_2, Order=True)
panel_15 = Panel(subtraction_7)
weave_2 = Weave(Pattern=smaller_3.SmallerThan, Stream0=subtraction_7, Stream1=dup_3, NullGaps=False)
rad_4 = Radians(Degrees=weave_2)
rot3d_3 = Rotate3D(Geometry=rot3d_2.Geometry, Angle=rad_4, Center=deplane_16.Origin, Axis=deplane_16.YAxis)  # -> Geometry, Transform
pln_7 = Plane(rot3d_3.Geometry)
clean_3 = CleanTree(RemoveNulls=True, RemoveInvalid=True, RemoveEmpty=Toggle(True), Tree=pln_7)
simplify_10 = SimplifyTree(Tree=clean_3, Front=False)
offset_toolpaths_3 = Curve(offset_toolpaths)
lng_3 = ListLength(List=offset_toolpaths_3)
flatten_4 = FlattenTree(Tree=lng_3, Path="{0}")
panel_16 = Panel(flatten_4)
sort = SortList(Keys=flatten_4)  # -> Keys, ValuesA
rev_11 = ReverseList(List=sort.Keys)
item_11 = ListItem(List=rev_11, Index=0, Wrap=True)
larger_3 = LargerThan(FirstNumber=item_11, SecondNumber="1")  # -> LargerThan, OrEqualTo
p_n_c_2 = PickNChoose(Pattern=larger_3.LargerThan, Stream0="0", Stream1="-1")
panel_17 = Panel(p_n_c_2)

# ---- group: Prepare and filter position level commands
join_3 = TextJoin(Text=["PL=", position_level])
panel_18 = Panel(join_3)

# ---- group: Add output signals at start and end
panel_19 = Panel("DOUT OT#(2) OFF")
panel_20 = Panel("DOUT OT#(2) ON")
panel_21 = Panel("1")
use_putput_bollean = Panel(use_output_bollean)

# ----
panel_22 = Panel("split")

panel_23 = Panel("split")

# ---- group: Generate Bark Beetle inform code 9
panel_24 = Panel("""///TOOL 0
///POSTYPE ROBOT
///RECTAN
///RCONF 0,0,0,0,0""")
panel_25 = Panel("""/JOB
//NAME BARKBE09
//POS""")
panel_26 = Panel("""//INST
///DATE 2015/05/22 15:03
///ATTR SC,RW,RJ
////FRAME ROBOT
///GROUP1 RB1
NOP""")

# ---- group: Generate Bark Beetle inform code 10
panel_27 = Panel("""///TOOL 0
///POSTYPE ROBOT
///RECTAN
///RCONF 0,0,0,0,0""")
panel_28 = Panel("""/JOB
//NAME BARKBE10
//POS""")
panel_29 = Panel("""//INST
///DATE 2015/05/22 15:03
///ATTR SC,RW,RJ
////FRAME ROBOT
///GROUP1 RB1
NOP""")

# ---- group: Generate Bark Beetle inform code 8
panel_30 = Panel("""///TOOL 0
///POSTYPE ROBOT
///RECTAN
///RCONF 0,0,0,0,0""")
panel_31 = Panel("""/JOB
//NAME BARKBE08
//POS""")
panel_32 = Panel("""//INST
///DATE 2015/05/22 15:03
///ATTR SC,RW,RJ
////FRAME ROBOT
///GROUP1 RB1
NOP""")

# ---- group: Generate Bark Beetle inform code 2
panel_33 = Panel("""///TOOL 0
///POSTYPE ROBOT
///RECTAN
///RCONF 0,0,0,0,0""")
panel_34 = Panel("""/JOB
//NAME BARKBE02
//POS""")
panel_35 = Panel("""//INST
///DATE 2015/05/22 15:03
///ATTR SC,RW,RJ
////FRAME ROBOT
///GROUP1 RB1
NOP""")

# ---- group: Generate Bark Beetle inform code 3
panel_36 = Panel("""///TOOL 0
///POSTYPE ROBOT
///RECTAN
///RCONF 0,0,0,0,0""")
panel_37 = Panel("""/JOB
//NAME BARKBE03
//POS""")
panel_38 = Panel("""//INST
///DATE 2015/05/22 15:03
///ATTR SC,RW,RJ
////FRAME ROBOT
///GROUP1 RB1
NOP""")

# ---- group: Generate Bark Beetle inform code 6
panel_39 = Panel("""///TOOL 0
///POSTYPE ROBOT
///RECTAN
///RCONF 0,0,0,0,0""")
panel_40 = Panel("""/JOB
//NAME BARKBE06
//POS""")
panel_41 = Panel("""//INST
///DATE 2015/05/22 15:03
///ATTR SC,RW,RJ
////FRAME ROBOT
///GROUP1 RB1
NOP""")

# ---- group: Generate Bark Beetle inform code 7
panel_42 = Panel("""///TOOL 0
///POSTYPE ROBOT
///RECTAN
///RCONF 0,0,0,0,0""")
panel_43 = Panel("""/JOB
//NAME BARKBE07
//POS""")
panel_44 = Panel("""//INST
///DATE 2015/05/22 15:03
///ATTR SC,RW,RJ
////FRAME ROBOT
///GROUP1 RB1
NOP""")

# ---- group: Generate Bark Beetle inform code 1
panel_45 = Panel("""///TOOL 0
///POSTYPE ROBOT
///RECTAN
///RCONF 0,0,0,0,0""")
panel_46 = Panel("""/JOB
//NAME BARKBE01
//POS""")
panel_47 = Panel("""//INST
///DATE 2015/05/22 15:03
///ATTR SC,RW,RJ
////FRAME ROBOT
///GROUP1 RB1
NOP""")

# ---- group: Generate Bark Beetle inform code 4
panel_48 = Panel("""///TOOL 0
///POSTYPE ROBOT
///RECTAN
///RCONF 0,0,0,0,0""")
panel_49 = Panel("""/JOB
//NAME BARKBE04
//POS""")
panel_50 = Panel("""//INST
///DATE 2015/05/22 15:03
///ATTR SC,RW,RJ
////FRAME ROBOT
///GROUP1 RB1
NOP""")

# ---- group: Generate Bark Beetle inform code 5
panel_51 = Panel("""///TOOL 0
///POSTYPE ROBOT
///RECTAN
///RCONF 0,0,0,0,0""")
panel_52 = Panel("""/JOB
//NAME BARKBE05
//POS""")
panel_53 = Panel("""//INST
///DATE 2015/05/22 15:03
///ATTR SC,RW,RJ
////FRAME ROBOT
///GROUP1 RB1
NOP""")

# ----
deplane_17 = DeconstructPlane(Plane=simplify_10)  # -> Origin, XAxis, YAxis, ZAxis
milling_bit_radius_6 = Panel(milling_bit_radius_4)
pl_12 = ConstructPlane(Origin=deplane_17.Origin, XAxis=deplane_17.YAxis, YAxis=deplane_17.ZAxis)
X_6 = UnitX(Factor=1)
align_2 = AlignPlane(Plane=pl_12, Direction=X_6)  # -> Plane, Angle
neg_13 = Negative(Value=milling_bit_radius_6)
neg_14 = Negative(Value=number_slider_7)
material_bottom_planes_2 = Plane(material_bottom_planes)
amp_10 = Amplitude(Vector=deplane_17.ZAxis, Amplitude=neg_13)
dom_2 = ConstructDomain(DomainStart=neg_14, DomainEnd=number_slider_7)
move_37 = Move(Geometry=deplane_17.Origin, Motion=amp_10)  # -> Geometry, Transform
rectangle_2 = Rectangle(Plane=material_bottom_planes_2, XSize=dom_2, YSize=dom_2, Radius=0)  # -> Rectangle, Length
mesh_31 = Mesh(rectangle_2.Rectangle)
rev_12 = Reverse(Vector=deplane_17.XAxis)
graft_5 = GraftTree(Tree=mesh_31, IncludeEmptyLists=True, IncludeNullItems=True)
pt_20 = Point(move_37.Geometry)
simplify_11 = SimplifyTree(Tree=graft_5, Front=False)
intersection_meshes = Mesh(simplify_11)

panel_54 = Panel(graft_5)
pshift_8 = ShiftPaths(Data=rev_12, Offset=panel_17)
pshift_9 = ShiftPaths(Data=pt_20, Offset=panel_17)

surface_normal_vector = Vector(amp_10)
pt_21 = ConstructPoint(XCoordinate=0, YCoordinate=0, ZCoordinate=0)
move_38 = Move(Geometry=pt_21, Motion=surface_normal_vector)  # -> Geometry, Transform
project = Project(Geometry=pt_21, Plane=PlaneXY(0, 0, 0))  # -> Geometry, Transform
project_2 = Project(Geometry=move_38.Geometry, Plane=PlaneXY(0, 0, 0))  # -> Geometry, Transform
milling_bit_radius_7 = Panel(milling_bit_radius_4)
vec2pt_6 = Vector2Pt(PointA=project.Geometry, PointB=project_2.Geometry, Unitize=False)  # -> Vector, Length
rev_13 = Reverse(Vector=vec2pt_6.Vector)
multiplication_10 = Multiplication(A=milling_bit_radius_7, B="1.8")
amp_11 = Amplitude(Vector=rev_13, Amplitude=multiplication_10)

meshray = MeshRay(Mesh=intersection_meshes, Point=pshift_9, Direction=pshift_8)  # -> Point, Hit

unflatten_2 = UnflattenTree(Tree=meshray.Point, Guide=pt_20)
unflatten_3 = UnflattenTree(Tree=meshray.Hit, Guide=pt_20)

vec2pt_7 = Vector2Pt(PointA=pt_20, PointB=unflatten_2, Unitize=False)  # -> Vector, Length
move_39 = Move(Geometry=align_2.Plane, Motion=vec2pt_7.Vector)  # -> Geometry, Transform
dispatch_6 = Dispatch(List=align_2.Plane, DispatchPattern=unflatten_3)  # -> ListA, ListB
dispatch_7 = Dispatch(List=move_39.Geometry, DispatchPattern=unflatten_3)  # -> ListA, ListB
weave_3 = Weave(Pattern=unflatten_3, Stream0=dispatch_6.ListB, Stream1=dispatch_7.ListA, NullGaps=False)
simplify_12 = SimplifyTree(Tree=weave_3, Front=False)

# ---- group: create correct intersect position
item_12 = ListItem(List=flatten(simplify_10), Index=panel_9, Wrap=True)  # disabled
item_13 = ListItem(List=flatten(simplify_12), Index=panel_9, Wrap=True)  # disabled
deplane_18 = DeconstructPlane(Plane=item_13)  # -> Origin, XAxis, YAxis, ZAxis
deplane_19 = DeconstructPlane(Plane=item_12)  # -> Origin, XAxis, YAxis, ZAxis
ln = Line(StartPoint=deplane_18.Origin, EndPoint=deplane_19.Origin)

# ----
edge_milling_planes = Plane(simplify_12)

meshes_for_robofab_11 = Mesh(meshes_for_robofab_4)
edge_milling_planes_2 = Plane(edge_milling_planes)
deplane_20 = DeconstructPlane(Plane=edge_milling_planes_2)  # -> Origin, XAxis, YAxis, ZAxis
minc_2 = MeshInclusion(Mesh=meshes_for_robofab_11, Point=deplane_20.Origin, Strict=False)
dispatch_8 = Dispatch(List=edge_milling_planes_2, DispatchPattern=minc_2)  # -> ListA, ListB
dispatch_9 = Dispatch(List=deplane_20.YAxis, DispatchPattern=minc_2)  # -> ListA, ListB
dispatch_10 = Dispatch(List=deplane_20.ZAxis, DispatchPattern=minc_2)  # -> ListA, ListB
dispatch_11 = Dispatch(List=deplane_20.Origin, DispatchPattern=minc_2)  # -> ListA, ListB
milling_bit_radius_8 = Panel(milling_bit_radius_4)
amp_12 = Amplitude(Vector=dispatch_9.ListA, Amplitude=milling_bit_radius_8)
move_40 = Move(Geometry=dispatch_11.ListA, Motion=amp_12)  # -> Geometry, Transform
pt_22 = Point(move_40.Geometry)
meshray_2 = MeshRay(Mesh=meshes_for_robofab_11, Point=pt_22, Direction=dispatch_10.ListA)  # -> Point, Hit
vec2pt_8 = Vector2Pt(PointA=pt_22, PointB=meshray_2.Point, Unitize=False)  # -> Vector, Length
move_41 = Move(Geometry=dispatch_8.ListA, Motion=vec2pt_8.Vector)  # -> Geometry, Transform
weave_4 = Weave(Pattern=minc_2, Stream0=dispatch_8.ListB, Stream1=move_41.Geometry, NullGaps=False)
pln_8 = Plane(weave_4)

# ---- group: Create lines for preview toolpath bands
material_thickness_6 = Panel(material_thickness)
edge_milling_planes_3 = Plane(pln_8)
intersection_meshes_2 = Mesh(intersection_meshes)
surface_normal_vector_2 = Vector(amp_10)
Z_25 = UnitZ(Factor=material_thickness_6)
panel_55 = Panel(p_n_c_2)
deplane_21 = DeconstructPlane(Plane=edge_milling_planes_3)  # -> Origin, XAxis, YAxis, ZAxis
move_42 = Move(Geometry=deplane_21.Origin, Motion=surface_normal_vector_2)  # -> Geometry, Transform
move_43 = Move(Geometry=intersection_meshes_2, Motion=Z_25)  # -> Geometry, Transform
pshift_10 = ShiftPaths(Data=move_42.Geometry, Offset=panel_55)
pshift_11 = ShiftPaths(Data=deplane_21.ZAxis, Offset=panel_55)
rev_14 = Reverse(Vector=pshift_11)
meshray_3 = MeshRay(Mesh=move_43.Geometry, Point=pshift_10, Direction=pshift_11)  # -> Point, Hit
meshray_4 = MeshRay(Mesh=intersection_meshes_2, Point=meshray_3.Point, Direction=rev_14)  # -> Point, Hit
ln_2 = Line(StartPoint=meshray_3.Point, EndPoint=meshray_4.Point)
unflatten_4 = UnflattenTree(Tree=ln_2, Guide=deplane_21.Origin)
line = Line(unflatten_4)

# ----
pln_9 = Plane(pln_8)  # disabled
graft_6 = GraftTree(Tree=pln_9, IncludeEmptyLists=True, IncludeNullItems=True)
item_14 = ListItem(List=flatten(pln_9), Index=number_slider_9, Wrap=True)
bbox_3 = BoundingBox(Content=mcx.Points, Plane=graft_6, UnionBox=True)  # -> Box, Box_2
debrep_3 = DeconstructBrep(Brep=bbox_3.Box)  # -> Faces, Edges, Vertices
len_3 = Length(Curve=debrep_3.Edges)
sort_2 = SortList(Keys=len_3)  # -> Keys, ValuesA
rev_15 = ReverseList(List=sort_2.Keys)
item_15 = ListItem(List=rev_15, Index=0, Wrap=True)
pshift_12 = ShiftPaths(Data=item_15, Offset=-1)
pshift_13 = ShiftPaths(Data=pshift_12, Offset=-1)
larger_4 = LargerThan(FirstNumber=pshift_13, SecondNumber="5")  # -> LargerThan, OrEqualTo
larger_5 = LargerThan(FirstNumber=pshift_13, SecondNumber="20")  # -> LargerThan, OrEqualTo
panel_56 = Panel(item_15)
dispatch_12 = Dispatch(List=pln_9, DispatchPattern=larger_4.LargerThan)  # -> ListA, ListB
dispatch_13 = Dispatch(List=pln_9, DispatchPattern=larger_5.LargerThan)  # -> ListA, ListB
geo = Geometry(dispatch_13.ListB)
pln_10 = Plane(dispatch_12.ListB)

meshes_for_robofab_12 = Mesh(meshes_for_robofab_4)
surface_normal_vector_3 = Vector(surface_normal_vector)
line_2 = Line(line)
vec = Vector(amp_11)
end_2 = EndPoints(Curve=line_2)  # -> Start, End
extr_5 = Extrude(Base=line_2, Direction=vec)
vec2pt_9 = Vector2Pt(PointA=end_2.Start, PointB=end_2.End, Unitize=False)  # -> Vector, Length
mesh_32 = MeshBrep(
    Brep=extr_5,
    Settings={GridMaxCount=0, GridMinCount=16, JaggedSeams=False, MaxEdgeLength=0, MinEdgeLength=0.0001, MinTolerance=0, Refine=True, RefineAngle=0, RelativeTolerance=0.65, SimplePlanes=True, Tolerance=0})
pl_13 = ConstructPlane(Origin=deplane_21.Origin, XAxis=surface_normal_vector_3, YAxis=vec2pt_9.Vector)
mmx = MeshMesh(MeshA=meshes_for_robofab_12, MeshB=mesh_32, UseMeshMeshFast=True)
bbox_4 = BoundingBox(Content=mmx, Plane=graft(pl_13), UnionBox=True)  # -> Box, Box_2
debrep_4 = DeconstructBrep(Brep=bbox_4.Box)  # -> Faces, Edges, Vertices
item_16 = ListItem(List=debrep_4.Edges, Index="1", Wrap=True)
item_17 = ListItem(List=debrep_4.Edges, Index="3", Wrap=True)
eval_2 = EvaluateLength(Curve=item_16, Length="0.5", Normalized=True)  # -> Point, Tangent, Parameter
xy_20 = XYPlane(Origin=eval_2.Point)
plx = LinePlane(Line=item_17, Plane=xy_20)  # -> Point, ParamL, ParamP
# -make safe z transitions
# -make glue station visit between layers
# -detect and make pockets when new cavity floors gets exposed
# -make collision detection with angle detection
# -make bit to flange proximity check?
vec2pt_10 = Vector2Pt(PointA=eval_2.Point, PointB=plx.Point, Unitize=False)  # -> Vector, Length
pshift_14 = ShiftPaths(Data=vec2pt_10.Vector, Offset=-1)
pshift_15 = ShiftPaths(Data=pshift_14, Offset=-1)
simplify_13 = SimplifyTree(Tree=line_2, Front=False)
simplify_14 = SimplifyTree(Tree=pshift_15, Front=False)
simplify_15 = SimplifyTree(Tree=line_2, Front=False)
null = NullItem(Item=simplify_14)  # -> NullFlags, InvalidFlags, Description
move_44 = Move(Geometry=simplify_13, Motion=simplify_14)  # -> Geometry, Transform
dispatch_14 = Dispatch(List=move_44.Geometry, DispatchPattern=null.NullFlags)  # -> ListA, ListB
dispatch_15 = Dispatch(List=simplify_15, DispatchPattern=null.NullFlags)  # -> ListA, ListB
weave_5 = Weave(Pattern=null.NullFlags, Stream0=dispatch_14.ListB, Stream1=dispatch_15.ListA, NullGaps=False)
Z_26 = UnitZ(Factor=Slider(0, range=0..100))
nullrep = ReplaceNulls(Items=simplify_14, Replacements=Z_26)  # -> Items, Count
move_45 = Move(Geometry=edge_milling_planes_3, Motion=nullrep.Items)  # -> Geometry, Transform
edge_milling_planes_4 = Plane(move_45.Geometry)
preview_lines = Line(weave_5)

clean_4 = CleanTree(RemoveNulls=True, RemoveInvalid=True, RemoveEmpty=False, Tree=edge_milling_planes_4)

# ---- group: Create safe Z transitions
milling_bit_target_plane_2 = Plane(flatten_2)
flange_center_plane_2 = Plane(flange_center_plane)
edge_milling_planes_5 = Plane(clean_4)
flatten_5 = FlattenTree(Tree=flange_center_plane_2, Path="{0}")
milling_bit_target_plane_3 = Plane(milling_bit_target_plane_2)
orient_5 = Orient(Geometry=flatten_5, Source=edge_milling_planes_5, Target=milling_bit_target_plane_2)  # -> Geometry, Transform
safe_z_height_4 = Panel(safe_z_height)
oriented_flange_planes = Plane(orient_5.Geometry)
deplane_22 = DeconstructPlane(Plane=milling_bit_target_plane_3)  # -> Origin, XAxis, YAxis, ZAxis
oriented_flange_planes_2 = Plane(oriented_flange_planes)
rev_16 = Reverse(Vector=deplane_22.ZAxis)
lng_4 = ListLength(List=oriented_flange_planes)
panel_57 = Panel(lng_4)
amp_13 = Amplitude(Vector=rev_16, Amplitude=safe_z_height_4)
item_18 = ListItem(List=oriented_flange_planes_2, Index=panel_57, Wrap=True)
move_46 = Move(Geometry=item_18, Motion=amp_13)  # -> Geometry, Transform
ins = InsertItems(List=oriented_flange_planes_2, Item=move_46.Geometry, Indices=panel_57, Wrap=True)
pshift_16 = ShiftPaths(Data=ins, Offset=-1)
panel_58 = Panel("0")
pln_11 = Plane(pshift_16)
item_19 = ListItem(List=pln_11, Index=panel_58, Wrap=True)
move_47 = Move(Geometry=item_19, Motion=amp_13)  # -> Geometry, Transform
ins_2 = InsertItems(List=pln_11, Item=move_47.Geometry, Indices=panel_58, Wrap=True)
pshift_17 = ShiftPaths(Data=ins_2, Offset=-1)
oriented_flange_planes_with_safe_z = Plane(pshift_17)

# ----
oriented_edge_milling_planes = Plane(oriented_flange_planes)
feed_rate_2 = Panel(feed_rate)
maximum_flange_move_speed_2 = Panel(maximum_flange_move_speed)
edge_milling_planes_6 = Plane(edge_milling_planes_5)
toggle_2 = BooleanToggle(True)
pline_4 = PolyLine(Vertices=flatten(oriented_edge_milling_planes), Closed=toggle_2)
pline_5 = PolyLine(Vertices=flatten(edge_milling_planes_6), Closed=toggle_2)
explode = Explode(Curve=pline_5, Recursive=True)  # -> Segments, Vertices
explode_2 = Explode(Curve=pline_4, Recursive=True)  # -> Segments, Vertices
len_4 = Length(Curve=explode_2.Segments)
len_5 = Length(Curve=explode.Segments)
move_distance_on_surface = Panel(len_5)
flange_move_distance = Panel(len_4)
dom_3 = ConstructDomain(DomainStart="0", DomainEnd=maximum_flange_move_speed_2)
division_5 = Division(A=flange_move_distance, B=move_distance_on_surface)
speed_difference_factor = Panel(division_5)
multiplication_11 = Multiplication(A=feed_rate_2, B=speed_difference_factor)
constrain = Constrain(Number=multiplication_11, Domain=dom_3)
unflatten_5 = UnflattenTree(Tree=constrain, Guide=edge_milling_planes_6)
move_speeds_milling = Panel(unflatten_5)

milling_bit_radius_9 = Panel(milling_bit_radius)
milling_bit_length_2 = Panel(milling_bit_length)
xy_21 = XYPlane(Origin=Point(0, 0, 0))
cyl_2 = Cylinder(Base=xy_21, Radius=milling_bit_radius_9, Length=milling_bit_length_2)
cap_7 = CapHoles(Brep=cyl_2)
orient_6 = Orient(Geometry=cap_7, Source=xy_21, Target=milling_bit_target_plane_2)  # -> Geometry, Transform
material_9 = CreateMaterial(
    Diffuse=ColourSwatch(SwatchColor=RGB(212, 212, 212)),
    Specular=RGB(255, 255, 255),
    Emission=RGB(0, 0, 0),
    Transparency=Slider(0.662, range=0..1),
    Shine=0)
preview_5 = CustomPreview(Geometry=orient_6.Geometry, Shader=material_9)

orient_7 = Orient(Geometry=cap_7, Source=milling_bit_target_plane_2, Target=pln_9)  # -> Geometry, Transform
item_20 = ListItem(List=flatten(orient_7.Geometry), Index=number_slider_9, Wrap=True)
mmx_2 = MeshMesh(MeshA=orient_7.Geometry, MeshB=simplify_2, UseMeshMeshFast=True)
bbox_5 = BoundingBox(Content=mmx_2, Plane=graft(pln_9), UnionBox=True)  # -> Box, Box_2
item_21 = ListItem(List=flatten(bbox_5.Box), Index=number_slider_9, Wrap=True)
volume_3 = Volume(Geometry=bbox_5.Box)  # -> Volume, Centroid
simplify_16 = SimplifyTree(Tree=volume_3.Volume, Front=False)
pshift_18 = ShiftPaths(Data=simplify_16, Offset=-1)

# ---- group: Check for object with only one toolpath per layer
pline_6 = PolyLine(Vertices=edge_milling_planes_5, Closed=False)
pshift_19 = ShiftPaths(Data=pline_6, Offset=-1)
flatten_6 = FlattenTree(Tree=pshift_19, Path="{0}")
item_22 = ListItem(List=flatten_6, Index=0, Wrap=True)
null_2 = NullItem(Item=item_22)  # -> NullFlags, InvalidFlags, Description
object_has_only_one_toolpath_per_layer = Panel(null_2.NullFlags)

# ---- group: Generate toolpath preview ribbons
preview_lines_2 = Line(preview_lines)
clean_5 = CleanTree(RemoveNulls=True, RemoveInvalid=True, RemoveEmpty=False, Tree=preview_lines_2)
line_3 = Line(clean_5)
shift = ShiftList(List=line_3, Shift=1, Wrap=False)
shift_2 = ShiftList(List=line_3, Shift=-1, Wrap=False)
graft_7 = GraftTree(Tree=shift_2, IncludeEmptyLists=True, IncludeNullItems=True)
graft_8 = GraftTree(Tree=shift, IncludeEmptyLists=True, IncludeNullItems=True)
loft = Loft(
    Curves=[graft_7, graft_8],
    Options={Adjust=False, Closed=False, LoftEnds=0, LoftSimp=0, LoftType=0, Rebuild=10, Refit=0.01})
mesh_33 = Mesh(loft)
simplify_17 = SimplifyTree(Tree=mesh_33, Front=False)
pshift_20 = ShiftPaths(Data=simplify_17, Offset=-1)
toolpath_preview_ribbons = Mesh(pshift_20)

# ----
ma = MassAddition(Input=flange_move_distance)  # -> Result, PartialResults
ma_2 = MassAddition(Input=move_distance_on_surface)  # -> Result, PartialResults
panel_59 = Panel(ma_2.Result)
panel_60 = Panel(ma.Result)
division_6 = Division(A=panel_60, B=panel_59)
panel_61 = Panel(division_6)

# ---- group: Insert jog out of cut speeds
jog_speed_6 = Panel(jog_speed_4)
subtraction_8 = Subtraction(A=panel_57, B="1")
replace = ReplaceItems(List=move_speeds_milling, Item=jog_speed_6, Indices=subtraction_8, Wrap=False)
pshift_21 = ShiftPaths(Data=replace, Offset=-1)

# ----
object_has_only_one_toolpath_per_layer_2 = Panel(object_has_only_one_toolpath_per_layer)
object_has_only_one_toolpath_per_layer_3 = Panel(object_has_only_one_toolpath_per_layer)
milling_bit_target_plane_4 = Plane(milling_bit_target_plane_2)
flange_center_plane_3 = Plane(flange_center_plane_2)
milling_bit_target_plane_5 = Plane(milling_bit_target_plane_4)
flange_center_plane_4 = Plane(flange_center_plane_3)

# ---- group: Insert empty positions to math jog and glue
toolpath_preview_ribbons_2 = Mesh(toolpath_preview_ribbons)
glue_and_stack_planes_2 = Plane(glue_and_stack_planes)
lng_5 = ListLength(List=glue_and_stack_planes_2)
dup_4 = DuplicateData(Data="0", Number=lng_5, Order=True)

# ----
lng_6 = ListLength(List=toolpath_preview_ribbons_2)
ins_3 = InsertItems(List=toolpath_preview_ribbons_2, Item=dup, Indices=lng_6, Wrap=True)
pshift_22 = ShiftPaths(Data=ins_3, Offset=-1)
ins_4 = InsertItems(List=pshift_22, Item="0", Indices="0", Wrap=True)
pshift_23 = ShiftPaths(Data=ins_4, Offset=-1)
pshift_24 = ShiftPaths(Data=pshift_23, Offset=-1)
filter = StreamFilter(Gate=object_has_only_one_toolpath_per_layer_2, Stream0=pshift_24, Stream1=pshift_23)

# ---- group: Insert plunge rate speeds
plunge_rate_3 = Panel(plunge_rate_2)
dup_5 = DuplicateData(Data=plunge_rate_3, Number="2", Order=True)

# ----
merge_13 = Merge(Data1=jog_speed_5, Data2=plunge_rate_3)

# ---- group: Insert plunge rate speeds (continued)
ins_5 = InsertItems(List=pshift_21, Item=merge_13, Indices=panel_58, Wrap=True)
pshift_25 = ShiftPaths(Data=ins_5, Offset=-1)

# ----
move_speeds_including_safe_z = Panel(pshift_25)

# ---- group: Insert empty positions to math jog and glue (continued)
ins_6 = InsertItems(List=filter, Item=dup_4, Indices="0", Wrap=True)

# ----
pshift_26 = ShiftPaths(Data=ins_6, Offset=-1)

# ---- group: Insert empty positions to math jog and glue (continued)
toolpath_preview_ribbons_with_empty_posi = Mesh(pshift_26)  # "Toolpath preview ribbons with empty positions"

# ----
toolpath_preview_ribbons_with_empty_posi_2 = Mesh(toolpath_preview_ribbons_with_empty_posi)  # "Toolpath preview ribbons with empty positions"
toolpath_preview_ribbons_3 = Geometry(flatten(toolpath_preview_ribbons_with_empty_posi_2))
lng_7 = ListLength(List=toolpath_preview_ribbons_3)
multiplication_12 = Multiplication(A=lng_7, B=robofab_preview_position_3)
preview_plane_number = Integer(multiplication_12)
preview_plane_number_2 = Integer(preview_plane_number)
panel_62 = Panel(preview_plane_number)
series_5 = Series(Start=0, Step=1, Count=panel_62)
item_23 = ListItem(List=toolpath_preview_ribbons_3, Index=series_5, Wrap=True)
preview_6 = CustomPreview(Geometry=item_23, Shader=material_4)

move_speeds_including_safe_z_2 = Panel(move_speeds_including_safe_z)
oriented_flange_planes_with_safe_z_2 = Plane(oriented_flange_planes_with_safe_z)
gluepot_swipe_planes_2 = Plane(gluepot_swipe_planes)
glue_pot_normal_2 = Vector(glue_pot_normal)
material_stack_planes_2 = Plane(material_stack_planes)
glue_and_stack_list_for_glue_pause_2 = Panel(glue_and_stack_list_for_glue_pause)
glue_and_stack_move_speeds_2 = Panel(glue_and_stack_move_speeds)
material_thickness_7 = Panel(material_thickness)
object_has_only_one_toolpath_per_layer_4 = Panel(object_has_only_one_toolpath_per_layer)
pshift_27 = ShiftPaths(Data=move_speeds_including_safe_z_2, Offset=-1)
pshift_28 = ShiftPaths(Data=oriented_flange_planes_with_safe_z_2, Offset=-1)
filter_2 = StreamFilter(Gate=object_has_only_one_toolpath_per_layer_4, Stream0=pshift_28, Stream1=oriented_flange_planes_with_safe_z_2)
pline_7 = PolyLine(Vertices=filter_2, Closed=False)
flatten_7 = FlattenTree(Tree=pline_7, Path="{0}")
lng_8 = ListLength(List=flatten_7)
series_6 = Series(Start=0, Step=material_thickness_7, Count=lng_8)
series_7 = Series(Start=0, Step="0", Count=lng_8)
amp_14 = Amplitude(Vector=glue_pot_normal_2, Amplitude=series_6)
amp_15 = Amplitude(Vector=glue_pot_normal_2, Amplitude=series_7)
graft_9 = GraftTree(Tree=amp_14, IncludeEmptyLists=True, IncludeNullItems=True)
graft_10 = GraftTree(Tree=amp_15, IncludeEmptyLists=True, IncludeNullItems=True)
move_48 = Move(Geometry=gluepot_swipe_planes_2, Motion=graft_9)  # -> Geometry, Transform
move_49 = Move(Geometry=material_stack_planes_2, Motion=graft_10)  # -> Geometry, Transform
simplify_18 = SimplifyTree(Tree=move_48.Geometry, Front=False)
simplify_19 = SimplifyTree(Tree=move_49.Geometry, Front=False)
ins_7 = InsertItems(List=simplify_19, Item=simplify_18, Indices="0", Wrap=True)
glue_and_stack_planes_3 = Plane(ins_7)
ins_8 = InsertItems(List=filter_2, Item=glue_and_stack_planes_3, Indices="0", Wrap=True)
robofab_toolpath_planes = Plane(ins_8)

robofab_toolpath_planes_2 = Plane(robofab_toolpath_planes)
flatten_8 = FlattenTree(Tree=robofab_toolpath_planes_2, Path="{0}")
toolpath_planes_2 = Plane(flatten(flatten_8))
oriented_toolpath_planes = Plane(flatten(toolpath_planes_2))
pln_12 = Plane(oriented_toolpath_planes)  # disabled

toolpath_planes_3 = Plane(pln_12)
deplane_23 = DeconstructPlane(Plane=toolpath_planes_3)  # -> Origin, XAxis, YAxis, ZAxis
pline_8 = PolyLine(Vertices=flatten(deplane_23.Origin), Closed=False)
cp_6 = ControlPoints(Curve=pline_8)  # -> Points, Weights, Knots
crv_cp_2 = CurveClosestPoint(Point=cp_6.Points, Curve=pline_8)  # -> Point, Parameter, Distance
addition = Addition(A=crv_cp_2.Parameter, B=Slider(0.5, range=0..1))
frame = CurveFrame(Curve=pline_8, Parameter=addition)
deplane_24 = DeconstructPlane(Plane=frame)  # -> Origin, XAxis, YAxis, ZAxis
item_24 = ListItem(List=cp_6.Points, Index=0, Wrap=True)
pl_14 = ConstructPlane(Origin=deplane_24.Origin, XAxis=deplane_24.XAxis, YAxis=Z_24)
xy_22 = XYPlane(Origin=item_24)
sph_2 = Sphere(Base=xy_22, Radius=Slider(2, range=0..10))
orient_8 = Orient(Geometry=mesh_30, Source=xz, Target=pl_14)  # -> Geometry, Transform
preview_7 = CustomPreview(Geometry=sph_2, Shader=material_7)
preview_8 = CustomPreview(Geometry=[orient_8.Geometry, pline_8, toolpath_planes_3], Shader=material_8)

orient_9 = Orient(Source=xy_14, Target=oriented_toolpath_planes)  # -> Geometry, Transform
c_script = CSharpScript(x=orient_9.Transform)  # -> out, A, B, C; inputs x: Transform
# ---------- c_script: C# ----------
    A = Math.Atan2(x.M21, x.M22);
    B = -Math.Atan2(x.M20, Math.Sqrt(x.M21 * x.M21 + x.M22 * x.M22));
    C = Math.Atan2(x.M10, x.M00);
# ---------- end c_script ----------
addition_2 = Addition(A=c_script.B, B=pi)
addition_3 = Addition(A=c_script.C, B=pi_2)
deg_4 = Degrees(Radians=c_script.A)
deg_5 = Degrees(Radians=c_script.B)
deg_6 = Degrees(Radians=c_script.C)
multiplication_13 = Multiplication(A=deg_4, B=number_slider_2)
multiplication_14 = Multiplication(A=deg_5, B=number_slider_3)
multiplication_15 = Multiplication(A=deg_6, B=number_slider_4)
round_3 = Round(Number=multiplication_13)  # -> Nearest, Floor, Ceiling
round_4 = Round(Number=multiplication_14)  # -> Nearest, Floor, Ceiling
round_5 = Round(Number=multiplication_15)  # -> Nearest, Floor, Ceiling
division_7 = Division(A=round_3.Nearest, B=number_slider_2)
division_8 = Division(A=round_4.Nearest, B=number_slider_3)
division_9 = Division(A=round_5.Nearest, B=number_slider_4)
lng_9 = ListLength(List=division_7)
lng_10 = ListLength(List=division_7)
lng_11 = ListLength(List=division_7)
dup_6 = DuplicateData(Data=rz_overide, Number=lng_9, Order=True)
dup_7 = DuplicateData(Data=ry_overide, Number=lng_10, Order=True)
dup_8 = DuplicateData(Data=rx_overide, Number=lng_11, Order=True)
panel_63 = Panel(dup_6)
panel_64 = Panel(dup_7)
panel_65 = Panel(dup_8)
x_rotation = Panel(division_7)
y_rotation = Panel(division_8)
z_rotation = Panel(division_9)
flatten_9 = FlattenTree(Tree=y_rotation, Path="{0}")
flatten_10 = FlattenTree(Tree=x_rotation, Path="{0}")
flatten_11 = FlattenTree(Tree=z_rotation, Path="{0}")
lng_12 = ListLength(List=flatten(oriented_toolpath_planes))
number_of_toolpath_positions = Panel(lng_12)
# make end position for job
# make position level from angle
number_of_positions = Panel(number_of_toolpath_positions)
number_of_positions_2 = Panel(number_of_toolpath_positions)

split = TextSplit(Text=flatten_9, Separators=".")
item_25 = ListItem(List=split, Index=0, Wrap=True)
item_26 = ListItem(List=split, Index="1", Wrap=True)
panel_66 = Panel(item_25)
panel_67 = Panel(item_26)
len_6 = TextLength(Text=panel_67)
larger_6 = LargerThan(FirstNumber=len_6, SecondNumber="1")  # -> LargerThan, OrEqualTo
dispatch_16 = Dispatch(List=panel_67, DispatchPattern=larger_6.LargerThan)  # -> ListA, ListB
flatten_12 = FlattenTree(Tree=dispatch_16.ListB, Path="{0}")
lng_13 = ListLength(List=flatten_12)
dup_9 = DuplicateData(Data="0", Number=lng_13, Order=True)
flatten_13 = FlattenTree(Tree=dup_9, Path="{0}")
flatten_14 = FlattenTree(Tree=dispatch_16.ListB, Path="{0}")
graft_11 = GraftTree(Tree=flatten_14, IncludeEmptyLists=True, IncludeNullItems=True)
graft_12 = GraftTree(Tree=flatten_13, IncludeEmptyLists=True, IncludeNullItems=True)
simplify_20 = SimplifyTree(Tree=dispatch_16.ListA, Front=False)
join_4 = TextJoin(Text=[graft_11, graft_12])
simplify_21 = SimplifyTree(Tree=larger_6.LargerThan, Front=False)
weave_6 = Weave(Pattern=flatten(simplify_21), Stream0=flatten(join_4), Stream1=flatten(simplify_20), NullGaps=False)
lng_14 = ListLength(List=flatten(panel_66))
panel_68 = Panel(weave_6)
panel_69 = Panel(panel_66)
dup_10 = DuplicateData(Data=".", Number=lng_14, Order=True)
flatten_15 = FlattenTree(Tree=panel_69, Path="{0}")
flatten_16 = FlattenTree(Tree=dup_10, Path="{0}")
flatten_17 = FlattenTree(Tree=panel_68, Path="{0}")
graft_13 = GraftTree(Tree=flatten_15, IncludeEmptyLists=True, IncludeNullItems=True)
graft_14 = GraftTree(Tree=flatten_16, IncludeEmptyLists=True, IncludeNullItems=True)
graft_15 = GraftTree(Tree=flatten_17, IncludeEmptyLists=True, IncludeNullItems=True)
join_5 = TextJoin(Text=[graft_13, graft_14, graft_15])
flatten_18 = FlattenTree(Tree=join_5, Path="{0}")
panel_70 = Panel(flatten_18)

split_2 = TextSplit(Text=flatten_11, Separators=".")
item_27 = ListItem(List=split_2, Index=0, Wrap=True)
item_28 = ListItem(List=split_2, Index="1", Wrap=True)
panel_71 = Panel(item_27)
panel_72 = Panel(item_28)
len_7 = TextLength(Text=panel_72)
larger_7 = LargerThan(FirstNumber=len_7, SecondNumber="1")  # -> LargerThan, OrEqualTo
dispatch_17 = Dispatch(List=panel_72, DispatchPattern=larger_7.LargerThan)  # -> ListA, ListB
flatten_19 = FlattenTree(Tree=dispatch_17.ListB, Path="{0}")
lng_15 = ListLength(List=flatten_19)
dup_11 = DuplicateData(Data="0", Number=lng_15, Order=True)
flatten_20 = FlattenTree(Tree=dup_11, Path="{0}")
flatten_21 = FlattenTree(Tree=dispatch_17.ListB, Path="{0}")
graft_16 = GraftTree(Tree=flatten_21, IncludeEmptyLists=True, IncludeNullItems=True)
graft_17 = GraftTree(Tree=flatten_20, IncludeEmptyLists=True, IncludeNullItems=True)
simplify_22 = SimplifyTree(Tree=dispatch_17.ListA, Front=False)
join_6 = TextJoin(Text=[graft_16, graft_17])
simplify_23 = SimplifyTree(Tree=larger_7.LargerThan, Front=False)
weave_7 = Weave(Pattern=flatten(simplify_23), Stream0=flatten(join_6), Stream1=flatten(simplify_22), NullGaps=False)
lng_16 = ListLength(List=flatten(panel_71))
panel_73 = Panel(weave_7)
panel_74 = Panel(panel_71)
dup_12 = DuplicateData(Data=".", Number=lng_16, Order=True)
flatten_22 = FlattenTree(Tree=panel_74, Path="{0}")
flatten_23 = FlattenTree(Tree=dup_12, Path="{0}")
flatten_24 = FlattenTree(Tree=panel_73, Path="{0}")
graft_18 = GraftTree(Tree=flatten_22, IncludeEmptyLists=True, IncludeNullItems=True)
graft_19 = GraftTree(Tree=flatten_23, IncludeEmptyLists=True, IncludeNullItems=True)
graft_20 = GraftTree(Tree=flatten_24, IncludeEmptyLists=True, IncludeNullItems=True)
join_7 = TextJoin(Text=[graft_18, graft_19, graft_20])
flatten_25 = FlattenTree(Tree=join_7, Path="{0}")
panel_75 = Panel(flatten_25)

# ---- group: Create duble deciaml on every number (continued)
split_3 = TextSplit(Text=flatten_10, Separators=".")
item_29 = ListItem(List=split_3, Index=0, Wrap=True)
item_30 = ListItem(List=split_3, Index="1", Wrap=True)
panel_76 = Panel(item_29)
panel_77 = Panel(item_30)
len_8 = TextLength(Text=panel_77)
larger_8 = LargerThan(FirstNumber=len_8, SecondNumber="1")  # -> LargerThan, OrEqualTo
dispatch_18 = Dispatch(List=panel_77, DispatchPattern=larger_8.LargerThan)  # -> ListA, ListB
flatten_26 = FlattenTree(Tree=dispatch_18.ListB, Path="{0}")
lng_17 = ListLength(List=flatten_26)
dup_13 = DuplicateData(Data="0", Number=lng_17, Order=True)
flatten_27 = FlattenTree(Tree=dup_13, Path="{0}")
flatten_28 = FlattenTree(Tree=dispatch_18.ListB, Path="{0}")
graft_21 = GraftTree(Tree=flatten_28, IncludeEmptyLists=True, IncludeNullItems=True)
graft_22 = GraftTree(Tree=flatten_27, IncludeEmptyLists=True, IncludeNullItems=True)
simplify_24 = SimplifyTree(Tree=dispatch_18.ListA, Front=False)
join_8 = TextJoin(Text=[graft_21, graft_22])
simplify_25 = SimplifyTree(Tree=larger_8.LargerThan, Front=False)
weave_8 = Weave(Pattern=flatten(simplify_25), Stream0=flatten(join_8), Stream1=flatten(simplify_24), NullGaps=False)
lng_18 = ListLength(List=flatten(panel_76))
panel_78 = Panel(weave_8)
panel_79 = Panel(panel_76)
dup_14 = DuplicateData(Data=".", Number=lng_18, Order=True)
flatten_29 = FlattenTree(Tree=panel_79, Path="{0}")
flatten_30 = FlattenTree(Tree=dup_14, Path="{0}")
flatten_31 = FlattenTree(Tree=panel_78, Path="{0}")
graft_23 = GraftTree(Tree=flatten_29, IncludeEmptyLists=True, IncludeNullItems=True)
graft_24 = GraftTree(Tree=flatten_30, IncludeEmptyLists=True, IncludeNullItems=True)
graft_25 = GraftTree(Tree=flatten_31, IncludeEmptyLists=True, IncludeNullItems=True)
join_9 = TextJoin(Text=[graft_23, graft_24, graft_25])
flatten_32 = FlattenTree(Tree=join_9, Path="{0}")
panel_80 = Panel(flatten_32)

# ----
series_8 = Series(Start=0, Step=1, Count=number_of_toolpath_positions)

# ---- group: Find split indexes
division_10 = Division(A=number_of_toolpath_positions, B=maximum_number_positions_per_job)
round_6 = Round(Number=division_10)  # -> Nearest, Floor, Ceiling
series_9 = Series(Start=maximum_number_positions_per_job, Step=maximum_number_positions_per_job, Count=round_6.Floor)

# ----
item_31 = ListItem(List=series, Index=series_8, Wrap=True)
flatten_33 = FlattenTree(Tree=item_31, Path="{0}")
number_of_jobs = Panel(round_6.Ceiling)
number_of_jobs_2 = Panel(number_of_jobs)
int_3 = Integer(graft(flatten_33))
position_numbers = Panel(int_3)
len_9 = TextLength(Text=position_numbers)
subtraction_9 = Subtraction(A=number_of_digits_in_series, B=len_9)
deplane_25 = DeconstructPlane(Plane=oriented_toolpath_planes)  # -> Origin, XAxis, YAxis, ZAxis
dup_15 = DuplicateData(Data=Slider(0, range=0..100), Number=subtraction_9, Order=True)
int_4 = Integer(dup_15)
ins_9 = InsertItems(List=position_numbers, Item=int_4, Indices=number_slider_5, Wrap=True)
pdecon_5 = Deconstruct(Point=deplane_25.Origin)  # -> XComponent, YComponent, ZComponent
ins_10 = InsertItems(List=ins_9, Item="C", Indices=number_slider_5, Wrap=True)
multiplication_16 = Multiplication(A=pdecon_5.XComponent, B=number_slider_6)
multiplication_17 = Multiplication(A=pdecon_5.YComponent, B=number_slider_6)
multiplication_18 = Multiplication(A=pdecon_5.ZComponent, B=number_slider_6)
ins_11 = InsertItems(List="=", Item=ins_10, Indices=number_slider_5, Wrap=True)
round_7 = Round(Number=multiplication_16)  # -> Nearest, Floor, Ceiling
round_8 = Round(Number=multiplication_17)  # -> Nearest, Floor, Ceiling
round_9 = Round(Number=multiplication_18)  # -> Nearest, Floor, Ceiling
join_10 = TextJoin(Text=ins_10)
join_11 = TextJoin(Text=ins_11)
division_11 = Division(A=round_7.Nearest, B=number_slider_6)
division_12 = Division(A=round_8.Nearest, B=number_slider_6)
division_13 = Division(A=round_9.Nearest, B=number_slider_6)
flatten_34 = FlattenTree(Tree=join_11, Path="{0}")
flatten_35 = FlattenTree(Tree=join_10, Path="{0}")
simplify_26 = SimplifyTree(Tree=join_10, Front=False)
simplify_27 = SimplifyTree(Tree=join_11, Front=False)
x_cords = Panel(division_11)
y_cords = Panel(division_12)
z_cords = Panel(division_13)
ins_12 = InsertItems(List=flatten_34, Item="split", Indices=series_9, Wrap=True)
ins_13 = InsertItems(List=flatten_35, Item="split", Indices=series_9, Wrap=True)
panel_81 = Panel(ins_12)
panel_82 = Panel(simplify_27)
panel_83 = Panel(ins_13)
panel_84 = Panel(simplify_26)
graft_26 = GraftTree(Tree=y_cords, IncludeEmptyLists=True, IncludeNullItems=True)
graft_27 = GraftTree(Tree=z_cords, IncludeEmptyLists=True, IncludeNullItems=True)
graft_28 = GraftTree(Tree=x_cords, IncludeEmptyLists=True, IncludeNullItems=True)
graft_29 = GraftTree(Tree=panel_70, IncludeEmptyLists=True, IncludeNullItems=True)
graft_30 = GraftTree(Tree=panel_75, IncludeEmptyLists=True, IncludeNullItems=True)
graft_31 = GraftTree(Tree=panel_80, IncludeEmptyLists=True, IncludeNullItems=True)
panel_85 = Panel(panel_84)
join_12 = TextJoin(Text=[graft_28, graft_26, graft_27, graft_31, graft_29, graft_30], Join=",")
simplify_28 = SimplifyTree(Tree=join_12, Front=False)
lng_19 = ListLength(List=flatten(panel_85))
panel_86 = Panel(simplify_28)

# ---- group: Prepare move type commands
dup_16 = DuplicateData(Data="MOVL", Number=lng_19, Order=True)
graft_32 = GraftTree(Tree=flatten(dup_16), IncludeEmptyLists=True, IncludeNullItems=True)

# ---- group: Prepare and filter position level commands (continued)
dup_17 = DuplicateData(Data=panel_18, Number=lng_19, Order=True)
graft_33 = GraftTree(Tree=flatten(dup_17), IncludeEmptyLists=True, IncludeNullItems=True)
filter_3 = StreamFilter(Gate=use_position_level_3, Stream1=graft_33)

# ---- group: Coordinate ID's
graft_34 = GraftTree(Tree=flatten(panel_85), IncludeEmptyLists=True, IncludeNullItems=True)

# ----
join_13 = TextJoin(Text=[panel_82, panel_86])
flatten_36 = FlattenTree(Tree=join_13, Path="{0}")
positions = Panel(flatten_36)
panel_87 = Panel(panel_81)

mindex = MemberIndex(Set=panel_87, Member=panel_23)  # -> Index, Count
flatten_37 = FlattenTree(Tree=mindex.Index, Path="{0}")

split_index = Panel(flatten_37)
positions_2 = Panel(positions)
shift_3 = ShiftList(List=split_index, Shift="-1", Wrap=Toggle(False))
addition_4 = Addition(A=shift_3, B="1")
ins_14 = InsertItems(List=addition_4, Item="0", Indices="0", Wrap=True)
subtraction_10 = Subtraction(A=split_index, B=ins_14)
partition = PartitionList(List=flatten(positions_2), Size=flatten(subtraction_10))

panel_88 = Panel(partition)
flip_2 = FlipMatrix(Data=panel_88)

item_32 = ListItem(List=flip_2, Index="0", Wrap=True)
clean_6 = CleanTree(RemoveNulls=True, RemoveInvalid=True, RemoveEmpty=True, Tree=item_32)
flatten_38 = FlattenTree(Tree=clean_6, Path="{0}")
item_33 = ListItem(List=flatten_38, Index=0, Wrap=True)
null_3 = NullItem(Item=item_33)  # -> NullFlags, InvalidFlags, Description
filter_4 = StreamFilter(Gate=null_3.NullFlags, Stream0=clean_6, Stream1=positions_2)
positions_barkbe01 = Panel(filter_4)

item_34 = ListItem(List=flip_2, Index="1", Wrap=False)
clean_7 = CleanTree(RemoveNulls=True, RemoveInvalid=True, RemoveEmpty=True, Tree=item_34)
positions_barkbe02 = Panel(clean_7)

item_35 = ListItem(List=flip_2, Index="2", Wrap=False)
clean_8 = CleanTree(RemoveNulls=True, RemoveInvalid=True, RemoveEmpty=True, Tree=item_35)
positions_barkbe03 = Panel(clean_8)

item_36 = ListItem(List=flip_2, Index="3", Wrap=False)
clean_9 = CleanTree(RemoveNulls=True, RemoveInvalid=True, RemoveEmpty=True, Tree=item_36)
positions_barkbe04 = Panel(clean_9)

item_37 = ListItem(List=flip_2, Index="4", Wrap=False)
clean_10 = CleanTree(RemoveNulls=True, RemoveInvalid=True, RemoveEmpty=True, Tree=item_37)
positions_barkbe05 = Panel(clean_10)

item_38 = ListItem(List=flip_2, Index="5", Wrap=False)
clean_11 = CleanTree(RemoveNulls=True, RemoveInvalid=True, RemoveEmpty=True, Tree=item_38)
positions_barkbe06 = Panel(clean_11)

item_39 = ListItem(List=flip_2, Index="6", Wrap=False)
clean_12 = CleanTree(RemoveNulls=True, RemoveInvalid=True, RemoveEmpty=True, Tree=item_39)
positions_barkbe07 = Panel(clean_12)

item_40 = ListItem(List=flip_2, Index="7", Wrap=False)
clean_13 = CleanTree(RemoveNulls=True, RemoveInvalid=True, RemoveEmpty=True, Tree=item_40)
positions_barkbe08 = Panel(clean_13)

item_41 = ListItem(List=flip_2, Index="8", Wrap=False)
clean_14 = CleanTree(RemoveNulls=True, RemoveInvalid=True, RemoveEmpty=True, Tree=item_41)
positions_barkbe09 = Panel(clean_14)

item_42 = ListItem(List=flip_2, Index="9", Wrap=False)
clean_15 = CleanTree(RemoveNulls=True, RemoveInvalid=True, RemoveEmpty=True, Tree=item_42)
positions_barkbe10 = Panel(clean_15)

filter_5 = StreamFilter(Gate=object_has_only_one_toolpath_per_layer_3, Stream0=pshift_27, Stream1=move_speeds_including_safe_z_2)
robofab_toolpath_planes_3 = Plane(robofab_toolpath_planes)
lng_20 = ListLength(List=robofab_toolpath_planes_3)
panel_89 = Panel(lng_20)
ma_3 = MassAddition(Input=flatten(panel_89))  # -> Result, PartialResults
robofab_toolpath_planes_4 = Plane(flatten(robofab_toolpath_planes_3))
panel_90 = Panel(ma_3.PartialResults)
robofab_toolpath_planes_5 = Plane(robofab_toolpath_planes)
larger_9 = LargerThan(FirstNumber=preview_plane_number_2, SecondNumber=panel_90)  # -> LargerThan, OrEqualTo
flatten_39 = FlattenTree(Tree=robofab_toolpath_planes_5, Path="{0}")
item_43 = ListItem(List=flatten_39, Index="299", Wrap=True)  # disabled
pline_9 = PolyLine(Vertices=robofab_toolpath_planes_5, Closed=False)  # disabled
ma_4 = MassAddition(Input=larger_9.LargerThan)  # -> Result, PartialResults
item_44 = ListItem(List=flatten(pline_9), Index=Slider(0, range=0..10), Wrap=False)
orient_10 = Orient(Geometry=milling_bit_target_plane_5, Source=robofab_toolpath_planes_4, Target=flange_center_plane_4)  # -> Geometry, Transform
pline_10 = PolyLine(Vertices=flatten(flatten_39), Closed=False)
eval_3 = EvaluateLength(Curve=item_44, Length=Slider(0.292373, range=0..1), Normalized=True)  # -> Point, Tangent, Parameter
item_45 = ListItem(List=robofab_toolpath_planes_4, Index=panel_62, Wrap=True)
preview_9 = CustomPreview(Geometry=pline_10, Shader=ColourSwatch(SwatchColor=RGB(115, 115, 115)))
item_46 = ListItem(List=end.Start, Index=ma_4.Result, Wrap=True)
pdecon_6 = Deconstruct(Point=item_46)  # -> XComponent, YComponent, ZComponent
current_preview_plane_2 = Plane(item_45)
current_preview_plane_3 = Plane(current_preview_plane_2)
move_50 = Move(Geometry=current_preview_plane_3, Motion=Z_12)  # -> Geometry, Transform
c_script_2 = CSharpScript(P1=pt_7, P2=pt_8, P3=pt_10, P4=pt_9, BasePlane=xy_10, TargetPlane=move_50.Geometry)  # -> out, A1, A2, A3, A4, A5, A6; inputs P1: Point3d, P2: Point3d, P3: Point3d, P4: Point3d, BasePlane: Plane, TargetPlane: Plane
# ---------- c_script_2: C# ----------
    //Lobster reloaded
    //Inverse Kinematics definition by Daniel Piker
    //You are free to use and modify without restriction, but acknowledgement is appreciated

    Transform xform = Rhino.Geometry.Transform.PlaneToPlane(BasePlane, Plane.WorldXY);

    Plane EndPlane = new Plane(TargetPlane.Origin, TargetPlane.YAxis, TargetPlane.XAxis);
    double pi = Math.PI;
    double WristOffset = P4.X - P3.X;
    double LowerArmLength = P1.DistanceTo(P2);
    double UpperArmLength = P2.DistanceTo(P3);
    double Axis4offsetAngle = Math.Atan2(P3.Z - P2.Z, P3.X - P2.X);

    P1.Transform(xform);
    P2.Transform(xform);
    P3.Transform(xform);
    P4.Transform(xform);

    Point3d Wrist = new Point3d(EndPlane.PointAt(0, 0, WristOffset));

    List<double> Axis1Angles = new List<double>();
    List<double> Axis2Angles = new List<double>();
    List<double> Axis3Angles = new List<double>();
    List<double> Axis4Angles = new List<double>();
    List<double> Axis5Angles = new List<double>();
    List<double> Axis6Angles = new List<double>();

    double Axis1Angle = -1 * Math.Atan2(Wrist.Y, Wrist.X);
    //note that this is reversed because the clockwise direction when looking down at the XY plane
    //is typically taken as the positive direction for robot axis1

    if(Axis1Angle > Math.PI)
    {
      Axis1Angle -= 2 * Math.PI;
    }

    for (int i = 0; i < 4; i++)
    {
      Axis1Angles.Add(Axis1Angle);
    }

    Axis1Angle += Math.PI;
    if(Axis1Angle > Math.PI)
    {
      Axis1Angle -= 2 * Math.PI;
    }
    for (int i = 0; i < 4; i++)
    {
      Axis1Angles.Add(1 * Axis1Angle);
    }

    for (int i = 0; i < 2; i++)  // to generate 4 sets of values for each option of axis1
    {
      Axis1Angle = Axis1Angles[i * 4];

      Transform Rot1 = Rhino.Geometry.Transform.Rotation(-1 * Axis1Angle, Point3d.Origin);

      Point3d P1A = new Point3d(P1);
      Point3d P2A = new Point3d(P2);
      Point3d P3A = new Point3d(P3);

      P1A.Transform(Rot1);
      P2A.Transform(Rot1);
      P3A.Transform(Rot1);
      Vector3d ElbowDir = new Vector3d(1, 0, 0);
      ElbowDir.Transform(Rot1);
      Plane ElbowPlane = new Rhino.Geometry.Plane(P1A, ElbowDir, Vector3d.ZAxis);

      Sphere Sphere1 = new Sphere(P1A, LowerArmLength);
      Sphere Sphere2 = new Sphere(Wrist, UpperArmLength);
      Circle Circ = new Circle();

      double Par1 = new double();
      double Par2 = new double();

      Rhino.Geometry.Intersect.Intersection.SphereSphere(Sphere1, Sphere2, out Circ);
      Rhino.Geometry.Intersect.Intersection.PlaneCircle(ElbowPlane, Circ, out Par1, out Par2);

      Point3d IntersectPt1 = Circ.PointAt(Par1);
      Point3d IntersectPt2 = Circ.PointAt(Par2);

      for(int j = 0;j < 2;j++)
      {
        Point3d ElbowPt = new Point3d();

        if(j == 0)
        {ElbowPt = IntersectPt1;}
        else
        {ElbowPt = IntersectPt2;}

        double elbowx,elbowy,wristx,wristy; //parameters in the elbow plane

        ElbowPlane.ClosestParameter(ElbowPt, out elbowx, out elbowy);
        ElbowPlane.ClosestParameter(Wrist, out wristx, out wristy);

        double Axis2Angle = Math.Atan2(elbowy, elbowx);
        double Axis3Angle = Math.PI - Axis2Angle + Math.Atan2(wristy - elbowy, wristx - elbowx) - Axis4offsetAngle;

        for(int k = 0;k < 2;k++)
        {
          Axis2Angles.Add(-Axis2Angle);

          double Axis3AngleWrapped = -Axis3Angle + pi;
          while (Axis3AngleWrapped >= pi) Axis3AngleWrapped -= 2 * pi;
          while (Axis3AngleWrapped < -pi) Axis3AngleWrapped += 2 * pi;
          Axis3Angles.Add(Axis3AngleWrapped);
        }

        for(int k = 0;k < 2;k++)
        {
          Vector3d Axis4 = new Vector3d(Wrist - ElbowPt);
          Axis4.Rotate(-Axis4offsetAngle, ElbowPlane.ZAxis);
          Vector3d LowerArm = new Vector3d(ElbowPt - P1A);
          Plane TempPlane = ElbowPlane;
          TempPlane.Rotate(Axis2Angle + Axis3Angle, TempPlane.ZAxis);

          // B = TempPlane;
          Plane Axis4Plane = new Rhino.Geometry.Plane(Wrist, TempPlane.ZAxis, -1.0 * TempPlane.YAxis);
          double axis6x,axis6y;
          Axis4Plane.ClosestParameter(EndPlane.Origin, out axis6x, out axis6y);

          double Axis4Angle = Math.Atan2(axis6y, axis6x);
          if(k == 1)
          {
            Axis4Angle += Math.PI;
            if(Axis4Angle > Math.PI)
            {
              Axis4Angle -= 2 * Math.PI;
            }
          }

          double Axis4AngleWrapped = Axis4Angle + pi / 2;
          while (Axis4AngleWrapped >= pi) Axis4AngleWrapped -= 2 * pi;
          while (Axis4AngleWrapped < -pi) Axis4AngleWrapped += 2 * pi;
          Axis4Angles.Add(Axis4AngleWrapped);

          Plane Axis5Plane = new Rhino.Geometry.Plane(Axis4Plane);
          Axis5Plane.Rotate(Axis4Angle, Axis4Plane.ZAxis);
          Axis5Plane = new Rhino.Geometry.Plane(Wrist, -Axis5Plane.ZAxis, Axis5Plane.XAxis);
          Axis5Plane.ClosestParameter(EndPlane.Origin, out axis6x, out axis6y);
          double Axis5Angle = Math.Atan2(axis6y, axis6x);
          Axis5Angles.Add(Axis5Angle);

          Plane Axis6Plane = new Rhino.Geometry.Plane(Axis5Plane);
          Axis6Plane.Rotate(Axis5Angle, Axis5Plane.ZAxis);
          Axis6Plane = new Rhino.Geometry.Plane(Wrist, -Axis6Plane.YAxis, Axis6Plane.ZAxis);
          double endx,endy;
          Axis6Plane.ClosestParameter(EndPlane.PointAt(1, 0), out endx, out endy);
          double Axis6Angle = Math.Atan2(endy, endx);
          Axis6Angles.Add(Axis6Angle);
        }
      }
    }
    for(int i = 0;i < 8;i++)
    {
      Axis1Angles[i] = Axis1Angles[i] * 180 / pi;
      Axis2Angles[i] = Axis2Angles[i] * 180 / pi;
      Axis3Angles[i] = Axis3Angles[i] * 180 / pi;
      Axis4Angles[i] = Axis4Angles[i] * 180 / pi;
      Axis5Angles[i] = Axis5Angles[i] * 180 / pi;
      Axis6Angles[i] = Axis6Angles[i] * 180 / pi;
    }
    A1 = Axis1Angles;
    A2 = Axis2Angles;
    A3 = Axis3Angles;
    A4 = Axis4Angles;
    A5 = Axis5Angles;
    A6 = Axis6Angles;
# ---------- end c_script_2 ----------
item_47 = ListItem(List=c_script_2.A1, Index=slider, Wrap=False)
item_48 = ListItem(List=c_script_2.A2, Index=slider, Wrap=False)
item_49 = ListItem(List=c_script_2.A3, Index=slider, Wrap=False)
item_50 = ListItem(List=c_script_2.A4, Index=slider, Wrap=False)
item_51 = ListItem(List=c_script_2.A5, Index=slider, Wrap=False)
item_52 = ListItem(List=c_script_2.A6, Index=slider, Wrap=False)
panel_91 = Panel([item_47, item_48, item_49, item_50, item_51, item_52])
forward_kinematics = CSharpScript(
    P1=pt_7,
    P2=pt_8,
    P3=pt_10,
    P4=pt_9,
    A1=item_47,
    A2=item_48,
    A3=item_49,
    A4=item_50,
    A5=item_51,
    A6=item_52,
    BasePlane=xy_10,
    J1=mesh_12,
    J2=mesh_13,
    J3=mesh_14,
    J4=mesh_15,
    J5=mesh_10,
    J6=mesh_16,
    J7=mesh_11)  # -> out, Robot, EndPlane; inputs P1: Point3d, P2: Point3d, P3: Point3d, P4: Point3d, A1: Double, A2: Double, A3: Double, A4: Double, A5: Double, A6: Double, BasePlane: Plane, J1: Mesh, J2: Mesh, J3: Mesh, J4: Mesh, J5: Mesh, J6: Mesh, J7: Mesh
# ---------- forward_kinematics: C# ----------
    //your code here
    double pi = Math.PI;
    double A1Rad = (A1 / 180) * pi;
    double A2Rad = (A2 / 180) * pi;
    double A3Rad = (A3 / 180) * pi;
    double A4Rad = (A4 / 180) * pi;
    double A5Rad = (A5 / 180) * pi;
    double A6Rad = (A6 / 180) * pi;

    Mesh[] RobotMesh = {J1, J2, J3, J4, J5, J6, J7};
    Plane AP1 = Plane.WorldZX;
    AP1.Origin = P1;
    Plane AP2 = Plane.WorldZX;
    AP2.Origin = P2;
    Plane AP3 = Plane.WorldYZ;
    AP3.Origin = P3;
    Plane AP4 = Plane.WorldZX;
    AP4.Origin = P3;
    Plane AP5 = Plane.WorldYZ;
    AP5.Origin = P3;
    Plane AP6 = Plane.WorldYZ;
    AP6.Origin = P4;

    Plane[] AxisPlanes = {AP1,AP2,AP3,AP4,AP5,AP6};

    Transform Rot1 = Rhino.Geometry.Transform.Rotation(-1 * A1Rad, BasePlane.ZAxis, BasePlane.Origin);

    for (int i = 1;i < 7;i++)
    {
      RobotMesh[i].Transform(Rot1);
    }
    for (int i = 0; i < 6;i++)
    {
      AxisPlanes[i].Transform(Rot1);
    }

    Transform Rot2 = Rhino.Geometry.Transform.Rotation(A2Rad + pi / 2, AxisPlanes[0].ZAxis, AxisPlanes[0].Origin);

    for (int i = 2;i < 7;i++)
    {
      RobotMesh[i].Transform(Rot2);
    }
    for (int i = 1; i < 6;i++)
    {
      AxisPlanes[i].Transform(Rot2);
    }

    Transform Rot3 = Rhino.Geometry.Transform.Rotation(A3Rad - pi / 2, AxisPlanes[1].ZAxis, AxisPlanes[1].Origin);

    for (int i = 3;i < 7;i++)
    {
      RobotMesh[i].Transform(Rot3);
    }
    for (int i = 2; i < 6;i++)
    {
      AxisPlanes[i].Transform(Rot3);
    }

    Transform Rot4 = Rhino.Geometry.Transform.Rotation(A4Rad * -1.0, AxisPlanes[2].ZAxis, AxisPlanes[2].Origin);

    for (int i = 4;i < 7;i++)
    {
      RobotMesh[i].Transform(Rot4);
    }
    for (int i = 3; i < 6;i++)
    {
      AxisPlanes[i].Transform(Rot4);
    }

    Transform Rot5 = Rhino.Geometry.Transform.Rotation(A5Rad, AxisPlanes[3].ZAxis, AxisPlanes[3].Origin);

    for (int i = 5;i < 7;i++)
    {
      RobotMesh[i].Transform(Rot5);
    }
    for (int i = 4; i < 6;i++)
    {
      AxisPlanes[i].Transform(Rot5);
    }

    Transform Rot6 = Rhino.Geometry.Transform.Rotation(-1.0 * A6Rad, AxisPlanes[4].ZAxis, AxisPlanes[4].Origin);

    for (int i = 6;i < 7;i++)
    {
      RobotMesh[i].Transform(Rot6);
    }
    for (int i = 5; i < 6;i++)
    {
      AxisPlanes[i].Transform(Rot6);
    }

    Robot = RobotMesh;

    EndPlane = AxisPlanes[5];
# ---------- end forward_kinematics ----------
pln_13 = Plane(forward_kinematics.EndPlane)
move_51 = Move(Geometry=forward_kinematics.Robot, Motion=Z_13)  # -> Geometry, Transform
preview_10 = CustomPreview(Geometry=move_51.Geometry, Shader=material)
item_53 = ListItem(List=orient_10.Geometry, Index=panel_62, Wrap=True)
deplane_26 = DeconstructPlane(Plane=current_preview_plane_2)  # -> Origin, XAxis, YAxis, ZAxis
pt_23 = ConstructPoint(XCoordinate=pdecon_4.XComponent, YCoordinate=pdecon_4.YComponent, ZCoordinate=pdecon_6.ZComponent)
amp_16 = Amplitude(Vector=deplane_26.XAxis, Amplitude="60")
rev_17 = Reverse(Vector=deplane_26.YAxis)
move_52 = Move(Geometry=deplane_26.Origin, Motion=amp_16)  # -> Geometry, Transform
box = CenterBox(Base=pt_23, X=multiplication_7, Y=multiplication_7, Z=multiplication_6)
pl_15 = ConstructPlane(Origin=move_52.Geometry, XAxis=deplane_26.XAxis, YAxis=rev_17)
orient_11 = Orient(Geometry=orient_4.Geometry, Source=item_53, Target=milling_bit_target_plane_4)  # -> Geometry, Transform
orient_12 = Orient(Geometry=item_23, Source=item_53, Target=milling_bit_target_plane_4)  # -> Geometry, Transform
orient_13 = Orient(Geometry=cap_7, Source=xy_21, Target=item_53)  # -> Geometry, Transform
orient_14 = Orient(Geometry=box, Source=item_53, Target=milling_bit_target_plane_4)  # -> Geometry, Transform
medges = MeshEdges(Mesh=orient_11.Geometry)  # -> NakedEdges, InteriorEdges, NonManifoldEdges
crv_9 = Curve(medges.InteriorEdges)
preview_11 = CustomPreview(Geometry=orient_12.Geometry, Shader=material_4)
preview_12 = CustomPreview(Geometry=crv_9, Shader=material_3)
preview_13 = CustomPreview(Geometry=orient_13.Geometry, Shader=material_5)
preview_14 = CustomPreview(Geometry=orient_14.Geometry, Shader=material_6)

panel_92 = Panel(panel_83)

# ---- group: Generate Bark Beetle inform code 9 (continued)
flatten_40 = FlattenTree(Tree=positions_barkbe09, Path="{0}")
positions_3 = Panel(flatten_40)

# ----
lng_21 = ListLength(List=flatten_40)
number_of_positions_in_next_job = Panel(lng_21)
null_4 = NullItem(Item=number_of_positions_in_next_job)  # -> NullFlags, InvalidFlags, Description
filter_6 = StreamFilter(Gate=null_4.NullFlags, Stream0="CALL JOB:BARKBE09")
panel_93 = Panel(filter_6)

# ---- group: Generate Bark Beetle inform code 10 (continued)
flatten_41 = FlattenTree(Tree=positions_barkbe10, Path="{0}")
positions_4 = Panel(flatten_41)

# ----
lng_22 = ListLength(List=flatten_41)
number_of_positions_in_next_job_2 = Panel(lng_22)
null_5 = NullItem(Item=number_of_positions_in_next_job_2)  # -> NullFlags, InvalidFlags, Description
filter_7 = StreamFilter(Gate=null_5.NullFlags, Stream0="CALL JOB:BARKBE10")
panel_94 = Panel(filter_7)

# ---- group: Generate Bark Beetle inform code 8 (continued)
flatten_42 = FlattenTree(Tree=positions_barkbe08, Path="{0}")
positions_5 = Panel(flatten_42)

# ----
lng_23 = ListLength(List=flatten_42)
number_of_positions_in_next_job_3 = Panel(lng_23)
null_6 = NullItem(Item=number_of_positions_in_next_job_3)  # -> NullFlags, InvalidFlags, Description
filter_8 = StreamFilter(Gate=null_6.NullFlags, Stream0="CALL JOB:BARKBE08")
panel_95 = Panel(filter_8)

# ---- group: Generate Bark Beetle inform code 2 (continued)
flatten_43 = FlattenTree(Tree=positions_barkbe02, Path="{0}")
positions_6 = Panel(flatten_43)

# ----
lng_24 = ListLength(List=flatten_43)
number_of_positions_in_next_job_4 = Panel(lng_24)
null_7 = NullItem(Item=number_of_positions_in_next_job_4)  # -> NullFlags, InvalidFlags, Description
filter_9 = StreamFilter(Gate=null_7.NullFlags, Stream0="CALL JOB:BARKBE02")
panel_96 = Panel(filter_9)

# ---- group: Generate Bark Beetle inform code 7 (continued)
flatten_44 = FlattenTree(Tree=positions_barkbe07, Path="{0}")
positions_7 = Panel(flatten_44)

# ----
lng_25 = ListLength(List=flatten_44)
number_of_positions_in_next_job_5 = Panel(lng_25)
null_8 = NullItem(Item=number_of_positions_in_next_job_5)  # -> NullFlags, InvalidFlags, Description
filter_10 = StreamFilter(Gate=null_8.NullFlags, Stream0="CALL JOB:BARKBE07")
panel_97 = Panel(filter_10)

# ---- group: Generate Bark Beetle inform code 3 (continued)
flatten_45 = FlattenTree(Tree=positions_barkbe03, Path="{0}")
positions_8 = Panel(flatten_45)

# ----
lng_26 = ListLength(List=flatten_45)
number_of_positions_in_next_job_6 = Panel(lng_26)
null_9 = NullItem(Item=number_of_positions_in_next_job_6)  # -> NullFlags, InvalidFlags, Description
filter_11 = StreamFilter(Gate=null_9.NullFlags, Stream0="CALL JOB:BARKBE03")
panel_98 = Panel(filter_11)

# ---- group: Generate Bark Beetle inform code 6 (continued)
flatten_46 = FlattenTree(Tree=positions_barkbe06, Path="{0}")
positions_9 = Panel(flatten_46)

# ----
lng_27 = ListLength(List=flatten_46)
number_of_positions_in_next_job_7 = Panel(lng_27)
null_10 = NullItem(Item=number_of_positions_in_next_job_7)  # -> NullFlags, InvalidFlags, Description
filter_12 = StreamFilter(Gate=null_10.NullFlags, Stream0="CALL JOB:BARKBE06")
panel_99 = Panel(filter_12)

# ---- group: Generate Bark Beetle inform code 4 (continued)
flatten_47 = FlattenTree(Tree=positions_barkbe04, Path="{0}")
positions_10 = Panel(flatten_47)

# ----
lng_28 = ListLength(List=flatten_47)
number_of_positions_in_next_job_8 = Panel(lng_28)
null_11 = NullItem(Item=number_of_positions_in_next_job_8)  # -> NullFlags, InvalidFlags, Description
filter_13 = StreamFilter(Gate=null_11.NullFlags, Stream0="CALL JOB:BARKBE04")
panel_100 = Panel(filter_13)

# ---- group: Generate Bark Beetle inform code 1 (continued)
flatten_48 = FlattenTree(Tree=positions_barkbe01, Path="{0}")
positions_11 = Panel(flatten_48)

# ----
lng_29 = ListLength(List=flatten_48)

# ---- group: Generate Bark Beetle inform code 5 (continued)
flatten_49 = FlattenTree(Tree=positions_barkbe05, Path="{0}")
positions_12 = Panel(flatten_49)

# ----
lng_30 = ListLength(List=flatten_49)
number_of_positions_in_next_job_9 = Panel(lng_30)
null_12 = NullItem(Item=number_of_positions_in_next_job_9)  # -> NullFlags, InvalidFlags, Description
filter_14 = StreamFilter(Gate=null_12.NullFlags, Stream0="CALL JOB:BARKBE05")
panel_101 = Panel(filter_14)

# ---- group: Generate Bark Beetle inform code 9 (continued)
number_of_positions_3 = Panel(lng_21)
merge_14 = Merge(Data1="///NPOS ", Data2=number_of_positions_3, Data3=",0,0,0,0,0")
join_14 = TextJoin(Text=merge_14)
merge_15 = Merge(Data1=panel_25, Data2=join_14, Data3=panel_24)
panel_102 = Panel(merge_15)

# ---- group: Generate Bark Beetle inform code 10 (continued)
number_of_positions_4 = Panel(lng_22)
merge_16 = Merge(Data1="///NPOS ", Data2=number_of_positions_4, Data3=",0,0,0,0,0")
join_15 = TextJoin(Text=merge_16)
merge_17 = Merge(Data1=panel_28, Data2=join_15, Data3=panel_27)
panel_103 = Panel(merge_17)

# ---- group: Generate Bark Beetle inform code 8 (continued)
number_of_positions_5 = Panel(lng_23)
merge_18 = Merge(Data1="///NPOS ", Data2=number_of_positions_5, Data3=",0,0,0,0,0")
join_16 = TextJoin(Text=merge_18)
merge_19 = Merge(Data1=panel_31, Data2=join_16, Data3=panel_30)
panel_104 = Panel(merge_19)

# ---- group: Generate Bark Beetle inform code 2 (continued)
number_of_positions_6 = Panel(lng_24)
merge_20 = Merge(Data1="///NPOS ", Data2=number_of_positions_6, Data3=",0,0,0,0,0")
join_17 = TextJoin(Text=merge_20)
merge_21 = Merge(Data1=panel_34, Data2=join_17, Data3=panel_33)
panel_105 = Panel(merge_21)

# ---- group: Generate Bark Beetle inform code 3 (continued)
number_of_positions_7 = Panel(lng_26)
merge_22 = Merge(Data1="///NPOS ", Data2=number_of_positions_7, Data3=",0,0,0,0,0")
join_18 = TextJoin(Text=merge_22)
merge_23 = Merge(Data1=panel_37, Data2=join_18, Data3=panel_36)
panel_106 = Panel(merge_23)

# ---- group: Generate Bark Beetle inform code 7 (continued)
number_of_positions_8 = Panel(lng_25)
merge_24 = Merge(Data1="///NPOS ", Data2=number_of_positions_8, Data3=",0,0,0,0,0")
join_19 = TextJoin(Text=merge_24)
merge_25 = Merge(Data1=panel_43, Data2=join_19, Data3=panel_42)
panel_107 = Panel(merge_25)

# ---- group: Generate Bark Beetle inform code 6 (continued)
number_of_positions_9 = Panel(lng_27)
merge_26 = Merge(Data1="///NPOS ", Data2=number_of_positions_9, Data3=",0,0,0,0,0")
join_20 = TextJoin(Text=merge_26)
merge_27 = Merge(Data1=panel_40, Data2=join_20, Data3=panel_39)
panel_108 = Panel(merge_27)

# ---- group: Generate Bark Beetle inform code 1 (continued)
number_of_positions_10 = Panel(lng_29)
merge_28 = Merge(Data1="///NPOS ", Data2=number_of_positions_10, Data3=",0,0,0,0,0")
join_21 = TextJoin(Text=merge_28)
merge_29 = Merge(Data1=panel_46, Data2=join_21, Data3=panel_45)
panel_109 = Panel(merge_29)

# ---- group: Generate Bark Beetle inform code 4 (continued)
number_of_positions_11 = Panel(lng_28)
merge_30 = Merge(Data1="///NPOS ", Data2=number_of_positions_11, Data3=",0,0,0,0,0")
join_22 = TextJoin(Text=merge_30)
merge_31 = Merge(Data1=panel_49, Data2=join_22, Data3=panel_48)
panel_110 = Panel(merge_31)

# ---- group: Generate Bark Beetle inform code 5 (continued)
number_of_positions_12 = Panel(lng_30)
merge_32 = Merge(Data1="///NPOS ", Data2=number_of_positions_12, Data3=",0,0,0,0,0")
join_23 = TextJoin(Text=merge_32)
merge_33 = Merge(Data1=panel_52, Data2=join_23, Data3=panel_51)
panel_111 = Panel(merge_33)

# ----
ins_15 = InsertItems(List=filter_5, Item=glue_and_stack_list_for_glue_pause_2, Indices="0", Wrap=True)
flatten_50 = FlattenTree(Tree=ins_15, Path="{0}")
mindex_2 = MemberIndex(Set=flatten_50, Member="gluetime")  # -> Index, Count
ins_16 = InsertItems(List=filter_5, Item=glue_and_stack_move_speeds_2, Indices="0", Wrap=True)

addition_5 = Addition(A=mindex_2.Index, B="1")
round_10 = Round(Number=ins_16)  # -> Nearest, Floor, Ceiling

flatten_51 = FlattenTree(Tree=addition_5, Path="{0}")
glue_pause_index = Panel(flatten_51)
robofab_movement_speeds = Panel(round_10.Ceiling)

glue_pause_index_2 = Panel(glue_pause_index)
robofab_movement_speeds_2 = Panel(robofab_movement_speeds)
flatten_52 = FlattenTree(Tree=robofab_movement_speeds_2, Path="{0}")
pause_index = Panel(glue_pause_index_2)
move_speed_mm_s_2 = Panel(flatten_52)
int_5 = Integer(move_speed_mm_s_2)
graft_35 = GraftTree(Tree=int_5, IncludeEmptyLists=True, IncludeNullItems=True)
pause_index_2 = Panel(pause_index)
move_speed = Panel(graft_35)
lng_31 = ListLength(List=flatten(move_speed))

# ---- group: Prepeare move speed commands
dup_18 = DuplicateData(Data="V=", Number=lng_31, Order=True)
graft_36 = GraftTree(Tree=flatten(dup_18), IncludeEmptyLists=True, IncludeNullItems=True)
join_24 = TextJoin(Text=[graft_36, move_speed])
panel_112 = Panel(join_24)

# ----
join_25 = TextJoin(Text=["SPEED V=", move_speed])
pause_index_3 = Panel(pause_index_2)

# ---- group: Merged move instructions
join_26 = TextJoin(Text=[graft_32, graft_34, panel_112, filter_3], Join=" ")
flatten_53 = FlattenTree(Tree=join_26, Path="{0}")

# ---- group: Insert pause commands
ins_17 = InsertItems(List=flatten_53, Item=panel_7, Indices=pause_index_3, Wrap=True)
flatten_54 = FlattenTree(Tree=ins_17, Path="{0}")
panel_113 = Panel(flatten_54)

# ----
ins_18 = InsertItems(List=panel_92, Item=panel_7, Indices=pause_index_3, Wrap=True)
flatten_55 = FlattenTree(Tree=ins_18, Path="{0}")
panel_114 = Panel(flatten_55)

# ---- group: Add output signals at start and end (continued)
lng_32 = ListLength(List=panel_113)
subtraction_11 = Subtraction(A=lng_32, B="0")
panel_115 = Panel(subtraction_11)
ins_19 = InsertItems(List=panel_113, Item=[panel_20, panel_19], Indices=[panel_21, panel_115], Wrap=True)
panel_116 = Panel(ins_19)
filter_15 = StreamFilter(Gate=use_putput_bollean, Stream0=panel_113, Stream1=panel_116)

# ----
ins_20 = InsertItems(List=panel_114, Item=[panel_20, panel_19], Indices=[panel_21, panel_115], Wrap=True)
panel_117 = Panel(ins_20)
filter_16 = StreamFilter(Gate=use_putput_bollean, Stream0=panel_114, Stream1=panel_117)

mindex_3 = MemberIndex(Set=filter_16, Member=panel_22)  # -> Index, Count
flatten_56 = FlattenTree(Tree=mindex_3.Index, Path="{0}")

split_index_2 = Panel(flatten_56)
position_types = Panel(filter_15)
shift_4 = ShiftList(List=split_index_2, Shift="-1", Wrap=Toggle(False))
addition_6 = Addition(A=shift_4, B="1")
ins_21 = InsertItems(List=addition_6, Item="0", Indices="0", Wrap=True)
subtraction_12 = Subtraction(A=split_index_2, B=ins_21)
partition_2 = PartitionList(List=flatten(position_types), Size=flatten(subtraction_12))

panel_118 = Panel(partition_2)
flip_3 = FlipMatrix(Data=panel_118)

item_54 = ListItem(List=flip_3, Index="0", Wrap=True)
clean_16 = CleanTree(RemoveNulls=True, RemoveInvalid=True, RemoveEmpty=True, Tree=item_54)
flatten_57 = FlattenTree(Tree=clean_16, Path="{0}")
item_55 = ListItem(List=flatten_57, Index=0, Wrap=True)
null_13 = NullItem(Item=item_55)  # -> NullFlags, InvalidFlags, Description
filter_17 = StreamFilter(Gate=null_13.NullFlags, Stream0=clean_16, Stream1=position_types)
position_types_barkbe01 = Panel(filter_17)

item_56 = ListItem(List=flip_3, Index="1", Wrap=False)
clean_17 = CleanTree(RemoveNulls=True, RemoveInvalid=True, RemoveEmpty=True, Tree=item_56)
position_types_barkbe02 = Panel(clean_17)

item_57 = ListItem(List=flip_3, Index="2", Wrap=False)
clean_18 = CleanTree(RemoveNulls=True, RemoveInvalid=True, RemoveEmpty=True, Tree=item_57)
position_types_barkbe03 = Panel(clean_18)

item_58 = ListItem(List=flip_3, Index="3", Wrap=False)
clean_19 = CleanTree(RemoveNulls=True, RemoveInvalid=True, RemoveEmpty=True, Tree=item_58)
position_types_barkbe04 = Panel(clean_19)

item_59 = ListItem(List=flip_3, Index="4", Wrap=False)
clean_20 = CleanTree(RemoveNulls=True, RemoveInvalid=True, RemoveEmpty=True, Tree=item_59)
position_types_barkbe05 = Panel(clean_20)

item_60 = ListItem(List=flip_3, Index="5", Wrap=False)
clean_21 = CleanTree(RemoveNulls=True, RemoveInvalid=True, RemoveEmpty=True, Tree=item_60)
position_types_barkbe06 = Panel(clean_21)

item_61 = ListItem(List=flip_3, Index="6", Wrap=False)
clean_22 = CleanTree(RemoveNulls=True, RemoveInvalid=True, RemoveEmpty=True, Tree=item_61)
position_types_barkbe07 = Panel(clean_22)

item_62 = ListItem(List=flip_3, Index="7", Wrap=False)
clean_23 = CleanTree(RemoveNulls=True, RemoveInvalid=True, RemoveEmpty=True, Tree=item_62)
position_types_barkbe08 = Panel(clean_23)

item_63 = ListItem(List=flip_3, Index="8", Wrap=False)
clean_24 = CleanTree(RemoveNulls=True, RemoveInvalid=True, RemoveEmpty=True, Tree=item_63)
position_types_barkbe09 = Panel(clean_24)

item_64 = ListItem(List=flip_3, Index="9", Wrap=False)
clean_25 = CleanTree(RemoveNulls=True, RemoveInvalid=True, RemoveEmpty=True, Tree=item_64)
position_types_barkbe10 = Panel(clean_25)

# ---- group: Generate Bark Beetle inform code 9 (continued)
flatten_58 = FlattenTree(Tree=position_types_barkbe09, Path="{0}")
position_types_2 = Panel(flatten_58)
merge_34 = Merge(
    Data1=flatten(panel_102),
    Data2=flatten(positions_3),
    Data3=flatten(panel_26),
    Data4=flatten(position_types_2),
    Data5=flatten(panel_94),
    Data6=flatten("END"))
panel_119 = Panel(merge_34)

# ---- group: Generate Bark Beetle inform code 10 (continued)
flatten_59 = FlattenTree(Tree=position_types_barkbe10, Path="{0}")
position_types_3 = Panel(flatten_59)
merge_35 = Merge(
    Data1=flatten(panel_103),
    Data2=flatten(positions_4),
    Data3=flatten(panel_29),
    Data4=flatten(position_types_3),
    Data6=flatten("END"))
panel_120 = Panel(merge_35)

# ---- group: Generate Bark Beetle inform code 8 (continued)
flatten_60 = FlattenTree(Tree=position_types_barkbe08, Path="{0}")
position_types_4 = Panel(flatten_60)
merge_36 = Merge(
    Data1=flatten(panel_104),
    Data2=flatten(positions_5),
    Data3=flatten(panel_32),
    Data4=flatten(position_types_4),
    Data6=flatten("END"))
panel_121 = Panel(merge_36)

# ---- group: Generate Bark Beetle inform code 2 (continued)
flatten_61 = FlattenTree(Tree=position_types_barkbe02, Path="{0}")
position_types_5 = Panel(flatten_61)
merge_37 = Merge(
    Data1=flatten(panel_105),
    Data2=flatten(positions_6),
    Data3=flatten(panel_35),
    Data4=flatten(position_types_5),
    Data6=flatten("END"))
panel_122 = Panel(merge_37)

# ---- group: Generate Bark Beetle inform code 7 (continued)
flatten_62 = FlattenTree(Tree=position_types_barkbe07, Path="{0}")
position_types_6 = Panel(flatten_62)
merge_38 = Merge(
    Data1=flatten(panel_107),
    Data2=flatten(positions_7),
    Data3=flatten(panel_44),
    Data4=flatten(position_types_6),
    Data5=flatten(panel_95),
    Data6=flatten("END"))
panel_123 = Panel(merge_38)

# ---- group: Generate Bark Beetle inform code 3 (continued)
flatten_63 = FlattenTree(Tree=position_types_barkbe03, Path="{0}")
position_types_7 = Panel(flatten_63)
merge_39 = Merge(
    Data1=flatten(panel_106),
    Data2=flatten(positions_8),
    Data3=flatten(panel_38),
    Data4=flatten(position_types_7),
    Data5=flatten(panel_100),
    Data6=flatten("END"))
panel_124 = Panel(merge_39)

# ---- group: Generate Bark Beetle inform code 6 (continued)
flatten_64 = FlattenTree(Tree=position_types_barkbe06, Path="{0}")
position_types_8 = Panel(flatten_64)
merge_40 = Merge(
    Data1=flatten(panel_108),
    Data2=flatten(positions_9),
    Data3=flatten(panel_41),
    Data4=flatten(position_types_8),
    Data6=flatten("END"))
panel_125 = Panel(merge_40)

# ---- group: Generate Bark Beetle inform code 4 (continued)
flatten_65 = FlattenTree(Tree=position_types_barkbe04, Path="{0}")
position_types_9 = Panel(flatten_65)
merge_41 = Merge(
    Data1=flatten(panel_110),
    Data2=flatten(positions_10),
    Data3=flatten(panel_50),
    Data4=flatten(position_types_9),
    Data6=flatten("END"))
panel_126 = Panel(merge_41)

# ---- group: Generate Bark Beetle inform code 1 (continued)
flatten_66 = FlattenTree(Tree=position_types_barkbe01, Path="{0}")
position_types_10 = Panel(flatten_66)
merge_42 = Merge(
    Data1=flatten(panel_109),
    Data2=flatten(positions_11),
    Data3=flatten(panel_47),
    Data4=flatten(position_types_10),
    Data5=flatten(panel_96),
    Data6=flatten("END"))
panel_127 = Panel(merge_42)

# ---- group: Generate Bark Beetle inform code 5 (continued)
flatten_67 = FlattenTree(Tree=position_types_barkbe05, Path="{0}")
position_types_11 = Panel(flatten_67)
merge_43 = Merge(
    Data1=flatten(panel_111),
    Data2=flatten(positions_12),
    Data3=flatten(panel_53),
    Data4=flatten(position_types_11),
    Data5=flatten(panel_99),
    Data6=flatten("END"))
panel_128 = Panel(merge_43)

# ----
robofab_movement_speeds_3 = Panel(robofab_movement_speeds)
flatten_68 = FlattenTree(Tree=robofab_movement_speeds_3, Path="{0}")
robofab_movement_speeds_4 = Panel(robofab_movement_speeds)
tag = TextTag(Location=flatten_39, Text=flatten_68)
flatten_69 = FlattenTree(Tree=robofab_movement_speeds_4, Path="{0}")
item_65 = ListItem(List=flatten_69, Index=panel_62, Wrap=True)
tag_2 = TextTag3D(
    Location=pl_15,
    Text=item_65,
    Size=Slider(8, range=0..10),
    Colour=ColourSwatch(SwatchColor=RGB(255, 173, 31)),
    Justification=4)

# ==== cluster AlignCurveDirection
curves_for_aligned_direction = ClusterInput()

# ---- group: Align curve directions
curves_for_aligned_direction_2 = Curve(curves_for_aligned_direction)
graft = GraftTree(Tree=curves_for_aligned_direction_2, IncludeEmptyLists=True, IncludeNullItems=True)
offset = Offset(Curve=graft, Distance="0.01", Plane=PlaneXY(0, 0, 0), Corners=2)
end = EndPoints(Curve=offset)  # -> Start, End
pshift = ShiftPaths(Data=end.Start, Offset=-1)
incurve = PointInCurve(Point=pshift, Curve=graft)  # -> Relationship, Point
multiplication = Multiplication(A=incurve.Relationship, B="0.5")
round = Round(Number=multiplication)  # -> Nearest, Floor, Ceiling
crv = Curve(graft)
int = Integer(round.Nearest)
flip = FlipCurve(Curve=crv)  # -> Curve, Flag
weave = Weave(Pattern=int, Stream0=flip.Curve, Stream1=crv, NullGaps=False)
pshift_2 = ShiftPaths(Data=weave, Offset=-1)
aligned_curves = Curve(pshift_2)

# ----
aligned_curves_2 = ClusterOutput(aligned_curves)

# ==== cluster Pocket
cut_depth_pocket = ClusterInput()
raster_along_y_0_1 = ClusterInput()
tool_diameter = ClusterInput()
stepover_0_1 = ClusterInput()
pass_depth = ClusterInput()
curves_for_raster_pocket = ClusterInput()
cut_depth_pocket_2 = Number(cut_depth_pocket)
raster_along_y_0_1_2 = Integer(raster_along_y_0_1)
tool_diameter_2 = Number(tool_diameter)
stepover_0_1_2 = Number(stepover_0_1)
pass_depth_2 = Number(pass_depth)

# ---- group: Filter out open curves
curves_for_raster_pocket_2 = Curve(curves_for_raster_pocket)
cls = Closed(Curve=curves_for_raster_pocket_2)  # -> Closed, Periodic
dispatch = Dispatch(List=curves_for_raster_pocket_2, DispatchPattern=cls.Closed)  # -> ListA, ListB

# ----
xy = XYPlane(Origin=Point(0, 0, 0))
multiplication = Multiplication(A=tool_diameter_2, B="0.5")
multiplication_2 = Multiplication(A=tool_diameter_2, B=stepover_0_1_2)
operation_plane = Plane(xy)
tool_radius = Panel(multiplication)
stepover_distance = Panel(multiplication_2)
tool_radius_2 = Panel(tool_radius)

# ---- group: Merge overlapping curves
curves_for_merging_overlap = Curve(dispatch.ListA)
mcx = MultipleCurves(Curves=curves_for_merging_overlap)  # -> Points, IndexA, IndexB, ParamA, ParamB
dcon = DeleteConsecutive(Set=[mcx.IndexA, mcx.IndexB], Wrap=False)  # -> Set, Count
item = ListItem(List=curves_for_merging_overlap, Index=dcon.Set, Wrap=True)
cull_i = CullIndex(List=curves_for_merging_overlap, Indices=dcon.Set, Wrap=True)
runion = RegionUnion(Curves=item, Plane=operation_plane)
merged_overlapping_curves = Curve([runion, cull_i])

# ---- group: Align curve directions
curves_for_aligned_direction = Curve(merged_overlapping_curves)
graft = GraftTree(Tree=curves_for_aligned_direction, IncludeEmptyLists=True, IncludeNullItems=True)
offset = Offset(Curve=graft, Distance="0.01", Plane=PlaneXY(0, 0, 0), Corners=2)
end = EndPoints(Curve=offset)  # -> Start, End
pshift = ShiftPaths(Data=end.Start, Offset=-1)
incurve = PointInCurve(Point=pshift, Curve=graft)  # -> Relationship, Point
multiplication_3 = Multiplication(A=incurve.Relationship, B="0.5")
round = Round(Number=multiplication_3)  # -> Nearest, Floor, Ceiling
crv = Curve(graft)
int = Integer(round.Nearest)
flip = FlipCurve(Curve=crv)  # -> Curve, Flag
weave = Weave(Pattern=int, Stream0=flip.Curve, Stream1=crv, NullGaps=False)
pshift_2 = ShiftPaths(Data=weave, Offset=-1)
aligned_curves = Curve(pshift_2)

# ---- group: Detect curves inside curves
aligned_curves_2 = Curve(aligned_curves)
graft_2 = GraftTree(Tree=aligned_curves_2, IncludeEmptyLists=True, IncludeNullItems=True)
end_2 = EndPoints(Curve=aligned_curves_2)  # -> Start, End
incurve_2 = PointInCurve(Point=end_2.Start, Curve=graft_2)  # -> Relationship, Point
multiplication_4 = Multiplication(A=incurve_2.Relationship, B="0.5")
round_2 = Round(Number=multiplication_4)  # -> Nearest, Floor, Ceiling
int_2 = Integer(round_2.Floor)
flip_2 = FlipMatrix(Data=int_2)
ma = MassAddition(Input=flip_2)  # -> Result, PartialResults
pshift_3 = ShiftPaths(Data=ma.Result, Offset=-1)
dispatch_2 = Dispatch(List=aligned_curves_2, DispatchPattern=pshift_3)  # -> ListA, ListB
curves_outside = Curve(dispatch_2.ListB)
curves_inside = Curve(dispatch_2.ListA)

# ----
curves_for_offset_outwards = Curve(curves_inside)
curves_for_offset_inwards = Curve(curves_outside)
operation_plane_2 = Plane(operation_plane)
neg = Negative(Value=tool_radius_2)
offset_2 = Offset(Curve=curves_for_offset_inwards, Distance=tool_radius_2, Plane=operation_plane_2, Corners=2)
offset_3 = Offset(Curve=curves_for_offset_outwards, Distance=neg, Plane=operation_plane_2, Corners=2)
pshift_4 = ShiftPaths(Data=offset_3, Offset=-1)
pshift_5 = ShiftPaths(Data=offset_2, Offset=-1)

# ---- group: Merge overlapping inside curves
curves_for_merging_overlap_2 = Curve(pshift_4)
mcx_2 = MultipleCurves(Curves=curves_for_merging_overlap_2)  # -> Points, IndexA, IndexB, ParamA, ParamB
dcon_2 = DeleteConsecutive(Set=[mcx_2.IndexA, mcx_2.IndexB], Wrap=False)  # -> Set, Count
item_2 = ListItem(List=curves_for_merging_overlap_2, Index=dcon_2.Set, Wrap=True)
runion_2 = RegionUnion(Curves=item_2, Plane=operation_plane_2)
cull_i_2 = CullIndex(List=curves_for_merging_overlap_2, Indices=dcon_2.Set, Wrap=True)
merged_overlapping_curves_2 = Curve([runion_2, cull_i_2])

# ----
operation_plane_3 = Plane(operation_plane_2)

# ---- group: Detect narrow gaps
graft_3 = GraftTree(Tree=merged_overlapping_curves_2, IncludeEmptyLists=True, IncludeNullItems=True)
ccx = CurveCurve(CurveA=flatten(pshift_5), CurveB=graft_3)  # -> Points, ParamsA, ParamsB
lng = ListLength(List=ccx.ParamsB)
larger = LargerThan(FirstNumber=lng, SecondNumber="0")  # -> LargerThan, OrEqualTo
pshift_6 = ShiftPaths(Data=larger.LargerThan, Offset=-1)
ma_2 = MassAddition(Input=pshift_6)  # -> Result, PartialResults
pshift_7 = ShiftPaths(Data=ma_2.Result, Offset=-1)
dispatch_3 = Dispatch(List=merged_overlapping_curves_2, DispatchPattern=pshift_7)  # -> ListA, ListB
rdiff = RegionDifference(CurvesA=pshift_5, CurvesB=dispatch_3.ListA, Plane=operation_plane_3)
inside_outline_curves = Curve(dispatch_3.ListB)
fixed_outline_curves = Curve(rdiff)

# ----
curves_for_raster_generation = Curve(fixed_outline_curves)
raster_direction_bollean = Integer(raster_along_y_0_1_2)

oultine_curve = Curve(curves_for_raster_generation)
X = UnitX(Factor=1)
Y = UnitY(Factor=1)
bbox = BoundingBox(Content=oultine_curve, Plane=PlaneXY(0, 0, 0))  # -> Box, Box_2
rev = Reverse(Vector=Y)
edges = BrepEdges(Brep=bbox.Box)  # -> Naked, Interior, NonManifold
filter = StreamFilter(Gate=raster_direction_bollean, Stream0="2", Stream1="3")
filter_2 = StreamFilter(Gate=raster_direction_bollean, Stream0="3", Stream1="2")
filter_3 = StreamFilter(Gate=raster_direction_bollean, Stream0=rev, Stream1=X)
item_3 = ListItem(List=edges.Naked, Index=filter_2, Wrap=True)
item_4 = ListItem(List=edges.Naked, Index=filter, Wrap=True)
len = Length(Curve=item_3)
stepover_distance_2 = Panel(stepover_distance)
division = Division(A=len, B=stepover_distance_2)
round_3 = Round(Number=division)  # -> Nearest, Floor, Ceiling
series = Series(Start=stepover_distance_2, Step=stepover_distance_2, Count=round_3.Floor)
amp = Amplitude(Vector=filter_3, Amplitude=series)
move = Move(Geometry=item_4, Motion=amp)  # -> Geometry, Transform
raster_curves = Curve(move.Geometry)

raster_cutoff_safety_factor = Panel("0.05")

# ---- group: Trim raster curves
dispatch_4 = Dispatch(List=flatten(raster_curves), DispatchPattern=[True, False])  # -> ListA, ListB
operation_plane_4 = Plane(operation_plane)
oultine_curve_2 = Curve(curves_for_raster_generation)
flip_3 = FlipCurve(Curve=dispatch_4.ListA)  # -> Curve, Flag
weave_2 = Weave(Pattern=[0, 1], Stream0=flip_3.Curve, Stream1=dispatch_4.ListB, NullGaps=False)
multiplication_5 = Multiplication(A=tool_radius_2, B=raster_cutoff_safety_factor)
raster_curves_2 = Curve(weave_2)
offset_4 = Offset(Curve=oultine_curve_2, Distance=multiplication_5, Plane=operation_plane_4, Corners=1)
trim = TrimWithRegion(Curve=raster_curves_2, Region=offset_4, Plane=operation_plane_4)  # -> Inside, Outside
simplify = SimplifyTree(Tree=trim.Inside, Front=False)
trimmed_raster_curves = Curve(simplify)

# ---- group: Filter short curves
stepover_distance_3 = Panel(stepover_distance_2)
len_2 = Length(Curve=trimmed_raster_curves)
multiplication_6 = Multiplication(A=stepover_distance_3, B="0.8")
smaller = SmallerThan(FirstNumber=len_2, SecondNumber=multiplication_6)  # -> SmallerThan, OrEqualTo
dispatch_5 = Dispatch(List=trimmed_raster_curves, DispatchPattern=smaller.SmallerThan)  # -> ListA, ListB
trimmed_and_filtered_raster_curves = Curve(dispatch_5.ListB)

# ---- group: Create line connections
oultine_curve_3 = Curve(oultine_curve_2)
lng_2 = ListLength(List=flatten(oultine_curve_3))
smaller_2 = SmallerThan(FirstNumber=lng_2, SecondNumber="2")  # -> SmallerThan, OrEqualTo
flatten = FlattenTree(Tree=trimmed_and_filtered_raster_curves, Path="{0}")
pshift_8 = ShiftPaths(Data=trimmed_and_filtered_raster_curves, Offset=-1)
filter_4 = StreamFilter(Gate=smaller_2.SmallerThan, Stream0=pshift_8, Stream1=flatten)
crv_2 = Curve(filter_4)
shift = ShiftList(List=crv_2, Shift="-1", Wrap=False)
shift_2 = ShiftList(List=crv_2, Shift="1", Wrap=False)
end_3 = EndPoints(Curve=shift)  # -> Start, End
end_4 = EndPoints(Curve=shift_2)  # -> Start, End
ln = Line(StartPoint=end_3.End, EndPoint=end_4.Start)

# ---- group: Filter intersecting curves
line_connections = Curve(ln)
oultine_curve_4 = Curve(oultine_curve_2)
colom = CollisionOneMany(Collider=line_connections, Obstacles=oultine_curve_4)  # -> Collision, Index
dispatch_6 = Dispatch(List=line_connections, DispatchPattern=colom.Collision)  # -> ListA, ListB
connection_lines = Curve(dispatch_6.ListB)

# ---- group: Trim with inside outline curves
trimmed_and_filtered_raster_curves_2 = Curve(trimmed_and_filtered_raster_curves)
connection_lines_2 = Curve(connection_lines)
inside_outline_curves_2 = Curve(inside_outline_curves)
operation_plane_5 = Plane(operation_plane)
neg_2 = Negative(Value=multiplication_5)
offset_5 = Offset(Curve=inside_outline_curves_2, Distance=neg_2, Plane=operation_plane_5, Corners=1)
oultine_curve_5 = Curve(oultine_curve_2)
lng_3 = ListLength(List=flatten(oultine_curve_5))
smaller_3 = SmallerThan(FirstNumber=lng_3, SecondNumber="2")  # -> SmallerThan, OrEqualTo
pshift_9 = ShiftPaths(Data=trimmed_and_filtered_raster_curves_2, Offset=-1)
flatten_2 = FlattenTree(Tree=trimmed_and_filtered_raster_curves_2, Path="{0}")
filter_5 = StreamFilter(Gate=smaller_3.SmallerThan, Stream0=pshift_9, Stream1=flatten_2)
pshift_10 = ShiftPaths(Data=offset_5, Offset=-1)
lng_4 = ListLength(List=flatten(inside_outline_curves_2))
smaller_4 = SmallerThan(FirstNumber=lng_4, SecondNumber="1")  # -> SmallerThan, OrEqualTo
trim_2 = TrimWithRegions(Curve=filter_5, Regions=pshift_10, Plane=operation_plane_4)  # -> Inside, Outside

# ----
filter_6 = StreamFilter(Gate=smaller_4.SmallerThan, Stream0=trim_2.Outside, Stream1=filter_5)

# ---- group: Trim with inside outline curves (continued)
crv_3 = Curve(filter_6)
join = JoinCurves(Curves=flatten([connection_lines_2, crv_3]), Preserve=True)
raster_curves_3 = Curve(join)

# ----
end_5 = EndPoints(Curve=raster_curves_3)  # -> Start, End
cps = ClosestPoints(Point=end_5.End, Cloud=end_5.Start, Count=2)  # -> ClosestPoint, CPIndex, Distance
dist = Distance(PointA=graft(end_5.Start), PointB=cps.ClosestPoint)
equals = Equality(FirstNumber=dist, SecondNumber="0")  # -> Equality, Inequality
dispatch_7 = Dispatch(List=cps.ClosestPoint, DispatchPattern=equals.Equality)  # -> ListA, ListB
item_5 = ListItem(List=dispatch_7.ListB, Index=0, Wrap=True)
ln_2 = Line(StartPoint=item_5, EndPoint=graft(end_5.End))

merge = Merge(Data1=inside_outline_curves_2, Data2=oultine_curve_4)
insied_and_outside_outline_curves = Curve(flatten(merge))
line_connections_2 = Curve(ln_2)
colom_2 = CollisionOneMany(Collider=line_connections_2, Obstacles=insied_and_outside_outline_curves)  # -> Collision, Index
dispatch_8 = Dispatch(List=line_connections_2, DispatchPattern=colom_2.Collision)  # -> ListA, ListB
stepover_distance_4 = Panel(stepover_distance_2)
len_3 = Length(Curve=dispatch_8.ListB)
multiplication_7 = Multiplication(A=stepover_distance_4, B="3")
larger_2 = LargerThan(FirstNumber=len_3, SecondNumber=multiplication_7)  # -> LargerThan, OrEqualTo
dispatch_9 = Dispatch(List=dispatch_8.ListB, DispatchPattern=larger_2.LargerThan)  # -> ListA, ListB
extra_connection_lines = Curve(dispatch_9.ListB)

extra_connection_lines_2 = Curve(extra_connection_lines)
raster_curves_4 = Curve(join)
join_2 = JoinCurves(Curves=flatten([raster_curves_4, extra_connection_lines_2]), Preserve=False)
raster_curves_5 = Curve(join_2)

inside_outline_curves_3 = Curve(inside_outline_curves)
raster_curves_6 = Curve(raster_curves_5)
oultine_curve_6 = Curve(curves_for_raster_generation)
flatten_3 = FlattenTree(Tree=oultine_curve_6, Path="{0}")
end_6 = EndPoints(Curve=inside_outline_curves_3)  # -> Start, End
incurves = PointInCurves(Point=end_6.Start, Curves=flatten_3)  # -> Relationship, Index, Point
addition = Addition(A=incurves.Index, B="1")
# fix curve order fail when no raster lines
# fix offset from when 1 line becomes more ? (narrow channels)
ins = InsertItems(List=flatten_3, Item=inside_outline_curves_3, Indices=addition, Wrap=True)
end_7 = EndPoints(Curve=raster_curves_6)  # -> Start, End
incurves_2 = PointInCurves(Point=end_7.Start, Curves=ins)  # -> Relationship, Index, Point
ins_2 = InsertItems(List=ins, Item=raster_curves_6, Indices=incurves_2.Index, Wrap=True)
sorted_raster_and_outline_routes = Curve(flatten(ins_2))

# ---- group: Move pocket toolpaths to cut depths
pass_depth_3 = Panel(pass_depth_2)
cut_depth_pocket_3 = Panel(cut_depth_pocket_2)
sorted_raster_and_outline_routes_2 = Curve(sorted_raster_and_outline_routes)
division_2 = Division(A=cut_depth_pocket_3, B=pass_depth_3)
round_4 = Round(Number=division_2)  # -> Nearest, Floor, Ceiling
division_3 = Division(A=cut_depth_pocket_3, B=round_4.Ceiling)
actual_pass_depth = Panel(division_3)
series_2 = Series(Start=actual_pass_depth, Step=actual_pass_depth, Count=round_4.Ceiling)
neg_3 = Negative(Value=series_2)
item_6 = ListItem(List=neg_3, Index=0, Wrap=True)
null = NullItem(Item=item_6)  # -> NullFlags, InvalidFlags, Description
filter_7 = StreamFilter(Gate=null.NullFlags, Stream0=neg_3, Stream1="0")
Z = UnitZ(Factor=filter_7)

# ----
group = Group(Objects=sorted_raster_and_outline_routes_2)

# ---- group: Move pocket toolpaths to cut depths (continued)
move_2 = Move(Geometry=group, Motion=Z)  # -> Geometry, Transform
ungroup = Ungroup(Group=move_2.Geometry)
flatten_4 = FlattenTree(Tree=ungroup, Path="{0}")

# ----
pocket_toolpaths = Curve(flatten_4)
pocket_toolpaths_2 = ClusterOutput(pocket_toolpaths)
