# Grasshopper definition Bark-beete-PCB-milling.gh (Grasshopper 0.9.76)
# Copyright: Creative commons BY-SA
# Copyright: Creative Commons BY-SA
# Copyright: none

# ---- group: Traces
number_of_trace_offsets = Slider(3, range=0..10)
trace_milling_bit_diameter = ValueList({"0.2mm": 0.2, "0.3mm": 0.3, "0.4mm": 0.4, "1mm": 1, "2mm": 2, "3mm": 3}, selected="1mm")
trace_depth = Slider(0.1, range=0..40)
mill_traces_on = ValueList({"inside": true, "outside": false}, selected="outside")
number_of_flutes = ValueList({"1", "2", "3", "4"}, selected="2")

# ---- group: Cutout
# Developed by Jens Dyvik / Fellesverkstedet
# 
# License: Creative Commons Attribution ShareAllike (cc-by-sa)
cutout_extra_depth = Slider(0.1, range=0..40)
cutout_bit_diameter = ValueList({"1mm": 1, "2mm": 2, "3mm": 3, "4mm": 4, "6mm": 6, "8mm": 8, "10mm": 10}, selected="2mm")
number_of_flutes_2 = ValueList({"1", "2", "3", "4"}, selected="1")
bit_type = ValueList({"Up-cut": 0, "Down-cut": 1, "Ball nose": 2, "V-bit": 3}, selected="Up-cut")

# ---- group: Material
board_thickness = Slider(1.9, range=0..100)
material_cutout = ValueList({"Foam / wax": 0, "Soft wood": 1, "Hard wood": 2, "Plastic": 3, "Aluminium / brass": 4, "Bronze": 5, "Soft steel": 6, "Stainless steel": 7}, selected="Plastic")
# Main settings
material_traces = ValueList({"Foam / wax": 0, "Soft wood": 1, "Hard wood": 2, "Plastic": 3, "Aluminium / brass": 4, "Copper": 5, "Soft steel": 6, "Stainless steel": 7}, selected="Copper")

# ---- group: Hole drilling
drill_extra_depth = Slider(0.6, range=0..40)
number_of_flutes_3 = ValueList({"1", "2", "3", "4"}, selected="2")
drill_diameter = ValueList({"1mm": 1, "2mm": 2, "3mm": 3, "4mm": 4, "6mm": 6, "8mm": 8, "10mm": 10}, selected="1mm")

# ---- group: Tricks
use_high_speed_maching = ValueList({"No": 0, "Trochoidal": 1, "Plunge": 2}, selected="No")
use_inside_cutting = ValueList({"No": 0, "Yes": 1}, selected="No")
make_finish_pass = ValueList({"No": 0, "Yes": 1}, selected="No")
make_dogbones = ValueList({"No": 0, "Yes": 1}, selected="No")

# ---- group: Trace override
# Values above 1 makes passes deeper. good for strong and stiff machines
# 
# Values bellow 1 makes passes shallower, so more passes are reuired to cut through. Good for weak machines
# Adjusts how fast the machine moves during cuts (it is best to adjust pass depth, and leave feedrates to default).
pass_depth_factor = Slider(1, range=0.2..2)
feed_rate_factor = Slider(0.5, range=0.2..2)

# ---- group: Drill override
# Values above 1 makes passes deeper. good for strong and stiff machines
# 
# Values bellow 1 makes passes shallower, so more passes are reuired to cut through. Good for weak machines
# Adjusts how fast the machine moves during cuts (it is best to adjust pass depth, and leave feedrates to default).
pass_depth_factor_2 = Slider(1, range=0.2..2)
feed_rate_factor_2 = Slider(0.3, range=0.2..2)

# ---- group: Cutout override
# Values above 1 makes passes deeper. good for strong and stiff machines
# 
# Values bellow 1 makes passes shallower, so more passes are reuired to cut through. Good for weak machines
# Adjusts how fast the machine moves during cuts (it is best to adjust pass depth, and leave feedrates to default).
pass_depth_factor_3 = Slider(0.5, range=0.2..2)
feed_rate_factor_3 = Slider(0.8, range=0.2..2)

# ----
# POST PROCESSOR SETTINGS
custom_start_g_code = Panel("""$H					;run GRBL homing cycle
G92 X-16.5 Y4.5 Z0    ;set the difference between homing location and where we want X and X home postion to be
G0 X-32 Z-5		;quickly jog to a good position to start probing. X is important, Z negative is just to save some time
G38.2 F200 Z-300	;start probing downwards
G92 Z0				;make probe surface Z zero
G0 Z1				;move up 1 mm
G38.2 F50 Z-100		;probe again with extra slow speed for maximum precision
G92 Z0				;make probe surface Z zero again
G0 Z17.7				;move to the height of the bed
G92 Z0				;make bed height Z zero""")
addition = Addition(A=board_thickness, B=drill_extra_depth)
addition_2 = Addition(A=board_thickness, B=cutout_extra_depth)
drill_depth_from_easy_interface = Panel(addition)
cutout_depth_from_easy_interface = Panel(addition_2)
make_dogbones_from_easy_interface = Panel(make_dogbones)
use_inside_cutting_from_easy_interface = Panel(use_inside_cutting)

# ---- group: Check if we should use climb milling (metals and plastic)
material_type_from_easy_interface = Panel(material_cutout)
larger = LargerThan(FirstNumber=material_type_from_easy_interface, SecondNumber="2")  # -> LargerThan, OrEqualTo

# ----
custom_start_g_code_2 = CustomStartGCode(custom_start_code=custom_start_g_code, material_thicness=board_thickness)

dogbone_corner_angle_threshold = Slider(121, range=0..1000)
dogbone_corner_angle_threshold_2 = Panel(dogbone_corner_angle_threshold)

deviation_tolerance = Slider(0.01, range=0.01..0.1)
jog_rate_xy = Slider(200, range=0..2440)
jog_rate_z = Slider(60, range=0..2440)

use_climb_direction = BooleanToggle(False)
use_auto_settings = BooleanToggle(True)
filter = StreamFilter(Gate=use_auto_settings, Stream0=use_climb_direction, Stream1=larger.LargerThan)
use_climb_direction_2 = Panel(filter)

spindle_speed = Slider(24000, range=6000..24000)
safe_z = Slider(2, range=0..20)
use_trochoidal_peck_entry = BooleanToggle(False)

# ----
# Advanced 2D settings:
pocket_raster_direction_along_y = BooleanToggle(False)
raster_direction_along_y = Panel(pocket_raster_direction_along_y)

cutout_tolerance = Slider(0, range=-0.5..0.5)
cutout_tolerance_2 = Panel(cutout_tolerance)

pocket_stepover = Slider(0.75, range=0..1)
pocket_stepover_2 = Panel(pocket_stepover)

# ---- group: Advanced trace settings
trace_tolerance = Slider(0, range=-0.5..0.5)
trace_tolerance_2 = Panel(trace_tolerance)
trace_stepover_0_1 = Panel("0.7")
trace_pass_depth = Panel("0.2")
climb_mill_traces = BooleanToggle(True)

# ---- group: CNC mill input geometery
cnc_drill_curves = Curve()
cnc_cutout_curves = Curve()
pipeline = GeometryPipeline(
    GroupByLayer=False,
    GroupByType=False,
    IncludeHidden=True,
    IncludeLocked=True,
    LayerFilter="CNC drill",
    NameFilter="*",
    TypeFilter=4)
tab_breps = Brep()
pipeline_2 = GeometryPipeline(
    GroupByLayer=False,
    GroupByType=False,
    IncludeHidden=True,
    IncludeLocked=True,
    LayerFilter="CNC engrave",
    NameFilter="*",
    TypeFilter=4)
pipeline_3 = GeometryPipeline(
    GroupByLayer=False,
    GroupByType=False,
    IncludeHidden=True,
    IncludeLocked=True,
    LayerFilter="CNC cut",
    NameFilter="*",
    TypeFilter=4)
# Developed by Jens Dyvik / Fellesverkstedet
# 
# License: Creative Commons Attribution ShareAllike (cc-by-sa)
# GEOMETRY INPUT
# Add rhino geometry in the corresponding layers, or right click  to set geometry
cnc_engrave_curves = Curve()
pipeline_4 = GeometryPipeline(
    GroupByLayer=False,
    GroupByType=False,
    IncludeHidden=True,
    IncludeLocked=True,
    LayerFilter="CNC traces",
    NameFilter="*",
    TypeFilter=4)
pipeline_5 = GeometryPipeline(
    GroupByLayer=False,
    GroupByType=False,
    IncludeHidden=True,
    IncludeLocked=True,
    LayerFilter="CNC tabs",
    NameFilter="*",
    TypeFilter=1073741848)
cnc_trace_curves = Curve()

# ----
finsih_pass_offset_ratio_bit_diamter = Panel("0.03")
use_peck_entry = Panel(use_trochoidal_peck_entry)
trochoidal_toolpath_width_factor = Panel("2.3")
# fix - slice objects true triggers camera to be set to 1:1 location
reroute_circular_curves_to_drill_instead = Panel("True")  # "Reroute circular curves to drill instead traces"

cnc_line_engrave_curves = Curve(reparameterize(flatten([pipeline_2, cnc_engrave_curves])))
engrave = Engrave(engrave_curves=cnc_line_engrave_curves, cut_depth=trace_depth, pass_depth=trace_pass_depth)

# ---- group: Create toolapths for traces
# Toolpath generation:
# Fix climb/conventional!
cutout_with_offsets = CutoutWithOffsets(
    curves_for_cutout_with_offsets=[pipeline_4, cnc_trace_curves],
    cut_depth=trace_depth,
    pass_depth=trace_pass_depth,
    tool_diameter=trace_milling_bit_diameter,
    number_of_offsets=number_of_trace_offsets,
    stepover=trace_stepover_0_1,
    cutout_tolerance=trace_tolerance_2,
    use_climb_direction=climb_mill_traces,
    use_inside_cutting=mill_traces_on,
    mill_outer_layer_first=False)  # -> toolpaths_2, unused_open_curves_2

# ----
cnc_drill_curves_2 = Curve(reparameterize(flatten([pipeline, cnc_drill_curves])))
drill = Drill(drill_curves=cnc_drill_curves_2, I=drill_depth_from_easy_interface, I_2=drill_diameter)  # -> drill_toolpaths_3, drill_preview_geometry_3

merge = Merge(Data1=cutout_with_offsets.toolpaths_2, Data2=engrave)

# ---- group: Create warning about open curves
warning_text = Panel("Open curve removed  from operation")
unused_open_curves = Curve(cutout_with_offsets.unused_open_curves_2)
end = EndPoints(Curve=unused_open_curves)  # -> Start, End
tag = TextTag(Location=end.Start, Text=warning_text)

# ---- group: Make preview colors
number_of_color_types_to_make = Panel("5")
number_slider = Slider(0.7, range=0..1)
# Preview generation:
series = Series(Start=Slider(0.39, range=0..1), Step=Slider(0.073, range=0..1), Count=number_of_color_types_to_make)
rev = ReverseList(List=series)
item = ListItem(List=rev, Index="3", Wrap=True)
item_2 = ListItem(List=rev, Index="4", Wrap=True)
item_3 = ListItem(List=rev, Index="1", Wrap=True)
item_4 = ListItem(List=rev, Index="2", Wrap=True)
item_5 = ListItem(List=rev, Index="0", Wrap=True)
hsl = ColourHSL(Alpha=1, Hue=item_3, Saturation=1, Luminance=number_slider)
hsl_2 = ColourHSL(Alpha=1, Hue=item_4, Saturation=1, Luminance=number_slider)
hsl_3 = ColourHSL(Alpha=1, Hue=item, Saturation=1, Luminance=number_slider)
hsl_4 = ColourHSL(Alpha=1, Hue=item_5, Saturation=1, Luminance=number_slider)
hsl_5 = ColourHSL(Alpha=1, Hue=item_2, Saturation=1, Luminance=number_slider)
_3d_rough_color = Colour(hsl_3)
_3d_finish_color = Colour(hsl_5)
pocket_color = Colour(hsl_4)
engrave_color = Colour(hsl)
cut_color = Colour(hsl_2)

# ---- group: Make machine wireframe preview
neg = Negative(Value=board_thickness)
machine_preview_curves = Curve()
Z = UnitZ(Factor=neg)
move = Move(Geometry=flatten(machine_preview_curves), Motion=Z)  # -> Geometry, Transform
preview = CustomPreview(Geometry=move.Geometry, Shader=ColourSwatch(SwatchColor=RGB(125, 125, 125)))

# ----
# 2D SETTINGS
milling_bit_diameter = Slider(6.9, range=0..10)
use_auto_settings_2 = BooleanToggle(True)

pass_depth = Slider(2, range=0.4..20)
use_auto_settings_3 = BooleanToggle(True)

plunge_rate = Slider(20, range=6..80)
use_auto_settings_4 = BooleanToggle(True)

feed_rate = Slider(62, range=6..200)
use_auto_settings_5 = BooleanToggle(True)

ramp_angle = Slider(0.8, range=0.2..101)
use_auto_settings_6 = BooleanToggle(True)

use_auto_settings_7 = BooleanToggle(True)
ramp_plunges = BooleanToggle(False)

# ---- group: ShopBot PostProcessor settings
make_shopbot_code_not_g_code = BooleanToggle(False)
custom_start_g_code_3 = Panel(custom_start_g_code_2)
custom_end_g_code = Panel("M5")
custom_end_sbp_code = Panel("""END
Canceljob:	'define the name of the sub routine
	MSGBOX (Please specificy the correct material thickness in you CAM program and try again,16,Shame on you)	'define the message box of shame
END	'end the job""")
safe_z_height = Panel(safe_z)
spindle_speed_2 = Panel(spindle_speed)
jog_rate_xy_mm_s = Panel(jog_rate_xy)
jog_rate_z_mm_s = Panel(jog_rate_z)
worka_area_size_x = Panel("150")
worka_area_size_y = Panel("220")
end_of_job_go_to_x_position = Panel("75")
end_of_job_go_to_y_position = Panel("220")
deviation_tolerance_2 = Panel(deviation_tolerance)
job_name = Panel("Bark beetle stream")
use_trochoidal_milling = Panel(use_high_speed_maching)
include_start_code = BooleanToggle(True)
include_end_code = BooleanToggle(True)
use_spindle = BooleanToggle(True)

# ----
custom_start_sbp_code = CustomStartSBPCode(material_thicness=board_thickness, safe_z_height=safe_z_height)
filter_2 = StreamFilter(Gate=make_shopbot_code_not_g_code, Stream0=custom_end_g_code, Stream1=custom_end_sbp_code)
filter_3 = StreamFilter(Gate=include_end_code, Stream1=filter_2)

# ---- group: Make work area preview
worka_area_size_y_2 = Panel(worka_area_size_y)
worka_area_size_x_2 = Panel(worka_area_size_x)
dom = ConstructDomain(DomainStart="0", DomainEnd=worka_area_size_x_2)
dom_2 = ConstructDomain(DomainStart="0", DomainEnd=worka_area_size_y_2)
rectangle = Rectangle(Plane=PlaneXY(0, 0, 0), XSize=dom, YSize=dom_2, Radius=0)  # -> Rectangle, Length
machine_work_area = Curve(rectangle.Rectangle)
divide_curve_even_lenght = DivideCurveEvenLenght(crv=machine_work_area, B="1.6")
swatch = ColourSwatch(SwatchColor=RGB(161, 247, 255))
preview_2 = CustomPreview(Geometry=machine_work_area, Shader=swatch)
dots = DotDisplay(Point=divide_curve_even_lenght, Colour=swatch, Size=".8")  # disabled

# ---- group: trace
settings_generator = FeedRateLibraryExperimemtal(
    material_id=material_traces,
    bit_diameter=trace_milling_bit_diameter,
    bit_type_id=0,
    number_of_flutes=number_of_flutes,
    spindle_rpm=spindle_speed_2,
    use_high_speed_maching=0,
    toolpath_width_factor=2.3,
    pass_depth_factor=pass_depth_factor,
    feed_rate_factor=feed_rate_factor)  # -> feed_rate_4, plunge_rate_4, pass_depth_4, ramp_plunges_4, ramp_angle_4, trochoidal_stepover_2, toolpath_width_2, actual_bit_diameter_3

# ---- group: cutout
settings_generator_2 = FeedRateLibraryExperimemtal(
    material_id=material_cutout,
    bit_diameter=cutout_bit_diameter,
    bit_type_id=bit_type,
    number_of_flutes=number_of_flutes_2,
    spindle_rpm=spindle_speed_2,
    use_high_speed_maching=use_high_speed_maching,
    toolpath_width_factor=trochoidal_toolpath_width_factor,
    pass_depth_factor=pass_depth_factor_3,
    feed_rate_factor=feed_rate_factor_3)  # -> feed_rate_4, plunge_rate_4, pass_depth_4, ramp_plunges_4, ramp_angle_4, trochoidal_stepover_2, toolpath_width_2, actual_bit_diameter_3

# ----
bit_diameter_from_easy_interface = Panel(settings_generator_2.toolpath_width_2)
feed_rate_from_easy_interface = Panel(settings_generator_2.feed_rate_4)
plunge_rate_from_easy_interface = Panel(settings_generator_2.plunge_rate_4)
pass_depth_from_easy_interface = Panel(settings_generator_2.pass_depth_4)
ramp_plunges_from_easy_interface = Panel(settings_generator_2.ramp_plunges_4)
ramp_angle_from_easy_interface = Panel(settings_generator_2.ramp_angle_4)

filter_4 = StreamFilter(Gate=use_auto_settings_7, Stream0=ramp_plunges, Stream1=ramp_plunges_from_easy_interface)
ramp_plunges_2 = Panel(filter_4)

filter_5 = StreamFilter(Gate=use_auto_settings_6, Stream0=ramp_angle, Stream1=ramp_angle_from_easy_interface)
ramp_angle_2 = Panel(filter_5)

filter_6 = StreamFilter(Gate=use_auto_settings_3, Stream0=pass_depth, Stream1=pass_depth_from_easy_interface)
pass_depth_2 = Panel(filter_6)

filter_7 = StreamFilter(Gate=use_auto_settings_5, Stream0=feed_rate, Stream1=feed_rate_from_easy_interface)
feed_rate_mm_s = Panel(filter_7)

filter_8 = StreamFilter(Gate=use_auto_settings_4, Stream0=plunge_rate, Stream1=plunge_rate_from_easy_interface)
plunge_rate_mm_s = Panel(filter_8)

filter_9 = StreamFilter(Gate=use_auto_settings_2, Stream0=milling_bit_diameter, Stream1=bit_diameter_from_easy_interface)
# Main
milling_bit_diameter_2 = Panel(filter_9)

# ---- group: ShopBot PostProcessor settings (continued)
custom_start_sbp_code_2 = Panel(custom_start_sbp_code)
trochoidal_stepover = Panel(settings_generator_2.trochoidal_stepover_2)
actual_milling_bit_diamter = Panel(settings_generator_2.actual_bit_diameter_3)

# ----
filter_10 = StreamFilter(Gate=make_shopbot_code_not_g_code, Stream0=custom_start_g_code_3, Stream1=custom_start_sbp_code_2)
filter_11 = StreamFilter(Gate=include_start_code, Stream1=filter_10)

# ---- group: drill
settings_generator_3 = FeedRateLibraryExperimemtal(
    material_id=material_cutout,
    bit_diameter=drill_diameter,
    bit_type_id=0,
    number_of_flutes=number_of_flutes_3,
    spindle_rpm=spindle_speed_2,
    use_high_speed_maching=0,
    toolpath_width_factor=2.3,
    pass_depth_factor=pass_depth_factor_2,
    feed_rate_factor=feed_rate_factor_2)  # -> feed_rate_4, plunge_rate_4, pass_depth_4, ramp_plunges_4, ramp_angle_4, trochoidal_stepover_2, toolpath_width_2, actual_bit_diameter_3

# ----
cutout_curves_from_automill = Curve()
cutout_curves_from_3d_mesh = Curve()
finsih_pass_offset_ratio_bit_diamter_2 = Panel(finsih_pass_offset_ratio_bit_diamter)
cutout_depths_from_automill = Number()
milling_bit_diameter_3 = Panel(milling_bit_diameter_2)
make_finsih_pass = Panel(make_finish_pass)
cutout_depths_from_3d_mesh = Number()
merge_2 = Merge(Data1=flatten(cutout_curves_from_automill), Data2=flatten(cutout_curves_from_3d_mesh))
multiplication = Multiplication(A=milling_bit_diameter_3, B=finsih_pass_offset_ratio_bit_diamter_2)
merge_3 = Merge(Data1=flatten(cutout_depths_from_automill), Data2=flatten(cutout_depths_from_3d_mesh))
addition_3 = Addition(A=milling_bit_diameter_3, B=multiplication)
filter_12 = StreamFilter(Gate=make_finsih_pass, Stream0=milling_bit_diameter_3, Stream1=addition_3)
cut_depths_from_automill_and_3d_mesh = Number(merge_3)
tab_breps_2 = Brep(flatten([pipeline_5, tab_breps]))
use_inside_cutting_from_easy_interface_2 = Panel(use_inside_cutting)
make_dogbones_2 = Panel(make_dogbones_from_easy_interface)
corner_angle_threshold = Panel(dogbone_corner_angle_threshold_2)
milling_bit_diameter_4 = Panel(milling_bit_diameter_3)
filter_13 = StreamFilter(Gate=use_inside_cutting_from_easy_interface_2, Stream0=Toggle(False), Stream1=Toggle(True))
milling_bit_diameter_before_finish = Panel(filter_12)

item_6 = ListItem(List=merge_2, Index=0, Wrap=True)
null = NullItem(Item=item_6)  # -> NullFlags, InvalidFlags, Description
filter_14 = StreamFilter(Gate=null.NullFlags, Stream0=merge_2, Stream1=[pipeline_3, cnc_cutout_curves])

cut_depths_from_automill_and_3d_mesh_2 = Number(cut_depths_from_automill_and_3d_mesh)
item_7 = ListItem(List=cut_depths_from_automill_and_3d_mesh_2, Index=0, Wrap=True)
null_2 = NullItem(Item=item_7)  # -> NullFlags, InvalidFlags, Description
filter_15 = StreamFilter(Gate=null_2.NullFlags, Stream0=cut_depths_from_automill_and_3d_mesh_2, Stream1=cutout_depth_from_easy_interface)

cnc_cutout_curves_2 = Curve(reparameterize(flatten(filter_14)))
gate = StreamGate(Stream=cnc_cutout_curves_2, Gate=make_dogbones_2)  # -> Target0, Target1
dogbone_maker = DogboneMaker(
    curves_to_dogbone=gate.Target1,
    milling_bit_diameter=milling_bit_diameter_4,
    corner_angle_threshold=corner_angle_threshold,
    flip_cornes_boolean=filter_13)
filter_16 = StreamFilter(Gate=make_dogbones_2, Stream0=gate.Target0, Stream1=dogbone_maker)
gate_2 = StreamGate(Stream=filter_16, Gate=make_finsih_pass)  # -> Target0, Target1
cutout = CutoutOrProfile(
    curves_for_cutout=filter_16,
    cut_depth=filter_15,
    pass_depth=pass_depth_2,
    tool_diameter=milling_bit_diameter_before_finish,
    cutout_tolerance=cutout_tolerance_2,
    use_climb_direction=use_climb_direction_2,
    use_inside_cutting=use_inside_cutting_from_easy_interface)
cutout_2 = CutoutOrProfile(
    curves_for_cutout=gate_2.Target1,
    cut_depth=filter_15,
    pass_depth=filter_15,
    tool_diameter=milling_bit_diameter_4,
    cutout_tolerance=cutout_tolerance_2,
    use_climb_direction=use_climb_direction_2,
    use_inside_cutting=use_inside_cutting_from_easy_interface)
merge_4 = Merge(Data1=cutout, Data2=cutout_2)
clean = CleanTree(RemoveNulls=True, RemoveInvalid=True, RemoveEmpty=False, Tree=merge_4)

cnc_milling_postprocessor = CNCMillingPostProcessor(
    toolpath_curves=drill.drill_toolpaths_3,
    tab_breps=tab_breps_2,
    feed_rate=settings_generator_3.plunge_rate_4,
    plunge_rate=settings_generator_3.plunge_rate_4,
    jog_rate=jog_rate_xy_mm_s,
    jog_rate_z=jog_rate_z_mm_s,
    safe_z_height=safe_z_height,
    use_spindle=use_spindle,
    spindle_speed=spindle_speed_2,
    ramp_plunges=ramp_plunges_2,
    ramp_angle=ramp_angle_2,
    start_code=filter_11,
    end_code=filter_3,
    make_shopbot_code_not_g_code=make_shopbot_code_not_g_code,
    custom_home_x=end_of_job_go_to_x_position,
    custom_home_y=end_of_job_go_to_y_position,
    deviation_tolerance=deviation_tolerance_2,
    use_high_speed_machining=0,
    milling_bit_diameter=milling_bit_diameter_2,
    toolpath_width_factor=2.3,
    stepover=0.1,
    use_peck_entry=False,
    job_name=job_name)  # -> g_code_stream, g_code_for_tab_cleanup, toolpath_preview_curves_2, tab_cleanup_preview_curves_2, cut_transition_preview_lines_2, cut_entry_preview_lines_2, cut_exit_preview_lines_2
# Post processing, set output directory here:
cnc_milling_postprocessor_2 = CNCMillingPostProcessor_2(
    toolpath_curves=merge,
    tab_breps=tab_breps_2,
    feed_rate=settings_generator.feed_rate_4,
    plunge_rate=settings_generator.plunge_rate_4,
    jog_rate=jog_rate_xy_mm_s,
    jog_rate_z=jog_rate_z_mm_s,
    safe_z_height=safe_z_height,
    use_spindle=use_spindle,
    spindle_speed=spindle_speed_2,
    ramp_plunges=ramp_plunges_2,
    ramp_angle=ramp_angle_2,
    start_code=filter_11,
    end_code=filter_3,
    make_shopbot_code_not_g_code=make_shopbot_code_not_g_code,
    custom_home_x=end_of_job_go_to_x_position,
    custom_home_y=end_of_job_go_to_y_position,
    deviation_tolerance=deviation_tolerance_2,
    use_high_speed_machining=use_trochoidal_milling,
    milling_bit_diameter=actual_milling_bit_diamter,
    toolpath_width_factor=trochoidal_toolpath_width_factor,
    stepover=trochoidal_stepover,
    use_peck_entry=use_peck_entry,
    job_name=job_name)  # -> g_code_stream, g_code_for_tab_cleanup, toolpath_preview_curves_2, tab_cleanup_preview_curves_2, cut_transition_preview_lines_2, cut_entry_preview_lines_2, cut_exit_preview_lines_2
cnc_milling_postprocessor_3 = CNCMillingPostProcessor_2(
    toolpath_curves=clean,
    tab_breps=tab_breps_2,
    feed_rate=feed_rate_mm_s,
    plunge_rate=plunge_rate_mm_s,
    jog_rate=jog_rate_xy_mm_s,
    jog_rate_z=jog_rate_z_mm_s,
    safe_z_height=safe_z_height,
    use_spindle=use_spindle,
    spindle_speed=spindle_speed_2,
    ramp_plunges=ramp_plunges_2,
    ramp_angle=ramp_angle_2,
    start_code=filter_11,
    end_code=filter_3,
    make_shopbot_code_not_g_code=make_shopbot_code_not_g_code,
    custom_home_x=end_of_job_go_to_x_position,
    custom_home_y=end_of_job_go_to_y_position,
    deviation_tolerance=deviation_tolerance_2,
    use_high_speed_machining=use_trochoidal_milling,
    milling_bit_diameter=actual_milling_bit_diamter,
    toolpath_width_factor=trochoidal_toolpath_width_factor,
    stepover=trochoidal_stepover,
    use_peck_entry=use_peck_entry,
    job_name=job_name)  # -> g_code_stream, g_code_for_tab_cleanup, toolpath_preview_curves_2, tab_cleanup_preview_curves_2, cut_transition_preview_lines_2, cut_entry_preview_lines_2, cut_exit_preview_lines_2

# ---- group: Trace mill G-code
stream_and_save_as_code = Panel(cnc_milling_postprocessor_2.g_code_stream)

# ---- group: Drill G-code
stream_and_save_as_code_2 = Panel(cnc_milling_postprocessor.g_code_stream)

# ---- group: Cutout G-code
stream_and_save_as_code_3 = Panel(cnc_milling_postprocessor_3.g_code_stream)

# ---- group: Tab cleanup G-code
stream_and_save_as_code_4 = Panel(cnc_milling_postprocessor_3.g_code_for_tab_cleanup)

# ----
tab_cleanup_preview_lines = Curve(cnc_milling_postprocessor_3.tab_cleanup_preview_curves_2)

# ---- group: Toolpath preview
pocket_toolpaths = Curve(cnc_milling_postprocessor_2.toolpath_preview_curves_2)
_3d_rough_toolpaths = Curve()
_3d_finish_toolpaths = Curve()
cut_transition_preview_lines = Curve([cnc_milling_postprocessor.cut_transition_preview_lines_2, cnc_milling_postprocessor_3.cut_transition_preview_lines_2, cnc_milling_postprocessor_2.cut_transition_preview_lines_2])
cut_exit_preview_lines = Curve([cnc_milling_postprocessor.cut_exit_preview_lines_2, cnc_milling_postprocessor_3.cut_exit_preview_lines_2, cnc_milling_postprocessor_2.cut_entry_preview_lines_2])
engrave_toolpaths = Curve()
cut_toolpaths = Curve(cnc_milling_postprocessor_3.toolpath_preview_curves_2)
cut_entry_preview_lines = Curve([cnc_milling_postprocessor.cut_entry_preview_lines_2, cnc_milling_postprocessor_3.cut_entry_preview_lines_2, cnc_milling_postprocessor_2.cut_entry_preview_lines_2])
use_inside_cutting_2 = Panel(use_inside_cutting_from_easy_interface)
engrave_color_2 = Colour(engrave_color)
_3d_rough_color_2 = Colour(_3d_rough_color)
_3d_finish_color_2 = Colour(_3d_finish_color)
pocket_color_2 = Colour(pocket_color)
cut_color_2 = Colour(cut_color)
drill_preview_geometry = Curve(drill.drill_preview_geometry_3)
jog_transitions = ColourSwatch(SwatchColor=RGB(71, 61, 38))
tab_cleanup = ColourSwatch(SwatchColor=RGB(74, 74, 74))
hold_down = ColourSwatch(SwatchColor=RGB(255, 191, 0))
cut_entries = ColourSwatch(SwatchColor=RGB(145, 193, 194))
filter_17 = StreamFilter(Gate=use_inside_cutting_2, Stream0=_3d_finish_color_2, Stream1=ColourSwatch(SwatchColor=RGB(255, 61, 155)))
cut_exits = ColourSwatch(SwatchColor=RGB(61, 88, 89))
filter_18 = StreamFilter(Gate=use_inside_cutting_2, Stream0=engrave_color_2, Stream1=ColourSwatch(SwatchColor=RGB(255, 61, 155)))
filter_19 = StreamFilter(Gate=use_inside_cutting_2, Stream0=pocket_color_2, Stream1=ColourSwatch(SwatchColor=RGB(255, 61, 155)))
filter_20 = StreamFilter(Gate=use_inside_cutting_2, Stream0=cut_color_2, Stream1=ColourSwatch(SwatchColor=RGB(255, 61, 155)))
filter_21 = StreamFilter(Gate=use_inside_cutting_2, Stream0=_3d_rough_color_2, Stream1=ColourSwatch(SwatchColor=RGB(255, 61, 155)))
preview_3 = CustomPreview(Geometry=_3d_finish_toolpaths, Shader=filter_17)
preview_4 = CustomPreview(Geometry=cut_transition_preview_lines, Shader=jog_transitions)
preview_5 = CustomPreview(Geometry=cut_entry_preview_lines, Shader=cut_entries)
preview_6 = CustomPreview(Geometry=cut_exit_preview_lines, Shader=cut_exits)
preview_7 = CustomPreview(Geometry=drill_preview_geometry, Shader=hold_down)
preview_8 = CustomPreview(Geometry=engrave_toolpaths, Shader=filter_18)
preview_9 = CustomPreview(Geometry=tab_cleanup_preview_lines, Shader=tab_cleanup)
preview_10 = CustomPreview(Geometry=pocket_toolpaths, Shader=filter_19)
preview_11 = CustomPreview(Geometry=cut_toolpaths, Shader=filter_20)
preview_12 = CustomPreview(Geometry=_3d_rough_toolpaths, Shader=filter_21)

# ----
all_toolpath_preview_curves = Curve(flatten([cnc_milling_postprocessor.toolpath_preview_curves_2, cnc_milling_postprocessor_3.toolpath_preview_curves_2, cnc_milling_postprocessor_2.toolpath_preview_curves_2]))

len = Length(Curve=cut_transition_preview_lines)
jog_rate = Panel("150")
ma = MassAddition(Input=len)  # -> Result, PartialResults
panel = Panel(ma.Result)
division = Division(A=panel, B=jog_rate)
division_2 = Division(A=division, B="60")
estimated_time = Panel(division_2)

len_2 = Length(Curve=all_toolpath_preview_curves)
feed_rate_2 = Panel(feed_rate_mm_s)
ma_2 = MassAddition(Input=len_2)  # -> Result, PartialResults
panel_2 = Panel(ma_2.Result)
division_3 = Division(A=panel_2, B=feed_rate_2)
division_4 = Division(A=division_3, B="60")
estimated_time_2 = Panel(division_4)

len_3 = Length(Curve=[cut_entry_preview_lines, cut_exit_preview_lines])
feed_rate_3 = Panel(feed_rate_mm_s)
ma_3 = MassAddition(Input=len_3)  # -> Result, PartialResults
panel_3 = Panel(ma_3.Result)
division_5 = Division(A=panel_3, B=feed_rate_3)
division_6 = Division(A=division_5, B="60")
estimated_time_3 = Panel(division_6)

# ---- group: find deepest Z for summary info
find_deepest_z = FindDeepestZ(toolpaths=all_toolpath_preview_curves)
deepest_z = Panel(find_deepest_z)

# ----
ma_4 = MassAddition(Input=[estimated_time_2, estimated_time, estimated_time_3])  # -> Result, PartialResults
estimated_job_minutes = Integer(ma_4.Result)
estimated_time_4 = Panel(estimated_job_minutes)

# ---- group: trace (continued)
compile_settings = CompileSettings(
    estimated_job_time=estimated_time_4,
    feed_rate=settings_generator.feed_rate_4,
    plunge_rate=settings_generator.plunge_rate_4,
    spindle_rpm=spindle_speed_2,
    pass_depth=trace_pass_depth,
    ramp_plunges=ramp_plunges_2,
    ramp_angle=ramp_angle_2,
    deepest_z=find_deepest_z)  # -> complete_settings, crucial_settings

# ---- group: Current trace settings
panel_4 = Panel(compile_settings.complete_settings)

# ---- group: cutout (continued)
compile_settings_2 = CompileSettings(
    estimated_job_time=estimated_time_4,
    feed_rate=feed_rate_mm_s,
    plunge_rate=plunge_rate_mm_s,
    spindle_rpm=spindle_speed_2,
    pass_depth=pass_depth_2,
    ramp_plunges=ramp_plunges_2,
    ramp_angle=ramp_angle_2,
    deepest_z=find_deepest_z)  # -> complete_settings, crucial_settings

# ---- group: Current cutout settings
panel_5 = Panel(compile_settings_2.complete_settings)

# ---- group: drill (continued)
compile_settings_3 = CompileSettings(
    estimated_job_time=estimated_time_4,
    feed_rate=settings_generator_3.plunge_rate_4,
    plunge_rate=settings_generator_3.plunge_rate_4,
    spindle_rpm=spindle_speed_2,
    pass_depth=pass_depth_2,
    ramp_plunges=ramp_plunges_2,
    ramp_angle=ramp_angle_2,
    deepest_z=find_deepest_z)  # -> complete_settings, crucial_settings

# ---- group: Current drill settings
panel_6 = Panel(compile_settings_3.complete_settings)

# ==== cluster Drill: Creates a drilling toolpath from the center of the input geometry, usually circles. Handy for making pre milling hold down holes. Pro-tip: Make your input circle diameter the diameter of your screw head + 2x the diameter of your milling bit. Then you know how close you can place your screw holes o your cutting geometry. If your screw hole circle and cutting geometry overlap, you are in trouble.
I = ClusterInput()
I_2 = ClusterInput()
default_tool_diameter = Panel("6")
default_drill_depth = Panel("10")
null = NullItem(Item=I_2)  # -> NullFlags, InvalidFlags, Description
null_2 = NullItem(Item=I)  # -> NullFlags, InvalidFlags, Description
drill_curves = ClusterInput()
filter = StreamFilter(Gate=null.NullFlags, Stream0=I_2, Stream1=default_tool_diameter)
filter_2 = StreamFilter(Gate=null_2.NullFlags, Stream0=I, Stream1=default_drill_depth)

# ---- group: Creat hold down drill lines
drill_curves_2 = Curve(drill_curves)
drill_depth = Number(filter_2)
area = Area(Geometry=drill_curves_2)  # -> Area, Centroid
drill_depth_2 = Panel(drill_depth)
pdecon = Deconstruct(Point=area.Centroid)  # -> XComponent, YComponent, ZComponent
pt = ConstructPoint(XCoordinate=pdecon.XComponent, YCoordinate=pdecon.YComponent, ZCoordinate=0)
neg = Negative(Value=drill_depth_2)
Z = UnitZ(Factor=neg)
move = Move(Geometry=pt, Motion=Z)  # -> Geometry, Transform
ln = Line(StartPoint=pt, EndPoint=move.Geometry)

# ----
tool_diameter_for_preview = Number(filter)

# ---- group: Create hold down preview circles
drill_toolpaths = Curve(ln)
tool_diameter = Panel(tool_diameter_for_preview)
end = EndPoints(Curve=drill_toolpaths)  # -> Start, End
multiplication = Multiplication(A=tool_diameter, B="0.5")
pt_2 = Point(end.Start)
neg_2 = Negative(Value=multiplication)
neg_3 = Negative(Value=multiplication)
X = UnitX(Factor=multiplication)
X_2 = UnitX(Factor=neg_3)
Y = UnitY(Factor=neg_2)
Y_2 = UnitY(Factor=multiplication)
move_2 = Move(Geometry=pt_2, Motion=Y)  # -> Geometry, Transform
xy = XYPlane(Origin=pt_2)
move_3 = Move(Geometry=pt_2, Motion=X_2)  # -> Geometry, Transform
move_4 = Move(Geometry=pt_2, Motion=Y_2)  # -> Geometry, Transform
move_5 = Move(Geometry=pt_2, Motion=X)  # -> Geometry, Transform
cir = Circle(Plane=xy, Radius=multiplication)
ln_2 = Line(StartPoint=move_4.Geometry, EndPoint=move_2.Geometry)
ln_3 = Line(StartPoint=move_5.Geometry, EndPoint=move_3.Geometry)
drill_preview_geometry = Curve([ln_3, ln_2, cir])

# ----
drill_preview_geometry_2 = Curve(drill_preview_geometry)
drill_toolpaths_2 = Curve(ln)
drill_preview_geometry_3 = ClusterOutput(drill_preview_geometry_2)
drill_toolpaths_3 = ClusterOutput(drill_toolpaths_2)

# ==== cluster Engrave: Creates toolpaths with pass depths from 2D and 3D curves. Handy for making your own freestyle toolpaths. Be careful about start depths of your curves. Pass depth and cut depth assumes your input curve starts at surface level (Z0).
engrave_curves = ClusterInput()
pass_depth = ClusterInput()
cut_depth = ClusterInput()
engrave_curves_2 = Curve(engrave_curves)
pass_depth_2 = Number(pass_depth)
cut_depth_2 = Number(cut_depth)
pass_depth_3 = Panel(pass_depth_2)
cut_depth_line_engrave = Panel(cut_depth_2)
division = Division(A=cut_depth_line_engrave, B=pass_depth_3)
round = Round(Number=division)  # -> Nearest, Floor, Ceiling
division_2 = Division(A=cut_depth_line_engrave, B=round.Ceiling)
actual_pass_depth = Panel(division_2)
series = Series(Start=actual_pass_depth, Step=actual_pass_depth, Count=round.Ceiling)
neg = Negative(Value=series)
null = NullItem(Item=division_2)  # -> NullFlags, InvalidFlags, Description
filter = StreamFilter(Gate=null.NullFlags, Stream0=neg, Stream1="0")
Z = UnitZ(Factor=filter)
move = Move(Geometry=graft(engrave_curves_2), Motion=Z)  # -> Geometry, Transform
flatten = FlattenTree(Tree=move.Geometry, Path="{0}")
clean = CleanTree(RemoveNulls=True, RemoveInvalid=True, RemoveEmpty=False, Tree=flatten)
engrave_toolpaths = Curve(clean)
engrave_toolpaths_2 = ClusterOutput(engrave_toolpaths)

# ==== cluster CutoutOrProfile: Creates cutout toolpaths from closed flat 2D curves. Compensates for the diameter of your milling bit. It will detect curves inside curves. Inside curves will be cut first and on the inside of the curve. Outside curves last and on the outside of the curve. Note: Only one level of curve inside curve is supported. Use multiple setups to achieve a cure inside a curve inside a curve. Supports climb and conventional. Supports inside cutting, but remember to switch of when your are done cutting a inside hole. Cutting your outer geometry on the inside is classic.
use_climb_direction = ClusterInput()
use_inside_cutting = ClusterInput()
curves_for_cutout = ClusterInput()
cutout_tolerance = ClusterInput()
tool_diameter = ClusterInput()
pass_depth = ClusterInput()
cut_depth = ClusterInput()
use_climb_direction_2 = Integer(use_climb_direction)
use_inside_cutting_2 = Integer(use_inside_cutting)
curves_for_cutout_2 = Curve(curves_for_cutout)
cutout_tolerance_2 = Number(cutout_tolerance)
tool_diameter_2 = Number(tool_diameter)
pass_depth_2 = Number(pass_depth)
cut_depth_2 = Number(cut_depth)
tool_diameter_3 = Panel(tool_diameter_2)
use_climb_direction_3 = Panel(use_climb_direction_2)
use_inside_cutting_3 = Panel(use_inside_cutting_2)

# ---- group: Filter out open curves
curves_for_cutout_3 = Curve(curves_for_cutout_2)
cls = Closed(Curve=curves_for_cutout_3)  # -> Closed, Periodic
dispatch = Dispatch(List=curves_for_cutout_3, DispatchPattern=cls.Closed)  # -> ListA, ListB

# ----
xy = XYPlane(Origin=Point(0, 0, 0))
operation_plane = Plane(xy)
multiplication = Multiplication(A=tool_diameter_3, B="0.5")
cutout_tolerance_3 = Panel(cutout_tolerance_2)
tool_radius = Panel(multiplication)

# ---- group: Re-join to assist in offsetting
explode = Explode(Curve=dispatch.ListA, Recursive=True)  # -> Segments, Vertices
crv = Curve(graft(dispatch.ListA))
join = JoinCurves(Curves=explode.Segments, Preserve=False)
cls_2 = Closed(Curve=join)  # -> Closed, Periodic
p_n_c = PickNChoose(Pattern=cls_2.Closed, Stream0=crv, Stream1=join)
flatten = FlattenTree(Tree=p_n_c, Path="{0}")

# ----
addition = Addition(A=tool_radius, B=cutout_tolerance_3)
compensated_tool_radius = Panel(addition)

# ---- group: Project onto XY plane for safety
xy_2 = XYPlane(Origin=Point(0, 0, 0))
project = Project(Geometry=flatten, Plane=xy_2)  # -> Geometry, Transform

# ---- group: Merge overlapping curves
curves_for_merging_overlap = Curve(project.Geometry)
mcx = MultipleCurves(Curves=curves_for_merging_overlap)  # -> Points, IndexA, IndexB, ParamA, ParamB
dcon = DeleteConsecutive(Set=[mcx.IndexA, mcx.IndexB], Wrap=False)  # -> Set, Count
item = ListItem(List=curves_for_merging_overlap, Index=dcon.Set, Wrap=True)
cull_i = CullIndex(List=curves_for_merging_overlap, Indices=dcon.Set, Wrap=True)
runion = RegionUnion(Curves=item, Plane=operation_plane)
merged_overlapping_curves = Curve([runion, cull_i])

# ----
use_inside_cutting_4 = Panel(use_inside_cutting_3)
distance_to_offset = Number(compensated_tool_radius)
operation_plane_2 = Plane(operation_plane)
offset_plane = Plane(operation_plane_2)
neg = Negative(Value=compensated_tool_radius)
abs = Absolute(Value=distance_to_offset)
feedback = Text()
pass_depth_3 = Number(pass_depth_2)
cut_depth_3 = Number(cut_depth_2)

# ---- group: Align curve directions
curves_for_aligned_direction = Curve(merged_overlapping_curves)
graft = GraftTree(Tree=curves_for_aligned_direction, IncludeEmptyLists=True, IncludeNullItems=True)
offset = Offset(Curve=graft, Distance="0.01", Plane=PlaneXY(0, 0, 0), Corners=2)
end = EndPoints(Curve=offset)  # -> Start, End
pshift = ShiftPaths(Data=end.Start, Offset=-1)
incurve = PointInCurve(Point=pshift, Curve=graft)  # -> Relationship, Point
multiplication_2 = Multiplication(A=incurve.Relationship, B="0.5")
round = Round(Number=multiplication_2)  # -> Nearest, Floor, Ceiling
crv_2 = Curve(graft)
int = Integer(round.Nearest)
flip = FlipCurve(Curve=crv_2)  # -> Curve, Flag
weave = Weave(Pattern=int, Stream0=flip.Curve, Stream1=crv_2, NullGaps=False)
pshift_2 = ShiftPaths(Data=weave, Offset=-1)

# ----
flip_2 = FlipCurve(Curve=pshift_2)  # -> Curve, Flag
filter = StreamFilter(Gate=use_inside_cutting_4, Stream0=pshift_2, Stream1=flip_2.Curve)

# ---- group: Align curve directions (continued)
aligned_curves = Curve(filter)

# ---- group: Detect curves inside curves
aligned_curves_2 = Curve(aligned_curves)
graft_2 = GraftTree(Tree=aligned_curves_2, IncludeEmptyLists=True, IncludeNullItems=True)
end_2 = EndPoints(Curve=aligned_curves_2)  # -> Start, End
incurve_2 = PointInCurve(Point=end_2.Start, Curve=graft_2)  # -> Relationship, Point
multiplication_3 = Multiplication(A=incurve_2.Relationship, B="0.5")
round_2 = Round(Number=multiplication_3)  # -> Nearest, Floor, Ceiling
int_2 = Integer(round_2.Floor)
flip_3 = FlipMatrix(Data=int_2)
ma = MassAddition(Input=flip_3)  # -> Result, PartialResults
pshift_3 = ShiftPaths(Data=ma.Result, Offset=-1)
dispatch_2 = Dispatch(List=aligned_curves_2, DispatchPattern=pshift_3)  # -> ListA, ListB
curves_outside = Curve(dispatch_2.ListB)
curves_inside = Curve(dispatch_2.ListA)

# ----
curves_for_offset_outwards = Curve(curves_outside)
curves_for_offset_inwards = Curve(curves_inside)
curves_to_offset = Curve(curves_for_offset_inwards)
offset_2 = Offset(Curve=curves_to_offset, Distance=distance_to_offset, Plane=offset_plane, Corners=2)
offset_curves = Curve(offset_2)
cls_3 = Closed(Curve=offset_curves)  # -> Closed, Periodic
flatten_2 = FlattenTree(Tree=curves_for_offset_inwards, Path="{0}")
sort = SortList(Keys=flatten(cls_3.Closed))  # -> Keys, ValuesA
item_2 = ListItem(List=flatten_2, Index=0, Wrap=True)
null = NullItem(Item=item_2)  # -> NullFlags, InvalidFlags, Description
item_3 = ListItem(List=sort.Keys, Index=0, Wrap=True)
offset_3 = Offset(Curve=curves_for_offset_inwards, Distance=compensated_tool_radius, Plane=operation_plane_2, Corners=2)  # disabled
offset_4 = Offset(Curve=curves_for_offset_outwards, Distance=neg, Plane=operation_plane_2, Corners=2)
bool = Boolean(item_3)
offset_was_successfull = Panel(bool)
pshift_4 = ShiftPaths(Data=offset_4, Offset=-1)
outside_cutout_curves = Curve(pshift_4)
curves_to_offset_2 = Curve(curves_to_offset)
gate = StreamGate(Stream=curves_to_offset_2, Gate=offset_was_successfull)  # -> Target0, Target1
fillet = Fillet(Curve=gate.Target0, Radius=abs)
offset_5 = Offset(Curve=fillet, Distance=distance_to_offset, Plane=offset_plane, Corners=2)
fillet_offset_curves = Curve(offset_5)
cls_4 = Closed(Curve=fillet_offset_curves)  # -> Closed, Periodic
sort_2 = SortList(Keys=flatten(cls_4.Closed))  # -> Keys, ValuesA
item_4 = ListItem(List=sort_2.Keys, Index=0, Wrap=True)
bool_2 = Boolean(item_4)
fillet_offset_was_successfull = Panel(bool_2)
filter_2 = StreamFilter(Gate=fillet_offset_was_successfull, Stream1=fillet_offset_curves)
offset_was_successfull_2 = Panel(offset_was_successfull)
offset_curves_2 = Curve(offset_curves)
fillet_offset_curves_2 = Curve(filter_2)
filter_3 = StreamFilter(Gate=offset_was_successfull_2, Stream0=fillet_offset_curves_2, Stream1=offset_curves_2)
offset_curves_3 = Curve(filter_3)
offset_curves_4 = Curve(offset_curves_3)
filter_4 = StreamFilter(Gate=null.NullFlags, Stream0=offset_curves_4, Stream1=curves_for_offset_inwards)
pshift_5 = ShiftPaths(Data=filter_4, Offset=-1)
flip_4 = FlipCurve(Curve=pshift_5)  # -> Curve, Flag
inside_cutout_curves = Curve(flip_4.Curve)

outside_cutout_curves_2 = Curve(outside_cutout_curves)
inside_cutout_curves_2 = Curve(inside_cutout_curves)
inside_outline_curves = Curve(inside_cutout_curves_2)
flatten_3 = FlattenTree(Tree=outside_cutout_curves_2, Path="{0}")
end_3 = EndPoints(Curve=inside_outline_curves)  # -> Start, End
incurves = PointInCurves(Point=end_3.Start, Curves=flatten_3)  # -> Relationship, Index, Point
addition_2 = Addition(A=incurves.Index, B="1")
ins = InsertItems(List=flatten_3, Item=inside_outline_curves, Indices=incurves.Index, Wrap=True)

# ---- group: Flip curves for climb direction
sorted_inside_and_outside_curves = Curve(ins)
use_climb_direction_4 = Panel(use_climb_direction_3)
flip_5 = FlipCurve(Curve=sorted_inside_and_outside_curves)  # -> Curve, Flag
filter_5 = StreamFilter(Gate=use_climb_direction_4, Stream0=flip_5.Curve, Stream1=sorted_inside_and_outside_curves)
sorted_inside_and_outside_curves_2 = Curve(filter_5)

# ---- group: Move cutout toolpaths to cut depths
sorted_inside_and_outside_curves_3 = Curve(sorted_inside_and_outside_curves_2)
pass_depth_4 = Panel(pass_depth_3)
cut_depth_cutout = Panel(cut_depth_3)
division = Division(A=cut_depth_cutout, B=pass_depth_4)
graft_3 = GraftTree(Tree=sorted_inside_and_outside_curves_3, IncludeEmptyLists=True, IncludeNullItems=True)
round_3 = Round(Number=division)  # -> Nearest, Floor, Ceiling
division_2 = Division(A=cut_depth_cutout, B=round_3.Ceiling)
actual_pass_depth = Panel(division_2)
series = Series(Start=actual_pass_depth, Step=actual_pass_depth, Count=round_3.Ceiling)
neg_2 = Negative(Value=series)
Z = UnitZ(Factor=neg_2)
simplify = SimplifyTree(Tree=graft_3, Front=False)
simplify_2 = SimplifyTree(Tree=Z, Front=False)
move = Move(Geometry=simplify, Motion=simplify_2)  # -> Geometry, Transform
flatten_4 = FlattenTree(Tree=move.Geometry, Path="{0}")

# ----
cutout_toolpaths = Curve(flatten_4)
cutout_toolpaths_2 = ClusterOutput(cutout_toolpaths)

# ==== cluster DogboneMaker: Automatically adds dogbones to toolpath curves. Dogbones are used for making sharp internal cornes. This overcomes to challenge of making a sharp corner with a round spinning milling bit
corner_angle_threshold = ClusterInput()
milling_bit_diameter = ClusterInput()
flip_cornes_boolean = ClusterInput()
curves_to_dogbone = ClusterInput()
flip_cornes_boolean_2 = Integer(flip_cornes_boolean)
radius_margin = Panel("0.1")

milling_bit_diameter_2 = Number(milling_bit_diameter)
multiplication = Multiplication(A=milling_bit_diameter_2, B="0.5")
addition = Addition(A=multiplication, B=radius_margin)
dogbone_radius = Panel(addition)

corner_angle_threshold_2 = Number(corner_angle_threshold)
dom = ConstructDomain(DomainStart="1", DomainEnd="179")
smaller = SmallerThan(FirstNumber=corner_angle_threshold_2, SecondNumber="1")  # -> SmallerThan, OrEqualTo
filter = StreamFilter(Gate=smaller.SmallerThan, Stream0=corner_angle_threshold_2, Stream1="1")
larger = LargerThan(FirstNumber=filter, SecondNumber="179")  # -> LargerThan, OrEqualTo
filter_2 = StreamFilter(Gate=larger.LargerThan, Stream0=corner_angle_threshold_2, Stream1="179")
subtraction = Subtraction(A="360", B=filter_2)
division = Division(A=subtraction, B="360")
dogbone_minium_angle = Panel(division)

curves_to_dogbone_2 = Curve(curves_to_dogbone)
flatten = FlattenTree(Tree=curves_to_dogbone_2, Path="{0}")

# ---- group: Merge overlapping curves //removed to alow neighbouring pockets
mcx = MultipleCurves(Curves=flatten)  # -> Points, IndexA, IndexB, ParamA, ParamB; disabled
dcon = DeleteConsecutive(Set=[mcx.IndexA, mcx.IndexB], Wrap=False)  # -> Set, Count
item = ListItem(List=flatten, Index=dcon.Set, Wrap=True)
cull_i = CullIndex(List=flatten, Indices=dcon.Set, Wrap=True)
runion = RegionUnion(Curves=item)
merged_overlapping_curves = Curve([runion, cull_i])

# ---- group: Detect curves inside curves
aligned_curves = Curve(flatten)
graft = GraftTree(Tree=aligned_curves, IncludeEmptyLists=True, IncludeNullItems=True)
end = EndPoints(Curve=aligned_curves)  # -> Start, End
incurve = PointInCurve(Point=end.Start, Curve=graft)  # -> Relationship, Point
multiplication_2 = Multiplication(A=incurve.Relationship, B="0.5")
round = Round(Number=multiplication_2)  # -> Nearest, Floor, Ceiling
int = Integer(round.Floor)
flip = FlipMatrix(Data=int)
ma = MassAddition(Input=flip)  # -> Result, PartialResults
pshift = ShiftPaths(Data=ma.Result, Offset=-1)
dispatch = Dispatch(List=aligned_curves, DispatchPattern=pshift)  # -> ListA, ListB
curves_outside = Curve(dispatch.ListB)
curves_inside = Curve(dispatch.ListA)

# ----
xy = XYPlane(Origin=Point(0, 0, 0))
cir = Circle(Plane=xy, Radius="0.01")
dogbone_minium_angle_2 = Panel(dogbone_minium_angle)
len = Length(Curve=cir)
multiplication_3 = Multiplication(A=len, B=dogbone_minium_angle_2)

xy_2 = XYPlane(Origin=Point(0, 0, 0))
cir_2 = Circle(Plane=xy_2, Radius="0.01")
dogbone_minium_angle_3 = Panel(dogbone_minium_angle)
len_2 = Length(Curve=cir_2)
multiplication_4 = Multiplication(A=len_2, B=dogbone_minium_angle_3)

flip_cornes_boolean_3 = Panel(flip_cornes_boolean_2)
flip_cornes_boolean_4 = Panel(flip_cornes_boolean_2)
curves_to_dogbone_3 = Curve(flatten)
lng = ListLength(List=curves_to_dogbone_3)

curves_for_dogbone = Curve(curves_inside)
cp = ControlPoints(Curve=curves_for_dogbone)  # -> Points, Weights, Knots

disc = Discontinuity(Curve=curves_for_dogbone, Level=1)  # -> Points, Parameters

curves_for_dogbone_2 = Curve(curves_outside)
cp_2 = ControlPoints(Curve=curves_for_dogbone_2)  # -> Points, Weights, Knots

disc_2 = Discontinuity(Curve=curves_for_dogbone_2, Level=1)  # -> Points, Parameters

xy_3 = XYPlane(Origin=disc.Points)
cir_3 = Circle(Plane=xy_3, Radius="0.01")
trim = TrimWithRegion(Curve=cir_3, Region=graft(curves_for_dogbone), Plane=xy_3)  # -> Inside, Outside

filter_3 = StreamFilter(Gate=flip_cornes_boolean_4, Stream0=trim.Outside, Stream1=trim.Inside)

pshift_2 = ShiftPaths(Data=filter_3, Offset=-1)
len_3 = Length(Curve=pshift_2)

xy_4 = XYPlane(Origin=disc_2.Points)
cir_4 = Circle(Plane=xy_4, Radius="0.01")
trim_2 = TrimWithRegion(Curve=cir_4, Region=graft(curves_for_dogbone_2), Plane=xy_4)  # -> Inside, Outside

filter_4 = StreamFilter(Gate=flip_cornes_boolean_3, Stream0=trim_2.Inside, Stream1=trim_2.Outside)

pshift_3 = ShiftPaths(Data=filter_4, Offset=-1)
len_4 = Length(Curve=pshift_3)

larger_2 = LargerThan(FirstNumber=len_3, SecondNumber=multiplication_3)  # -> LargerThan, OrEqualTo
dogbone_radius_2 = Panel(dogbone_radius)
dispatch_2 = Dispatch(List=disc.Points, DispatchPattern=larger_2.LargerThan)  # -> ListA, ListB
dispatch_3 = Dispatch(List=pshift_2, DispatchPattern=larger_2.LargerThan)  # -> ListA, ListB
eval = EvaluateLength(Curve=dispatch_3.ListA, Length="0.5", Normalized=True)  # -> Point, Tangent, Parameter
pt = Point(dispatch_2.ListA)
pln = Plane(dispatch_2.ListA)
pt_2 = Point(eval.Point)
vec2pt = Vector2Pt(PointA=pt_2, PointB=pt, Unitize=False)  # -> Vector, Length

amp = Amplitude(Vector=vec2pt.Vector, Amplitude=dogbone_radius_2)

move = Move(Geometry=pln, Motion=amp)  # -> Geometry, Transform
cir_5 = Circle(Plane=move.Geometry, Radius=dogbone_radius_2)

lng_2 = ListLength(List=cir_5)
larger_3 = LargerThan(FirstNumber=lng_2, SecondNumber="0.01")  # -> LargerThan, OrEqualTo
pshift_4 = ShiftPaths(Data=larger_3.LargerThan, Offset=-1)
ma_2 = MassAddition(Input=pshift_4)  # -> Result, PartialResults
dispatch_4 = Dispatch(List=curves_for_dogbone, DispatchPattern=pshift_4)  # -> ListA, ListB
crv = Curve(dispatch_4.ListB)
smaller_2 = SmallerThan(FirstNumber=ma_2.Result, SecondNumber="0.5")  # -> SmallerThan, OrEqualTo
clean = CleanTree(RemoveNulls=True, RemoveInvalid=True, RemoveEmpty=False, Tree=crv)

crv_2 = Curve(curves_for_dogbone)
graft_2 = GraftTree(Tree=crv_2, IncludeEmptyLists=True, IncludeNullItems=True)
runion_2 = RegionUnion(Curves=[cir_5, graft_2])
pshift_5 = ShiftPaths(Data=runion_2, Offset=-1)
pshift_6 = ShiftPaths(Data=pshift_5, Offset=-1)

filter_5 = StreamFilter(Gate=smaller_2.SmallerThan, Stream0=pshift_6)
merge = Merge(Data1=filter_5, Data2=clean)
dogboned_inside_curves = Curve(merge)

larger_4 = LargerThan(FirstNumber=len_4, SecondNumber=multiplication_4)  # -> LargerThan, OrEqualTo
dogbone_radius_3 = Panel(dogbone_radius)
dispatch_5 = Dispatch(List=disc_2.Points, DispatchPattern=larger_4.LargerThan)  # -> ListA, ListB
dispatch_6 = Dispatch(List=pshift_3, DispatchPattern=larger_4.LargerThan)  # -> ListA, ListB
eval_2 = EvaluateLength(Curve=dispatch_6.ListA, Length="0.5", Normalized=True)  # -> Point, Tangent, Parameter
pln_2 = Plane(dispatch_5.ListA)
pt_3 = Point(dispatch_5.ListA)
pt_4 = Point(eval_2.Point)
vec2pt_2 = Vector2Pt(PointA=pt_4, PointB=pt_3, Unitize=False)  # -> Vector, Length

amp_2 = Amplitude(Vector=vec2pt_2.Vector, Amplitude=dogbone_radius_3)

move_2 = Move(Geometry=pln_2, Motion=amp_2)  # -> Geometry, Transform
cir_6 = Circle(Plane=move_2.Geometry, Radius=dogbone_radius_3)

crv_3 = Curve(curves_for_dogbone_2)
flip_cornes_boolean_5 = Panel(flip_cornes_boolean_2)
graft_3 = GraftTree(Tree=crv_3, IncludeEmptyLists=True, IncludeNullItems=True)
gate = StreamGate(Stream=[graft_3, cir_6], Gate=flip_cornes_boolean_5)  # -> Target0, Target1
gate_2 = StreamGate(Stream=graft_3, Gate=flip_cornes_boolean_5)  # -> Target0, Target1
gate_3 = StreamGate(Stream=cir_6, Gate=flip_cornes_boolean_5)  # -> Target0, Target1
runion_3 = RegionUnion(Curves=gate.Target1)
rdiff = RegionDifference(CurvesA=gate_2.Target0, CurvesB=gate_3.Target0)
filter_6 = StreamFilter(Gate=flip_cornes_boolean_5, Stream0=rdiff, Stream1=runion_3)
pshift_7 = ShiftPaths(Data=filter_6, Offset=-1)
pshift_8 = ShiftPaths(Data=pshift_7, Offset=-1)

lng_3 = ListLength(List=cir_6)
larger_5 = LargerThan(FirstNumber=lng_3, SecondNumber="0.01")  # -> LargerThan, OrEqualTo
pshift_9 = ShiftPaths(Data=larger_5.LargerThan, Offset=-1)
ma_3 = MassAddition(Input=pshift_9)  # -> Result, PartialResults
dispatch_7 = Dispatch(List=curves_for_dogbone_2, DispatchPattern=pshift_9)  # -> ListA, ListB
crv_4 = Curve(dispatch_7.ListB)
smaller_3 = SmallerThan(FirstNumber=ma_3.Result, SecondNumber="0.5")  # -> SmallerThan, OrEqualTo
clean_2 = CleanTree(RemoveNulls=True, RemoveInvalid=True, RemoveEmpty=False, Tree=crv_4)

filter_7 = StreamFilter(Gate=smaller_3.SmallerThan, Stream0=pshift_8)
merge_2 = Merge(Data1=filter_7, Data2=clean_2)
dogboned_outside_curves = Curve(merge_2)
merge_3 = Merge(Data1=dogboned_inside_curves, Data2=dogboned_outside_curves)
flatten_2 = FlattenTree(Tree=merge_3, Path="{0}")
end_2 = EndPoints(Curve=flatten_2)  # -> Start, End
dup = DuplicateData(Data=graft(flatten_2), Number=lng, Order=True)
flip_2 = FlipMatrix(Data=dup)
crv_cp = CurveClosestPoint(Point=end_2.Start, Curve=graft(curves_to_dogbone_3))  # -> Point, Parameter, Distance
pshift_10 = ShiftPaths(Data=flip_2, Offset=-1)
sort = SortList(Keys=crv_cp.Distance, ValuesA=pshift_10)  # -> Keys, ValuesA
item_2 = ListItem(List=sort.ValuesA, Index=0, Wrap=True)
flatten_3 = FlattenTree(Tree=item_2, Path="{0}")
dogboned_curves = Curve(flatten_3)
dogboned_curves_2 = ClusterOutput(dogboned_curves)

# ==== cluster FindDeepestZ: Finds the deepest Z coordinate in your toolapths. Handy for safety checks!
toolpaths = ClusterInput()
toolpaths_2 = Geometry(toolpaths)
bbox = BoundingBox(Content=flatten(toolpaths_2), Plane=PlaneXY(0, 0, 0), UnionBox=True)  # -> Box, Box_2
box_corners = BoxCorners(Box=bbox.Box)  # -> CornerA, CornerB, CornerC, CornerD, CornerE, CornerF, CornerG, CornerH
pt = Point(box_corners.CornerA)
pdecon = Deconstruct(Point=pt)  # -> XComponent, YComponent, ZComponent
deepest_z = Number(pdecon.ZComponent)
deepest_z_2 = ClusterOutput(deepest_z)

# ==== cluster FeedRateLibraryExperimemtal: Outputs CNC milling settings based on material type, bit diameter, bit type. Current values based on ShopBot alpha, single flute end mills and18000 rpm spindle speed
use_high_speed_maching = ClusterInput()
toolpath_width_factor = ClusterInput()
pass_depth_factor = ClusterInput()
# Adjust feed rate defaults here:
# (chip load)
feed_rate_factor = ClusterInput()
number_of_flutes = ClusterInput()
spindle_rpm = ClusterInput()
bit_diameter = ClusterInput()
material_id = ClusterInput()
bit_type_id = ClusterInput()
material_id_2 = Integer(material_id)
bit_diameter_2 = Number(bit_diameter)
number_of_flutes_2 = Integer(number_of_flutes)
spindle_rpm_2 = Number(spindle_rpm)
use_high_speed_maching_2 = Integer(use_high_speed_maching)
toolpath_width_factor_2 = Number(toolpath_width_factor)
feed_rate_factor_2 = Number(feed_rate_factor)
bit_type_id_2 = Number(bit_type_id)
pass_depth_factor_2 = Number(pass_depth_factor)
material_type_id = Panel(material_id_2)
bit_type_id_3 = Panel(bit_type_id_2)
bit_diameter_3 = Panel(bit_diameter_2)
larger = LargerThan(FirstNumber=bit_type_id_3, SecondNumber="0")  # -> LargerThan, OrEqualTo
bool = Boolean(larger.LargerThan)
bit_type_is_not_an_up_cut = Panel(bool)

# ---- group: ShopBot alpha pass depths
# Adjust pass depth defaults here:
pass_depths_6mm_upcut_single_flute = Panel("""19.8
15
10
8
2.5
1.2
0.9
0.6""")

# ---- group: Calculate feedrate
# Material ID ref: Foam / wax        = 0
# Soft wood         = 1
# Hard wood         = 2
# Plastic           = 3
# Aluminium / brass = 4
# Bronze            = 5
# Soft steel        = 6
# Stainless steel   = 7
chip_loads_for_6mm_bit = Panel("""0.25
0.165
0.115
0.0725
0.04
0.035
0.032
0.025""")
bit_diameter_chip_loads_are_based_on = Panel("6")
number_of_flutes_3 = Panel(number_of_flutes_2)
plunge_rate_reduction_factor_down_cut_or = Panel("0.5")  # "Plunge rate reduction factor down-cut or other"
spindle_rpm_3 = Panel(spindle_rpm_2)
plunge_rate_reduction_factor_up_cut = Panel("0.7")
bit_diameter_4 = Panel(bit_diameter_3)
multiplication_factor = Panel("0.45")
multiplication = Multiplication(A=spindle_rpm_3, B=number_of_flutes_3)
multiplication_2 = Multiplication(A=multiplication, B=chip_loads_for_6mm_bit)
division = Division(A=multiplication_2, B="60")
int = Integer(division)
feedrates_based_on_default_bit_biamter = Panel(int)

# ----
# Material ID ref: Foam / wax        = 0
# Soft wood         = 1
# Hard wood         = 2
# Plastic           = 3
# Aluminium / brass = 4
# Bronze            = 5
# Soft steel        = 6
# Stainless steel   = 7
# Adjust ramp angles here:
material_ramp_angles = Panel("""45
30
25
18
12
9
6
4""")
# Adjust high speed machining defaults here:
# Material ID ref: Foam / wax        = 0
# Soft wood         = 1
# Hard wood         = 2
# Plastic           = 3
# Aluminium / brass = 4
# Bronze            = 5
# Soft steel        = 6
# Stainless steel   = 7
plunge_rough_stepover_for_different_mate = Panel("""0.4
0.4
0.4
0.4
0.25
0.22
0.18
0.12""")  # "Plunge rough stepover for different materials"
use_high_speed_maching_3 = Panel(use_high_speed_maching_2)

# ---- group: Make a Feedrate multiplier based on current bit diamter
subtraction = Subtraction(A="1", B=multiplication_factor)
multiplication_3 = Multiplication(A=bit_diameter_4, B=multiplication_factor)
multiplication_4 = Multiplication(A=bit_diameter_chip_loads_are_based_on, B=subtraction)
addition = Addition(A=multiplication_4, B=multiplication_3)
division_2 = Division(A=addition, B=bit_diameter_chip_loads_are_based_on)
feedrate_multiplier_based_on_bit_diamter = Panel(division_2)

# ----
multiplication_5 = Multiplication(A=feedrates_based_on_default_bit_biamter, B=feedrate_multiplier_based_on_bit_diamter)
feedrates_adjusted_to_current_bit_diamte = Panel(multiplication_5)  # "Feedrates adjusted to current bit diamter"

# ---- group: Make feed rate domain
int_2 = Integer()
int_3 = Integer()
dom = ConstructDomain(DomainStart=int_3, DomainEnd=int_2)
feed_rates_domains = Panel(dom)
material_type = Panel(material_type_id)
flatten = FlattenTree(Path="{0}")
item = ListItem(List=feed_rates_domains, Index=material_type, Wrap=True)
feed_rate_domain = Panel(item)

# ---- group: Map ramp and ramp angles
material_type_2 = Panel(material_type_id)
bit_type_is_not_an_up_cut_2 = Panel(bit_type_is_not_an_up_cut)
material_ramp_angles_2 = Panel(material_ramp_angles)
material_type_3 = Panel(material_type_id)
larger_2 = LargerThan(FirstNumber=material_type_2, SecondNumber="1")  # -> LargerThan, OrEqualTo
bool_2 = Boolean(bit_type_is_not_an_up_cut_2)
larger_3 = LargerThan(FirstNumber=material_type_3, SecondNumber="2")  # -> LargerThan, OrEqualTo
item_2 = ListItem(List=material_ramp_angles_2, Index=material_type_3, Wrap=True)
ramp_because_of_special_bit_in_material = Panel(larger_2.LargerThan)
ramp_because_of_bit_type = Panel(bool_2)
ramp_because_of_material = Panel(larger_3.LargerThan)
and = GateAnd(A=ramp_because_of_bit_type, B=ramp_because_of_special_bit_in_material)
or = GateOr(A=ramp_because_of_material, B=and)
ramp_angle = Panel(item_2)
ramp_plunges = Panel(or)

# ---- group: Select feedrate
material_type_4 = Panel(material_type_id)
item_3 = ListItem(List=feedrates_adjusted_to_current_bit_diamte, Index=material_type_4, Wrap=True)
feed_rate = Panel(item_3)

# ---- group: Calculate plunge rate
plunge_rate_reduction_factor_up_cut_2 = Panel(plunge_rate_reduction_factor_down_cut_or)
bit_type_is_not_an_up_cut_3 = Panel(bit_type_is_not_an_up_cut)
plunge_rate_reduction_factor_up_cut_3 = Panel(plunge_rate_reduction_factor_up_cut)
filter = StreamFilter(
    Gate=bit_type_is_not_an_up_cut_3,
    Stream0=plunge_rate_reduction_factor_up_cut_3,
    Stream1=plunge_rate_reduction_factor_up_cut_2)
multiplication_6 = Multiplication(A=feed_rate, B=filter)
int_4 = Integer(multiplication_6)
num = Number(int_4)
plunge_rate = Panel(num)

# ----
use_high_speed_maching_4 = Panel(use_high_speed_maching_2)
use_high_speed_maching_5 = Panel(use_high_speed_maching_2)
use_high_speed_maching_6 = Panel(use_high_speed_maching_2)
ramp_plunges_2 = Panel(ramp_plunges)
use_high_speed_maching_7 = Panel(use_high_speed_maching_2)
ramp_angle_2 = Panel(ramp_angle)
use_high_speed_maching_8 = Panel(use_high_speed_maching_2)
actual_bit_diameter = Panel(bit_diameter_3)
actual_bit_diameter_2 = Number(actual_bit_diameter)
ramp_plunges_3 = Boolean(ramp_plunges_2)
ramp_plunges_4 = ClusterOutput(ramp_plunges_3)
actual_bit_diameter_3 = ClusterOutput(actual_bit_diameter_2)

# ---- group: Calculate pass depth
# Material ID ref: Foam / wax        = 0
# Soft wood         = 1
# Hard wood         = 2
# Plastic           = 3
# Aluminium / brass = 4
# Bronze            = 5
# Soft steel        = 6
# Stainless steel   = 7
pass_depths_6mm_upcut_single_flute_2 = Panel("""19.8
10
6
4
1.8
1.2
0.9
0.6""")
v_bit_reduction_factor = Panel("0.5")
v_bit_identifier = Panel("3")
bit_diameter_chip_loads_are_based_on_2 = Panel("6")
downcut_or_ball_nose_depth_reduction_fac = Panel("0.6")  # "Downcut or ball nose depth reduction factor"
bit_type_id_4 = Panel(bit_type_id_3)
bit_type_is_not_an_up_cut_4 = Panel(bit_type_is_not_an_up_cut)
number_of_flutes_4 = Panel(number_of_flutes_2)
multiplication_factor_flutes = Panel("0.33")
bit_diameter_5 = Panel(bit_diameter_3)
multiplication_factor_diamter = Panel("1.05")
subtraction_2 = Subtraction(A="1", B=multiplication_factor_diamter)
multiplication_7 = Multiplication(A=bit_diameter_5, B=multiplication_factor_diamter)
multiplication_8 = Multiplication(A=bit_diameter_chip_loads_are_based_on_2, B=subtraction_2)
addition_2 = Addition(A=multiplication_8, B=multiplication_7)
division_3 = Division(A=addition_2, B=bit_diameter_chip_loads_are_based_on_2)
pass_depth_multiplier_based_on_bit_diamt = Panel(division_3)  # "Pass depth multiplier based on bit diamter"
multiplication_9 = Multiplication(A=pass_depths_6mm_upcut_single_flute_2, B=pass_depth_multiplier_based_on_bit_diamt)
pass_depths_adjusted_to_current_bit_diam = Panel(multiplication_9)  # "Pass depths adjusted to current bit diamter"
number_of_flutes_5 = Panel(number_of_flutes_4)
multiplication_factor_flutes_2 = Panel(multiplication_factor_flutes)
division_4 = Division(A=pass_depths_adjusted_to_current_bit_diam, B=number_of_flutes_5)
multiplication_10 = Multiplication(A=division_4, B=multiplication_factor_flutes_2)
addition_3 = Addition(A=division_4, B=multiplication_10)
panel = Panel("10")
bit_type_simple = Panel(bit_type_is_not_an_up_cut_4)
material_type_5 = Panel(material_type_id)
bit_type_id_5 = Panel(bit_type_id_4)
v_bit_reduction_factor_2 = Panel(v_bit_reduction_factor)
v_bit_identifier_2 = Panel(v_bit_identifier)
v_bit_reduction_factor_3 = Panel(v_bit_reduction_factor_2)
equals = Equality(FirstNumber=bit_type_id_5, SecondNumber=v_bit_identifier_2)  # -> Equality, Inequality

# ----
larger_4 = LargerThan(FirstNumber=number_of_flutes_5, SecondNumber="1")  # -> LargerThan, OrEqualTo
filter_2 = StreamFilter(Gate=larger_4.LargerThan, Stream0=pass_depths_adjusted_to_current_bit_diam, Stream1=addition_3)
downcut_or_ball_nose_depth_reduction_fac_2 = Panel(downcut_or_ball_nose_depth_reduction_fac)  # "Downcut or ball nose depth reduction factor"

# ---- group: Make high speed milling speeds
# Material ID ref: Foam / wax        = 0
# Soft wood         = 1
# Hard wood         = 2
# Plastic           = 3
# Aluminium / brass = 4
# Bronze            = 5
# Soft steel        = 6
# Stainless steel   = 7
stepover_for_different_materials = Panel("""0.9
0.9
0.9
0.8
0.2
0.15
0.1
0.09""")
material_type_id_2 = Panel(material_type_id)
# Material ID ref: Foam / wax        = 0
# Soft wood         = 1
# Hard wood         = 2
# Plastic           = 3
# Aluminium / brass = 4
# Bronze            = 5
# Soft steel        = 6
# Stainless steel   = 7
high_speed_chip_loads_for_different_mate = Panel("""0.5
0.3
0.2
0.2
0.08
0.07
0.04
0.03""")  # "High speed chip loads for different materials"
# Material ID ref: Foam / wax        = 0
# Soft wood         = 1
# Hard wood         = 2
# Plastic           = 3
# Aluminium / brass = 4
# Bronze            = 5
# Soft steel        = 6
# Stainless steel   = 7
ramp_angle_for_different_materials = Panel("""45
20
10
3
1.2
0.9
0.8
0.6""")
plunge_rough_feed_and_plunge_rate_reduct = Panel("0.7")  # "Plunge rough feed and plunge rate reduction factor"
high_speed_pass_depth_to_bit_diameter_ra = Panel("2.5")  # "High speed pass depth to bit diameter ratio"
item_4 = ListItem(List=ramp_angle_for_different_materials, Index=material_type_id_2, Wrap=True)
item_5 = ListItem(List=high_speed_chip_loads_for_different_mate, Index=material_type_id_2, Wrap=True)
ramp_angle_high_speed_helix = Panel(item_4)
high_speed_chip_load = Panel(item_5)
bit_diameter_from_easy_interface = Panel(bit_diameter_3)
arc_diamter_factor = Panel(toolpath_width_factor_2)
bit_diameter_6 = Panel(bit_diameter_3)
multiplication_11 = Multiplication(A=high_speed_pass_depth_to_bit_diameter_ra, B=bit_diameter_6)
multiplication_12 = Multiplication(A=bit_diameter_from_easy_interface, B=arc_diamter_factor)
high_speed_pass_depth = Panel(multiplication_11)
high_speed_virtual_bit_diamter = Panel(multiplication_12)

# ----
filter_3 = StreamFilter(
    Gate=use_high_speed_maching_3,
    Stream1=stepover_for_different_materials,
    Stream2=plunge_rough_stepover_for_different_mate)

# ---- group: Make high speed milling speeds (continued)
item_6 = ListItem(List=filter_3, Index=material_type_id_2, Wrap=True)
current_high_speed_stepover = Panel(item_6)
feedrate_calculator_for_arcs = FeedrateCalculatorForArcs(
    spindle_rpm=spindle_rpm_2,
    milling_bit_diameter=bit_diameter_3,
    arc_diameter_factor=toolpath_width_factor_2,
    number_of_flutes=number_of_flutes_2,
    chip_load=high_speed_chip_load,
    max_stepover=current_high_speed_stepover,
    ramp_feed_reduction_factor=0.5)  # -> arc_compensated_feedrate_3, ramp_feedrate_2, feedback_3
multiplication_13 = Multiplication(A=feedrate_calculator_for_arcs.arc_compensated_feedrate_3, B=plunge_rough_feed_and_plunge_rate_reduct)
plungr_rough_rate = Panel(multiplication_13)

# ----
high_speed_virtual_bit_diamter_2 = Panel(high_speed_virtual_bit_diamter)
ramp_angle_high_speed_helix_2 = Panel(ramp_angle_high_speed_helix)
plunge_rough_rate = Panel(plungr_rough_rate)
plunge_rough_rate_2 = Panel(plungr_rough_rate)
high_speed_feedrate = Panel(feedrate_calculator_for_arcs.arc_compensated_feedrate_3)
high_speed_pass_depth_2 = Panel(high_speed_pass_depth)
filter_4 = StreamFilter(
    Gate=use_high_speed_maching_7,
    Stream0=ramp_angle_2,
    Stream1=ramp_angle_high_speed_helix_2,
    Stream2=ramp_angle_high_speed_helix_2)
filter_5 = StreamFilter(
    Gate=use_high_speed_maching_8,
    Stream0=actual_bit_diameter,
    Stream1=high_speed_virtual_bit_diamter_2,
    Stream2=actual_bit_diameter)
trochoidal_stepover = Number(current_high_speed_stepover)
toolpath_width = Number(filter_5)
ramp_angle_3 = Integer(filter_4)
ramp_angle_4 = ClusterOutput(ramp_angle_3)
trochoidal_stepover_2 = ClusterOutput(trochoidal_stepover)
toolpath_width_2 = ClusterOutput(toolpath_width)

# ---- group: Calculate pass depth (continued)
pass_depths_adjusted_to_current_flute_co = Panel(filter_2)  # "Pass depths adjusted to current flute count"
multiplication_14 = Multiplication(A=pass_depths_adjusted_to_current_flute_co, B=panel)

# ----
int_5 = Integer(multiplication_14)
division_5 = Division(A=int_5, B=panel)
current_pass_depths = Panel(division_5)
multiplication_15 = Multiplication(A=current_pass_depths, B=downcut_or_ball_nose_depth_reduction_fac_2)

# ---- group: Calculate pass depth (continued)
filter_6 = StreamFilter(Gate=bit_type_simple, Stream0=current_pass_depths, Stream1=multiplication_15)
item_7 = ListItem(List=filter_6, Index=material_type_5, Wrap=True)
multiplication_16 = Multiplication(A=item_7, B="10")
int_6 = Integer(multiplication_16)
division_6 = Division(A=int_6, B="10")
multiplication_17 = Multiplication(A=division_6, B=v_bit_reduction_factor_3)
filter_7 = StreamFilter(Gate=equals.Equality, Stream0=division_6, Stream1=multiplication_17)
pass_depth = Panel(filter_7)

# ---- group: Feed rate and pass depth adjustment
feed_rate_2 = Panel(feed_rate)
plunge_rate_2 = Panel(plunge_rate)
pass_depth_2 = Panel(pass_depth)
pass_depth_factor_3 = Number(pass_depth_factor_2)
feed_rate_factor_3 = Number(feed_rate_factor_2)
multiplication_18 = Multiplication(A=pass_depth_2, B=pass_depth_factor_3)
multiplication_19 = Multiplication(A=plunge_rate_2, B=feed_rate_factor_3)
multiplication_20 = Multiplication(A=feed_rate_2, B=feed_rate_factor_3)
int_7 = Integer(multiplication_19)
num_2 = Number(multiplication_18)
ajusted_pass_depth = Panel(num_2)
adjusted_plunge_rateod_plunge_rate = Panel(int_7)

# ----
int_8 = Integer(multiplication_20)

# ---- group: Feed rate and pass depth adjustment (continued)
adjusted_feedrate = Panel(int_8)

# ----
classic_feed_rate = Panel(adjusted_feedrate)
classic_pass_depth = Panel(ajusted_pass_depth)
classic_plunge_rate = Panel(adjusted_plunge_rateod_plunge_rate)
filter_8 = StreamFilter(Gate=use_high_speed_maching_4, Stream0=classic_feed_rate, Stream1=high_speed_feedrate, Stream2=plunge_rough_rate)
filter_9 = StreamFilter(Gate=use_high_speed_maching_5, Stream0=classic_plunge_rate, Stream1=classic_plunge_rate, Stream2=plunge_rough_rate_2)
filter_10 = StreamFilter(
    Gate=use_high_speed_maching_6,
    Stream0=classic_pass_depth,
    Stream1=high_speed_pass_depth_2,
    Stream2=high_speed_pass_depth_2)
plunge_rate_3 = Number(filter_9)
pass_depth_3 = Number(filter_10)
feed_rate_3 = Integer(filter_8)
feed_rate_4 = ClusterOutput(feed_rate_3)
plunge_rate_4 = ClusterOutput(plunge_rate_3)
pass_depth_4 = ClusterOutput(pass_depth_3)

# ==== cluster CompileSettings: Compiles an overview of current milling settings. Nice for quickly checking your settings, or the output from the feedrate calculator, before running a job.
estimated_job_time = ClusterInput()
plunge_rate = ClusterInput()
spindle_rpm = ClusterInput()
deepest_z = ClusterInput()
ramp_angle = ClusterInput()
ramp_plunges = ClusterInput()
feed_rate = ClusterInput()
pass_depth = ClusterInput()
estimated_job_time_2 = Number(estimated_job_time)
plunge_rate_2 = Number(plunge_rate)
ramp_plunges_2 = Boolean(ramp_plunges)
pass_depth_2 = Number(pass_depth)
feed_rate_2 = Number(feed_rate)
spindle_rpm_2 = Number(spindle_rpm)
ramp_angle_2 = Integer(ramp_angle)
deepest_z_2 = Number(deepest_z)
int = Integer(plunge_rate_2)
int_2 = Integer(estimated_job_time_2)
int_3 = Integer(feed_rate_2)
int_4 = Integer(spindle_rpm_2)
spindle_rpm_3 = Panel(int_4)
join = TextJoin(Text=["Spindle RPM: ", spindle_rpm_3])

# ---- group: Format for settings display
estimated_job_time_3 = Panel(int_2)
feed_rate_3 = Panel(int_3)
plunge_rate_3 = Panel(int)
pass_depth_3 = Panel(pass_depth_2)
ramp_plunges_3 = Panel(ramp_plunges_2)
ramp_angle_3 = Panel(ramp_angle_2)
deepest_point = Panel(deepest_z_2)
join_2 = TextJoin(Text=["Estimated job time: ", estimated_job_time_3, " minutes"])
join_3 = TextJoin(Text=["Feed rate: ", feed_rate_3])
join_4 = TextJoin(Text=["Plunge rate: ", plunge_rate_3])
join_5 = TextJoin(Text=["Pass depth: ", pass_depth_3])
join_6 = TextJoin(Text=["Ramp plunges: ", ramp_plunges_3])
join_7 = TextJoin(Text=["Ramp angle:", ramp_angle_3])
join_8 = TextJoin(Text=["Deepest Z: ", deepest_point])
merge = Merge(
    Data1=join_2,
    Data2=" ",
    Data3=join_3,
    Data4=" ",
    Data5=join_4,
    Data6=" ",
    Data7=join,
    Data8=" ",
    Data9=join_5,
    Data10=" ",
    Data11=join_6,
    Data12=" ",
    Data13=join_7,
    Data14=" ",
    Data15=join_8)
merge_2 = Merge(Data1=join_3, Data2=" ", Data3=join_4, Data4=" ", Data5=join_5, Data6=" ", Data7=join_8, Data8=" ")

# ----
crucial_settings = ClusterOutput(merge_2)
complete_settings = ClusterOutput(merge)

# ==== cluster CNCMillingPostProcessor: Converts toolpath curves into coordinates that a CNC machine can read. Use tab boxes for making safe cutouts, and ramps for smooth entry into hard materials.
make_shopbot_code_not_g_code = ClusterInput()
use_high_speed_machining = ClusterInput()  # 0=off 1=Trochoidal 2=Plunge roughing
toolpath_width_factor = ClusterInput()
milling_bit_diameter = ClusterInput()
deviation_tolerance = ClusterInput()
custom_home_x = ClusterInput()
toolpath_curves = ClusterInput()
custom_home_y = ClusterInput()
use_peck_entry = ClusterInput()
ramp_plunges = ClusterInput()
spindle_speed = ClusterInput()
safe_z_height = ClusterInput()
ramp_angle = ClusterInput()
use_spindle = ClusterInput()
plunge_rate = ClusterInput()
start_code = ClusterInput()  # Add a suitable start code for your machine here
tab_breps = ClusterInput()
jog_rate_z = ClusterInput()
job_name = ClusterInput()
feed_rate = ClusterInput()
end_code = ClusterInput()  # Add a suitable end code for your machine here
stepover = ClusterInput()
jog_rate = ClusterInput()

# ---- group: Additional settings
spindle_startup_time_g_code = Panel("5")
max_peck_depth_factor = Panel("0.4")
use_custom_jog_home = Integer(Toggle(True))

# ----
jog_rate_2 = Number(jog_rate)
jog_rate_z_2 = Number(jog_rate_z)
start_code_2 = Text(start_code)
end_code_2 = Text(end_code)
make_shopbot_code_not_g_code_2 = Boolean(make_shopbot_code_not_g_code)
use_high_speed_machining_2 = Integer(use_high_speed_machining)
toolpath_width_factor_2 = Number(toolpath_width_factor)
stepover_2 = Number(stepover)
use_peck_entry_2 = Boolean(use_peck_entry)
multiplication = Multiplication(A=jog_rate_2, B="60")
multiplication_2 = Multiplication(A=jog_rate_z_2, B="60")
jog_rate_z_3 = Number(multiplication_2)
jog_rate_x_y = Number(multiplication)
use_trochoidal_milling = Panel(use_high_speed_machining_2)
use_high_speed_machining_3 = Panel(use_high_speed_machining_2)
use_high_speed_machining_4 = Panel(use_high_speed_machining_2)
text = Text("J2,")
text_2 = Text("J2,")
text_3 = Text(",")
text_4 = Text(",")
start_code_3 = Text(start_code_2)
start_code_4 = Text(start_code_2)
end_code_3 = Text(end_code_2)
end_code_4 = Text(end_code_2)
endcode = Panel(end_code_3)
endcode_2 = Panel(end_code_4)
endcode_3 = Panel("""G4  S3
M280 S-90 P0 F3000 R""")
# Endcode - Ultimaker original , extruder upgrade + heatbed: ;End GCode
# M104 S0                     ;extruder heater off
# M140 S0                     ;heated bed heater off (if you have it)
# G91                                    ;relative positioning
# G1 E-1 F300                            ;retract the filament a bit before lifting the nozzle, to release some of the pressure
# G1 Z+0.5 E-5 X-20 Y-20 F9000 ;move Z up a bit and retract filament even more
# G28 X0 Y0                              ;move X/Y to min endstops, so the head is out of the way
# M84                         ;steppers off
# G90                         ;absolute positioning
# Endcode - Printrbot Simple: M104 S0                     ;extruder heater off
# M140 S0                     ;heated bed heater off (if you have it)
# 
# G91                                    ;relative positioning
# G1 E-1 F300                            ;retract the filament a bit before lifting the nozzle, to release some of the pressure
# G1 Z+0.5 E-5 X-20 Y-20 F9000 ;move Z up a bit and retract filament even more
# G28 X0 Y0                              ;move X/Y to min endstops, so the head is out of the way
# 
# M84                         ;steppers off
# G90                         ;absolute positioning
endcode_fabtotum = Panel("""G4 S2; Dwell
M5; SPINDLE OFF""")
start_code_5 = Text(start_code_2)
start_code_6 = Text(start_code_2)
end_code_5 = Text(end_code_2)
end_code_6 = Text(end_code_2)

toolpath_curves_2 = Curve(toolpath_curves)
tab_breps_2 = Brep(tab_breps)
feed_rate_2 = Number(feed_rate)
plunge_rate_2 = Number(plunge_rate)
safe_z_height_2 = Number(safe_z_height)
use_spindle_2 = Integer(use_spindle)
spindle_speed_2 = Number(spindle_speed)
ramp_plunges_2 = Integer(ramp_plunges)
ramp_angle_2 = Number(ramp_angle)
custom_home_x_2 = Number(custom_home_x)
custom_home_y_2 = Number(custom_home_y)
deviation_tolerance_2 = Number(deviation_tolerance)
milling_bit_diameter_2 = Number(milling_bit_diameter)
job_name_2 = Text(job_name)
convert_to_inches = BooleanToggle(False)
flatten = FlattenTree(Tree=tab_breps_2, Path="{0}")
flatten_2 = FlattenTree(Tree=toolpath_curves_2, Path="{0}")
use_inches_boolean = Panel(convert_to_inches)
clean = CleanTree(RemoveNulls=True, RemoveInvalid=True, RemoveEmpty=False, Tree=flatten_2)
filter = StreamFilter(Gate=use_inches_boolean, Stream0="1", Stream1="25.4")
division = Division(A=custom_home_x_2, B=filter)
division_2 = Division(A=custom_home_y_2, B=filter)
join = TextJoin(Text=flatten(["'", job_name_2]))
division_3 = Division(A=safe_z_height_2, B=filter)
division_4 = Division(A=feed_rate_2, B=filter)
division_5 = Division(A=plunge_rate_2, B=filter)

multiplication_3 = Multiplication(A=milling_bit_diameter_2, B=toolpath_width_factor_2)
multiplication_4 = Multiplication(A=feed_rate_2, B="60")

# ---- group: Make G-Code spindle start
spindle_speed_3 = Number(spindle_speed_2)
use_spindle_3 = Integer(use_spindle_2)
spindle_startup_time_g_code_2 = Panel(spindle_startup_time_g_code)
int = Integer(spindle_speed_3)
merge = Merge(Data1="M3 S", Data2=int, Data3=" ; start spindle and set spindle speed")
merge_2 = Merge(Data1="G4 P", Data2=spindle_startup_time_g_code_2, Data3=" ;wait a few seconds for the spindle to start")
join_2 = TextJoin(Text=merge)
join_3 = TextJoin(Text=merge_2)
merge_3 = Merge(Data1=flatten(join_2), Data2=flatten(join_3))
filter_2 = StreamFilter(Gate=use_spindle_3, Stream1=merge_3)
g_code_spindle_start = Panel(filter_2)

# ----
feed_rate_3 = Number(multiplication_4)
gate = StreamGate(Stream=clean, Gate=use_trochoidal_milling)  # -> Target0, Target1, Target2

topoly = CurveToPolyline(Curve=gate.Target0, ToleranceDistance=deviation_tolerance_2, ToleranceAngle=0)  # -> Polyline, Segments
polyline_toolpaths = Curve(topoly.Polyline)

safe_z_height_3 = Number(division_3)
trochoidal_milling_bit_diameter = Number(multiplication_3)

# ---- group: Eliminate unecessary jog Z
connect_overlapping_toolpaths = ConnectOverlappingToolpaths(polyline_toolpaths=polyline_toolpaths)

# ---- group: Adds tabs to toolpaths
tab_toolpaths = TabToolpaths(polyline_toolpaths=gate.Target1, tab_breps=flatten, milling_bit_diamter=trochoidal_milling_bit_diameter)  # -> tabbed_toolpaths_3, tab_cleanup_toolpaths_4

tab_toolpaths_2 = TabToolpaths(polyline_toolpaths=gate.Target2, tab_breps=flatten, milling_bit_diamter=milling_bit_diameter_2)  # -> tabbed_toolpaths_3, tab_cleanup_toolpaths_4

# ----
ramp_plunges_3 = Integer(ramp_plunges_2)
filter_3 = StreamFilter(Gate=ramp_plunges_3, Stream0=connect_overlapping_toolpaths, Stream1=polyline_toolpaths)
trochoidal_high_speed_milling = TrochoidalHighSpeedMilling(
    toolpath_curves=tab_toolpaths.tab_cleanup_toolpaths_4,
    milling_bit_diameter=milling_bit_diameter_2,
    toolpath_width_factor=toolpath_width_factor_2,
    stepover=stepover_2,
    ramp_angle=ramp_angle_2,
    jog_z_lift_factor=0.1,
    use_climb_milling=True,
    straight_arc_extensions=True,
    use_peck_entry=use_peck_entry_2,
    max_peck_depth_factor=max_peck_depth_factor)
trochoidal_high_speed_milling_2 = TrochoidalHighSpeedMilling(
    toolpath_curves=tab_toolpaths.tabbed_toolpaths_3,
    milling_bit_diameter=milling_bit_diameter_2,
    toolpath_width_factor=toolpath_width_factor_2,
    stepover=stepover_2,
    ramp_angle=ramp_angle_2,
    jog_z_lift_factor=0.1,
    use_climb_milling=True,
    straight_arc_extensions=True,
    use_peck_entry=use_peck_entry_2,
    max_peck_depth_factor=max_peck_depth_factor)
plunge_roughing = PlungeRoughing(toolpath_curves=tab_toolpaths_2.tabbed_toolpaths_3, milling_bit_diameter=milling_bit_diameter_2, stepover=stepover_2)
plunge_roughing_2 = PlungeRoughing(
    toolpath_curves=tab_toolpaths_2.tab_cleanup_toolpaths_4,
    milling_bit_diameter=milling_bit_diameter_2,
    stepover=stepover_2)

# ---- group: Adds tabs to toolpaths
tab_toolpaths_3 = TabToolpaths(polyline_toolpaths=filter_3, tab_breps=flatten, milling_bit_diamter=milling_bit_diameter_2)  # -> tabbed_toolpaths_3, tab_cleanup_toolpaths_4

# ----
topoly_2 = CurveToPolyline(Curve=trochoidal_high_speed_milling, ToleranceDistance=deviation_tolerance_2, ToleranceAngle=0)  # -> Polyline, Segments
topoly_3 = CurveToPolyline(Curve=trochoidal_high_speed_milling_2, ToleranceDistance=deviation_tolerance_2, ToleranceAngle=0)  # -> Polyline, Segments

# ---- group: Add ramps to cleanup toolpaths
tab_cleanup_toolpaths = Curve(tab_toolpaths_3.tab_cleanup_toolpaths_4)
ramp_toolpath_plunges = RampToolpathPlunges(toolpaths_to_ramp=tab_cleanup_toolpaths, ramp_angle=ramp_angle_2)
ramp_plunges_4 = Integer(ramp_plunges_2)
filter_4 = StreamFilter(Gate=ramp_plunges_4, Stream0=tab_cleanup_toolpaths, Stream1=ramp_toolpath_plunges)

# ----
plunge_rough_lines = Curve(plunge_roughing)
plunge_rough_lines_2 = Curve(plunge_roughing_2)
join_4 = JoinCurves(Curves=topoly_3.Polyline, Preserve=False)
join_5 = JoinCurves(Curves=topoly_2.Polyline, Preserve=False)

# ---- group: Add ramps to toolpaths
ramp_toolpath_plunges_2 = RampToolpathPlunges(toolpaths_to_ramp=tab_toolpaths_3.tabbed_toolpaths_3, ramp_angle=ramp_angle_2)
ramp_plunges_5 = Integer(ramp_plunges_2)
filter_5 = StreamFilter(
    Gate=flatten(ramp_plunges_5),
    Stream0=flatten(tab_toolpaths_3.tabbed_toolpaths_3),
    Stream1=flatten(ramp_toolpath_plunges_2))

# ----
trochoidal_polyline_toolpaths = Curve(join_4)
trochoidal_polyline_toolpaths_2 = Curve(join_5)
connect_overlapping_toolpaths_2 = ConnectOverlappingToolpaths(polyline_toolpaths=filter_4)
connect_overlapping_toolpaths_3 = ConnectOverlappingToolpaths(polyline_toolpaths=filter_5)
filter_6 = StreamFilter(
    Gate=use_high_speed_machining_3,
    Stream0=connect_overlapping_toolpaths_2,
    Stream1=trochoidal_polyline_toolpaths_2,
    Stream2=plunge_rough_lines_2)
filter_7 = StreamFilter(
    Gate=use_high_speed_machining_4,
    Stream0=connect_overlapping_toolpaths_3,
    Stream1=trochoidal_polyline_toolpaths,
    Stream2=plunge_rough_lines)

# ---- group: Send tab cleanup toolpath points to g-code or ShopBot code postprocessor
cp = ControlPoints(Curve=filter_6)  # -> Points, Weights, Knots
toolpath_points_for_tab_cleanup_job = Point(cp.Points)
make_shopbot_code_not_g_code_3 = Boolean(make_shopbot_code_not_g_code_2)
gate_2 = StreamGate(Stream=toolpath_points_for_tab_cleanup_job, Gate=make_shopbot_code_not_g_code_3)  # -> Target0, Target1

# ---- group: Convert polylines to toolpath points
cp_2 = ControlPoints(Curve=filter_7)  # -> Points, Weights, Knots
toolpath_points = Point(cp_2.Points)

# ---- group: Send main toolpath points to g-code or ShopBot code postprocessor
make_shopbot_code_not_g_code_4 = Boolean(make_shopbot_code_not_g_code_2)
toolpath_points_2 = Point(toolpath_points)
gate_3 = StreamGate(Stream=toolpath_points_2, Gate=make_shopbot_code_not_g_code_4)  # -> Target0, Target1

# ----
toolpath_points_3 = Point(gate_3.Target0)
flatten_3 = FlattenTree(Tree=toolpath_points_3, Path="{0}")
lng = ListLength(List=flatten_3)
feed_rate_4 = Number(feed_rate_3)
dup = DuplicateData(Data=graft(feed_rate_4), Number=graft(lng), Order=True)
lng_2 = ListLength(List=toolpath_points_3)
dup_2 = DuplicateData(Data=flatten("F"), Number=flatten(lng), Order=True)
dup_3 = DuplicateData(Data=flatten(" X"), Number=flatten(lng), Order=True)
flatten_4 = FlattenTree(Tree=dup_2, Path="{0}")
flatten_5 = FlattenTree(Tree=dup_3, Path="{0}")
flatten_6 = FlattenTree(Tree=dup, Path="{0}")
pdecon = Deconstruct(Point=toolpath_points_3)  # -> XComponent, YComponent, ZComponent
graft = GraftTree(Tree=flatten_4, IncludeEmptyLists=True, IncludeNullItems=True)
graft_2 = GraftTree(Tree=flatten_6, IncludeEmptyLists=True, IncludeNullItems=True)
graft_3 = GraftTree(Tree=flatten_5, IncludeEmptyLists=True, IncludeNullItems=True)
panel = Panel(pdecon.XComponent)
panel_2 = Panel(pdecon.YComponent)
panel_3 = Panel(pdecon.ZComponent)
join_6 = TextJoin(Text=[graft, graft_2, graft_3])
dup_4 = DuplicateData(Data=" Z", Number=lng_2, Order=True)
dup_5 = DuplicateData(Data=" Y", Number=lng_2, Order=True)
dup_6 = DuplicateData(Data="G1 ", Number=lng_2, Order=True)
simplify = SimplifyTree(Tree=flatten(join_6), Front=False)
simplify_2 = SimplifyTree(Tree=flatten(dup_6), Front=False)
simplify_3 = SimplifyTree(Tree=flatten(panel), Front=False)
simplify_4 = SimplifyTree(Tree=flatten(dup_5), Front=False)
simplify_5 = SimplifyTree(Tree=flatten(panel_2), Front=False)
simplify_6 = SimplifyTree(Tree=flatten(dup_4), Front=False)
simplify_7 = SimplifyTree(Tree=flatten(panel_3), Front=False)
graft_4 = GraftTree(Tree=simplify_2, IncludeEmptyLists=True, IncludeNullItems=True)
graft_5 = GraftTree(Tree=simplify_3, IncludeEmptyLists=True, IncludeNullItems=True)
graft_6 = GraftTree(Tree=simplify_4, IncludeEmptyLists=True, IncludeNullItems=True)
graft_7 = GraftTree(Tree=simplify_5, IncludeEmptyLists=True, IncludeNullItems=True)
graft_8 = GraftTree(Tree=simplify_6, IncludeEmptyLists=True, IncludeNullItems=True)
graft_9 = GraftTree(Tree=simplify_7, IncludeEmptyLists=True, IncludeNullItems=True)
graft_10 = GraftTree(Tree=simplify, IncludeEmptyLists=True, IncludeNullItems=True)
join_7 = TextJoin(Text=[graft_4, graft_10, graft_5, graft_6, graft_7, graft_8, graft_9])
flatten_7 = FlattenTree(Tree=join_7, Path="{0}")
panel_4 = Panel(flatten_7)

toolpath_points_4 = Point(gate_2.Target0)
flatten_8 = FlattenTree(Tree=toolpath_points_4, Path="{0}")
lng_3 = ListLength(List=flatten_8)
feed_rate_5 = Number(feed_rate_3)
dup_7 = DuplicateData(Data=graft(feed_rate_5), Number=graft(lng_3), Order=True)
lng_4 = ListLength(List=toolpath_points_4)
dup_8 = DuplicateData(Data=flatten("F"), Number=flatten(lng_3), Order=True)
dup_9 = DuplicateData(Data=flatten(" X"), Number=flatten(lng_3), Order=True)
flatten_9 = FlattenTree(Tree=dup_8, Path="{0}")
flatten_10 = FlattenTree(Tree=dup_9, Path="{0}")
flatten_11 = FlattenTree(Tree=dup_7, Path="{0}")
pdecon_2 = Deconstruct(Point=toolpath_points_4)  # -> XComponent, YComponent, ZComponent
graft_11 = GraftTree(Tree=flatten_9, IncludeEmptyLists=True, IncludeNullItems=True)
graft_12 = GraftTree(Tree=flatten_11, IncludeEmptyLists=True, IncludeNullItems=True)
graft_13 = GraftTree(Tree=flatten_10, IncludeEmptyLists=True, IncludeNullItems=True)
panel_5 = Panel(pdecon_2.XComponent)
panel_6 = Panel(pdecon_2.YComponent)
panel_7 = Panel(pdecon_2.ZComponent)
join_8 = TextJoin(Text=[graft_11, graft_12, graft_13])
dup_10 = DuplicateData(Data=" Z", Number=lng_4, Order=True)
dup_11 = DuplicateData(Data=" Y", Number=lng_4, Order=True)
dup_12 = DuplicateData(Data="G1 ", Number=lng_4, Order=True)
simplify_8 = SimplifyTree(Tree=flatten(join_8), Front=False)
simplify_9 = SimplifyTree(Tree=flatten(dup_12), Front=False)
simplify_10 = SimplifyTree(Tree=flatten(panel_5), Front=False)
simplify_11 = SimplifyTree(Tree=flatten(dup_11), Front=False)
simplify_12 = SimplifyTree(Tree=flatten(panel_6), Front=False)
simplify_13 = SimplifyTree(Tree=flatten(dup_10), Front=False)
simplify_14 = SimplifyTree(Tree=flatten(panel_7), Front=False)
graft_14 = GraftTree(Tree=simplify_9, IncludeEmptyLists=True, IncludeNullItems=True)
graft_15 = GraftTree(Tree=simplify_10, IncludeEmptyLists=True, IncludeNullItems=True)
graft_16 = GraftTree(Tree=simplify_11, IncludeEmptyLists=True, IncludeNullItems=True)
graft_17 = GraftTree(Tree=simplify_12, IncludeEmptyLists=True, IncludeNullItems=True)
graft_18 = GraftTree(Tree=simplify_13, IncludeEmptyLists=True, IncludeNullItems=True)
graft_19 = GraftTree(Tree=simplify_14, IncludeEmptyLists=True, IncludeNullItems=True)
graft_20 = GraftTree(Tree=simplify_8, IncludeEmptyLists=True, IncludeNullItems=True)
join_9 = TextJoin(Text=[graft_14, graft_20, graft_15, graft_16, graft_17, graft_18, graft_19])
flatten_12 = FlattenTree(Tree=join_9, Path="{0}")
panel_8 = Panel(flatten_12)

toolpath_points_5 = Point(gate_2.Target1)
toolpath_points_6 = Point(gate_3.Target1)
pdecon_3 = Deconstruct(Point=toolpath_points_5)  # -> XComponent, YComponent, ZComponent

# ---- group: Optional MM to inch conversion
convert_to_inches_boolean = Panel(convert_to_inches)
filter_8 = StreamFilter(Gate=convert_to_inches_boolean, Stream0="1", Stream1="25.4")
division_6 = Division(A=pdecon_3.XComponent, B=filter_8)
division_7 = Division(A=pdecon_3.YComponent, B=filter_8)
division_8 = Division(A=pdecon_3.ZComponent, B=filter_8)

# ----
lng_5 = ListLength(List=toolpath_points_5)
pdecon_4 = Deconstruct(Point=toolpath_points_6)  # -> XComponent, YComponent, ZComponent

# ---- group: Optional MM to inch conversion
convert_to_inches_boolean_2 = Panel(convert_to_inches)
filter_9 = StreamFilter(Gate=convert_to_inches_boolean_2, Stream0="1", Stream1="25.4")
division_9 = Division(A=pdecon_4.XComponent, B=filter_9)
division_10 = Division(A=pdecon_4.YComponent, B=filter_9)
division_11 = Division(A=pdecon_4.ZComponent, B=filter_9)

# ----
lng_6 = ListLength(List=toolpath_points_6)

jog_rate_x_y_2 = Number(jog_rate_x_y)
item = ListItem(List=pdecon_2.XComponent, Index=0, Wrap=True)
custom_home_x_3 = Number(division)
use_custom_jog_home_2 = Integer(use_custom_jog_home)
custom_home_y_3 = Number(division_2)
item_2 = ListItem(List=pdecon_2.YComponent, Index=0, Wrap=True)
int_2 = Integer(jog_rate_x_y_2)
lng_7 = ListLength(List=flatten(item))
safe_z_height_4 = Number(safe_z_height_2)
lng_8 = ListLength(List=flatten(item))
panel_9 = Panel(custom_home_y_3)
join_10 = TextJoin(Text=["F", int_2, " X"])
panel_10 = Panel(custom_home_x_3)
dup_13 = DuplicateData(Data="G1 ", Number=lng_7, Order=True)
dup_14 = DuplicateData(Data=" Y", Number=lng_7, Order=True)
dup_15 = DuplicateData(Data=" Z", Number=lng_7, Order=True)
dup_16 = DuplicateData(Data=safe_z_height_4, Number=lng_7, Order=True)
dup_17 = DuplicateData(Data=join_10, Number=lng_8, Order=True)
filter_10 = StreamFilter(Gate=use_custom_jog_home_2, Stream0="0", Stream1=panel_9)
filter_11 = StreamFilter(Gate=use_custom_jog_home_2, Stream0="0", Stream1=panel_10)
simplify_15 = SimplifyTree(Tree=flatten(dup_13), Front=False)
simplify_16 = SimplifyTree(Tree=flatten(item), Front=False)
simplify_17 = SimplifyTree(Tree=flatten(dup_14), Front=False)
simplify_18 = SimplifyTree(Tree=flatten(item_2), Front=False)
simplify_19 = SimplifyTree(Tree=flatten(dup_15), Front=False)
simplify_20 = SimplifyTree(Tree=flatten(dup_16), Front=False)
simplify_21 = SimplifyTree(Tree=flatten(dup_17), Front=False)
graft_21 = GraftTree(Tree=simplify_15, IncludeEmptyLists=True, IncludeNullItems=True)
graft_22 = GraftTree(Tree=simplify_21, IncludeEmptyLists=True, IncludeNullItems=True)
graft_23 = GraftTree(Tree=simplify_16, IncludeEmptyLists=True, IncludeNullItems=True)
graft_24 = GraftTree(Tree=simplify_17, IncludeEmptyLists=True, IncludeNullItems=True)
graft_25 = GraftTree(Tree=simplify_18, IncludeEmptyLists=True, IncludeNullItems=True)
graft_26 = GraftTree(Tree=simplify_19, IncludeEmptyLists=True, IncludeNullItems=True)
graft_27 = GraftTree(Tree=simplify_20, IncludeEmptyLists=True, IncludeNullItems=True)
join_11 = TextJoin(Text=[graft_21, graft_22, graft_23, graft_24, graft_25])
jog_rate_x_y_3 = Integer(jog_rate_x_y_2)
flatten_13 = FlattenTree(Tree=join_11, Path="{0}")
join_12 = TextJoin(Text=["F", jog_rate_x_y_3])
home_x = Number(filter_11)
home_y = Number(filter_10)
join_13 = TextJoin(Text=["G1 ", join_12, " X", home_x, " Y", home_y])
merge_4 = Merge(Data1=flatten(flatten_13), Data2=flatten(join_13))
jog_x_y_positions = Panel(merge_4)

jog_rate_x_y_4 = Number(jog_rate_x_y)
item_3 = ListItem(List=pdecon.XComponent, Index=0, Wrap=True)
custom_home_x_4 = Number(division)
custom_home_y_4 = Number(division_2)
use_custom_jog_home_3 = Integer(use_custom_jog_home)
item_4 = ListItem(List=pdecon.YComponent, Index=0, Wrap=True)
int_3 = Integer(jog_rate_x_y_4)
lng_9 = ListLength(List=flatten(item_3))
safe_z_height_5 = Number(safe_z_height_2)
lng_10 = ListLength(List=flatten(item_3))
panel_11 = Panel(custom_home_y_4)
join_14 = TextJoin(Text=["F", int_3, " X"])
panel_12 = Panel(custom_home_x_4)
dup_18 = DuplicateData(Data="G1 ", Number=lng_9, Order=True)
dup_19 = DuplicateData(Data=" Y", Number=lng_9, Order=True)
dup_20 = DuplicateData(Data=" Z", Number=lng_9, Order=True)
dup_21 = DuplicateData(Data=safe_z_height_5, Number=lng_9, Order=True)
dup_22 = DuplicateData(Data=join_14, Number=lng_10, Order=True)
filter_12 = StreamFilter(Gate=use_custom_jog_home_3, Stream0="0", Stream1=panel_11)
filter_13 = StreamFilter(Gate=use_custom_jog_home_3, Stream0="0", Stream1=panel_12)
simplify_22 = SimplifyTree(Tree=flatten(dup_18), Front=False)
simplify_23 = SimplifyTree(Tree=flatten(item_3), Front=False)
simplify_24 = SimplifyTree(Tree=flatten(dup_19), Front=False)
simplify_25 = SimplifyTree(Tree=flatten(item_4), Front=False)
simplify_26 = SimplifyTree(Tree=flatten(dup_20), Front=False)
simplify_27 = SimplifyTree(Tree=flatten(dup_21), Front=False)
simplify_28 = SimplifyTree(Tree=flatten(dup_22), Front=False)
graft_28 = GraftTree(Tree=simplify_22, IncludeEmptyLists=True, IncludeNullItems=True)
graft_29 = GraftTree(Tree=simplify_28, IncludeEmptyLists=True, IncludeNullItems=True)
graft_30 = GraftTree(Tree=simplify_23, IncludeEmptyLists=True, IncludeNullItems=True)
graft_31 = GraftTree(Tree=simplify_24, IncludeEmptyLists=True, IncludeNullItems=True)
graft_32 = GraftTree(Tree=simplify_25, IncludeEmptyLists=True, IncludeNullItems=True)
graft_33 = GraftTree(Tree=simplify_26, IncludeEmptyLists=True, IncludeNullItems=True)
graft_34 = GraftTree(Tree=simplify_27, IncludeEmptyLists=True, IncludeNullItems=True)
join_15 = TextJoin(Text=[graft_28, graft_29, graft_30, graft_31, graft_32])
jog_rate_x_y_5 = Integer(jog_rate_x_y_4)
flatten_14 = FlattenTree(Tree=join_15, Path="{0}")
join_16 = TextJoin(Text=["F", jog_rate_x_y_5])
home_x_2 = Number(filter_13)
home_y_2 = Number(filter_12)
join_17 = TextJoin(Text=["G1 ", join_16, " X", home_x_2, " Y", home_y_2])
merge_5 = Merge(Data1=flatten(flatten_14), Data2=flatten(join_17))
jog_x_y_positions_2 = Panel(merge_5)

flatten_15 = FlattenTree(Tree=lng_5, Path="{0}")
flatten_16 = FlattenTree(Tree=lng_6, Path="{0}")
merge_6 = Merge(Data1=Slider(0, range=0..100), Data2=flatten_15)
merge_7 = Merge(Data1=Slider(0, range=0..100), Data2=flatten_16)
panel_13 = Panel(division_6)
panel_14 = Panel(division_7)
panel_15 = Panel(division_8)
panel_16 = Panel(division_9)
panel_17 = Panel(division_10)
panel_18 = Panel(division_11)

# ---- group: Jog to safe Z
safe_z_height_6 = Number(flatten(safe_z_height_3))
text_5 = Text("JZ,")
graft_35 = GraftTree(Tree=safe_z_height_6, IncludeEmptyLists=True, IncludeNullItems=True)
graft_36 = GraftTree(Tree=text_5, IncludeEmptyLists=True, IncludeNullItems=True)
lng_11 = ListLength(List=flatten(merge_6))
join_18 = TextJoin(Text=[graft_36, graft_35])
dup_23 = DuplicateData(Data=join_18, Number=lng_11, Order=True)

safe_z_height_7 = Number(flatten(safe_z_height_3))
text_6 = Text("JZ,")
graft_37 = GraftTree(Tree=safe_z_height_7, IncludeEmptyLists=True, IncludeNullItems=True)
graft_38 = GraftTree(Tree=text_6, IncludeEmptyLists=True, IncludeNullItems=True)
lng_12 = ListLength(List=flatten(merge_7))
join_19 = TextJoin(Text=[graft_38, graft_37])
dup_24 = DuplicateData(Data=join_19, Number=lng_12, Order=True)

# ---- group: Name
# ShopBot code tab cleanup processing
panel_19 = Panel(join)

# ---- group: Set spindle speed
spindle_speed_4 = Number(spindle_speed_2)
int_4 = Integer(spindle_speed_4)
join_20 = TextJoin(Text=["TR,", int_4, ",1"])

# ---- group: Turn off spindle
filter_14 = StreamFilter(Gate=use_spindle_2, Stream1="SO,1,0")

# ---- group: Name
# ShopBot code toolpath processing
panel_20 = Panel(join)

# ---- group: Set spindle speed
spindle_speed_5 = Number(spindle_speed_2)
int_5 = Integer(spindle_speed_5)
join_21 = TextJoin(Text=["TR,", int_5, ",1"])

# ---- group: Toolpath coordinates
text_7 = Text("M3,")
text_8 = Text(",")
text_9 = Text(",")
dup_25 = DuplicateData(Data=text_9, Number=lng_5, Order=True)
dup_26 = DuplicateData(Data=text_8, Number=lng_5, Order=True)
dup_27 = DuplicateData(Data=text_7, Number=lng_5, Order=True)
simplify_29 = SimplifyTree(Tree=flatten(dup_27), Front=False)
simplify_30 = SimplifyTree(Tree=flatten(panel_13), Front=False)
simplify_31 = SimplifyTree(Tree=flatten(dup_26), Front=False)
simplify_32 = SimplifyTree(Tree=flatten(panel_14), Front=False)
simplify_33 = SimplifyTree(Tree=flatten(dup_25), Front=False)
simplify_34 = SimplifyTree(Tree=flatten(panel_15), Front=False)
graft_39 = GraftTree(Tree=simplify_29, IncludeEmptyLists=True, IncludeNullItems=True)
graft_40 = GraftTree(Tree=simplify_30, IncludeEmptyLists=True, IncludeNullItems=True)
graft_41 = GraftTree(Tree=simplify_31, IncludeEmptyLists=True, IncludeNullItems=True)
graft_42 = GraftTree(Tree=simplify_32, IncludeEmptyLists=True, IncludeNullItems=True)
graft_43 = GraftTree(Tree=simplify_33, IncludeEmptyLists=True, IncludeNullItems=True)
graft_44 = GraftTree(Tree=simplify_34, IncludeEmptyLists=True, IncludeNullItems=True)
join_22 = TextJoin(Text=[graft_39, graft_40, graft_41, graft_42, graft_43, graft_44])
flatten_17 = FlattenTree(Tree=join_22, Path="{0}")

# ---- group: Turn off spindle
filter_15 = StreamFilter(Gate=use_spindle_2, Stream1="SO,1,0")

# ---- group: Toolpath coordinates
text_10 = Text("M3,")
text_11 = Text(",")
text_12 = Text(",")
dup_28 = DuplicateData(Data=text_12, Number=lng_6, Order=True)
dup_29 = DuplicateData(Data=text_11, Number=lng_6, Order=True)
dup_30 = DuplicateData(Data=text_10, Number=lng_6, Order=True)
simplify_35 = SimplifyTree(Tree=flatten(dup_30), Front=False)
simplify_36 = SimplifyTree(Tree=flatten(panel_16), Front=False)
simplify_37 = SimplifyTree(Tree=flatten(dup_29), Front=False)
simplify_38 = SimplifyTree(Tree=flatten(panel_17), Front=False)
simplify_39 = SimplifyTree(Tree=flatten(dup_28), Front=False)
simplify_40 = SimplifyTree(Tree=flatten(panel_18), Front=False)
graft_45 = GraftTree(Tree=simplify_35, IncludeEmptyLists=True, IncludeNullItems=True)
graft_46 = GraftTree(Tree=simplify_36, IncludeEmptyLists=True, IncludeNullItems=True)
graft_47 = GraftTree(Tree=simplify_37, IncludeEmptyLists=True, IncludeNullItems=True)
graft_48 = GraftTree(Tree=simplify_38, IncludeEmptyLists=True, IncludeNullItems=True)
graft_49 = GraftTree(Tree=simplify_39, IncludeEmptyLists=True, IncludeNullItems=True)
graft_50 = GraftTree(Tree=simplify_40, IncludeEmptyLists=True, IncludeNullItems=True)
join_23 = TextJoin(Text=[graft_45, graft_46, graft_47, graft_48, graft_49, graft_50])
flatten_18 = FlattenTree(Tree=join_23, Path="{0}")

# ---- group: Start spindle
panel_21 = Panel("PAUSE 1")
filter_16 = StreamFilter(Gate=use_spindle_2, Stream1="SO,1,1")

# ---- group: Set Feed rate (X Y speed) and plunge rate (Z speed)
feed_rate_6 = Number(division_4)
plunge_rate_3 = Number(division_5)
plunge_rate_4 = Number(plunge_rate_3)
feed_rate_7 = Number(feed_rate_6)
text_13 = Text("MS,")
text_14 = Text(",")
join_24 = TextJoin(Text=flatten([text_13, feed_rate_7, text_14, plunge_rate_4]))

# ---- group: Start spindle
panel_22 = Panel("PAUSE 1")
filter_17 = StreamFilter(Gate=use_spindle_2, Stream1="SO,1,1")

# ---- group: Set Feed rate (X Y speed) and plunge rate (Z speed)
feed_rate_8 = Number(division_4)
plunge_rate_5 = Number(division_5)
plunge_rate_6 = Number(plunge_rate_5)
feed_rate_9 = Number(feed_rate_8)
text_15 = Text("MS,")
text_16 = Text(",")
join_25 = TextJoin(Text=flatten([text_15, feed_rate_9, text_16, plunge_rate_6]))

# ----
# G-Code toolpath processing
jog_rate_z_4 = Number(jog_rate_z_3)
int_6 = Integer(jog_rate_z_4)
safe_z_height_8 = Number(safe_z_height_2)
join_26 = TextJoin(Text=["F", int_6])
join_27 = TextJoin(Text=["G1 ", join_26, " Z", safe_z_height_8])
lng_13 = ListLength(List=merge_5)
dup_31 = DuplicateData(Data=join_27, Number=lng_13, Order=True)
flatten_19 = FlattenTree(Tree=dup_31, Path="{0}")
jog_z_positions = Panel(flatten_19)

# ----
# G-Code tab cleanup processing
jog_rate_z_5 = Number(jog_rate_z_3)
int_7 = Integer(jog_rate_z_5)
safe_z_height_9 = Number(safe_z_height_2)
join_28 = TextJoin(Text=["F", int_7])
join_29 = TextJoin(Text=["G1 ", join_28, " Z", safe_z_height_9])
lng_14 = ListLength(List=merge_4)
dup_32 = DuplicateData(Data=join_29, Number=lng_14, Order=True)
flatten_20 = FlattenTree(Tree=dup_32, Path="{0}")
jog_z_positions_2 = Panel(flatten_20)

filter_18 = StreamFilter(Gate=use_spindle_2, Stream1=join_20)
filter_19 = StreamFilter(Gate=use_spindle_2, Stream1=join_21)

# ---- group: Create safe Z transtions
toolpath_points_7 = Point(toolpath_points)
rev = ReverseList(List=toolpath_points_7)
safe_z_height_10 = Number(division_3)
item_5 = ListItem(List=toolpath_points_7, Index=0, Wrap=True)
item_6 = ListItem(List=rev, Index=0, Wrap=True)
pdecon_5 = Deconstruct(Point=item_5)  # -> XComponent, YComponent, ZComponent
pdecon_6 = Deconstruct(Point=item_6)  # -> XComponent, YComponent, ZComponent
pt = ConstructPoint(XCoordinate=pdecon_5.XComponent, YCoordinate=pdecon_5.YComponent, ZCoordinate=safe_z_height_10)
pt_2 = ConstructPoint(XCoordinate=pdecon_6.XComponent, YCoordinate=pdecon_6.YComponent, ZCoordinate=safe_z_height_10)
safe_z_end_point = Point(pt_2)
safe_z_start_point = Point(pt)

# ----
join_30 = TextJoin(Text=[text, division, text_3, division_2])
join_31 = TextJoin(Text=[text_2, division, text_4, division_2])

# ---- group: Insert JZ commands
ma = MassAddition(Input=merge_6)  # -> Result, PartialResults
ins = InsertItems(List=flatten_17, Item=dup_23, Indices=ma.PartialResults, Wrap=True)

ma_2 = MassAddition(Input=merge_7)  # -> Result, PartialResults
ins_2 = InsertItems(List=flatten_18, Item=dup_24, Indices=ma_2.PartialResults, Wrap=True)

# ---- group: Insert jog to safe Z
ma_3 = MassAddition(Input=flatten(lng_2))  # -> Result, PartialResults
merge_8 = Merge(Data1=Slider(0, range=0..100), Data2=ma_3.PartialResults)
ins_3 = InsertItems(List=flatten(panel_4), Item=flatten(jog_z_positions), Indices=flatten(merge_8), Wrap=True)

ma_4 = MassAddition(Input=flatten(lng_4))  # -> Result, PartialResults
merge_9 = Merge(Data1=Slider(0, range=0..100), Data2=ma_4.PartialResults)
ins_4 = InsertItems(List=flatten(panel_8), Item=flatten(jog_z_positions_2), Indices=flatten(merge_9), Wrap=True)

# ---- group: Create toolpath preview
rev_2 = ReverseList(List=flatten(safe_z_end_point))
cull_i = CullIndex(List=flatten(safe_z_start_point), Indices=0, Wrap=True)
cull_i_2 = CullIndex(List=rev_2, Indices=0, Wrap=True)
rev_3 = ReverseList(List=flatten(cull_i_2))
ln = Line(StartPoint=rev_3, EndPoint=cull_i)
ln_2 = Line(StartPoint=safe_z_start_point, EndPoint=item_5)
ln_3 = Line(StartPoint=item_6, EndPoint=safe_z_end_point)
tab_cleanup_preview_curves = Curve(filter_6)
cut_transition_preview_lines = Curve(flatten(ln))
cut_entry_preview_lines = Curve(flatten(ln_2))
cut_exit_preview_lines = Curve(flatten(ln_3))
toolpath_preview_curves = Curve(filter_7)

# ----
g_code_spindle_start_2 = Panel(g_code_spindle_start)
g_code_spindle_start_3 = Panel(g_code_spindle_start)
panel_23 = Panel(join_27)
panel_24 = Panel(join_29)

# ---- group: Insert jog X Y positions
lng_15 = ListLength(List=merge_8)
series = Series(Start=1, Step=1, Count=lng_15)
addition = Addition(A=merge_8, B=series)
ins_5 = InsertItems(List=flatten(ins_3), Item=flatten(jog_x_y_positions_2), Indices=flatten(addition), Wrap=True)

lng_16 = ListLength(List=merge_9)
series_2 = Series(Start=1, Step=1, Count=lng_16)
addition_2 = Addition(A=merge_9, B=series_2)
ins_6 = InsertItems(List=flatten(ins_4), Item=flatten(jog_x_y_positions), Indices=flatten(addition_2), Wrap=True)

# ----
merge_10 = Merge(Data1=start_code_3, Data2=panel_23, Data3=g_code_spindle_start_2)
merge_11 = Merge(Data1=start_code_4, Data2=panel_24, Data3=g_code_spindle_start_3)
tab_cleanup_preview_curves_2 = ClusterOutput(tab_cleanup_preview_curves)
# Startcode - Ultimaker original , extruder upgrade + heatbed: M190 S70.000000
# M109 T0 S220.000000
# T0
# G21        ;metric values
# G90        ;absolute positioning
# M82        ;set extruder to absolute mode
# M107       ;start with the fan off
# G28 X0 Y0  ;move X/Y to min endstops
# G28 Z0     ;move Z to min endstops
# G1 Z15.0 F9000 ;move the platform down 15mm
# G92 E0                  ;zero the extruded length
# G1 F200 E17              ;extrude 17mm of feed stock
# G92 E0                  ;zero the extruded length again
# G1 F9000
# ;Put printing message on LCD screen
# M117 Bark beetle
# Startcode - Printrbot Simple: M190 S30.000000
# M109 S220.000000
# ;Sliced at: Mon 16-03-2015 21:37:50
# ;Basic settings: Layer height: 0.2 Walls: 0.8 Fill: 20
# ;Print time: 3 minutes
# ;Filament used: 0.151m 0.0g
# ;Filament cost: None
# ;M190 S30 ;Uncomment to add your own bed temperature line
# ;M109 S220 ;Uncomment to add your own temperature line
# G21        ;metric values
# G90        ;absolute positioning
# M82        ;set extruder to absolute mode
# M107       ;start with the fan off
# 
# G28 X0 Y0  ;move X/Y to min endstops
# G28 Z0     ;move Z to min endstops
# 
# G1 Z15.0 F9000 ;move the platform down 15mm
# 
# G92 E0                  ;zero the extruded length
# G1 F200 E6              ;extrude 6mm of feed stock
# G92 E0                  ;zero the extruded length again
# G1 F9000
# Startcode - FABtotum: G90        ;absolute positioning
# 
# ;G28	;Home all Axis
# 
# M3 S15000 ;SPINDLE ON - Clockwise , tries to maintain RPM constant min: 6500, max: 15000
# G4 S4; Dwell 4 seconds
# 
# G0 F600 Z-210; move to custom Z 0 position
# G92 Z0; set new zero position
startcode = Panel(merge_10)
startcode_2 = Panel(merge_11)
cut_transition_preview_lines_2 = ClusterOutput(cut_transition_preview_lines)
cut_exit_preview_lines_2 = ClusterOutput(cut_exit_preview_lines)
toolpath_preview_curves_2 = ClusterOutput(toolpath_preview_curves)
cut_entry_preview_lines_2 = ClusterOutput(cut_entry_preview_lines)
merge_12 = Merge(Data1=flatten(startcode), Data2=flatten(ins_5), Data3=flatten(endcode))
merge_13 = Merge(Data1=flatten(startcode_2), Data2=flatten(ins_6), Data3=flatten(endcode_2))
tab_cleanup_toolpath_g_code = Panel(merge_13)
# Rigth click and choose "Stream destination"
# 
# Give a file name ending with .gcode
# 
# Your toolpath will automatically be updated!
toolpath_g_code = Panel(merge_12)
toolpath_g_code_2 = Panel(toolpath_g_code)
tab_cleanup_toolpath_g_code_2 = Panel(tab_cleanup_toolpath_g_code)

# ---- group: Jog to startpoints
item_7 = ListItem(List=division_6, Index=0, Wrap=True)
item_8 = ListItem(List=division_7, Index=0, Wrap=True)
lng_17 = ListLength(List=flatten(item_7))
text_17 = Text(",")
text_18 = Text("J2,")
dup_33 = DuplicateData(Data=text_18, Number=lng_17, Order=True)
dup_34 = DuplicateData(Data=text_17, Number=lng_17, Order=True)
simplify_41 = SimplifyTree(Tree=flatten(dup_33), Front=False)
simplify_42 = SimplifyTree(Tree=flatten(item_7), Front=False)
simplify_43 = SimplifyTree(Tree=flatten(dup_34), Front=False)
simplify_44 = SimplifyTree(Tree=flatten(item_8), Front=False)
graft_51 = GraftTree(Tree=simplify_41, IncludeEmptyLists=True, IncludeNullItems=True)
graft_52 = GraftTree(Tree=simplify_42, IncludeEmptyLists=True, IncludeNullItems=True)
graft_53 = GraftTree(Tree=simplify_43, IncludeEmptyLists=True, IncludeNullItems=True)
graft_54 = GraftTree(Tree=simplify_44, IncludeEmptyLists=True, IncludeNullItems=True)
join_32 = TextJoin(Text=[graft_51, graft_52, graft_53, graft_54])
jh = Text("JH")
flatten_21 = FlattenTree(Tree=join_32, Path="{0}")

# ----
filter_20 = StreamFilter(Gate=use_custom_jog_home, Stream0=jh, Stream1=flatten(join_30))

# ---- group: Jog to startpoints (continued)
merge_14 = Merge(Data1=flatten_21, Data2=filter_20)

# ---- group: Insert J2 commands
lng_18 = ListLength(List=merge_14)
dup_35 = DuplicateData(Data=Slider(1, range=0..1), Number=lng_18, Order=True)
addition_3 = Addition(A=dup_35, B=merge_6)
ma_5 = MassAddition(Input=addition_3)  # -> Result, PartialResults
ins_7 = InsertItems(List=ins, Item=merge_14, Indices=ma_5.PartialResults, Wrap=True)

# ----
flatten_22 = FlattenTree(Tree=ins_7, Path="{0}")
merge_15 = Merge(
    Data1=start_code_5,
    Data2=panel_19,
    Data3=filter_18,
    Data4=filter_16,
    Data5=panel_21,
    Data6=join_24,
    Data7=flatten_22,
    Data8=filter_14,
    Data9=end_code_5)
tab_cleanup_toolpath_shopbot_code = Panel(merge_15)
tab_cleanup_toolpath_shopbot_code_2 = Panel(tab_cleanup_toolpath_shopbot_code)
filter_21 = StreamFilter(Gate=make_shopbot_code_not_g_code_2, Stream0=tab_cleanup_toolpath_g_code_2, Stream1=tab_cleanup_toolpath_shopbot_code_2)
g_code_for_tab_cleanup = ClusterOutput(filter_21)  # Connect a panel to stream the code to a folder on your computer

# ---- group: Jog to startpoints
item_9 = ListItem(List=division_9, Index=0, Wrap=True)
item_10 = ListItem(List=division_10, Index=0, Wrap=True)
lng_19 = ListLength(List=flatten(item_9))
text_19 = Text(",")
text_20 = Text("J2,")
dup_36 = DuplicateData(Data=text_20, Number=lng_19, Order=True)
dup_37 = DuplicateData(Data=text_19, Number=lng_19, Order=True)
simplify_45 = SimplifyTree(Tree=flatten(dup_36), Front=False)
simplify_46 = SimplifyTree(Tree=flatten(item_9), Front=False)
simplify_47 = SimplifyTree(Tree=flatten(dup_37), Front=False)
simplify_48 = SimplifyTree(Tree=flatten(item_10), Front=False)
graft_55 = GraftTree(Tree=simplify_45, IncludeEmptyLists=True, IncludeNullItems=True)
graft_56 = GraftTree(Tree=simplify_46, IncludeEmptyLists=True, IncludeNullItems=True)
graft_57 = GraftTree(Tree=simplify_47, IncludeEmptyLists=True, IncludeNullItems=True)
graft_58 = GraftTree(Tree=simplify_48, IncludeEmptyLists=True, IncludeNullItems=True)
join_33 = TextJoin(Text=[graft_55, graft_56, graft_57, graft_58])
jh_2 = Text("JH")
flatten_23 = FlattenTree(Tree=join_33, Path="{0}")

# ----
filter_22 = StreamFilter(Gate=use_custom_jog_home, Stream0=jh_2, Stream1=flatten(join_31))

# ---- group: Jog to startpoints (continued)
merge_16 = Merge(Data1=flatten_23, Data2=filter_22)

# ---- group: Insert J2 commands
lng_20 = ListLength(List=merge_16)
dup_38 = DuplicateData(Data=Slider(1, range=0..1), Number=lng_20, Order=True)
addition_4 = Addition(A=dup_38, B=merge_7)
ma_6 = MassAddition(Input=addition_4)  # -> Result, PartialResults
ins_8 = InsertItems(List=ins_2, Item=merge_16, Indices=ma_6.PartialResults, Wrap=True)

# ----
flatten_24 = FlattenTree(Tree=ins_8, Path="{0}")
merge_17 = Merge(
    Data1=start_code_6,
    Data2=panel_20,
    Data3=filter_19,
    Data4=filter_17,
    Data5=panel_22,
    Data6=join_25,
    Data7=flatten_24,
    Data8=filter_15,
    Data9=end_code_6)
toolpath_shopbot_code = Panel(merge_17)
toolpath_shopbot_code_2 = Panel(toolpath_shopbot_code)
filter_23 = StreamFilter(Gate=make_shopbot_code_not_g_code_2, Stream0=toolpath_g_code_2, Stream1=toolpath_shopbot_code_2)
g_code_stream = ClusterOutput(filter_23)  # Connect a panel to stream the code to a folder on your computer

# ==== cluster CustomStartGCode
material_thicness = ClusterInput()
custom_start_code = ClusterInput()
material_thicness_2 = Number(material_thicness)
start_code_fom_external_file = Panel(custom_start_code)
material_thicness_3 = Panel(material_thicness_2)
merge = Merge(Data1="G0 Z", Data2=material_thicness_3, Data3=" ;jog to material height")
join = TextJoin(Text=merge)
merge_2 = Merge(Data1=flatten(start_code_fom_external_file), Data2=flatten(join), Data3=flatten("G92 Z0 ; make top of material Z zero"))
panel = Panel(merge_2)
start_code = Text(panel)
start_code_2 = ClusterOutput(start_code)

# ==== cluster CNCMillingPostProcessor_2: Converts toolpath curves into coordinates that a CNC machine can read. Use tab boxes for making safe cutouts, and ramps for smooth entry into hard materials.
make_shopbot_code_not_g_code = ClusterInput()
use_high_speed_machining = ClusterInput()  # 0=off 1=Trochoidal 2=Plunge roughing
toolpath_width_factor = ClusterInput()
milling_bit_diameter = ClusterInput()
deviation_tolerance = ClusterInput()
custom_home_x = ClusterInput()
toolpath_curves = ClusterInput()
custom_home_y = ClusterInput()
use_peck_entry = ClusterInput()
ramp_plunges = ClusterInput()
spindle_speed = ClusterInput()
safe_z_height = ClusterInput()
ramp_angle = ClusterInput()
use_spindle = ClusterInput()
plunge_rate = ClusterInput()
start_code = ClusterInput()  # Add a suitable start code for your machine here
tab_breps = ClusterInput()
jog_rate_z = ClusterInput()
job_name = ClusterInput()
feed_rate = ClusterInput()
end_code = ClusterInput()  # Add a suitable end code for your machine here
stepover = ClusterInput()
jog_rate = ClusterInput()

# ---- group: Additional settings
spindle_startup_time_g_code = Panel("5")
max_peck_depth_factor = Panel("0.4")
use_custom_jog_home = Integer(Toggle(True))

# ----
jog_rate_2 = Number(jog_rate)
jog_rate_z_2 = Number(jog_rate_z)
start_code_2 = Text(start_code)
end_code_2 = Text(end_code)
make_shopbot_code_not_g_code_2 = Boolean(make_shopbot_code_not_g_code)
use_high_speed_machining_2 = Integer(use_high_speed_machining)
toolpath_width_factor_2 = Number(toolpath_width_factor)
stepover_2 = Number(stepover)
use_peck_entry_2 = Boolean(use_peck_entry)
multiplication = Multiplication(A=jog_rate_2, B="60")
multiplication_2 = Multiplication(A=jog_rate_z_2, B="60")
jog_rate_z_3 = Number(multiplication_2)
jog_rate_x_y = Number(multiplication)
use_trochoidal_milling = Panel(use_high_speed_machining_2)
use_high_speed_machining_3 = Panel(use_high_speed_machining_2)
use_high_speed_machining_4 = Panel(use_high_speed_machining_2)
text = Text("J2,")
text_2 = Text("J2,")
text_3 = Text(",")
text_4 = Text(",")
start_code_3 = Text(start_code_2)
start_code_4 = Text(start_code_2)
end_code_3 = Text(end_code_2)
end_code_4 = Text(end_code_2)
endcode = Panel(end_code_3)
endcode_2 = Panel(end_code_4)
endcode_3 = Panel("""G4  S3
M280 S-90 P0 F3000 R""")
endcode_fabtotum = Panel("""G4 S2; Dwell
M5; SPINDLE OFF""")
start_code_5 = Text(start_code_2)
start_code_6 = Text(start_code_2)
end_code_5 = Text(end_code_2)
end_code_6 = Text(end_code_2)

toolpath_curves_2 = Curve(toolpath_curves)
tab_breps_2 = Brep(tab_breps)
feed_rate_2 = Number(feed_rate)
plunge_rate_2 = Number(plunge_rate)
safe_z_height_2 = Number(safe_z_height)
use_spindle_2 = Integer(use_spindle)
spindle_speed_2 = Number(spindle_speed)
ramp_plunges_2 = Integer(ramp_plunges)
ramp_angle_2 = Number(ramp_angle)
custom_home_x_2 = Number(custom_home_x)
custom_home_y_2 = Number(custom_home_y)
deviation_tolerance_2 = Number(deviation_tolerance)
milling_bit_diameter_2 = Number(milling_bit_diameter)
job_name_2 = Text(job_name)
convert_to_inches = BooleanToggle(False)
flatten = FlattenTree(Tree=tab_breps_2, Path="{0}")
flatten_2 = FlattenTree(Tree=toolpath_curves_2, Path="{0}")
use_inches_boolean = Panel(convert_to_inches)
clean = CleanTree(RemoveNulls=True, RemoveInvalid=True, RemoveEmpty=False, Tree=flatten_2)
filter = StreamFilter(Gate=use_inches_boolean, Stream0="1", Stream1="25.4")
division = Division(A=custom_home_x_2, B=filter)
division_2 = Division(A=custom_home_y_2, B=filter)
join = TextJoin(Text=flatten(["'", job_name_2]))
division_3 = Division(A=safe_z_height_2, B=filter)
division_4 = Division(A=feed_rate_2, B=filter)
division_5 = Division(A=plunge_rate_2, B=filter)

multiplication_3 = Multiplication(A=milling_bit_diameter_2, B=toolpath_width_factor_2)
multiplication_4 = Multiplication(A=feed_rate_2, B="60")

# ---- group: Make G-Code spindle start
spindle_speed_3 = Number(spindle_speed_2)
use_spindle_3 = Integer(use_spindle_2)
spindle_startup_time_g_code_2 = Panel(spindle_startup_time_g_code)
int = Integer(spindle_speed_3)
merge = Merge(Data1="M3 S", Data2=int, Data3=" ; start spindle and set spindle speed")
merge_2 = Merge(Data1="G4 P", Data2=spindle_startup_time_g_code_2, Data3=" ;wait a few seconds for the spindle to start")
join_2 = TextJoin(Text=merge)
join_3 = TextJoin(Text=merge_2)
merge_3 = Merge(Data1=flatten(join_2), Data2=flatten(join_3))
filter_2 = StreamFilter(Gate=use_spindle_3, Stream1=merge_3)
g_code_spindle_start = Panel(filter_2)

# ----
feed_rate_3 = Number(multiplication_4)
gate = StreamGate(Stream=clean, Gate=use_trochoidal_milling)  # -> Target0, Target1, Target2

topoly = CurveToPolyline(Curve=gate.Target0, ToleranceDistance=deviation_tolerance_2, ToleranceAngle=0)  # -> Polyline, Segments
polyline_toolpaths = Curve(topoly.Polyline)

safe_z_height_3 = Number(division_3)
trochoidal_milling_bit_diameter = Number(multiplication_3)

# ---- group: Eliminate unecessary jog Z
connect_overlapping_toolpaths = ConnectOverlappingToolpaths(polyline_toolpaths=polyline_toolpaths)

# ---- group: Adds tabs to toolpaths
tab_toolpaths = TabToolpaths(polyline_toolpaths=gate.Target1, tab_breps=flatten, milling_bit_diamter=trochoidal_milling_bit_diameter)  # -> tabbed_toolpaths_3, tab_cleanup_toolpaths_4

tab_toolpaths_2 = TabToolpaths(polyline_toolpaths=gate.Target2, tab_breps=flatten, milling_bit_diamter=milling_bit_diameter_2)  # -> tabbed_toolpaths_3, tab_cleanup_toolpaths_4

# ----
ramp_plunges_3 = Integer(ramp_plunges_2)
filter_3 = StreamFilter(Gate=ramp_plunges_3, Stream0=connect_overlapping_toolpaths, Stream1=polyline_toolpaths)
trochoidal_high_speed_milling = TrochoidalHighSpeedMilling(
    toolpath_curves=tab_toolpaths.tab_cleanup_toolpaths_4,
    milling_bit_diameter=milling_bit_diameter_2,
    toolpath_width_factor=toolpath_width_factor_2,
    stepover=stepover_2,
    ramp_angle=ramp_angle_2,
    jog_z_lift_factor=0.1,
    use_climb_milling=True,
    straight_arc_extensions=True,
    use_peck_entry=use_peck_entry_2,
    max_peck_depth_factor=max_peck_depth_factor)
trochoidal_high_speed_milling_2 = TrochoidalHighSpeedMilling(
    toolpath_curves=tab_toolpaths.tabbed_toolpaths_3,
    milling_bit_diameter=milling_bit_diameter_2,
    toolpath_width_factor=toolpath_width_factor_2,
    stepover=stepover_2,
    ramp_angle=ramp_angle_2,
    jog_z_lift_factor=0.1,
    use_climb_milling=True,
    straight_arc_extensions=True,
    use_peck_entry=use_peck_entry_2,
    max_peck_depth_factor=max_peck_depth_factor)
plunge_roughing = PlungeRoughing(toolpath_curves=tab_toolpaths_2.tabbed_toolpaths_3, milling_bit_diameter=milling_bit_diameter_2, stepover=stepover_2)
plunge_roughing_2 = PlungeRoughing(
    toolpath_curves=tab_toolpaths_2.tab_cleanup_toolpaths_4,
    milling_bit_diameter=milling_bit_diameter_2,
    stepover=stepover_2)

# ---- group: Adds tabs to toolpaths
tab_toolpaths_3 = TabToolpaths(polyline_toolpaths=filter_3, tab_breps=flatten, milling_bit_diamter=milling_bit_diameter_2)  # -> tabbed_toolpaths_3, tab_cleanup_toolpaths_4

# ----
topoly_2 = CurveToPolyline(Curve=trochoidal_high_speed_milling, ToleranceDistance=deviation_tolerance_2, ToleranceAngle=0)  # -> Polyline, Segments
topoly_3 = CurveToPolyline(Curve=trochoidal_high_speed_milling_2, ToleranceDistance=deviation_tolerance_2, ToleranceAngle=0)  # -> Polyline, Segments

# ---- group: Add ramps to cleanup toolpaths
tab_cleanup_toolpaths = Curve(tab_toolpaths_3.tab_cleanup_toolpaths_4)
ramp_toolpath_plunges = RampToolpathPlunges(toolpaths_to_ramp=tab_cleanup_toolpaths, ramp_angle=ramp_angle_2)
ramp_plunges_4 = Integer(ramp_plunges_2)
filter_4 = StreamFilter(Gate=ramp_plunges_4, Stream0=tab_cleanup_toolpaths, Stream1=ramp_toolpath_plunges)

# ----
plunge_rough_lines = Curve(plunge_roughing)
plunge_rough_lines_2 = Curve(plunge_roughing_2)
join_4 = JoinCurves(Curves=topoly_3.Polyline, Preserve=False)
join_5 = JoinCurves(Curves=topoly_2.Polyline, Preserve=False)

# ---- group: Add ramps to toolpaths
ramp_toolpath_plunges_2 = RampToolpathPlunges(toolpaths_to_ramp=tab_toolpaths_3.tabbed_toolpaths_3, ramp_angle=ramp_angle_2)
ramp_plunges_5 = Integer(ramp_plunges_2)
filter_5 = StreamFilter(
    Gate=flatten(ramp_plunges_5),
    Stream0=flatten(tab_toolpaths_3.tabbed_toolpaths_3),
    Stream1=flatten(ramp_toolpath_plunges_2))

# ----
trochoidal_polyline_toolpaths = Curve(join_4)
trochoidal_polyline_toolpaths_2 = Curve(join_5)
connect_overlapping_toolpaths_2 = ConnectOverlappingToolpaths(polyline_toolpaths=filter_4)
connect_overlapping_toolpaths_3 = ConnectOverlappingToolpaths(polyline_toolpaths=filter_5)
filter_6 = StreamFilter(
    Gate=use_high_speed_machining_3,
    Stream0=connect_overlapping_toolpaths_2,
    Stream1=trochoidal_polyline_toolpaths_2,
    Stream2=plunge_rough_lines_2)
filter_7 = StreamFilter(
    Gate=use_high_speed_machining_4,
    Stream0=connect_overlapping_toolpaths_3,
    Stream1=trochoidal_polyline_toolpaths,
    Stream2=plunge_rough_lines)

# ---- group: Send tab cleanup toolpath points to g-code or ShopBot code postprocessor
cp = ControlPoints(Curve=filter_6)  # -> Points, Weights, Knots
toolpath_points_for_tab_cleanup_job = Point(cp.Points)
make_shopbot_code_not_g_code_3 = Boolean(make_shopbot_code_not_g_code_2)
gate_2 = StreamGate(Stream=toolpath_points_for_tab_cleanup_job, Gate=make_shopbot_code_not_g_code_3)  # -> Target0, Target1

# ---- group: Convert polylines to toolpath points
cp_2 = ControlPoints(Curve=filter_7)  # -> Points, Weights, Knots
toolpath_points = Point(cp_2.Points)

# ---- group: Send main toolpath points to g-code or ShopBot code postprocessor
make_shopbot_code_not_g_code_4 = Boolean(make_shopbot_code_not_g_code_2)
toolpath_points_2 = Point(toolpath_points)
gate_3 = StreamGate(Stream=toolpath_points_2, Gate=make_shopbot_code_not_g_code_4)  # -> Target0, Target1

# ----
toolpath_points_3 = Point(gate_3.Target0)
flatten_3 = FlattenTree(Tree=toolpath_points_3, Path="{0}")
lng = ListLength(List=flatten_3)
feed_rate_4 = Number(feed_rate_3)
dup = DuplicateData(Data=graft(feed_rate_4), Number=graft(lng), Order=True)
lng_2 = ListLength(List=toolpath_points_3)
dup_2 = DuplicateData(Data=flatten("F"), Number=flatten(lng), Order=True)
dup_3 = DuplicateData(Data=flatten(" X"), Number=flatten(lng), Order=True)
flatten_4 = FlattenTree(Tree=dup_2, Path="{0}")
flatten_5 = FlattenTree(Tree=dup_3, Path="{0}")
flatten_6 = FlattenTree(Tree=dup, Path="{0}")
pdecon = Deconstruct(Point=toolpath_points_3)  # -> XComponent, YComponent, ZComponent
graft = GraftTree(Tree=flatten_4, IncludeEmptyLists=True, IncludeNullItems=True)
graft_2 = GraftTree(Tree=flatten_6, IncludeEmptyLists=True, IncludeNullItems=True)
graft_3 = GraftTree(Tree=flatten_5, IncludeEmptyLists=True, IncludeNullItems=True)
panel = Panel(pdecon.XComponent)
panel_2 = Panel(pdecon.YComponent)
panel_3 = Panel(pdecon.ZComponent)
join_6 = TextJoin(Text=[graft, graft_2, graft_3])
dup_4 = DuplicateData(Data=" Z", Number=lng_2, Order=True)
dup_5 = DuplicateData(Data=" Y", Number=lng_2, Order=True)
dup_6 = DuplicateData(Data="G1 ", Number=lng_2, Order=True)
simplify = SimplifyTree(Tree=flatten(join_6), Front=False)
simplify_2 = SimplifyTree(Tree=flatten(dup_6), Front=False)
simplify_3 = SimplifyTree(Tree=flatten(panel), Front=False)
simplify_4 = SimplifyTree(Tree=flatten(dup_5), Front=False)
simplify_5 = SimplifyTree(Tree=flatten(panel_2), Front=False)
simplify_6 = SimplifyTree(Tree=flatten(dup_4), Front=False)
simplify_7 = SimplifyTree(Tree=flatten(panel_3), Front=False)
graft_4 = GraftTree(Tree=simplify_2, IncludeEmptyLists=True, IncludeNullItems=True)
graft_5 = GraftTree(Tree=simplify_3, IncludeEmptyLists=True, IncludeNullItems=True)
graft_6 = GraftTree(Tree=simplify_4, IncludeEmptyLists=True, IncludeNullItems=True)
graft_7 = GraftTree(Tree=simplify_5, IncludeEmptyLists=True, IncludeNullItems=True)
graft_8 = GraftTree(Tree=simplify_6, IncludeEmptyLists=True, IncludeNullItems=True)
graft_9 = GraftTree(Tree=simplify_7, IncludeEmptyLists=True, IncludeNullItems=True)
graft_10 = GraftTree(Tree=simplify, IncludeEmptyLists=True, IncludeNullItems=True)
join_7 = TextJoin(Text=[graft_4, graft_10, graft_5, graft_6, graft_7, graft_8, graft_9])
flatten_7 = FlattenTree(Tree=join_7, Path="{0}")
panel_4 = Panel(flatten_7)

toolpath_points_4 = Point(gate_2.Target0)
flatten_8 = FlattenTree(Tree=toolpath_points_4, Path="{0}")
lng_3 = ListLength(List=flatten_8)
feed_rate_5 = Number(feed_rate_3)
dup_7 = DuplicateData(Data=graft(feed_rate_5), Number=graft(lng_3), Order=True)
lng_4 = ListLength(List=toolpath_points_4)
dup_8 = DuplicateData(Data=flatten("F"), Number=flatten(lng_3), Order=True)
dup_9 = DuplicateData(Data=flatten(" X"), Number=flatten(lng_3), Order=True)
flatten_9 = FlattenTree(Tree=dup_8, Path="{0}")
flatten_10 = FlattenTree(Tree=dup_9, Path="{0}")
flatten_11 = FlattenTree(Tree=dup_7, Path="{0}")
pdecon_2 = Deconstruct(Point=toolpath_points_4)  # -> XComponent, YComponent, ZComponent
graft_11 = GraftTree(Tree=flatten_9, IncludeEmptyLists=True, IncludeNullItems=True)
graft_12 = GraftTree(Tree=flatten_11, IncludeEmptyLists=True, IncludeNullItems=True)
graft_13 = GraftTree(Tree=flatten_10, IncludeEmptyLists=True, IncludeNullItems=True)
panel_5 = Panel(pdecon_2.XComponent)
panel_6 = Panel(pdecon_2.YComponent)
panel_7 = Panel(pdecon_2.ZComponent)
join_8 = TextJoin(Text=[graft_11, graft_12, graft_13])
dup_10 = DuplicateData(Data=" Z", Number=lng_4, Order=True)
dup_11 = DuplicateData(Data=" Y", Number=lng_4, Order=True)
dup_12 = DuplicateData(Data="G1 ", Number=lng_4, Order=True)
simplify_8 = SimplifyTree(Tree=flatten(join_8), Front=False)
simplify_9 = SimplifyTree(Tree=flatten(dup_12), Front=False)
simplify_10 = SimplifyTree(Tree=flatten(panel_5), Front=False)
simplify_11 = SimplifyTree(Tree=flatten(dup_11), Front=False)
simplify_12 = SimplifyTree(Tree=flatten(panel_6), Front=False)
simplify_13 = SimplifyTree(Tree=flatten(dup_10), Front=False)
simplify_14 = SimplifyTree(Tree=flatten(panel_7), Front=False)
graft_14 = GraftTree(Tree=simplify_9, IncludeEmptyLists=True, IncludeNullItems=True)
graft_15 = GraftTree(Tree=simplify_10, IncludeEmptyLists=True, IncludeNullItems=True)
graft_16 = GraftTree(Tree=simplify_11, IncludeEmptyLists=True, IncludeNullItems=True)
graft_17 = GraftTree(Tree=simplify_12, IncludeEmptyLists=True, IncludeNullItems=True)
graft_18 = GraftTree(Tree=simplify_13, IncludeEmptyLists=True, IncludeNullItems=True)
graft_19 = GraftTree(Tree=simplify_14, IncludeEmptyLists=True, IncludeNullItems=True)
graft_20 = GraftTree(Tree=simplify_8, IncludeEmptyLists=True, IncludeNullItems=True)
join_9 = TextJoin(Text=[graft_14, graft_20, graft_15, graft_16, graft_17, graft_18, graft_19])
flatten_12 = FlattenTree(Tree=join_9, Path="{0}")
panel_8 = Panel(flatten_12)

toolpath_points_5 = Point(gate_2.Target1)
toolpath_points_6 = Point(gate_3.Target1)
pdecon_3 = Deconstruct(Point=toolpath_points_5)  # -> XComponent, YComponent, ZComponent

# ---- group: Optional MM to inch conversion
convert_to_inches_boolean = Panel(convert_to_inches)
filter_8 = StreamFilter(Gate=convert_to_inches_boolean, Stream0="1", Stream1="25.4")
division_6 = Division(A=pdecon_3.XComponent, B=filter_8)
division_7 = Division(A=pdecon_3.YComponent, B=filter_8)
division_8 = Division(A=pdecon_3.ZComponent, B=filter_8)

# ----
lng_5 = ListLength(List=toolpath_points_5)
pdecon_4 = Deconstruct(Point=toolpath_points_6)  # -> XComponent, YComponent, ZComponent

# ---- group: Optional MM to inch conversion
convert_to_inches_boolean_2 = Panel(convert_to_inches)
filter_9 = StreamFilter(Gate=convert_to_inches_boolean_2, Stream0="1", Stream1="25.4")
division_9 = Division(A=pdecon_4.XComponent, B=filter_9)
division_10 = Division(A=pdecon_4.YComponent, B=filter_9)
division_11 = Division(A=pdecon_4.ZComponent, B=filter_9)

# ----
lng_6 = ListLength(List=toolpath_points_6)

jog_rate_x_y_2 = Number(jog_rate_x_y)
item = ListItem(List=pdecon_2.XComponent, Index=0, Wrap=True)
custom_home_x_3 = Number(division)
use_custom_jog_home_2 = Integer(use_custom_jog_home)
custom_home_y_3 = Number(division_2)
item_2 = ListItem(List=pdecon_2.YComponent, Index=0, Wrap=True)
int_2 = Integer(jog_rate_x_y_2)
lng_7 = ListLength(List=flatten(item))
safe_z_height_4 = Number(safe_z_height_2)
lng_8 = ListLength(List=flatten(item))
panel_9 = Panel(custom_home_y_3)
join_10 = TextJoin(Text=["F", int_2, " X"])
panel_10 = Panel(custom_home_x_3)
dup_13 = DuplicateData(Data="G1 ", Number=lng_7, Order=True)
dup_14 = DuplicateData(Data=" Y", Number=lng_7, Order=True)
dup_15 = DuplicateData(Data=" Z", Number=lng_7, Order=True)
dup_16 = DuplicateData(Data=safe_z_height_4, Number=lng_7, Order=True)
dup_17 = DuplicateData(Data=join_10, Number=lng_8, Order=True)
filter_10 = StreamFilter(Gate=use_custom_jog_home_2, Stream0="0", Stream1=panel_9)
filter_11 = StreamFilter(Gate=use_custom_jog_home_2, Stream0="0", Stream1=panel_10)
simplify_15 = SimplifyTree(Tree=flatten(dup_13), Front=False)
simplify_16 = SimplifyTree(Tree=flatten(item), Front=False)
simplify_17 = SimplifyTree(Tree=flatten(dup_14), Front=False)
simplify_18 = SimplifyTree(Tree=flatten(item_2), Front=False)
simplify_19 = SimplifyTree(Tree=flatten(dup_15), Front=False)
simplify_20 = SimplifyTree(Tree=flatten(dup_16), Front=False)
simplify_21 = SimplifyTree(Tree=flatten(dup_17), Front=False)
graft_21 = GraftTree(Tree=simplify_15, IncludeEmptyLists=True, IncludeNullItems=True)
graft_22 = GraftTree(Tree=simplify_21, IncludeEmptyLists=True, IncludeNullItems=True)
graft_23 = GraftTree(Tree=simplify_16, IncludeEmptyLists=True, IncludeNullItems=True)
graft_24 = GraftTree(Tree=simplify_17, IncludeEmptyLists=True, IncludeNullItems=True)
graft_25 = GraftTree(Tree=simplify_18, IncludeEmptyLists=True, IncludeNullItems=True)
graft_26 = GraftTree(Tree=simplify_19, IncludeEmptyLists=True, IncludeNullItems=True)
graft_27 = GraftTree(Tree=simplify_20, IncludeEmptyLists=True, IncludeNullItems=True)
join_11 = TextJoin(Text=[graft_21, graft_22, graft_23, graft_24, graft_25])
jog_rate_x_y_3 = Integer(jog_rate_x_y_2)
flatten_13 = FlattenTree(Tree=join_11, Path="{0}")
join_12 = TextJoin(Text=["F", jog_rate_x_y_3])
home_x = Number(filter_11)
home_y = Number(filter_10)
join_13 = TextJoin(Text=["G1 ", join_12, " X", home_x, " Y", home_y])
merge_4 = Merge(Data1=flatten(flatten_13), Data2=flatten(join_13))
jog_x_y_positions = Panel(merge_4)

jog_rate_x_y_4 = Number(jog_rate_x_y)
item_3 = ListItem(List=pdecon.XComponent, Index=0, Wrap=True)
custom_home_x_4 = Number(division)
custom_home_y_4 = Number(division_2)
use_custom_jog_home_3 = Integer(use_custom_jog_home)
item_4 = ListItem(List=pdecon.YComponent, Index=0, Wrap=True)
int_3 = Integer(jog_rate_x_y_4)
lng_9 = ListLength(List=flatten(item_3))
safe_z_height_5 = Number(safe_z_height_2)
lng_10 = ListLength(List=flatten(item_3))
panel_11 = Panel(custom_home_y_4)
join_14 = TextJoin(Text=["F", int_3, " X"])
panel_12 = Panel(custom_home_x_4)
dup_18 = DuplicateData(Data="G1 ", Number=lng_9, Order=True)
dup_19 = DuplicateData(Data=" Y", Number=lng_9, Order=True)
dup_20 = DuplicateData(Data=" Z", Number=lng_9, Order=True)
dup_21 = DuplicateData(Data=safe_z_height_5, Number=lng_9, Order=True)
dup_22 = DuplicateData(Data=join_14, Number=lng_10, Order=True)
filter_12 = StreamFilter(Gate=use_custom_jog_home_3, Stream0="0", Stream1=panel_11)
filter_13 = StreamFilter(Gate=use_custom_jog_home_3, Stream0="0", Stream1=panel_12)
simplify_22 = SimplifyTree(Tree=flatten(dup_18), Front=False)
simplify_23 = SimplifyTree(Tree=flatten(item_3), Front=False)
simplify_24 = SimplifyTree(Tree=flatten(dup_19), Front=False)
simplify_25 = SimplifyTree(Tree=flatten(item_4), Front=False)
simplify_26 = SimplifyTree(Tree=flatten(dup_20), Front=False)
simplify_27 = SimplifyTree(Tree=flatten(dup_21), Front=False)
simplify_28 = SimplifyTree(Tree=flatten(dup_22), Front=False)
graft_28 = GraftTree(Tree=simplify_22, IncludeEmptyLists=True, IncludeNullItems=True)
graft_29 = GraftTree(Tree=simplify_28, IncludeEmptyLists=True, IncludeNullItems=True)
graft_30 = GraftTree(Tree=simplify_23, IncludeEmptyLists=True, IncludeNullItems=True)
graft_31 = GraftTree(Tree=simplify_24, IncludeEmptyLists=True, IncludeNullItems=True)
graft_32 = GraftTree(Tree=simplify_25, IncludeEmptyLists=True, IncludeNullItems=True)
graft_33 = GraftTree(Tree=simplify_26, IncludeEmptyLists=True, IncludeNullItems=True)
graft_34 = GraftTree(Tree=simplify_27, IncludeEmptyLists=True, IncludeNullItems=True)
join_15 = TextJoin(Text=[graft_28, graft_29, graft_30, graft_31, graft_32])
jog_rate_x_y_5 = Integer(jog_rate_x_y_4)
flatten_14 = FlattenTree(Tree=join_15, Path="{0}")
join_16 = TextJoin(Text=["F", jog_rate_x_y_5])
home_x_2 = Number(filter_13)
home_y_2 = Number(filter_12)
join_17 = TextJoin(Text=["G1 ", join_16, " X", home_x_2, " Y", home_y_2])
merge_5 = Merge(Data1=flatten(flatten_14), Data2=flatten(join_17))
jog_x_y_positions_2 = Panel(merge_5)

flatten_15 = FlattenTree(Tree=lng_5, Path="{0}")
flatten_16 = FlattenTree(Tree=lng_6, Path="{0}")
merge_6 = Merge(Data1=Slider(0, range=0..100), Data2=flatten_15)
merge_7 = Merge(Data1=Slider(0, range=0..100), Data2=flatten_16)
panel_13 = Panel(division_6)
panel_14 = Panel(division_7)
panel_15 = Panel(division_8)
panel_16 = Panel(division_9)
panel_17 = Panel(division_10)
panel_18 = Panel(division_11)

# ---- group: Jog to safe Z
safe_z_height_6 = Number(flatten(safe_z_height_3))
text_5 = Text("JZ,")
graft_35 = GraftTree(Tree=safe_z_height_6, IncludeEmptyLists=True, IncludeNullItems=True)
graft_36 = GraftTree(Tree=text_5, IncludeEmptyLists=True, IncludeNullItems=True)
lng_11 = ListLength(List=flatten(merge_6))
join_18 = TextJoin(Text=[graft_36, graft_35])
dup_23 = DuplicateData(Data=join_18, Number=lng_11, Order=True)

safe_z_height_7 = Number(flatten(safe_z_height_3))
text_6 = Text("JZ,")
graft_37 = GraftTree(Tree=safe_z_height_7, IncludeEmptyLists=True, IncludeNullItems=True)
graft_38 = GraftTree(Tree=text_6, IncludeEmptyLists=True, IncludeNullItems=True)
lng_12 = ListLength(List=flatten(merge_7))
join_19 = TextJoin(Text=[graft_38, graft_37])
dup_24 = DuplicateData(Data=join_19, Number=lng_12, Order=True)

# ---- group: Name
# ShopBot code tab cleanup processing
panel_19 = Panel(join)

# ---- group: Set spindle speed
spindle_speed_4 = Number(spindle_speed_2)
int_4 = Integer(spindle_speed_4)
join_20 = TextJoin(Text=["TR,", int_4, ",1"])

# ---- group: Turn off spindle
filter_14 = StreamFilter(Gate=use_spindle_2, Stream1="SO,1,0")

# ---- group: Name
# ShopBot code toolpath processing
panel_20 = Panel(join)

# ---- group: Set spindle speed
spindle_speed_5 = Number(spindle_speed_2)
int_5 = Integer(spindle_speed_5)
join_21 = TextJoin(Text=["TR,", int_5, ",1"])

# ---- group: Toolpath coordinates
text_7 = Text("M3,")
text_8 = Text(",")
text_9 = Text(",")
dup_25 = DuplicateData(Data=text_9, Number=lng_5, Order=True)
dup_26 = DuplicateData(Data=text_8, Number=lng_5, Order=True)
dup_27 = DuplicateData(Data=text_7, Number=lng_5, Order=True)
simplify_29 = SimplifyTree(Tree=flatten(dup_27), Front=False)
simplify_30 = SimplifyTree(Tree=flatten(panel_13), Front=False)
simplify_31 = SimplifyTree(Tree=flatten(dup_26), Front=False)
simplify_32 = SimplifyTree(Tree=flatten(panel_14), Front=False)
simplify_33 = SimplifyTree(Tree=flatten(dup_25), Front=False)
simplify_34 = SimplifyTree(Tree=flatten(panel_15), Front=False)
graft_39 = GraftTree(Tree=simplify_29, IncludeEmptyLists=True, IncludeNullItems=True)
graft_40 = GraftTree(Tree=simplify_30, IncludeEmptyLists=True, IncludeNullItems=True)
graft_41 = GraftTree(Tree=simplify_31, IncludeEmptyLists=True, IncludeNullItems=True)
graft_42 = GraftTree(Tree=simplify_32, IncludeEmptyLists=True, IncludeNullItems=True)
graft_43 = GraftTree(Tree=simplify_33, IncludeEmptyLists=True, IncludeNullItems=True)
graft_44 = GraftTree(Tree=simplify_34, IncludeEmptyLists=True, IncludeNullItems=True)
join_22 = TextJoin(Text=[graft_39, graft_40, graft_41, graft_42, graft_43, graft_44])
flatten_17 = FlattenTree(Tree=join_22, Path="{0}")

# ---- group: Turn off spindle
filter_15 = StreamFilter(Gate=use_spindle_2, Stream1="SO,1,0")

# ---- group: Toolpath coordinates
text_10 = Text("M3,")
text_11 = Text(",")
text_12 = Text(",")
dup_28 = DuplicateData(Data=text_12, Number=lng_6, Order=True)
dup_29 = DuplicateData(Data=text_11, Number=lng_6, Order=True)
dup_30 = DuplicateData(Data=text_10, Number=lng_6, Order=True)
simplify_35 = SimplifyTree(Tree=flatten(dup_30), Front=False)
simplify_36 = SimplifyTree(Tree=flatten(panel_16), Front=False)
simplify_37 = SimplifyTree(Tree=flatten(dup_29), Front=False)
simplify_38 = SimplifyTree(Tree=flatten(panel_17), Front=False)
simplify_39 = SimplifyTree(Tree=flatten(dup_28), Front=False)
simplify_40 = SimplifyTree(Tree=flatten(panel_18), Front=False)
graft_45 = GraftTree(Tree=simplify_35, IncludeEmptyLists=True, IncludeNullItems=True)
graft_46 = GraftTree(Tree=simplify_36, IncludeEmptyLists=True, IncludeNullItems=True)
graft_47 = GraftTree(Tree=simplify_37, IncludeEmptyLists=True, IncludeNullItems=True)
graft_48 = GraftTree(Tree=simplify_38, IncludeEmptyLists=True, IncludeNullItems=True)
graft_49 = GraftTree(Tree=simplify_39, IncludeEmptyLists=True, IncludeNullItems=True)
graft_50 = GraftTree(Tree=simplify_40, IncludeEmptyLists=True, IncludeNullItems=True)
join_23 = TextJoin(Text=[graft_45, graft_46, graft_47, graft_48, graft_49, graft_50])
flatten_18 = FlattenTree(Tree=join_23, Path="{0}")

# ---- group: Start spindle
panel_21 = Panel("PAUSE 1")
filter_16 = StreamFilter(Gate=use_spindle_2, Stream1="SO,1,1")

# ---- group: Set Feed rate (X Y speed) and plunge rate (Z speed)
feed_rate_6 = Number(division_4)
plunge_rate_3 = Number(division_5)
plunge_rate_4 = Number(plunge_rate_3)
feed_rate_7 = Number(feed_rate_6)
text_13 = Text("MS,")
text_14 = Text(",")
join_24 = TextJoin(Text=flatten([text_13, feed_rate_7, text_14, plunge_rate_4]))

# ---- group: Start spindle
panel_22 = Panel("PAUSE 1")
filter_17 = StreamFilter(Gate=use_spindle_2, Stream1="SO,1,1")

# ---- group: Set Feed rate (X Y speed) and plunge rate (Z speed)
feed_rate_8 = Number(division_4)
plunge_rate_5 = Number(division_5)
plunge_rate_6 = Number(plunge_rate_5)
feed_rate_9 = Number(feed_rate_8)
text_15 = Text("MS,")
text_16 = Text(",")
join_25 = TextJoin(Text=flatten([text_15, feed_rate_9, text_16, plunge_rate_6]))

# ----
# G-Code toolpath processing
jog_rate_z_4 = Number(jog_rate_z_3)
int_6 = Integer(jog_rate_z_4)
safe_z_height_8 = Number(safe_z_height_2)
join_26 = TextJoin(Text=["F", int_6])
join_27 = TextJoin(Text=["G1 ", join_26, " Z", safe_z_height_8])
lng_13 = ListLength(List=merge_5)
dup_31 = DuplicateData(Data=join_27, Number=lng_13, Order=True)
flatten_19 = FlattenTree(Tree=dup_31, Path="{0}")
jog_z_positions = Panel(flatten_19)

# ----
# G-Code tab cleanup processing
jog_rate_z_5 = Number(jog_rate_z_3)
int_7 = Integer(jog_rate_z_5)
safe_z_height_9 = Number(safe_z_height_2)
join_28 = TextJoin(Text=["F", int_7])
join_29 = TextJoin(Text=["G1 ", join_28, " Z", safe_z_height_9])
lng_14 = ListLength(List=merge_4)
dup_32 = DuplicateData(Data=join_29, Number=lng_14, Order=True)
flatten_20 = FlattenTree(Tree=dup_32, Path="{0}")
jog_z_positions_2 = Panel(flatten_20)

filter_18 = StreamFilter(Gate=use_spindle_2, Stream1=join_20)
filter_19 = StreamFilter(Gate=use_spindle_2, Stream1=join_21)

# ---- group: Create safe Z transtions
toolpath_points_7 = Point(toolpath_points)
rev = ReverseList(List=toolpath_points_7)
safe_z_height_10 = Number(division_3)
item_5 = ListItem(List=toolpath_points_7, Index=0, Wrap=True)
item_6 = ListItem(List=rev, Index=0, Wrap=True)
pdecon_5 = Deconstruct(Point=item_5)  # -> XComponent, YComponent, ZComponent
pdecon_6 = Deconstruct(Point=item_6)  # -> XComponent, YComponent, ZComponent
pt = ConstructPoint(XCoordinate=pdecon_5.XComponent, YCoordinate=pdecon_5.YComponent, ZCoordinate=safe_z_height_10)
pt_2 = ConstructPoint(XCoordinate=pdecon_6.XComponent, YCoordinate=pdecon_6.YComponent, ZCoordinate=safe_z_height_10)
safe_z_end_point = Point(pt_2)
safe_z_start_point = Point(pt)

# ----
join_30 = TextJoin(Text=[text, division, text_3, division_2])
join_31 = TextJoin(Text=[text_2, division, text_4, division_2])

# ---- group: Insert JZ commands
ma = MassAddition(Input=merge_6)  # -> Result, PartialResults
ins = InsertItems(List=flatten_17, Item=dup_23, Indices=ma.PartialResults, Wrap=True)

ma_2 = MassAddition(Input=merge_7)  # -> Result, PartialResults
ins_2 = InsertItems(List=flatten_18, Item=dup_24, Indices=ma_2.PartialResults, Wrap=True)

# ---- group: Insert jog to safe Z
ma_3 = MassAddition(Input=flatten(lng_2))  # -> Result, PartialResults
merge_8 = Merge(Data1=Slider(0, range=0..100), Data2=ma_3.PartialResults)
ins_3 = InsertItems(List=flatten(panel_4), Item=flatten(jog_z_positions), Indices=flatten(merge_8), Wrap=True)

ma_4 = MassAddition(Input=flatten(lng_4))  # -> Result, PartialResults
merge_9 = Merge(Data1=Slider(0, range=0..100), Data2=ma_4.PartialResults)
ins_4 = InsertItems(List=flatten(panel_8), Item=flatten(jog_z_positions_2), Indices=flatten(merge_9), Wrap=True)

# ---- group: Create toolpath preview
rev_2 = ReverseList(List=flatten(safe_z_end_point))
cull_i = CullIndex(List=flatten(safe_z_start_point), Indices=0, Wrap=True)
cull_i_2 = CullIndex(List=rev_2, Indices=0, Wrap=True)
rev_3 = ReverseList(List=flatten(cull_i_2))
ln = Line(StartPoint=rev_3, EndPoint=cull_i)
ln_2 = Line(StartPoint=safe_z_start_point, EndPoint=item_5)
ln_3 = Line(StartPoint=item_6, EndPoint=safe_z_end_point)
tab_cleanup_preview_curves = Curve(filter_6)
cut_transition_preview_lines = Curve(flatten(ln))
cut_entry_preview_lines = Curve(flatten(ln_2))
cut_exit_preview_lines = Curve(flatten(ln_3))
toolpath_preview_curves = Curve(filter_7)

# ----
g_code_spindle_start_2 = Panel(g_code_spindle_start)
g_code_spindle_start_3 = Panel(g_code_spindle_start)
panel_23 = Panel(join_27)
panel_24 = Panel(join_29)

# ---- group: Insert jog X Y positions
lng_15 = ListLength(List=merge_8)
series = Series(Start=1, Step=1, Count=lng_15)
addition = Addition(A=merge_8, B=series)
ins_5 = InsertItems(List=flatten(ins_3), Item=flatten(jog_x_y_positions_2), Indices=flatten(addition), Wrap=True)

lng_16 = ListLength(List=merge_9)
series_2 = Series(Start=1, Step=1, Count=lng_16)
addition_2 = Addition(A=merge_9, B=series_2)
ins_6 = InsertItems(List=flatten(ins_4), Item=flatten(jog_x_y_positions), Indices=flatten(addition_2), Wrap=True)

# ----
merge_10 = Merge(Data1=start_code_3, Data2=panel_23, Data3=g_code_spindle_start_2)
merge_11 = Merge(Data1=start_code_4, Data2=panel_24, Data3=g_code_spindle_start_3)
tab_cleanup_preview_curves_2 = ClusterOutput(tab_cleanup_preview_curves)
startcode = Panel(merge_10)
startcode_2 = Panel(merge_11)
cut_transition_preview_lines_2 = ClusterOutput(cut_transition_preview_lines)
cut_exit_preview_lines_2 = ClusterOutput(cut_exit_preview_lines)
toolpath_preview_curves_2 = ClusterOutput(toolpath_preview_curves)
cut_entry_preview_lines_2 = ClusterOutput(cut_entry_preview_lines)
merge_12 = Merge(Data1=flatten(startcode), Data2=flatten(ins_5), Data3=flatten(endcode))
merge_13 = Merge(Data1=flatten(startcode_2), Data2=flatten(ins_6), Data3=flatten(endcode_2))
tab_cleanup_toolpath_g_code = Panel(merge_13)
# Rigth click and choose "Stream destination"
# 
# Give a file name ending with .gcode
# 
# Your toolpath will automatically be updated!
toolpath_g_code = Panel(merge_12)
toolpath_g_code_2 = Panel(toolpath_g_code)
tab_cleanup_toolpath_g_code_2 = Panel(tab_cleanup_toolpath_g_code)

# ---- group: Jog to startpoints
item_7 = ListItem(List=division_6, Index=0, Wrap=True)
item_8 = ListItem(List=division_7, Index=0, Wrap=True)
lng_17 = ListLength(List=flatten(item_7))
text_17 = Text(",")
text_18 = Text("J2,")
dup_33 = DuplicateData(Data=text_18, Number=lng_17, Order=True)
dup_34 = DuplicateData(Data=text_17, Number=lng_17, Order=True)
simplify_41 = SimplifyTree(Tree=flatten(dup_33), Front=False)
simplify_42 = SimplifyTree(Tree=flatten(item_7), Front=False)
simplify_43 = SimplifyTree(Tree=flatten(dup_34), Front=False)
simplify_44 = SimplifyTree(Tree=flatten(item_8), Front=False)
graft_51 = GraftTree(Tree=simplify_41, IncludeEmptyLists=True, IncludeNullItems=True)
graft_52 = GraftTree(Tree=simplify_42, IncludeEmptyLists=True, IncludeNullItems=True)
graft_53 = GraftTree(Tree=simplify_43, IncludeEmptyLists=True, IncludeNullItems=True)
graft_54 = GraftTree(Tree=simplify_44, IncludeEmptyLists=True, IncludeNullItems=True)
join_32 = TextJoin(Text=[graft_51, graft_52, graft_53, graft_54])
jh = Text("JH")
flatten_21 = FlattenTree(Tree=join_32, Path="{0}")

# ----
filter_20 = StreamFilter(Gate=use_custom_jog_home, Stream0=jh, Stream1=flatten(join_30))

# ---- group: Jog to startpoints (continued)
merge_14 = Merge(Data1=flatten_21, Data2=filter_20)

# ---- group: Insert J2 commands
lng_18 = ListLength(List=merge_14)
dup_35 = DuplicateData(Data=Slider(1, range=0..1), Number=lng_18, Order=True)
addition_3 = Addition(A=dup_35, B=merge_6)
ma_5 = MassAddition(Input=addition_3)  # -> Result, PartialResults
ins_7 = InsertItems(List=ins, Item=merge_14, Indices=ma_5.PartialResults, Wrap=True)

# ----
flatten_22 = FlattenTree(Tree=ins_7, Path="{0}")
merge_15 = Merge(
    Data1=start_code_5,
    Data2=panel_19,
    Data3=filter_18,
    Data4=filter_16,
    Data5=panel_21,
    Data6=join_24,
    Data7=flatten_22,
    Data8=filter_14,
    Data9=end_code_5)
tab_cleanup_toolpath_shopbot_code = Panel(merge_15)
tab_cleanup_toolpath_shopbot_code_2 = Panel(tab_cleanup_toolpath_shopbot_code)
filter_21 = StreamFilter(Gate=make_shopbot_code_not_g_code_2, Stream0=tab_cleanup_toolpath_g_code_2, Stream1=tab_cleanup_toolpath_shopbot_code_2)
g_code_for_tab_cleanup = ClusterOutput(filter_21)  # Connect a panel to stream the code to a folder on your computer

# ---- group: Jog to startpoints
item_9 = ListItem(List=division_9, Index=0, Wrap=True)
item_10 = ListItem(List=division_10, Index=0, Wrap=True)
lng_19 = ListLength(List=flatten(item_9))
text_19 = Text(",")
text_20 = Text("J2,")
dup_36 = DuplicateData(Data=text_20, Number=lng_19, Order=True)
dup_37 = DuplicateData(Data=text_19, Number=lng_19, Order=True)
simplify_45 = SimplifyTree(Tree=flatten(dup_36), Front=False)
simplify_46 = SimplifyTree(Tree=flatten(item_9), Front=False)
simplify_47 = SimplifyTree(Tree=flatten(dup_37), Front=False)
simplify_48 = SimplifyTree(Tree=flatten(item_10), Front=False)
graft_55 = GraftTree(Tree=simplify_45, IncludeEmptyLists=True, IncludeNullItems=True)
graft_56 = GraftTree(Tree=simplify_46, IncludeEmptyLists=True, IncludeNullItems=True)
graft_57 = GraftTree(Tree=simplify_47, IncludeEmptyLists=True, IncludeNullItems=True)
graft_58 = GraftTree(Tree=simplify_48, IncludeEmptyLists=True, IncludeNullItems=True)
join_33 = TextJoin(Text=[graft_55, graft_56, graft_57, graft_58])
jh_2 = Text("JH")
flatten_23 = FlattenTree(Tree=join_33, Path="{0}")

# ----
filter_22 = StreamFilter(Gate=use_custom_jog_home, Stream0=jh_2, Stream1=flatten(join_31))

# ---- group: Jog to startpoints (continued)
merge_16 = Merge(Data1=flatten_23, Data2=filter_22)

# ---- group: Insert J2 commands
lng_20 = ListLength(List=merge_16)
dup_38 = DuplicateData(Data=Slider(1, range=0..1), Number=lng_20, Order=True)
addition_4 = Addition(A=dup_38, B=merge_7)
ma_6 = MassAddition(Input=addition_4)  # -> Result, PartialResults
ins_8 = InsertItems(List=ins_2, Item=merge_16, Indices=ma_6.PartialResults, Wrap=True)

# ----
flatten_24 = FlattenTree(Tree=ins_8, Path="{0}")
merge_17 = Merge(
    Data1=start_code_6,
    Data2=panel_20,
    Data3=filter_19,
    Data4=filter_17,
    Data5=panel_22,
    Data6=join_25,
    Data7=flatten_24,
    Data8=filter_15,
    Data9=end_code_6)
toolpath_shopbot_code = Panel(merge_17)
toolpath_shopbot_code_2 = Panel(toolpath_shopbot_code)
filter_23 = StreamFilter(Gate=make_shopbot_code_not_g_code_2, Stream0=toolpath_g_code_2, Stream1=toolpath_shopbot_code_2)
g_code_stream = ClusterOutput(filter_23)  # Connect a panel to stream the code to a folder on your computer

# ==== cluster CustomStartSBPCode
material_thicness = ClusterInput()
safe_z_height = ClusterInput()
safe_z_height_2 = Number(safe_z_height)
material_thicness_2 = Number(material_thicness)
int = Integer(material_thicness_2)
# Make dialog box for safety material check: MSGBOX (Is your material thickness &Materialthickness mm?, YesNo, SAFETY CHECK)    'create a pop-up dialog asking for confirmation of material thickness
# IF &msganswer = NO THEN GOSUB Canceljob      'if material thickness is wrong, go to the cancel job sub routine with a pop up message of shame
make_dialog_box_for_safety_material_chec = Panel("""MSGBOX (Is your material thickness &Materialthickness mm?, YesNo, SAFETY CHECK)    'create a pop-up dialog asking for confirmation of material thickness
IF &msganswer = NO THEN GOSUB Canceljob      'if material thickness is wrong, go to the cancel job sub routine with a pop up message of shame""")  # "Make dialog box for safety material check"
start_the_authome_x_y_z_subroutine = Panel("FP,C:\\SbParts\\XYandZzero_Zzero_bellow_material.sbp \t\t    'load the file that automatically sets X, Y and Z Zero")
zero_z_part_3 = Panel("       'make a variable for material thickness based on the user input at the start of Bark Beetle main settings")
zero_z_part_1 = Panel("&Materialthickness = ")
zero_z_part_3_2 = Panel(",,,,,0\t      'tell the controller that the current postion is ZH home position (thereby making top of material our new Z Zero)")
zero_z_part_1_2 = Panel("VA,,,")
jog_part_3 = Panel("         'move to Z axis to material top of material + Z home postion")
jog_part_1 = Panel("JZ,")
addition = Addition(A=int, B=safe_z_height_2)
merge = Merge(Data1=zero_z_part_1, Data2=int, Data3=zero_z_part_3)
merge_2 = Merge(Data1=zero_z_part_1_2, Data2=safe_z_height_2, Data3=zero_z_part_3_2)
merge_3 = Merge(Data1=jog_part_1, Data2=addition, Data3=jog_part_3)
join = TextJoin(Text=merge)
join_2 = TextJoin(Text=merge_2)
join_3 = TextJoin(Text=merge_3)
merge_4 = Merge(
    Data1=flatten(start_the_authome_x_y_z_subroutine),
    Data2=flatten(join_3),
    Data3=flatten(join_2),
    Data4=flatten(join),
    Data5=flatten(make_dialog_box_for_safety_material_chec))
panel = Panel(merge_4)
start_code = Text(panel)
start_code_2 = ClusterOutput(start_code)

# ==== cluster CutoutWithOffsets: Creates cutout toolpaths from closed flat 2D curves with multiple offsets. Compensates for the diameter of your milling bit. Great for milling PCBs Uses Clipper for Grasshopper plugin by arendvw
mill_outer_layer_first = ClusterInput()
use_climb_direction = ClusterInput()
number_of_offsets = ClusterInput()
use_inside_cutting = ClusterInput()
cutout_tolerance = ClusterInput()
tool_diameter = ClusterInput()
pass_depth = ClusterInput()
cut_depth = ClusterInput()  # how the total depth of cut
stepover = ClusterInput()
curves_for_cutout_with_offsets = ClusterInput()  # the geaomtery that the toolpaths will create
pass_depth_2 = Number(pass_depth)
tool_diameter_2 = Number(tool_diameter)
stepover_2 = Number(stepover)
use_climb_direction_2 = Boolean(use_climb_direction)
use_inside_cutting_2 = Boolean(use_inside_cutting)
mill_outer_layer_first_2 = Boolean(mill_outer_layer_first)
cut_depth_2 = Number(cut_depth)
number_of_offsets_2 = Number(number_of_offsets)
cutout_tolerance_2 = Number(cutout_tolerance)
curves = Curve(curves_for_cutout_with_offsets)
tool_diameter_3 = Panel(tool_diameter_2)
use_climb_direction_3 = Panel(use_climb_direction_2)
use_inside_cutting_3 = Panel(use_inside_cutting_2)
multiplication = Multiplication(A=tool_diameter_3, B=stepover_2)
multiplication_2 = Multiplication(A=tool_diameter_3, B="0.5")
join = JoinCurves(Curves=flatten(curves), Preserve=False)
cutout_tolerance_3 = Panel(cutout_tolerance_2)
tool_radius = Panel(multiplication_2)
cls = Closed(Curve=join)  # -> Closed, Periodic
addition = Addition(A=tool_radius, B=cutout_tolerance_3)
dispatch = Dispatch(List=join, DispatchPattern=cls.Closed)  # -> ListA, ListB
compensated_tool_radius = Panel(addition)
unusable_open_curves = Curve(dispatch.ListB)
closed_curves = Curve(dispatch.ListA)
series = Series(Start=compensated_tool_radius, Step=multiplication, Count=number_of_offsets_2)
flatten = FlattenTree(Tree=closed_curves, Path="{0}")
polyoffset = PolylineOffset(
    Polylines=closed_curves,
    Distance=series,
    Plane=Plane(origin=(0, 0, 0), x=(0, 0, 0), y=(0, 0, 0)),
    Tolerance=0.001,
    ClosedFillet=0,
    OpenFillet=0,
    Miter=2)  # -> Contour, Holes
boundary = BoundarySurfaces(Edges=flatten)
mesh = MeshBrep(
    Brep=boundary,
    Settings={GridMaxCount=0, GridMinCount=16, JaggedSeams=False, MaxEdgeLength=0, MinEdgeLength=0.0001, MinTolerance=0, Refine=True, RefineAngle=0, RelativeTolerance=0.65, SimplePlanes=True, Tolerance=0})
crv = Curve(polyoffset.Contour)
crv_2 = Curve(polyoffset.Holes)
mjoin = MeshJoin(Meshes=mesh)
end = EndPoints(Curve=crv)  # -> Start, End
end_2 = EndPoints(Curve=crv_2)  # -> Start, End
meshcp = MeshClosestPoint(Point=end.Start, Mesh=mjoin)  # -> Point, Index, Parameter
meshcp_2 = MeshClosestPoint(Point=end_2.Start, Mesh=mjoin)  # -> Point, Index, Parameter
dist = Distance(PointA=meshcp_2.Point, PointB=end_2.Start)
dist_2 = Distance(PointA=meshcp.Point, PointB=end.Start)
larger = LargerThan(FirstNumber=dist_2, SecondNumber="0.001")  # -> LargerThan, OrEqualTo
larger_2 = LargerThan(FirstNumber=dist, SecondNumber="0.001")  # -> LargerThan, OrEqualTo
dispatch_2 = Dispatch(List=simplify(crv), DispatchPattern=simplify(larger.LargerThan))  # -> ListA, ListB
dispatch_3 = Dispatch(List=simplify(crv_2), DispatchPattern=simplify(larger_2.LargerThan))  # -> ListA, ListB
filter = StreamFilter(Gate=use_inside_cutting_3, Stream0=dispatch_2.ListA, Stream1=dispatch_2.ListB)
filter_2 = StreamFilter(Gate=use_inside_cutting_3, Stream0=dispatch_3.ListA, Stream1=dispatch_3.ListB)
mill_outer_layer_first_3 = Panel(mill_outer_layer_first_2)
merge = Merge(Data1=filter, Data2=filter_2)
gate = StreamGate(Stream=merge, Gate=mill_outer_layer_first_3)  # -> Target0, Target1
rev = ReverseList(List=gate.Target1)
filter_3 = StreamFilter(Gate=0, Stream0=gate.Target0, Stream1=rev)
pass_depth_3 = Panel(pass_depth_2)
cut_depth_3 = Panel(cut_depth_2)
offset_curves = Curve(filter_3)
group = Group(Objects=flatten(offset_curves))
division = Division(A=cut_depth_3, B=pass_depth_3)
round = Round(Number=division)  # -> Nearest, Floor, Ceiling
graft = GraftTree(Tree=group, IncludeEmptyLists=True, IncludeNullItems=True)
division_2 = Division(A=cut_depth_3, B=round.Ceiling)
actual_pass_depth = Panel(division_2)
series_2 = Series(Start=actual_pass_depth, Step=actual_pass_depth, Count=round.Ceiling)
neg = Negative(Value=series_2)
Z = UnitZ(Factor=neg)
simplify = SimplifyTree(Tree=graft, Front=False)
simplify_2 = SimplifyTree(Tree=Z, Front=False)
move = Move(Geometry=simplify, Motion=simplify_2)  # -> Geometry, Transform
ungroup = Ungroup(Group=move.Geometry)
unused_open_curves = Curve(unusable_open_curves)
flatten_2 = FlattenTree(Tree=ungroup, Path="{0}")
unused_open_curves_2 = ClusterOutput(unused_open_curves)
toolpaths = Curve(flatten_2)
toolpaths_2 = ClusterOutput(toolpaths)

# ==== cluster FeedrateCalculatorForArcs: Compensates for the speed difference between the center of a bit and its outer edge when cutting in circular paths. Calculates a feedrate matching chipload and rpm. This speed difference is similar to how the wheels on a car spin at different speeds during a turn. Can take chip thining into account. Input the maxium stepover the tool will encounter. Normal pockets and profiles will have a full stepover of 1, while the Arc Based High speed milling givve constant low stepovers as speciified.
ramp_feed_reduction_factor = ClusterInput()
ramp_feed_reduction_factor_2 = Number(ramp_feed_reduction_factor)
arc_diameter_factor = ClusterInput()
milling_bit_diameter = ClusterInput()
number_of_flutes = ClusterInput()
max_stepover = ClusterInput()
spindle_rpm = ClusterInput()
chip_load = ClusterInput()
number_of_flutes_2 = Number(number_of_flutes)
milling_bit_diameter_2 = Number(milling_bit_diameter)
spindle_rpm_2 = Number(spindle_rpm)
max_stepover_2 = Number(max_stepover)
chip_load_2 = Number(chip_load)
arc_diameter_factor_2 = Number(arc_diameter_factor)
number_of_flutes_3 = Panel(number_of_flutes_2)
chip_load_3 = Panel(chip_load_2)
max_stepover_3 = Panel(max_stepover_2)
ramp_feedrate_reduction_factor = Panel(ramp_feed_reduction_factor_2)
arc_diameter_factor_3 = Panel(arc_diameter_factor_2)
spindle_rpm_3 = Panel(spindle_rpm_2)
milling_bit_diameter_3 = Panel(milling_bit_diameter_2)

multiplication = Multiplication(A=milling_bit_diameter_3, B=arc_diameter_factor_3)
subtraction = Subtraction(A=multiplication, B=milling_bit_diameter_3)
arc_diameter_at_bit_edge = Panel(multiplication)
arc_diameter_at_bit_center = Panel(subtraction)
division = Division(A=arc_diameter_at_bit_center, B=arc_diameter_at_bit_edge)
arc_feedrate_reduction_factor = Panel(division)

# ---- group: Calulate chip thining
larger = LargerThan(FirstNumber=max_stepover_3, SecondNumber="0.5")  # -> LargerThan, OrEqualTo
filter = StreamFilter(Gate=larger.LargerThan, Stream0=max_stepover_3, Stream1="0.5")
multiplication_2 = Multiplication(A=milling_bit_diameter_3, B=filter)
multiplication_3 = Multiplication(A="0.5", B=milling_bit_diameter_3)
subtraction_2 = Subtraction(A=multiplication_3, B=multiplication_2)
neg = Negative(Value=subtraction_2)
pt = ConstructPoint(XCoordinate=milling_bit_diameter_3, YCoordinate=neg, ZCoordinate=0)
pt_2 = ConstructPoint(XCoordinate=0, YCoordinate=neg, ZCoordinate=0)
xy = XYPlane(Origin=Point(0, 0, 0))
ln = Line(StartPoint=pt_2, EndPoint=pt)
cir = Circle(Plane=xy, Radius=multiplication_3)
ccx = CurveCurve(CurveA=cir, CurveB=ln)  # -> Points, ParamsA, ParamsB
pt_3 = ConstructPoint(XCoordinate=0, YCoordinate=0, ZCoordinate=0)
chip_load_4 = Panel(chip_load_3)
vec2pt = Vector2Pt(PointA=pt_3, PointB=ccx.Points, Unitize=False)  # -> Vector, Length
amp = Amplitude(Vector=vec2pt.Vector, Amplitude=chip_load_4)
move = Move(Geometry=ccx.Points, Motion=amp)  # -> Geometry, Transform
pdecon = Deconstruct(Point=move.Geometry)  # -> XComponent, YComponent, ZComponent
pt_4 = ConstructPoint(XCoordinate=0, YCoordinate=pdecon.YComponent, ZCoordinate=pdecon.ZComponent)
ln_2 = Line(StartPoint=move.Geometry, EndPoint=pt_4)
ccx_2 = CurveCurve(CurveA=cir, CurveB=ln_2)  # -> Points, ParamsA, ParamsB
dist = Distance(PointA=flatten(ccx_2.Points), PointB=flatten(move.Geometry))
move_distance_needed_for_chipload = Panel(dist)
chip_load_5 = Panel(chip_load_3)
division_2 = Division(A=move_distance_needed_for_chipload, B=chip_load_5)

# ---- group: Calculate feedrate
multiplication_4 = Multiplication(A=spindle_rpm_3, B=number_of_flutes_3)
multiplication_5 = Multiplication(A=multiplication_4, B=chip_load_3)
division_3 = Division(A=multiplication_5, B="60")
feedrate = Panel(division_3)

# ----
multiplication_6 = Multiplication(A=feedrate, B=arc_feedrate_reduction_factor)
arc_compensated_feedrate = Panel(multiplication_6)

# ---- group: Safatey in case of too extreme values
backup_feedrate_multiplaication_factor = Panel("2")
feedrate_multiplaication_factor = Panel(division_2)
null = NullItem(Item=ccx_2.Points)  # -> NullFlags, InvalidFlags, Description
filter_2 = StreamFilter(Gate=null.NullFlags, Stream0=feedrate_multiplaication_factor, Stream1=backup_feedrate_multiplaication_factor)

# ---- group: Visualize chip size
X = UnitX(Factor=dist)
ln_3 = Line(StartPoint=ccx.Points, EndPoint=pt)
ln_4 = Line(StartPoint=ccx.Points, EndPoint=move.Geometry)
move_2 = Move(Geometry=cir, Motion=X)  # -> Geometry, Transform
chip_load_cross_section = Curve(ln_4)
new_bit_position = Curve(move_2.Geometry)
old_bit_position = Curve(cir)
material_edge = Curve(ln_3)

# ----
panel = Panel("Stepover to small or chipload to high. Unable to compute optimal feedrate multiplication factor.")
filter_3 = StreamFilter(Gate=null.NullFlags, Stream0="All good", Stream1=panel)
ramp_feedrate_reduction_factor_2 = Panel(ramp_feedrate_reduction_factor)
feedrate_multiplication_factor = Panel(filter_2)
feedrate_2 = Panel(arc_compensated_feedrate)
feedback = Panel(filter_3)
multiplication_7 = Multiplication(A=feedrate_2, B=feedrate_multiplication_factor)
multiplication_8 = Multiplication(A=multiplication_7, B=ramp_feedrate_reduction_factor_2)
feedback_2 = Text(feedback)
int = Integer(multiplication_7)
int_2 = Integer(multiplication_8)
feedback_3 = ClusterOutput(feedback_2)
arc_compensated_feedrate_2 = Number(int)
ramp_feedrate = Number(int_2)
ramp_feedrate_2 = ClusterOutput(ramp_feedrate)
arc_compensated_feedrate_3 = ClusterOutput(arc_compensated_feedrate_2)

# ==== cluster ConnectOverlappingToolpaths
polyline_toolpaths = ClusterInput()
polyline_toolpaths_2 = Curve(polyline_toolpaths)
clean = CleanTree(RemoveNulls=True, RemoveInvalid=True, RemoveEmpty=False, Tree=polyline_toolpaths_2)
crv = Curve(clean)
cp = ControlPoints(Curve=crv)  # -> Points, Weights, Knots
cp_2 = ControlPoints(Curve=crv)  # -> Points, Weights, Knots
end = EndPoints(Curve=crv)  # -> Start, End
lng = ListLength(List=cp.Points)
pshift = ShiftPaths(Data=cp_2.Points, Offset=-1)
shift = ShiftList(List=end.Start, Shift=1, Wrap=False)
shift_2 = ShiftList(List=end.End, Shift=-1, Wrap=False)
pshift_2 = ShiftPaths(Data=lng, Offset=-1)
pline = PolyLine(Vertices=pshift, Closed=False)
pdecon = Deconstruct(Point=shift)  # -> XComponent, YComponent, ZComponent
pdecon_2 = Deconstruct(Point=shift_2)  # -> XComponent, YComponent, ZComponent
ma = MassAddition(Input=pshift_2)  # -> Result, PartialResults
cp_3 = ControlPoints(Curve=pline)  # -> Points, Weights, Knots
pshift_3 = ShiftPaths(Data=cp_2.Points, Offset=-1)
flatten = FlattenTree(Tree=ma.PartialResults, Path="{0}")
multiplication = Multiplication(A=pdecon.YComponent, B="100")
multiplication_2 = Multiplication(A=pdecon.XComponent, B="100")
multiplication_3 = Multiplication(A=pdecon_2.XComponent, B="100")
multiplication_4 = Multiplication(A=pdecon_2.YComponent, B="100")
lng_2 = ListLength(List=pshift_3)
lng_3 = ListLength(List=cp_3.Points)
int = Integer(multiplication)
int_2 = Integer(multiplication_2)
int_3 = Integer(multiplication_3)
int_4 = Integer(multiplication_4)
smaller = SmallerThan(FirstNumber=lng_3, SecondNumber=lng_2)  # -> SmallerThan, OrEqualTo
division = Division(A=int, B="100")
division_2 = Division(A=int_2, B="100")
division_3 = Division(A=int_3, B="100")
division_4 = Division(A=int_4, B="100")
unreialiable_result_boolean = Panel(smaller.SmallerThan)
equals = Equality(FirstNumber=division_2, SecondNumber=division_3)  # -> Equality, Inequality
equals_2 = Equality(FirstNumber=division, SecondNumber=division_4)  # -> Equality, Inequality
and = GateAnd(A=equals.Equality, B=equals_2.Equality)

# ---- group: Line connection viz for troubleshooting
dispatch = Dispatch(List=shift_2, DispatchPattern=and)  # -> ListA, ListB
dispatch_2 = Dispatch(List=shift, DispatchPattern=and)  # -> ListA, ListB
ln = Line(StartPoint=dispatch_2.ListA, EndPoint=dispatch.ListA)  # disabled

# ----
rev = ReverseList(List=flatten)
rev_2 = ReverseList(List=flatten)
cull_i = CullIndex(List=rev, Indices="0", Wrap=True)
item = ListItem(List=rev, Index="0", Wrap=True)
cull_i_2 = CullIndex(List=rev_2, Indices="0", Wrap=True)
pshift_4 = ShiftPaths(Data=and, Offset=-1)
pshift_5 = ShiftPaths(Data=cull_i, Offset=-1)
pshift_6 = ShiftPaths(Data=cull_i_2, Offset=-1)
lng_4 = ListLength(List=pshift_4)
rev_3 = ReverseList(List=pshift_5)
rev_4 = ReverseList(List=pshift_6)
ins = InsertItems(List=pshift_4, Item=Toggle(False), Indices="0", Wrap=True)
ins_2 = InsertItems(List=pshift_4, Item=Toggle(False), Indices=lng_4, Wrap=True)
subtraction = Subtraction(A=rev_3, B="1")
cp_4 = ControlPoints(Curve=pline)  # -> Points, Weights, Knots
flatten_2 = FlattenTree(Tree=pshift, Path="{0}")
pshift_7 = ShiftPaths(Data=ins, Offset=-1)
merge = Merge(Data1=subtraction, Data2=item)
merge_2 = Merge(Data1="0", Data2=rev_4)
pshift_8 = ShiftPaths(Data=ins_2, Offset=-1)
dispatch_3 = Dispatch(List=merge_2, DispatchPattern=pshift_7)  # -> ListA, ListB
dispatch_4 = Dispatch(List=merge, DispatchPattern=pshift_8)  # -> ListA, ListB
dom = ConstructDomain(DomainStart=dispatch_3.ListB, DomainEnd=dispatch_4.ListB)
subset = SubList(List=flatten_2, Domain=dom, Wrap=False)  # -> List, Index
pline_2 = PolyLine(Vertices=subset.List, Closed=False)
unreialiable_result_boolean_2 = Panel(unreialiable_result_boolean)
flatten_3 = FlattenTree(Tree=pline_2, Path="{0}")
pshift_9 = ShiftPaths(Data=pline_2, Offset=-2)
filter = StreamFilter(Gate=unreialiable_result_boolean_2, Stream0=pshift_9)
item_2 = ListItem(List=flatten_3, Index=0, Wrap=True)
polyline_toolpaths_3 = Curve(polyline_toolpaths_2)
null = NullItem(Item=item_2)  # -> NullFlags, InvalidFlags, Description
filter_2 = StreamFilter(Gate=null.NullFlags, Stream0=flatten_3, Stream1=polyline_toolpaths_3)
z_connected_polyline_toolpaths = Curve(filter_2)
z_connected_polyline_toolpaths_2 = ClusterOutput(z_connected_polyline_toolpaths)

# ==== cluster TabToolpaths
polyline_toolpaths = ClusterInput()
milling_bit_diamter = ClusterInput()
tab_breps = ClusterInput()
tab_cleanup_overshoot_lenght = Panel("1")
tab_breps_2 = Brep(tab_breps)
polyline_toolpaths_2 = Curve(polyline_toolpaths)
milling_bit_diamter_2 = Number(milling_bit_diamter)
flatten = FlattenTree(Tree=tab_breps_2, Path="{0}")
clean = CleanTree(RemoveNulls=True, RemoveInvalid=True, RemoveEmpty=False, Tree=polyline_toolpaths_2)
bbox = BoundingBox(Content=clean, Plane=PlaneXY(0, 0, 0), UnionBox=True)  # -> Box, Box_2

# ---- group: Check if any tab volumes break material surface
bbox_2 = BoundingBox(Content=flatten, Plane=PlaneXY(0, 0, 0))  # -> Box, Box_2
debrep = DeconstructBrep(Brep=bbox_2.Box)  # -> Faces, Edges, Vertices
item = ListItem(List=debrep.Vertices, Index="4", Wrap=True)
pdecon = Deconstruct(Point=item)  # -> XComponent, YComponent, ZComponent
sort = SortList(Keys=flatten(pdecon.ZComponent))  # -> Keys, ValuesA
rev = ReverseList(List=sort.Keys)
item_2 = ListItem(List=rev, Index=0, Wrap=True)
larger = LargerThan(FirstNumber=item_2, SecondNumber="0")  # -> LargerThan, OrEqualTo
make_severed_toolapths = Panel(larger.LargerThan)

# ---- group: Check for input tab breps
item_3 = ListItem(List=flatten, Index=0, Wrap=True)
null = NullItem(Item=item_3)  # -> NullFlags, InvalidFlags, Description
no_tab_brep_input_boolean = Panel(null.NullFlags)

# ----
debrep_2 = DeconstructBrep(Brep=bbox.Box)  # -> Faces, Edges, Vertices
item_4 = ListItem(List=debrep_2.Vertices, Index="0", Wrap=True)
pdecon_2 = Deconstruct(Point=flatten(item_4))  # -> XComponent, YComponent, ZComponent
subtraction = Subtraction(A=pdecon_2.ZComponent, B="0.1")
lowes_toolpath_point = Panel(subtraction)
polyline_toolpaths_3 = Curve(clean)
tab_breps_3 = Brep(flatten)

# ---- group: Bit diameter compensate tab breps (for tab cleanup)
tab_cleanup_overshoot_lenght_2 = Panel(tab_cleanup_overshoot_lenght)
milling_bit_diamter_3 = Number(milling_bit_diamter_2)
tab_breps_4 = Brep(tab_breps_3)
multiplication = Multiplication(A=milling_bit_diamter_3, B="0.5")
debrep_3 = DeconstructBrep(Brep=tab_breps_4)  # -> Faces, Edges, Vertices
bbox_3 = BoundingBox(Content=tab_breps_4, Plane=PlaneXY(0, 0, 0))  # -> Box, Box_2
addition = Addition(A=multiplication, B=tab_cleanup_overshoot_lenght_2)
debrep_4 = DeconstructBrep(Brep=bbox_3.Box)  # -> Faces, Edges, Vertices
planar = IsPlanar(Surface=debrep_3.Faces, Interior=True)  # -> Planar, Plane
deplane = DeconstructPlane(Plane=planar.Plane)  # -> Origin, XAxis, YAxis, ZAxis
lowes_toolpath_point_2 = Panel(lowes_toolpath_point)
pdecon_3 = Deconstruct(Point=deplane.Origin)  # -> XComponent, YComponent, ZComponent
item_5 = ListItem(List=debrep_4.Vertices, Index=4, Wrap=True)
sort_2 = SortList(Keys=pdecon_3.ZComponent, ValuesA=debrep_3.Faces)  # -> Keys, ValuesA
pt = ConstructPoint(XCoordinate=0, YCoordinate=0, ZCoordinate=lowes_toolpath_point_2)
item_6 = ListItem(List=sort_2.ValuesA, Index=0, Wrap=True)
xy = XYPlane(Origin=pt)
edges = BrepEdges(Brep=item_6)  # -> Naked, Interior, NonManifold
cp = PlaneClosestPoint(Point=item_5, Plane=xy)  # -> Point, UVPoint, Distance
pshift = ShiftPaths(Data=edges.Naked, Offset=-1)
join = JoinCurves(Curves=pshift, Preserve=False)
Z = UnitZ(Factor=cp.Distance)
simplify = SimplifyTree(Tree=join, Front=False)
simplify_2 = SimplifyTree(Tree=Z, Front=False)
milling_bit_radius = Panel(addition)
project = Project(Geometry=simplify, Plane=xy)  # -> Geometry, Transform
neg = Negative(Value=milling_bit_radius)
offset = Offset(Curve=project.Geometry, Distance=milling_bit_radius, Plane=PlaneXY(0, 0, 0), Corners=1)
offset_2 = Offset(Curve=project.Geometry, Distance=neg, Plane=PlaneXY(0, 0, 0), Corners=1)
len = Length(Curve=offset)
len_2 = Length(Curve=offset_2)
smaller = SmallerThan(FirstNumber=len, SecondNumber=len_2)  # -> SmallerThan, OrEqualTo
weave = Weave(Pattern=smaller.SmallerThan, Stream0=offset, Stream1=offset_2, NullGaps=False)
extr = Extrude(Base=weave, Direction=simplify_2)
cap = CapHoles(Brep=extr)
bit_diameter_compensated_tab_breps = Brep(flatten(cap))

# ---- group: Bit diameter compensate tab breps
milling_bit_diamter_4 = Number(milling_bit_diamter_2)
tab_breps_5 = Brep(tab_breps_3)
multiplication_2 = Multiplication(A=milling_bit_diamter_4, B="0.5")
debrep_5 = DeconstructBrep(Brep=tab_breps_5)  # -> Faces, Edges, Vertices
bbox_4 = BoundingBox(Content=tab_breps_5, Plane=PlaneXY(0, 0, 0))  # -> Box, Box_2
milling_bit_radius_2 = Panel(multiplication_2)
debrep_6 = DeconstructBrep(Brep=bbox_4.Box)  # -> Faces, Edges, Vertices
planar_2 = IsPlanar(Surface=debrep_5.Faces, Interior=True)  # -> Planar, Plane
deplane_2 = DeconstructPlane(Plane=planar_2.Plane)  # -> Origin, XAxis, YAxis, ZAxis
lowes_toolpath_point_3 = Panel(lowes_toolpath_point)
item_7 = ListItem(List=debrep_6.Vertices, Index=4, Wrap=True)
pdecon_4 = Deconstruct(Point=deplane_2.Origin)  # -> XComponent, YComponent, ZComponent
sort_3 = SortList(Keys=pdecon_4.ZComponent, ValuesA=debrep_5.Faces)  # -> Keys, ValuesA
pt_2 = ConstructPoint(XCoordinate=0, YCoordinate=0, ZCoordinate=lowes_toolpath_point_3)
item_8 = ListItem(List=sort_3.ValuesA, Index=0, Wrap=True)
xy_2 = XYPlane(Origin=pt_2)
edges_2 = BrepEdges(Brep=item_8)  # -> Naked, Interior, NonManifold
cp_2 = PlaneClosestPoint(Point=item_7, Plane=xy_2)  # -> Point, UVPoint, Distance
pshift_2 = ShiftPaths(Data=edges_2.Naked, Offset=-1)
join_2 = JoinCurves(Curves=pshift_2, Preserve=False)
Z_2 = UnitZ(Factor=cp_2.Distance)
simplify_3 = SimplifyTree(Tree=join_2, Front=False)
# FIX BUG: Tabs equal to bit diamter makes offset and select error
simplify_4 = SimplifyTree(Tree=Z_2, Front=False)
milling_bit_radius_3 = Panel(milling_bit_radius_2)
project_2 = Project(Geometry=simplify_3, Plane=xy_2)  # -> Geometry, Transform
neg_2 = Negative(Value=milling_bit_radius_3)
offset_3 = Offset(Curve=project_2.Geometry, Distance=milling_bit_radius_3, Plane=PlaneXY(0, 0, 0), Corners=1)
offset_4 = Offset(Curve=project_2.Geometry, Distance=neg_2, Plane=PlaneXY(0, 0, 0), Corners=1)
len_3 = Length(Curve=offset_3)
len_4 = Length(Curve=offset_4)
smaller_2 = SmallerThan(FirstNumber=len_3, SecondNumber=len_4)  # -> SmallerThan, OrEqualTo
weave_2 = Weave(Pattern=smaller_2.SmallerThan, Stream0=offset_3, Stream1=offset_4, NullGaps=False)
extr_2 = Extrude(Base=weave_2, Direction=simplify_4)
cap_2 = CapHoles(Brep=extr_2)
bit_diameter_compensated_tab_breps_2 = Brep(flatten(cap_2))

# ---- group: Check for invalid boxes
flatten_2 = FlattenTree(Tree=bit_diameter_compensated_tab_breps_2, Path="{0}")
item_9 = ListItem(List=flatten_2, Index=0, Wrap=True)
null_2 = NullItem(Item=item_9)  # -> NullFlags, InvalidFlags, Description
filter = StreamFilter(Gate=null_2.NullFlags, Stream0=bit_diameter_compensated_tab_breps_2, Stream1=tab_breps_3)

flatten_3 = FlattenTree(Tree=bit_diameter_compensated_tab_breps, Path="{0}")
item_10 = ListItem(List=flatten_3, Index=0, Wrap=True)
null_3 = NullItem(Item=item_10)  # -> NullFlags, InvalidFlags, Description
filter_2 = StreamFilter(Gate=null_3.NullFlags, Stream0=bit_diameter_compensated_tab_breps, Stream1=tab_breps_3)

# ----
mesh = MeshBrep(
    Brep=filter_2,
    Settings={GridMaxCount=0, GridMinCount=16, JaggedSeams=False, MaxEdgeLength=0, MinEdgeLength=0.0001, MinTolerance=0, Refine=True, RefineAngle=0, RelativeTolerance=0.65, SimplePlanes=True, Tolerance=0})
mjoin = MeshJoin(Meshes=mesh)
tab_cleanup_volume_mesh = Mesh(mjoin)

make_severed_toolapths_2 = Panel(make_severed_toolapths)
no_tab_brep_input_boolean_2 = Panel(no_tab_brep_input_boolean)
polyline_toolpaths_4 = Curve(clean)

mesh_2 = MeshBrep(
    Brep=filter,
    Settings={GridMaxCount=0, GridMinCount=16, JaggedSeams=False, MaxEdgeLength=0, MinEdgeLength=0.0001, MinTolerance=0, Refine=True, RefineAngle=0, RelativeTolerance=0.65, SimplePlanes=True, Tolerance=0})
mjoin_2 = MeshJoin(Meshes=mesh_2)
tab_volume_mesh = Mesh(mjoin_2)
colom = CollisionOneMany(Collider=tab_volume_mesh, Obstacles=graft(polyline_toolpaths_3))  # -> Collision, Index
pshift_3 = ShiftPaths(Data=colom.Collision, Offset=-1)

tab_or_no_tab_booleans = Integer(pshift_3)

dispatch = Dispatch(List=polyline_toolpaths_3, DispatchPattern=tab_or_no_tab_booleans)  # -> ListA, ListB
toolpaths_without_tabs = Curve(dispatch.ListB)
toolpaths_for_tabbing = Curve(dispatch.ListA)

bbox_5 = BoundingBox(Content=mesh_2, Plane=PlaneXY(0, 0, 0))  # -> Box, Box_2
volume = Volume(Geometry=bbox_5.Box)  # -> Volume, Centroid
xy_3 = XYPlane(Origin=volume.Centroid)
scale_nu = ScaleNU(Geometry=bbox_5.Box, Plane=xy_3, ScaleX="1.01", ScaleY="1.01", ScaleZ=1)  # -> Geometry, Transform
mjoin_3 = MeshJoin(Meshes=scale_nu.Geometry)
tab_control_point_intersect_mesh = Mesh(mjoin_3)

# ---- group: Filter toolpaths entirely inside tabs
toolpaths_without_tabs_2 = Curve(dispatch.ListB)
tab_breps_6 = Brep(filter)
shapein = ShapeInBrep(Brep=tab_breps_6, Shape=toolpaths_without_tabs_2)
lng = ListLength(List=toolpaths_without_tabs_2)
bool = Boolean(shapein)
series = Series(Start=0, Step=1, Count=lng)
dispatch_2 = Dispatch(List=series, DispatchPattern=bool)  # -> ListA, ListB
replace = ReplaceItems(List=toolpaths_without_tabs_2, Indices=dispatch_2.ListB, Wrap=False)
toolpaths_without_tabs_3 = Curve(replace)

# ---- group: Test closing
cls = Closed(Curve=toolpaths_for_tabbing)  # -> Closed, Periodic
graft = GraftTree(Tree=cls.Closed, IncludeEmptyLists=True, IncludeNullItems=True)

# ----
tab_or_no_tab_booleans_2 = Integer(tab_or_no_tab_booleans)
toolpaths_without_tabs_4 = Curve(replace)

# ---- group: Cut toolpaths with extended tab volumes for tab cleanup
tab_cleanup_volume_mesh_2 = Mesh(tab_cleanup_volume_mesh)
mcx = MeshCurve(Mesh=tab_cleanup_volume_mesh_2, Curve=toolpaths_for_tabbing)  # -> Points, Faces

# ----
cullpt = CullDuplicates(Points=mcx.Points, Tolerance="0.01", CullMode=3)  # -> Points, Indices, Valence
pshift_4 = ShiftPaths(Data=cullpt.Points, Offset=-1)

# ---- group: Cut toolpaths with extended tab volumes for tab cleanup (continued)
crv_cp = CurveClosestPoint(Point=pshift_4, Curve=graft(toolpaths_for_tabbing))  # -> Point, Parameter, Distance
shatter = Shatter(Curve=graft(toolpaths_for_tabbing), Parameters=crv_cp.Parameter)
curvepoint = PointOnCurve(shatter, parameter=0.5)
minc = MeshInclusion(Mesh=tab_cleanup_volume_mesh_2, Point=curvepoint, Strict=False)
dispatch_3 = Dispatch(List=shatter, DispatchPattern=minc)  # -> ListA, ListB
tab_cleanup_toolpaths = Curve(dispatch_3.ListA)
toolpath_outside_tabs = Curve(dispatch_3.ListB)

# ----
tab_cleanup_toolpaths_2 = Curve(tab_cleanup_toolpaths)
flatten_4 = FlattenTree(Tree=tab_cleanup_toolpaths_2, Path="{0}")
tab_cleanup_toolpaths_3 = Curve(flatten_4)
tab_cleanup_toolpaths_4 = ClusterOutput(tab_cleanup_toolpaths_3)

# ---- group: Cut toolpaths with tab volumes
tab_volume_mesh_2 = Mesh(tab_volume_mesh)
mcx_2 = MeshCurve(Mesh=tab_volume_mesh_2, Curve=toolpaths_for_tabbing)  # -> Points, Faces

# ----
cullpt_2 = CullDuplicates(Points=mcx_2.Points, Tolerance="0.01", CullMode=3)  # -> Points, Indices, Valence
pshift_5 = ShiftPaths(Data=cullpt_2.Points, Offset=-1)

# ---- group: Cut toolpaths with tab volumes (continued)
crv_cp_2 = CurveClosestPoint(Point=pshift_5, Curve=graft(toolpaths_for_tabbing))  # -> Point, Parameter, Distance
shatter_2 = Shatter(Curve=graft(toolpaths_for_tabbing), Parameters=crv_cp_2.Parameter)
curvepoint_2 = PointOnCurve(shatter_2, parameter=0.5)
minc_2 = MeshInclusion(Mesh=tab_volume_mesh_2, Point=curvepoint_2, Strict=False)
dispatch_4 = Dispatch(List=shatter_2, DispatchPattern=minc_2)  # -> ListA, ListB
toolpath_outside_tabs_2 = Curve(dispatch_4.ListB)
toolpaths_inside_tabs = Curve(dispatch_4.ListA)

# ----
cp_3 = ControlPoints(Curve=toolpaths_inside_tabs)  # -> Points, Weights, Knots
Z_3 = UnitZ(Factor=1)
meshray = MeshRay(Mesh=tab_control_point_intersect_mesh, Point=cp_3.Points, Direction=Z_3)  # -> Point, Hit
pline = PolyLine(Vertices=meshray.Point, Closed=False)
pshift_6 = ShiftPaths(Data=pline, Offset=-1)

weave_3 = Weave(Pattern=minc_2, Stream0=toolpath_outside_tabs_2, Stream1=pshift_6, NullGaps=False)
cp_4 = ControlPoints(Curve=weave_3)  # -> Points, Weights, Knots
pshift_7 = ShiftPaths(Data=cp_4.Points, Offset=-1)
pline_2 = PolyLine(Vertices=pshift_7, Closed=graft)
pshift_8 = ShiftPaths(Data=pline_2, Offset="-2")
toolpath_outside_tabs_3 = Curve(toolpath_outside_tabs_2)
group = Group(Objects=toolpath_outside_tabs_3)

# ---- group: Check
flatten_5 = FlattenTree(Tree=pline_2, Path="{0}")
flatten_6 = FlattenTree(Tree=group, Path="{0}")

# ----
toolpaths_with_tabs = Curve(flatten_5)
pshift_9 = ShiftPaths(Data=group, Offset="-2")
filter_3 = StreamFilter(Gate=make_severed_toolapths_2, Stream0=toolpaths_with_tabs, Stream1=flatten_6)
tabbed_toolpaths = Geometry(filter_3)
weave_4 = Weave(Pattern=tab_or_no_tab_booleans_2, Stream0=toolpaths_without_tabs_4, Stream1=tabbed_toolpaths, NullGaps=False)
ungroup = Ungroup(Group=weave_4)
pshift_10 = ShiftPaths(Data=ungroup, Offset=-1)

polyline_toolpaths_5 = Curve(clean)
end = EndPoints(Curve=pshift_10)  # -> Start, End

end_2 = EndPoints(Curve=polyline_toolpaths_5)  # -> Start, End
crv_cp_3 = CurveClosestPoint(Point=end_2.End, Curve=pshift_10)  # -> Point, Parameter, Distance
pt_3 = Point(end_2.End)

dist = Distance(PointA=end.End, PointB=pt_3)
smaller_3 = SmallerThan(FirstNumber=dist, SecondNumber="0.01")  # -> SmallerThan, OrEqualTo
dispatch_5 = Dispatch(List=crv_cp_3.Parameter, DispatchPattern=smaller_3.SmallerThan)  # -> ListA, ListB
dispatch_6 = Dispatch(List=pshift_10, DispatchPattern=smaller_3.SmallerThan)  # -> ListA, ListB
seam = Seam(Curve=dispatch_6.ListB, Seam=dispatch_5.ListB)
weave_5 = Weave(Pattern=smaller_3.SmallerThan, Stream0=seam, Stream1=dispatch_6.ListA, NullGaps=False)

filter_4 = StreamFilter(Gate=no_tab_brep_input_boolean_2, Stream0=weave_5, Stream1=polyline_toolpaths_4)
clean_2 = CleanTree(RemoveNulls=True, RemoveInvalid=False, RemoveEmpty=False, Tree=filter_4)
flatten_7 = FlattenTree(Tree=clean_2, Path="{0}")
tabbed_toolpaths_2 = Curve(flatten_7)
tabbed_toolpaths_3 = ClusterOutput(tabbed_toolpaths_2)

# ==== cluster RampToolpathPlunges
toolpaths_to_ramp = ClusterInput()
ramp_angle = ClusterInput()
toolpaths_to_ramp_2 = Curve(toolpaths_to_ramp)
ramp_angle_2 = Number(ramp_angle)
end = EndPoints(Curve=toolpaths_to_ramp_2)  # -> Start, End
pdecon = Deconstruct(Point=end.Start)  # -> XComponent, YComponent, ZComponent
abs = Absolute(Value=pdecon.ZComponent)
dom = ConstructDomain(DomainStart="1", DomainEnd="89")
rad = Radians(Degrees=ramp_angle_2)
rtrig = RightTrigonometry(Beta=rad, QLength=abs)  # -> Alpha, Beta, PLength, QLength, RLength
len = Length(Curve=toolpaths_to_ramp_2)
smaller = SmallerThan(FirstNumber=len, SecondNumber=rtrig.PLength)  # -> SmallerThan, OrEqualTo
dispatch = Dispatch(List=len, DispatchPattern=smaller.OrEqualTo)  # -> ListA, ListB
dispatch_2 = Dispatch(List=rtrig.PLength, DispatchPattern=smaller.OrEqualTo)  # -> ListA, ListB
division = Division(A=dispatch_2.ListA, B=dispatch.ListA)
weave = Weave(Pattern=smaller.OrEqualTo, Stream0=dispatch_2.ListB, Stream1=dispatch.ListA, NullGaps=False)

cls = Closed(Curve=toolpaths_to_ramp_2)  # -> Closed, Periodic
dispatch_3 = Dispatch(List=toolpaths_to_ramp_2, DispatchPattern=cls.Closed)  # -> ListA, ListB
flip = FlipCurve(Curve=dispatch_3.ListA)  # -> Curve, Flag
weave_2 = Weave(Pattern=cls.Closed, Stream0=dispatch_3.ListB, Stream1=flip.Curve, NullGaps=False)

round = Round(Number=division)  # -> Nearest, Floor, Ceiling
division_2 = Division(A=weave, B="0.1")
dispatch_4 = Dispatch(List=abs, DispatchPattern=smaller.OrEqualTo)  # -> ListA, ListB
int = Integer(division_2)
division_3 = Division(A=dispatch_4.ListA, B=round.Ceiling)
int_2 = Integer(division_2)
division_4 = Division(A=weave, B=int)
weave_3 = Weave(Pattern=smaller.OrEqualTo, Stream0=dispatch_4.ListB, Stream1=division_3, NullGaps=False)
addition = Addition(A=int, B="1")
division_5 = Division(A=weave_3, B=int_2)
series = Series(Start=0, Step=division_4, Count=addition)
series_2 = Series(Start=0, Step=division_5, Count=addition)
eval = EvaluateLength(Curve=graft(weave_2), Length=series, Normalized=False)  # -> Point, Tangent, Parameter
Z = UnitZ(Factor=series_2)
move = Move(Geometry=eval.Point, Motion=Z)  # -> Geometry, Transform
pline = PolyLine(Vertices=move.Geometry, Closed=False)
pshift = ShiftPaths(Data=pline, Offset=-1)
redpline = Reduce(Polyline=pshift, Tolerance="0.02")  # -> Polyline, Reduction
flip_2 = FlipCurve(Curve=redpline.Polyline)  # -> Curve, Flag

dispatch_5 = Dispatch(List=flip_2.Curve, DispatchPattern=smaller.OrEqualTo)  # -> ListA, ListB
end_2 = EndPoints(Curve=dispatch_5.ListA)  # -> Start, End
pdecon_2 = Deconstruct(Point=end_2.End)  # -> XComponent, YComponent, ZComponent
pdecon_3 = Deconstruct(Point=end_2.Start)  # -> XComponent, YComponent, ZComponent
pt = ConstructPoint(XCoordinate=0, YCoordinate=0, ZCoordinate=pdecon_2.ZComponent)
pt_2 = ConstructPoint(XCoordinate=0, YCoordinate=0, ZCoordinate=pdecon_3.ZComponent)
dist = Distance(PointA=pt_2, PointB=pt)
series_3 = Series(Start=0, Step=dist, Count=round.Ceiling)
Z_2 = UnitZ(Factor=series_3)
move_2 = Move(Geometry=graft(dispatch_5.ListA), Motion=Z_2)  # -> Geometry, Transform

clean = CleanTree(RemoveNulls=True, RemoveInvalid=True, RemoveEmpty=False, Tree=move_2.Geometry)
join = JoinCurves(Curves=move_2.Geometry, Preserve=False)
flip_3 = FlipMatrix(Data=clean)
lng = ListLength(List=join)
dispatch_6 = Dispatch(List=flip_3, DispatchPattern=cls.Closed)  # -> ListA, ListB
larger = LargerThan(FirstNumber=lng, SecondNumber="1")  # -> LargerThan, OrEqualTo
flip_4 = FlipMatrix(Data=dispatch_6.ListB)
dispatch_7 = Dispatch(List=join, DispatchPattern=larger.LargerThan)  # -> ListA, ListB
simplify = SimplifyTree(Tree=dispatch_7.ListA, Front=False)
dispatch_8 = Dispatch(List=flip_4, DispatchPattern=[True, False])  # -> ListA, ListB
flatten = FlattenTree(Tree=dispatch_7.ListB, Path="{0}")
dispatch_9 = Dispatch(List=simplify, DispatchPattern=[True, False])  # -> ListA, ListB
crv = Curve(dispatch_9.ListB)
bbox = BoundingBox(Content=dispatch_9.ListB, Plane=PlaneXY(0, 0, 0))  # -> Box, Box_2
xy = XYPlane(Origin=Point(0, 0, 0))
cp = ControlPoints(Curve=dispatch_8.ListB)  # -> Points, Weights, Knots
x_tremez = Extremes(Curve=crv, Plane=xy)  # -> Highest, Lowest
cp_2 = ControlPoints(Curve=dispatch_9.ListB)  # -> Points, Weights, Knots; disabled
pshift_2 = ShiftPaths(Data=bbox.Box, Offset=-1)
pdecon_4 = Deconstruct(Point=cp.Points)  # -> XComponent, YComponent, ZComponent
ln = Line(StartPoint=x_tremez.Highest, EndPoint=x_tremez.Lowest)
debrep = DeconstructBrep(Brep=pshift_2)  # -> Faces, Edges, Vertices
rev = ReverseList(List=pdecon_4.ZComponent)
pdecon_5 = Deconstruct(Point=cp_2.Points)  # -> XComponent, YComponent, ZComponent
pt_3 = ConstructPoint(XCoordinate=pdecon_4.XComponent, YCoordinate=pdecon_4.YComponent, ZCoordinate=rev)
item = ListItem(List=debrep.Edges, Index="8", Wrap=True)
rev_2 = ReverseList(List=pdecon_5.ZComponent)
eval_2 = EvaluateLength(Curve=ln, Length="0.5", Normalized=True)  # -> Point, Tangent, Parameter
pline_2 = PolyLine(Vertices=pt_3, Closed=False)
pt_4 = ConstructPoint(XCoordinate=pdecon_5.XComponent, YCoordinate=pdecon_5.YComponent, ZCoordinate=rev_2)
pshift_3 = ShiftPaths(Data=eval_2.Point, Offset=-1)  # disabled
pshift_4 = ShiftPaths(Data=pline_2, Offset=-1)
pline_3 = PolyLine(Vertices=pt_4, Closed=False)
xy_2 = XYPlane(Origin=eval_2.Point)
flip_5 = FlipCurve(Curve=pshift_4)  # -> Curve, Flag
pshift_5 = ShiftPaths(Data=pline_3, Offset=-1)
mirror = Mirror(Geometry=crv, Plane=xy_2)  # -> Geometry, Transform
weave_4 = Weave(Pattern=[0, 1], Stream0=dispatch_8.ListA, Stream1=flip_5.Curve, NullGaps=False)
flip_6 = FlipCurve(Curve=pshift_5)  # -> Curve, Flag
flip_7 = FlipMatrix(Data=weave_4)
flip_8 = FlipCurve(Curve=mirror.Geometry)  # -> Curve, Flag
weave_5 = Weave(Pattern=[0, 1], Stream0=dispatch_9.ListA, Stream1=flip_8.Curve, NullGaps=False)
weave_6 = Weave(Pattern=cls.Closed, Stream0=flip_7, Stream1=dispatch_6.ListA, NullGaps=False)
join_2 = JoinCurves(Curves=weave_5, Preserve=False)
flip_9 = FlipMatrix(Data=weave_6)
simplify_2 = SimplifyTree(Tree=join_2, Front=False)
join_3 = JoinCurves(Curves=flip_9, Preserve=False)
number_slider = Slider(4, range=0..10)
weave_7 = Weave(Pattern=flatten(larger.LargerThan), Stream0=flatten(flatten), Stream1=flatten(simplify_2), NullGaps=False)
pshift_6 = ShiftPaths(Data=join_3, Offset=-1)
pshift_7 = ShiftPaths(Data=pshift_6, Offset=-1)
weave_8 = Weave(Pattern=smaller.OrEqualTo, Stream0=dispatch_5.ListB, Stream1=weave_7, NullGaps=False)
item_2 = ListItem(List=toolpaths_to_ramp_2, Index=number_slider, Wrap=True)
item_3 = ListItem(List=weave_8, Index=number_slider, Wrap=True)
weave_9 = Weave(Pattern=[0, 1], Stream0=weave_8, Stream1=toolpaths_to_ramp_2, NullGaps=False)
join_4 = JoinCurves(Curves=weave_9, Preserve=Toggle(True))  # disabled
ramped_toolpaths = Curve(weave_9)
ramped_toolpaths_2 = ClusterOutput(ramped_toolpaths)

# ==== cluster TrochoidalHighSpeedMilling: Makes highspeed toolpaths for deep and fast cutting in metal. Input toolpath curves for the arcs to follow. Be careful about feedrates and stepovers. Prioritize deep passes and small stepovers (0.05 to 0.2). This technique is known as high speed feed machining.

# ---- group: Left this always on to reduce inpput options
make_helical_entry = Boolean(Toggle(True))

# ----
max_peck_depth_factor = ClusterInput()  # How deep each ehlical entry will be. Depth of entry helix = Max peck depth factor * Bit diameter
straight_arc_extensions = ClusterInput()  # Creates a smoother finish but increases the chance of rubbing (and heat buildup)
milling_bit_diameter = ClusterInput()  # The diameter of your milling bit
toolpath_width_factor = ClusterInput()  # How much wider the toolpath will be than the diamter of your milling bit. Width of trochoidal cut = Toolpath width factor * Bit diameter
toolpath_curves = ClusterInput()  # Curve geometry that you want to convert to trochoidal toolpaths. Pro tip: This can be output from toolpath functions like pocket and Cutout
use_climb_milling = ClusterInput()  # Climb milling direction works best in almost all materials
use_peck_entry = ClusterInput()  # Peck entry stops a helical entry at a max epth, before it starts the entry helix again. Allows for hard metals to cool inbetween entries. Use in case of un-optimized feedrates or machine acceleration.
jog_z_lift_factor = ClusterInput()  # How high up the bit moves during its return pass. Helps avoiding that the bit rubs on the floor during a return pass
ramp_angle = ClusterInput()  # The angle of the entry helix. Low angles and high speeds works well for metals
stepover = ClusterInput()  # How far into the material the bit moves each pass. Stepover distance = Bit diameter * Stepover

# ---- group: Separate feedrate and jog rates is not yet impleneted, it is rarely needed
ramp_entry_feedrate = Number(25)
feedrate = Number(50)
jograte = Number(60)

# ----
straight_arc_extensions_2 = Boolean(straight_arc_extensions)
max_peck_depth_factor_2 = Number(max_peck_depth_factor)
toolpath_width_factor_2 = Number(toolpath_width_factor)
use_peck_entry_2 = Boolean(use_peck_entry)
milling_bit_diameter_2 = Number(milling_bit_diameter)
use_climb_milling_2 = Boolean(use_climb_milling)
toolpath_curves_2 = Curve(toolpath_curves)
jog_z_lift_factor_2 = Number(jog_z_lift_factor)
ramp_angle_2 = Number(ramp_angle)
stepover_2 = Number(stepover)
max_diameter_factor_of_ramp_helix = Panel("2.2")
ramp_angle_3 = Panel(ramp_angle_2)
jog_z_lift_factor_3 = Panel(jog_z_lift_factor_2)
use_climb_milling_3 = Panel(use_climb_milling_2)
milling_bit_diameter_3 = Panel(milling_bit_diameter_2)
arc_diameter_factor = Panel(toolpath_width_factor_2)
stepover_3 = Panel(stepover_2)
make_straight_arc_extensions = Panel(straight_arc_extensions_2)
feedrate_2 = Panel(feedrate)
jograte_2 = Panel(jograte)
ramp_feedrate = Panel(ramp_entry_feedrate)
make_helical_entry_ramp = Panel(make_helical_entry)
max_peck_depth_factor_3 = Panel(max_peck_depth_factor_2)
use_peck_entry_3 = Panel(use_peck_entry_2)

# ---- group: Shetter curves at corners and shatter closed curves
disc = Discontinuity(Curve=toolpath_curves_2, Level=1)  # -> Points, Parameters
lng = ListLength(List=disc.Parameters)
smaller = SmallerThan(FirstNumber=lng, SecondNumber="1")  # -> SmallerThan, OrEqualTo
weave = Weave(Pattern=smaller.SmallerThan, Stream0=disc.Parameters, Stream1="0", NullGaps=False)
shatter = Shatter(Curve=graft(toolpath_curves_2), Parameters=weave)

# ----
straight = Panel("0")
smooth = Panel("2")
multiplication = Multiplication(A=milling_bit_diameter_3, B=arc_diameter_factor)
multiplication_2 = Multiplication(A=milling_bit_diameter_3, B=jog_z_lift_factor_3)
multiplication_3 = Multiplication(A=milling_bit_diameter_3, B=stepover_3)
subtraction = Subtraction(A=multiplication, B=milling_bit_diameter_3)
filter = StreamFilter(Gate=make_straight_arc_extensions, Stream0=smooth, Stream1=straight)
stepover_distance = Panel(multiplication_3)
z_lift_distance = Panel(multiplication_2)
arc_extension_type = Panel(filter)
arc_diameter = Panel(subtraction)
shattered_toolpath_curves = Curve(shatter)

# ---- group: Check if all curves consist of singel line, can give errors in data weaving
lng_2 = ListLength(List=shattered_toolpath_curves)
sort = SortList(Keys=flatten(lng_2))  # -> Keys, ValuesA
rev = ReverseList(List=sort.Keys)
item = ListItem(List=rev, Index=0, Wrap=True)
smaller_2 = SmallerThan(FirstNumber=item, SecondNumber="2")  # -> SmallerThan, OrEqualTo
all_toolpaths_are_single_curve = Panel(smaller_2.SmallerThan)

# ---- group: Make oriented planes for toolpah arcs
len = Length(Curve=shattered_toolpath_curves)
division = Division(A=len, B=stepover_distance)
int = Integer(division)
divide = DivideCurve(Curve=shattered_toolpath_curves, Count=int, Kinks=False)  # -> Points, Tangents, Parameters
cull_i = CullIndex(List=divide.Tangents, Indices="0", Wrap=True)
cull_i_2 = CullIndex(List=divide.Points, Indices="0", Wrap=True)
xy = XYPlane(Origin=cull_i_2)
align = AlignPlane(Plane=xy, Direction=cull_i)  # -> Plane, Angle
simplify = SimplifyTree(Tree=align.Plane, Front=False)
toolpath_planes = Plane(simplify)

# ----
max_diameter_factor_of_ramp_helix_2 = Panel(max_diameter_factor_of_ramp_helix)
all_toolpaths_are_single_curve_2 = Panel(all_toolpaths_are_single_curve)

# ---- group: Make toolpath arcs
arc_diameter_2 = Panel(arc_diameter)
use_climb_milling_4 = Panel(use_climb_milling_3)
arc_extension_type_2 = Panel(arc_extension_type)
stepover_distance_2 = Panel(stepover_distance)
pi = Pi(Factor=1)
pi_2 = Pi(Factor=1)
multiplication_4 = Multiplication(A=arc_diameter_2, B="0.5")
multiplication_5 = Multiplication(A=pi, B="0.5")
multiplication_6 = Multiplication(A=pi_2, B="-0.5")
xy_2 = XYPlane(Origin=Point(0, 0, 0))
dom = ConstructDomain(DomainStart=multiplication_6, DomainEnd=multiplication_5)
arc = Arc(Plane=xy_2, Radius=multiplication_4, Angle=dom)  # -> Arc, Length
ext = ExtendCurve(Curve=arc.Arc, Type=arc_extension_type_2, Start=stepover_distance_2, End=stepover_distance_2)
gate = StreamGate(Stream=ext, Gate=use_climb_milling_4)  # -> Target0, Target1
flip = FlipCurve(Curve=gate.Target0)  # -> Curve, Flag
filter_2 = StreamFilter(Gate=use_climb_milling_4, Stream0=flip.Curve, Stream1=gate.Target1)
orient = Orient(Geometry=filter_2, Source=xy_2, Target=toolpath_planes)  # -> Geometry, Transform
toolpath_arcs = Curve(orient.Geometry)

# ----
all_toolpaths_are_single_curve_3 = Panel(all_toolpaths_are_single_curve)

# ---- group: Make transition jog arcs for corner transitions
z_lift_distance_2 = Panel(z_lift_distance)
toolpath_arcs_2 = Curve(toolpath_arcs)
rev_2 = ReverseList(List=toolpath_arcs_2)
number_slider = Slider(0.5, range=0..1)
item_2 = ListItem(List=rev_2, Index=0, Wrap=True)
item_3 = ListItem(List=toolpath_arcs_2, Index=0, Wrap=True)
flatten = FlattenTree(Tree=item_3, Path="{0}")
pshift = ShiftPaths(Data=item_2, Offset=-1)
flatten_2 = FlattenTree(Tree=item_2, Path="{0}")
pshift_2 = ShiftPaths(Data=item_3, Offset=-1)
flatten_3 = FlattenTree(Tree=pshift, Path="{0}")
clean = CleanTree(RemoveNulls=True, RemoveInvalid=True, RemoveEmpty=False, Tree=flatten_3)
item_4 = ListItem(List=clean, Index=0, Wrap=True)
null = NullItem(Item=item_4)  # -> NullFlags, InvalidFlags, Description
filter_3 = StreamFilter(Gate=null.NullFlags, Stream0=pshift, Stream1=flatten_2)
filter_4 = StreamFilter(Gate=null.NullFlags, Stream0=pshift_2, Stream1=flatten)
shift = ShiftList(List=filter_4, Shift=1, Wrap=False)
shift_2 = ShiftList(List=filter_3, Shift=-1, Wrap=False)
blendc = BlendCurve(CurveA=shift_2, CurveB=shift, BulgeA=number_slider, BulgeB=number_slider, Continuity=1)
reb = RebuildCurve(Curve=blendc, Count="5", Tangents=False)
multiplication_7 = Multiplication(A="5", B="0.5")
cp = ControlPoints(Curve=reb)  # -> Points, Weights, Knots
int_2 = Integer(multiplication_7)
Z = UnitZ(Factor=z_lift_distance_2)
item_5 = ListItem(List=cp.Points, Index=int_2, Wrap=True)
move = Move(Geometry=item_5, Motion=Z)  # -> Geometry, Transform
replace = ReplaceItems(List=cp.Points, Item=move.Geometry, Indices=int_2, Wrap=False)
nurbs = NurbsCurve(Vertices=replace, Degree=3, Periodic=False)  # -> Curve, Length, Domain
all_toolpaths_are_single_curve_4 = Panel(all_toolpaths_are_single_curve_3)
simplify_2 = SimplifyTree(Tree=nurbs.Curve, Front=False)
gate_2 = StreamGate(Stream=simplify_2, Gate=all_toolpaths_are_single_curve_4)  # -> Target0, Target1

# ---- group: Make fancy jog to surface ending
all_toolpaths_are_single_curve_5 = Panel(all_toolpaths_are_single_curve)
last_arcs_in_list = Curve(filter_3)
graft = GraftTree(Tree=last_arcs_in_list, IncludeEmptyLists=True, IncludeNullItems=True)
filter_5 = StreamFilter(Gate=all_toolpaths_are_single_curve_5, Stream0=last_arcs_in_list, Stream1=graft)
rev_3 = ReverseList(List=filter_5)
item_6 = ListItem(List=rev_3, Index=0, Wrap=True)
end = EndPoints(Curve=item_6)  # -> Start, End
crv_cp = CurveClosestPoint(Point=end.End, Curve=item_6)  # -> Point, Parameter, Distance
ln = Line(StartPoint=end.Start, EndPoint=end.End)
dist = Distance(PointA=end.Start, PointB=end.End)
eval = EvaluateLength(Curve=ln, Length="0.3", Normalized=True)  # -> Point, Tangent, Parameter
eval_2 = EvaluateCurve(Curve=item_6, Parameter=crv_cp.Parameter)  # -> Point, Tangent, Angle
multiplication_8 = Multiplication(A=dist, B="0.5")
end_point_tangent = Vector(eval_2.Tangent)
arc_center_point = Point(eval.Point)
arc_end_point = Point(end.End)
arc_radius = Panel(multiplication_8)
arc_2 = ArcSED(Start=arc_end_point, End=arc_center_point, Direction=end_point_tangent)  # -> Arc, Plane, Radius
reb_2 = RebuildCurve(Curve=arc_2.Arc, Count="5", Tangents=False)
multiplication_9 = Multiplication(A="5", B="0.5")
cp_2 = ControlPoints(Curve=reb_2)  # -> Points, Weights, Knots
multiplication_10 = Multiplication(A=arc_radius, B="0.1")
multiplication_11 = Multiplication(A=arc_radius, B="0.7")
multiplication_12 = Multiplication(A=arc_radius, B="0.3")
int_3 = Integer(multiplication_9)
addition = Addition(A=int_3, B="1")
Z_2 = UnitZ(Factor=multiplication_12)
Z_3 = UnitZ(Factor=multiplication_10)
item_7 = ListItem(List=cp_2.Points, Index=int_3, Wrap=True)
Z_4 = UnitZ(Factor=arc_radius)
Z_5 = UnitZ(Factor=multiplication_11)
move_2 = Move(Geometry=item_7, Motion=Z_3)  # -> Geometry, Transform
replace_2 = ReplaceItems(List=cp_2.Points, Item=move_2.Geometry, Indices=int_3, Wrap=False)
item_8 = ListItem(List=replace_2, Index=addition, Wrap=True)
move_3 = Move(Geometry=item_8, Motion=Z_2)  # -> Geometry, Transform
subtraction_2 = Subtraction(A="5", B="1")
replace_3 = ReplaceItems(List=replace_2, Item=move_3.Geometry, Indices=addition, Wrap=False)
item_9 = ListItem(List=replace_3, Index=subtraction_2, Wrap=True)
move_4 = Move(Geometry=item_9, Motion=Z_5)  # -> Geometry, Transform
move_5 = Move(Geometry=item_9, Motion=Z_4)  # -> Geometry, Transform
replace_4 = ReplaceItems(List=replace_3, Item=move_4.Geometry, Indices=subtraction_2, Wrap=False)
ins = InsertItems(List=replace_4, Item=move_5.Geometry, Indices="5", Wrap=True)
nurbs_2 = NurbsCurve(Vertices=ins, Degree=3, Periodic=False)  # -> Curve, Length, Domain
simplify_3 = SimplifyTree(Tree=nurbs_2.Curve, Front=False)
end_jog_arcs = Curve(simplify_3)

# ---- group: Make jog arcs, transtion between each semicircular cut
z_lift_distance_3 = Panel(z_lift_distance)
toolpath_arcs_3 = Curve(toolpath_arcs)
number_slider_2 = Slider(0.5, range=0..1)
shift_3 = ShiftList(List=toolpath_arcs_3, Shift=1, Wrap=False)
shift_4 = ShiftList(List=toolpath_arcs_3, Shift=-1, Wrap=False)
blendc_2 = BlendCurve(CurveA=shift_4, CurveB=shift_3, BulgeA=number_slider_2, BulgeB=number_slider_2, Continuity=1)
blended_transitions = Curve(blendc_2)
reb_3 = RebuildCurve(Curve=blended_transitions, Count="5", Tangents=False)
multiplication_13 = Multiplication(A="5", B="0.5")
cp_3 = ControlPoints(Curve=reb_3)  # -> Points, Weights, Knots
int_4 = Integer(multiplication_13)
Z_6 = UnitZ(Factor=z_lift_distance_3)
item_10 = ListItem(List=cp_3.Points, Index=int_4, Wrap=True)
move_6 = Move(Geometry=item_10, Motion=Z_6)  # -> Geometry, Transform
replace_5 = ReplaceItems(List=cp_3.Points, Item=move_6.Geometry, Indices=int_4, Wrap=False)
nurbs_3 = NurbsCurve(Vertices=replace_5, Degree=3, Periodic=False)  # -> Curve, Length, Domain
jog_arcs = Curve(nurbs_3.Curve)

# ----
neg = Negative(Value="1")
Z_7 = UnitZ(Factor=neg)
multiplication_14 = Multiplication(A="1", B="2")

# ---- group: Inser fancy end jog to surface
corner_jog_arcs = Curve(gate_2.Target0)
end_jog_arcs_2 = Curve(end_jog_arcs)
pshift_3 = ShiftPaths(Data=corner_jog_arcs, Offset=-1)
flatten_4 = FlattenTree(Tree=corner_jog_arcs, Path="{0}")
flatten_5 = FlattenTree(Tree=pshift_3, Path="{0}")
flatten_6 = FlattenTree(Tree=end_jog_arcs_2, Path="{0}")
clean_2 = CleanTree(RemoveNulls=True, RemoveInvalid=True, RemoveEmpty=False, Tree=flatten_5)
item_11 = ListItem(List=clean_2, Index=0, Wrap=True)
null_2 = NullItem(Item=item_11)  # -> NullFlags, InvalidFlags, Description
filter_6 = StreamFilter(Gate=null_2.NullFlags, Stream0=pshift_3, Stream1=flatten_4)
filter_7 = StreamFilter(Gate=null_2.NullFlags, Stream0=end_jog_arcs_2, Stream1=flatten_6)
merge = Merge(Data1=filter_6, Data2=filter_7)
graft_2 = GraftTree(Tree=merge, IncludeEmptyLists=True, IncludeNullItems=True)
clean_3 = CleanTree(RemoveNulls=True, RemoveInvalid=True, RemoveEmpty=True, Tree=graft_2)
transition_jog_arcs = Curve(clean_3)

# ---- group: Insert jog corner transitions
corner_jog_arcs_2 = Curve(transition_jog_arcs)
jog_arcs_2 = Curve(jog_arcs)
simplify_4 = SimplifyTree(Tree=jog_arcs_2, Front=False)
pshift_4 = ShiftPaths(Data=simplify_4, Offset=-1)
flatten_7 = FlattenTree(Tree=simplify_4, Path="{0}")
flatten_8 = FlattenTree(Tree=pshift_4, Path="{0}")
clean_4 = CleanTree(RemoveNulls=True, RemoveInvalid=True, RemoveEmpty=False, Tree=flatten_8)
item_12 = ListItem(List=clean_4, Index=0, Wrap=True)
null_3 = NullItem(Item=item_12)  # -> NullFlags, InvalidFlags, Description
filter_8 = StreamFilter(Gate=null_3.NullFlags, Stream0=pshift_4, Stream1=flatten_7)
lng_3 = ListLength(List=filter_8)
ins_2 = InsertItems(List=filter_8, Item=corner_jog_arcs_2, Indices=lng_3, Wrap=False)
jog_arcs_3 = Curve(ins_2)

# ---- group: Weave cuts and jogs
toolpath_arcs_4 = Curve(toolpath_arcs)
jog_arcs_4 = Curve(jog_arcs_3)
jograte_3 = Panel(jograte_2)
feedrate_3 = Panel(feedrate_2)
lng_4 = ListLength(List=toolpath_arcs_4)
lng_5 = ListLength(List=jog_arcs_4)
dup = DuplicateData(Data=feedrate_3, Number=lng_4, Order=True)
dup_2 = DuplicateData(Data=jograte_3, Number=lng_5, Order=True)
simplify_5 = SimplifyTree(Tree=dup_2, Front=False)
simplify_6 = SimplifyTree(Tree=dup, Front=False)
simplify_7 = SimplifyTree(Tree=jog_arcs_4, Front=False)
simplify_8 = SimplifyTree(Tree=toolpath_arcs_4, Front=False)
match = MatchTree(Tree=simplify_5, Guide=simplify_6)
match_2 = MatchTree(Tree=simplify_7, Guide=simplify_8)
weave_2 = Weave(Pattern=[0, 1], Stream0=simplify_6, Stream1=match, NullGaps=False)
weave_3 = Weave(Pattern=[0, 1], Stream0=simplify_8, Stream1=match_2, NullGaps=False)
shift_paths_if_possible = ShiftPathsIfPossible(data_paths_to_shifts=weave_2)
shift_paths_if_possible_2 = ShiftPathsIfPossible(data_paths_to_shifts=weave_3)

# ----
feedback = Panel("All good")

# ---- group: Feedback is not yet implemented
feedback_2 = Text(feedback)

# ---- group: Make helical entry plunge
stepover_distance_3 = Panel(stepover_distance)
make_helical_entry_ramp_2 = Panel(make_helical_entry_ramp)
inner_diameter_overlap = Panel("0.05")
milling_bit_diameter_4 = Panel(milling_bit_diameter_3)
ramp_angle_4 = Panel(ramp_angle_3)
ramp_extra_start_height = Panel("1")
start_arcs = Curve(filter_4)
filter_9 = StreamFilter(Gate=make_helical_entry_ramp_2, Stream1=start_arcs)
rad = Radians(Degrees=ramp_angle_4)
subtraction_3 = Subtraction(A="1", B=inner_diameter_overlap)
rtrig = RightTrigonometry(Beta=rad, PLength=stepover_distance_3)  # -> Alpha, Beta, PLength, QLength, RLength
multiplication_15 = Multiplication(A=milling_bit_diameter_4, B=subtraction_3)
multiplication_16 = Multiplication(A=multiplication_15, B="0.5")
eleveation_per_stepover_distance = Panel(rtrig.QLength)
inner_circle_radius = Panel(multiplication_16)
stepover_distance_4 = Panel(stepover_distance_3)
division_2 = Division(A="1", B="12")
Z_8 = UnitZ(Factor=1)
eleveation_per_stepover_distance_2 = Panel(eleveation_per_stepover_distance)
stepover_distance_5 = Panel(stepover_distance_3)
Z_9 = UnitZ(Factor=1)
xy_3 = XYPlane(Origin=Point(0, 0, 0))
rad_2 = Radians(Degrees="5")
rad_3 = Radians(Degrees="360")
dom_2 = ConstructDomain(DomainStart=rad_2, DomainEnd=rad_3)

# ----
multiplication_17 = Multiplication(A=milling_bit_diameter_4, B=max_diameter_factor_of_ramp_helix_2)
graft_3 = GraftTree(Tree=filter_9, IncludeEmptyLists=True, IncludeNullItems=True)
item_13 = ListItem(List=flatten(start_arcs), Index=0, Wrap=True)
subtraction_4 = Subtraction(A=multiplication_17, B=milling_bit_diameter_4)
filter_10 = StreamFilter(Gate=all_toolpaths_are_single_curve_2, Stream0=filter_9, Stream1=graft_3)
end_2 = EndPoints(Curve=item_13)  # -> Start, End
max_helix_diameter = Panel(subtraction_4)
dist_2 = Distance(PointA=end_2.Start, PointB=end_2.End)
larger = LargerThan(FirstNumber=dist_2, SecondNumber=0)  # -> LargerThan, OrEqualTo
make_narrow_entry_helix = Panel(larger.LargerThan)
max_helix_diameter_2 = Panel(max_helix_diameter)
make_narrow_entry_helix_2 = Panel(make_narrow_entry_helix)
multiplication_18 = Multiplication(A=max_helix_diameter_2, B="0.5")
make_narrow_entry_helix_3 = Panel(make_narrow_entry_helix)

# ---- group: Make helical entry plunge (continued)
item_14 = ListItem(List=filter_10, Index=0, Wrap=True)
end_3 = EndPoints(Curve=item_14)  # -> Start, End
dist_3 = Distance(PointA=end_3.Start, PointB=end_3.End)
ln_2 = Line(StartPoint=end_3.Start, EndPoint=end_3.End)
pdecon = Deconstruct(Point=end_3.Start)  # -> XComponent, YComponent, ZComponent
vec2pt = Vector2Pt(PointA=end_3.Start, PointB=end_3.End, Unitize=False)  # -> Vector, Length
multiplication_19 = Multiplication(A=dist_3, B="0.5")
eval_3 = EvaluateLength(Curve=ln_2, Length="0.5", Normalized=True)  # -> Point, Tangent, Parameter
abs = Absolute(Value=pdecon.ZComponent)
start_point = Point(eval_3.Point)
addition_2 = Addition(A=abs, B=ramp_extra_start_height)
rev_4 = Reverse(Vector=vec2pt.Vector)
xy_4 = XYPlane(Origin=start_point)
arc_radius_2 = Panel(multiplication_19)
cut_depths = Panel(addition_2)
align_2 = AlignPlane(Plane=xy_4, Direction=rev_4)  # -> Plane, Angle
cir = Circle(Plane=align_2.Plane, Radius=multiplication_19)
arc_radius_3 = Panel(arc_radius_2)
flip_2 = FlipCurve(Curve=cir)  # -> Curve, Flag
subtraction_5 = Subtraction(A=arc_radius_3, B=inner_circle_radius)
horizontal_spiral_distance = Panel(subtraction_5)
divide_2 = DivideCurve(Curve=flip_2.Curve, Count="12", Kinks=False)  # -> Points, Tangents, Parameters
division_3 = Division(A=horizontal_spiral_distance, B=stepover_distance_4)
multiplication_20 = Multiplication(A="12", B=division_3)
number_of_spiral_points = Panel(multiplication_20)
series = Series(Start=0, Step=1, Count=number_of_spiral_points)
series_2 = Series(Start=0, Step=division_2, Count=number_of_spiral_points)
item_15 = ListItem(List=divide_2.Points, Index=series, Wrap=True)
multiplication_21 = Multiplication(A=series_2, B=stepover_distance_4)
vec2pt_2 = Vector2Pt(PointA=item_15, PointB=start_point, Unitize=False)  # -> Vector, Length
amp = Amplitude(Vector=vec2pt_2.Vector, Amplitude=multiplication_21)
move_7 = Move(Geometry=item_15, Motion=amp)  # -> Geometry, Transform
intcrv = Interpolate(Vertices=move_7.Geometry, Degree=3, Periodic=False, KnotStyle=1)  # -> Curve, Length, Domain
flip_3 = FlipCurve(Curve=intcrv.Curve)  # -> Curve, Flag
start_point_2 = Point(start_point)
start_point_3 = Point(start_point)
cut_depths_2 = Panel(cut_depths)
start_point_4 = Point(start_point)
project = Project(Geometry=start_point_4, Plane=xy_3)  # -> Geometry, Transform
xy_5 = XYPlane(Origin=start_point_4)
cut_depths_3 = Panel(cut_depths)
Z_10 = UnitZ(Factor=cut_depths_3)
move_8 = Move(Geometry=xy_5, Motion=Z_10)  # -> Geometry, Transform
arc_radius_4 = Panel(arc_radius_2)
start_point_plane = Plane(align_2.Plane)
arc_3 = Arc(Plane=start_point_plane, Radius=arc_radius_4, Angle=dom_2)  # -> Arc, Length
simplify_9 = SimplifyTree(Tree=arc_3.Arc, Front=False)

# ----
pln = Plane(align_2.Plane)
gate_3 = StreamGate(Stream=pln, Gate=make_narrow_entry_helix_2)  # -> Target0, Target1
move_9 = Move(Geometry=gate_3.Target1, Motion=Z_7)  # -> Geometry, Transform
cyl = Cylinder(Base=move_9.Geometry, Radius=multiplication_18, Length=multiplication_14)
cap = CapHoles(Brep=cyl)
trim = TrimWithBrep(Curve=flip_3.Curve, Brep=cap)  # -> Inside, Outside
narrow_bottom_flat_spiral = Curve(trim.Inside)
bottom_flat_spiral = Curve(flip_3.Curve)
filter_11 = StreamFilter(Gate=make_narrow_entry_helix_3, Stream0=bottom_flat_spiral, Stream1=narrow_bottom_flat_spiral)

# ---- group: Make helical entry plunge (continued)
bottom_flat_spiral_for_buidling_helix = Curve(filter_11)
end_4 = EndPoints(Curve=bottom_flat_spiral_for_buidling_helix)  # -> Start, End
vec2pt_3 = Vector2Pt(PointA=start_point_2, PointB=end_4.Start, Unitize=False)  # -> Vector, Length
pl = ConstructPlane(Origin=start_point_2, XAxis=vec2pt_3.Vector, YAxis=Z_8)
mirror = Mirror(Geometry=bottom_flat_spiral_for_buidling_helix, Plane=pl)  # -> Geometry, Transform
divide_curve_even_lenght = DivideCurveEvenLenght(crv=mirror.Geometry, B=stepover_distance_5)
lng_6 = ListLength(List=divide_curve_even_lenght)
series_3 = Series(Start=0, Step=eleveation_per_stepover_distance_2, Count=lng_6)
Z_11 = UnitZ(Factor=series_3)
move_10 = Move(Geometry=divide_curve_even_lenght, Motion=Z_11)  # -> Geometry, Transform
intcrv_2 = Interpolate(Vertices=move_10.Geometry, Degree=3, Periodic=False, KnotStyle=1)  # -> Curve, Length, Domain
flip_4 = FlipCurve(Curve=intcrv_2.Curve)  # -> Curve, Flag
lower_plunge_helix = Curve(flip_4.Curve)
end_5 = EndPoints(Curve=lower_plunge_helix)  # -> Start, End
vec2pt_4 = Vector2Pt(PointA=start_point_3, PointB=end_5.Start, Unitize=False)  # -> Vector, Length
pl_2 = ConstructPlane(Origin=end_5.Start, XAxis=vec2pt_4.Vector, YAxis=Z_9)
mirror_2 = Mirror(Geometry=lower_plunge_helix, Plane=pl_2)  # -> Geometry, Transform
flip_5 = FlipCurve(Curve=mirror_2.Geometry)  # -> Curve, Flag
xy_6 = XYPlane(Origin=end_5.Start)
mirror_3 = Mirror(Geometry=flip_5.Curve, Plane=xy_6)  # -> Geometry, Transform
upper_plunge_helix = Curve(mirror_3.Geometry)
lower_plunge_helix_2 = Curve(lower_plunge_helix)
merge_2 = Merge(Data1=upper_plunge_helix, Data2=lower_plunge_helix_2)
join = JoinCurves(Curves=merge_2, Preserve=False)
simplify_10 = SimplifyTree(Tree=join, Front=False)
plunge_helix = Curve(simplify_10)
end_6 = EndPoints(Curve=plunge_helix)  # -> Start, End
pdecon_2 = Deconstruct(Point=end_6.Start)  # -> XComponent, YComponent, ZComponent
pdecon_3 = Deconstruct(Point=end_6.End)  # -> XComponent, YComponent, ZComponent
pt = ConstructPoint(XCoordinate=0, YCoordinate=0, ZCoordinate=pdecon_2.ZComponent)
pt_2 = ConstructPoint(XCoordinate=0, YCoordinate=0, ZCoordinate=pdecon_3.ZComponent)
dist_4 = Distance(PointA=pt, PointB=pt_2)
plunge_helix_height = Panel(dist_4)
division_4 = Division(A=cut_depths_2, B=plunge_helix_height)
round = Round(Number=division_4)  # -> Nearest, Floor, Ceiling
addition_3 = Addition(A=division_4, B="0.5")
end_7 = EndPoints(Curve=plunge_helix)  # -> Start, End
project_2 = Project(Geometry=end_7.Start, Plane=xy_3)  # -> Geometry, Transform
project_3 = Project(Geometry=end_7.End, Plane=xy_3)  # -> Geometry, Transform
vec2pt_5 = Vector2Pt(PointA=project.Geometry, PointB=project_3.Geometry, Unitize=False)  # -> Vector, Length
vec2pt_6 = Vector2Pt(PointA=project.Geometry, PointB=project_2.Geometry, Unitize=False)  # -> Vector, Length
angle = Angle(VectorA=vec2pt_6.Vector, VectorB=vec2pt_5.Vector, Plane=xy_3)  # -> Angle, Reflex
series_4 = Series(Start=0, Step=plunge_helix_height, Count=round.Ceiling)
series_5 = Series(Start=0, Step=angle.Reflex, Count=round.Ceiling)
Z_12 = UnitZ(Factor=series_4)
move_11 = Move(Geometry=plunge_helix, Motion=Z_12)  # -> Geometry, Transform
rotate = Rotate(Geometry=move_11.Geometry, Angle=series_5, Plane=xy_5)  # -> Geometry, Transform
join_2 = JoinCurves(Curves=rotate.Geometry, Preserve=False)
bottom_flat_spiral_2 = Curve(bottom_flat_spiral)
simplify_11 = SimplifyTree(Tree=join_2, Front=False)
plunge_helix_tower = Curve(simplify_11)
flatten_9 = FlattenTree(Tree=bottom_flat_spiral_2, Path="{0}")
lng_7 = ListLength(List=flatten_9)
pcx = CurvePlane(Curve=plunge_helix_tower, Plane=move_8.Geometry)  # -> Points, ParamsC, ParamsP
smaller_3 = SmallerThan(FirstNumber=lng_7, SecondNumber="2")  # -> SmallerThan, OrEqualTo
shatter_2 = Shatter(Curve=plunge_helix_tower, Parameters=pcx.ParamsC)
rev_5 = ReverseList(List=shatter_2)
filter_12 = StreamFilter(Gate=smaller_3.SmallerThan, Stream0=bottom_flat_spiral_2, Stream1=flatten_9)
item_16 = ListItem(List=rev_5, Index=0, Wrap=True)
rotate_2 = Rotate(Geometry=filter_12, Angle=rad_2, Plane=start_point_plane)  # -> Geometry, Transform
rev_6 = ReverseList(List=item_16)
simplify_12 = SimplifyTree(Tree=rotate_2.Geometry, Front=False)
rotate_3 = Rotate(Geometry=rev_6, Angle=rad_2, Plane=start_point_plane)  # -> Geometry, Transform
join_3 = JoinCurves(Curves=[simplify_12, simplify_9], Preserve=False)
simplify_13 = SimplifyTree(Tree=rotate_3.Geometry, Front=False)
simplify_14 = SimplifyTree(Tree=join_3, Front=False)
flatten_10 = FlattenTree(Tree=simplify_14, Path="{0}")
flatten_11 = FlattenTree(Tree=simplify_13, Path="{0}")
filter_13 = StreamFilter(Gate=smaller_3.SmallerThan, Stream0=simplify_14, Stream1=flatten_10)
filter_14 = StreamFilter(Gate=smaller_3.SmallerThan, Stream0=simplify_13, Stream1=flatten_11)
join_4 = JoinCurves(Curves=[filter_14, filter_13], Preserve=False)
cut_entry_plunges = Curve(join_4)

# ---- group: Make peck helix entry
max_peck_depth_factor_4 = Panel(max_peck_depth_factor_3)
milling_bit_diameter_5 = Panel(milling_bit_diameter_3)
use_peck_entry_4 = Panel(use_peck_entry_3)
cut_entry_plunges_2 = Curve(cut_entry_plunges)
multiplication_22 = Multiplication(A=max_peck_depth_factor_4, B=milling_bit_diameter_5)
gate_4 = StreamGate(Stream=cut_entry_plunges_2, Gate=use_peck_entry_4)  # -> Target0, Target1
bbox = BoundingBox(Content=gate_4.Target1, Plane=PlaneXY(0, 0, 0))  # -> Box, Box_2
debrep = DeconstructBrep(Brep=bbox.Box)  # -> Faces, Edges, Vertices
item_17 = ListItem(List=debrep.Edges, Index="8", Wrap=True)
item_18 = ListItem(List=debrep.Faces, Index="5", Wrap=True)
len_2 = Length(Curve=item_17)
edges = BrepEdges(Brep=item_18)  # -> Naked, Interior, NonManifold
max_peck_depth = Panel(multiplication_22)
helix_depths = Panel(len_2)
join_5 = JoinCurves(Curves=edges.Naked, Preserve=False)
offset = Offset(Curve=join_5, Distance="0.1", Plane=PlaneXY(0, 0, 0), Corners=1)
division_5 = Division(A=helix_depths, B=max_peck_depth)
round_2 = Round(Number=division_5)  # -> Nearest, Floor, Ceiling
series_6 = Series(Start=max_peck_depth, Step=max_peck_depth, Count=round_2.Floor)
neg_2 = Negative(Value=series_6)
Z_13 = UnitZ(Factor=neg_2)
extr = Extrude(Base=offset, Direction=Z_13)
cut_entry_plunges_3 = Curve(gate_4.Target1)
cap_2 = CapHoles(Brep=extr)
simplify_15 = SimplifyTree(Tree=cap_2, Front=False)
simplify_16 = SimplifyTree(Tree=cut_entry_plunges_3, Front=False)
lng_8 = ListLength(List=simplify_15)
dup_3 = DuplicateData(Data=simplify_16, Number=lng_8, Order=True)
simplify_17 = SimplifyTree(Tree=dup_3, Front=False)
trim_2 = TrimWithBreps(Curve=graft(simplify_17), Brep=graft(simplify_15))  # -> Inside, Outside
pshift_5 = ShiftPaths(Data=trim_2.Inside, Offset=-1)
pshift_6 = ShiftPaths(Data=pshift_5, Offset=-1)
end_8 = EndPoints(Curve=pshift_6)  # -> Start, End
item_19 = ListItem(List=end_8.Start, Index=0, Wrap=True)
max_peck_depth_2 = Panel(max_peck_depth)
vec2pt_7 = Vector2Pt(PointA=end_8.End, PointB=item_19, Unitize=False)  # -> Vector, Length
amp_2 = Amplitude(Vector=vec2pt_7.Vector, Amplitude=max_peck_depth_2)
multiplication_23 = Multiplication(A=max_peck_depth_2, B="0.9")
amp_3 = Amplitude(Vector=vec2pt_7.Vector, Amplitude=multiplication_23)
move_12 = Move(Geometry=end_8.End, Motion=amp_2)  # -> Geometry, Transform
move_13 = Move(Geometry=end_8.End, Motion=amp_3)  # -> Geometry, Transform
ln_3 = Line(StartPoint=move_13.Geometry, EndPoint=move_12.Geometry)
flip_6 = FlipCurve(Curve=pshift_6)  # -> Curve, Flag
eval_4 = EvaluateLength(Curve=flip_6.Curve, Length=multiplication_23, Normalized=False)  # -> Point, Tangent, Parameter
shatter_3 = Shatter(Curve=graft(flip_6.Curve), Parameters=graft(eval_4.Parameter))
item_20 = ListItem(List=shatter_3, Index="1", Wrap=False)
flip_7 = FlipCurve(Curve=item_20)  # -> Curve, Flag
number_slider_3 = Slider(0.5, range=0..1)
pshift_7 = ShiftPaths(Data=flip_7.Curve, Offset=-1)
pshift_8 = ShiftPaths(Data=pshift_7, Offset=-1)
blendc_3 = BlendCurve(CurveA=pshift_8, CurveB=ln_3, BulgeA=number_slider_3, BulgeB=number_slider_3, Continuity=2)
merge_3 = Merge(Data1=graft(pshift_8), Data2=graft(blendc_3))
join_6 = JoinCurves(Curves=merge_3, Preserve=False)
pshift_9 = ShiftPaths(Data=join_6, Offset=-1)
cut_entry_plunges_4 = Curve(gate_4.Target1)
pshift_10 = ShiftPaths(Data=pshift_9, Offset=-1)
distance_to_extend_top_of_helix_curve_fo = Panel("0.1")  # "Distance to extend top of helix curve (for joining)"
simplify_18 = SimplifyTree(Tree=pshift_10, Front=False)
simplify_19 = SimplifyTree(Tree=cut_entry_plunges_4, Front=False)
lng_9 = ListLength(List=flatten(simplify_19))
merge_4 = Merge(Data1=flatten(simplify_18), Data2=flatten(simplify_19))
merge_5 = Merge(Data1=simplify_18, Data2=simplify_19)
addition_4 = Addition(A=round_2.Floor, B="1")
smaller_4 = SmallerThan(FirstNumber=lng_9, SecondNumber="2")  # -> SmallerThan, OrEqualTo
series_7 = Series(Start=0, Step=distance_to_extend_top_of_helix_curve_fo, Count=simplify(addition_4))
filter_15 = StreamFilter(Gate=smaller_4.SmallerThan, Stream0=merge_5, Stream1=flatten(merge_4))
ext_2 = ExtendCurve(Curve=filter_15, Type=2, Start=series_7, End="0")
end_9 = EndPoints(Curve=ext_2)  # -> Start, End
shift_5 = ShiftList(List=end_9.End, Shift="-1", Wrap=False)
shift_6 = ShiftList(List=end_9.Start, Shift="1", Wrap=False)
ln_4 = Line(StartPoint=shift_5, EndPoint=shift_6)
simplify_20 = SimplifyTree(Tree=ext_2, Front=False)
simplify_21 = SimplifyTree(Tree=ln_4, Front=False)
merge_6 = Merge(Data1=simplify_20, Data2=simplify_21)
merge_7 = Merge(Data1=graft(simplify_20), Data2=graft(simplify_21))
filter_16 = StreamFilter(Gate=smaller_4.SmallerThan, Stream0=merge_6, Stream1=flatten(merge_7))
join_7 = JoinCurves(Curves=filter_16, Preserve=False)
pshift_11 = ShiftPaths(Data=join_7, Offset=-1)
simplify_22 = SimplifyTree(Tree=pshift_11, Front=False)
match_3 = MatchTree(Tree=simplify_22, Guide=cut_entry_plunges_2)
peck_helix = Curve(match_3)

# ---- group: Prepare ramp for insert
cut_entry_plunges_with_peck_helix = Curve(peck_helix)
ramp_feedrate_2 = Panel(ramp_feedrate)
use_peck_entry_5 = Panel(use_peck_entry_3)
make_helical_entry_ramp_3 = Panel(make_helical_entry_ramp)
all_toolpaths_are_single_curve_6 = Panel(all_toolpaths_are_single_curve)
cut_entry_plunges_5 = Curve(cut_entry_plunges)

# ----
filter_17 = StreamFilter(Gate=use_peck_entry_5, Stream0=cut_entry_plunges_5, Stream1=cut_entry_plunges_with_peck_helix)

# ---- group: Prepare ramp for insert (continued)
cut_entry_plunges_6 = Curve(filter_17)
lng_10 = ListLength(List=cut_entry_plunges_6)
dup_4 = DuplicateData(Data=ramp_feedrate_2, Number=lng_10, Order=True)
simplify_23 = SimplifyTree(Tree=cut_entry_plunges_6, Front=False)
simplify_24 = SimplifyTree(Tree=dup_4, Front=False)
flatten_12 = FlattenTree(Tree=simplify_24, Path="{0}")
flatten_13 = FlattenTree(Tree=simplify_23, Path="{0}")
filter_18 = StreamFilter(Gate=all_toolpaths_are_single_curve_6, Stream0=simplify_24, Stream1=flatten_12)
filter_19 = StreamFilter(Gate=all_toolpaths_are_single_curve_6, Stream0=simplify_23, Stream1=flatten_13)

# ---- group: Insert ramp feedrates
ins_3 = InsertItems(List=shift_paths_if_possible, Item=filter_18, Indices="0", Wrap=True)
simplify_25 = SimplifyTree(Tree=ins_3, Front=False)
filter_20 = StreamFilter(Gate=make_helical_entry_ramp_3, Stream0=shift_paths_if_possible, Stream1=simplify_25)

# ---- group: Insert ramp geometry
ins_4 = InsertItems(List=shift_paths_if_possible_2, Item=filter_19, Indices="0", Wrap=True)
simplify_26 = SimplifyTree(Tree=ins_4, Front=False)
filter_21 = StreamFilter(Gate=make_helical_entry_ramp_3, Stream0=shift_paths_if_possible_2, Stream1=simplify_26)

# ----
toolpaths = Curve(filter_21)
feedrates = Panel(filter_20)

# ---- group: Preview toolpaths
preview_toolpath = Slider(0, range=0..1)
shift_paths_if_possible_3 = ShiftPathsIfPossible(data_paths_to_shifts=toolpaths)  # disabled
join_8 = JoinCurves(Curves=shift_paths_if_possible_3, Preserve=False)
milling_bit_diameter_6 = Panel(milling_bit_diameter_3)
eval_5 = EvaluateLength(Curve=graft(join_8), Length=preview_toolpath, Normalized=True)  # -> Point, Tangent, Parameter
shatter_4 = Shatter(Curve=graft(join_8), Parameters=eval_5.Parameter)
multiplication_24 = Multiplication(A=milling_bit_diameter_6, B="0.5")
pt_3 = Point(eval_5.Point)
xy_7 = XYPlane(Origin=eval_5.Point)
xy_8 = XYPlane(Origin=Point(0, 0, 0))
item_21 = ListItem(List=shatter_4, Index=0, Wrap=True)
cyl_2 = Cylinder(Base=xy_8, Radius=multiplication_24, Length=Slider(40, range=0..100))
orient_2 = Orient(Geometry=cyl_2, Source=xy_8, Target=xy_7)  # -> Geometry, Transform
preview = CustomPreview(Geometry=orient_2.Geometry, Shader=ColourSwatch(SwatchColor=RGB(79, 79, 79)))

# ---- group: Separate feedrate and jog rates is not yet impleneted, it is rarely needed
feedrates_2 = Number(feedrates)

# ----
toolpaths_2 = Curve(toolpaths)
trochoidal_toolpaths = ClusterOutput(toolpaths_2)  # Input into post processor

# ==== cluster PlungeRoughing
milling_bit_diameter = ClusterInput()
toolpath_curves = ClusterInput()
stepover = ClusterInput()
milling_bit_diameter_2 = Number(milling_bit_diameter)
toolpath_curves_2 = Curve(toolpath_curves)
stepover_2 = Number(stepover)
milling_bit_diameter_3 = Panel(milling_bit_diameter_2)
safe_z = Panel("1")
stepover_3 = Panel(stepover_2)

# ---- group: Shetter curves at corners and shatter closed curves
disc = Discontinuity(Curve=toolpath_curves_2, Level=1)  # -> Points, Parameters
lng = ListLength(List=disc.Parameters)
smaller = SmallerThan(FirstNumber=lng, SecondNumber="1")  # -> SmallerThan, OrEqualTo
weave = Weave(Pattern=smaller.SmallerThan, Stream0=disc.Parameters, Stream1="0", NullGaps=False)
shatter = Shatter(Curve=graft(toolpath_curves_2), Parameters=weave)

# ----
multiplication = Multiplication(A=milling_bit_diameter_3, B=stepover_3)
stepover_distance = Panel(multiplication)
shattered_toolpath_curves = Curve(shatter)
len = Length(Curve=shattered_toolpath_curves)
division = Division(A=len, B=stepover_distance)
int = Integer(division)
divide = DivideCurve(Curve=shattered_toolpath_curves, Count=int, Kinks=False)  # -> Points, Tangents, Parameters

# ---- group: Create drill lines
pdecon = Deconstruct(Point=divide.Points)  # -> XComponent, YComponent, ZComponent; disabled
pt = ConstructPoint(XCoordinate=pdecon.XComponent, YCoordinate=pdecon.YComponent, ZCoordinate=0)
Z = UnitZ(Factor=pdecon.ZComponent)
move = Move(Geometry=pt, Motion=Z)  # -> Geometry, Transform
ln = Line(StartPoint=pt, EndPoint=move.Geometry)

# ---- group: Create plunges with custom safe Z
safe_z_2 = Panel(safe_z)
pdecon_2 = Deconstruct(Point=divide.Points)  # -> XComponent, YComponent, ZComponent
pt_2 = Point(divide.Points)
pt_3 = ConstructPoint(XCoordinate=pdecon_2.XComponent, YCoordinate=pdecon_2.YComponent, ZCoordinate=safe_z_2)
simplify = SimplifyTree(Tree=pt_2, Front=False)
simplify_2 = SimplifyTree(Tree=pt_3, Front=False)
weave_2 = Weave(Pattern=[0, 1, 2], Stream0=simplify_2, Stream1=simplify, Stream2=simplify_2, NullGaps=False)
pline = PolyLine(Vertices=weave_2, Closed=False)

# ----
plunge_rough_lines = Curve(flatten(pline))
plunge_rough_lines_2 = ClusterOutput(plunge_rough_lines)

# ==== cluster ShiftPathsIfPossible
data_paths_to_shifts = ClusterInput()
pshift = ShiftPaths(Data=data_paths_to_shifts, Offset=-1)
flatten = FlattenTree(Tree=data_paths_to_shifts, Path="{0}")
flatten_2 = FlattenTree(Tree=pshift, Path="{0}")
clean = CleanTree(RemoveNulls=True, RemoveInvalid=True, RemoveEmpty=False, Tree=flatten_2)
item = ListItem(List=clean, Index=0, Wrap=True)
null = NullItem(Item=item)  # -> NullFlags, InvalidFlags, Description
filter = StreamFilter(Gate=null.NullFlags, Stream0=pshift, Stream1=flatten)
safely_shifted_paths = ClusterOutput(filter)  # Safely shifted paths

# ==== cluster DivideCurveEvenLenght: Calculates approximate curve length for even division
crv = ClusterInput()
crv_2 = Curve(crv)
B = ClusterInput()
len = Length(Curve=crv_2)
division = Division(A=len, B=B)
int = Integer(division)
divide = DivideCurve(Curve=crv_2, Count=int, Kinks=False)  # -> Points, Tangents, Parameters
P = ClusterOutput(divide.Points)
