# Grasshopper definition FFF-slicing.gh (Grasshopper 0.9.76)
# plug-ins: ClipperComponents, LunchBox

preview_slider = Slider(1, range=0..1)
brep = Brep([<brep referenced from the Rhino model> x4])
mesh = Mesh(<mesh referenced from the Rhino model>)
mesh_2 = MeshBrep(
    Brep=brep,
    Settings={GridMaxCount=0, GridMinCount=16, JaggedSeams=False, MaxEdgeLength=0, MinEdgeLength=0.0001, MinTolerance=0, Refine=True, RefineAngle=0, RelativeTolerance=0.65, SimplePlanes=True, Tolerance=0})
number_off_shell_layers = Panel("2")
offset_stepover = Panel("0.9")
infill_to_shell_stepover = Panel("0.3")
infill_percentage = Panel(Slider(20, range=0..100))
angle_threshold_for_closed_top = Panel(Slider(15, range=0..360))
start_path_offset_distance = Panel("8")
minimum_lengt_start = Panel("200")
print_bed_height = Panel("0")
layer_thickness = Panel("0.2")
nozzle_diamter = Panel("0.5")
infill_angle = Panel("45")
closed_layers_top = Panel("4")
closed_layers_bottom = Panel("4")
angle_threshold_for_closed_bottom = Panel(Slider(15, range=0..360))
number_of_slow_start_layers = Panel("4")
objects_to_fdm_print = Mesh(mesh)

# ---- group: Move objects to print bed height
print_bed_height_2 = Panel(print_bed_height)
objects_to_fdm_print_2 = Mesh(objects_to_fdm_print)
bbox = BoundingBox(Content=objects_to_fdm_print_2, Plane=PlaneXY(0, 0, 0))  # -> Box, Box_2
debrep = DeconstructBrep(Brep=bbox.Box)  # -> Faces, Edges, Vertices
item = ListItem(List=debrep.Vertices, Index=0, Wrap=True)
pdecon = Deconstruct(Point=item)  # -> XComponent, YComponent, ZComponent
pt = ConstructPoint(XCoordinate=pdecon.XComponent, YCoordinate=pdecon.YComponent, ZCoordinate=print_bed_height_2)
vec2pt = Vector2Pt(PointA=item, PointB=pt, Unitize=False)  # -> Vector, Length
pshift = ShiftPaths(Data=vec2pt.Vector, Offset=-1)
move = Move(Geometry=objects_to_fdm_print_2, Motion=pshift)  # -> Geometry, Transform

# ----
objects_to_fdm_print_3 = Mesh(move.Geometry)

# ---- group: Get bounding box and infill angles
xy = XYPlane(Origin=Point(0, 0, 0))
mjoin = MeshJoin(Meshes=flatten(objects_to_fdm_print_3))
rotate = Rotate(Geometry=mjoin, Angle=degrees(infill_angle), Plane=xy)  # -> Geometry, Transform
neg = Negative(Value=infill_angle)
bbox_2 = BoundingBox(Content=rotate.Geometry, Plane=PlaneXY(0, 0, 0))  # -> Box, Box_2
rotate_2 = Rotate(Geometry=bbox_2.Box, Angle=degrees(neg), Plane=xy)  # -> Geometry, Transform
debrep_2 = DeconstructBrep(Brep=rotate_2.Geometry)  # -> Faces, Edges, Vertices

# ---- group: Anticipate actual extrusin width per layer heigth
layer_thickness_2 = Panel(layer_thickness)
nozzle_diamter_2 = Panel(nozzle_diamter)

# ---- group: Create offsets
adjusted_nozzle_diamter = Panel(nozzle_diamter_2)
item_2 = ListItem(List=debrep_2.Vertices, Index=0, Wrap=True)
multiplication = Multiplication(A=layer_thickness, B="0.501")
Z = UnitZ(Factor=multiplication)
move_2 = Move(Geometry=item_2, Motion=Z)  # -> Geometry, Transform
multiplication_2 = Multiplication(A=adjusted_nozzle_diamter, B=infill_to_shell_stepover)
multiplication_3 = Multiplication(A=adjusted_nozzle_diamter, B="0.5")
multiplication_4 = Multiplication(A=adjusted_nozzle_diamter, B=offset_stepover)
series = Series(Start=multiplication_3, Step=multiplication_4, Count=number_off_shell_layers)
rev = ReverseList(List=series)
contour = Contour(Shape=mjoin, Point=move_2.Geometry, Direction=Z, Distance=layer_thickness)
item_3 = ListItem(List=rev, Index=0, Wrap=True)
addition = Addition(A=item_3, B=multiplication_2)
polyoffset = PolylineOffset(
    Polylines=contour,
    Distance=series,
    Plane=Plane(origin=(0, 0, 0), x=(0, 0, 0), y=(0, 0, 0)),
    Tolerance=0.001,
    ClosedFillet=0,
    OpenFillet=0,
    Miter=2)  # -> Contour, Holes
mesh_3 = Mesh(mjoin)
polyoffset_2 = PolylineOffset(
    Polylines=contour,
    Distance=addition,
    Plane=Plane(origin=(0, 0, 0), x=(0, 0, 0), y=(0, 0, 0)),
    Tolerance=0.001,
    ClosedFillet=0,
    OpenFillet=0,
    Miter=2)  # -> Contour, Holes
end = EndPoints(Curve=polyoffset.Contour)  # -> Start, End
end_2 = EndPoints(Curve=polyoffset_2.Contour)  # -> Start, End
end_3 = EndPoints(Curve=polyoffset_2.Holes)  # -> Start, End
end_4 = EndPoints(Curve=polyoffset.Holes)  # -> Start, End
minc = MeshInclusion(Mesh=mesh_3, Point=end_2.Start, Strict=False)
minc_2 = MeshInclusion(Mesh=mesh_3, Point=end_3.Start, Strict=False)
minc_3 = MeshInclusion(Mesh=mesh_3, Point=end.Start, Strict=False)
minc_4 = MeshInclusion(Mesh=mesh_3, Point=end_4.Start, Strict=False)
dispatch = Dispatch(List=polyoffset.Contour, DispatchPattern=minc_3)  # -> ListA, ListB
dispatch_2 = Dispatch(List=polyoffset_2.Contour, DispatchPattern=minc)  # -> ListA, ListB
dispatch_3 = Dispatch(List=polyoffset_2.Holes, DispatchPattern=minc_2)  # -> ListA, ListB
dispatch_4 = Dispatch(List=polyoffset.Holes, DispatchPattern=minc_4)  # -> ListA, ListB
crv = Curve(dispatch.ListA)
crv_2 = Curve(dispatch_3.ListA)
crv_3 = Curve(dispatch_4.ListA)
crv_4 = Curve(dispatch_2.ListA)
merge = Merge(Data1=crv_4, Data2=crv_2)
merge_2 = Merge(Data1=crv, Data2=crv_3)
infill_trim_curves = Curve(merge)
shell_curves = Curve(merge_2)

# ---- group: Create infill and closed layer patterns
infill_percentage_2 = Panel(infill_percentage)
multiplication_5 = Multiplication(A=adjusted_nozzle_diamter, B=offset_stepover)
infill_spacing = Panel(multiplication_5)
item_4 = ListItem(List=debrep_2.Edges, Index="3", Wrap=True)
item_5 = ListItem(List=debrep_2.Edges, Index=0, Wrap=True)
division = Division(A="100", B=infill_percentage_2)
int = Integer(division)
infill_line_y = Line(item_4)
infill_line_x = Line(item_5)
infill_nth = Panel(int)
len = Length(Curve=infill_line_x)
len_2 = Length(Curve=infill_line_y)
end_5 = EndPoints(Curve=infill_line_x)  # -> Start, End
end_6 = EndPoints(Curve=infill_line_y)  # -> Start, End
division_2 = Division(A=len, B=infill_spacing)
division_3 = Division(A=len_2, B=infill_spacing)
multiplication_6 = Multiplication(A=infill_spacing, B="0.5")
vec2pt_2 = Vector2Pt(PointA=end_5.Start, PointB=end_5.End, Unitize=False)  # -> Vector, Length
vec2pt_3 = Vector2Pt(PointA=end_6.End, PointB=end_6.Start, Unitize=False)  # -> Vector, Length
round = Round(Number=division_2)  # -> Nearest, Floor, Ceiling
round_2 = Round(Number=division_3)  # -> Nearest, Floor, Ceiling
subtraction = Subtraction(A=infill_nth, B="1")
dup = DuplicateData(Data=Toggle(False), Number=subtraction, Order=True)
series_2 = Series(Start=multiplication_6, Step=infill_spacing, Count=round.Floor)
series_3 = Series(Start=multiplication_6, Step=infill_spacing, Count=round_2.Floor)
merge_3 = Merge(Data1=flatten(dup), Data2=flatten(Toggle(True)))
amp = Amplitude(Vector=vec2pt_2.Vector, Amplitude=series_2)
amp_2 = Amplitude(Vector=vec2pt_3.Vector, Amplitude=series_3)
not = GateNot(A=merge_3)
move_3 = Move(Geometry=infill_line_y, Motion=amp)  # -> Geometry, Transform
move_4 = Move(Geometry=infill_line_x, Motion=amp_2)  # -> Geometry, Transform
closed_layer_cull_pattern = Panel(not)
infill_cull_pattern = Panel(merge_3)
cull = CullPattern(List=move_4.Geometry, CullPattern=closed_layer_cull_pattern)
cull_2 = CullPattern(List=move_3.Geometry, CullPattern=closed_layer_cull_pattern)
cull_3 = CullPattern(List=move_4.Geometry, CullPattern=infill_cull_pattern)
cull_4 = CullPattern(List=move_3.Geometry, CullPattern=infill_cull_pattern)
closed_layer_pattern_y = Curve(cull)
closed_layer_pattern_x = Curve(cull_2)
infill_pattern_x = Curve(cull_4)
infill_pattern_y = Curve(cull_3)

# ---- group: Sort top and bottom faces that need fill
angle_threshold_for_closed_bottom_2 = Panel(angle_threshold_for_closed_bottom)
angle_threshold_for_closed_top_2 = Panel(angle_threshold_for_closed_top)
mesh_4 = Mesh(mjoin)
facen = FaceNormals(Mesh=mesh_4)  # -> Centers, Normals
Z_2 = UnitZ(Factor=1)
addition_2 = Addition(A=angle_threshold_for_closed_top_2, B="180")
subtraction_2 = Subtraction(A="360", B=angle_threshold_for_closed_bottom_2)
rev_2 = Reverse(Vector=facen.Normals)
angle = Angle(VectorA=rev_2, VectorB=Z_2)  # -> Angle, Reflex
deg = Degrees(Radians=angle.Reflex)
larger = LargerThan(FirstNumber=deg, SecondNumber=subtraction_2)  # -> LargerThan, OrEqualTo
larger_2 = LargerThan(FirstNumber=deg, SecondNumber=addition_2)  # -> LargerThan, OrEqualTo
not_2 = GateNot(A=larger.LargerThan)

# ---- group: Separate outer shel curves from rest
number_off_shell_layers_2 = Panel(number_off_shell_layers)
shell_curves_2 = Curve(shell_curves)
simplify = SimplifyTree(Tree=shell_curves_2, Front=False)
subtraction_3 = Subtraction(A=number_off_shell_layers_2, B="1")
group = Group(Objects=simplify)
dup_2 = DuplicateData(Data=Toggle(False), Number=subtraction_3, Order=True)
dispatch_5 = Dispatch(List=flatten(group), DispatchPattern=flatten([Toggle(True), dup_2]))  # -> ListA, ListB
outermost_shell_curves = Geometry(dispatch_5.ListA)
inner_shell_curves = Geometry(dispatch_5.ListB)

# ---- group: Trim infill to fit iside shapes
infill_trim_curves_2 = Curve(infill_trim_curves)
infill_pattern_x_2 = Curve(infill_pattern_x)
infill_pattern_y_2 = Curve(infill_pattern_y)
simplify_2 = SimplifyTree(Tree=infill_trim_curves_2, Front=False)
Z_3 = UnitZ(Factor=layer_thickness)
group_2 = Group(Objects=infill_pattern_y_2)
group_3 = Group(Objects=infill_pattern_x_2)
lng = ListLength(List=simplify_2)
lng_2 = ListLength(List=flatten(lng))
multiplication_7 = Multiplication(A=layer_thickness, B="2")
division_4 = Division(A=lng_2, B="2")
move_5 = Move(Geometry=group_2, Motion=Z_3)  # -> Geometry, Transform
series_4 = Series(Start=multiplication, Step=layer_thickness, Count=lng_2)
series_5 = Series(Start=multiplication, Step=multiplication_7, Count=division_4)
group_4 = Group(Objects=[move_5.Geometry, group_3])
Z_4 = UnitZ(Factor=series_4)
Z_5 = UnitZ(Factor=series_5)
xy_2 = XYPlane(Origin=Point(0, 0, 0))
move_6 = Move(Geometry=graft(group_4), Motion=Z_5)  # -> Geometry, Transform
move_7 = Move(Geometry=xy_2, Motion=Z_4)  # -> Geometry, Transform
ungroup = Ungroup(Group=move_6.Geometry)
ungroup_2 = Ungroup(Group=flatten(ungroup))
graft = GraftTree(Tree=move_7.Geometry, IncludeEmptyLists=True, IncludeNullItems=True)
simplify_3 = SimplifyTree(Tree=ungroup_2, Front=False)
simplify_4 = SimplifyTree(Tree=graft, Front=False)
polyboolean = PolylineBoolean(A=simplify_3, B=simplify_2, BooleanType=0, Plane=simplify_4, Tolerance=0.001, EvenOdd=True)
trimmed_closed_upper_layers = Curve(polyboolean)

# ---- group: Create boundary curves for top facing polygons
closed_layers_top_2 = Panel(closed_layers_top)
layer_thickness_3 = Panel(layer_thickness)
infill_trim_curves_3 = Curve(infill_trim_curves)
cullf = CullFaces(Mesh=mesh_4, Pattern=larger_2.LargerThan)
addition_3 = Addition(A=closed_layers_top_2, B=".2")
multiplication_8 = Multiplication(A=layer_thickness_3, B=addition_3)
total_offset_thickness = Panel(multiplication_8)
mshedge = MeshEdgesWithTolerance(Mesh=cullf, AngleThreshold=45)  # -> InteriorEdges, NakedEdges
Z_6 = UnitZ(Factor=1)
neg_2 = Negative(Value=total_offset_thickness)
amp_3 = Amplitude(Vector=Z_6, Amplitude=neg_2)
flip = FlipCurve(Curve=mshedge.NakedEdges)  # -> Curve, Flag
move_8 = Move(Geometry=mshedge.NakedEdges, Motion=amp_3)  # -> Geometry, Transform
panel = Panel("""0
1""")
move_9 = Move(Geometry=cullf, Motion=amp_3)  # -> Geometry, Transform
eval = EvaluateLength(Curve=graft(move_8.Geometry), Length=panel, Normalized=True)  # -> Point, Tangent, Parameter
eval_2 = EvaluateLength(Curve=graft(flip.Curve), Length=panel, Normalized=True)  # -> Point, Tangent, Parameter
merge_4 = Merge(Data1=eval_2.Point, Data2=eval.Point)
quad_poly_pattern = Text("Q{0;1;2;3}")
conmesh = ConstructMesh(Vertices=merge_4, Faces=quad_poly_pattern)
mjoin_2 = MeshJoin(Meshes=flatten([move_9.Geometry, conmesh, cullf]))
weld = WeldMesh(Mesh=mjoin_2, Angle=3.141592654)
flip_2 = FlipMatrix(Data=infill_trim_curves_3)
lng_3 = ListLength(List=flip_2)
sort = SortList(Keys=flatten(lng_3))  # -> Keys, ValuesA
item_6 = ListItem(List=sort.Keys, Index=0, Wrap=True)
series_6 = Series(Start=0, Step=layer_thickness, Count=item_6)
xy_3 = XYPlane(Origin=move_2.Geometry)
Z_7 = UnitZ(Factor=series_6)
move_10 = Move(Geometry=xy_3, Motion=Z_7)  # -> Geometry, Transform
sec = MeshPlane(Mesh=weld, Plane=move_10.Geometry)
join = JoinCurves(Curves=flatten(sec), Preserve=False)
end_7 = EndPoints(Curve=join)  # -> Start, End
pdecon_2 = Deconstruct(Point=move_10.Geometry)  # -> XComponent, YComponent, ZComponent
pdecon_3 = Deconstruct(Point=end_7.Start)  # -> XComponent, YComponent, ZComponent
mindex = MemberIndex(Set=pdecon_3.ZComponent, Member=pdecon_2.ZComponent)  # -> Index, Count
item_7 = ListItem(List=join, Index=mindex.Index, Wrap=True)
polyboolean_2 = PolylineBoolean(A=item_7, B=infill_trim_curves_3, BooleanType=0, Plane=graft(move_10.Geometry), Tolerance=0.001, EvenOdd=True)
boundary_curves_for_filled_top = Curve(polyboolean_2)

# ---- group: Create boundary curves for bottom facing polygons
closed_layers_bottom_2 = Panel(closed_layers_bottom)
layer_thickness_4 = Panel(layer_thickness)
infill_trim_curves_4 = Curve(infill_trim_curves)
cullf_2 = CullFaces(Mesh=mesh_4, Pattern=not_2)
addition_4 = Addition(A=closed_layers_bottom_2, B=".2")
multiplication_9 = Multiplication(A=layer_thickness_4, B=addition_4)
total_offset_thickness_2 = Panel(multiplication_9)
mshedge_2 = MeshEdgesWithTolerance(Mesh=cullf_2, AngleThreshold=45)  # -> InteriorEdges, NakedEdges
Z_8 = UnitZ(Factor=1)
amp_4 = Amplitude(Vector=Z_8, Amplitude=total_offset_thickness_2)
flip_3 = FlipCurve(Curve=mshedge_2.NakedEdges)  # -> Curve, Flag
move_11 = Move(Geometry=mshedge_2.NakedEdges, Motion=amp_4)  # -> Geometry, Transform
panel_2 = Panel("""0
1""")
move_12 = Move(Geometry=cullf_2, Motion=amp_4)  # -> Geometry, Transform
eval_3 = EvaluateLength(Curve=graft(move_11.Geometry), Length=panel_2, Normalized=True)  # -> Point, Tangent, Parameter
eval_4 = EvaluateLength(Curve=graft(flip_3.Curve), Length=panel_2, Normalized=True)  # -> Point, Tangent, Parameter
merge_5 = Merge(Data1=eval_4.Point, Data2=eval_3.Point)
quad_poly_pattern_2 = Text("Q{0;1;2;3}")
conmesh_2 = ConstructMesh(Vertices=merge_5, Faces=quad_poly_pattern_2)
mjoin_3 = MeshJoin(Meshes=flatten([move_12.Geometry, conmesh_2, cullf_2]))
weld_2 = WeldMesh(Mesh=mjoin_3, Angle=3.141592654)
flip_4 = FlipMatrix(Data=infill_trim_curves_4)
lng_4 = ListLength(List=flip_4)
sort_2 = SortList(Keys=flatten(lng_4))  # -> Keys, ValuesA
item_8 = ListItem(List=sort_2.Keys, Index=0, Wrap=True)
series_7 = Series(Start=0, Step=layer_thickness, Count=item_8)
xy_4 = XYPlane(Origin=move_2.Geometry)
Z_9 = UnitZ(Factor=series_7)
move_13 = Move(Geometry=xy_4, Motion=Z_9)  # -> Geometry, Transform
sec_2 = MeshPlane(Mesh=weld_2, Plane=move_13.Geometry)
join_2 = JoinCurves(Curves=flatten(sec_2), Preserve=False)
end_8 = EndPoints(Curve=join_2)  # -> Start, End
pdecon_4 = Deconstruct(Point=move_13.Geometry)  # -> XComponent, YComponent, ZComponent
pdecon_5 = Deconstruct(Point=end_8.Start)  # -> XComponent, YComponent, ZComponent
mindex_2 = MemberIndex(Set=pdecon_5.ZComponent, Member=pdecon_4.ZComponent)  # -> Index, Count
item_9 = ListItem(List=join_2, Index=mindex_2.Index, Wrap=True)
polyboolean_3 = PolylineBoolean(A=item_9, B=infill_trim_curves_4, BooleanType=0, Plane=graft(move_13.Geometry), Tolerance=0.001, EvenOdd=True)
boundary_curves_for_filled_bottom = Curve(polyboolean_3)

# ----
nozzle_diamter_3 = Panel(nozzle_diamter)
multiplication_10 = Multiplication(A=nozzle_diamter_3, B="3")

# ---- group: Create start layers
start_path_offset_distance_2 = Panel(start_path_offset_distance)
minimum_lengt_start_2 = Panel(minimum_lengt_start)
outermost_shell_curves_2 = Geometry(outermost_shell_curves)
item_10 = ListItem(List=outermost_shell_curves_2, Index=0, Wrap=True)
ungroup_3 = Ungroup(Group=item_10)
runion = RegionUnion(Curves=ungroup_3)
item_11 = ListItem(List=flatten(runion), Index=0, Wrap=True)
null = NullItem(Item=item_11)  # -> NullFlags, InvalidFlags, Description
filter = StreamFilter(Gate=null.NullFlags, Stream0=runion, Stream1=ungroup_3)
pi = Pi(Factor="2")
lng_5 = ListLength(List=filter)
multiplication_11 = Multiplication(A=start_path_offset_distance_2, B=pi)
len_3 = Length(Curve=filter)
multiplication_12 = Multiplication(A=lng_5, B=multiplication_11)
ma = MassAddition(Input=len_3)  # -> Result, PartialResults
addition_5 = Addition(A=ma.Result, B=multiplication_12)
division_5 = Division(A=minimum_lengt_start_2, B=addition_5)
round_3 = Round(Number=division_5)  # -> Nearest, Floor, Ceiling
series_8 = Series(Start=start_path_offset_distance_2, Step=multiplication_10, Count=round_3.Ceiling)
polyoffset_3 = PolylineOffset(
    Polylines=filter,
    Distance=series_8,
    Plane=Plane(origin=(0, 0, 0), x=(0, 0, 0), y=(0, 0, 0)),
    Tolerance=0.001,
    ClosedFillet=0,
    OpenFillet=0,
    Miter=2)  # -> Contour, Holes
start_layers = Curve(polyoffset_3.Contour)

# ---- group: Trim infill to fit iside shapes
boundary_curves_for_filled_bottom_2 = Curve(boundary_curves_for_filled_bottom)
closed_layer_pattern_x_2 = Curve(closed_layer_pattern_x)
closed_layer_pattern_y_2 = Curve(closed_layer_pattern_y)
simplify_5 = SimplifyTree(Tree=boundary_curves_for_filled_bottom_2, Front=False)
Z_10 = UnitZ(Factor=layer_thickness)
group_5 = Group(Objects=closed_layer_pattern_y_2)
group_6 = Group(Objects=closed_layer_pattern_x_2)
lng_6 = ListLength(List=simplify_5)
lng_7 = ListLength(List=flatten(lng_6))
multiplication_13 = Multiplication(A=layer_thickness, B="2")
larger_3 = LargerThan(FirstNumber=lng_6, SecondNumber="0")  # -> LargerThan, OrEqualTo
division_6 = Division(A=lng_7, B="2")
move_14 = Move(Geometry=group_5, Motion=Z_10)  # -> Geometry, Transform
series_9 = Series(Start=multiplication, Step=layer_thickness, Count=lng_7)
series_10 = Series(Start=multiplication, Step=multiplication_13, Count=division_6)
group_7 = Group(Objects=[move_14.Geometry, group_6])
Z_11 = UnitZ(Factor=series_9)
Z_12 = UnitZ(Factor=series_10)
xy_5 = XYPlane(Origin=Point(0, 0, 0))
move_15 = Move(Geometry=graft(group_7), Motion=Z_12)  # -> Geometry, Transform
move_16 = Move(Geometry=xy_5, Motion=Z_11)  # -> Geometry, Transform
ungroup_4 = Ungroup(Group=move_15.Geometry)
p_n_c = PickNChoose(Pattern=flatten(larger_3.LargerThan), Stream0=flatten(larger_3.LargerThan), Stream1=flatten(ungroup_4))
ungroup_5 = Ungroup(Group=p_n_c)
graft_2 = GraftTree(Tree=move_16.Geometry, IncludeEmptyLists=True, IncludeNullItems=True)
simplify_6 = SimplifyTree(Tree=ungroup_5, Front=False)
simplify_7 = SimplifyTree(Tree=graft_2, Front=False)
polyboolean_4 = PolylineBoolean(A=simplify_6, B=simplify_5, BooleanType=0, Plane=simplify_7, Tolerance=0.001, EvenOdd=True)
trimmed_closed_lower_layers = Curve(polyboolean_4)

boundary_curves_for_filled_top_2 = Curve(boundary_curves_for_filled_top)
closed_layer_pattern_x_3 = Curve(closed_layer_pattern_x)
closed_layer_pattern_y_3 = Curve(closed_layer_pattern_y)
simplify_8 = SimplifyTree(Tree=boundary_curves_for_filled_top_2, Front=False)
Z_13 = UnitZ(Factor=layer_thickness)
group_8 = Group(Objects=closed_layer_pattern_y_3)
group_9 = Group(Objects=closed_layer_pattern_x_3)
lng_8 = ListLength(List=simplify_8)
lng_9 = ListLength(List=flatten(lng_8))
multiplication_14 = Multiplication(A=layer_thickness, B="2")
larger_4 = LargerThan(FirstNumber=lng_8, SecondNumber="0")  # -> LargerThan, OrEqualTo
division_7 = Division(A=lng_9, B="2")
move_17 = Move(Geometry=group_8, Motion=Z_13)  # -> Geometry, Transform
series_11 = Series(Start=multiplication, Step=layer_thickness, Count=lng_9)
series_12 = Series(Start=multiplication, Step=multiplication_14, Count=division_7)
group_10 = Group(Objects=[move_17.Geometry, group_9])
Z_14 = UnitZ(Factor=series_11)
Z_15 = UnitZ(Factor=series_12)
xy_6 = XYPlane(Origin=Point(0, 0, 0))
move_18 = Move(Geometry=graft(group_10), Motion=Z_15)  # -> Geometry, Transform
move_19 = Move(Geometry=xy_6, Motion=Z_14)  # -> Geometry, Transform
ungroup_6 = Ungroup(Group=move_18.Geometry)
p_n_c_2 = PickNChoose(Pattern=flatten(larger_4.LargerThan), Stream0=flatten(larger_4.LargerThan), Stream1=flatten(ungroup_6))
ungroup_7 = Ungroup(Group=p_n_c_2)
graft_3 = GraftTree(Tree=move_19.Geometry, IncludeEmptyLists=True, IncludeNullItems=True)
simplify_9 = SimplifyTree(Tree=ungroup_7, Front=False)
simplify_10 = SimplifyTree(Tree=graft_3, Front=False)
polyboolean_5 = PolylineBoolean(A=simplify_9, B=simplify_8, BooleanType=0, Plane=simplify_10, Tolerance=0.001, EvenOdd=True)
trimmed_closed_upper_layers_2 = Curve(polyboolean_5)

# ---- group: Flip every second curve to optimzie route
dispatch_6 = Dispatch(List=trimmed_closed_upper_layers_2, DispatchPattern=[True, False])  # -> ListA, ListB
flip_5 = FlipCurve(Curve=dispatch_6.ListB)  # -> Curve, Flag
weave = Weave(Pattern=[0, 1], Stream0=dispatch_6.ListA, Stream1=flip_5.Curve, NullGaps=False)
filled_top = Curve(weave)

dispatch_7 = Dispatch(List=trimmed_closed_lower_layers, DispatchPattern=[True, False])  # -> ListA, ListB
flip_6 = FlipCurve(Curve=dispatch_7.ListB)  # -> Curve, Flag
weave_2 = Weave(Pattern=[0, 1], Stream0=dispatch_7.ListA, Stream1=flip_6.Curve, NullGaps=False)
filled_bottom = Curve(weave_2)

# ----
outermost_shell_curves_3 = Geometry(outermost_shell_curves)
trimmed_infill = Curve(trimmed_closed_upper_layers)
inner_shell_curves_2 = Geometry(inner_shell_curves)
filled_bottom_2 = Curve(filled_bottom)
filled_top_2 = Curve(filled_top)
start_layers_2 = Curve(start_layers)
simplify_11 = SimplifyTree(Tree=trimmed_infill, Front=False)
simplify_12 = SimplifyTree(Tree=filled_top_2, Front=False)
simplify_13 = SimplifyTree(Tree=filled_bottom_2, Front=False)

# ---- group: Add start layer to layer order
rev_3 = ReverseList(List=flatten(start_layers_2))
item_12 = ListItem(List=inner_shell_curves_2, Index=0, Wrap=True)
group_11 = Group(Objects=rev_3)
ungroup_8 = Ungroup(Group=item_12)
merge_6 = Merge(Data1=flatten(rev_3), Data2=flatten(ungroup_8))
group_12 = Group(Objects=merge_6)
replace = ReplaceItems(List=inner_shell_curves_2, Item=group_12, Indices="0", Wrap=False)
flatten = FlattenTree(Tree=replace, Path="{0}")

# ---- group: Collect infill and closed fill per layer
merge_7 = Merge(Data1=simplify_11, Data2=simplify_12, Data3=simplify_13)
group_13 = Group(Objects=merge_7)
flatten_2 = FlattenTree(Tree=group_13, Path="{0}")

# ---- group: Merge curves per layer in dersired order (sorting logic would be nice)
graft_4 = GraftTree(Tree=flatten, IncludeEmptyLists=True, IncludeNullItems=True)
graft_5 = GraftTree(Tree=flatten_2, IncludeEmptyLists=True, IncludeNullItems=True)
graft_6 = GraftTree(Tree=outermost_shell_curves_3, IncludeEmptyLists=True, IncludeNullItems=True)
merge_8 = Merge(Data1=graft_4, Data2=graft_5, Data3=graft_6)

# ----
number_of_slow_start_layers_2 = Panel(number_of_slow_start_layers)

# ---- group: Create preview
preview_slider_value = Panel(preview_slider)
larger_5 = LargerThan(FirstNumber=preview_slider_value, SecondNumber="0.99999")  # -> LargerThan, OrEqualTo
filter_2 = StreamFilter(Gate=larger_5.LargerThan, Stream0=Toggle(True), Stream1=Toggle(False))
gate = StreamGate(Stream=flatten_2, Gate=filter_2)  # -> Target0, Target1
gate_2 = StreamGate(Stream=outermost_shell_curves_3, Gate=filter_2)  # -> Target0, Target1
gate_3 = StreamGate(Stream=inner_shell_curves_2, Gate=filter_2)  # -> Target0, Target1
lng_10 = ListLength(List=gate.Target1)
multiplication_15 = Multiplication(A=lng_10, B=preview_slider_value)
lng_11 = ListLength(List=gate_2.Target1)
int_2 = Integer(multiplication_15)
multiplication_16 = Multiplication(A=lng_11, B=preview_slider_value)
multiplication_17 = Multiplication(A=int_2, B=subtraction_3)
subtraction_4 = Subtraction(A=int_2, B="1")
int_3 = Integer(multiplication_16)
series_13 = Series(Start="0", Step="1", Count=subtraction_4)
subtraction_5 = Subtraction(A=int_3, B="1")
subtraction_6 = Subtraction(A=multiplication_17, B="1")
series_14 = Series(Start=multiplication_17, Step=1, Count=subtraction_3)
series_15 = Series(Start="0", Step="1", Count=subtraction_5)
series_16 = Series(Start="0", Step="1", Count=subtraction_6)
item_13 = ListItem(List=gate.Target1, Index=int_2, Wrap=False)
item_14 = ListItem(List=gate.Target1, Index=series_13, Wrap=False)
item_15 = ListItem(List=group_11, Index=int_2, Wrap=False)
item_16 = ListItem(List=group_11, Index=series_13, Wrap=False)
ungroup_9 = Ungroup(Group=item_13)
ungroup_10 = Ungroup(Group=item_14)
item_17 = ListItem(List=gate_2.Target1, Index=multiplication_16, Wrap=False)
item_18 = ListItem(List=gate_2.Target1, Index=series_15, Wrap=False)
item_19 = ListItem(List=gate_3.Target1, Index=series_14, Wrap=False)
item_20 = ListItem(List=gate_3.Target1, Index=series_16, Wrap=False)
selected_outermost_shell_curves = Geometry(item_17)
selected_inner_shell_curves = Geometry(item_19)
selected_infill = Curve(ungroup_9)
outermost_shell_curves_4 = Geometry(outermost_shell_curves_3)
inner_shell_curves_3 = Geometry(inner_shell_curves_2)
selected_start_layer = Group(item_15)
start_layer = Group(group_11)
infill = Curve(merge_7)
filter_3 = StreamFilter(Gate=filter_2, Stream0=outermost_shell_curves_4, Stream1=selected_outermost_shell_curves)
filter_4 = StreamFilter(Gate=filter_2, Stream0=inner_shell_curves_3, Stream1=selected_inner_shell_curves)
filter_5 = StreamFilter(Gate=filter_2, Stream0=infill, Stream1=selected_infill)
filter_6 = StreamFilter(Gate=filter_2, Stream0=start_layer, Stream1=selected_start_layer)
preview = CustomPreview(Geometry=filter_3, Shader=ColourSwatch(SwatchColor=RGB(255, 0, 0)))
preview_2 = CustomPreview(Geometry=filter_4, Shader=ColourSwatch(SwatchColor=RGB(68, 255, 0)))
preview_3 = CustomPreview(Geometry=filter_5, Shader=ColourSwatch(SwatchColor=RGB(247, 255, 0)))
preview_4 = CustomPreview(Geometry=item_18, Shader=ColourSwatch(SwatchColor=RGB(135, 119, 119)))
preview_5 = CustomPreview(Geometry=item_20, Shader=ColourSwatch(SwatchColor=RGB(108, 122, 103)))
preview_6 = CustomPreview(Geometry=ungroup_10, Shader=ColourSwatch(SwatchColor=RGB(137, 138, 114)))
preview_7 = CustomPreview(Geometry=filter_6, Shader=ColourSwatch(SwatchColor=RGB(0, 255, 255)))
preview_8 = CustomPreview(Geometry=item_16, Shader=ColourSwatch(SwatchColor=RGB(77, 130, 130)))

# ----
ungroup_11 = Ungroup(Group=merge_8)
series_17 = Series(Start=0, Step=1, Count=number_of_slow_start_layers_2)
group_14 = Group(Objects=merge_8)
panel_3 = Panel(multiplication)
flatten_3 = FlattenTree(Tree=ungroup_11, Path="{0}")
neg_3 = Negative(Value=panel_3)
item_21 = ListItem(List=flatten(group_14), Index=series_17, Wrap=True)
Z_16 = UnitZ(Factor=neg_3)
ungroup_12 = Ungroup(Group=item_21)
move_20 = Move(Geometry=flatten_3, Motion=Z_16)  # -> Geometry, Transform
ungroup_13 = Ungroup(Group=ungroup_12)
toolpaths = Curve(move_20.Geometry)
lng_12 = ListLength(List=flatten(ungroup_13))
number_off_start_paths = Panel(lng_12)
