# Grasshopper definition Millingbit feedrate and passdepth recommender.gh (Grasshopper 0.9.76)
# Copyright: Creative commons BY-SA
# Copyright: Creative Commons BY-SA

material_thickness = Slider(10, range=0..100)
material = ValueList({"Foam / wax": 0, "Soft wood": 1, "Hard wood": 2, "Plastic": 3, "Aluminium / brass": 4, "Bronze": 5, "Soft steel": 6, "Stainless steel": 7}, selected="Aluminium / brass")

# ---- group: Override
# Values above 1 makes passes deeper. good for strong and stiff machines
# 
# Values bellow 1 makes passes shallower, so more passes are reuired to cut through. Good for weak machines
# 
# Default allround value = 1.0
# ShopBot PRS Alpha = 1.4
# Quite crappy machine = 0.4
# Adjusts how fast the machine moves during cuts (it is best to adjust pass depth, and leave feedrates to default).
pass_depth_factor = Slider(1.4, range=0.2..2)
feed_rate_factor = Slider(1, range=0.2..2)

# ---- group: Secondary input
# It is usually the best to set your spindle speed to max.
# 
# The faster it spins, the faster you can cut. But make sure your machine acceleraton is not too slow, otherwise you risk heat buildup in corners
spindle_rpm = Slider(18000, range=0..30000)

# ----
material_id_legend = Panel("""Foam_Wax
SoftWood
HardWood
Plastic
Aluminium_Brass
Bronze
SoftSteel
StainlessSteel
3DprintedPlasticStock""")
item = ListItem(List=material_id_legend, Index=material, Wrap=True)
bit_selector = BitSelector(material_thickness=material_thickness, material_type=item, material_id_legend=material_id_legend)  # -> bit_type_18, diameter_22, number_of_flutes_20, name_of_bit_3
bit_type = Panel(bit_selector.bit_type_18)
spindle_rpm_2 = Panel(spindle_rpm)
milling_bit_diameter = Panel(bit_selector.diameter_22)
number_of_flutes = Panel(bit_selector.number_of_flutes_20)
settings_generator = FeedRateLibraryExperimemtal(
    material_id=material,
    bit_diameter=milling_bit_diameter,
    bit_type=bit_type,
    number_of_flutes=number_of_flutes,
    spindle_rpm=spindle_rpm_2,
    use_high_speed_maching=0,
    toolpath_width_factor=2.3,
    pass_depth_factor=pass_depth_factor,
    feed_rate_factor=feed_rate_factor)  # -> feed_rate_4, plunge_rate_4, pass_depth_4, ramp_plunges_4, ramp_angle_4, trochoidal_stepover_2, toolpath_width_2, actual_bit_diameter_3
compile_settings = CompileSettings(
    bit_type=bit_selector.name_of_bit_3,
    feed_rate=settings_generator.feed_rate_4,
    plunge_rate=settings_generator.plunge_rate_4,
    spindle_rpm=spindle_rpm_2,
    pass_depth=settings_generator.pass_depth_4,
    ramp_plunges=settings_generator.ramp_plunges_4,
    ramp_angle=settings_generator.ramp_angle_4)  # -> complete_settings, crucial_settings
bit_type_and_settings = Panel(compile_settings.complete_settings)

# ==== cluster BitSelector
material_id_legend = ClusterInput()
material_type = ClusterInput()
material_thickness = ClusterInput()
material_id_legend_2 = Text(material_id_legend)
material_type_2 = Text(material_type)
material_thickness_2 = Number(material_thickness)
material_id_legend_3 = Panel(material_id_legend_2)
mindex = MemberIndex(Set=material_id_legend_3, Member=material_type_2)  # -> Index, Count
threshold_for_foam_wax_and_wood = Panel("0")
threshold_for_plastic = Panel("3")
threshold_for_metals = Panel("4")
material_type_id = Panel(mindex.Index)
larger = LargerThan(
    FirstNumber=material_type_id,
    SecondNumber=[threshold_for_foam_wax_and_wood, threshold_for_plastic, threshold_for_metals])  # -> LargerThan, OrEqualTo
ma = MassAddition(Input=flatten(larger.OrEqualTo))  # -> Result, PartialResults
subtraction = Subtraction(A=ma.Result, B="1")
gate_index_for_bit_type_to_use = Panel(subtraction)

# ---- group: Select milling bit for metals
material_thickness_3 = Panel(material_thickness_2)
bit_type = ValueList({"Upcut", "Downcut", "Compression", "Ballnose", "V-bit"}, selected="Upcut")
max_thickness_to_cut = Panel("3")
bit_type_2 = ValueList({"Upcut", "Downcut", "Compression", "Ballnose", "V-bit"}, selected="Upcut")
bit_type_3 = ValueList({"Upcut", "Downcut", "Compression", "Ballnose", "V-bit"}, selected="Upcut")
max_thickness_to_cut_2 = Panel("5")
bit_type_4 = ValueList({"Upcut", "Downcut", "Compression", "Ballnose", "V-bit"}, selected="Upcut")
max_thickness_to_cut_3 = Panel("8")
bit_type_5 = ValueList({"Upcut", "Downcut", "Compression", "Ballnose", "V-bit"}, selected="Upcut")
max_thickness_to_cut_4 = Panel("10")
number_of_flutes = Panel("1")
number_of_flutes_2 = Panel("1")
diameter = Panel("2")
number_of_flutes_3 = Panel("1")
number_of_flutes_4 = Panel("1")
diameter_2 = Panel("3")
number_of_flutes_5 = Panel("1")
diameter_3 = Panel("4")
diameter_4 = Panel("8")
diameter_5 = Panel("6")
larger_2 = LargerThan(
    FirstNumber=material_thickness_3,
    SecondNumber=[max_thickness_to_cut, max_thickness_to_cut_2, max_thickness_to_cut_3, max_thickness_to_cut_4])  # -> LargerThan, OrEqualTo
ma_2 = MassAddition(Input=larger_2.LargerThan)  # -> Result, PartialResults
gate_index_for_bit = Panel(ma_2.Result)
filter = StreamFilter(
    Gate=gate_index_for_bit,
    Stream0=bit_type,
    Stream1=bit_type_2,
    Stream2=bit_type_3,
    Stream3=bit_type_5,
    Stream4=bit_type_4)
filter_2 = StreamFilter(
    Gate=gate_index_for_bit,
    Stream0=diameter,
    Stream1=diameter_2,
    Stream2=diameter_3,
    Stream3=diameter_5,
    Stream4=diameter_4)
filter_3 = StreamFilter(
    Gate=gate_index_for_bit,
    Stream0=number_of_flutes,
    Stream1=number_of_flutes_2,
    Stream2=number_of_flutes_3,
    Stream3=number_of_flutes_5,
    Stream4=number_of_flutes_4)
name_of_bit_to_use_for_metals = Panel(filter)
diameter_6 = Panel(filter_2)
diameter_7 = Panel(filter_3)

# ---- group: Select milling bit for plastics
material_thickness_4 = Panel(material_thickness_2)
bit_type_6 = ValueList({"Upcut", "Downcut", "Compression", "Ballnose", "V-bit"}, selected="Downcut")
bit_type_7 = ValueList({"Upcut", "Downcut", "Compression", "Ballnose", "V-bit"}, selected="Upcut")
max_thickness_to_cut_5 = Panel("4")
max_thickness_to_cut_6 = Panel("8")
bit_type_8 = ValueList({"Upcut", "Downcut", "Compression", "Ballnose", "V-bit"}, selected="Upcut")
bit_type_9 = ValueList({"Upcut", "Downcut", "Compression", "Ballnose", "V-bit"}, selected="Upcut")
bit_type_10 = ValueList({"Upcut", "Downcut", "Compression", "Ballnose", "V-bit"}, selected="Upcut")
max_thickness_to_cut_7 = Panel("13")
max_thickness_to_cut_8 = Panel("18")
number_of_flutes_6 = Panel("1")
number_of_flutes_7 = Panel("1")
diameter_8 = Panel("2")
number_of_flutes_8 = Panel("1")
diameter_9 = Panel("3")
number_of_flutes_9 = Panel("1")
diameter_10 = Panel("4")
number_of_flutes_10 = Panel("1")
diameter_11 = Panel("8")
diameter_12 = Panel("6")
larger_3 = LargerThan(
    FirstNumber=material_thickness_4,
    SecondNumber=[max_thickness_to_cut_5, max_thickness_to_cut_6, max_thickness_to_cut_7, max_thickness_to_cut_8])  # -> LargerThan, OrEqualTo
ma_3 = MassAddition(Input=larger_3.LargerThan)  # -> Result, PartialResults
gate_index_for_bit_2 = Panel(ma_3.Result)
filter_4 = StreamFilter(
    Gate=gate_index_for_bit_2,
    Stream0=bit_type_6,
    Stream1=bit_type_7,
    Stream2=bit_type_8,
    Stream3=bit_type_9,
    Stream4=bit_type_10)
filter_5 = StreamFilter(
    Gate=gate_index_for_bit_2,
    Stream0=diameter_8,
    Stream1=diameter_9,
    Stream2=diameter_10,
    Stream3=diameter_12,
    Stream4=diameter_11)
filter_6 = StreamFilter(
    Gate=gate_index_for_bit_2,
    Stream0=number_of_flutes_6,
    Stream1=number_of_flutes_7,
    Stream2=number_of_flutes_9,
    Stream3=number_of_flutes_10,
    Stream4=number_of_flutes_8)
diameter_13 = Panel(filter_5)
number_of_flutes_11 = Panel(filter_6)
name_of_bit_to_use_for_plastics = Panel(filter_4)

# ---- group: Select milling bit for foam. wax and wood
material_thickness_5 = Panel(material_thickness_2)
bit_type_11 = ValueList({"Upcut", "Downcut", "Compression", "Ballnose", "V-bit"}, selected="Downcut")
bit_type_12 = ValueList({"Upcut", "Downcut", "Compression", "Ballnose", "V-bit"}, selected="Upcut")
bit_type_13 = ValueList({"Upcut", "Downcut", "Compression", "Ballnose", "V-bit"}, selected="Upcut")
max_thickness_to_cut_9 = Panel("4")
max_thickness_to_cut_10 = Panel("8")
bit_type_14 = ValueList({"Upcut", "Downcut", "Compression", "Ballnose", "V-bit"}, selected="Upcut")
max_thickness_to_cut_11 = Panel("15")
max_thickness_to_cut_12 = Panel("21")
bit_type_15 = ValueList({"Upcut", "Downcut", "Compression", "Ballnose", "V-bit"}, selected="Upcut")
number_of_flutes_12 = Panel("1")
number_of_flutes_13 = Panel("1")
diameter_14 = Panel("2")
number_of_flutes_14 = Panel("1")
number_of_flutes_15 = Panel("1")
diameter_15 = Panel("3")
number_of_flutes_16 = Panel("1")
diameter_16 = Panel("4")
diameter_17 = Panel("8")
diameter_18 = Panel("6")
larger_4 = LargerThan(
    FirstNumber=material_thickness_5,
    SecondNumber=[max_thickness_to_cut_9, max_thickness_to_cut_10, max_thickness_to_cut_11, max_thickness_to_cut_12])  # -> LargerThan, OrEqualTo
ma_4 = MassAddition(Input=larger_4.LargerThan)  # -> Result, PartialResults
gate_index_for_bit_3 = Panel(ma_4.Result)
filter_7 = StreamFilter(
    Gate=gate_index_for_bit_3,
    Stream0=bit_type_11,
    Stream1=bit_type_12,
    Stream2=bit_type_14,
    Stream3=bit_type_15,
    Stream4=bit_type_13)
filter_8 = StreamFilter(
    Gate=gate_index_for_bit_3,
    Stream0=diameter_14,
    Stream1=diameter_15,
    Stream2=diameter_16,
    Stream3=diameter_18,
    Stream4=diameter_17)
filter_9 = StreamFilter(
    Gate=gate_index_for_bit_3,
    Stream0=number_of_flutes_12,
    Stream1=number_of_flutes_13,
    Stream2=number_of_flutes_14,
    Stream3=number_of_flutes_16,
    Stream4=number_of_flutes_15)
name_of_bit_to_use_for_wood = Panel(filter_7)
diameter_19 = Panel(filter_8)
number_of_flutes_17 = Panel(filter_9)

# ----
filter_10 = StreamFilter(
    Gate=gate_index_for_bit_type_to_use,
    Stream0=name_of_bit_to_use_for_wood,
    Stream1=name_of_bit_to_use_for_plastics,
    Stream2=name_of_bit_to_use_for_metals)
filter_11 = StreamFilter(Gate=gate_index_for_bit_type_to_use, Stream0=diameter_19, Stream1=diameter_13, Stream2=diameter_6)
filter_12 = StreamFilter(Gate=gate_index_for_bit_type_to_use, Stream0=number_of_flutes_17, Stream1=number_of_flutes_11, Stream2=diameter_7)

# ---- group: Format name of bit
panel = Panel("""-
Single
Double
Triple
Four""")
item = ListItem(List=panel, Index=filter_12, Wrap=True)
merge = Merge(Data1=filter_11, Data2="mm - ", Data3=item, Data4=" flute - ", Data5=filter_10)
join = TextJoin(Text=merge)

# ----
name_of_bit = Panel(join)
diameter_20 = Panel(filter_11)
number_of_flutes_18 = Panel(filter_12)
bit_type_16 = Panel(filter_10)
number_of_flutes_19 = Number(number_of_flutes_18)
name_of_bit_2 = Text(name_of_bit)
diameter_21 = Number(diameter_20)
bit_type_17 = Text(bit_type_16)
bit_type_18 = ClusterOutput(bit_type_17)
diameter_22 = ClusterOutput(diameter_21)
name_of_bit_3 = ClusterOutput(name_of_bit_2)
number_of_flutes_20 = ClusterOutput(number_of_flutes_19)

# ==== cluster FeedRateLibraryExperimemtal: Outputs CNC milling settings based on material type, bit diameter, bit type. Current values based on ShopBot alpha, single flute end mills and18000 rpm spindle speed
use_high_speed_maching = ClusterInput()
toolpath_width_factor = ClusterInput()
pass_depth_factor = ClusterInput()
number_of_flutes = ClusterInput()
# Adjust feed rate defaults here:
# (chip load)
feed_rate_factor = ClusterInput()
spindle_rpm = ClusterInput()
bit_diameter = ClusterInput()
material_id = ClusterInput()
bit_type = ClusterInput()
material_id_2 = Integer(material_id)
bit_diameter_2 = Number(bit_diameter)
bit_type_2 = Text(bit_type)
number_of_flutes_2 = Integer(number_of_flutes)
spindle_rpm_2 = Number(spindle_rpm)
use_high_speed_maching_2 = Integer(use_high_speed_maching)
toolpath_width_factor_2 = Number(toolpath_width_factor)
pass_depth_factor_2 = Number(pass_depth_factor)
feed_rate_factor_2 = Number(feed_rate_factor)
bit_type_ids = Panel("""Upcut
Compression
Downcut
Ballnose
V-bit""")
mindex = MemberIndex(Set=bit_type_ids, Member=bit_type_2)  # -> Index, Count
material_type_id = Panel(material_id_2)
bit_diameter_3 = Panel(bit_diameter_2)
bit_type_id = Panel(mindex.Index)
larger = LargerThan(FirstNumber=bit_type_id, SecondNumber="1")  # -> LargerThan, OrEqualTo
bool = Boolean(larger.LargerThan)
bit_type_is_not_an_up_cut_or_compression = Panel(bool)

# ---- group: ShopBot alpha pass depths
# Adjust pass depth defaults here:
pass_depths_6mm_upcut_single_flute = Panel("""19.8
15
10
8
2.5
1.2
0.9
0.6""")

# ---- group: Calculate feedrate
# Material ID ref: Foam / wax        = 0
# Soft wood         = 1
# Hard wood         = 2
# Plastic           = 3
# Aluminium / brass = 4
# Bronze            = 5
# Soft steel        = 6
# Stainless steel   = 7
chip_loads_for_6mm_bit = Panel("""0.25
0.165
0.115
0.0725
0.04
0.035
0.032
0.025""")
bit_diameter_chip_loads_are_based_on = Panel("6")
number_of_flutes_3 = Panel(number_of_flutes_2)
plunge_rate_reduction_factor_down_cut_or = Panel("0.5")  # "Plunge rate reduction factor down-cut or other"
spindle_rpm_3 = Panel(spindle_rpm_2)
plunge_rate_reduction_factor_up_cut = Panel("0.7")
bit_diameter_4 = Panel(bit_diameter_3)
multiplication_factor = Panel("0.45")
multiplication = Multiplication(A=spindle_rpm_3, B=number_of_flutes_3)
multiplication_2 = Multiplication(A=multiplication, B=chip_loads_for_6mm_bit)
division = Division(A=multiplication_2, B="60")
int = Integer(division)
feedrates_based_on_default_bit_biamter = Panel(int)

# ----
# Material ID ref: Foam / wax        = 0
# Soft wood         = 1
# Hard wood         = 2
# Plastic           = 3
# Aluminium / brass = 4
# Bronze            = 5
# Soft steel        = 6
# Stainless steel   = 7
# Adjust ramp angles here:
material_ramp_angles = Panel("""45
30
25
18
12
9
6
4""")
# Adjust high speed machining defaults here:
# Material ID ref: Foam / wax        = 0
# Soft wood         = 1
# Hard wood         = 2
# Plastic           = 3
# Aluminium / brass = 4
# Bronze            = 5
# Soft steel        = 6
# Stainless steel   = 7
plunge_rough_stepover_for_different_mate = Panel("""0.4
0.4
0.4
0.4
0.25
0.22
0.18
0.12""")  # "Plunge rough stepover for different materials"
use_high_speed_maching_3 = Panel(use_high_speed_maching_2)

# ---- group: Make a Feedrate multiplier based on current bit diamter
subtraction = Subtraction(A="1", B=multiplication_factor)
multiplication_3 = Multiplication(A=bit_diameter_4, B=multiplication_factor)
multiplication_4 = Multiplication(A=bit_diameter_chip_loads_are_based_on, B=subtraction)
addition = Addition(A=multiplication_4, B=multiplication_3)
division_2 = Division(A=addition, B=bit_diameter_chip_loads_are_based_on)
feedrate_multiplier_based_on_bit_diamter = Panel(division_2)

# ----
multiplication_5 = Multiplication(A=feedrates_based_on_default_bit_biamter, B=feedrate_multiplier_based_on_bit_diamter)
feedrates_adjusted_to_current_bit_diamte = Panel(multiplication_5)  # "Feedrates adjusted to current bit diamter"

# ---- group: Make feed rate domain
int_2 = Integer()
int_3 = Integer()
dom = ConstructDomain(DomainStart=int_3, DomainEnd=int_2)
feed_rates_domains = Panel(dom)
material_type = Panel(material_type_id)
flatten = FlattenTree(Path="{0}")
item = ListItem(List=feed_rates_domains, Index=material_type, Wrap=True)
feed_rate_domain = Panel(item)

# ---- group: Map ramp and ramp angles
material_type_2 = Panel(material_type_id)
bit_type_is_not_an_up_cut_or_compression_2 = Panel(bit_type_is_not_an_up_cut_or_compression)
material_ramp_angles_2 = Panel(material_ramp_angles)
material_type_3 = Panel(material_type_id)
larger_2 = LargerThan(FirstNumber=material_type_2, SecondNumber="1")  # -> LargerThan, OrEqualTo
bool_2 = Boolean(bit_type_is_not_an_up_cut_or_compression_2)
larger_3 = LargerThan(FirstNumber=material_type_3, SecondNumber="2")  # -> LargerThan, OrEqualTo
item_2 = ListItem(List=material_ramp_angles_2, Index=material_type_3, Wrap=True)
ramp_because_of_special_bit_in_material = Panel(larger_2.LargerThan)
ramp_because_of_bit_type = Panel(bool_2)
ramp_because_of_material = Panel(larger_3.LargerThan)
and = GateAnd(A=ramp_because_of_bit_type, B=ramp_because_of_special_bit_in_material)
or = GateOr(A=ramp_because_of_material, B=and)
ramp_angle = Panel(item_2)
ramp_plunges = Panel(or)

# ---- group: Select feedrate
material_type_4 = Panel(material_type_id)
item_3 = ListItem(List=feedrates_adjusted_to_current_bit_diamte, Index=material_type_4, Wrap=True)
feed_rate = Panel(item_3)

# ---- group: Calculate plunge rate
plunge_rate_reduction_factor_up_cut_2 = Panel(plunge_rate_reduction_factor_down_cut_or)
bit_type_is_not_an_up_cut_or_compression_3 = Panel(bit_type_is_not_an_up_cut_or_compression)
plunge_rate_reduction_factor_up_cut_3 = Panel(plunge_rate_reduction_factor_up_cut)
filter = StreamFilter(
    Gate=bit_type_is_not_an_up_cut_or_compression_3,
    Stream0=plunge_rate_reduction_factor_up_cut_3,
    Stream1=plunge_rate_reduction_factor_up_cut_2)
multiplication_6 = Multiplication(A=feed_rate, B=filter)
int_4 = Integer(multiplication_6)
num = Number(int_4)
plunge_rate = Panel(num)

# ----
use_high_speed_maching_4 = Panel(use_high_speed_maching_2)
use_high_speed_maching_5 = Panel(use_high_speed_maching_2)
use_high_speed_maching_6 = Panel(use_high_speed_maching_2)
ramp_plunges_2 = Panel(ramp_plunges)
use_high_speed_maching_7 = Panel(use_high_speed_maching_2)
ramp_angle_2 = Panel(ramp_angle)
use_high_speed_maching_8 = Panel(use_high_speed_maching_2)
actual_bit_diameter = Panel(bit_diameter_3)
actual_bit_diameter_2 = Number(actual_bit_diameter)
ramp_plunges_3 = Boolean(ramp_plunges_2)
ramp_plunges_4 = ClusterOutput(ramp_plunges_3)
actual_bit_diameter_3 = ClusterOutput(actual_bit_diameter_2)

# ---- group: Calculate pass depth
# Material ID ref: Foam / wax        = 0
# Soft wood         = 1
# Hard wood         = 2
# Plastic           = 3
# Aluminium / brass = 4
# Bronze            = 5
# Soft steel        = 6
# Stainless steel   = 7
pass_depths_6mm_upcut_single_flute_2 = Panel("""19.8
10
6
4
1.8
1.2
0.9
0.6""")
v_bit_reduction_factor = Panel("0.5")
v_bit_identifier = Panel("4")
bit_diameter_chip_loads_are_based_on_2 = Panel("6")
downcut_or_ball_nose_depth_reduction_fac = Panel("0.6")  # "Downcut or ball nose depth reduction factor"
bit_type_id_2 = Panel(bit_type_id)
bit_type_is_not_an_up_cut = Panel(bit_type_is_not_an_up_cut_or_compression)
number_of_flutes_4 = Panel(number_of_flutes_2)
multiplication_factor_flutes = Panel("0.33")
bit_diameter_5 = Panel(bit_diameter_3)
multiplication_factor_diamter = Panel("1.05")
subtraction_2 = Subtraction(A="1", B=multiplication_factor_diamter)
multiplication_7 = Multiplication(A=bit_diameter_5, B=multiplication_factor_diamter)
multiplication_8 = Multiplication(A=bit_diameter_chip_loads_are_based_on_2, B=subtraction_2)
addition_2 = Addition(A=multiplication_8, B=multiplication_7)
division_3 = Division(A=addition_2, B=bit_diameter_chip_loads_are_based_on_2)
pass_depth_multiplier_based_on_bit_diamt = Panel(division_3)  # "Pass depth multiplier based on bit diamter"
multiplication_9 = Multiplication(A=pass_depths_6mm_upcut_single_flute_2, B=pass_depth_multiplier_based_on_bit_diamt)
pass_depths_adjusted_to_current_bit_diam = Panel(multiplication_9)  # "Pass depths adjusted to current bit diamter"
number_of_flutes_5 = Panel(number_of_flutes_4)
multiplication_factor_flutes_2 = Panel(multiplication_factor_flutes)
division_4 = Division(A=pass_depths_adjusted_to_current_bit_diam, B=number_of_flutes_5)
multiplication_10 = Multiplication(A=division_4, B=multiplication_factor_flutes_2)
addition_3 = Addition(A=division_4, B=multiplication_10)
panel = Panel("10")
bit_type_simple = Panel(bit_type_is_not_an_up_cut)
material_type_5 = Panel(material_type_id)
bit_type_id_3 = Panel(bit_type_id_2)
v_bit_reduction_factor_2 = Panel(v_bit_reduction_factor)
v_bit_identifier_2 = Panel(v_bit_identifier)
v_bit_reduction_factor_3 = Panel(v_bit_reduction_factor_2)
equals = Equality(FirstNumber=bit_type_id_3, SecondNumber=v_bit_identifier_2)  # -> Equality, Inequality

# ----
larger_4 = LargerThan(FirstNumber=number_of_flutes_5, SecondNumber="1")  # -> LargerThan, OrEqualTo
filter_2 = StreamFilter(Gate=larger_4.LargerThan, Stream0=pass_depths_adjusted_to_current_bit_diam, Stream1=addition_3)
downcut_or_ball_nose_depth_reduction_fac_2 = Panel(downcut_or_ball_nose_depth_reduction_fac)  # "Downcut or ball nose depth reduction factor"

# ---- group: Make high speed milling speeds
# Material ID ref: Foam / wax        = 0
# Soft wood         = 1
# Hard wood         = 2
# Plastic           = 3
# Aluminium / brass = 4
# Bronze            = 5
# Soft steel        = 6
# Stainless steel   = 7
stepover_for_different_materials = Panel("""0.9
0.9
0.9
0.8
0.2
0.15
0.1
0.09""")
material_type_id_2 = Panel(material_type_id)
# Material ID ref: Foam / wax        = 0
# Soft wood         = 1
# Hard wood         = 2
# Plastic           = 3
# Aluminium / brass = 4
# Bronze            = 5
# Soft steel        = 6
# Stainless steel   = 7
high_speed_chip_loads_for_different_mate = Panel("""0.5
0.3
0.2
0.2
0.08
0.07
0.04
0.03""")  # "High speed chip loads for different materials"
# Material ID ref: Foam / wax        = 0
# Soft wood         = 1
# Hard wood         = 2
# Plastic           = 3
# Aluminium / brass = 4
# Bronze            = 5
# Soft steel        = 6
# Stainless steel   = 7
ramp_angle_for_different_materials = Panel("""45
20
10
3
1.2
0.9
0.8
0.6""")
plunge_rough_feed_and_plunge_rate_reduct = Panel("0.7")  # "Plunge rough feed and plunge rate reduction factor"
high_speed_pass_depth_to_bit_diameter_ra = Panel("2.5")  # "High speed pass depth to bit diameter ratio"
item_4 = ListItem(List=ramp_angle_for_different_materials, Index=material_type_id_2, Wrap=True)
item_5 = ListItem(List=high_speed_chip_loads_for_different_mate, Index=material_type_id_2, Wrap=True)
ramp_angle_high_speed_helix = Panel(item_4)
high_speed_chip_load = Panel(item_5)
bit_diameter_from_easy_interface = Panel(bit_diameter_3)
arc_diamter_factor = Panel(toolpath_width_factor_2)
bit_diameter_6 = Panel(bit_diameter_3)
multiplication_11 = Multiplication(A=high_speed_pass_depth_to_bit_diameter_ra, B=bit_diameter_6)
multiplication_12 = Multiplication(A=bit_diameter_from_easy_interface, B=arc_diamter_factor)
high_speed_pass_depth = Panel(multiplication_11)
high_speed_virtual_bit_diamter = Panel(multiplication_12)

# ----
filter_3 = StreamFilter(
    Gate=use_high_speed_maching_3,
    Stream1=stepover_for_different_materials,
    Stream2=plunge_rough_stepover_for_different_mate)

# ---- group: Make high speed milling speeds (continued)
item_6 = ListItem(List=filter_3, Index=material_type_id_2, Wrap=True)
current_high_speed_stepover = Panel(item_6)
feedrate_calculator_for_arcs = FeedrateCalculatorForArcs(
    spindle_rpm=spindle_rpm_2,
    milling_bit_diameter=bit_diameter_3,
    arc_diameter_factor=toolpath_width_factor_2,
    number_of_flutes=number_of_flutes_2,
    chip_load=high_speed_chip_load,
    max_stepover=current_high_speed_stepover,
    ramp_feed_reduction_factor=0.5)  # -> arc_compensated_feedrate_3, ramp_feedrate_2, feedback_3
multiplication_13 = Multiplication(A=feedrate_calculator_for_arcs.arc_compensated_feedrate_3, B=plunge_rough_feed_and_plunge_rate_reduct)
plungr_rough_rate = Panel(multiplication_13)

# ----
high_speed_virtual_bit_diamter_2 = Panel(high_speed_virtual_bit_diamter)
ramp_angle_high_speed_helix_2 = Panel(ramp_angle_high_speed_helix)
plunge_rough_rate = Panel(plungr_rough_rate)
plunge_rough_rate_2 = Panel(plungr_rough_rate)
high_speed_feedrate = Panel(feedrate_calculator_for_arcs.arc_compensated_feedrate_3)
high_speed_pass_depth_2 = Panel(high_speed_pass_depth)
filter_4 = StreamFilter(
    Gate=use_high_speed_maching_7,
    Stream0=ramp_angle_2,
    Stream1=ramp_angle_high_speed_helix_2,
    Stream2=ramp_angle_high_speed_helix_2)
filter_5 = StreamFilter(
    Gate=use_high_speed_maching_8,
    Stream0=actual_bit_diameter,
    Stream1=high_speed_virtual_bit_diamter_2,
    Stream2=actual_bit_diameter)
trochoidal_stepover = Number(current_high_speed_stepover)
toolpath_width = Number(filter_5)
ramp_angle_3 = Integer(filter_4)
ramp_angle_4 = ClusterOutput(ramp_angle_3)
trochoidal_stepover_2 = ClusterOutput(trochoidal_stepover)
toolpath_width_2 = ClusterOutput(toolpath_width)

# ---- group: Calculate pass depth (continued)
pass_depths_adjusted_to_current_flute_co = Panel(filter_2)  # "Pass depths adjusted to current flute count"
multiplication_14 = Multiplication(A=pass_depths_adjusted_to_current_flute_co, B=panel)

# ----
int_5 = Integer(multiplication_14)
division_5 = Division(A=int_5, B=panel)
current_pass_depths = Panel(division_5)
multiplication_15 = Multiplication(A=current_pass_depths, B=downcut_or_ball_nose_depth_reduction_fac_2)

# ---- group: Calculate pass depth (continued)
filter_6 = StreamFilter(Gate=bit_type_simple, Stream0=current_pass_depths, Stream1=multiplication_15)
item_7 = ListItem(List=filter_6, Index=material_type_5, Wrap=True)
multiplication_16 = Multiplication(A=item_7, B="10")
int_6 = Integer(multiplication_16)
division_6 = Division(A=int_6, B="10")
multiplication_17 = Multiplication(A=division_6, B=v_bit_reduction_factor_3)
filter_7 = StreamFilter(Gate=equals.Equality, Stream0=division_6, Stream1=multiplication_17)
pass_depth = Panel(filter_7)

# ---- group: Feed rate and pass depth adjustment
feed_rate_2 = Panel(feed_rate)
plunge_rate_2 = Panel(plunge_rate)
pass_depth_2 = Panel(pass_depth)
pass_depth_factor_3 = Number(pass_depth_factor_2)
feed_rate_factor_3 = Number(feed_rate_factor_2)
multiplication_18 = Multiplication(A=pass_depth_2, B=pass_depth_factor_3)
multiplication_19 = Multiplication(A=plunge_rate_2, B=feed_rate_factor_3)
multiplication_20 = Multiplication(A=feed_rate_2, B=feed_rate_factor_3)
int_7 = Integer(multiplication_19)
num_2 = Number(multiplication_18)
ajusted_pass_depth = Panel(num_2)
adjusted_plunge_rateod_plunge_rate = Panel(int_7)

# ----
int_8 = Integer(multiplication_20)

# ---- group: Feed rate and pass depth adjustment (continued)
adjusted_feedrate = Panel(int_8)

# ----
classic_feed_rate = Panel(adjusted_feedrate)
classic_pass_depth = Panel(ajusted_pass_depth)
classic_plunge_rate = Panel(adjusted_plunge_rateod_plunge_rate)
filter_8 = StreamFilter(Gate=use_high_speed_maching_4, Stream0=classic_feed_rate, Stream1=high_speed_feedrate, Stream2=plunge_rough_rate)
filter_9 = StreamFilter(Gate=use_high_speed_maching_5, Stream0=classic_plunge_rate, Stream1=classic_plunge_rate, Stream2=plunge_rough_rate_2)
filter_10 = StreamFilter(
    Gate=use_high_speed_maching_6,
    Stream0=classic_pass_depth,
    Stream1=high_speed_pass_depth_2,
    Stream2=high_speed_pass_depth_2)
plunge_rate_3 = Number(filter_9)
pass_depth_3 = Number(filter_10)
feed_rate_3 = Integer(filter_8)
feed_rate_4 = ClusterOutput(feed_rate_3)
plunge_rate_4 = ClusterOutput(plunge_rate_3)
pass_depth_4 = ClusterOutput(pass_depth_3)

# ==== cluster CompileSettings: Compiles an overview of current milling settings. Nice for quickly checking your settings, or the output from the feedrate calculator, before running a job.
ramp_plunges = ClusterInput()
spindle_rpm = ClusterInput()
ramp_angle = ClusterInput()
plunge_rate = ClusterInput()
pass_depth = ClusterInput()
feed_rate = ClusterInput()
bit_type = ClusterInput()
bit_type_2 = Text(bit_type)
feed_rate_2 = Number(feed_rate)
plunge_rate_2 = Number(plunge_rate)
spindle_rpm_2 = Number(spindle_rpm)
pass_depth_2 = Number(pass_depth)
ramp_plunges_2 = Boolean(ramp_plunges)
ramp_angle_2 = Integer(ramp_angle)
int = Integer(plunge_rate_2)
int_2 = Integer(feed_rate_2)
int_3 = Integer(spindle_rpm_2)

# ---- group: Format for settings display
spindle_rpm_3 = Panel(int_3)
bit_type_3 = Panel(bit_type_2)
feed_rate_3 = Panel(int_2)
plunge_rate_3 = Panel(int)
pass_depth_3 = Panel(pass_depth_2)
ramp_plunges_3 = Panel(ramp_plunges_2)
ramp_angle_3 = Panel(ramp_angle_2)
join = TextJoin(Text=["Bit type: ", bit_type_3])
join_2 = TextJoin(Text=["Plunge rate: ", plunge_rate_3, " mm/s"])
join_3 = TextJoin(Text=["Feed rate: ", feed_rate_3, " mm/s"])
join_4 = TextJoin(Text=["Spindle speed: ", spindle_rpm_3, " RPM"])
join_5 = TextJoin(Text=["Ramp angle: ", "No ramping needed"])
join_6 = TextJoin(Text=["Pass depth: ", pass_depth_3, " mm"])
join_7 = TextJoin(Text=["Ramp angle: ", ramp_angle_3, " degrees"])

# ----
filter = StreamFilter(Gate=ramp_plunges_3, Stream0=join_5, Stream1=join_7)

# ---- group: Format for settings display (continued)
merge = Merge(
    Data1=" ",
    Data2=join,
    Data3=" ",
    Data4=join_3,
    Data5=" ",
    Data6=join_2,
    Data7=" ",
    Data8=join_4,
    Data9=" ",
    Data10=join_6,
    Data11=" ",
    Data12=filter)
merge_2 = Merge(Data1=join_3, Data2=" ", Data3=join_2, Data4=" ", Data5=join_6, Data6=" ", Data7=filter)

# ----
panel = Panel(merge_2)
panel_2 = Panel(merge)
complete_settings = ClusterOutput(panel_2)
crucial_settings = ClusterOutput(panel)

# ==== cluster FeedrateCalculatorForArcs: Compensates for the speed difference between the center of a bit and its outer edge when cutting in circular paths. Calculates a feedrate matching chipload and rpm. This speed difference is similar to how the wheels on a car spin at different speeds during a turn. Can take chip thining into account. Input the maxium stepover the tool will encounter. Normal pockets and profiles will have a full stepover of 1, while the Arc Based High speed milling givve constant low stepovers as speciified.
ramp_feed_reduction_factor = ClusterInput()
ramp_feed_reduction_factor_2 = Number(ramp_feed_reduction_factor)
arc_diameter_factor = ClusterInput()
milling_bit_diameter = ClusterInput()
number_of_flutes = ClusterInput()
max_stepover = ClusterInput()
spindle_rpm = ClusterInput()
chip_load = ClusterInput()
number_of_flutes_2 = Number(number_of_flutes)
milling_bit_diameter_2 = Number(milling_bit_diameter)
spindle_rpm_2 = Number(spindle_rpm)
max_stepover_2 = Number(max_stepover)
chip_load_2 = Number(chip_load)
arc_diameter_factor_2 = Number(arc_diameter_factor)
number_of_flutes_3 = Panel(number_of_flutes_2)
chip_load_3 = Panel(chip_load_2)
max_stepover_3 = Panel(max_stepover_2)
ramp_feedrate_reduction_factor = Panel(ramp_feed_reduction_factor_2)
arc_diameter_factor_3 = Panel(arc_diameter_factor_2)
spindle_rpm_3 = Panel(spindle_rpm_2)
milling_bit_diameter_3 = Panel(milling_bit_diameter_2)

multiplication = Multiplication(A=milling_bit_diameter_3, B=arc_diameter_factor_3)
subtraction = Subtraction(A=multiplication, B=milling_bit_diameter_3)
arc_diameter_at_bit_edge = Panel(multiplication)
arc_diameter_at_bit_center = Panel(subtraction)
division = Division(A=arc_diameter_at_bit_center, B=arc_diameter_at_bit_edge)
arc_feedrate_reduction_factor = Panel(division)

# ---- group: Calulate chip thining
larger = LargerThan(FirstNumber=max_stepover_3, SecondNumber="0.5")  # -> LargerThan, OrEqualTo
filter = StreamFilter(Gate=larger.LargerThan, Stream0=max_stepover_3, Stream1="0.5")
multiplication_2 = Multiplication(A=milling_bit_diameter_3, B=filter)
multiplication_3 = Multiplication(A="0.5", B=milling_bit_diameter_3)
subtraction_2 = Subtraction(A=multiplication_3, B=multiplication_2)
neg = Negative(Value=subtraction_2)
pt = ConstructPoint(XCoordinate=milling_bit_diameter_3, YCoordinate=neg, ZCoordinate=0)
pt_2 = ConstructPoint(XCoordinate=0, YCoordinate=neg, ZCoordinate=0)
xy = XYPlane(Origin=Point(0, 0, 0))
ln = Line(StartPoint=pt_2, EndPoint=pt)
cir = Circle(Plane=xy, Radius=multiplication_3)
ccx = CurveCurve(CurveA=cir, CurveB=ln)  # -> Points, ParamsA, ParamsB
pt_3 = ConstructPoint(XCoordinate=0, YCoordinate=0, ZCoordinate=0)
chip_load_4 = Panel(chip_load_3)
vec2pt = Vector2Pt(PointA=pt_3, PointB=ccx.Points, Unitize=False)  # -> Vector, Length
amp = Amplitude(Vector=vec2pt.Vector, Amplitude=chip_load_4)
move = Move(Geometry=ccx.Points, Motion=amp)  # -> Geometry, Transform
pdecon = Deconstruct(Point=move.Geometry)  # -> XComponent, YComponent, ZComponent
pt_4 = ConstructPoint(XCoordinate=0, YCoordinate=pdecon.YComponent, ZCoordinate=pdecon.ZComponent)
ln_2 = Line(StartPoint=move.Geometry, EndPoint=pt_4)
ccx_2 = CurveCurve(CurveA=cir, CurveB=ln_2)  # -> Points, ParamsA, ParamsB
dist = Distance(PointA=flatten(ccx_2.Points), PointB=flatten(move.Geometry))
move_distance_needed_for_chipload = Panel(dist)
chip_load_5 = Panel(chip_load_3)
division_2 = Division(A=move_distance_needed_for_chipload, B=chip_load_5)

# ---- group: Calculate feedrate
multiplication_4 = Multiplication(A=spindle_rpm_3, B=number_of_flutes_3)
multiplication_5 = Multiplication(A=multiplication_4, B=chip_load_3)
division_3 = Division(A=multiplication_5, B="60")
feedrate = Panel(division_3)

# ----
multiplication_6 = Multiplication(A=feedrate, B=arc_feedrate_reduction_factor)
arc_compensated_feedrate = Panel(multiplication_6)

# ---- group: Safatey in case of too extreme values
backup_feedrate_multiplaication_factor = Panel("2")
feedrate_multiplaication_factor = Panel(division_2)
null = NullItem(Item=ccx_2.Points)  # -> NullFlags, InvalidFlags, Description
filter_2 = StreamFilter(Gate=null.NullFlags, Stream0=feedrate_multiplaication_factor, Stream1=backup_feedrate_multiplaication_factor)

# ---- group: Visualize chip size
X = UnitX(Factor=dist)
ln_3 = Line(StartPoint=ccx.Points, EndPoint=pt)
ln_4 = Line(StartPoint=ccx.Points, EndPoint=move.Geometry)
move_2 = Move(Geometry=cir, Motion=X)  # -> Geometry, Transform
chip_load_cross_section = Curve(ln_4)
new_bit_position = Curve(move_2.Geometry)
old_bit_position = Curve(cir)
material_edge = Curve(ln_3)

# ----
panel = Panel("Stepover to small or chipload to high. Unable to compute optimal feedrate multiplication factor.")
filter_3 = StreamFilter(Gate=null.NullFlags, Stream0="All good", Stream1=panel)
ramp_feedrate_reduction_factor_2 = Panel(ramp_feedrate_reduction_factor)
feedrate_multiplication_factor = Panel(filter_2)
feedrate_2 = Panel(arc_compensated_feedrate)
feedback = Panel(filter_3)
multiplication_7 = Multiplication(A=feedrate_2, B=feedrate_multiplication_factor)
multiplication_8 = Multiplication(A=multiplication_7, B=ramp_feedrate_reduction_factor_2)
feedback_2 = Text(feedback)
int = Integer(multiplication_7)
int_2 = Integer(multiplication_8)
feedback_3 = ClusterOutput(feedback_2)
arc_compensated_feedrate_2 = Number(int)
ramp_feedrate = Number(int_2)
ramp_feedrate_2 = ClusterOutput(ramp_feedrate)
arc_compensated_feedrate_3 = ClusterOutput(arc_compensated_feedrate_2)
