# Grasshopper definition clipper based pocket.gh (Grasshopper 0.9.76)
# plug-ins: ClipperComponents

pocket_curves = Curve([<curve referenced from the Rhino model> x4])
milling_bit_diamter = Panel("6")
stepover = Panel("0.48")
voronoi_sample_ratio = Panel(".5")
tolerance = Panel("0.01")
multiplication = Multiplication(A=milling_bit_diamter, B=stepover)
multiplication_2 = Multiplication(A=milling_bit_diamter, B="0.5")
multiplication_3 = Multiplication(A=milling_bit_diamter, B=voronoi_sample_ratio)

# ---- group: Separete cicrles from curves (for v-carving)
circle = Circle(pocket_curves)  # disabled
null = NullItem(Item=circle)  # -> NullFlags, InvalidFlags, Description; disabled
dispatch = Dispatch(List=pocket_curves, DispatchPattern=null.NullFlags)  # -> ListA, ListB; disabled
ciircles_to_drill = Curve(dispatch.ListB)  # disabled
curves_to_v_carve = Curve(dispatch.ListA)  # disabled

# ----
stepover_distance = Panel(multiplication)
milling_bit_radius = Panel(multiplication_2)
samling_distance = Panel(multiplication_3)

# ---- group: Identify individual objects to mill
# Remeber to cull duplicates to avoid super slow solution!
# use clipper boolean?
# Check for intersections?
boundary = BoundarySurfaces(Edges=flatten(pocket_curves))
sunion = SolidUnion(Breps=boundary)
fmerge = MergeFaces(Brep=sunion)  # -> Breps, Before, After
wires = BrepWireframe(Brep=fmerge.Breps, Density=-1)
join = JoinCurves(Curves=wires, Preserve=False)
simplify = SimplifyTree(Tree=join, Front=False)
pocket_surfaces = Surface(fmerge.Breps)
curves = Curve(simplify)

# ---- group: Sort curves for inside and outside cutting
bbox = BoundingBox(Content=curves, Plane=PlaneXY(0, 0, 0), UnionBox=False)  # -> Box, Box_2
area = Area(Geometry=bbox.Box)  # -> Area, Centroid
sort = SortList(Keys=area.Area, ValuesA=curves)  # -> Keys, ValuesA
rev = ReverseList(List=sort.ValuesA)
cull_i = CullIndex(List=rev, Indices="0", Wrap=True)
item = ListItem(List=rev, Index="0", Wrap=True)
inner_curves = Curve(cull_i)
outer_curves = Curve(item)

# ---- group: Shatter curves at corners and shatter closed curves
curves_to_voronoi = Curve(curves)
disc = Discontinuity(Curve=curves_to_voronoi, Level=1)  # -> Points, Parameters
lng = ListLength(List=disc.Parameters)
smaller = SmallerThan(FirstNumber=lng, SecondNumber="1")  # -> SmallerThan, OrEqualTo
weave = Weave(Pattern=smaller.SmallerThan, Stream0=disc.Parameters, Stream1="0", NullGaps=False)
shatter = Shatter(Curve=graft(curves_to_voronoi), Parameters=weave)
shattered_toolpath_curves = Curve(shatter)

# ---- group: Divide curve and make voronoi pattern
divide_curve_even_lenght = DivideCurveEvenLenght(crv=shattered_toolpath_curves, B=samling_distance)
pshift = ShiftPaths(Data=divide_curve_even_lenght, Offset=-1)
pshift_2 = ShiftPaths(Data=pshift, Offset=-1)
pshift_3 = ShiftPaths(Data=pshift_2, Offset=-1)
cullpt = CullDuplicates(Points=pshift_3, Tolerance=tolerance, CullMode=1)  # -> Points, Indices, Valence
voronoi = Voronoi(Points=cullpt.Points, BruteForceOverride=False)
points_used_in_voronoi = Point(cullpt.Points)
voronoied_stuff = Curve(voronoi)

# ---- group: Find the voronoi points inside pocket areas
explode = Explode(Curve=voronoied_stuff, Recursive=True)  # -> Segments, Vertices
pocket_surfaces_2 = Surface(graft(pocket_surfaces))
pshift_4 = ShiftPaths(Data=explode.Segments, Offset=-1)
end = EndPoints(Curve=pshift_4)  # -> Start, End
srf_cp = SurfaceClosestPoint(Point=end.Start, Surface=pocket_surfaces_2)  # -> Point, UVPoint, Distance
larger = LargerThan(FirstNumber=srf_cp.Distance, SecondNumber="0.01")  # -> LargerThan, OrEqualTo
dispatch_2 = Dispatch(List=end.Start, DispatchPattern=larger.LargerThan)  # -> ListA, ListB

# ---- group: Find the point that is the furthes from the edge and the distance. This distance can be used to calculted how many offets are needed
voronoi_intersection_points_inside = Point(dispatch_2.ListB)
points_used_to_make_voronoi = Point(points_used_in_voronoi)
simplify_2 = SimplifyTree(Tree=voronoi_intersection_points_inside, Front=False)
simplify_3 = SimplifyTree(Tree=points_used_to_make_voronoi, Front=False)
cp = ClosestPoint(Point=simplify_2, Cloud=simplify_3)  # -> ClosestPoint, CPIndex, Distance
sort_2 = SortList(Keys=cp.Distance, ValuesA=simplify_2)  # -> Keys, ValuesA
rev_2 = ReverseList(List=sort_2.Keys)
rev_3 = ReverseList(List=sort_2.ValuesA)
item_2 = ListItem(List=rev_2, Index=0, Wrap=True)
item_3 = ListItem(List=rev_3, Index=0, Wrap=True)
point_furtest_from_any_edge = Point(item_3)
distance_from_edge = Panel(item_2)

# ----
distance_from_edge_2 = Panel(distance_from_edge)
milling_bit_radius_2 = Panel(milling_bit_radius)
stepover_distance_2 = Panel(stepover_distance)
point_furtest_from_any_edge_2 = Point(point_furtest_from_any_edge)
tolerance_2 = Panel(tolerance)
pocket_surfaces_3 = Surface(graft(pocket_surfaces))
curves_2 = Curve(curves)

# ---- group: Fileter away pockets that are too small for the bit to fit inside
smaller_2 = SmallerThan(FirstNumber=distance_from_edge_2, SecondNumber=milling_bit_radius_2)  # -> SmallerThan, OrEqualTo
dispatch_3 = Dispatch(List=curves_2, DispatchPattern=smaller_2.SmallerThan)  # -> ListA, ListB
dispatch_4 = Dispatch(List=pocket_surfaces_3, DispatchPattern=smaller_2.SmallerThan)  # -> ListA, ListB
dispatch_5 = Dispatch(List=distance_from_edge_2, DispatchPattern=smaller_2.SmallerThan)  # -> ListA, ListB
dispatch_6 = Dispatch(List=point_furtest_from_any_edge_2, DispatchPattern=smaller_2.SmallerThan)  # -> ListA, ListB

# ---- group: Solve how many offsets are need for each pocket
distance_from_edge_3 = Panel(dispatch_5.ListB)
subtraction = Subtraction(A=distance_from_edge_3, B=milling_bit_radius_2)
division = Division(A=subtraction, B=stepover_distance_2)
round = Round(Number=division)  # -> Nearest, Floor, Ceiling
series = Series(Start=milling_bit_radius_2, Step=stepover_distance_2, Count=round.Ceiling)

# ---- group: Do the offsetting magic with clipper. This creates the onion layer toolpaths
topoly = CurveToPolyline(Curve=dispatch_3.ListB, ToleranceDistance=tolerance_2, ToleranceAngle=0)  # -> Polyline, Segments
multiplication_4 = Multiplication(A=tolerance_2, B="0.5")
polyoffset = PolylineOffset(
    Polylines=topoly.Polyline,
    Distance=series,
    Plane=Plane(origin=(0, 0, 0), x=(0, 0, 0), y=(0, 0, 0)),
    Tolerance=multiplication_4,
    ClosedFillet=0,
    OpenFillet=0,
    Miter=2)  # -> Contour, Holes

# ---- group: Format offset lists to help select the correct polylines
merge = Merge(Data1=polyoffset.Contour, Data2=polyoffset.Holes)
end_2 = EndPoints(Curve=merge)  # -> Start, End
lng_2 = ListLength(List=pocket_surfaces)
simplify_4 = SimplifyTree(Tree=merge, Front=False)
simplify_5 = SimplifyTree(Tree=end_2.Start, Front=False)
larger_2 = LargerThan(FirstNumber=lng_2, SecondNumber="1")  # -> LargerThan, OrEqualTo
pshift_5 = ShiftPaths(Data=simplify_4, Offset=-1)
pshift_6 = ShiftPaths(Data=simplify_5, Offset=-1)
filter = StreamFilter(Gate=larger_2.LargerThan, Stream0=simplify_4, Stream1=pshift_5)
filter_2 = StreamFilter(Gate=larger_2.LargerThan, Stream0=simplify_5, Stream1=pshift_6)

# ---- group: Select th polylines that are on the correct side off the edges
srf_cp_2 = SurfaceClosestPoint(Point=filter_2, Surface=dispatch_4.ListB)  # -> Point, UVPoint, Distance
larger_3 = LargerThan(FirstNumber=srf_cp_2.Distance, SecondNumber="0.01")  # -> LargerThan, OrEqualTo
dispatch_7 = Dispatch(List=filter, DispatchPattern=larger_3.LargerThan)  # -> ListA, ListB
crv = Curve(dispatch_7.ListB)

# ---- group: Optimze by removing unecceary points
simplify_6 = SimplifyTree(Tree=crv, Front=False)
redpline = Reduce(Polyline=simplify_6, Tolerance=tolerance_2)  # -> Polyline, Reduction

# ---- group: A rough attempt at optimzing cut order. Most important is to start inside and cur the outermost path last
point_furtest_from_any_edge_3 = Point(dispatch_6.ListB)
# Check length of first curve and swap order if very short? ( in case of ramping in aluminium)
end_3 = EndPoints(Curve=redpline.Polyline)  # -> Start, End
dist = Distance(PointA=end_3.Start, PointB=point_furtest_from_any_edge_3)
sort_3 = SortList(Keys=dist, ValuesA=redpline.Polyline)  # -> Keys, ValuesA

# ----
# 48% offset ssems to be max for stable results.
# divide toolapth and iso vist 90 deg to check if an area will be uncleared and the do more offset?
# 
# or do twice as many offsets as needed when steopver is aboive 48%, then cull the uneccessary paths?
# 
# also "dogbones" must be added in corners when stepover is above 50%
number_slider = Slider(0, range=0..10)
item_4 = ListItem(List=sort_3.ValuesA, Index=number_slider, Wrap=True)
end_4 = EndPoints(Curve=item_4)  # -> Start, End
pocket_toolpaths = Curve(sort_3.ValuesA)

# ==== cluster DivideCurveEvenLenght: Calculates approximate curve length for even division
crv = ClusterInput()
crv_2 = Curve(crv)
B = ClusterInput()
len = Length(Curve=crv_2)
division = Division(A=len, B=B)
round = Round(Number=division)  # -> Nearest, Floor, Ceiling
divide = DivideCurve(Curve=crv_2, Count=round.Ceiling, Kinks=False)  # -> Points, Tangents, Parameters
P = ClusterOutput(divide.Points)
