# Grasshopper definition BarkBeetle1 - Simple ShopBot turning.gh (Grasshopper 1.0.7)
# Copyright: Creative commons BY-SA
# Copyright: Creative Commons BY-SA
# Copyright: none

# ---- group: Stock settings
# MAIN SETTINGS
stock_diameter = Panel("35")
stock_length = Panel("93")

# ---- group: Trace turning settings
cut_depth = Panel("4")
pass_depth = Panel(".3")
feedrate_mm_s = Panel("5")
plungerate_mm_s = Panel("2")
turning_spindle_speed = Panel("700")

# ---- group: Thread turning settings
cut_depth_2 = Panel("1")
pass_depth_2 = Panel(".05")
feedrate_mm_s_2 = Panel("60")
plungerate_mm_s_2 = Panel("60")
threading_pitch = Panel("2.5")

# ----
division = Division(A=stock_diameter, B="2")
# POST PROCESSOR SETTINGS
custom_start_g_code = Panel("""$H					;run GRBL homing cycle
G92 X-24.5 Y-2.5 Z0    ;set the difference between homing location and where we want X and X home postion to be
G0 X-24.5 Z-85		;quickly jog to a good postion to start probing. X is important, Z negative is just to save some time
G38.2 F200 Z-300	;start probing downwards
G92 Z0				;make probe surface Z zero
G0 Z1				;move up 1 mm
G38.2 F50 Z-100		;probe again with extra slow speed for maximum precision
G92 Z0				;make probe surface Z zero again
G0 Z16.2				;move to the height of the bed
G92 Z0				;make bed height Z zero""")
custom_start_g_code_2 = CustomStartGCode(custom_start_code=custom_start_g_code)
deviation_tolerance = Slider(0.01, range=0.01..0.1)

# ---- group: ShopBot PostProcessor settings
make_shopbot_code_not_g_code = BooleanToggle(True)
custom_start_g_code_3 = Panel(custom_start_g_code_2)
custom_start_sbp_code = Panel("")
custom_end_g_code = Panel("MI, O")
custom_end_sbp_code = Panel("""END
Canceljob:	'define the name of the sub routine
	MSGBOX (Please specificy the correct material thickness in you CAM program and try again,16,Shame on you)	'define the message box of shame
END	'end the job""")
thread_turning_tool_offset_z = Panel("-8")
thread_turning_tool_offset_x = Panel("42")
thread_turning_tool_offset_y = Panel("10.5")
safe_z_height = Panel("10")
jog_rate_xy_mm_s = Panel("50")
jog_rate_z_mm_s = Panel("20")
end_of_job_go_to_x_position = Panel("100")
end_of_job_go_to_y_position = Panel("100")
deviation_tolerance_2 = Panel(deviation_tolerance)
include_start_code = BooleanToggle(False)
toolpath_streaming_folder = FilePath("C:\Users\Siemen\Dropbox\Fellesverkstedet Siemen\09_Bark Beetle stream\")
use_spindle = BooleanToggle(True)
include_end_code = BooleanToggle(True)
stream_contents = BooleanToggle(True)

# ----
z_zero_is_at_bottom_of_stock = BooleanToggle(False)

# ---- group: CNC thread trace input geometery
pipeline = GeometryPipeline(
    GroupByLayer=False,
    GroupByType=False,
    IncludeHidden=True,
    IncludeLocked=True,
    LayerFilter="CNC turn - trace",
    NameFilter="*",
    SublayerFiltering=False,
    TypeFilter=4)
# GEOMETRY INPUT
turn_trace_curves = Curve(<curve referenced from the Rhino model>)

# ---- group: CNC turn thread input geometery
pipeline_2 = GeometryPipeline(
    GroupByLayer=False,
    GroupByType=False,
    IncludeHidden=True,
    IncludeLocked=True,
    LayerFilter="CNC turn - thread",
    NameFilter="*",
    SublayerFiltering=False,
    TypeFilter=4)
turn_thread_curves = Curve(<curve referenced from the Rhino model>)

# ----
addition = Addition(SafeZHeight=safe_z_height, MaterialThickness=division)
custom_start_sbp_code_2 = CustomStartSBPCode(safe_z_height=addition)
filter = StreamFilter(Gate=make_shopbot_code_not_g_code, Stream0=custom_start_g_code_3, Stream1=custom_start_sbp_code)
filter_2 = StreamFilter(Gate=make_shopbot_code_not_g_code, Stream0=custom_end_g_code, Stream1=custom_end_sbp_code)
filter_3 = StreamFilter(Gate=include_start_code, Stream1=filter)
filter_4 = StreamFilter(Gate=include_end_code, Stream1=filter_2)

# ---- group: Move curves to the coordinates of the turning tool and make passdepths
thread_turning_tool_offset_x_2 = Panel(thread_turning_tool_offset_x)
thread_turning_tool_offset_y_2 = Panel(thread_turning_tool_offset_y)
thread_turning_tool_offset_z_2 = Panel(thread_turning_tool_offset_z)
cnc_line_engrave_curves = Curve(reparameterize(flatten([pipeline_2, turn_thread_curves])))
X = UnitX(Factor=thread_turning_tool_offset_x_2)
move = Move(Geometry=cnc_line_engrave_curves, Motion=X)  # -> Geometry, Transform
Y = UnitY(Factor=thread_turning_tool_offset_y_2)
Z = UnitZ(Factor=thread_turning_tool_offset_z_2)
move_2 = Move(Geometry=move.Geometry, Motion=Y)  # -> Geometry, Transform
move_3 = Move(Geometry=move_2.Geometry, Motion=Z)  # -> Geometry, Transform
engrave = Engrave(engrave_curves=move_3.Geometry, cut_depth=cut_depth_2, pass_depth=pass_depth_2)

# ----
cnc_line_engrave_curves_2 = Curve(reparameterize(flatten([pipeline, turn_trace_curves])))
engrave_2 = Engrave(engrave_curves=cnc_line_engrave_curves_2, cut_depth=cut_depth, pass_depth=pass_depth)

job_name = Panel("Bark beetle - trace turning stream")
job_name_2 = Panel("Bark beetle - thread turning stream")
shopbot_cnc_turning_postprocessor = CNCMillingPostProcessor(
    toolpath_curves=engrave_2,
    feed_rate=feedrate_mm_s,
    plunge_rate=plungerate_mm_s,
    jog_rate=jog_rate_xy_mm_s,
    jog_rate_z=jog_rate_z_mm_s,
    safe_z_height=addition,
    use_spindle=use_spindle,
    thread_pitch=turning_spindle_speed,
    ramp_plunges=0,
    ramp_angle=25,
    start_code=filter_3,
    end_code=filter_4,
    make_shopbot_code_not_g_code=make_shopbot_code_not_g_code,
    end_of_job_go_to_x=end_of_job_go_to_x_position,
    end_of_job_go_to_y=end_of_job_go_to_y_position,
    deviation_tolerance=deviation_tolerance_2,
    use_high_speed_machining=0,
    milling_bit_diameter=6,
    toolpath_width_factor=2.3,
    stepover=0.1,
    use_peck_entry=False,
    z_zero_is_at_bottom_of_stock=z_zero_is_at_bottom_of_stock,
    material_thickness=division,
    job_name=job_name)  # -> g_code_stream, g_code_for_tab_cleanup, toolpath_preview_curves_2, tab_cleanup_preview_curves_2, cut_transition_preview_lines_2, cut_entry_preview_lines_2, cut_exit_preview_lines_2
trace_turning_job = Panel(shopbot_cnc_turning_postprocessor.g_code_stream)
shopbot_cnc_turn_threading_postprocessor = CNCMillingPostProcessor_2(
    toolpath_curves=engrave,
    feed_rate=feedrate_mm_s_2,
    plunge_rate=plungerate_mm_s_2,
    jog_rate=jog_rate_xy_mm_s,
    jog_rate_z=jog_rate_z_mm_s,
    safe_z_height=addition,
    use_spindle=use_spindle,
    thread_pitch=18000,
    ramp_plunges=0,
    ramp_angle=25,
    start_code=filter_3,
    end_code=filter_4,
    make_shopbot_code_not_g_code=make_shopbot_code_not_g_code,
    end_of_job_go_to_x=end_of_job_go_to_x_position,
    end_of_job_go_to_y=end_of_job_go_to_y_position,
    deviation_tolerance=deviation_tolerance_2,
    use_high_speed_machining=0,
    milling_bit_diameter=6,
    toolpath_width_factor=2.3,
    stepover=0.1,
    use_peck_entry=False,
    z_zero_is_at_bottom_of_stock=z_zero_is_at_bottom_of_stock,
    material_thickness=division,
    job_name=job_name_2)  # -> g_code_stream, g_code_for_tab_cleanup, toolpath_preview_curves_2, tab_cleanup_preview_curves_2, cut_transition_preview_lines_2, cut_entry_preview_lines_2, cut_exit_preview_lines_2
thread_turning_job = Panel(shopbot_cnc_turn_threading_postprocessor.g_code_stream)

# ---- group: Compensate for offset for the threading tool
thread_turning_tool_offset_x_3 = Panel(thread_turning_tool_offset_x)
thread_turning_tool_offset_y_3 = Panel(thread_turning_tool_offset_y)
thread_turning_tool_offset_z_3 = Panel(thread_turning_tool_offset_z)
neg = Negative(Value=thread_turning_tool_offset_x_3)
X_2 = UnitX(Factor=neg)
neg_2 = Negative(Value=thread_turning_tool_offset_y_3)
neg_3 = Negative(Value=thread_turning_tool_offset_z_3)
move_4 = Move(Geometry=shopbot_cnc_turn_threading_postprocessor.toolpath_preview_curves_2, Motion=X_2)  # -> Geometry, Transform
Y_2 = UnitY(Factor=neg_2)
Z_2 = UnitZ(Factor=neg_3)
move_5 = Move(Geometry=move_4.Geometry, Motion=Y_2)  # -> Geometry, Transform
move_6 = Move(Geometry=move_5.Geometry, Motion=Z_2)  # -> Geometry, Transform

# ---- group: Make stock preview
xz = XZPlane(Origin=Point(0, 0, 0))
stock_radius = Panel(division)
stock_length_2 = Panel(stock_length)
pln = Plane(xz)
deplane = DeconstructPlane(Plane=pln)  # -> Origin, XAxis, YAxis, ZAxis
cir = Circle(Plane=pln, Radius=stock_radius)
amp = Amplitude(Vector=deplane.ZAxis, Amplitude=stock_length_2)
rev = Reverse(Vector=amp)
panel = Panel("""0
90
180
270""")
end = EndPoints(Curve=cir)  # -> Start, End
move_7 = Move(Geometry=cir, Motion=rev)  # -> Geometry, Transform
end_2 = EndPoints(Curve=move_7.Geometry)  # -> Start, End
ln = Line(StartPoint=end.Start, EndPoint=end_2.Start)
rotate = Rotate(Geometry=ln, Angle=degrees(panel), Plane=pln)  # -> Geometry, Transform
stock_curves = Curve([move_7.Geometry, cir, rotate.Geometry])
swatch = ColourSwatch(SwatchColor=RGB(161, 247, 255))
swatch_2 = ColourSwatch(SwatchColor=RGB(161, 247, 255))
tag = TextTag3D(Location=pln, Text=" X,Y,Z 0", Size=1.5, Colour=swatch_2, Justification=7)
dots = DotDisplay(Point=deplane.Origin, Colour=swatch_2, Size=0.4)
preview = CustomPreview(Geometry=stock_curves, Shader=swatch_2)

# ---- group: Trace G-code
stream_and_save_as_code = Panel(shopbot_cnc_turning_postprocessor.g_code_stream)

# ---- group: Thread G-code
stream_and_save_as_code_2 = Panel(shopbot_cnc_turn_threading_postprocessor.g_code_stream)

# ----
stream_code = FileCreator(name="3 Engrave - Bark beetle", lines=stream_and_save_as_code_2)  # inputs lines: list, write: Boolean
#   port name: Desired file name.
# ---------- stream_code: Python ----------
#Tweaked by Siemen Cuypers / 2019

ghenv.Component.Name = "File Creator"

import rhinoscriptsyntax as rs
import Grasshopper as gh

# Set varible to desired folder path
def Export(ext):
    
    dir = path
    txt = name + "." + ext
    
    if dir:
        file=str(dir)+ '\\' + txt
    filePath = open(file, "w") # Open the file
    for line in lines: # Iterate through lines
        filePath.write(line + "\n") # Write separate lines
    filePath.close() # Close the file

if write:
    if path:
        Export(ext)
    else:
        msg = "Set directory path for streaming"
        ghenv.Component.AddRuntimeMessage(gh.Kernel.GH_RuntimeMessageLevel.Warning, msg)
else:
    msg = "Set 'write' to True for streaming"
    ghenv.Component.AddRuntimeMessage(gh.Kernel.GH_RuntimeMessageLevel.Warning, msg)
# ---------- end stream_code ----------
stream_code_2 = FileCreator(name="3 Engrave - Bark beetle", lines=stream_and_save_as_code)  # inputs lines: list, write: Boolean; same code as stream_code

# ---- group: Toolpath preview
color_of_toolpaths = ColourSwatch(SwatchColor=RGB(0, 255, 149))
color_of_toolpaths_when_inside_cutting_i = ColourSwatch(SwatchColor=RGB(255, 61, 155))  # "Color of toolpaths when inside cutting is on"
cut_transition_preview_lines = Curve(shopbot_cnc_turn_threading_postprocessor.cut_transition_preview_lines_2)
cut_entry_preview_lines = Curve(shopbot_cnc_turn_threading_postprocessor.cut_entry_preview_lines_2)
cut_exit_preview_lines = Curve(shopbot_cnc_turn_threading_postprocessor.cut_exit_preview_lines_2)
engrave_toolpaths = Curve(move_6.Geometry)
jog_transitions = ColourSwatch(SwatchColor=RGB(71, 61, 38))
cut_entries = ColourSwatch(SwatchColor=RGB(145, 193, 194))
filter_5 = StreamFilter(Gate=0, Stream0=color_of_toolpaths, Stream1=color_of_toolpaths_when_inside_cutting_i)
cut_exits = ColourSwatch(SwatchColor=RGB(61, 88, 89))
preview_2 = CustomPreview(Geometry=cut_transition_preview_lines, Shader=jog_transitions)
preview_3 = CustomPreview(Geometry=cut_entry_preview_lines, Shader=cut_entries)
preview_4 = CustomPreview(Geometry=cut_exit_preview_lines, Shader=cut_exits)
preview_5 = CustomPreview(Geometry=engrave_toolpaths, Shader=filter_5)

color_of_toolpaths_2 = ColourSwatch(SwatchColor=RGB(0, 255, 238))
color_of_toolpaths_when_inside_cutting_i_2 = ColourSwatch(SwatchColor=RGB(255, 61, 155))  # "Color of toolpaths when inside cutting is on"
cut_transition_preview_lines_2 = Curve(shopbot_cnc_turning_postprocessor.cut_transition_preview_lines_2)
cut_entry_preview_lines_2 = Curve(shopbot_cnc_turning_postprocessor.cut_entry_preview_lines_2)
cut_exit_preview_lines_2 = Curve(shopbot_cnc_turning_postprocessor.cut_exit_preview_lines_2)
engrave_toolpaths_2 = Curve(shopbot_cnc_turning_postprocessor.toolpath_preview_curves_2)
jog_transitions_2 = ColourSwatch(SwatchColor=RGB(71, 61, 38))
cut_entries_2 = ColourSwatch(SwatchColor=RGB(145, 193, 194))
cut_exits_2 = ColourSwatch(SwatchColor=RGB(61, 88, 89))
filter_6 = StreamFilter(Gate=0, Stream0=color_of_toolpaths_2, Stream1=color_of_toolpaths_when_inside_cutting_i_2)
preview_6 = CustomPreview(Geometry=cut_transition_preview_lines_2, Shader=jog_transitions_2)
preview_7 = CustomPreview(Geometry=cut_entry_preview_lines_2, Shader=cut_entries_2)
preview_8 = CustomPreview(Geometry=cut_exit_preview_lines_2, Shader=cut_exits_2)
preview_9 = CustomPreview(Geometry=engrave_toolpaths_2, Shader=filter_6)

# ---- group: Create start point and direction arrows
start_arrow_length = Panel("2")
start_arrow_pixel_width = Panel("3")
eval = EvaluateLength(Curve=engrave_toolpaths, Length=0, Normalized=True)  # -> Point, Tangent, Parameter
amp_2 = Amplitude(Vector=eval.Tangent, Amplitude=start_arrow_length)
vdisex = VectorDisplayEx(Point=eval.Point, Vector=amp_2, Colour=filter_5, Width=start_arrow_pixel_width)
vdisex_2 = VectorDisplayEx(Colour=RGB(0, 0, 0), Width=start_arrow_pixel_width)

start_arrow_length_2 = Panel("2")
start_arrow_pixel_width_2 = Panel("3")
eval_2 = EvaluateLength(Curve=engrave_toolpaths_2, Length=0, Normalized=True)  # -> Point, Tangent, Parameter
amp_3 = Amplitude(Vector=eval_2.Tangent, Amplitude=start_arrow_length_2)
vdisex_3 = VectorDisplayEx(Point=eval_2.Point, Vector=amp_3, Colour=filter_6, Width=start_arrow_pixel_width_2)
vdisex_4 = VectorDisplayEx(Colour=RGB(0, 0, 0), Width=start_arrow_pixel_width_2)

# ==== cluster Engrave: Creates toolpaths with pass depths from 2D and 3D curves. Handy for making your own freestyle toolpaths. Be careful about start depths of your curves. Pass depth and cut depth assumes your input curve starts at surface level (Z0).
engrave_curves = ClusterInput()
pass_depth = ClusterInput()
cut_depth = ClusterInput()
engrave_curves_2 = Curve(engrave_curves)
pass_depth_2 = Number(pass_depth)
cut_depth_2 = Number(cut_depth)
pass_depth_3 = Panel(pass_depth_2)
cut_depth_line_engrave = Panel(cut_depth_2)
division = Division(A=cut_depth_line_engrave, B=pass_depth_3)
round = Round(Number=division)  # -> Nearest, Floor, Ceiling
division_2 = Division(A=cut_depth_line_engrave, B=round.Ceiling)
actual_pass_depth = Panel(division_2)
series = Series(Start=actual_pass_depth, Step=actual_pass_depth, Count=round.Ceiling)
neg = Negative(Value=series)
null = NullItem(Item=division_2)  # -> NullFlags, InvalidFlags, Description
filter = StreamFilter(Gate=null.NullFlags, Stream0=neg, Stream1="0")
Z = UnitZ(Factor=filter)
move = Move(Geometry=graft(engrave_curves_2), Motion=Z)  # -> Geometry, Transform
flatten = FlattenTree(Tree=move.Geometry, Path="{0}")
clean = CleanTree(RemoveNulls=True, RemoveInvalid=True, RemoveEmpty=False, Tree=flatten)
engrave_toolpaths = Curve(clean)
engrave_toolpaths_2 = ClusterOutput(engrave_toolpaths)

# ==== cluster CustomStartGCode
material_thicness = ClusterInput()
custom_start_code = ClusterInput()
material_thicness_2 = Number(material_thicness)
start_code_fom_external_file = Panel(custom_start_code)
material_thicness_3 = Panel(material_thicness_2)
merge = Merge(Data1="G0 Z", Data2=material_thicness_3, Data3=" ;jog to material height")
join = TextJoin(Text=merge)
merge_2 = Merge(Data1=flatten(start_code_fom_external_file), Data2=flatten(join), Data3=flatten("G92 Z0 ; make top of material Z zero"))
panel = Panel(merge_2)
start_code = Text(panel)
start_code_2 = ClusterOutput(start_code)

# ==== cluster CNCMillingPostProcessor: Converts toolpath curves into coordinates that a CNC machine can read. Use tab boxes for making safe cutouts, and ramps for smooth entry into hard materials.
make_shopbot_code_not_g_code = ClusterInput()
z_zero_is_at_bottom_of_stock = ClusterInput()  # Is Z zero postion at bottom or top of staock
use_high_speed_machining = ClusterInput()  # 0=off 1=Trochoidal 2=Plunge roughing
toolpath_width_factor = ClusterInput()
milling_bit_diameter = ClusterInput()
deviation_tolerance = ClusterInput()
end_of_job_go_to_x = ClusterInput()
end_of_job_go_to_y = ClusterInput()
material_thickness = ClusterInput()  # Used to create correct Z height for toolpaths when Z zero is at stock bottom
toolpath_curves = ClusterInput()
use_peck_entry = ClusterInput()
ramp_plunges = ClusterInput()
thread_pitch = ClusterInput()
safe_z_height = ClusterInput()
ramp_angle = ClusterInput()
use_spindle = ClusterInput()
plunge_rate = ClusterInput()
start_code = ClusterInput()  # Add a suitable start code for your machine here
tab_breps = ClusterInput()
jog_rate_z = ClusterInput()
job_name = ClusterInput()
feed_rate = ClusterInput()
end_code = ClusterInput()  # Add a suitable end code for your machine here
stepover = ClusterInput()
jog_rate = ClusterInput()

# ---- group: Additional settings
spindle_startup_time_g_code = Panel("5")
max_peck_depth_factor_plunge_roughing = Panel("0.4")
number_of_decimal_places = Panel("3")

# ----
toolpath_curves_2 = Curve(toolpath_curves)
tab_breps_2 = Brep(tab_breps)
feed_rate_2 = Number(feed_rate)
plunge_rate_2 = Number(plunge_rate)
jog_rate_2 = Number(jog_rate)
jog_rate_z_2 = Number(jog_rate_z)
safe_z_height_2 = Number(safe_z_height)
use_spindle_2 = Integer(use_spindle)
ramp_plunges_2 = Integer(ramp_plunges)
ramp_angle_2 = Number(ramp_angle)
start_code_2 = Text(start_code)
end_code_2 = Text(end_code)
make_shopbot_code_not_g_code_2 = Boolean(make_shopbot_code_not_g_code)
end_of_job_go_to_x_2 = Number(end_of_job_go_to_x)
end_of_job_go_to_y_2 = Number(end_of_job_go_to_y)
deviation_tolerance_2 = Number(deviation_tolerance)
use_high_speed_machining_2 = Integer(use_high_speed_machining)
milling_bit_diameter_2 = Number(milling_bit_diameter)
toolpath_width_factor_2 = Number(toolpath_width_factor)
stepover_2 = Number(stepover)
use_peck_entry_2 = Boolean(use_peck_entry)
z_zero_is_at_bottom_of_stock_2 = Boolean(z_zero_is_at_bottom_of_stock)
material_thickness_2 = Number(material_thickness)
job_name_2 = Text(job_name)
thread_pitch_2 = Number(thread_pitch)

flatten = FlattenTree(Tree=tab_breps_2, Path="{0}")
flatten_2 = FlattenTree(Tree=toolpath_curves_2, Path="{0}")

# ---- group: Convert speeds from mm per seond to mm per minute for g-code
seconds_in_a_minute = Panel("60")
multiplication = Multiplication(A=feed_rate_2, B=seconds_in_a_minute)
multiplication_2 = Multiplication(A=plunge_rate_2, B=seconds_in_a_minute)
multiplication_3 = Multiplication(A=jog_rate_2, B=seconds_in_a_minute)
multiplication_4 = Multiplication(A=jog_rate_z_2, B=seconds_in_a_minute)
feed_rate_in_mm_m = Number(multiplication)
plunge_rate_in_mm_m = Number(multiplication_2)
jog_rate_x_y_in_mm_m = Number(multiplication_3)
jog_rate_z_in_mm_m = Number(multiplication_4)

# ---- group: Make G-Code spindle start
spindle_speed = Number(thread_pitch_2)
use_spindle_3 = Integer(use_spindle_2)
spindle_startup_time_g_code_2 = Panel(spindle_startup_time_g_code)
int = Integer(spindle_speed)
merge = Merge(Data1="M3 S", Data2=int, Data3=" ; start spindle and set spindle speed")
merge_2 = Merge(Data1="G4 P", Data2=spindle_startup_time_g_code_2, Data3=" ;wait a few seconds for the spindle to start")
join = TextJoin(Text=merge)
join_2 = TextJoin(Text=merge_2)
merge_3 = Merge(Data1=flatten(join), Data2=flatten(join_2))
filter = StreamFilter(Gate=use_spindle_3, Stream1=merge_3)
g_code_spindle_start = Panel(filter)

# ---- group: Find virtual bit diamter for trochoidal milling
multiplication_5 = Multiplication(A=milling_bit_diameter_2, B=toolpath_width_factor_2)
trochoidal_milling_bit_diameter = Number(multiplication_5)

# ---- group: Add prefix to shopbot job name
join_3 = TextJoin(Text=flatten(["'", job_name_2]))

# ----
clean = CleanTree(RemoveNulls=True, RemoveInvalid=True, RemoveEmpty=False, Tree=flatten_2)

# ---- group: Route toolpaths according to machining type
use_trochoidal_milling = Panel(use_high_speed_machining_2)
gate = StreamGate(Stream=clean, Gate=use_trochoidal_milling)  # -> Target0, Target1, Target2

# ---- group: Convert to polylines to extract toolpath coordinates
topoly = CurveToPolyline(Curve=gate.Target0, ToleranceDistance=deviation_tolerance_2, ToleranceAngle=0)  # -> Polyline, Segments
polyline_toolpaths = Curve(topoly.Polyline)

# ---- group: Adds tabs to toolpaths
tab_toolpaths = TabToolpaths(polyline_toolpaths=gate.Target1, tab_breps=flatten, milling_bit_diamter=trochoidal_milling_bit_diameter)  # -> tabbed_toolpaths_3, tab_cleanup_toolpaths_4

# ---- group: Eliminate unecessary jog Z
connect_overlapping_toolpaths = ConnectOverlappingToolpaths(polyline_toolpaths=polyline_toolpaths)

# ---- group: Adds tabs to toolpaths
tab_toolpaths_2 = TabToolpaths(polyline_toolpaths=gate.Target2, tab_breps=flatten, milling_bit_diamter=milling_bit_diameter_2)  # -> tabbed_toolpaths_3, tab_cleanup_toolpaths_4

# ----
ramp_plunges_3 = Integer(ramp_plunges_2)

# ---- group: Avoid trochoidal milling to use computer calculations
gate_2 = StreamGate(Stream=milling_bit_diameter_2, Gate=use_high_speed_machining_2)  # -> Target0, Target1
gate_3 = StreamGate(Stream=toolpath_width_factor_2, Gate=use_high_speed_machining_2)  # -> Target0, Target1
gate_4 = StreamGate(Stream=ramp_angle_2, Gate=use_high_speed_machining_2)  # -> Target0, Target1
gate_5 = StreamGate(Stream=use_peck_entry_2, Gate=use_high_speed_machining_2)  # -> Target0, Target1
gate_6 = StreamGate(Stream=max_peck_depth_factor_plunge_roughing, Gate=use_high_speed_machining_2)  # -> Target0, Target1

gate_7 = StreamGate(Stream=milling_bit_diameter_2, Gate=use_high_speed_machining_2)  # -> Target0, Target1
gate_8 = StreamGate(Stream=toolpath_width_factor_2, Gate=use_high_speed_machining_2)  # -> Target0, Target1
gate_9 = StreamGate(Stream=ramp_angle_2, Gate=use_high_speed_machining_2)  # -> Target0, Target1
gate_10 = StreamGate(Stream=use_peck_entry_2, Gate=use_high_speed_machining_2)  # -> Target0, Target1
gate_11 = StreamGate(Stream=max_peck_depth_factor_plunge_roughing, Gate=use_high_speed_machining_2)  # -> Target0, Target1

# ----
filter_2 = StreamFilter(Gate=ramp_plunges_3, Stream0=connect_overlapping_toolpaths, Stream1=polyline_toolpaths)
trochoidal_high_speed_milling = TrochoidalHighSpeedMilling(
    toolpath_curves=tab_toolpaths.tabbed_toolpaths_3,
    milling_bit_diameter=gate_2.Target1,
    toolpath_width_factor=gate_3.Target1,
    stepover=stepover_2,
    ramp_angle=gate_4.Target1,
    jog_z_lift_factor=0.1,
    use_climb_milling=True,
    straight_arc_extensions=True,
    use_peck_entry=gate_5.Target1,
    max_peck_depth_factor=gate_6.Target1)
trochoidal_high_speed_milling_2 = TrochoidalHighSpeedMilling(
    toolpath_curves=tab_toolpaths.tab_cleanup_toolpaths_4,
    milling_bit_diameter=gate_7.Target1,
    toolpath_width_factor=gate_8.Target1,
    stepover=stepover_2,
    ramp_angle=gate_9.Target1,
    jog_z_lift_factor=0.1,
    use_climb_milling=True,
    straight_arc_extensions=True,
    use_peck_entry=gate_10.Target1,
    max_peck_depth_factor=gate_11.Target1)
plunge_roughing = PlungeRoughing(toolpath_curves=tab_toolpaths_2.tabbed_toolpaths_3, milling_bit_diameter=milling_bit_diameter_2, stepover=stepover_2)
plunge_roughing_2 = PlungeRoughing(
    toolpath_curves=tab_toolpaths_2.tab_cleanup_toolpaths_4,
    milling_bit_diameter=milling_bit_diameter_2,
    stepover=stepover_2)
plunge_rough_lines = Curve(plunge_roughing)
plunge_rough_lines_2 = Curve(plunge_roughing_2)

# ---- group: Convert to polylines to extract toolpath coordinates
topoly_2 = CurveToPolyline(Curve=trochoidal_high_speed_milling_2, ToleranceDistance=deviation_tolerance_2, ToleranceAngle=0)  # -> Polyline, Segments
join_4 = JoinCurves(Curves=topoly_2.Polyline, Preserve=False)

topoly_3 = CurveToPolyline(Curve=trochoidal_high_speed_milling, ToleranceDistance=deviation_tolerance_2, ToleranceAngle=0)  # -> Polyline, Segments
join_5 = JoinCurves(Curves=topoly_3.Polyline, Preserve=False)

# ----
trochoidal_polyline_toolpaths = Curve(join_5)
trochoidal_polyline_toolpaths_from_insid = Curve(join_4)  # "Trochoidal polyline toolpaths from inside tab boundary boxes"
use_high_speed_machining_3 = Panel(use_high_speed_machining_2)
use_high_speed_machining_4 = Panel(use_high_speed_machining_2)
number_of_decimal_places_2 = Panel(number_of_decimal_places)
number_of_decimal_places_3 = Panel(number_of_decimal_places)
num = Number(number_of_decimal_places_3)
num_2 = Number(number_of_decimal_places_3)
num_3 = Number(number_of_decimal_places_3)
num_4 = Number(number_of_decimal_places_2)
num_5 = Number(number_of_decimal_places_2)
num_6 = Number(number_of_decimal_places_2)

# ---- group: Prepare correct safe Z height
subtraction = Subtraction(ActualSafeZHeight=safe_z_height_2, MaterialThickness=material_thickness_2)
filter_3 = StreamFilter(ZZeroIsAtBottomOfStock=z_zero_is_at_bottom_of_stock_2, Stream0=safe_z_height_2, Stream1=subtraction)

# ---- group: Set indexer spinning speed
spindle_speed_2 = Number(thread_pitch_2)
int_2 = Integer(spindle_speed_2)
join_6 = TextJoin(Text=["MI,B,1,", int_2, ",0,0"])

# ---- group: Start spindle
filter_4 = StreamFilter(Gate=use_spindle_2, Stream1="SO,1,1")

# ---- group: Name
# ShopBot code toolpath processing
panel = Panel(join_3)

# ---- group: Set Feed rate (X Y speed) and plunge rate (Z speed)
feed_rate_3 = Number(feed_rate_2)
plunge_rate_3 = Number(plunge_rate_2)
plunge_rate_4 = Number(plunge_rate_3)
feed_rate_4 = Number(feed_rate_3)
text = Text("MS,")
text_2 = Text(",")
join_7 = TextJoin(Text=flatten([text, feed_rate_4, text_2, plunge_rate_4]))

# ---- group: Turn off indexer spin
filter_5 = StreamFilter(Gate=use_spindle_2, Stream1="MI,O")

# ---- group: Name
# ShopBot code tab cleanup processing
panel_2 = Panel(join_3)

# ---- group: Turn off spindle
filter_6 = StreamFilter(Gate=use_spindle_2, Stream1="SO,1,0")

# ---- group: Set spindle speed
spindle_speed_3 = Number(thread_pitch_2)
int_3 = Integer(spindle_speed_3)
join_8 = TextJoin(Text=["TR,", int_3, ",1"])

# ---- group: Start spindle
panel_3 = Panel("PAUSE 1")
filter_7 = StreamFilter(Gate=use_spindle_2, Stream1="SO,1,1")

# ---- group: Set Feed rate (X Y speed) and plunge rate (Z speed)
feed_rate_5 = Number(feed_rate_2)
plunge_rate_5 = Number(plunge_rate_2)
plunge_rate_6 = Number(plunge_rate_5)
feed_rate_6 = Number(feed_rate_5)
text_3 = Text("MS,")
text_4 = Text(",")
join_9 = TextJoin(Text=flatten([text_3, feed_rate_6, text_4, plunge_rate_6]))

# ----
filter_8 = StreamFilter(Gate=use_spindle_2, Stream1=join_6)
filter_9 = StreamFilter(Gate=use_spindle_2, Stream1=join_8)
text_5 = Text("J2,")
text_6 = Text("J2,")
text_7 = Text(",")
text_8 = Text(",")
join_10 = TextJoin(Text=[text_5, end_of_job_go_to_x_2, text_8, end_of_job_go_to_y_2])
join_11 = TextJoin(Text=[text_6, end_of_job_go_to_x_2, text_7, end_of_job_go_to_y_2])
g_code_spindle_start_2 = Panel(g_code_spindle_start)
g_code_spindle_start_3 = Panel(g_code_spindle_start)
start_code_3 = Text(start_code_2)
start_code_4 = Text(start_code_2)
end_code_3 = Text(end_code_2)
end_code_4 = Text(end_code_2)
endcode = Panel(end_code_3)
endcode_2 = Panel(end_code_4)
endcode_3 = Panel("""G4  S3
M280 S-90 P0 F3000 R""")
# Endcode - Ultimaker original , extruder upgrade + heatbed: ;End GCode
# M104 S0                     ;extruder heater off
# M140 S0                     ;heated bed heater off (if you have it)
# G91                                    ;relative positioning
# G1 E-1 F300                            ;retract the filament a bit before lifting the nozzle, to release some of the pressure
# G1 Z+0.5 E-5 X-20 Y-20 F9000 ;move Z up a bit and retract filament even more
# G28 X0 Y0                              ;move X/Y to min endstops, so the head is out of the way
# M84                         ;steppers off
# G90                         ;absolute positioning
# Endcode - Printrbot Simple: M104 S0                     ;extruder heater off
# M140 S0                     ;heated bed heater off (if you have it)
# 
# G91                                    ;relative positioning
# G1 E-1 F300                            ;retract the filament a bit before lifting the nozzle, to release some of the pressure
# G1 Z+0.5 E-5 X-20 Y-20 F9000 ;move Z up a bit and retract filament even more
# G28 X0 Y0                              ;move X/Y to min endstops, so the head is out of the way
# 
# M84                         ;steppers off
# G90                         ;absolute positioning
endcode_fabtotum = Panel("""G4 S2; Dwell
M5; SPINDLE OFF""")
start_code_5 = Text(start_code_2)
end_code_5 = Text(end_code_2)
start_code_6 = Text(start_code_2)
end_code_6 = Text(end_code_2)

# ---- group: Checks if there are tabs and skips tab toolpaths if there are no tab breps
lng = ListLength(List=flatten)
null = NullItem(Item=lng)  # -> NullFlags, InvalidFlags, Description
cull = CullPattern(List=milling_bit_diameter_2, CullPattern=invert(null.NullFlags))
gate_12 = StreamGate(Stream=filter_2, Gate=null.NullFlags)  # -> Target0, Target1

# ---- group: Adds tabs to toolpaths
tab_toolpaths_3 = TabToolpaths(polyline_toolpaths=gate_12.Target0, tab_breps=flatten, milling_bit_diamter=cull)  # -> tabbed_toolpaths_3, tab_cleanup_toolpaths_4

# ---- group: Checks if there are tabs and skips tab toolpaths if there are no tab breps (continued)
filter_10 = StreamFilter(Gate=null.NullFlags, Stream0=tab_toolpaths_3.tabbed_toolpaths_3, Stream1=gate_12.Target1)

# ---- group: Add ramps to cleanup toolpaths
tab_cleanup_toolpaths = Curve(tab_toolpaths_3.tab_cleanup_toolpaths_4)
ramp_plunges_4 = Integer(ramp_plunges_2)
ramp_toolpath_plunges = RampToolpathPlunges(toolpaths_to_ramp=tab_cleanup_toolpaths, ramp_angle=ramp_angle_2)
filter_11 = StreamFilter(Gate=ramp_plunges_4, Stream0=tab_cleanup_toolpaths, Stream1=ramp_toolpath_plunges)

# ---- group: Try to reduce uneccessy Z movement
connect_overlapping_toolpaths_2 = ConnectOverlappingToolpaths(polyline_toolpaths=filter_11)

# ----
panel_4 = Panel(connect_overlapping_toolpaths_2)
filter_12 = StreamFilter(
    Gate=use_high_speed_machining_3,
    Stream0=connect_overlapping_toolpaths_2,
    Stream1=trochoidal_polyline_toolpaths_from_insid,
    Stream2=plunge_rough_lines_2)

# ---- group: Move toolpaths up with material thcikness distance in case of Z zero at bottom of stock
Z = UnitZ(MaterialThickness=material_thickness_2)
move = Move(TabCleanupToolpaths=filter_12, Motion=Z)  # -> Geometry, Transform
filter_13 = StreamFilter(ZZeroIsAtBottomOfStock=z_zero_is_at_bottom_of_stock_2, Stream0=filter_12, Stream1=move.Geometry)

# ---- group: Extract toolpath points from toopath polylines
cp = ControlPoints(Curve=filter_13)  # -> Points, Weights, Knots

# ---- group: Send tab cleanup toolpath points to g-code or ShopBot code postprocessor
toolpath_points_for_tab_cleanup_job = Point(cp.Points)
make_shopbot_code_not_g_code_3 = Boolean(make_shopbot_code_not_g_code_2)
gate_13 = StreamGate(Stream=toolpath_points_for_tab_cleanup_job, Gate=make_shopbot_code_not_g_code_3)  # -> Target0, Target1

# ---- group: Format milling positions with axis names and feedrates
toolpath_points = Point(gate_13.Target0)
lng_2 = ListLength(List=toolpath_points)
number_of_decimal_places_4 = Panel(number_of_decimal_places)
feed_rate_7 = Number(feed_rate_in_mm_m)
plunge_rate_7 = Number(plunge_rate_in_mm_m)
dup = DuplicateData(Data=flatten(" X"), Number=flatten(lng_2), Order=True)
dup_2 = DuplicateData(Data=flatten("F"), Number=flatten(lng_2), Order=True)
dup_3 = DuplicateData(Data=graft(feed_rate_7), Number=graft(lng_2), Order=True)
pdecon = Deconstruct(Point=toolpath_points)  # -> XComponent, YComponent, ZComponent
lng_3 = ListLength(List=toolpath_points)
replace = ReplaceItems(List=dup_3, Item=plunge_rate_7, Indices="0", Wrap=False)
flatten_3 = FlattenTree(Tree=dup_2, Path="{0}")
flatten_4 = FlattenTree(Tree=dup, Path="{0}")
flatten_5 = FlattenTree(Tree=replace, Path="{0}")
num_7 = Number(pdecon.XComponent)
num_8 = Number(number_of_decimal_places_4)
num_9 = Number(pdecon.YComponent)
num_10 = Number(number_of_decimal_places_4)
num_11 = Number(pdecon.ZComponent)
num_12 = Number(number_of_decimal_places_4)
graft = GraftTree(Tree=flatten_3, IncludeEmptyLists=True, IncludeNullItems=True)
expression = Expression(x=num_7, y=num_8, Expression="Round(x,y)")
expression_2 = Expression(x=num_9, y=num_10, Expression="Round(x,y)")
expression_3 = Expression(x=num_11, y=num_12, Expression="Round(x,y)")
graft_2 = GraftTree(Tree=flatten_5, IncludeEmptyLists=True, IncludeNullItems=True)
graft_3 = GraftTree(Tree=flatten_4, IncludeEmptyLists=True, IncludeNullItems=True)
panel_5 = Panel(expression)
panel_6 = Panel(expression_2)
panel_7 = Panel(expression_3)
join_12 = TextJoin(Text=[graft, graft_2, graft_3])
dup_4 = DuplicateData(Data=" Z", Number=lng_3, Order=True)
dup_5 = DuplicateData(Data=" Y", Number=lng_3, Order=True)
dup_6 = DuplicateData(Data="G1 ", Number=lng_3, Order=True)
simplify = SimplifyTree(Tree=flatten(join_12), Front=False)
simplify_2 = SimplifyTree(Tree=flatten(dup_6), Front=False)
simplify_3 = SimplifyTree(Tree=flatten(panel_5), Front=False)
simplify_4 = SimplifyTree(Tree=flatten(dup_5), Front=False)
simplify_5 = SimplifyTree(Tree=flatten(panel_6), Front=False)
simplify_6 = SimplifyTree(Tree=flatten(dup_4), Front=False)
simplify_7 = SimplifyTree(Tree=flatten(panel_7), Front=False)
graft_4 = GraftTree(Tree=simplify_2, IncludeEmptyLists=True, IncludeNullItems=True)
graft_5 = GraftTree(Tree=simplify_3, IncludeEmptyLists=True, IncludeNullItems=True)
graft_6 = GraftTree(Tree=simplify_4, IncludeEmptyLists=True, IncludeNullItems=True)
graft_7 = GraftTree(Tree=simplify_5, IncludeEmptyLists=True, IncludeNullItems=True)
graft_8 = GraftTree(Tree=simplify_6, IncludeEmptyLists=True, IncludeNullItems=True)
graft_9 = GraftTree(Tree=simplify_7, IncludeEmptyLists=True, IncludeNullItems=True)
graft_10 = GraftTree(Tree=simplify, IncludeEmptyLists=True, IncludeNullItems=True)
join_13 = TextJoin(Text=[graft_4, graft_10, graft_5, graft_6, graft_7, graft_8, graft_9])
flatten_6 = FlattenTree(Tree=join_13, Path="{0}")
panel_8 = Panel(flatten_6)

# ----
toolpath_points_2 = Point(gate_13.Target1)
pdecon_2 = Deconstruct(Point=toolpath_points_2)  # -> XComponent, YComponent, ZComponent
lng_4 = ListLength(List=toolpath_points_2)
num_13 = Number(pdecon_2.XComponent)
num_14 = Number(pdecon_2.YComponent)
num_15 = Number(pdecon_2.ZComponent)

# ---- group: Format jog XY postions
custom_home_y = Number(end_of_job_go_to_y_2)
jog_rate_x_y = Number(jog_rate_x_y_in_mm_m)
item = ListItem(List=expression, Index=0, Wrap=True)
custom_home_x = Number(end_of_job_go_to_x_2)
item_2 = ListItem(List=expression_2, Index=0, Wrap=True)
int_4 = Integer(jog_rate_x_y)
lng_5 = ListLength(List=flatten(item))
safe_z_height_3 = Number(safe_z_height_2)
lng_6 = ListLength(List=flatten(item))
join_14 = TextJoin(Text=["F", int_4, " X"])
dup_7 = DuplicateData(Data="G1 ", Number=lng_5, Order=True)
dup_8 = DuplicateData(Data=" Y", Number=lng_5, Order=True)
dup_9 = DuplicateData(Data=" Z", Number=lng_5, Order=True)
dup_10 = DuplicateData(Data=safe_z_height_3, Number=lng_5, Order=True)
dup_11 = DuplicateData(Data=join_14, Number=lng_6, Order=True)
simplify_8 = SimplifyTree(Tree=flatten(dup_7), Front=False)
simplify_9 = SimplifyTree(Tree=flatten(item), Front=False)
simplify_10 = SimplifyTree(Tree=flatten(dup_8), Front=False)
simplify_11 = SimplifyTree(Tree=flatten(item_2), Front=False)
simplify_12 = SimplifyTree(Tree=flatten(dup_9), Front=False)
simplify_13 = SimplifyTree(Tree=flatten(dup_10), Front=False)
simplify_14 = SimplifyTree(Tree=flatten(dup_11), Front=False)
graft_11 = GraftTree(Tree=simplify_8, IncludeEmptyLists=True, IncludeNullItems=True)
graft_12 = GraftTree(Tree=simplify_14, IncludeEmptyLists=True, IncludeNullItems=True)
graft_13 = GraftTree(Tree=simplify_9, IncludeEmptyLists=True, IncludeNullItems=True)
graft_14 = GraftTree(Tree=simplify_10, IncludeEmptyLists=True, IncludeNullItems=True)
graft_15 = GraftTree(Tree=simplify_11, IncludeEmptyLists=True, IncludeNullItems=True)
graft_16 = GraftTree(Tree=simplify_12, IncludeEmptyLists=True, IncludeNullItems=True)
graft_17 = GraftTree(Tree=simplify_13, IncludeEmptyLists=True, IncludeNullItems=True)
join_15 = TextJoin(Text=[graft_11, graft_12, graft_13, graft_14, graft_15])
jog_rate_x_y_2 = Integer(jog_rate_x_y)
flatten_7 = FlattenTree(Tree=join_15, Path="{0}")
join_16 = TextJoin(Text=["F", jog_rate_x_y_2])
home_x = Number(custom_home_x)
home_y = Number(custom_home_y)
join_17 = TextJoin(Text=["G1 ", join_16, " X", home_x, " Y", home_y])
merge_4 = Merge(Data1=flatten(flatten_7), Data2=flatten(join_17))
jog_x_y_positions = Panel(merge_4)

# ----
expression_4 = Expression(x=num_13, y=num, Expression="Round(x,y)")
expression_5 = Expression(x=num_14, y=num_2, Expression="Round(x,y)")
expression_6 = Expression(x=num_15, y=num_3, Expression="Round(x,y)")
flatten_8 = FlattenTree(Tree=lng_4, Path="{0}")
merge_5 = Merge(Data1=Slider(0, range=0..100), Data2=flatten_8)
panel_9 = Panel(expression_4)
panel_10 = Panel(expression_5)
panel_11 = Panel(expression_6)

# ---- group: Jog to startpoints
item_3 = ListItem(List=expression_4, Index=0, Wrap=True)
item_4 = ListItem(List=expression_5, Index=0, Wrap=True)
lng_7 = ListLength(List=flatten(item_3))
text_9 = Text(",")
text_10 = Text("J2,")
dup_12 = DuplicateData(Data=text_10, Number=lng_7, Order=True)
dup_13 = DuplicateData(Data=text_9, Number=lng_7, Order=True)
simplify_15 = SimplifyTree(Tree=flatten(dup_12), Front=False)
simplify_16 = SimplifyTree(Tree=flatten(item_3), Front=False)
simplify_17 = SimplifyTree(Tree=flatten(dup_13), Front=False)
simplify_18 = SimplifyTree(Tree=flatten(item_4), Front=False)
graft_18 = GraftTree(Tree=simplify_15, IncludeEmptyLists=True, IncludeNullItems=True)
graft_19 = GraftTree(Tree=simplify_16, IncludeEmptyLists=True, IncludeNullItems=True)
graft_20 = GraftTree(Tree=simplify_17, IncludeEmptyLists=True, IncludeNullItems=True)
graft_21 = GraftTree(Tree=simplify_18, IncludeEmptyLists=True, IncludeNullItems=True)
join_18 = TextJoin(Text=[graft_18, graft_19, graft_20, graft_21])
flatten_9 = FlattenTree(Tree=join_18, Path="{0}")
merge_6 = Merge(Data1=flatten_9, Data2=join_10)

# ---- group: Jog to safe Z
safe_z_height_4 = Number(flatten(safe_z_height_2))
text_11 = Text("JZ,")
graft_22 = GraftTree(Tree=safe_z_height_4, IncludeEmptyLists=True, IncludeNullItems=True)
graft_23 = GraftTree(Tree=text_11, IncludeEmptyLists=True, IncludeNullItems=True)
lng_8 = ListLength(List=flatten(merge_5))
join_19 = TextJoin(Text=[graft_23, graft_22])
dup_14 = DuplicateData(Data=join_19, Number=lng_8, Order=True)

# ---- group: Toolpath coordinates
text_12 = Text("M3,")
text_13 = Text(",")
text_14 = Text(",")
dup_15 = DuplicateData(Data=text_14, Number=lng_4, Order=True)
dup_16 = DuplicateData(Data=text_13, Number=lng_4, Order=True)
dup_17 = DuplicateData(Data=text_12, Number=lng_4, Order=True)
simplify_19 = SimplifyTree(Tree=flatten(dup_17), Front=False)
simplify_20 = SimplifyTree(Tree=flatten(panel_9), Front=False)
simplify_21 = SimplifyTree(Tree=flatten(dup_16), Front=False)
simplify_22 = SimplifyTree(Tree=flatten(panel_10), Front=False)
simplify_23 = SimplifyTree(Tree=flatten(dup_15), Front=False)
simplify_24 = SimplifyTree(Tree=flatten(panel_11), Front=False)
graft_24 = GraftTree(Tree=simplify_19, IncludeEmptyLists=True, IncludeNullItems=True)
graft_25 = GraftTree(Tree=simplify_20, IncludeEmptyLists=True, IncludeNullItems=True)
graft_26 = GraftTree(Tree=simplify_21, IncludeEmptyLists=True, IncludeNullItems=True)
graft_27 = GraftTree(Tree=simplify_22, IncludeEmptyLists=True, IncludeNullItems=True)
graft_28 = GraftTree(Tree=simplify_23, IncludeEmptyLists=True, IncludeNullItems=True)
graft_29 = GraftTree(Tree=simplify_24, IncludeEmptyLists=True, IncludeNullItems=True)
join_20 = TextJoin(Text=[graft_24, graft_25, graft_26, graft_27, graft_28, graft_29])
flatten_10 = FlattenTree(Tree=join_20, Path="{0}")

# ---- group: Format jog Z postions
# G-Code tab cleanup processing
jog_rate_z_3 = Number(jog_rate_z_in_mm_m)
int_5 = Integer(jog_rate_z_3)
join_21 = TextJoin(Text=["F", int_5])
safe_z_height_5 = Number(safe_z_height_2)
join_22 = TextJoin(Text=["G1 ", join_21, " Z", safe_z_height_5])
lng_9 = ListLength(List=merge_4)
dup_18 = DuplicateData(Data=join_22, Number=lng_9, Order=True)
flatten_11 = FlattenTree(Tree=dup_18, Path="{0}")
jog_z_positions = Panel(flatten_11)

# ---- group: Insert JZ commands
ma = MassAddition(Input=merge_5)  # -> Result, PartialResults
ins = InsertItems(List=flatten_10, Item=dup_14, Indices=ma.PartialResults, Wrap=True)

# ---- group: Insert jog to safe Z
ma_2 = MassAddition(Input=flatten(lng_3))  # -> Result, PartialResults
merge_7 = Merge(Data1=Slider(0, range=0..100), Data2=ma_2.PartialResults)
ins_2 = InsertItems(List=flatten(panel_8), Item=flatten(jog_z_positions), Indices=flatten(merge_7), Wrap=True)

# ---- group: Insert J2 commands
lng_10 = ListLength(List=merge_6)
dup_19 = DuplicateData(Data=Slider(1, range=0..1), Number=lng_10, Order=True)
addition = Addition(A=dup_19, B=merge_5)
ma_3 = MassAddition(Input=addition)  # -> Result, PartialResults
ins_3 = InsertItems(List=ins, Item=merge_6, Indices=ma_3.PartialResults, Wrap=True)

# ----
panel_12 = Panel(join_22)

# ---- group: Insert jog X Y positions
lng_11 = ListLength(List=merge_7)
series = Series(Start=1, Step=1, Count=lng_11)
addition_2 = Addition(A=merge_7, B=series)
ins_4 = InsertItems(List=flatten(ins_2), Item=flatten(jog_x_y_positions), Indices=flatten(addition_2), Wrap=True)

# ----
flatten_12 = FlattenTree(Tree=ins_3, Path="{0}")
merge_8 = Merge(Data1=start_code_4, Data2=panel_12, Data3=g_code_spindle_start_3)
startcode = Panel(merge_8)
merge_9 = Merge(
    Data1=start_code_5,
    Data2=panel_2,
    Data3=filter_9,
    Data4=filter_7,
    Data5=panel_3,
    Data6=join_9,
    Data7=flatten_12,
    Data8=filter_6,
    Data9=end_code_5)
merge_10 = Merge(Data1=flatten(startcode), Data2=flatten(ins_4), Data3=flatten(endcode_2))
tab_cleanup_toolpath_shopbot_code = Panel(merge_9)
tab_cleanup_toolpath_g_code = Panel(merge_10)
tab_cleanup_toolpath_shopbot_code_2 = Panel(tab_cleanup_toolpath_shopbot_code)
tab_cleanup_toolpath_g_code_2 = Panel(tab_cleanup_toolpath_g_code)
filter_14 = StreamFilter(Gate=make_shopbot_code_not_g_code_2, Stream0=tab_cleanup_toolpath_g_code_2, Stream1=tab_cleanup_toolpath_shopbot_code_2)
g_code_for_tab_cleanup = ClusterOutput(filter_14)  # Connect a panel to stream the code to a folder on your computer

# ---- group: Checks if ramp plunges = true
ramp_plunges_5 = Integer(ramp_plunges_2)
gate_14 = StreamGate(Stream=filter_10, Gate=ramp_plunges_5)  # -> Target0, Target1

# ---- group: Add ramps to toolpaths
ramp_toolpath_plunges_2 = RampToolpathPlunges(toolpaths_to_ramp=gate_14.Target1, ramp_angle=ramp_angle_2)

# ---- group: Try to reduce uneccessy Z movement
connect_overlapping_toolpaths_3 = ConnectOverlappingToolpaths(polyline_toolpaths=ramp_toolpath_plunges_2)

# ---- group: Checks if ramp plunges = true (continued)
filter_15 = StreamFilter(Gate=flatten(ramp_plunges_5), Stream0=flatten(gate_14.Target0), Stream1=flatten(connect_overlapping_toolpaths_3))

# ----
filter_16 = StreamFilter(Gate=use_high_speed_machining_4, Stream0=filter_15, Stream1=trochoidal_polyline_toolpaths, Stream2=plunge_rough_lines)

# ---- group: Move toolpaths up with material thcikness distance in case of Z zero at bottom of stock
Z_2 = UnitZ(MaterialThickness=material_thickness_2)
move_2 = Move(Toolpaths=filter_16, Motion=Z_2)  # -> Geometry, Transform
filter_17 = StreamFilter(ZZeroIsAtBottomOfStock=z_zero_is_at_bottom_of_stock_2, Stream0=filter_16, Stream1=move_2.Geometry)

# ---- group: Extract toolpath points from toopath polylines
cp_2 = ControlPoints(Curve=filter_17)  # -> Points, Weights, Knots

# ---- group: Send main toolpath points to g-code or ShopBot code postprocessor
make_shopbot_code_not_g_code_4 = Boolean(make_shopbot_code_not_g_code_2)
toolpath_points_3 = Point(cp_2.Points)
gate_15 = StreamGate(Stream=toolpath_points_3, Gate=make_shopbot_code_not_g_code_4)  # -> Target0, Target1

# ----
toolpath_points_4 = Point(gate_15.Target1)
pdecon_3 = Deconstruct(Point=toolpath_points_4)  # -> XComponent, YComponent, ZComponent
lng_12 = ListLength(List=toolpath_points_4)
num_16 = Number(pdecon_3.YComponent)
num_17 = Number(pdecon_3.XComponent)
num_18 = Number(pdecon_3.ZComponent)
expression_7 = Expression(x=num_16, y=num_5, Expression="Round(x,y)")
expression_8 = Expression(x=num_17, y=num_4, Expression="Round(x,y)")
expression_9 = Expression(x=num_18, y=num_6, Expression="Round(x,y)")

# ---- group: Prepare correct height of toolpaths for preview
Z_3 = UnitZ(MaterialThickness=material_thickness_2)
rev = Reverse(Vector=Z_3)
move_3 = Move(ToolpathPoints=toolpath_points_3, Motion=rev)  # -> Geometry, Transform
filter_18 = StreamFilter(ZZeroIsAtBottomOfStock=z_zero_is_at_bottom_of_stock_2, Stream0=toolpath_points_3, Stream1=move_3.Geometry)

# ----
flatten_13 = FlattenTree(Tree=lng_12, Path="{0}")
merge_11 = Merge(Data1=Slider(0, range=0..100), Data2=flatten_13)
panel_13 = Panel(expression_8)
panel_14 = Panel(expression_7)
panel_15 = Panel(expression_9)
lng_13 = ListLength(List=flatten(merge_11))

# ---- group: Jog to startpoints
item_5 = ListItem(List=expression_8, Index=0, Wrap=True)
item_6 = ListItem(List=expression_7, Index=0, Wrap=True)
lng_14 = ListLength(List=flatten(item_5))
text_15 = Text("J2,")
text_16 = Text(",")
dup_20 = DuplicateData(Data=text_15, Number=lng_14, Order=True)
dup_21 = DuplicateData(Data=text_16, Number=lng_14, Order=True)
simplify_25 = SimplifyTree(Tree=flatten(dup_20), Front=False)
simplify_26 = SimplifyTree(Tree=flatten(item_5), Front=False)
simplify_27 = SimplifyTree(Tree=flatten(dup_21), Front=False)
simplify_28 = SimplifyTree(Tree=flatten(item_6), Front=False)
graft_30 = GraftTree(Tree=simplify_25, IncludeEmptyLists=True, IncludeNullItems=True)
graft_31 = GraftTree(Tree=simplify_26, IncludeEmptyLists=True, IncludeNullItems=True)
graft_32 = GraftTree(Tree=simplify_27, IncludeEmptyLists=True, IncludeNullItems=True)
graft_33 = GraftTree(Tree=simplify_28, IncludeEmptyLists=True, IncludeNullItems=True)
join_23 = TextJoin(Text=[graft_30, graft_31, graft_32, graft_33])
flatten_14 = FlattenTree(Tree=join_23, Path="{0}")
merge_12 = Merge(Data1=flatten_14, Data2=join_11)

# ---- group: Make jog to safe Z
safe_z_height_6 = Number(flatten(safe_z_height_2))
text_17 = Text("JZ,")
graft_34 = GraftTree(Tree=safe_z_height_6, IncludeEmptyLists=True, IncludeNullItems=True)
graft_35 = GraftTree(Tree=text_17, IncludeEmptyLists=True, IncludeNullItems=True)
join_24 = TextJoin(Text=[graft_35, graft_34])
dup_22 = DuplicateData(Data=join_24, Number=lng_13, Order=True)

# ---- group: Toolpath coordinates and headstock rotations
text_18 = Text(",")
text_19 = Text(",")
text_20 = Text("M3,")
dup_23 = DuplicateData(Data=text_18, Number=lng_12, Order=True)
dup_24 = DuplicateData(Data=text_19, Number=lng_12, Order=True)
dup_25 = DuplicateData(Data=text_20, Number=lng_12, Order=True)
simplify_29 = SimplifyTree(Tree=flatten(dup_25), Front=False)
simplify_30 = SimplifyTree(Tree=flatten(panel_13), Front=False)
simplify_31 = SimplifyTree(Tree=flatten(dup_24), Front=False)
simplify_32 = SimplifyTree(Tree=flatten(panel_14), Front=False)
simplify_33 = SimplifyTree(Tree=flatten(dup_23), Front=False)
simplify_34 = SimplifyTree(Tree=flatten(panel_15), Front=False)
graft_36 = GraftTree(Tree=simplify_29, IncludeEmptyLists=True, IncludeNullItems=True)
graft_37 = GraftTree(Tree=simplify_30, IncludeEmptyLists=True, IncludeNullItems=True)
graft_38 = GraftTree(Tree=simplify_31, IncludeEmptyLists=True, IncludeNullItems=True)
graft_39 = GraftTree(Tree=simplify_32, IncludeEmptyLists=True, IncludeNullItems=True)
graft_40 = GraftTree(Tree=simplify_33, IncludeEmptyLists=True, IncludeNullItems=True)
graft_41 = GraftTree(Tree=simplify_34, IncludeEmptyLists=True, IncludeNullItems=True)
join_25 = TextJoin(Text=[graft_36, graft_37, graft_38, graft_39, graft_40, graft_41])
flatten_15 = FlattenTree(Tree=join_25, Path="{0}")

# ---- group: Create jog transtion points
safe_z_height_7 = Number(filter_3)
end_of_job_go_to_y_3 = Number(end_of_job_go_to_y_2)
toolpath_points_5 = Point(filter_18)
end_of_job_go_to_x_3 = Number(end_of_job_go_to_x_2)
flatten_16 = FlattenTree(Tree=toolpath_points_5, Path="{0}")
item_7 = ListItem(List=flatten_16, Index=0, Wrap=True)
rev_2 = ReverseList(List=toolpath_points_5)
null_2 = NullItem(Item=item_7)  # -> NullFlags, InvalidFlags, Description
# Create toolpath preview geometry
item_8 = ListItem(List=toolpath_points_5, Index=0, Wrap=True)
item_9 = ListItem(List=rev_2, Index=0, Wrap=True)
filter_19 = StreamFilter(Gate=null_2.NullFlags, Stream0=end_of_job_go_to_x_3)
filter_20 = StreamFilter(Gate=null_2.NullFlags, Stream0=end_of_job_go_to_y_3)
pdecon_4 = Deconstruct(Point=item_8)  # -> XComponent, YComponent, ZComponent
pdecon_5 = Deconstruct(Point=item_9)  # -> XComponent, YComponent, ZComponent
panel_16 = Panel(end_of_job_go_to_y_3)
panel_17 = Panel(end_of_job_go_to_x_3)
pt = ConstructPoint(XCoordinate=pdecon_4.XComponent, YCoordinate=pdecon_4.YComponent, ZCoordinate=safe_z_height_7)
pt_2 = ConstructPoint(XCoordinate=filter_19, YCoordinate=filter_20, ZCoordinate=safe_z_height_7)
pt_3 = ConstructPoint(XCoordinate=panel_17, YCoordinate=panel_16, ZCoordinate=safe_z_height_7)
pt_4 = ConstructPoint(XCoordinate=pdecon_5.XComponent, YCoordinate=pdecon_5.YComponent, ZCoordinate=safe_z_height_7)
most_probable_start_position = Point(pt_3)
end_position = Point(pt_2)
safe_z_end_point = Point(pt_4)
safe_z_start_point = Point(pt)

# ---- group: Insert JZ commands
ma_4 = MassAddition(Input=merge_11)  # -> Result, PartialResults
ins_5 = InsertItems(List=flatten_15, Item=dup_22, Indices=ma_4.PartialResults, Wrap=True)

# ---- group: Create toolpath previews
rev_3 = ReverseList(List=flatten(safe_z_start_point))
ins_6 = InsertItems(List=flatten(rev_3), Item=end_position, Indices="0", Wrap=True)
ins_7 = InsertItems(List=flatten(safe_z_end_point), Item=most_probable_start_position, Indices="0", Wrap=True)
rev_4 = ReverseList(List=flatten(ins_7))
ln = Line(StartPoint=rev_4, EndPoint=ins_6)
ln_2 = Line(StartPoint=safe_z_start_point, EndPoint=item_8)
ln_3 = Line(StartPoint=item_9, EndPoint=safe_z_end_point)
tab_cleanup_preview_curves = Curve(filter_12)
cut_transition_preview_lines = Curve(flatten(ln))
cut_exit_preview_lines = Curve(flatten(ln_3))
cut_entry_preview_lines = Curve(flatten(ln_2))
toolpath_preview_curves = Curve(filter_16)

# ---- group: Insert J2 commands
series_2 = Series(Start="1", Step="1", Count=lng_13)
addition_3 = Addition(A=ma_4.PartialResults, B=series_2)
ins_8 = InsertItems(List=ins_5, Item=merge_12, Indices=addition_3, Wrap=True)

# ----
flatten_17 = FlattenTree(Tree=ins_8, Path="{0}")
tab_cleanup_preview_curves_2 = ClusterOutput(tab_cleanup_preview_curves)
cut_transition_preview_lines_2 = ClusterOutput(cut_transition_preview_lines)
cut_exit_preview_lines_2 = ClusterOutput(cut_exit_preview_lines)
toolpath_preview_curves_2 = ClusterOutput(toolpath_preview_curves)
cut_entry_preview_lines_2 = ClusterOutput(cut_entry_preview_lines)
merge_13 = Merge(
    Data1=start_code_6,
    Data2=panel,
    Data3=filter_8,
    Data4="PAUSE 4",
    Data6=join_7,
    Data7=flatten_17,
    Data8=filter_5,
    Data9=end_code_6)
toolpath_shopbot_code = Panel(merge_13)
toolpath_shopbot_code_2 = Panel(toolpath_shopbot_code)

# ---- group: Format milling positions with axis names and feedrates
toolpath_points_6 = Point(gate_15.Target0)
lng_15 = ListLength(List=toolpath_points_6)
plunge_rate_8 = Number(plunge_rate_in_mm_m)
feed_rate_8 = Number(feed_rate_in_mm_m)
panel_18 = Panel(" X")  # disabled
panel_19 = Panel("F")  # disabled
dup_26 = DuplicateData(Data=flatten(panel_18), Number=flatten(lng_15), Order=True)  # disabled
dup_27 = DuplicateData(Data=flatten(panel_19), Number=flatten(lng_15), Order=True)  # disabled
dup_28 = DuplicateData(Data=graft(feed_rate_8), Number=graft(lng_15), Order=True)
number_of_decimal_places_5 = Panel(number_of_decimal_places)
lng_16 = ListLength(List=toolpath_points_6)
replace_2 = ReplaceItems(List=dup_28, Item=plunge_rate_8, Indices="0", Wrap=False)
pdecon_6 = Deconstruct(Point=toolpath_points_6)  # -> XComponent, YComponent, ZComponent
flatten_18 = FlattenTree(Tree=dup_27, Path="{0}")  # disabled
flatten_19 = FlattenTree(Tree=dup_26, Path="{0}")  # disabled
flatten_20 = FlattenTree(Tree=replace_2, Path="{0}")
graft_42 = GraftTree(Tree=flatten_18, IncludeEmptyLists=True, IncludeNullItems=True)  # disabled
graft_43 = GraftTree(Tree=flatten_20, IncludeEmptyLists=True, IncludeNullItems=True)
graft_44 = GraftTree(Tree=flatten_19, IncludeEmptyLists=True, IncludeNullItems=True)  # disabled
num_19 = Number(pdecon_6.XComponent)
num_20 = Number(number_of_decimal_places_5)
num_21 = Number(pdecon_6.YComponent)
num_22 = Number(number_of_decimal_places_5)
num_23 = Number(pdecon_6.ZComponent)
num_24 = Number(number_of_decimal_places_5)
expression_10 = Expression(x=num_19, y=num_20, Expression="Round(x,y)")
expression_11 = Expression(x=num_21, y=num_22, Expression="Round(x,y)")
expression_12 = Expression(x=num_23, y=num_24, Expression="Round(x,y)")
panel_20 = Panel(" Y")  # disabled
panel_21 = Panel(" Z")  # disabled
panel_22 = Panel("G1 ")  # disabled
join_26 = TextJoin(Text=[graft_42, graft_43, graft_44])  # disabled
dup_29 = DuplicateData(Data=panel_21, Number=lng_16, Order=True)  # disabled
dup_30 = DuplicateData(Data=panel_20, Number=lng_16, Order=True)  # disabled
dup_31 = DuplicateData(Data=panel_22, Number=lng_16, Order=True)  # disabled
simplify_35 = SimplifyTree(Tree=flatten(join_26), Front=False)  # disabled
simplify_36 = SimplifyTree(Tree=flatten(dup_31), Front=False)  # disabled
simplify_37 = SimplifyTree(Tree=flatten(expression_10), Front=False)
simplify_38 = SimplifyTree(Tree=flatten(dup_30), Front=False)  # disabled
simplify_39 = SimplifyTree(Tree=flatten(expression_11), Front=False)
simplify_40 = SimplifyTree(Tree=flatten(dup_29), Front=False)  # disabled
simplify_41 = SimplifyTree(Tree=flatten(expression_12), Front=False)
graft_45 = GraftTree(Tree=simplify_36, IncludeEmptyLists=True, IncludeNullItems=True)  # disabled
graft_46 = GraftTree(Tree=simplify_37, IncludeEmptyLists=True, IncludeNullItems=True)
graft_47 = GraftTree(Tree=simplify_38, IncludeEmptyLists=True, IncludeNullItems=True)  # disabled
graft_48 = GraftTree(Tree=simplify_39, IncludeEmptyLists=True, IncludeNullItems=True)
graft_49 = GraftTree(Tree=simplify_40, IncludeEmptyLists=True, IncludeNullItems=True)  # disabled
graft_50 = GraftTree(Tree=simplify_41, IncludeEmptyLists=True, IncludeNullItems=True)
graft_51 = GraftTree(Tree=simplify_35, IncludeEmptyLists=True, IncludeNullItems=True)  # disabled
join_27 = TextJoin(Text=[graft_45, graft_51, graft_46, graft_47, graft_48, graft_49, graft_50])  # disabled
flatten_21 = FlattenTree(Tree=join_27, Path="{0}")  # disabled

# ---- group: Format jog XY postions
jog_rate_x_y_3 = Number(jog_rate_x_y_in_mm_m)
item_10 = ListItem(List=expression_10, Index=0, Wrap=True)
custom_home_x_2 = Number(end_of_job_go_to_x_2)
custom_home_y_2 = Number(end_of_job_go_to_y_2)
item_11 = ListItem(List=expression_11, Index=0, Wrap=True)
int_6 = Integer(jog_rate_x_y_3)
lng_17 = ListLength(List=flatten(item_10))
safe_z_height_8 = Number(safe_z_height_2)
lng_18 = ListLength(List=flatten(item_10))
join_28 = TextJoin(Text=["F", int_6, " X"])
dup_32 = DuplicateData(Data="G1 ", Number=lng_17, Order=True)
dup_33 = DuplicateData(Data=" Y", Number=lng_17, Order=True)
dup_34 = DuplicateData(Data=" Z", Number=lng_17, Order=True)
dup_35 = DuplicateData(Data=safe_z_height_8, Number=lng_17, Order=True)
dup_36 = DuplicateData(Data=join_28, Number=lng_18, Order=True)
simplify_42 = SimplifyTree(Tree=flatten(dup_32), Front=False)
simplify_43 = SimplifyTree(Tree=flatten(item_10), Front=False)
simplify_44 = SimplifyTree(Tree=flatten(dup_33), Front=False)
simplify_45 = SimplifyTree(Tree=flatten(item_11), Front=False)
simplify_46 = SimplifyTree(Tree=flatten(dup_34), Front=False)
simplify_47 = SimplifyTree(Tree=flatten(dup_35), Front=False)
simplify_48 = SimplifyTree(Tree=flatten(dup_36), Front=False)
graft_52 = GraftTree(Tree=simplify_42, IncludeEmptyLists=True, IncludeNullItems=True)
graft_53 = GraftTree(Tree=simplify_48, IncludeEmptyLists=True, IncludeNullItems=True)
graft_54 = GraftTree(Tree=simplify_43, IncludeEmptyLists=True, IncludeNullItems=True)
graft_55 = GraftTree(Tree=simplify_44, IncludeEmptyLists=True, IncludeNullItems=True)
graft_56 = GraftTree(Tree=simplify_45, IncludeEmptyLists=True, IncludeNullItems=True)
graft_57 = GraftTree(Tree=simplify_46, IncludeEmptyLists=True, IncludeNullItems=True)
graft_58 = GraftTree(Tree=simplify_47, IncludeEmptyLists=True, IncludeNullItems=True)
join_29 = TextJoin(Text=[graft_52, graft_53, graft_54, graft_55, graft_56])
jog_rate_x_y_4 = Integer(jog_rate_x_y_3)
flatten_22 = FlattenTree(Tree=join_29, Path="{0}")
join_30 = TextJoin(Text=["F", jog_rate_x_y_4])
home_x_2 = Number(custom_home_x_2)
home_y_2 = Number(custom_home_y_2)
join_31 = TextJoin(Text=["G1 ", join_30, " X", home_x_2, " Y", home_y_2])
merge_14 = Merge(Data1=flatten(flatten_22), Data2=flatten(join_31))
jog_x_y_positions_2 = Panel(merge_14)

# ---- group: Format jog Z postions
# G-Code toolpath processing
jog_rate_z_4 = Number(jog_rate_z_in_mm_m)
int_7 = Integer(jog_rate_z_4)
join_32 = TextJoin(Text=["F", int_7])
safe_z_height_9 = Number(safe_z_height_2)
join_33 = TextJoin(Text=["G1 ", join_32, " Z", safe_z_height_9])
lng_19 = ListLength(List=merge_14)
dup_37 = DuplicateData(Data=join_33, Number=lng_19, Order=True)
flatten_23 = FlattenTree(Tree=dup_37, Path="{0}")
jog_z_positions_2 = Panel(flatten_23)

# ----
format = Format(Format="G1 F{0} X{1} Y{2} Z{3}", Culture=127, Data0=graft_43, Data1=graft_46, Data2=graft_48, Data3=graft_50)
flatten_24 = FlattenTree(Tree=format, Path="{0}")

# ---- group: Format milling positions with axis names and feedrates (continued)
panel_23 = Panel(flatten_24)

# ---- group: Insert jog to safe Z
ma_5 = MassAddition(Input=flatten(lng_16))  # -> Result, PartialResults
merge_15 = Merge(Data1=Slider(0, range=0..100), Data2=ma_5.PartialResults)
ins_9 = InsertItems(List=flatten(panel_23), Item=flatten(jog_z_positions_2), Indices=flatten(merge_15), Wrap=True)

# ----
panel_24 = Panel(join_33)

# ---- group: Insert jog X Y positions
lng_20 = ListLength(List=merge_15)
series_3 = Series(Start=1, Step=1, Count=lng_20)
addition_4 = Addition(A=merge_15, B=series_3)
ins_10 = InsertItems(List=flatten(ins_9), Item=flatten(jog_x_y_positions_2), Indices=flatten(addition_4), Wrap=True)

# ----
merge_16 = Merge(Data1=start_code_3, Data2=panel_24, Data3=g_code_spindle_start_2)
# Startcode - Ultimaker original , extruder upgrade + heatbed: M190 S70.000000
# M109 T0 S220.000000
# T0
# G21        ;metric values
# G90        ;absolute positioning
# M82        ;set extruder to absolute mode
# M107       ;start with the fan off
# G28 X0 Y0  ;move X/Y to min endstops
# G28 Z0     ;move Z to min endstops
# G1 Z15.0 F9000 ;move the platform down 15mm
# G92 E0                  ;zero the extruded length
# G1 F200 E17              ;extrude 17mm of feed stock
# G92 E0                  ;zero the extruded length again
# G1 F9000
# ;Put printing message on LCD screen
# M117 Bark beetle
# Startcode - Printrbot Simple: M190 S30.000000
# M109 S220.000000
# ;Sliced at: Mon 16-03-2015 21:37:50
# ;Basic settings: Layer height: 0.2 Walls: 0.8 Fill: 20
# ;Print time: 3 minutes
# ;Filament used: 0.151m 0.0g
# ;Filament cost: None
# ;M190 S30 ;Uncomment to add your own bed temperature line
# ;M109 S220 ;Uncomment to add your own temperature line
# G21        ;metric values
# G90        ;absolute positioning
# M82        ;set extruder to absolute mode
# M107       ;start with the fan off
# 
# G28 X0 Y0  ;move X/Y to min endstops
# G28 Z0     ;move Z to min endstops
# 
# G1 Z15.0 F9000 ;move the platform down 15mm
# 
# G92 E0                  ;zero the extruded length
# G1 F200 E6              ;extrude 6mm of feed stock
# G92 E0                  ;zero the extruded length again
# G1 F9000
# Startcode - FABtotum: G90        ;absolute positioning
# 
# ;G28	;Home all Axis
# 
# M3 S15000 ;SPINDLE ON - Clockwise , tries to maintain RPM constant min: 6500, max: 15000
# G4 S4; Dwell 4 seconds
# 
# G0 F600 Z-210; move to custom Z 0 position
# G92 Z0; set new zero position
startcode_2 = Panel(merge_16)
merge_17 = Merge(Data1=flatten(startcode_2), Data2=flatten(ins_10), Data3=flatten(endcode))
# Rigth click and choose "Stream destination"
# 
# Give a file name ending with .gcode
# 
# Your toolpath will automatically be updated!
toolpath_g_code = Panel(merge_17)
toolpath_g_code_2 = Panel(toolpath_g_code)
filter_21 = StreamFilter(Gate=make_shopbot_code_not_g_code_2, Stream0=toolpath_g_code_2, Stream1=toolpath_shopbot_code_2)
g_code_stream = ClusterOutput(filter_21)  # Connect a panel to stream the code to a folder on your computer

# ==== cluster CustomStartSBPCode
material_thicness = ClusterInput()
safe_z_height = ClusterInput()
safe_z_height_2 = Number(safe_z_height)
material_thicness_2 = Number(material_thicness)
# Make dialog box for safety material check: MSGBOX (Is your material thickness &Materialthickness mm?, YesNo, SAFETY CHECK)    'create a pop-up dialog asking for confirmation of material thickness
# IF &msganswer = NO THEN GOSUB Canceljob      'if material thickness is wrong, go to the cancel job sub routine with a pop up message of shame
make_dialog_box_for_safety_material_chec = Panel("""MSGBOX (Is your material thickness &Materialthickness mm?, YesNo, SAFETY CHECK)    'create a pop-up dialog asking for confirmation of material thickness
IF &msganswer = NO THEN GOSUB Canceljob      'if material thickness is wrong, go to the cancel job sub routine with a pop up message of shame""")  # "Make dialog box for safety material check"
start_the_authome_x_y_z_subroutine = Panel("FP,C:\\SbParts\\XYandZzero_Zzero_bellow_material.sbp \t\t    'load the file that automatically sets X, Y and Z Zero")
zero_z_part_3 = Panel("       'make a variable for material thickness based on the user input at the start of Bark Beetle main settings")
zero_z_part_1 = Panel("&Materialthickness = ")
zero_z_part_3_2 = Panel(",,,,,0\t      'tell the controller that the current postion is ZH home position (thereby making top of material our new Z Zero)")
zero_z_part_1_2 = Panel("VA,,,")
jog_part_3 = Panel("         'move to Z axis to material top of material + Z home postion")
jog_part_1 = Panel("JZ,")
addition = Addition(A=material_thicness_2, B=safe_z_height_2)
merge = Merge(Data1=zero_z_part_1, Data2=material_thicness_2, Data3=zero_z_part_3)
merge_2 = Merge(Data1=zero_z_part_1_2, Data2=safe_z_height_2, Data3=zero_z_part_3_2)
merge_3 = Merge(Data1=jog_part_1, Data2=addition, Data3=jog_part_3)
join = TextJoin(Text=merge)
join_2 = TextJoin(Text=merge_2)
join_3 = TextJoin(Text=merge_3)
merge_4 = Merge(
    Data1=flatten(join),
    Data2=flatten(make_dialog_box_for_safety_material_chec),
    Data3=flatten(start_the_authome_x_y_z_subroutine),
    Data4=flatten(join_3),
    Data5=flatten(join_2),
    Data6=flatten(join))
panel = Panel(merge_4)
start_code = Text(panel)
start_code_2 = ClusterOutput(start_code)

# ==== cluster CNCMillingPostProcessor_2: Converts toolpath curves into coordinates that a CNC machine can read. Use tab boxes for making safe cutouts, and ramps for smooth entry into hard materials.
make_shopbot_code_not_g_code = ClusterInput()
z_zero_is_at_bottom_of_stock = ClusterInput()  # Is Z zero postion at bottom or top of staock
use_high_speed_machining = ClusterInput()  # 0=off 1=Trochoidal 2=Plunge roughing
toolpath_width_factor = ClusterInput()
milling_bit_diameter = ClusterInput()
deviation_tolerance = ClusterInput()
end_of_job_go_to_x = ClusterInput()
end_of_job_go_to_y = ClusterInput()
material_thickness = ClusterInput()  # Used to create correct Z height for toolpaths when Z zero is at stock bottom
toolpath_curves = ClusterInput()
use_peck_entry = ClusterInput()
ramp_plunges = ClusterInput()
thread_pitch = ClusterInput()
safe_z_height = ClusterInput()
ramp_angle = ClusterInput()
use_spindle = ClusterInput()
plunge_rate = ClusterInput()
start_code = ClusterInput()  # Add a suitable start code for your machine here
tab_breps = ClusterInput()
jog_rate_z = ClusterInput()
job_name = ClusterInput()
feed_rate = ClusterInput()
end_code = ClusterInput()  # Add a suitable end code for your machine here
stepover = ClusterInput()
jog_rate = ClusterInput()

# ---- group: Additional settings
spindle_startup_time_g_code = Panel("5")
max_peck_depth_factor_plunge_roughing = Panel("0.4")
number_of_decimal_places = Panel("3")

# ----
toolpath_curves_2 = Curve(toolpath_curves)
tab_breps_2 = Brep(tab_breps)
feed_rate_2 = Number(feed_rate)
plunge_rate_2 = Number(plunge_rate)
jog_rate_2 = Number(jog_rate)
jog_rate_z_2 = Number(jog_rate_z)
safe_z_height_2 = Number(safe_z_height)
use_spindle_2 = Integer(use_spindle)
ramp_plunges_2 = Integer(ramp_plunges)
ramp_angle_2 = Number(ramp_angle)
start_code_2 = Text(start_code)
end_code_2 = Text(end_code)
make_shopbot_code_not_g_code_2 = Boolean(make_shopbot_code_not_g_code)
end_of_job_go_to_x_2 = Number(end_of_job_go_to_x)
end_of_job_go_to_y_2 = Number(end_of_job_go_to_y)
deviation_tolerance_2 = Number(deviation_tolerance)
use_high_speed_machining_2 = Integer(use_high_speed_machining)
milling_bit_diameter_2 = Number(milling_bit_diameter)
toolpath_width_factor_2 = Number(toolpath_width_factor)
stepover_2 = Number(stepover)
use_peck_entry_2 = Boolean(use_peck_entry)
z_zero_is_at_bottom_of_stock_2 = Boolean(z_zero_is_at_bottom_of_stock)
material_thickness_2 = Number(material_thickness)
job_name_2 = Text(job_name)
thread_pitch_2 = Number(thread_pitch)

flatten = FlattenTree(Tree=tab_breps_2, Path="{0}")
flatten_2 = FlattenTree(Tree=toolpath_curves_2, Path="{0}")

# ---- group: Convert speeds from mm per seond to mm per minute for g-code
seconds_in_a_minute = Panel("60")
multiplication = Multiplication(A=feed_rate_2, B=seconds_in_a_minute)
multiplication_2 = Multiplication(A=plunge_rate_2, B=seconds_in_a_minute)
multiplication_3 = Multiplication(A=jog_rate_2, B=seconds_in_a_minute)
multiplication_4 = Multiplication(A=jog_rate_z_2, B=seconds_in_a_minute)
feed_rate_in_mm_m = Number(multiplication)
plunge_rate_in_mm_m = Number(multiplication_2)
jog_rate_x_y_in_mm_m = Number(multiplication_3)
jog_rate_z_in_mm_m = Number(multiplication_4)

# ---- group: Make G-Code spindle start
spindle_speed = Number(thread_pitch_2)
use_spindle_3 = Integer(use_spindle_2)
spindle_startup_time_g_code_2 = Panel(spindle_startup_time_g_code)
int = Integer(spindle_speed)
merge = Merge(Data1="M3 S", Data2=int, Data3=" ; start spindle and set spindle speed")
merge_2 = Merge(Data1="G4 P", Data2=spindle_startup_time_g_code_2, Data3=" ;wait a few seconds for the spindle to start")
join = TextJoin(Text=merge)
join_2 = TextJoin(Text=merge_2)
merge_3 = Merge(Data1=flatten(join), Data2=flatten(join_2))
filter = StreamFilter(Gate=use_spindle_3, Stream1=merge_3)
g_code_spindle_start = Panel(filter)

# ---- group: Find virtual bit diamter for trochoidal milling
multiplication_5 = Multiplication(A=milling_bit_diameter_2, B=toolpath_width_factor_2)
trochoidal_milling_bit_diameter = Number(multiplication_5)

# ---- group: Add prefix to shopbot job name
join_3 = TextJoin(Text=flatten(["'", job_name_2]))

# ----
clean = CleanTree(RemoveNulls=True, RemoveInvalid=True, RemoveEmpty=False, Tree=flatten_2)

# ---- group: Route toolpaths according to machining type
use_trochoidal_milling = Panel(use_high_speed_machining_2)
gate = StreamGate(Stream=clean, Gate=use_trochoidal_milling)  # -> Target0, Target1, Target2

# ---- group: Convert to polylines to extract toolpath coordinates
topoly = CurveToPolyline(Curve=gate.Target0, ToleranceDistance=deviation_tolerance_2, ToleranceAngle=0)  # -> Polyline, Segments
polyline_toolpaths = Curve(topoly.Polyline)

# ---- group: Adds tabs to toolpaths
tab_toolpaths = TabToolpaths(polyline_toolpaths=gate.Target1, tab_breps=flatten, milling_bit_diamter=trochoidal_milling_bit_diameter)  # -> tabbed_toolpaths_3, tab_cleanup_toolpaths_4

# ---- group: Eliminate unecessary jog Z
connect_overlapping_toolpaths = ConnectOverlappingToolpaths(polyline_toolpaths=polyline_toolpaths)

# ---- group: Adds tabs to toolpaths
tab_toolpaths_2 = TabToolpaths(polyline_toolpaths=gate.Target2, tab_breps=flatten, milling_bit_diamter=milling_bit_diameter_2)  # -> tabbed_toolpaths_3, tab_cleanup_toolpaths_4

# ----
ramp_plunges_3 = Integer(ramp_plunges_2)

# ---- group: Avoid trochoidal milling to use computer calculations
gate_2 = StreamGate(Stream=milling_bit_diameter_2, Gate=use_high_speed_machining_2)  # -> Target0, Target1
gate_3 = StreamGate(Stream=toolpath_width_factor_2, Gate=use_high_speed_machining_2)  # -> Target0, Target1
gate_4 = StreamGate(Stream=ramp_angle_2, Gate=use_high_speed_machining_2)  # -> Target0, Target1
gate_5 = StreamGate(Stream=use_peck_entry_2, Gate=use_high_speed_machining_2)  # -> Target0, Target1
gate_6 = StreamGate(Stream=max_peck_depth_factor_plunge_roughing, Gate=use_high_speed_machining_2)  # -> Target0, Target1

gate_7 = StreamGate(Stream=milling_bit_diameter_2, Gate=use_high_speed_machining_2)  # -> Target0, Target1
gate_8 = StreamGate(Stream=toolpath_width_factor_2, Gate=use_high_speed_machining_2)  # -> Target0, Target1
gate_9 = StreamGate(Stream=ramp_angle_2, Gate=use_high_speed_machining_2)  # -> Target0, Target1
gate_10 = StreamGate(Stream=use_peck_entry_2, Gate=use_high_speed_machining_2)  # -> Target0, Target1
gate_11 = StreamGate(Stream=max_peck_depth_factor_plunge_roughing, Gate=use_high_speed_machining_2)  # -> Target0, Target1

# ----
filter_2 = StreamFilter(Gate=ramp_plunges_3, Stream0=connect_overlapping_toolpaths, Stream1=polyline_toolpaths)
trochoidal_high_speed_milling = TrochoidalHighSpeedMilling(
    toolpath_curves=tab_toolpaths.tabbed_toolpaths_3,
    milling_bit_diameter=gate_2.Target1,
    toolpath_width_factor=gate_3.Target1,
    stepover=stepover_2,
    ramp_angle=gate_4.Target1,
    jog_z_lift_factor=0.1,
    use_climb_milling=True,
    straight_arc_extensions=True,
    use_peck_entry=gate_5.Target1,
    max_peck_depth_factor=gate_6.Target1)
trochoidal_high_speed_milling_2 = TrochoidalHighSpeedMilling(
    toolpath_curves=tab_toolpaths.tab_cleanup_toolpaths_4,
    milling_bit_diameter=gate_7.Target1,
    toolpath_width_factor=gate_8.Target1,
    stepover=stepover_2,
    ramp_angle=gate_9.Target1,
    jog_z_lift_factor=0.1,
    use_climb_milling=True,
    straight_arc_extensions=True,
    use_peck_entry=gate_10.Target1,
    max_peck_depth_factor=gate_11.Target1)
plunge_roughing = PlungeRoughing(toolpath_curves=tab_toolpaths_2.tabbed_toolpaths_3, milling_bit_diameter=milling_bit_diameter_2, stepover=stepover_2)
plunge_roughing_2 = PlungeRoughing(
    toolpath_curves=tab_toolpaths_2.tab_cleanup_toolpaths_4,
    milling_bit_diameter=milling_bit_diameter_2,
    stepover=stepover_2)
plunge_rough_lines = Curve(plunge_roughing)
plunge_rough_lines_2 = Curve(plunge_roughing_2)

# ---- group: Convert to polylines to extract toolpath coordinates
topoly_2 = CurveToPolyline(Curve=trochoidal_high_speed_milling_2, ToleranceDistance=deviation_tolerance_2, ToleranceAngle=0)  # -> Polyline, Segments
join_4 = JoinCurves(Curves=topoly_2.Polyline, Preserve=False)

topoly_3 = CurveToPolyline(Curve=trochoidal_high_speed_milling, ToleranceDistance=deviation_tolerance_2, ToleranceAngle=0)  # -> Polyline, Segments
join_5 = JoinCurves(Curves=topoly_3.Polyline, Preserve=False)

# ----
trochoidal_polyline_toolpaths = Curve(join_5)
trochoidal_polyline_toolpaths_from_insid = Curve(join_4)  # "Trochoidal polyline toolpaths from inside tab boundary boxes"
use_high_speed_machining_3 = Panel(use_high_speed_machining_2)
use_high_speed_machining_4 = Panel(use_high_speed_machining_2)
number_of_decimal_places_2 = Panel(number_of_decimal_places)
number_of_decimal_places_3 = Panel(number_of_decimal_places)
num = Number(number_of_decimal_places_2)
num_2 = Number(number_of_decimal_places_2)
num_3 = Number(number_of_decimal_places_3)
num_4 = Number(number_of_decimal_places_3)
num_5 = Number(number_of_decimal_places_3)
num_6 = Number(number_of_decimal_places_2)
num_7 = Number(number_of_decimal_places_2)
num_8 = Number(number_of_decimal_places_2)

# ---- group: Prepare correct safe Z height
subtraction = Subtraction(ActualSafeZHeight=safe_z_height_2, MaterialThickness=material_thickness_2)
filter_3 = StreamFilter(ZZeroIsAtBottomOfStock=z_zero_is_at_bottom_of_stock_2, Stream0=safe_z_height_2, Stream1=subtraction)

# ----
rpm = Panel(",2000,2000")

# ---- group: Name
panel = Panel(join_3)

# ---- group: Set spindle speed
spindle_speed_2 = Number(thread_pitch_2)
int_2 = Integer(spindle_speed_2)
join_6 = TextJoin(Text=["MI,B,1,", int_2, ",0,0"])

# ---- group: Make intial jog to safe Z
safe_z_height_3 = Number(flatten(safe_z_height_2))
text = Text("JZ,")
graft = GraftTree(Tree=safe_z_height_3, IncludeEmptyLists=True, IncludeNullItems=True)
graft_2 = GraftTree(Tree=text, IncludeEmptyLists=True, IncludeNullItems=True)
join_7 = TextJoin(Text=[graft_2, graft])

# ---- group: Set Feed rate (X Y speed) and plunge rate (Z speed)
feed_rate_3 = Number(feed_rate_2)
plunge_rate_3 = Number(plunge_rate_2)
plunge_rate_4 = Number(plunge_rate_3)
feed_rate_4 = Number(feed_rate_3)
text_2 = Text("MS,")
text_3 = Text(",")
join_8 = TextJoin(Text=flatten([text_2, feed_rate_4, text_3, plunge_rate_4, rpm]))

# ---- group: Start spindle
panel_2 = Panel("PAUSE 1")
filter_4 = StreamFilter(Gate=use_spindle_2, Stream1="SO,1,1")

# ---- group: Name
# ShopBot code tab cleanup processing
panel_3 = Panel(join_3)

# ---- group: Turn off spindle
filter_5 = StreamFilter(Gate=use_spindle_2, Stream1="SO,1,0")

# ---- group: Set spindle speed
spindle_speed_3 = Number(thread_pitch_2)
int_3 = Integer(spindle_speed_3)
join_9 = TextJoin(Text=["TR,", int_3, ",1"])

# ---- group: Start spindle
panel_4 = Panel("PAUSE 1")
filter_6 = StreamFilter(Gate=use_spindle_2, Stream1="SO,1,1")

# ---- group: Set Feed rate (X Y speed) and plunge rate (Z speed)
feed_rate_5 = Number(feed_rate_2)
plunge_rate_5 = Number(plunge_rate_2)
plunge_rate_6 = Number(plunge_rate_5)
feed_rate_6 = Number(feed_rate_5)
text_4 = Text("MS,")
text_5 = Text(",")
join_10 = TextJoin(Text=flatten([text_4, feed_rate_6, text_5, plunge_rate_6]))

# ---- group: Turn off spindle
filter_7 = StreamFilter(Gate=use_spindle_2, Stream1="SO,1,0")

# ----
filter_8 = StreamFilter(Gate=use_spindle_2, Stream1=join_6)
panel_5 = Panel(join_8)
filter_9 = StreamFilter(Gate=use_spindle_2, Stream1=join_9)
text_6 = Text("J2,")
text_7 = Text("J2,")
text_8 = Text(",")
text_9 = Text(",")
join_11 = TextJoin(Text=[text_6, end_of_job_go_to_x_2, text_9, end_of_job_go_to_y_2])
join_12 = TextJoin(Text=[text_7, end_of_job_go_to_x_2, text_8, end_of_job_go_to_y_2])
g_code_spindle_start_2 = Panel(g_code_spindle_start)
g_code_spindle_start_3 = Panel(g_code_spindle_start)
start_code_3 = Text(start_code_2)
start_code_4 = Text(start_code_2)
end_code_3 = Text(end_code_2)
end_code_4 = Text(end_code_2)
endcode = Panel(end_code_3)
endcode_2 = Panel(end_code_4)
endcode_3 = Panel("""G4  S3
M280 S-90 P0 F3000 R""")
endcode_fabtotum = Panel("""G4 S2; Dwell
M5; SPINDLE OFF""")
start_code_5 = Text(start_code_2)
end_code_5 = Text(end_code_2)
start_code_6 = Text(start_code_2)
end_code_6 = Text(end_code_2)

# ---- group: Checks if there are tabs and skips tab toolpaths if there are no tab breps
lng = ListLength(List=flatten)
null = NullItem(Item=lng)  # -> NullFlags, InvalidFlags, Description
cull = CullPattern(List=milling_bit_diameter_2, CullPattern=invert(null.NullFlags))
gate_12 = StreamGate(Stream=filter_2, Gate=null.NullFlags)  # -> Target0, Target1

# ---- group: Adds tabs to toolpaths
tab_toolpaths_3 = TabToolpaths(polyline_toolpaths=gate_12.Target0, tab_breps=flatten, milling_bit_diamter=cull)  # -> tabbed_toolpaths_3, tab_cleanup_toolpaths_4

# ---- group: Checks if there are tabs and skips tab toolpaths if there are no tab breps (continued)
filter_10 = StreamFilter(Gate=null.NullFlags, Stream0=tab_toolpaths_3.tabbed_toolpaths_3, Stream1=gate_12.Target1)

# ---- group: Add ramps to cleanup toolpaths
tab_cleanup_toolpaths = Curve(tab_toolpaths_3.tab_cleanup_toolpaths_4)
ramp_plunges_4 = Integer(ramp_plunges_2)
ramp_toolpath_plunges = RampToolpathPlunges(toolpaths_to_ramp=tab_cleanup_toolpaths, ramp_angle=ramp_angle_2)
filter_11 = StreamFilter(Gate=ramp_plunges_4, Stream0=tab_cleanup_toolpaths, Stream1=ramp_toolpath_plunges)

# ---- group: Try to reduce uneccessy Z movement
connect_overlapping_toolpaths_2 = ConnectOverlappingToolpaths(polyline_toolpaths=filter_11)

# ----
panel_6 = Panel(connect_overlapping_toolpaths_2)
filter_12 = StreamFilter(
    Gate=use_high_speed_machining_3,
    Stream0=connect_overlapping_toolpaths_2,
    Stream1=trochoidal_polyline_toolpaths_from_insid,
    Stream2=plunge_rough_lines_2)

# ---- group: Move toolpaths up with material thcikness distance in case of Z zero at bottom of stock
Z = UnitZ(MaterialThickness=material_thickness_2)
move = Move(TabCleanupToolpaths=filter_12, Motion=Z)  # -> Geometry, Transform
filter_13 = StreamFilter(ZZeroIsAtBottomOfStock=z_zero_is_at_bottom_of_stock_2, Stream0=filter_12, Stream1=move.Geometry)

# ---- group: Extract toolpath points from toopath polylines
cp = ControlPoints(Curve=filter_13)  # -> Points, Weights, Knots

# ---- group: Send tab cleanup toolpath points to g-code or ShopBot code postprocessor
toolpath_points_for_tab_cleanup_job = Point(cp.Points)
make_shopbot_code_not_g_code_3 = Boolean(make_shopbot_code_not_g_code_2)
gate_13 = StreamGate(Stream=toolpath_points_for_tab_cleanup_job, Gate=make_shopbot_code_not_g_code_3)  # -> Target0, Target1

# ---- group: Format milling positions with axis names and feedrates
toolpath_points = Point(gate_13.Target0)
lng_2 = ListLength(List=toolpath_points)
number_of_decimal_places_4 = Panel(number_of_decimal_places)
feed_rate_7 = Number(feed_rate_in_mm_m)
plunge_rate_7 = Number(plunge_rate_in_mm_m)
dup = DuplicateData(Data=flatten(" X"), Number=flatten(lng_2), Order=True)
dup_2 = DuplicateData(Data=flatten("F"), Number=flatten(lng_2), Order=True)
dup_3 = DuplicateData(Data=graft(feed_rate_7), Number=graft(lng_2), Order=True)
pdecon = Deconstruct(Point=toolpath_points)  # -> XComponent, YComponent, ZComponent
lng_3 = ListLength(List=toolpath_points)
replace = ReplaceItems(List=dup_3, Item=plunge_rate_7, Indices="0", Wrap=False)
flatten_3 = FlattenTree(Tree=dup_2, Path="{0}")
flatten_4 = FlattenTree(Tree=dup, Path="{0}")
flatten_5 = FlattenTree(Tree=replace, Path="{0}")
num_9 = Number(pdecon.XComponent)
num_10 = Number(number_of_decimal_places_4)
num_11 = Number(pdecon.YComponent)
num_12 = Number(number_of_decimal_places_4)
num_13 = Number(pdecon.ZComponent)
# ShopBot code toolpath processing
num_14 = Number(number_of_decimal_places_4)
graft_3 = GraftTree(Tree=flatten_3, IncludeEmptyLists=True, IncludeNullItems=True)
expression = Expression(x=num_9, y=num_10, Expression="Round(x,y)")
expression_2 = Expression(x=num_11, y=num_12, Expression="Round(x,y)")
expression_3 = Expression(x=num_13, y=num_14, Expression="Round(x,y)")
graft_4 = GraftTree(Tree=flatten_5, IncludeEmptyLists=True, IncludeNullItems=True)
graft_5 = GraftTree(Tree=flatten_4, IncludeEmptyLists=True, IncludeNullItems=True)
panel_7 = Panel(expression)
panel_8 = Panel(expression_2)
panel_9 = Panel(expression_3)
join_13 = TextJoin(Text=[graft_3, graft_4, graft_5])
dup_4 = DuplicateData(Data=" Z", Number=lng_3, Order=True)
dup_5 = DuplicateData(Data=" Y", Number=lng_3, Order=True)
dup_6 = DuplicateData(Data="G1 ", Number=lng_3, Order=True)
simplify = SimplifyTree(Tree=flatten(join_13), Front=False)
simplify_2 = SimplifyTree(Tree=flatten(dup_6), Front=False)
simplify_3 = SimplifyTree(Tree=flatten(panel_7), Front=False)
simplify_4 = SimplifyTree(Tree=flatten(dup_5), Front=False)
simplify_5 = SimplifyTree(Tree=flatten(panel_8), Front=False)
simplify_6 = SimplifyTree(Tree=flatten(dup_4), Front=False)
simplify_7 = SimplifyTree(Tree=flatten(panel_9), Front=False)
graft_6 = GraftTree(Tree=simplify_2, IncludeEmptyLists=True, IncludeNullItems=True)
graft_7 = GraftTree(Tree=simplify_3, IncludeEmptyLists=True, IncludeNullItems=True)
graft_8 = GraftTree(Tree=simplify_4, IncludeEmptyLists=True, IncludeNullItems=True)
graft_9 = GraftTree(Tree=simplify_5, IncludeEmptyLists=True, IncludeNullItems=True)
graft_10 = GraftTree(Tree=simplify_6, IncludeEmptyLists=True, IncludeNullItems=True)
graft_11 = GraftTree(Tree=simplify_7, IncludeEmptyLists=True, IncludeNullItems=True)
graft_12 = GraftTree(Tree=simplify, IncludeEmptyLists=True, IncludeNullItems=True)
join_14 = TextJoin(Text=[graft_6, graft_12, graft_7, graft_8, graft_9, graft_10, graft_11])
flatten_6 = FlattenTree(Tree=join_14, Path="{0}")
panel_10 = Panel(flatten_6)

# ----
toolpath_points_2 = Point(gate_13.Target1)
pdecon_2 = Deconstruct(Point=toolpath_points_2)  # -> XComponent, YComponent, ZComponent
lng_4 = ListLength(List=toolpath_points_2)
num_15 = Number(pdecon_2.XComponent)
num_16 = Number(pdecon_2.YComponent)
num_17 = Number(pdecon_2.ZComponent)

# ---- group: Format jog XY postions
custom_home_y = Number(end_of_job_go_to_y_2)
jog_rate_x_y = Number(jog_rate_x_y_in_mm_m)
item = ListItem(List=expression, Index=0, Wrap=True)
custom_home_x = Number(end_of_job_go_to_x_2)
item_2 = ListItem(List=expression_2, Index=0, Wrap=True)
int_4 = Integer(jog_rate_x_y)
lng_5 = ListLength(List=flatten(item))
safe_z_height_4 = Number(safe_z_height_2)
lng_6 = ListLength(List=flatten(item))
join_15 = TextJoin(Text=["F", int_4, " X"])
dup_7 = DuplicateData(Data="G1 ", Number=lng_5, Order=True)
dup_8 = DuplicateData(Data=" Y", Number=lng_5, Order=True)
dup_9 = DuplicateData(Data=" Z", Number=lng_5, Order=True)
dup_10 = DuplicateData(Data=safe_z_height_4, Number=lng_5, Order=True)
dup_11 = DuplicateData(Data=join_15, Number=lng_6, Order=True)
simplify_8 = SimplifyTree(Tree=flatten(dup_7), Front=False)
simplify_9 = SimplifyTree(Tree=flatten(item), Front=False)
simplify_10 = SimplifyTree(Tree=flatten(dup_8), Front=False)
simplify_11 = SimplifyTree(Tree=flatten(item_2), Front=False)
simplify_12 = SimplifyTree(Tree=flatten(dup_9), Front=False)
simplify_13 = SimplifyTree(Tree=flatten(dup_10), Front=False)
simplify_14 = SimplifyTree(Tree=flatten(dup_11), Front=False)
graft_13 = GraftTree(Tree=simplify_8, IncludeEmptyLists=True, IncludeNullItems=True)
graft_14 = GraftTree(Tree=simplify_14, IncludeEmptyLists=True, IncludeNullItems=True)
graft_15 = GraftTree(Tree=simplify_9, IncludeEmptyLists=True, IncludeNullItems=True)
graft_16 = GraftTree(Tree=simplify_10, IncludeEmptyLists=True, IncludeNullItems=True)
graft_17 = GraftTree(Tree=simplify_11, IncludeEmptyLists=True, IncludeNullItems=True)
graft_18 = GraftTree(Tree=simplify_12, IncludeEmptyLists=True, IncludeNullItems=True)
graft_19 = GraftTree(Tree=simplify_13, IncludeEmptyLists=True, IncludeNullItems=True)
join_16 = TextJoin(Text=[graft_13, graft_14, graft_15, graft_16, graft_17])
jog_rate_x_y_2 = Integer(jog_rate_x_y)
flatten_7 = FlattenTree(Tree=join_16, Path="{0}")
join_17 = TextJoin(Text=["F", jog_rate_x_y_2])
home_x = Number(custom_home_x)
home_y = Number(custom_home_y)
join_18 = TextJoin(Text=["G1 ", join_17, " X", home_x, " Y", home_y])
merge_4 = Merge(Data1=flatten(flatten_7), Data2=flatten(join_18))
jog_x_y_positions = Panel(merge_4)

# ----
expression_4 = Expression(x=num_15, y=num_3, Expression="Round(x,y)")
expression_5 = Expression(x=num_16, y=num_4, Expression="Round(x,y)")
expression_6 = Expression(x=num_17, y=num_5, Expression="Round(x,y)")
flatten_8 = FlattenTree(Tree=lng_4, Path="{0}")
merge_5 = Merge(Data1=Slider(0, range=0..100), Data2=flatten_8)
panel_11 = Panel(expression_4)
panel_12 = Panel(expression_5)
panel_13 = Panel(expression_6)

# ---- group: Jog to startpoints
item_3 = ListItem(List=expression_4, Index=0, Wrap=True)
item_4 = ListItem(List=expression_5, Index=0, Wrap=True)
lng_7 = ListLength(List=flatten(item_3))
text_10 = Text(",")
text_11 = Text("J2,")
dup_12 = DuplicateData(Data=text_11, Number=lng_7, Order=True)
dup_13 = DuplicateData(Data=text_10, Number=lng_7, Order=True)
simplify_15 = SimplifyTree(Tree=flatten(dup_12), Front=False)
simplify_16 = SimplifyTree(Tree=flatten(item_3), Front=False)
simplify_17 = SimplifyTree(Tree=flatten(dup_13), Front=False)
simplify_18 = SimplifyTree(Tree=flatten(item_4), Front=False)
graft_20 = GraftTree(Tree=simplify_15, IncludeEmptyLists=True, IncludeNullItems=True)
graft_21 = GraftTree(Tree=simplify_16, IncludeEmptyLists=True, IncludeNullItems=True)
graft_22 = GraftTree(Tree=simplify_17, IncludeEmptyLists=True, IncludeNullItems=True)
graft_23 = GraftTree(Tree=simplify_18, IncludeEmptyLists=True, IncludeNullItems=True)
join_19 = TextJoin(Text=[graft_20, graft_21, graft_22, graft_23])
flatten_9 = FlattenTree(Tree=join_19, Path="{0}")
merge_6 = Merge(Data1=flatten_9, Data2=join_11)

# ---- group: Jog to safe Z
safe_z_height_5 = Number(flatten(safe_z_height_2))
text_12 = Text("JZ,")
graft_24 = GraftTree(Tree=safe_z_height_5, IncludeEmptyLists=True, IncludeNullItems=True)
graft_25 = GraftTree(Tree=text_12, IncludeEmptyLists=True, IncludeNullItems=True)
lng_8 = ListLength(List=flatten(merge_5))
join_20 = TextJoin(Text=[graft_25, graft_24])
dup_14 = DuplicateData(Data=join_20, Number=lng_8, Order=True)

# ---- group: Toolpath coordinates
text_13 = Text("M3,")
text_14 = Text(",")
text_15 = Text(",")
dup_15 = DuplicateData(Data=text_15, Number=lng_4, Order=True)
dup_16 = DuplicateData(Data=text_14, Number=lng_4, Order=True)
dup_17 = DuplicateData(Data=text_13, Number=lng_4, Order=True)
simplify_19 = SimplifyTree(Tree=flatten(dup_17), Front=False)
simplify_20 = SimplifyTree(Tree=flatten(panel_11), Front=False)
simplify_21 = SimplifyTree(Tree=flatten(dup_16), Front=False)
simplify_22 = SimplifyTree(Tree=flatten(panel_12), Front=False)
simplify_23 = SimplifyTree(Tree=flatten(dup_15), Front=False)
simplify_24 = SimplifyTree(Tree=flatten(panel_13), Front=False)
graft_26 = GraftTree(Tree=simplify_19, IncludeEmptyLists=True, IncludeNullItems=True)
graft_27 = GraftTree(Tree=simplify_20, IncludeEmptyLists=True, IncludeNullItems=True)
graft_28 = GraftTree(Tree=simplify_21, IncludeEmptyLists=True, IncludeNullItems=True)
graft_29 = GraftTree(Tree=simplify_22, IncludeEmptyLists=True, IncludeNullItems=True)
graft_30 = GraftTree(Tree=simplify_23, IncludeEmptyLists=True, IncludeNullItems=True)
graft_31 = GraftTree(Tree=simplify_24, IncludeEmptyLists=True, IncludeNullItems=True)
join_21 = TextJoin(Text=[graft_26, graft_27, graft_28, graft_29, graft_30, graft_31])
flatten_10 = FlattenTree(Tree=join_21, Path="{0}")

# ---- group: Format jog Z postions
# G-Code tab cleanup processing
jog_rate_z_3 = Number(jog_rate_z_in_mm_m)
int_5 = Integer(jog_rate_z_3)
join_22 = TextJoin(Text=["F", int_5])
safe_z_height_6 = Number(safe_z_height_2)
join_23 = TextJoin(Text=["G1 ", join_22, " Z", safe_z_height_6])
lng_9 = ListLength(List=merge_4)
dup_18 = DuplicateData(Data=join_23, Number=lng_9, Order=True)
flatten_11 = FlattenTree(Tree=dup_18, Path="{0}")
jog_z_positions = Panel(flatten_11)

# ---- group: Insert JZ commands
ma = MassAddition(Input=merge_5)  # -> Result, PartialResults
ins = InsertItems(List=flatten_10, Item=dup_14, Indices=ma.PartialResults, Wrap=True)

# ---- group: Insert jog to safe Z
ma_2 = MassAddition(Input=flatten(lng_3))  # -> Result, PartialResults
merge_7 = Merge(Data1=Slider(0, range=0..100), Data2=ma_2.PartialResults)
ins_2 = InsertItems(List=flatten(panel_10), Item=flatten(jog_z_positions), Indices=flatten(merge_7), Wrap=True)

# ---- group: Insert J2 commands
lng_10 = ListLength(List=merge_6)
dup_19 = DuplicateData(Data=Slider(1, range=0..1), Number=lng_10, Order=True)
addition = Addition(A=dup_19, B=merge_5)
ma_3 = MassAddition(Input=addition)  # -> Result, PartialResults
ins_3 = InsertItems(List=ins, Item=merge_6, Indices=ma_3.PartialResults, Wrap=True)

# ----
panel_14 = Panel(join_23)

# ---- group: Insert jog X Y positions
lng_11 = ListLength(List=merge_7)
series = Series(Start=1, Step=1, Count=lng_11)
addition_2 = Addition(A=merge_7, B=series)
ins_4 = InsertItems(List=flatten(ins_2), Item=flatten(jog_x_y_positions), Indices=flatten(addition_2), Wrap=True)

# ----
flatten_12 = FlattenTree(Tree=ins_3, Path="{0}")
merge_8 = Merge(Data1=start_code_4, Data2=panel_14, Data3=g_code_spindle_start_3)
startcode = Panel(merge_8)
merge_9 = Merge(
    Data1=start_code_5,
    Data2=panel_3,
    Data3=filter_9,
    Data4=filter_6,
    Data5=panel_4,
    Data6=join_10,
    Data7=flatten_12,
    Data8=filter_5,
    Data9=end_code_5)
merge_10 = Merge(Data1=flatten(startcode), Data2=flatten(ins_4), Data3=flatten(endcode_2))
tab_cleanup_toolpath_shopbot_code = Panel(merge_9)
tab_cleanup_toolpath_g_code = Panel(merge_10)
tab_cleanup_toolpath_shopbot_code_2 = Panel(tab_cleanup_toolpath_shopbot_code)
tab_cleanup_toolpath_g_code_2 = Panel(tab_cleanup_toolpath_g_code)
filter_14 = StreamFilter(Gate=make_shopbot_code_not_g_code_2, Stream0=tab_cleanup_toolpath_g_code_2, Stream1=tab_cleanup_toolpath_shopbot_code_2)
g_code_for_tab_cleanup = ClusterOutput(filter_14)  # Connect a panel to stream the code to a folder on your computer

# ---- group: Checks if ramp plunges = true
ramp_plunges_5 = Integer(ramp_plunges_2)
gate_14 = StreamGate(Stream=filter_10, Gate=ramp_plunges_5)  # -> Target0, Target1

# ---- group: Add ramps to toolpaths
ramp_toolpath_plunges_2 = RampToolpathPlunges(toolpaths_to_ramp=gate_14.Target1, ramp_angle=ramp_angle_2)

# ---- group: Try to reduce uneccessy Z movement
connect_overlapping_toolpaths_3 = ConnectOverlappingToolpaths(polyline_toolpaths=ramp_toolpath_plunges_2)

# ---- group: Checks if ramp plunges = true (continued)
filter_15 = StreamFilter(Gate=flatten(ramp_plunges_5), Stream0=flatten(gate_14.Target0), Stream1=flatten(connect_overlapping_toolpaths_3))

# ----
filter_16 = StreamFilter(Gate=use_high_speed_machining_4, Stream0=filter_15, Stream1=trochoidal_polyline_toolpaths, Stream2=plunge_rough_lines)

# ---- group: Move toolpaths up with material thcikness distance in case of Z zero at bottom of stock
Z_2 = UnitZ(MaterialThickness=material_thickness_2)
move_2 = Move(Toolpaths=filter_16, Motion=Z_2)  # -> Geometry, Transform
filter_17 = StreamFilter(ZZeroIsAtBottomOfStock=z_zero_is_at_bottom_of_stock_2, Stream0=filter_16, Stream1=move_2.Geometry)

# ---- group: Extract toolpath points from toopath polylines
cp_2 = ControlPoints(Curve=filter_17)  # -> Points, Weights, Knots

# ---- group: Send main toolpath points to g-code or ShopBot code postprocessor
make_shopbot_code_not_g_code_4 = Boolean(make_shopbot_code_not_g_code_2)
toolpath_points_3 = Point(cp_2.Points)
gate_15 = StreamGate(Stream=toolpath_points_3, Gate=make_shopbot_code_not_g_code_4)  # -> Target0, Target1

# ----
toolpath_points_4 = Point(gate_15.Target1)

# ---- group: Find distance of threading moves
rev = ReverseList(List=toolpath_points_4)
item_5 = ListItem(List=toolpath_points_4, Index=0, Wrap=True)
item_6 = ListItem(List=rev, Index=0, Wrap=True)
dist = Distance(PointA=item_5, PointB=item_6)
distance_of_threading_moves = Panel(dist)

# ---- group: Find headstock revoltion for entry into material
item_7 = ListItem(List=toolpath_points_4, Index=0, Wrap=True)
safe_z_height_7 = Number(flatten(safe_z_height_2))
threading_pitch = Number(thread_pitch_2)
pdecon_3 = Deconstruct(Point=item_7)  # -> XComponent, YComponent, ZComponent
subtraction_2 = Subtraction(A=safe_z_height_7, B=pdecon_3.ZComponent)
division = Division(A=subtraction_2, B=threading_pitch)
round = Round(Number=division)  # -> Nearest, Floor, Ceiling
multiplication_6 = Multiplication(A=round.Ceiling, B="360")
headstock_degrees_to_spin_to_during_entr = Panel(multiplication_6)  # "Headstock degrees to spin to during entry into material"

# ---- group: Find number of revolutions
threading_pitch_2 = Number(thread_pitch_2)
division_2 = Division(A=distance_of_threading_moves, B=threading_pitch_2)
multiplication_7 = Multiplication(A=division_2, B="360")
headstock_degrees_to_spin_to_per_move = Panel(multiplication_7)

# ---- group: Find rest revoltions
round_2 = Round(Number=division_2)  # -> Nearest, Floor, Ceiling
subtraction_3 = Subtraction(A=round_2.Ceiling, B=division_2)
panel_15 = Panel(subtraction_3)
multiplication_8 = Multiplication(A=panel_15, B="360")

# ----
toolpath_points_5 = Point(gate_15.Target1)
smaller = SmallerThan(FirstNumber=multiplication_8, SecondNumber="180")  # -> SmallerThan, OrEqualTo

# ---- group: Add full revoltion if zero
equals = Equality(FirstNumber=multiplication_8, SecondNumber="0")  # -> Equality, Inequality
p_n_c = PickNChoose(Pattern=equals.Equality, Stream0=multiplication_8, Stream1="360")

# ----
rev_2 = ReverseList(List=toolpath_points_4)
item_8 = ListItem(List=rev_2, Index=0, Wrap=True)
pdecon_4 = Deconstruct(Point=item_8)  # -> XComponent, YComponent, ZComponent
addition_3 = Addition(A=headstock_degrees_to_spin_to_per_move, B=headstock_degrees_to_spin_to_during_entr)
rest_degrees_for_jog_up_before_reset_b_a = Panel(p_n_c)  # "Rest degrees for jog up (before reset B axis to 0)"
headstock_degrees_after_entry_and_thread = Panel(addition_3)  # "Headstock degrees after entry and threading move"
num_18 = Number(pdecon_4.YComponent)
num_19 = Number(pdecon_4.XComponent)
expression_7 = Expression(x=num_18, y=num, Expression="Round(x,y)")
expression_8 = Expression(x=num_19, y=num_2, Expression="Round(x,y)")
weave = Weave(Pattern=[0, 1], Stream0=headstock_degrees_to_spin_to_during_entr, Stream1=addition_3, NullGaps=False)
pdecon_5 = Deconstruct(Point=toolpath_points_5)  # -> XComponent, YComponent, ZComponent
lng_12 = ListLength(List=toolpath_points_5)
panel_16 = Panel(expression_8)
panel_17 = Panel(expression_7)
addition_4 = Addition(A=rest_degrees_for_jog_up_before_reset_b_a, B=headstock_degrees_after_entry_and_thread)
num_20 = Number(pdecon_5.YComponent)
num_21 = Number(pdecon_5.XComponent)
num_22 = Number(pdecon_5.ZComponent)
expression_9 = Expression(x=num_20, y=num_7, Expression="Round(x,y)")
expression_10 = Expression(x=num_21, y=num_6, Expression="Round(x,y)")
expression_11 = Expression(x=num_22, y=num_8, Expression="Round(x,y)")

# ---- group: Prepare correct height of toolpaths for preview
Z_3 = UnitZ(MaterialThickness=material_thickness_2)
rev_3 = Reverse(Vector=Z_3)
move_3 = Move(ToolpathPoints=toolpath_points_3, Motion=rev_3)  # -> Geometry, Transform
filter_18 = StreamFilter(ZZeroIsAtBottomOfStock=z_zero_is_at_bottom_of_stock_2, Stream0=toolpath_points_3, Stream1=move_3.Geometry)

# ----
flatten_13 = FlattenTree(Tree=lng_12, Path="{0}")
merge_11 = Merge(Data1=Slider(0, range=0..100), Data2=flatten_13)
panel_18 = Panel(expression_10)
panel_19 = Panel(expression_9)
panel_20 = Panel(expression_11)
lng_13 = ListLength(List=flatten(flatten_13))
lng_14 = ListLength(List=flatten(merge_11))

# ---- group: Jog to startpoints
item_9 = ListItem(List=expression_10, Index=0, Wrap=True)
item_10 = ListItem(List=expression_9, Index=0, Wrap=True)
lng_15 = ListLength(List=flatten(item_9))
text_16 = Text("J2,")
text_17 = Text(",")
dup_20 = DuplicateData(Data=text_16, Number=lng_15, Order=True)
dup_21 = DuplicateData(Data=text_17, Number=lng_15, Order=True)
simplify_25 = SimplifyTree(Tree=flatten(dup_20), Front=False)
simplify_26 = SimplifyTree(Tree=flatten(item_9), Front=False)
simplify_27 = SimplifyTree(Tree=flatten(dup_21), Front=False)
simplify_28 = SimplifyTree(Tree=flatten(item_10), Front=False)
graft_32 = GraftTree(Tree=simplify_25, IncludeEmptyLists=True, IncludeNullItems=True)
graft_33 = GraftTree(Tree=simplify_26, IncludeEmptyLists=True, IncludeNullItems=True)
graft_34 = GraftTree(Tree=simplify_27, IncludeEmptyLists=True, IncludeNullItems=True)
graft_35 = GraftTree(Tree=simplify_28, IncludeEmptyLists=True, IncludeNullItems=True)
join_24 = TextJoin(Text=[graft_32, graft_33, graft_34, graft_35])
flatten_14 = FlattenTree(Tree=join_24, Path="{0}")
merge_12 = Merge(Data1=flatten_14, Data2=join_12)

# ---- group: Toolpath coordinates and headstock rotations
number_of_headstock_revolutions_per_move = Panel(weave)
text_18 = Text(",")
_0 = Text(",0,")
text_19 = Text(",")
text_20 = Text("M5,")
dup_22 = DuplicateData(Data=text_18, Number=lng_12, Order=True)
dup_23 = DuplicateData(Data=_0, Number=lng_12, Order=True)
dup_24 = DuplicateData(Data=text_19, Number=lng_12, Order=True)
dup_25 = DuplicateData(Data=text_20, Number=lng_12, Order=True)
simplify_29 = SimplifyTree(Tree=flatten(dup_25), Front=False)
simplify_30 = SimplifyTree(Tree=flatten(panel_18), Front=False)
simplify_31 = SimplifyTree(Tree=flatten(dup_24), Front=False)
simplify_32 = SimplifyTree(Tree=flatten(panel_19), Front=False)
simplify_33 = SimplifyTree(Tree=flatten(dup_22), Front=False)
simplify_34 = SimplifyTree(Tree=flatten(panel_20), Front=False)
simplify_35 = SimplifyTree(Tree=flatten(dup_23), Front=False)
simplify_36 = SimplifyTree(Tree=flatten(number_of_headstock_revolutions_per_move), Front=False)
graft_36 = GraftTree(Tree=simplify_29, IncludeEmptyLists=True, IncludeNullItems=True)
graft_37 = GraftTree(Tree=simplify_30, IncludeEmptyLists=True, IncludeNullItems=True)
graft_38 = GraftTree(Tree=simplify_31, IncludeEmptyLists=True, IncludeNullItems=True)
graft_39 = GraftTree(Tree=simplify_32, IncludeEmptyLists=True, IncludeNullItems=True)
graft_40 = GraftTree(Tree=simplify_33, IncludeEmptyLists=True, IncludeNullItems=True)
graft_41 = GraftTree(Tree=simplify_34, IncludeEmptyLists=True, IncludeNullItems=True)
graft_42 = GraftTree(Tree=simplify_35, IncludeEmptyLists=True, IncludeNullItems=True)
graft_43 = GraftTree(Tree=simplify_36, IncludeEmptyLists=True, IncludeNullItems=True)
join_25 = TextJoin(Text=[graft_36, graft_37, graft_38, graft_39, graft_40, graft_41, graft_42, graft_43])
flatten_15 = FlattenTree(Tree=join_25, Path="{0}")

# ---- group: Make zero B axis commands
zb = Text("ZB")
dup_26 = DuplicateData(Data=zb, Number=lng_14, Order=True)

# ----
simplify_37 = SimplifyTree(Tree=flatten(panel_17), Front=False)
dup_27 = DuplicateData(Data=",", Number=lng_13, Order=True)
simplify_38 = SimplifyTree(Tree=flatten(panel_16), Front=False)
simplify_39 = SimplifyTree(Tree=flatten(dup_27), Front=False)
simplify_40 = SimplifyTree(Tree=flatten(dup_27), Front=False)
graft_44 = GraftTree(Tree=simplify_37, IncludeEmptyLists=True, IncludeNullItems=True)
graft_45 = GraftTree(Tree=simplify_39, IncludeEmptyLists=True, IncludeNullItems=True)
graft_46 = GraftTree(Tree=simplify_38, IncludeEmptyLists=True, IncludeNullItems=True)
graft_47 = GraftTree(Tree=simplify_40, IncludeEmptyLists=True, IncludeNullItems=True)

# ---- group: Make jog to safe Z after moves, including and extra spin before reseting B axis to 0
safe_z_height_8 = Number(flatten(safe_z_height_2))
_0_2 = Text(",0,")
dup_28 = DuplicateData(Data="M5,", Number=lng_13, Order=True)
dup_29 = DuplicateData(Data=_0_2, Number=lng_13, Order=True)
flatten_16 = FlattenTree(Tree=addition_4, Path="{0}")
dup_30 = DuplicateData(Data=safe_z_height_8, Number=lng_13, Order=True)
simplify_41 = SimplifyTree(Tree=flatten(dup_28), Front=False)
simplify_42 = SimplifyTree(Tree=flatten(dup_29), Front=False)
simplify_43 = SimplifyTree(Tree=flatten(dup_30), Front=False)
simplify_44 = SimplifyTree(Tree=flatten(flatten_16), Front=False)
graft_48 = GraftTree(Tree=simplify_41, IncludeEmptyLists=True, IncludeNullItems=True)
graft_49 = GraftTree(Tree=simplify_42, IncludeEmptyLists=True, IncludeNullItems=True)
graft_50 = GraftTree(Tree=simplify_44, IncludeEmptyLists=True, IncludeNullItems=True)
graft_51 = GraftTree(Tree=simplify_43, IncludeEmptyLists=True, IncludeNullItems=True)
join_26 = TextJoin(Text=[graft_48, graft_46, graft_47, graft_44, graft_45, graft_51, graft_49, graft_50])
merge_13 = Merge(Data1=flatten(join_7), Data2=flatten(join_26))
panel_21 = Panel(merge_13)

# ---- group: Create jog transtion points
safe_z_height_9 = Number(filter_3)
end_of_job_go_to_y_3 = Number(end_of_job_go_to_y_2)
toolpath_points_6 = Point(filter_18)
end_of_job_go_to_x_3 = Number(end_of_job_go_to_x_2)
flatten_17 = FlattenTree(Tree=toolpath_points_6, Path="{0}")
item_11 = ListItem(List=flatten_17, Index=0, Wrap=True)
rev_4 = ReverseList(List=toolpath_points_6)
null_2 = NullItem(Item=item_11)  # -> NullFlags, InvalidFlags, Description
# Create toolpath preview geometry
item_12 = ListItem(List=toolpath_points_6, Index=0, Wrap=True)
item_13 = ListItem(List=rev_4, Index=0, Wrap=True)
filter_19 = StreamFilter(Gate=null_2.NullFlags, Stream0=end_of_job_go_to_x_3)
filter_20 = StreamFilter(Gate=null_2.NullFlags, Stream0=end_of_job_go_to_y_3)
pdecon_6 = Deconstruct(Point=item_12)  # -> XComponent, YComponent, ZComponent
pdecon_7 = Deconstruct(Point=item_13)  # -> XComponent, YComponent, ZComponent
panel_22 = Panel(end_of_job_go_to_y_3)
panel_23 = Panel(end_of_job_go_to_x_3)
pt = ConstructPoint(XCoordinate=pdecon_6.XComponent, YCoordinate=pdecon_6.YComponent, ZCoordinate=safe_z_height_9)
pt_2 = ConstructPoint(XCoordinate=filter_19, YCoordinate=filter_20, ZCoordinate=safe_z_height_9)
pt_3 = ConstructPoint(XCoordinate=panel_23, YCoordinate=panel_22, ZCoordinate=safe_z_height_9)
pt_4 = ConstructPoint(XCoordinate=pdecon_7.XComponent, YCoordinate=pdecon_7.YComponent, ZCoordinate=safe_z_height_9)
most_probable_start_position = Point(pt_3)
end_position = Point(pt_2)
safe_z_end_point = Point(pt_4)
safe_z_start_point = Point(pt)

# ---- group: Insert JZ commands
ma_4 = MassAddition(Input=merge_11)  # -> Result, PartialResults
ins_5 = InsertItems(List=flatten_15, Item=panel_21, Indices=ma_4.PartialResults, Wrap=True)

# ---- group: Insert zero B axis commands
series_2 = Series(Start="1", Step="1", Count=lng_14)
addition_5 = Addition(A=ma_4.PartialResults, B=series_2)
ins_6 = InsertItems(List=ins_5, Item=dup_26, Indices=addition_5, Wrap=True)

# ---- group: Create toolpath previews
rev_5 = ReverseList(List=flatten(safe_z_start_point))
ins_7 = InsertItems(List=flatten(rev_5), Item=end_position, Indices="0", Wrap=True)
ins_8 = InsertItems(List=flatten(safe_z_end_point), Item=most_probable_start_position, Indices="0", Wrap=True)
rev_6 = ReverseList(List=flatten(ins_8))
ln = Line(StartPoint=rev_6, EndPoint=ins_7)
ln_2 = Line(StartPoint=safe_z_start_point, EndPoint=item_12)
ln_3 = Line(StartPoint=item_13, EndPoint=safe_z_end_point)
tab_cleanup_preview_curves = Curve(filter_12)
cut_transition_preview_lines = Curve(flatten(ln))
cut_exit_preview_lines = Curve(flatten(ln_3))
cut_entry_preview_lines = Curve(flatten(ln_2))
toolpath_preview_curves = Curve(filter_16)

# ---- group: Insert J2 commands
addition_6 = Addition(A=addition_5, B=series_2)
ins_9 = InsertItems(List=ins_6, Item=merge_12, Indices=addition_6, Wrap=True)

# ----
tab_cleanup_preview_curves_2 = ClusterOutput(tab_cleanup_preview_curves)
cut_transition_preview_lines_2 = ClusterOutput(cut_transition_preview_lines)
cut_exit_preview_lines_2 = ClusterOutput(cut_exit_preview_lines)
toolpath_preview_curves_2 = ClusterOutput(toolpath_preview_curves)
cut_entry_preview_lines_2 = ClusterOutput(cut_entry_preview_lines)
flatten_18 = FlattenTree(Tree=ins_9, Path="{0}")
panel_24 = Panel(flatten_18)
merge_14 = Merge(Data1=start_code_6, Data2=panel, Data6=join_8, Data7=flatten_18, Data9=end_code_6)
toolpath_shopbot_code = Panel(merge_14)
toolpath_shopbot_code_2 = Panel(toolpath_shopbot_code)

# ---- group: Format milling positions with axis names and feedrates
toolpath_points_7 = Point(gate_15.Target0)
lng_16 = ListLength(List=toolpath_points_7)
plunge_rate_8 = Number(plunge_rate_in_mm_m)
feed_rate_8 = Number(feed_rate_in_mm_m)
panel_25 = Panel(" X")  # disabled
panel_26 = Panel("F")  # disabled
dup_31 = DuplicateData(Data=flatten(panel_25), Number=flatten(lng_16), Order=True)  # disabled
dup_32 = DuplicateData(Data=flatten(panel_26), Number=flatten(lng_16), Order=True)  # disabled
dup_33 = DuplicateData(Data=graft(feed_rate_8), Number=graft(lng_16), Order=True)
number_of_decimal_places_5 = Panel(number_of_decimal_places)
lng_17 = ListLength(List=toolpath_points_7)
replace_2 = ReplaceItems(List=dup_33, Item=plunge_rate_8, Indices="0", Wrap=False)
pdecon_8 = Deconstruct(Point=toolpath_points_7)  # -> XComponent, YComponent, ZComponent
flatten_19 = FlattenTree(Tree=dup_32, Path="{0}")  # disabled
flatten_20 = FlattenTree(Tree=dup_31, Path="{0}")  # disabled
flatten_21 = FlattenTree(Tree=replace_2, Path="{0}")
graft_52 = GraftTree(Tree=flatten_19, IncludeEmptyLists=True, IncludeNullItems=True)  # disabled
graft_53 = GraftTree(Tree=flatten_21, IncludeEmptyLists=True, IncludeNullItems=True)
graft_54 = GraftTree(Tree=flatten_20, IncludeEmptyLists=True, IncludeNullItems=True)  # disabled
num_23 = Number(pdecon_8.XComponent)
num_24 = Number(number_of_decimal_places_5)
num_25 = Number(pdecon_8.YComponent)
num_26 = Number(number_of_decimal_places_5)
num_27 = Number(pdecon_8.ZComponent)
num_28 = Number(number_of_decimal_places_5)
expression_12 = Expression(x=num_23, y=num_24, Expression="Round(x,y)")
expression_13 = Expression(x=num_25, y=num_26, Expression="Round(x,y)")
expression_14 = Expression(x=num_27, y=num_28, Expression="Round(x,y)")
panel_27 = Panel(" Y")  # disabled
panel_28 = Panel(" Z")  # disabled
panel_29 = Panel("G1 ")  # disabled
join_27 = TextJoin(Text=[graft_52, graft_53, graft_54])  # disabled
dup_34 = DuplicateData(Data=panel_28, Number=lng_17, Order=True)  # disabled
dup_35 = DuplicateData(Data=panel_27, Number=lng_17, Order=True)  # disabled
dup_36 = DuplicateData(Data=panel_29, Number=lng_17, Order=True)  # disabled
simplify_45 = SimplifyTree(Tree=flatten(join_27), Front=False)  # disabled
simplify_46 = SimplifyTree(Tree=flatten(dup_36), Front=False)  # disabled
simplify_47 = SimplifyTree(Tree=flatten(expression_12), Front=False)
simplify_48 = SimplifyTree(Tree=flatten(dup_35), Front=False)  # disabled
simplify_49 = SimplifyTree(Tree=flatten(expression_13), Front=False)
simplify_50 = SimplifyTree(Tree=flatten(dup_34), Front=False)  # disabled
simplify_51 = SimplifyTree(Tree=flatten(expression_14), Front=False)
graft_55 = GraftTree(Tree=simplify_46, IncludeEmptyLists=True, IncludeNullItems=True)  # disabled
graft_56 = GraftTree(Tree=simplify_47, IncludeEmptyLists=True, IncludeNullItems=True)
graft_57 = GraftTree(Tree=simplify_48, IncludeEmptyLists=True, IncludeNullItems=True)  # disabled
graft_58 = GraftTree(Tree=simplify_49, IncludeEmptyLists=True, IncludeNullItems=True)
graft_59 = GraftTree(Tree=simplify_50, IncludeEmptyLists=True, IncludeNullItems=True)  # disabled
graft_60 = GraftTree(Tree=simplify_51, IncludeEmptyLists=True, IncludeNullItems=True)
graft_61 = GraftTree(Tree=simplify_45, IncludeEmptyLists=True, IncludeNullItems=True)  # disabled
join_28 = TextJoin(Text=[graft_55, graft_61, graft_56, graft_57, graft_58, graft_59, graft_60])  # disabled
flatten_22 = FlattenTree(Tree=join_28, Path="{0}")  # disabled

# ---- group: Format jog XY postions
jog_rate_x_y_3 = Number(jog_rate_x_y_in_mm_m)
item_14 = ListItem(List=expression_12, Index=0, Wrap=True)
custom_home_x_2 = Number(end_of_job_go_to_x_2)
custom_home_y_2 = Number(end_of_job_go_to_y_2)
item_15 = ListItem(List=expression_13, Index=0, Wrap=True)
int_6 = Integer(jog_rate_x_y_3)
lng_18 = ListLength(List=flatten(item_14))
safe_z_height_10 = Number(safe_z_height_2)
lng_19 = ListLength(List=flatten(item_14))
join_29 = TextJoin(Text=["F", int_6, " X"])
dup_37 = DuplicateData(Data="G1 ", Number=lng_18, Order=True)
dup_38 = DuplicateData(Data=" Y", Number=lng_18, Order=True)
dup_39 = DuplicateData(Data=" Z", Number=lng_18, Order=True)
dup_40 = DuplicateData(Data=safe_z_height_10, Number=lng_18, Order=True)
dup_41 = DuplicateData(Data=join_29, Number=lng_19, Order=True)
simplify_52 = SimplifyTree(Tree=flatten(dup_37), Front=False)
simplify_53 = SimplifyTree(Tree=flatten(item_14), Front=False)
simplify_54 = SimplifyTree(Tree=flatten(dup_38), Front=False)
simplify_55 = SimplifyTree(Tree=flatten(item_15), Front=False)
simplify_56 = SimplifyTree(Tree=flatten(dup_39), Front=False)
simplify_57 = SimplifyTree(Tree=flatten(dup_40), Front=False)
simplify_58 = SimplifyTree(Tree=flatten(dup_41), Front=False)
graft_62 = GraftTree(Tree=simplify_52, IncludeEmptyLists=True, IncludeNullItems=True)
graft_63 = GraftTree(Tree=simplify_58, IncludeEmptyLists=True, IncludeNullItems=True)
graft_64 = GraftTree(Tree=simplify_53, IncludeEmptyLists=True, IncludeNullItems=True)
graft_65 = GraftTree(Tree=simplify_54, IncludeEmptyLists=True, IncludeNullItems=True)
graft_66 = GraftTree(Tree=simplify_55, IncludeEmptyLists=True, IncludeNullItems=True)
graft_67 = GraftTree(Tree=simplify_56, IncludeEmptyLists=True, IncludeNullItems=True)
graft_68 = GraftTree(Tree=simplify_57, IncludeEmptyLists=True, IncludeNullItems=True)
join_30 = TextJoin(Text=[graft_62, graft_63, graft_64, graft_65, graft_66])
jog_rate_x_y_4 = Integer(jog_rate_x_y_3)
flatten_23 = FlattenTree(Tree=join_30, Path="{0}")
join_31 = TextJoin(Text=["F", jog_rate_x_y_4])
home_x_2 = Number(custom_home_x_2)
home_y_2 = Number(custom_home_y_2)
join_32 = TextJoin(Text=["G1 ", join_31, " X", home_x_2, " Y", home_y_2])
merge_15 = Merge(Data1=flatten(flatten_23), Data2=flatten(join_32))
jog_x_y_positions_2 = Panel(merge_15)

# ---- group: Format jog Z postions
# G-Code toolpath processing
jog_rate_z_4 = Number(jog_rate_z_in_mm_m)
int_7 = Integer(jog_rate_z_4)
join_33 = TextJoin(Text=["F", int_7])
safe_z_height_11 = Number(safe_z_height_2)
join_34 = TextJoin(Text=["G1 ", join_33, " Z", safe_z_height_11])
lng_20 = ListLength(List=merge_15)
dup_42 = DuplicateData(Data=join_34, Number=lng_20, Order=True)
flatten_24 = FlattenTree(Tree=dup_42, Path="{0}")
jog_z_positions_2 = Panel(flatten_24)

# ----
format = Format(Format="G1 F{0} X{1} Y{2} Z{3}", Culture=127, Data0=graft_53, Data1=graft_56, Data2=graft_58, Data3=graft_60)
flatten_25 = FlattenTree(Tree=format, Path="{0}")

# ---- group: Format milling positions with axis names and feedrates (continued)
panel_30 = Panel(flatten_25)

# ---- group: Insert jog to safe Z
ma_5 = MassAddition(Input=flatten(lng_17))  # -> Result, PartialResults
merge_16 = Merge(Data1=Slider(0, range=0..100), Data2=ma_5.PartialResults)
ins_10 = InsertItems(List=flatten(panel_30), Item=flatten(jog_z_positions_2), Indices=flatten(merge_16), Wrap=True)

# ----
panel_31 = Panel(join_34)

# ---- group: Insert jog X Y positions
lng_21 = ListLength(List=merge_16)
series_3 = Series(Start=1, Step=1, Count=lng_21)
addition_7 = Addition(A=merge_16, B=series_3)
ins_11 = InsertItems(List=flatten(ins_10), Item=flatten(jog_x_y_positions_2), Indices=flatten(addition_7), Wrap=True)

# ----
merge_17 = Merge(Data1=start_code_3, Data2=panel_31, Data3=g_code_spindle_start_2)
startcode_2 = Panel(merge_17)
merge_18 = Merge(Data1=flatten(startcode_2), Data2=flatten(ins_11), Data3=flatten(endcode))
# Rigth click and choose "Stream destination"
# 
# Give a file name ending with .gcode
# 
# Your toolpath will automatically be updated!
toolpath_g_code = Panel(merge_18)
toolpath_g_code_2 = Panel(toolpath_g_code)
filter_21 = StreamFilter(Gate=make_shopbot_code_not_g_code_2, Stream0=toolpath_g_code_2, Stream1=toolpath_shopbot_code_2)
g_code_stream = ClusterOutput(filter_21)  # Connect a panel to stream the code to a folder on your computer

# ==== cluster ConnectOverlappingToolpaths
polyline_toolpaths = ClusterInput()
polyline_toolpaths_2 = Curve(polyline_toolpaths)
clean = CleanTree(RemoveNulls=True, RemoveInvalid=True, RemoveEmpty=False, Tree=polyline_toolpaths_2)
crv = Curve(clean)
cp = ControlPoints(Curve=crv)  # -> Points, Weights, Knots
cp_2 = ControlPoints(Curve=crv)  # -> Points, Weights, Knots
end = EndPoints(Curve=crv)  # -> Start, End
lng = ListLength(List=cp.Points)
pshift = ShiftPaths(Data=cp_2.Points, Offset=-1)
shift = ShiftList(List=end.Start, Shift=1, Wrap=False)
shift_2 = ShiftList(List=end.End, Shift=-1, Wrap=False)
pshift_2 = ShiftPaths(Data=lng, Offset=-1)
pline = PolyLine(Vertices=pshift, Closed=False)
pdecon = Deconstruct(Point=shift)  # -> XComponent, YComponent, ZComponent
pdecon_2 = Deconstruct(Point=shift_2)  # -> XComponent, YComponent, ZComponent
panel = Panel("100")
ma = MassAddition(Input=pshift_2)  # -> Result, PartialResults
cp_3 = ControlPoints(Curve=pline)  # -> Points, Weights, Knots
pshift_3 = ShiftPaths(Data=cp_2.Points, Offset=-1)
flatten = FlattenTree(Tree=ma.PartialResults, Path="{0}")

expression = Expression(x=pdecon_2.YComponent, Expression="Round(x,2)")
expression_2 = Expression(x=pdecon_2.XComponent, Expression="Round(x,2)")

expression_3 = Expression(x=pdecon.YComponent, Expression="Round(x,2)")
expression_4 = Expression(x=pdecon.XComponent, Expression="Round(x,2)")

lng_2 = ListLength(List=pshift_3)
lng_3 = ListLength(List=cp_3.Points)
smaller = SmallerThan(FirstNumber=lng_3, SecondNumber=lng_2)  # -> SmallerThan, OrEqualTo
unreialiable_result_boolean = Panel(smaller.SmallerThan)
equals = Equality(FirstNumber=expression_4, SecondNumber=expression_2)  # -> Equality, Inequality
equals_2 = Equality(FirstNumber=expression_3, SecondNumber=expression)  # -> Equality, Inequality
and = GateAnd(A=equals.Equality, B=equals_2.Equality)

# ---- group: Line connection viz for troubleshooting
dispatch = Dispatch(List=shift_2, DispatchPattern=and)  # -> ListA, ListB
dispatch_2 = Dispatch(List=shift, DispatchPattern=and)  # -> ListA, ListB
ln = Line(StartPoint=dispatch_2.ListA, EndPoint=dispatch.ListA)  # disabled

# ----
rev = ReverseList(List=flatten)
rev_2 = ReverseList(List=flatten)
cull_i = CullIndex(List=rev, Indices="0", Wrap=True)
item = ListItem(List=rev, Index="0", Wrap=True)
cull_i_2 = CullIndex(List=rev_2, Indices="0", Wrap=True)
pshift_4 = ShiftPaths(Data=and, Offset=-1)
pshift_5 = ShiftPaths(Data=cull_i, Offset=-1)
pshift_6 = ShiftPaths(Data=cull_i_2, Offset=-1)
rev_3 = ReverseList(List=pshift_5)
lng_4 = ListLength(List=pshift_4)
rev_4 = ReverseList(List=pshift_6)
ins = InsertItems(List=pshift_4, Item=Toggle(False), Indices="0", Wrap=True)
ins_2 = InsertItems(List=pshift_4, Item=Toggle(False), Indices=lng_4, Wrap=True)
subtraction = Subtraction(A=rev_3, B="1")
flatten_2 = FlattenTree(Tree=pshift, Path="{0}")
pshift_7 = ShiftPaths(Data=ins, Offset=-1)
merge = Merge(Data1=subtraction, Data2=item)
merge_2 = Merge(Data1="0", Data2=rev_4)
pshift_8 = ShiftPaths(Data=ins_2, Offset=-1)
dispatch_3 = Dispatch(List=merge_2, DispatchPattern=pshift_7)  # -> ListA, ListB
dispatch_4 = Dispatch(List=merge, DispatchPattern=pshift_8)  # -> ListA, ListB
dom = ConstructDomain(DomainStart=dispatch_3.ListB, DomainEnd=dispatch_4.ListB)
subset = SubList(List=flatten_2, Domain=dom, Wrap=False)  # -> List, Index
pline_2 = PolyLine(Vertices=subset.List, Closed=False)
unreialiable_result_boolean_2 = Panel(unreialiable_result_boolean)  # disabled
flatten_3 = FlattenTree(Tree=pline_2, Path="{0}")
pshift_9 = ShiftPaths(Data=pline_2, Offset=-2)  # disabled
filter = StreamFilter(Gate=unreialiable_result_boolean_2, Stream0=pshift_9)  # disabled
item_2 = ListItem(List=flatten_3, Index=0, Wrap=True)
polyline_toolpaths_3 = Curve(polyline_toolpaths_2)
null = NullItem(Item=item_2)  # -> NullFlags, InvalidFlags, Description
filter_2 = StreamFilter(Gate=null.NullFlags, Stream0=flatten_3, Stream1=polyline_toolpaths_3)
z_connected_polyline_toolpaths = Curve(filter_2)
z_connected_polyline_toolpaths_2 = ClusterOutput(z_connected_polyline_toolpaths)

# ==== cluster TabToolpaths
polyline_toolpaths = ClusterInput()
milling_bit_diamter = ClusterInput()
tab_breps = ClusterInput()
tab_cleanup_overshoot_lenght = Panel("1")
tab_breps_2 = Brep(tab_breps)
polyline_toolpaths_2 = Curve(polyline_toolpaths)
milling_bit_diamter_2 = Number(milling_bit_diamter)
flatten = FlattenTree(Tree=tab_breps_2, Path="{0}")
clean = CleanTree(RemoveNulls=True, RemoveInvalid=True, RemoveEmpty=False, Tree=polyline_toolpaths_2)
clean_2 = CleanTree(RemoveNulls=True, RemoveInvalid=True, RemoveEmpty=False, Tree=flatten)
bbox = BoundingBox(Content=clean, Plane=PlaneXY(0, 0, 0), UnionBox=True)  # -> Box, Box_2

# ---- group: Check if any tab volumes break material surface
bbox_2 = BoundingBox(Content=clean_2, Plane=PlaneXY(0, 0, 0))  # -> Box, Box_2
debrep = DeconstructBrep(Brep=bbox_2.Box)  # -> Faces, Edges, Vertices
item = ListItem(List=debrep.Vertices, Index="4", Wrap=True)
pdecon = Deconstruct(Point=item)  # -> XComponent, YComponent, ZComponent
sort = SortList(Keys=flatten(pdecon.ZComponent))  # -> Keys, ValuesA
rev = ReverseList(List=sort.Keys)
item_2 = ListItem(List=rev, Index=0, Wrap=True)
larger = LargerThan(FirstNumber=item_2, SecondNumber="0")  # -> LargerThan, OrEqualTo
make_severed_toolapths = Panel(larger.LargerThan)

# ---- group: Check for input tab breps
item_3 = ListItem(List=clean_2, Index=0, Wrap=True)
null = NullItem(Item=item_3)  # -> NullFlags, InvalidFlags, Description
no_tab_brep_input_boolean = Panel(null.NullFlags)

# ----
debrep_2 = DeconstructBrep(Brep=bbox.Box)  # -> Faces, Edges, Vertices
item_4 = ListItem(List=debrep_2.Vertices, Index="0", Wrap=True)
pdecon_2 = Deconstruct(Point=flatten(item_4))  # -> XComponent, YComponent, ZComponent
subtraction = Subtraction(A=pdecon_2.ZComponent, B="0.1")
lowes_toolpath_point = Panel(subtraction)
polyline_toolpaths_3 = Curve(clean)
tab_breps_3 = Brep(clean_2)

# ---- group: Bit diameter compensate tab breps (for tab cleanup)
tab_cleanup_overshoot_lenght_2 = Panel(tab_cleanup_overshoot_lenght)
milling_bit_diamter_3 = Number(milling_bit_diamter_2)
tab_breps_4 = Brep(tab_breps_3)
multiplication = Multiplication(A=milling_bit_diamter_3, B="0.5")
debrep_3 = DeconstructBrep(Brep=tab_breps_4)  # -> Faces, Edges, Vertices
bbox_3 = BoundingBox(Content=tab_breps_4, Plane=PlaneXY(0, 0, 0))  # -> Box, Box_2
addition = Addition(A=multiplication, B=tab_cleanup_overshoot_lenght_2)
debrep_4 = DeconstructBrep(Brep=bbox_3.Box)  # -> Faces, Edges, Vertices
planar = IsPlanar(Surface=debrep_3.Faces, Interior=True)  # -> Planar, Plane
deplane = DeconstructPlane(Plane=planar.Plane)  # -> Origin, XAxis, YAxis, ZAxis
lowes_toolpath_point_2 = Panel(lowes_toolpath_point)
pdecon_3 = Deconstruct(Point=deplane.Origin)  # -> XComponent, YComponent, ZComponent
item_5 = ListItem(List=debrep_4.Vertices, Index=4, Wrap=True)
sort_2 = SortList(Keys=pdecon_3.ZComponent, ValuesA=debrep_3.Faces)  # -> Keys, ValuesA
pt = ConstructPoint(XCoordinate=0, YCoordinate=0, ZCoordinate=lowes_toolpath_point_2)
item_6 = ListItem(List=sort_2.ValuesA, Index=0, Wrap=True)
xy = XYPlane(Origin=pt)
edges = BrepEdges(Brep=item_6)  # -> Naked, Interior, NonManifold
cp = PlaneClosestPoint(Point=item_5, Plane=xy)  # -> Point, UVPoint, Distance
pshift = ShiftPaths(Data=edges.Naked, Offset=-1)
join = JoinCurves(Curves=pshift, Preserve=False)
Z = UnitZ(Factor=cp.Distance)
simplify = SimplifyTree(Tree=join, Front=False)
simplify_2 = SimplifyTree(Tree=Z, Front=False)
milling_bit_radius_overshoot = Panel(addition)
project = Project(Geometry=simplify, Plane=xy)  # -> Geometry, Transform
cir = Circle(Plane=PlaneXY(0, 0, 0), Radius=1)
flip = FlipCurve(Curve=project.Geometry, Guide=cir)  # -> Curve, Flag
offset = Offset(Curve=flip.Curve, Distance=milling_bit_radius_overshoot, Plane=PlaneXY(0, 0, 0), Corners=1)
extr = Extrude(Base=offset, Direction=simplify_2)
cap = CapHoles(Brep=extr)
bit_diameter_compensated_tab_breps = Brep(flatten(cap))

# ---- group: Bit diameter compensate tab breps
milling_bit_diamter_4 = Number(milling_bit_diamter_2)
tab_breps_5 = Brep(tab_breps_3)
multiplication_2 = Multiplication(A=milling_bit_diamter_4, B="0.5")
debrep_5 = DeconstructBrep(Brep=tab_breps_5)  # -> Faces, Edges, Vertices
bbox_4 = BoundingBox(Content=tab_breps_5, Plane=PlaneXY(0, 0, 0))  # -> Box, Box_2
milling_bit_radius = Panel(multiplication_2)
debrep_6 = DeconstructBrep(Brep=bbox_4.Box)  # -> Faces, Edges, Vertices
planar_2 = IsPlanar(Surface=debrep_5.Faces, Interior=True)  # -> Planar, Plane
deplane_2 = DeconstructPlane(Plane=planar_2.Plane)  # -> Origin, XAxis, YAxis, ZAxis
lowes_toolpath_point_3 = Panel(lowes_toolpath_point)
item_7 = ListItem(List=debrep_6.Vertices, Index=4, Wrap=True)
pdecon_4 = Deconstruct(Point=deplane_2.Origin)  # -> XComponent, YComponent, ZComponent
sort_3 = SortList(Keys=pdecon_4.ZComponent, ValuesA=debrep_5.Faces)  # -> Keys, ValuesA
pt_2 = ConstructPoint(XCoordinate=0, YCoordinate=0, ZCoordinate=lowes_toolpath_point_3)
item_8 = ListItem(List=sort_3.ValuesA, Index=0, Wrap=True)
xy_2 = XYPlane(Origin=pt_2)
edges_2 = BrepEdges(Brep=item_8)  # -> Naked, Interior, NonManifold
cp_2 = PlaneClosestPoint(Point=item_7, Plane=xy_2)  # -> Point, UVPoint, Distance
pshift_2 = ShiftPaths(Data=edges_2.Naked, Offset=-1)
join_2 = JoinCurves(Curves=pshift_2, Preserve=False)
Z_2 = UnitZ(Factor=cp_2.Distance)
simplify_3 = SimplifyTree(Tree=join_2, Front=False)
# FIX BUG: Tabs equal to bit diamter makes offset and select error
simplify_4 = SimplifyTree(Tree=Z_2, Front=False)
milling_bit_radius_2 = Panel(milling_bit_radius)
project_2 = Project(Geometry=simplify_3, Plane=xy_2)  # -> Geometry, Transform
cir_2 = Circle(Plane=PlaneXY(0, 0, 0), Radius=1)
flip_2 = FlipCurve(Curve=project_2.Geometry, Guide=cir_2)  # -> Curve, Flag
offset_2 = Offset(Curve=flip_2.Curve, Distance=milling_bit_radius_2, Plane=PlaneXY(0, 0, 0), Corners=1)
extr_2 = Extrude(Base=offset_2, Direction=simplify_4)
cap_2 = CapHoles(Brep=extr_2)
bit_diameter_compensated_tab_breps_2 = Brep(flatten(cap_2))

# ---- group: Check for invalid boxes
flatten_2 = FlattenTree(Tree=bit_diameter_compensated_tab_breps_2, Path="{0}")
item_9 = ListItem(List=flatten_2, Index=0, Wrap=True)
null_2 = NullItem(Item=item_9)  # -> NullFlags, InvalidFlags, Description
filter = StreamFilter(Gate=null_2.NullFlags, Stream0=bit_diameter_compensated_tab_breps_2, Stream1=tab_breps_3)

flatten_3 = FlattenTree(Tree=bit_diameter_compensated_tab_breps, Path="{0}")
item_10 = ListItem(List=flatten_3, Index=0, Wrap=True)
null_3 = NullItem(Item=item_10)  # -> NullFlags, InvalidFlags, Description
filter_2 = StreamFilter(Gate=null_3.NullFlags, Stream0=bit_diameter_compensated_tab_breps, Stream1=tab_breps_3)

# ----
mesh = MeshBrep(
    Brep=filter_2,
    Settings={GridMaxCount=0, GridMinCount=16, JaggedSeams=False, MaxEdgeLength=0, MinEdgeLength=0.0001, MinTolerance=0, Refine=True, RefineAngle=0, RelativeTolerance=0.65, SimplePlanes=True, Tolerance=0})
mjoin = MeshJoin(Meshes=mesh)
tab_cleanup_volume_mesh = Mesh(mjoin)

make_severed_toolapths_2 = Panel(make_severed_toolapths)
no_tab_brep_input_boolean_2 = Panel(no_tab_brep_input_boolean)
polyline_toolpaths_4 = Curve(clean)

mesh_2 = MeshBrep(
    Brep=filter,
    Settings={GridMaxCount=0, GridMinCount=16, JaggedSeams=False, MaxEdgeLength=0, MinEdgeLength=0.0001, MinTolerance=0, Refine=True, RefineAngle=0, RelativeTolerance=0.65, SimplePlanes=True, Tolerance=0})
mjoin_2 = MeshJoin(Meshes=mesh_2)
tab_volume_mesh = Mesh(mjoin_2)
colom = CollisionOneMany(Collider=tab_volume_mesh, Obstacles=graft(polyline_toolpaths_3))  # -> Collision, Index
pshift_3 = ShiftPaths(Data=colom.Collision, Offset=-1)

tab_or_no_tab_booleans = Integer(pshift_3)

dispatch = Dispatch(List=polyline_toolpaths_3, DispatchPattern=tab_or_no_tab_booleans)  # -> ListA, ListB
toolpaths_without_tabs = Curve(dispatch.ListB)
toolpaths_for_tabbing = Curve(dispatch.ListA)

bbox_5 = BoundingBox(Content=mesh_2, Plane=PlaneXY(0, 0, 0))  # -> Box, Box_2
volume = Volume(Geometry=bbox_5.Box)  # -> Volume, Centroid
xy_3 = XYPlane(Origin=volume.Centroid)
scale_nu = ScaleNU(Geometry=bbox_5.Box, Plane=xy_3, ScaleX="1.01", ScaleY="1.01", ScaleZ=1)  # -> Geometry, Transform
mjoin_3 = MeshJoin(Meshes=scale_nu.Geometry)
tab_control_point_intersect_mesh = Mesh(mjoin_3)

# ---- group: Filter toolpaths entirely inside tabs
toolpaths_without_tabs_2 = Curve(dispatch.ListB)
tab_breps_6 = Brep(filter)
shapein = ShapeInBrep(Brep=tab_breps_6, Shape=toolpaths_without_tabs_2)
lng = ListLength(List=toolpaths_without_tabs_2)
bool = Boolean(shapein)
series = Series(Start=0, Step=1, Count=lng)
dispatch_2 = Dispatch(List=series, DispatchPattern=bool)  # -> ListA, ListB
replace = ReplaceItems(List=toolpaths_without_tabs_2, Indices=dispatch_2.ListB, Wrap=False)
toolpaths_without_tabs_3 = Curve(replace)

# ---- group: Test closing
cls = Closed(Curve=toolpaths_for_tabbing)  # -> Closed, Periodic
graft = GraftTree(Tree=cls.Closed, IncludeEmptyLists=True, IncludeNullItems=True)

# ----
tab_or_no_tab_booleans_2 = Integer(tab_or_no_tab_booleans)
toolpaths_without_tabs_4 = Curve(replace)

# ---- group: Cut toolpaths with extended tab volumes for tab cleanup
tab_cleanup_volume_mesh_2 = Mesh(tab_cleanup_volume_mesh)
mcx = MeshCurve(Mesh=tab_cleanup_volume_mesh_2, Curve=toolpaths_for_tabbing)  # -> Points, Faces

# ----
cullpt = CullDuplicates(Points=mcx.Points, Tolerance="0.01", CullMode=3)  # -> Points, Indices, Valence
pshift_4 = ShiftPaths(Data=cullpt.Points, Offset=-1)

# ---- group: Cut toolpaths with extended tab volumes for tab cleanup (continued)
crv_cp = CurveClosestPoint(Point=pshift_4, Curve=graft(toolpaths_for_tabbing))  # -> Point, Parameter, Distance
shatter = Shatter(Curve=graft(toolpaths_for_tabbing), Parameters=crv_cp.Parameter)
curvepoint = PointOnCurve(shatter, parameter=0.5)
minc = MeshInclusion(Mesh=tab_cleanup_volume_mesh_2, Point=curvepoint, Strict=False)
dispatch_3 = Dispatch(List=shatter, DispatchPattern=minc)  # -> ListA, ListB
tab_cleanup_toolpaths = Curve(dispatch_3.ListA)
toolpath_outside_tabs = Curve(dispatch_3.ListB)

# ----
tab_cleanup_toolpaths_2 = Curve(tab_cleanup_toolpaths)
flatten_4 = FlattenTree(Tree=tab_cleanup_toolpaths_2, Path="{0}")
tab_cleanup_toolpaths_3 = Curve(flatten_4)
tab_cleanup_toolpaths_4 = ClusterOutput(tab_cleanup_toolpaths_3)

# ---- group: Cut toolpaths with tab volumes
tab_volume_mesh_2 = Mesh(tab_volume_mesh)
mcx_2 = MeshCurve(Mesh=tab_volume_mesh_2, Curve=toolpaths_for_tabbing)  # -> Points, Faces

# ----
cullpt_2 = CullDuplicates(Points=mcx_2.Points, Tolerance="0.01", CullMode=3)  # -> Points, Indices, Valence
pshift_5 = ShiftPaths(Data=cullpt_2.Points, Offset=-1)

# ---- group: Cut toolpaths with tab volumes (continued)
crv_cp_2 = CurveClosestPoint(Point=pshift_5, Curve=graft(toolpaths_for_tabbing))  # -> Point, Parameter, Distance
shatter_2 = Shatter(Curve=graft(toolpaths_for_tabbing), Parameters=crv_cp_2.Parameter)
curvepoint_2 = PointOnCurve(shatter_2, parameter=0.5)
minc_2 = MeshInclusion(Mesh=tab_volume_mesh_2, Point=curvepoint_2, Strict=False)
dispatch_4 = Dispatch(List=shatter_2, DispatchPattern=minc_2)  # -> ListA, ListB
toolpaths_inside_tabs = Curve(dispatch_4.ListA)
toolpath_outside_tabs_2 = Curve(dispatch_4.ListB)

# ----
cp_3 = ControlPoints(Curve=toolpaths_inside_tabs)  # -> Points, Weights, Knots
Z_3 = UnitZ(Factor=1)
meshray = MeshRay(Mesh=tab_control_point_intersect_mesh, Point=cp_3.Points, Direction=Z_3)  # -> Point, Hit
pline = PolyLine(Vertices=meshray.Point, Closed=False)
pshift_6 = ShiftPaths(Data=pline, Offset=-1)

weave = Weave(Pattern=minc_2, Stream0=toolpath_outside_tabs_2, Stream1=pshift_6, NullGaps=False)
cp_4 = ControlPoints(Curve=weave)  # -> Points, Weights, Knots
pshift_7 = ShiftPaths(Data=cp_4.Points, Offset=-1)
pline_2 = PolyLine(Vertices=pshift_7, Closed=graft)
pshift_8 = ShiftPaths(Data=pline_2, Offset="-2")
toolpath_outside_tabs_3 = Curve(toolpath_outside_tabs_2)
group = Group(Objects=toolpath_outside_tabs_3)

# ---- group: Check
flatten_5 = FlattenTree(Tree=pline_2, Path="{0}")
flatten_6 = FlattenTree(Tree=group, Path="{0}")

# ----
toolpaths_with_tabs = Curve(flatten_5)
pshift_9 = ShiftPaths(Data=group, Offset="-2")
filter_3 = StreamFilter(Gate=make_severed_toolapths_2, Stream0=toolpaths_with_tabs, Stream1=flatten_6)
tabbed_toolpaths = Geometry(filter_3)
weave_2 = Weave(Pattern=tab_or_no_tab_booleans_2, Stream0=toolpaths_without_tabs_4, Stream1=tabbed_toolpaths, NullGaps=False)
ungroup = Ungroup(Group=weave_2)
pshift_10 = ShiftPaths(Data=ungroup, Offset=-1)

polyline_toolpaths_5 = Curve(clean)
end = EndPoints(Curve=pshift_10)  # -> Start, End

end_2 = EndPoints(Curve=polyline_toolpaths_5)  # -> Start, End
crv_cp_3 = CurveClosestPoint(Point=end_2.End, Curve=pshift_10)  # -> Point, Parameter, Distance
pt_3 = Point(end_2.End)

dist = Distance(PointA=end.End, PointB=pt_3)
smaller = SmallerThan(FirstNumber=dist, SecondNumber="0.01")  # -> SmallerThan, OrEqualTo
dispatch_5 = Dispatch(List=crv_cp_3.Parameter, DispatchPattern=smaller.SmallerThan)  # -> ListA, ListB
dispatch_6 = Dispatch(List=pshift_10, DispatchPattern=smaller.SmallerThan)  # -> ListA, ListB
seam = Seam(Curve=dispatch_6.ListB, Seam=dispatch_5.ListB)
weave_3 = Weave(Pattern=smaller.SmallerThan, Stream0=seam, Stream1=dispatch_6.ListA, NullGaps=False)

filter_4 = StreamFilter(Gate=no_tab_brep_input_boolean_2, Stream0=weave_3, Stream1=polyline_toolpaths_4)
clean_3 = CleanTree(RemoveNulls=True, RemoveInvalid=False, RemoveEmpty=False, Tree=filter_4)
flatten_7 = FlattenTree(Tree=clean_3, Path="{0}")
tabbed_toolpaths_2 = Curve(flatten_7)
tabbed_toolpaths_3 = ClusterOutput(tabbed_toolpaths_2)

# ==== cluster RampToolpathPlunges
toolpaths_to_ramp = ClusterInput()
ramp_angle = ClusterInput()
toolpaths_to_ramp_2 = Curve(toolpaths_to_ramp)
ramp_angle_2 = Number(ramp_angle)
end = EndPoints(Curve=toolpaths_to_ramp_2)  # -> Start, End
pdecon = Deconstruct(Point=end.Start)  # -> XComponent, YComponent, ZComponent
abs = Absolute(Value=pdecon.ZComponent)
dom = ConstructDomain(DomainStart="1", DomainEnd="89")
rad = Radians(Degrees=ramp_angle_2)
rtrig = RightTrigonometry(Alpha=rad, QLength=abs)  # -> Alpha, Beta, PLength, QLength, RLength
len = Length(Curve=toolpaths_to_ramp_2)
smaller = SmallerThan(FirstNumber=len, SecondNumber=rtrig.PLength)  # -> SmallerThan, OrEqualTo
dispatch = Dispatch(List=len, DispatchPattern=smaller.OrEqualTo)  # -> ListA, ListB
dispatch_2 = Dispatch(List=rtrig.PLength, DispatchPattern=smaller.OrEqualTo)  # -> ListA, ListB
division = Division(A=dispatch_2.ListA, B=dispatch.ListA)
weave = Weave(Pattern=smaller.OrEqualTo, Stream0=dispatch_2.ListB, Stream1=dispatch.ListA, NullGaps=False)

cls = Closed(Curve=toolpaths_to_ramp_2)  # -> Closed, Periodic
dispatch_3 = Dispatch(List=toolpaths_to_ramp_2, DispatchPattern=cls.Closed)  # -> ListA, ListB
flip = FlipCurve(Curve=dispatch_3.ListA)  # -> Curve, Flag
weave_2 = Weave(Pattern=cls.Closed, Stream0=dispatch_3.ListB, Stream1=flip.Curve, NullGaps=False)

round = Round(Number=division)  # -> Nearest, Floor, Ceiling
division_2 = Division(A=weave, B="0.1")
dispatch_4 = Dispatch(List=abs, DispatchPattern=smaller.OrEqualTo)  # -> ListA, ListB
int = Integer(division_2)
division_3 = Division(A=dispatch_4.ListA, B=round.Ceiling)
int_2 = Integer(division_2)
division_4 = Division(A=weave, B=int)
weave_3 = Weave(Pattern=smaller.OrEqualTo, Stream0=dispatch_4.ListB, Stream1=division_3, NullGaps=False)
addition = Addition(A=int, B="1")
division_5 = Division(A=weave_3, B=int_2)
series = Series(Start=0, Step=division_4, Count=addition)
series_2 = Series(Start=0, Step=division_5, Count=addition)
eval = EvaluateLength(Curve=graft(weave_2), Length=series, Normalized=False)  # -> Point, Tangent, Parameter
Z = UnitZ(Factor=series_2)
move = Move(Geometry=eval.Point, Motion=Z)  # -> Geometry, Transform
pline = PolyLine(Vertices=move.Geometry, Closed=False)
pshift = ShiftPaths(Data=pline, Offset=-1)
redpline = Reduce(Polyline=pshift, Tolerance="0.02")  # -> Polyline, Reduction
flip_2 = FlipCurve(Curve=redpline.Polyline)  # -> Curve, Flag

dispatch_5 = Dispatch(List=flip_2.Curve, DispatchPattern=smaller.OrEqualTo)  # -> ListA, ListB
end_2 = EndPoints(Curve=dispatch_5.ListA)  # -> Start, End
pdecon_2 = Deconstruct(Point=end_2.End)  # -> XComponent, YComponent, ZComponent
pdecon_3 = Deconstruct(Point=end_2.Start)  # -> XComponent, YComponent, ZComponent
pt = ConstructPoint(XCoordinate=0, YCoordinate=0, ZCoordinate=pdecon_2.ZComponent)
pt_2 = ConstructPoint(XCoordinate=0, YCoordinate=0, ZCoordinate=pdecon_3.ZComponent)
dist = Distance(PointA=pt_2, PointB=pt)
series_3 = Series(Start=0, Step=dist, Count=round.Ceiling)
Z_2 = UnitZ(Factor=series_3)
move_2 = Move(Geometry=graft(dispatch_5.ListA), Motion=Z_2)  # -> Geometry, Transform

clean = CleanTree(RemoveNulls=True, RemoveInvalid=True, RemoveEmpty=False, Tree=move_2.Geometry)
join = JoinCurves(Curves=move_2.Geometry, Preserve=False)
flip_3 = FlipMatrix(Data=clean)
lng = ListLength(List=join)
dispatch_6 = Dispatch(List=flip_3, DispatchPattern=cls.Closed)  # -> ListA, ListB
larger = LargerThan(FirstNumber=lng, SecondNumber="1")  # -> LargerThan, OrEqualTo
flip_4 = FlipMatrix(Data=dispatch_6.ListB)
dispatch_7 = Dispatch(List=join, DispatchPattern=larger.LargerThan)  # -> ListA, ListB
simplify = SimplifyTree(Tree=dispatch_7.ListA, Front=False)
dispatch_8 = Dispatch(List=flip_4, DispatchPattern=[True, False])  # -> ListA, ListB
flatten = FlattenTree(Tree=dispatch_7.ListB, Path="{0}")
dispatch_9 = Dispatch(List=simplify, DispatchPattern=[True, False])  # -> ListA, ListB
crv = Curve(dispatch_9.ListB)
bbox = BoundingBox(Content=dispatch_9.ListB, Plane=PlaneXY(0, 0, 0))  # -> Box, Box_2
xy = XYPlane(Origin=Point(0, 0, 0))
cp = ControlPoints(Curve=dispatch_8.ListB)  # -> Points, Weights, Knots
x_tremez = Extremes(Curve=crv, Plane=xy)  # -> Highest, Lowest
cp_2 = ControlPoints(Curve=dispatch_9.ListB)  # -> Points, Weights, Knots; disabled
pshift_2 = ShiftPaths(Data=bbox.Box, Offset=-1)
pdecon_4 = Deconstruct(Point=cp.Points)  # -> XComponent, YComponent, ZComponent
ln = Line(StartPoint=x_tremez.Highest, EndPoint=x_tremez.Lowest)
debrep = DeconstructBrep(Brep=pshift_2)  # -> Faces, Edges, Vertices
rev = ReverseList(List=pdecon_4.ZComponent)
pdecon_5 = Deconstruct(Point=cp_2.Points)  # -> XComponent, YComponent, ZComponent
pt_3 = ConstructPoint(XCoordinate=pdecon_4.XComponent, YCoordinate=pdecon_4.YComponent, ZCoordinate=rev)
item = ListItem(List=debrep.Edges, Index="8", Wrap=True)
rev_2 = ReverseList(List=pdecon_5.ZComponent)
eval_2 = EvaluateLength(Curve=ln, Length="0.5", Normalized=True)  # -> Point, Tangent, Parameter
pline_2 = PolyLine(Vertices=pt_3, Closed=False)
pt_4 = ConstructPoint(XCoordinate=pdecon_5.XComponent, YCoordinate=pdecon_5.YComponent, ZCoordinate=rev_2)
pshift_3 = ShiftPaths(Data=eval_2.Point, Offset=-1)  # disabled
pshift_4 = ShiftPaths(Data=pline_2, Offset=-1)
pline_3 = PolyLine(Vertices=pt_4, Closed=False)
xy_2 = XYPlane(Origin=eval_2.Point)
flip_5 = FlipCurve(Curve=pshift_4)  # -> Curve, Flag
pshift_5 = ShiftPaths(Data=pline_3, Offset=-1)
mirror = Mirror(Geometry=crv, Plane=xy_2)  # -> Geometry, Transform
weave_4 = Weave(Pattern=[0, 1], Stream0=dispatch_8.ListA, Stream1=flip_5.Curve, NullGaps=False)
flip_6 = FlipCurve(Curve=pshift_5)  # -> Curve, Flag
flip_7 = FlipMatrix(Data=weave_4)
flip_8 = FlipCurve(Curve=mirror.Geometry)  # -> Curve, Flag
weave_5 = Weave(Pattern=[0, 1], Stream0=dispatch_9.ListA, Stream1=flip_8.Curve, NullGaps=False)
weave_6 = Weave(Pattern=cls.Closed, Stream0=flip_7, Stream1=dispatch_6.ListA, NullGaps=False)
join_2 = JoinCurves(Curves=weave_5, Preserve=False)
flip_9 = FlipMatrix(Data=weave_6)
simplify_2 = SimplifyTree(Tree=join_2, Front=False)
join_3 = JoinCurves(Curves=flip_9, Preserve=False)
number_slider = Slider(4, range=0..10)
weave_7 = Weave(Pattern=flatten(larger.LargerThan), Stream0=flatten(flatten), Stream1=flatten(simplify_2), NullGaps=False)
pshift_6 = ShiftPaths(Data=join_3, Offset=-1)
pshift_7 = ShiftPaths(Data=pshift_6, Offset=-1)
weave_8 = Weave(Pattern=smaller.OrEqualTo, Stream0=dispatch_5.ListB, Stream1=weave_7, NullGaps=False)
item_2 = ListItem(List=toolpaths_to_ramp_2, Index=number_slider, Wrap=True)
item_3 = ListItem(List=weave_8, Index=number_slider, Wrap=True)
weave_9 = Weave(Pattern=[0, 1], Stream0=weave_8, Stream1=toolpaths_to_ramp_2, NullGaps=False)
join_4 = JoinCurves(Curves=weave_9, Preserve=Toggle(True))  # disabled
ramped_toolpaths = Curve(weave_9)
ramped_toolpaths_2 = ClusterOutput(ramped_toolpaths)

# ==== cluster TrochoidalHighSpeedMilling: Makes highspeed toolpaths for deep and fast cutting in metal. Input toolpath curves for the arcs to follow. Be careful about feedrates and stepovers. Prioritize deep passes and small stepovers (0.05 to 0.2). This technique is known as high speed feed machining.

# ---- group: Left this always on to reduce inpput options
make_helical_entry = Boolean(Toggle(True))

# ----
max_peck_depth_factor = ClusterInput()  # How deep each ehlical entry will be. Depth of entry helix = Max peck depth factor * Bit diameter
straight_arc_extensions = ClusterInput()  # Creates a smoother finish but increases the chance of rubbing (and heat buildup)
milling_bit_diameter = ClusterInput()  # The diameter of your milling bit
toolpath_width_factor = ClusterInput()  # How much wider the toolpath will be than the diamter of your milling bit. Width of trochoidal cut = Toolpath width factor * Bit diameter
toolpath_curves = ClusterInput()  # Curve geometry that you want to convert to trochoidal toolpaths. Pro tip: This can be output from toolpath functions like pocket and Cutout
use_climb_milling = ClusterInput()  # Climb milling direction works best in almost all materials
use_peck_entry = ClusterInput()  # Peck entry stops a helical entry at a max epth, before it starts the entry helix again. Allows for hard metals to cool inbetween entries. Use in case of un-optimized feedrates or machine acceleration.
jog_z_lift_factor = ClusterInput()  # How high up the bit moves during its return pass. Helps avoiding that the bit rubs on the floor during a return pass
ramp_angle = ClusterInput()  # The angle of the entry helix. Low angles and high speeds works well for metals
stepover = ClusterInput()  # How far into the material the bit moves each pass. Stepover distance = Bit diameter * Stepover

# ---- group: Separate feedrate and jog rates is not yet impleneted, it is rarely needed
ramp_entry_feedrate = Number(25)
feedrate = Number(50)
jograte = Number(60)

# ----
straight_arc_extensions_2 = Boolean(straight_arc_extensions)
max_peck_depth_factor_2 = Number(max_peck_depth_factor)
use_peck_entry_2 = Boolean(use_peck_entry)
toolpath_width_factor_2 = Number(toolpath_width_factor)
milling_bit_diameter_2 = Number(milling_bit_diameter)
use_climb_milling_2 = Boolean(use_climb_milling)
toolpath_curves_2 = Curve(toolpath_curves)
jog_z_lift_factor_2 = Number(jog_z_lift_factor)
ramp_angle_2 = Number(ramp_angle)
stepover_2 = Number(stepover)
max_diameter_factor_of_ramp_helix = Panel("2.2")
helix_entry_diameter_to_bit_diameter_rat = Panel("0.8")  # "Helix entry diameter to bit diameter ratio"
ramp_angle_3 = Panel(ramp_angle_2)
jog_z_lift_factor_3 = Panel(jog_z_lift_factor_2)
use_climb_milling_3 = Panel(use_climb_milling_2)
milling_bit_diameter_3 = Panel(milling_bit_diameter_2)
arc_diameter_factor = Panel(toolpath_width_factor_2)
stepover_3 = Panel(stepover_2)
make_straight_arc_extensions = Panel(straight_arc_extensions_2)
feedrate_2 = Panel(feedrate)
jograte_2 = Panel(jograte)
ramp_feedrate = Panel(ramp_entry_feedrate)
make_helical_entry_ramp = Panel(make_helical_entry)
max_peck_depth_factor_3 = Panel(max_peck_depth_factor_2)
use_peck_entry_3 = Panel(use_peck_entry_2)

# ---- group: Shetter curves at corners and shatter closed curves
disc = Discontinuity(Curve=toolpath_curves_2, Level=1)  # -> Points, Parameters
lng = ListLength(List=disc.Parameters)
smaller = SmallerThan(FirstNumber=lng, SecondNumber="1")  # -> SmallerThan, OrEqualTo
weave = Weave(Pattern=smaller.SmallerThan, Stream0=disc.Parameters, Stream1="0", NullGaps=False)
shatter = Shatter(Curve=graft(toolpath_curves_2), Parameters=weave)

# ----
straight = Panel("0")
smooth = Panel("2")
multiplication = Multiplication(A=milling_bit_diameter_3, B=arc_diameter_factor)
multiplication_2 = Multiplication(A=milling_bit_diameter_3, B=jog_z_lift_factor_3)
multiplication_3 = Multiplication(A=milling_bit_diameter_3, B=stepover_3)
subtraction = Subtraction(A=multiplication, B=milling_bit_diameter_3)
filter = StreamFilter(Gate=make_straight_arc_extensions, Stream0=smooth, Stream1=straight)
stepover_distance = Panel(multiplication_3)
z_lift_distance = Panel(multiplication_2)
arc_extension_type = Panel(filter)
arc_diameter = Panel(subtraction)
shattered_toolpath_curves = Curve(shatter)

# ---- group: Check if all curves consist of singel line, can give errors in data weaving
lng_2 = ListLength(List=shattered_toolpath_curves)
sort = SortList(Keys=flatten(lng_2))  # -> Keys, ValuesA
rev = ReverseList(List=sort.Keys)
item = ListItem(List=rev, Index=0, Wrap=True)
smaller_2 = SmallerThan(FirstNumber=item, SecondNumber="2")  # -> SmallerThan, OrEqualTo
all_toolpaths_are_single_curve = Panel(smaller_2.SmallerThan)

# ---- group: Make oriented planes for toolpah arcs
len = Length(Curve=shattered_toolpath_curves)
division = Division(A=len, B=stepover_distance)
int = Integer(division)
divide = DivideCurve(Curve=shattered_toolpath_curves, Count=int, Kinks=False)  # -> Points, Tangents, Parameters
cull_i = CullIndex(List=divide.Tangents, Indices="0", Wrap=True)
cull_i_2 = CullIndex(List=divide.Points, Indices="0", Wrap=True)
xy = XYPlane(Origin=cull_i_2)
align = AlignPlane(Plane=xy, Direction=cull_i)  # -> Plane, Angle
simplify = SimplifyTree(Tree=align.Plane, Front=False)
toolpath_planes = Plane(simplify)

# ----
all_toolpaths_are_single_curve_2 = Panel(all_toolpaths_are_single_curve)
max_diameter_factor_of_ramp_helix_2 = Panel(max_diameter_factor_of_ramp_helix)

# ---- group: Make toolpath arcs
arc_diameter_2 = Panel(arc_diameter)
use_climb_milling_4 = Panel(use_climb_milling_3)
arc_extension_type_2 = Panel(arc_extension_type)
stepover_distance_2 = Panel(stepover_distance)
pi = Pi(Factor=1)
pi_2 = Pi(Factor=1)
multiplication_4 = Multiplication(A=arc_diameter_2, B="0.5")
multiplication_5 = Multiplication(A=pi, B="0.5")
multiplication_6 = Multiplication(A=pi_2, B="-0.5")
xy_2 = XYPlane(Origin=Point(0, 0, 0))
dom = ConstructDomain(DomainStart=multiplication_6, DomainEnd=multiplication_5)
arc = Arc(Plane=xy_2, Radius=multiplication_4, Angle=dom)  # -> Arc, Length
ext = ExtendCurve(Curve=arc.Arc, Type=arc_extension_type_2, Start=stepover_distance_2, End=stepover_distance_2)
gate = StreamGate(Stream=ext, Gate=use_climb_milling_4)  # -> Target0, Target1
flip = FlipCurve(Curve=gate.Target0)  # -> Curve, Flag
filter_2 = StreamFilter(Gate=use_climb_milling_4, Stream0=flip.Curve, Stream1=gate.Target1)
orient = Orient(Geometry=filter_2, Source=xy_2, Target=toolpath_planes)  # -> Geometry, Transform
toolpath_arcs = Curve(orient.Geometry)

# ---- group: Abandoned work on making a better entry helix (without variable diameter) / Add curves here
curve_holes_to_thread_mill = Curve()  # disabled

# ---- group: Abandoned work on making a better entry helix (without variable diameter) / Create planes at center of curves
area = Area(Geometry=curve_holes_to_thread_mill)  # -> Area, Centroid; disabled
xy_3 = XYPlane(Origin=flatten(area.Centroid))  # disabled

# ---- group: Abandoned work on making a better entry helix (without variable diameter) / Select one plane to generate helix on
item_2 = ListItem(List=xy_3, Index=0, Wrap=True)  # disabled
helix_working_plane = Plane(item_2)  # disabled

# ----
all_toolpaths_are_single_curve_3 = Panel(all_toolpaths_are_single_curve)

# ---- group: Make transition jog arcs for corner transitions
z_lift_distance_2 = Panel(z_lift_distance)
toolpath_arcs_2 = Curve(toolpath_arcs)
rev_2 = ReverseList(List=toolpath_arcs_2)
number_slider = Slider(0.5, range=0..1)
item_3 = ListItem(List=rev_2, Index=0, Wrap=True)
item_4 = ListItem(List=toolpath_arcs_2, Index=0, Wrap=True)
flatten = FlattenTree(Tree=item_4, Path="{0}")
pshift = ShiftPaths(Data=item_3, Offset=-1)
flatten_2 = FlattenTree(Tree=item_3, Path="{0}")
pshift_2 = ShiftPaths(Data=item_4, Offset=-1)
flatten_3 = FlattenTree(Tree=pshift, Path="{0}")
clean = CleanTree(RemoveNulls=True, RemoveInvalid=True, RemoveEmpty=False, Tree=flatten_3)
item_5 = ListItem(List=clean, Index=0, Wrap=True)
null = NullItem(Item=item_5)  # -> NullFlags, InvalidFlags, Description
filter_3 = StreamFilter(Gate=null.NullFlags, Stream0=pshift, Stream1=flatten_2)
filter_4 = StreamFilter(Gate=null.NullFlags, Stream0=pshift_2, Stream1=flatten)
shift = ShiftList(List=filter_4, Shift=1, Wrap=False)
shift_2 = ShiftList(List=filter_3, Shift=-1, Wrap=False)
blendc = BlendCurve(CurveA=shift_2, CurveB=shift, BulgeA=number_slider, BulgeB=number_slider, Continuity=1)
reb = RebuildCurve(Curve=blendc, Count="5", Tangents=False)
multiplication_7 = Multiplication(A="5", B="0.5")
cp = ControlPoints(Curve=reb)  # -> Points, Weights, Knots
int_2 = Integer(multiplication_7)
Z = UnitZ(Factor=z_lift_distance_2)
item_6 = ListItem(List=cp.Points, Index=int_2, Wrap=True)
move = Move(Geometry=item_6, Motion=Z)  # -> Geometry, Transform
replace = ReplaceItems(List=cp.Points, Item=move.Geometry, Indices=int_2, Wrap=False)
nurbs = NurbsCurve(Vertices=replace, Degree=3, Periodic=False)  # -> Curve, Length, Domain
all_toolpaths_are_single_curve_4 = Panel(all_toolpaths_are_single_curve_3)
simplify_2 = SimplifyTree(Tree=nurbs.Curve, Front=False)
gate_2 = StreamGate(Stream=simplify_2, Gate=all_toolpaths_are_single_curve_4)  # -> Target0, Target1

# ---- group: Abandoned work on making a better entry helix (without variable diameter)
start_arcs = Curve(filter_4)  # disabled
make_helical_entry_ramp_2 = Panel(make_helical_entry_ramp)  # disabled
stepover_distance_3 = Panel(stepover_distance)  # disabled
helix_entry_diameter_to_bit_diameter_rat_2 = Panel(helix_entry_diameter_to_bit_diameter_rat)  # "Helix entry diameter to bit diameter ratio"; disabled
inner_diameter_overlap = Panel("0.05")  # disabled
ramp_angle_4 = Panel(ramp_angle_3)  # disabled
ramp_extra_start_height = Panel("1")  # disabled
all_toolpaths_are_single_curve_5 = Panel(all_toolpaths_are_single_curve)  # disabled
milling_bit_diameter_4 = Panel(milling_bit_diameter_3)  # disabled
multiplication_8 = Multiplication(A=milling_bit_diameter_4, B=helix_entry_diameter_to_bit_diameter_rat_2)  # disabled
item_7 = ListItem(List=flatten(start_arcs), Index=0, Wrap=True)  # disabled
helical_entry_diamter = Panel(multiplication_8)  # disabled
graft = GraftTree(Tree=start_arcs, IncludeEmptyLists=True, IncludeNullItems=True)  # disabled
end = EndPoints(Curve=item_7)  # -> Start, End; disabled
pitch = Panel("0.8")  # disabled
thread_depth = Panel("12")  # disabled
tool_diameter = Panel("3.9")  # disabled
thread_top_margin = Panel("0.6")  # disabled
thread_diameter = Panel("5.1")  # disabled
thread_bottom_margin = Panel("0.4")  # disabled
filter_5 = StreamFilter(Gate=all_toolpaths_are_single_curve_5, Stream0=start_arcs, Stream1=graft)  # disabled
dist = Distance(PointA=end.Start, PointB=end.End)  # disabled
arc_diameter_3 = Panel(dist)  # disabled
item_8 = ListItem(List=filter_5, Index=0, Wrap=True)  # disabled
end_2 = EndPoints(Curve=item_8)  # -> Start, End; disabled
pdecon = Deconstruct(Point=end_2.Start)  # -> XComponent, YComponent, ZComponent; disabled
ln = Line(StartPoint=end_2.Start, EndPoint=end_2.End)  # disabled
panel = Panel("0.5")  # disabled
abs = Absolute(Value=pdecon.ZComponent)  # disabled
eval = EvaluateLength(Curve=ln, Length=panel, Normalized=True)  # -> Point, Tangent, Parameter; disabled
addition = Addition(A=abs, B=ramp_extra_start_height)  # disabled
start_point = Point(eval.Point)  # disabled
cut_depths = Panel(addition)  # disabled

# ---- group: Make fancy jog to surface ending
all_toolpaths_are_single_curve_6 = Panel(all_toolpaths_are_single_curve)
last_arcs_in_list = Curve(filter_3)
graft_2 = GraftTree(Tree=last_arcs_in_list, IncludeEmptyLists=True, IncludeNullItems=True)
filter_6 = StreamFilter(Gate=all_toolpaths_are_single_curve_6, Stream0=last_arcs_in_list, Stream1=graft_2)
rev_3 = ReverseList(List=filter_6)
item_9 = ListItem(List=rev_3, Index=0, Wrap=True)
end_3 = EndPoints(Curve=item_9)  # -> Start, End
crv_cp = CurveClosestPoint(Point=end_3.End, Curve=item_9)  # -> Point, Parameter, Distance
ln_2 = Line(StartPoint=end_3.Start, EndPoint=end_3.End)
dist_2 = Distance(PointA=end_3.Start, PointB=end_3.End)
eval_2 = EvaluateLength(Curve=ln_2, Length="0.3", Normalized=True)  # -> Point, Tangent, Parameter
eval_3 = EvaluateCurve(Curve=item_9, Parameter=crv_cp.Parameter)  # -> Point, Tangent, Angle
multiplication_9 = Multiplication(A=dist_2, B="0.5")
end_point_tangent = Vector(eval_3.Tangent)
arc_center_point = Point(eval_2.Point)
arc_end_point = Point(end_3.End)
arc_radius = Panel(multiplication_9)
arc_2 = ArcSED(Start=arc_end_point, End=arc_center_point, Direction=end_point_tangent)  # -> Arc, Plane, Radius
reb_2 = RebuildCurve(Curve=arc_2.Arc, Count="5", Tangents=False)
multiplication_10 = Multiplication(A="5", B="0.5")
cp_2 = ControlPoints(Curve=reb_2)  # -> Points, Weights, Knots
multiplication_11 = Multiplication(A=arc_radius, B="0.1")
multiplication_12 = Multiplication(A=arc_radius, B="0.7")
multiplication_13 = Multiplication(A=arc_radius, B="0.3")
int_3 = Integer(multiplication_10)
addition_2 = Addition(A=int_3, B="1")
Z_2 = UnitZ(Factor=multiplication_13)
Z_3 = UnitZ(Factor=multiplication_11)
item_10 = ListItem(List=cp_2.Points, Index=int_3, Wrap=True)
Z_4 = UnitZ(Factor=arc_radius)
Z_5 = UnitZ(Factor=multiplication_12)
move_2 = Move(Geometry=item_10, Motion=Z_3)  # -> Geometry, Transform
replace_2 = ReplaceItems(List=cp_2.Points, Item=move_2.Geometry, Indices=int_3, Wrap=False)
item_11 = ListItem(List=replace_2, Index=addition_2, Wrap=True)
move_3 = Move(Geometry=item_11, Motion=Z_2)  # -> Geometry, Transform
subtraction_2 = Subtraction(A="5", B="1")
replace_3 = ReplaceItems(List=replace_2, Item=move_3.Geometry, Indices=addition_2, Wrap=False)
item_12 = ListItem(List=replace_3, Index=subtraction_2, Wrap=True)
move_4 = Move(Geometry=item_12, Motion=Z_5)  # -> Geometry, Transform
move_5 = Move(Geometry=item_12, Motion=Z_4)  # -> Geometry, Transform
replace_4 = ReplaceItems(List=replace_3, Item=move_4.Geometry, Indices=subtraction_2, Wrap=False)
ins = InsertItems(List=replace_4, Item=move_5.Geometry, Indices="5", Wrap=True)
nurbs_2 = NurbsCurve(Vertices=ins, Degree=3, Periodic=False)  # -> Curve, Length, Domain
simplify_3 = SimplifyTree(Tree=nurbs_2.Curve, Front=False)
end_jog_arcs = Curve(simplify_3)

# ---- group: Abandoned work on making a better entry helix (without variable diameter) / Find helix radius
subtraction_3 = Subtraction(A=thread_diameter, B=tool_diameter)  # disabled
panel_2 = Panel("2")  # disabled
division_2 = Division(A=subtraction_3, B=panel_2)  # disabled

# ---- group: Abandoned work on making a better entry helix (without variable diameter) / Create base circle for helix
cir = Circle(Plane=helix_working_plane, Radius=division_2)  # disabled
flip_2 = FlipCurve(Curve=cir)  # -> Curve, Flag; disabled
divide_2 = DivideCurve(Curve=flip_2.Curve, Count=10, Kinks=False)  # -> Points, Tangents, Parameters; disabled

# ---- group: Abandoned work on making a better entry helix (without variable diameter) / Find helix lenght and max turns
addition_3 = Addition(A=thread_depth, B=thread_top_margin, C=thread_bottom_margin)  # disabled
division_3 = Division(A=addition_3, B=pitch)  # disabled
round = Round(Number=division_3)  # -> Nearest, Floor, Ceiling; disabled

# ---- group: Abandoned work on making a better entry helix (without variable diameter) / Add start point to end
item_13 = ListItem(List=flatten(divide_2.Points), Index=0, Wrap=True)  # disabled
merge = Merge(Data1=flatten(divide_2.Points), Data2=flatten(item_13))  # disabled

# ---- group: Abandoned work on making a better entry helix (without variable diameter) / Create move vectors for helix points
lng_3 = ListLength(List=merge)  # disabled
panel_3 = Panel("1")  # disabled
subtraction_4 = Subtraction(A=lng_3, B=panel_3)  # disabled
division_4 = Division(A=pitch, B=subtraction_4)  # disabled
series = Series(Start=0, Step=division_4, Count=lng_3)  # disabled
neg = Negative(Value=series)  # disabled
Z_6 = UnitZ(Factor=neg)  # disabled

# ---- group: Make jog arcs, transtion between each semicircular cut
z_lift_distance_3 = Panel(z_lift_distance)
toolpath_arcs_3 = Curve(toolpath_arcs)
number_slider_2 = Slider(0.5, range=0..1)
shift_3 = ShiftList(List=toolpath_arcs_3, Shift=1, Wrap=False)
shift_4 = ShiftList(List=toolpath_arcs_3, Shift=-1, Wrap=False)
blendc_2 = BlendCurve(CurveA=shift_4, CurveB=shift_3, BulgeA=number_slider_2, BulgeB=number_slider_2, Continuity=1)
blended_transitions = Curve(blendc_2)
reb_3 = RebuildCurve(Curve=blended_transitions, Count="5", Tangents=False)
multiplication_14 = Multiplication(A="5", B="0.5")
cp_3 = ControlPoints(Curve=reb_3)  # -> Points, Weights, Knots
int_4 = Integer(multiplication_14)
Z_7 = UnitZ(Factor=z_lift_distance_3)
item_14 = ListItem(List=cp_3.Points, Index=int_4, Wrap=True)
move_6 = Move(Geometry=item_14, Motion=Z_7)  # -> Geometry, Transform
replace_5 = ReplaceItems(List=cp_3.Points, Item=move_6.Geometry, Indices=int_4, Wrap=False)
nurbs_3 = NurbsCurve(Vertices=replace_5, Degree=3, Periodic=False)  # -> Curve, Length, Domain
jog_arcs = Curve(nurbs_3.Curve)

# ---- group: Abandoned work on making a better entry helix (without variable diameter) / Create helix trim plane
addition_4 = Addition(A=thread_depth, B=thread_bottom_margin)  # disabled
neg_2 = Negative(Value=addition_4)  # disabled
Z_8 = UnitZ(Factor=neg_2)  # disabled
move_7 = Move(Geometry=helix_working_plane, Motion=Z_8)  # -> Geometry, Transform; disabled

# ---- group: Abandoned work on making a better entry helix (without variable diameter) / Create vectors for copying helixes downwards
series_2 = Series(Start=0, Step=pitch, Count=round.Ceiling)  # disabled
neg_3 = Negative(Value=series_2)  # disabled
Z_9 = UnitZ(Factor=neg_3)  # disabled

# ---- group: Abandoned work on making a better entry helix (without variable diameter) / Make helix
move_8 = Move(Geometry=merge, Motion=Z_6)  # -> Geometry, Transform; disabled
intcrv = Interpolate(Vertices=move_8.Geometry, Degree=3, Periodic=False, KnotStyle=1)  # -> Curve, Length, Domain; disabled

# ---- group: Abandoned work on making a better entry helix (without variable diameter) / Move to start height and
Z_10 = UnitZ(Factor=thread_top_margin)  # disabled
move_9 = Move(Geometry=intcrv.Curve, Motion=Z_10)  # -> Geometry, Transform; disabled
move_10 = Move(Geometry=move_9.Geometry, Motion=Z_9)  # -> Geometry, Transform; disabled

# ---- group: Abandoned work on making a better entry helix (without variable diameter) / Trim helix to correct length inc. margin
join = JoinCurves(Curves=move_10.Geometry, Preserve=False)  # disabled
pcx = CurvePlane(Curve=join, Plane=move_7.Geometry)  # -> Points, ParamsC, ParamsP; disabled
shatter_2 = Shatter(Curve=join, Parameters=pcx.ParamsC)  # disabled
item_15 = ListItem(List=shatter_2, Index=0, Wrap=True)  # disabled

# ---- group: Abandoned work on making a better entry helix (without variable diameter) / Create top exit point
deplane = DeconstructPlane(Plane=helix_working_plane)  # -> Origin, XAxis, YAxis, ZAxis; disabled
pdecon_2 = Deconstruct(Point=deplane.Origin)  # -> XComponent, YComponent, ZComponent; disabled
addition_5 = Addition(A=pdecon_2.ZComponent, B=thread_top_margin)  # disabled
pt = ConstructPoint(XCoordinate=pdecon_2.XComponent, YCoordinate=pdecon_2.YComponent, ZCoordinate=addition_5)  # disabled

# ---- group: Abandoned work on making a better entry helix (without variable diameter) / Create bottom exit point
end_4 = EndPoints(Curve=item_15)  # -> Start, End; disabled
pdecon_3 = Deconstruct(Point=end_4.End)  # -> XComponent, YComponent, ZComponent; disabled
pt_2 = ConstructPoint(XCoordinate=pdecon_2.XComponent, YCoordinate=pdecon_2.YComponent, ZCoordinate=pdecon_3.ZComponent)  # disabled

# ----
neg_4 = Negative(Value="1")
Z_11 = UnitZ(Factor=neg_4)
multiplication_15 = Multiplication(A="1", B="2")

# ---- group: Abandoned work on making a better entry helix (without variable diameter) / Create exit path and join
ln_3 = Line(StartPoint=end_4.End, EndPoint=pt_2)  # disabled
ln_4 = Line(StartPoint=pt_2, EndPoint=pt)  # disabled
merge_2 = Merge(Data1=item_15, Data2=ln_3, Data3=ln_4)  # disabled
join_2 = JoinCurves(Curves=merge_2, Preserve=False)  # disabled

# ---- group: Abandoned work on making a better entry helix (without variable diameter) / Finsihed path
thread_milling_path = Curve(join_2)  # disabled

# ---- group: Abandoned work on making a better entry helix (without variable diameter) / Copy helix path tp all holes and group for concenient selecting
orient_2 = Orient(Geometry=thread_milling_path, Source=helix_working_plane, Target=xy_3)  # -> Geometry, Transform; disabled
group = Group(Objects=flatten(orient_2.Geometry))  # disabled
thread_milling_paths = Geometry(group)  # disabled

# ---- group: Abandoned work on making a better entry helix (without variable diameter) / Bake these
thread_milling_paths_2 = Geometry(thread_milling_paths)  # disabled

# ---- group: Inser fancy end jog to surface
corner_jog_arcs = Curve(gate_2.Target0)
end_jog_arcs_2 = Curve(end_jog_arcs)
pshift_3 = ShiftPaths(Data=corner_jog_arcs, Offset=-1)
flatten_4 = FlattenTree(Tree=corner_jog_arcs, Path="{0}")
flatten_5 = FlattenTree(Tree=pshift_3, Path="{0}")
flatten_6 = FlattenTree(Tree=end_jog_arcs_2, Path="{0}")
clean_2 = CleanTree(RemoveNulls=True, RemoveInvalid=True, RemoveEmpty=False, Tree=flatten_5)
item_16 = ListItem(List=clean_2, Index=0, Wrap=True)
null_2 = NullItem(Item=item_16)  # -> NullFlags, InvalidFlags, Description
filter_7 = StreamFilter(Gate=null_2.NullFlags, Stream0=pshift_3, Stream1=flatten_4)
filter_8 = StreamFilter(Gate=null_2.NullFlags, Stream0=end_jog_arcs_2, Stream1=flatten_6)
merge_3 = Merge(Data1=filter_7, Data2=filter_8)
graft_3 = GraftTree(Tree=merge_3, IncludeEmptyLists=True, IncludeNullItems=True)
clean_3 = CleanTree(RemoveNulls=True, RemoveInvalid=True, RemoveEmpty=True, Tree=graft_3)
transition_jog_arcs = Curve(clean_3)

# ---- group: Insert jog corner transitions
jog_arcs_2 = Curve(jog_arcs)
corner_jog_arcs_2 = Curve(transition_jog_arcs)
simplify_4 = SimplifyTree(Tree=jog_arcs_2, Front=False)
pshift_4 = ShiftPaths(Data=simplify_4, Offset=-1)
flatten_7 = FlattenTree(Tree=simplify_4, Path="{0}")
flatten_8 = FlattenTree(Tree=pshift_4, Path="{0}")
clean_4 = CleanTree(RemoveNulls=True, RemoveInvalid=True, RemoveEmpty=False, Tree=flatten_8)
item_17 = ListItem(List=clean_4, Index=0, Wrap=True)
null_3 = NullItem(Item=item_17)  # -> NullFlags, InvalidFlags, Description
filter_9 = StreamFilter(Gate=null_3.NullFlags, Stream0=pshift_4, Stream1=flatten_7)
lng_4 = ListLength(List=filter_9)
ins_2 = InsertItems(List=filter_9, Item=corner_jog_arcs_2, Indices=lng_4, Wrap=False)
jog_arcs_3 = Curve(ins_2)

# ---- group: Weave cuts and jogs
toolpath_arcs_4 = Curve(toolpath_arcs)
jog_arcs_4 = Curve(jog_arcs_3)
jograte_3 = Panel(jograte_2)
feedrate_3 = Panel(feedrate_2)
lng_5 = ListLength(List=toolpath_arcs_4)
lng_6 = ListLength(List=jog_arcs_4)
dup = DuplicateData(Data=feedrate_3, Number=lng_5, Order=True)
dup_2 = DuplicateData(Data=jograte_3, Number=lng_6, Order=True)
simplify_5 = SimplifyTree(Tree=dup_2, Front=False)
simplify_6 = SimplifyTree(Tree=dup, Front=False)
simplify_7 = SimplifyTree(Tree=jog_arcs_4, Front=False)
simplify_8 = SimplifyTree(Tree=toolpath_arcs_4, Front=False)
match = MatchTree(Tree=simplify_5, Guide=simplify_6)
match_2 = MatchTree(Tree=simplify_7, Guide=simplify_8)
weave_2 = Weave(Pattern=[0, 1], Stream0=simplify_6, Stream1=match, NullGaps=False)
weave_3 = Weave(Pattern=[0, 1], Stream0=simplify_8, Stream1=match_2, NullGaps=False)
shift_paths_if_possible = ShiftPathsIfPossible(data_paths_to_shifts=weave_2)
shift_paths_if_possible_2 = ShiftPathsIfPossible(data_paths_to_shifts=weave_3)

# ----
feedback = Panel("All good")

# ---- group: Feedback is not yet implemented
feedback_2 = Text(feedback)

# ---- group: Make helical entry plunge
stepover_distance_4 = Panel(stepover_distance)
make_helical_entry_ramp_3 = Panel(make_helical_entry_ramp)
inner_diameter_overlap_2 = Panel("0.05")
milling_bit_diameter_5 = Panel(milling_bit_diameter_3)
ramp_angle_5 = Panel(ramp_angle_3)
ramp_extra_start_height_2 = Panel("1")
start_arcs_2 = Curve(filter_4)
filter_10 = StreamFilter(Gate=make_helical_entry_ramp_3, Stream1=start_arcs_2)
rad = Radians(Degrees=ramp_angle_5)
subtraction_5 = Subtraction(A="1", B=inner_diameter_overlap_2)
rtrig = RightTrigonometry(Alpha=rad, PLength=stepover_distance_4)  # -> Alpha, Beta, PLength, QLength, RLength
multiplication_16 = Multiplication(A=milling_bit_diameter_5, B=subtraction_5)
multiplication_17 = Multiplication(A=multiplication_16, B="0.5")
eleveation_per_stepover_distance = Panel(rtrig.QLength)
inner_circle_radius = Panel(multiplication_17)
stepover_distance_5 = Panel(stepover_distance_4)
division_5 = Division(A="1", B="12")
Z_12 = UnitZ(Factor=1)
eleveation_per_stepover_distance_2 = Panel(eleveation_per_stepover_distance)
stepover_distance_6 = Panel(stepover_distance_4)
Z_13 = UnitZ(Factor=1)
xy_4 = XYPlane(Origin=Point(0, 0, 0))
rad_2 = Radians(Degrees="5")
rad_3 = Radians(Degrees="360")
dom_2 = ConstructDomain(DomainStart=rad_2, DomainEnd=rad_3)

# ----
multiplication_18 = Multiplication(A=milling_bit_diameter_5, B=max_diameter_factor_of_ramp_helix_2)
item_18 = ListItem(List=flatten(start_arcs_2), Index=0, Wrap=True)
graft_4 = GraftTree(Tree=filter_10, IncludeEmptyLists=True, IncludeNullItems=True)
subtraction_6 = Subtraction(A=multiplication_18, B=milling_bit_diameter_5)
filter_11 = StreamFilter(Gate=all_toolpaths_are_single_curve_2, Stream0=filter_10, Stream1=graft_4)
end_5 = EndPoints(Curve=item_18)  # -> Start, End
max_helix_diameter = Panel(subtraction_6)
dist_3 = Distance(PointA=end_5.Start, PointB=end_5.End)
larger = LargerThan(FirstNumber=dist_3, SecondNumber=0)  # -> LargerThan, OrEqualTo
make_narrow_entry_helix = Panel(larger.LargerThan)
max_helix_diameter_2 = Panel(max_helix_diameter)
make_narrow_entry_helix_2 = Panel(make_narrow_entry_helix)
multiplication_19 = Multiplication(A=max_helix_diameter_2, B="0.5")
make_narrow_entry_helix_3 = Panel(make_narrow_entry_helix)

# ---- group: Make helical entry plunge (continued)
item_19 = ListItem(List=filter_11, Index=0, Wrap=True)
end_6 = EndPoints(Curve=item_19)  # -> Start, End
dist_4 = Distance(PointA=end_6.Start, PointB=end_6.End)
ln_5 = Line(StartPoint=end_6.Start, EndPoint=end_6.End)
pdecon_4 = Deconstruct(Point=end_6.Start)  # -> XComponent, YComponent, ZComponent
vec2pt = Vector2Pt(PointA=end_6.Start, PointB=end_6.End, Unitize=False)  # -> Vector, Length
multiplication_20 = Multiplication(A=dist_4, B="0.5")
eval_4 = EvaluateLength(Curve=ln_5, Length="0.5", Normalized=True)  # -> Point, Tangent, Parameter
abs_2 = Absolute(Value=pdecon_4.ZComponent)
start_point_2 = Point(eval_4.Point)
addition_6 = Addition(A=abs_2, B=ramp_extra_start_height_2)
rev_4 = Reverse(Vector=vec2pt.Vector)
xy_5 = XYPlane(Origin=start_point_2)
arc_radius_2 = Panel(multiplication_20)
cut_depths_2 = Panel(addition_6)
align_2 = AlignPlane(Plane=xy_5, Direction=rev_4)  # -> Plane, Angle
cir_2 = Circle(Plane=align_2.Plane, Radius=multiplication_20)
arc_radius_3 = Panel(arc_radius_2)
flip_3 = FlipCurve(Curve=cir_2)  # -> Curve, Flag
subtraction_7 = Subtraction(A=arc_radius_3, B=inner_circle_radius)
horizontal_spiral_distance = Panel(subtraction_7)
divide_3 = DivideCurve(Curve=flip_3.Curve, Count="12", Kinks=False)  # -> Points, Tangents, Parameters
division_6 = Division(A=horizontal_spiral_distance, B=stepover_distance_5)
multiplication_21 = Multiplication(A="12", B=division_6)
number_of_spiral_points = Panel(multiplication_21)
series_3 = Series(Start=0, Step=1, Count=number_of_spiral_points)
series_4 = Series(Start=0, Step=division_5, Count=number_of_spiral_points)
item_20 = ListItem(List=divide_3.Points, Index=series_3, Wrap=True)
multiplication_22 = Multiplication(A=series_4, B=stepover_distance_5)
vec2pt_2 = Vector2Pt(PointA=item_20, PointB=start_point_2, Unitize=False)  # -> Vector, Length
amp = Amplitude(Vector=vec2pt_2.Vector, Amplitude=multiplication_22)
move_11 = Move(Geometry=item_20, Motion=amp)  # -> Geometry, Transform
intcrv_2 = Interpolate(Vertices=move_11.Geometry, Degree=3, Periodic=False, KnotStyle=1)  # -> Curve, Length, Domain
flip_4 = FlipCurve(Curve=intcrv_2.Curve)  # -> Curve, Flag
start_point_3 = Point(start_point_2)
start_point_4 = Point(start_point_2)
cut_depths_3 = Panel(cut_depths_2)
start_point_5 = Point(start_point_2)
project = Project(Geometry=start_point_5, Plane=xy_4)  # -> Geometry, Transform
xy_6 = XYPlane(Origin=start_point_5)
cut_depths_4 = Panel(cut_depths_2)
Z_14 = UnitZ(Factor=cut_depths_4)
move_12 = Move(Geometry=xy_6, Motion=Z_14)  # -> Geometry, Transform
arc_radius_4 = Panel(arc_radius_2)
start_point_plane = Plane(align_2.Plane)
arc_3 = Arc(Plane=start_point_plane, Radius=arc_radius_4, Angle=dom_2)  # -> Arc, Length
simplify_9 = SimplifyTree(Tree=arc_3.Arc, Front=False)

# ----
pln = Plane(align_2.Plane)
gate_3 = StreamGate(Stream=pln, Gate=make_narrow_entry_helix_2)  # -> Target0, Target1
move_13 = Move(Geometry=gate_3.Target1, Motion=Z_11)  # -> Geometry, Transform
cyl = Cylinder(Base=move_13.Geometry, Radius=multiplication_19, Length=multiplication_15)
cap = CapHoles(Brep=cyl)
trim = TrimWithBrep(Curve=flip_4.Curve, Brep=cap)  # -> Inside, Outside
narrow_bottom_flat_spiral = Curve(trim.Inside)
bottom_flat_spiral = Curve(flip_4.Curve)
filter_12 = StreamFilter(Gate=make_narrow_entry_helix_3, Stream0=bottom_flat_spiral, Stream1=narrow_bottom_flat_spiral)

# ---- group: Make helical entry plunge (continued)
bottom_flat_spiral_for_buidling_helix = Curve(filter_12)
end_7 = EndPoints(Curve=bottom_flat_spiral_for_buidling_helix)  # -> Start, End
vec2pt_3 = Vector2Pt(PointA=start_point_3, PointB=end_7.Start, Unitize=False)  # -> Vector, Length
pl = ConstructPlane(Origin=start_point_3, XAxis=vec2pt_3.Vector, YAxis=Z_12)
mirror = Mirror(Geometry=bottom_flat_spiral_for_buidling_helix, Plane=pl)  # -> Geometry, Transform
divide_curve_even_lenght = DivideCurveEvenLenght(crv=mirror.Geometry, B=stepover_distance_6)
lng_7 = ListLength(List=divide_curve_even_lenght)
series_5 = Series(Start=0, Step=eleveation_per_stepover_distance_2, Count=lng_7)
Z_15 = UnitZ(Factor=series_5)
move_14 = Move(Geometry=divide_curve_even_lenght, Motion=Z_15)  # -> Geometry, Transform
intcrv_3 = Interpolate(Vertices=move_14.Geometry, Degree=3, Periodic=False, KnotStyle=1)  # -> Curve, Length, Domain
flip_5 = FlipCurve(Curve=intcrv_3.Curve)  # -> Curve, Flag
lower_plunge_helix = Curve(flip_5.Curve)
end_8 = EndPoints(Curve=lower_plunge_helix)  # -> Start, End
vec2pt_4 = Vector2Pt(PointA=start_point_4, PointB=end_8.Start, Unitize=False)  # -> Vector, Length
pl_2 = ConstructPlane(Origin=end_8.Start, XAxis=vec2pt_4.Vector, YAxis=Z_13)
mirror_2 = Mirror(Geometry=lower_plunge_helix, Plane=pl_2)  # -> Geometry, Transform
flip_6 = FlipCurve(Curve=mirror_2.Geometry)  # -> Curve, Flag
xy_7 = XYPlane(Origin=end_8.Start)
mirror_3 = Mirror(Geometry=flip_6.Curve, Plane=xy_7)  # -> Geometry, Transform
upper_plunge_helix = Curve(mirror_3.Geometry)
lower_plunge_helix_2 = Curve(lower_plunge_helix)
merge_4 = Merge(Data1=upper_plunge_helix, Data2=lower_plunge_helix_2)
join_3 = JoinCurves(Curves=merge_4, Preserve=False)
simplify_10 = SimplifyTree(Tree=join_3, Front=False)
plunge_helix = Curve(simplify_10)
end_9 = EndPoints(Curve=plunge_helix)  # -> Start, End
pdecon_5 = Deconstruct(Point=end_9.Start)  # -> XComponent, YComponent, ZComponent
pdecon_6 = Deconstruct(Point=end_9.End)  # -> XComponent, YComponent, ZComponent
pt_3 = ConstructPoint(XCoordinate=0, YCoordinate=0, ZCoordinate=pdecon_5.ZComponent)
pt_4 = ConstructPoint(XCoordinate=0, YCoordinate=0, ZCoordinate=pdecon_6.ZComponent)
dist_5 = Distance(PointA=pt_3, PointB=pt_4)
plunge_helix_height = Panel(dist_5)
division_7 = Division(A=cut_depths_3, B=plunge_helix_height)
round_2 = Round(Number=division_7)  # -> Nearest, Floor, Ceiling
end_10 = EndPoints(Curve=plunge_helix)  # -> Start, End
project_2 = Project(Geometry=end_10.Start, Plane=xy_4)  # -> Geometry, Transform
project_3 = Project(Geometry=end_10.End, Plane=xy_4)  # -> Geometry, Transform
vec2pt_5 = Vector2Pt(PointA=project.Geometry, PointB=project_3.Geometry, Unitize=False)  # -> Vector, Length
vec2pt_6 = Vector2Pt(PointA=project.Geometry, PointB=project_2.Geometry, Unitize=False)  # -> Vector, Length
angle = Angle(VectorA=vec2pt_6.Vector, VectorB=vec2pt_5.Vector, Plane=xy_4)  # -> Angle, Reflex
series_6 = Series(Start=0, Step=plunge_helix_height, Count=round_2.Ceiling)
series_7 = Series(Start=0, Step=angle.Reflex, Count=round_2.Ceiling)
Z_16 = UnitZ(Factor=series_6)
move_15 = Move(Geometry=plunge_helix, Motion=Z_16)  # -> Geometry, Transform
rotate = Rotate(Geometry=move_15.Geometry, Angle=series_7, Plane=xy_6)  # -> Geometry, Transform
join_4 = JoinCurves(Curves=rotate.Geometry, Preserve=False)
bottom_flat_spiral_2 = Curve(bottom_flat_spiral)
simplify_11 = SimplifyTree(Tree=join_4, Front=False)
plunge_helix_tower = Curve(simplify_11)
flatten_9 = FlattenTree(Tree=bottom_flat_spiral_2, Path="{0}")
lng_8 = ListLength(List=flatten_9)
pcx_2 = CurvePlane(Curve=plunge_helix_tower, Plane=move_12.Geometry)  # -> Points, ParamsC, ParamsP
smaller_3 = SmallerThan(FirstNumber=lng_8, SecondNumber="2")  # -> SmallerThan, OrEqualTo
shatter_3 = Shatter(Curve=plunge_helix_tower, Parameters=pcx_2.ParamsC)
rev_5 = ReverseList(List=shatter_3)
filter_13 = StreamFilter(Gate=smaller_3.SmallerThan, Stream0=bottom_flat_spiral_2, Stream1=flatten_9)
item_21 = ListItem(List=rev_5, Index=0, Wrap=True)
rotate_2 = Rotate(Geometry=filter_13, Angle=rad_2, Plane=start_point_plane)  # -> Geometry, Transform
rev_6 = ReverseList(List=item_21)
simplify_12 = SimplifyTree(Tree=rotate_2.Geometry, Front=False)
rotate_3 = Rotate(Geometry=rev_6, Angle=rad_2, Plane=start_point_plane)  # -> Geometry, Transform
join_5 = JoinCurves(Curves=[simplify_12, simplify_9], Preserve=False)
simplify_13 = SimplifyTree(Tree=rotate_3.Geometry, Front=False)
simplify_14 = SimplifyTree(Tree=join_5, Front=False)
flatten_10 = FlattenTree(Tree=simplify_14, Path="{0}")
flatten_11 = FlattenTree(Tree=simplify_13, Path="{0}")
filter_14 = StreamFilter(Gate=smaller_3.SmallerThan, Stream0=simplify_14, Stream1=flatten_10)
filter_15 = StreamFilter(Gate=smaller_3.SmallerThan, Stream0=simplify_13, Stream1=flatten_11)
join_6 = JoinCurves(Curves=[filter_15, filter_14], Preserve=False)
cut_entry_plunges = Curve(join_6)

# ---- group: Make peck helix entry
max_peck_depth_factor_4 = Panel(max_peck_depth_factor_3)
milling_bit_diameter_6 = Panel(milling_bit_diameter_3)
use_peck_entry_4 = Panel(use_peck_entry_3)
cut_entry_plunges_2 = Curve(cut_entry_plunges)
multiplication_23 = Multiplication(A=max_peck_depth_factor_4, B=milling_bit_diameter_6)
gate_4 = StreamGate(Stream=cut_entry_plunges_2, Gate=use_peck_entry_4)  # -> Target0, Target1
bbox = BoundingBox(Content=gate_4.Target1, Plane=PlaneXY(0, 0, 0))  # -> Box, Box_2
debrep = DeconstructBrep(Brep=bbox.Box)  # -> Faces, Edges, Vertices
item_22 = ListItem(List=debrep.Edges, Index="8", Wrap=True)
item_23 = ListItem(List=debrep.Faces, Index="5", Wrap=True)
len_2 = Length(Curve=item_22)
edges = BrepEdges(Brep=item_23)  # -> Naked, Interior, NonManifold
max_peck_depth = Panel(multiplication_23)
helix_depths = Panel(len_2)
join_7 = JoinCurves(Curves=edges.Naked, Preserve=False)
offset = Offset(Curve=join_7, Distance="0.1", Plane=PlaneXY(0, 0, 0), Corners=1)
division_8 = Division(A=helix_depths, B=max_peck_depth)
round_3 = Round(Number=division_8)  # -> Nearest, Floor, Ceiling
series_8 = Series(Start=max_peck_depth, Step=max_peck_depth, Count=round_3.Floor)
neg_5 = Negative(Value=series_8)
Z_17 = UnitZ(Factor=neg_5)
extr = Extrude(Base=offset, Direction=Z_17)
cut_entry_plunges_3 = Curve(gate_4.Target1)
cap_2 = CapHoles(Brep=extr)
simplify_15 = SimplifyTree(Tree=cap_2, Front=False)
simplify_16 = SimplifyTree(Tree=cut_entry_plunges_3, Front=False)
lng_9 = ListLength(List=simplify_15)
dup_3 = DuplicateData(Data=simplify_16, Number=lng_9, Order=True)
simplify_17 = SimplifyTree(Tree=dup_3, Front=False)
trim_2 = TrimWithBreps(Curve=graft(simplify_17), Brep=graft(simplify_15))  # -> Inside, Outside
pshift_5 = ShiftPaths(Data=trim_2.Inside, Offset=-1)
pshift_6 = ShiftPaths(Data=pshift_5, Offset=-1)
end_11 = EndPoints(Curve=pshift_6)  # -> Start, End
item_24 = ListItem(List=end_11.Start, Index=0, Wrap=True)
max_peck_depth_2 = Panel(max_peck_depth)
vec2pt_7 = Vector2Pt(PointA=end_11.End, PointB=item_24, Unitize=False)  # -> Vector, Length
amp_2 = Amplitude(Vector=vec2pt_7.Vector, Amplitude=max_peck_depth_2)
multiplication_24 = Multiplication(A=max_peck_depth_2, B="0.9")
amp_3 = Amplitude(Vector=vec2pt_7.Vector, Amplitude=multiplication_24)
move_16 = Move(Geometry=end_11.End, Motion=amp_2)  # -> Geometry, Transform
move_17 = Move(Geometry=end_11.End, Motion=amp_3)  # -> Geometry, Transform
ln_6 = Line(StartPoint=move_17.Geometry, EndPoint=move_16.Geometry)
flip_7 = FlipCurve(Curve=pshift_6)  # -> Curve, Flag
eval_5 = EvaluateLength(Curve=flip_7.Curve, Length=multiplication_24, Normalized=False)  # -> Point, Tangent, Parameter
shatter_4 = Shatter(Curve=graft(flip_7.Curve), Parameters=graft(eval_5.Parameter))
item_25 = ListItem(List=shatter_4, Index="1", Wrap=False)
flip_8 = FlipCurve(Curve=item_25)  # -> Curve, Flag
number_slider_3 = Slider(0.5, range=0..1)
pshift_7 = ShiftPaths(Data=flip_8.Curve, Offset=-1)
pshift_8 = ShiftPaths(Data=pshift_7, Offset=-1)
blendc_3 = BlendCurve(CurveA=pshift_8, CurveB=ln_6, BulgeA=number_slider_3, BulgeB=number_slider_3, Continuity=2)
merge_5 = Merge(Data1=graft(pshift_8), Data2=graft(blendc_3))
join_8 = JoinCurves(Curves=merge_5, Preserve=False)
pshift_9 = ShiftPaths(Data=join_8, Offset=-1)
cut_entry_plunges_4 = Curve(gate_4.Target1)
pshift_10 = ShiftPaths(Data=pshift_9, Offset=-1)
distance_to_extend_top_of_helix_curve_fo = Panel("0.1")  # "Distance to extend top of helix curve (for joining)"
simplify_18 = SimplifyTree(Tree=pshift_10, Front=False)
simplify_19 = SimplifyTree(Tree=cut_entry_plunges_4, Front=False)
lng_10 = ListLength(List=flatten(simplify_19))
merge_6 = Merge(Data1=flatten(simplify_18), Data2=flatten(simplify_19))
merge_7 = Merge(Data1=simplify_18, Data2=simplify_19)
addition_7 = Addition(A=round_3.Floor, B="1")
smaller_4 = SmallerThan(FirstNumber=lng_10, SecondNumber="2")  # -> SmallerThan, OrEqualTo
series_9 = Series(Start=0, Step=distance_to_extend_top_of_helix_curve_fo, Count=simplify(addition_7))
filter_16 = StreamFilter(Gate=smaller_4.SmallerThan, Stream0=merge_7, Stream1=flatten(merge_6))
ext_2 = ExtendCurve(Curve=filter_16, Type=2, Start=series_9, End="0")
end_12 = EndPoints(Curve=ext_2)  # -> Start, End
shift_5 = ShiftList(List=end_12.End, Shift="-1", Wrap=False)
shift_6 = ShiftList(List=end_12.Start, Shift="1", Wrap=False)
ln_7 = Line(StartPoint=shift_5, EndPoint=shift_6)
simplify_20 = SimplifyTree(Tree=ext_2, Front=False)
simplify_21 = SimplifyTree(Tree=ln_7, Front=False)
merge_8 = Merge(Data1=simplify_20, Data2=simplify_21)
merge_9 = Merge(Data1=graft(simplify_20), Data2=graft(simplify_21))
filter_17 = StreamFilter(Gate=smaller_4.SmallerThan, Stream0=merge_8, Stream1=flatten(merge_9))
join_9 = JoinCurves(Curves=filter_17, Preserve=False)
pshift_11 = ShiftPaths(Data=join_9, Offset=-1)
simplify_22 = SimplifyTree(Tree=pshift_11, Front=False)
match_3 = MatchTree(Tree=simplify_22, Guide=cut_entry_plunges_2)
peck_helix = Curve(match_3)

# ---- group: Prepare ramp for insert
cut_entry_plunges_with_peck_helix = Curve(peck_helix)
ramp_feedrate_2 = Panel(ramp_feedrate)
use_peck_entry_5 = Panel(use_peck_entry_3)
make_helical_entry_ramp_4 = Panel(make_helical_entry_ramp)
all_toolpaths_are_single_curve_7 = Panel(all_toolpaths_are_single_curve)
cut_entry_plunges_5 = Curve(cut_entry_plunges)

# ----
filter_18 = StreamFilter(Gate=use_peck_entry_5, Stream0=cut_entry_plunges_5, Stream1=cut_entry_plunges_with_peck_helix)

# ---- group: Prepare ramp for insert (continued)
cut_entry_plunges_6 = Curve(filter_18)
lng_11 = ListLength(List=cut_entry_plunges_6)
dup_4 = DuplicateData(Data=ramp_feedrate_2, Number=lng_11, Order=True)
simplify_23 = SimplifyTree(Tree=cut_entry_plunges_6, Front=False)
simplify_24 = SimplifyTree(Tree=dup_4, Front=False)
flatten_12 = FlattenTree(Tree=simplify_24, Path="{0}")
flatten_13 = FlattenTree(Tree=simplify_23, Path="{0}")
filter_19 = StreamFilter(Gate=all_toolpaths_are_single_curve_7, Stream0=simplify_24, Stream1=flatten_12)
filter_20 = StreamFilter(Gate=all_toolpaths_are_single_curve_7, Stream0=simplify_23, Stream1=flatten_13)

# ---- group: Insert ramp feedrates
ins_3 = InsertItems(List=shift_paths_if_possible, Item=filter_19, Indices="0", Wrap=True)
simplify_25 = SimplifyTree(Tree=ins_3, Front=False)
filter_21 = StreamFilter(Gate=make_helical_entry_ramp_4, Stream0=shift_paths_if_possible, Stream1=simplify_25)

# ---- group: Insert ramp geometry
ins_4 = InsertItems(List=shift_paths_if_possible_2, Item=filter_20, Indices="0", Wrap=True)
simplify_26 = SimplifyTree(Tree=ins_4, Front=False)
filter_22 = StreamFilter(Gate=make_helical_entry_ramp_4, Stream0=shift_paths_if_possible_2, Stream1=simplify_26)

# ----
toolpaths = Curve(filter_22)
feedrates = Panel(filter_21)

# ---- group: Preview toolpaths
preview_toolpath = Slider(0, range=0..1)
shift_paths_if_possible_3 = ShiftPathsIfPossible(data_paths_to_shifts=toolpaths)  # disabled
join_10 = JoinCurves(Curves=shift_paths_if_possible_3, Preserve=False)
milling_bit_diameter_7 = Panel(milling_bit_diameter_3)
eval_6 = EvaluateLength(Curve=graft(join_10), Length=preview_toolpath, Normalized=True)  # -> Point, Tangent, Parameter
shatter_5 = Shatter(Curve=graft(join_10), Parameters=eval_6.Parameter)
multiplication_25 = Multiplication(A=milling_bit_diameter_7, B="0.5")
pt_5 = Point(eval_6.Point)
xy_8 = XYPlane(Origin=eval_6.Point)
xy_9 = XYPlane(Origin=Point(0, 0, 0))
item_26 = ListItem(List=shatter_5, Index=0, Wrap=True)
cyl_2 = Cylinder(Base=xy_9, Radius=multiplication_25, Length=Slider(40, range=0..100))
orient_3 = Orient(Geometry=cyl_2, Source=xy_9, Target=xy_8)  # -> Geometry, Transform
preview = CustomPreview(Geometry=orient_3.Geometry, Shader=ColourSwatch(SwatchColor=RGB(79, 79, 79)))

# ---- group: Separate feedrate and jog rates is not yet impleneted, it is rarely needed
feedrates_2 = Number(feedrates)

# ----
toolpaths_2 = Curve(toolpaths)
trochoidal_toolpaths = ClusterOutput(toolpaths_2)  # Input into post processor

# ==== cluster PlungeRoughing
milling_bit_diameter = ClusterInput()
toolpath_curves = ClusterInput()
stepover = ClusterInput()
milling_bit_diameter_2 = Number(milling_bit_diameter)
toolpath_curves_2 = Curve(toolpath_curves)
stepover_2 = Number(stepover)
milling_bit_diameter_3 = Panel(milling_bit_diameter_2)
safe_z = Panel("1")
stepover_3 = Panel(stepover_2)

# ---- group: Shetter curves at corners and shatter closed curves
disc = Discontinuity(Curve=toolpath_curves_2, Level=1)  # -> Points, Parameters
lng = ListLength(List=disc.Parameters)
smaller = SmallerThan(FirstNumber=lng, SecondNumber="1")  # -> SmallerThan, OrEqualTo
weave = Weave(Pattern=smaller.SmallerThan, Stream0=disc.Parameters, Stream1="0", NullGaps=False)
shatter = Shatter(Curve=graft(toolpath_curves_2), Parameters=weave)

# ----
multiplication = Multiplication(A=milling_bit_diameter_3, B=stepover_3)
stepover_distance = Panel(multiplication)
shattered_toolpath_curves = Curve(shatter)
len = Length(Curve=shattered_toolpath_curves)
division = Division(A=len, B=stepover_distance)
int = Integer(division)
divide = DivideCurve(Curve=shattered_toolpath_curves, Count=int, Kinks=False)  # -> Points, Tangents, Parameters

# ---- group: Create drill lines
pdecon = Deconstruct(Point=divide.Points)  # -> XComponent, YComponent, ZComponent; disabled
pt = ConstructPoint(XCoordinate=pdecon.XComponent, YCoordinate=pdecon.YComponent, ZCoordinate=0)
Z = UnitZ(Factor=pdecon.ZComponent)
move = Move(Geometry=pt, Motion=Z)  # -> Geometry, Transform
ln = Line(StartPoint=pt, EndPoint=move.Geometry)

# ---- group: Create plunges with custom safe Z
safe_z_2 = Panel(safe_z)
pdecon_2 = Deconstruct(Point=divide.Points)  # -> XComponent, YComponent, ZComponent
pt_2 = Point(divide.Points)
pt_3 = ConstructPoint(XCoordinate=pdecon_2.XComponent, YCoordinate=pdecon_2.YComponent, ZCoordinate=safe_z_2)
simplify = SimplifyTree(Tree=pt_2, Front=False)
simplify_2 = SimplifyTree(Tree=pt_3, Front=False)
weave_2 = Weave(Pattern=[0, 1, 2], Stream0=simplify_2, Stream1=simplify, Stream2=simplify_2, NullGaps=False)
pline = PolyLine(Vertices=weave_2, Closed=False)

# ----
plunge_rough_lines = Curve(flatten(pline))
plunge_rough_lines_2 = ClusterOutput(plunge_rough_lines)

# ==== cluster ShiftPathsIfPossible
data_paths_to_shifts = ClusterInput()
pshift = ShiftPaths(Data=data_paths_to_shifts, Offset=-1)
flatten = FlattenTree(Tree=data_paths_to_shifts, Path="{0}")
flatten_2 = FlattenTree(Tree=pshift, Path="{0}")
clean = CleanTree(RemoveNulls=True, RemoveInvalid=True, RemoveEmpty=False, Tree=flatten_2)
item = ListItem(List=clean, Index=0, Wrap=True)
null = NullItem(Item=item)  # -> NullFlags, InvalidFlags, Description
filter = StreamFilter(Gate=null.NullFlags, Stream0=pshift, Stream1=flatten)
safely_shifted_paths = ClusterOutput(filter)  # Safely shifted paths

# ==== cluster DivideCurveEvenLenght: Calculates approximate curve length for even division
crv = ClusterInput()
crv_2 = Curve(crv)
B = ClusterInput()
len = Length(Curve=crv_2)
division = Division(A=len, B=B)
int = Integer(division)
divide = DivideCurve(Curve=crv_2, Count=int, Kinks=False)  # -> Points, Tangents, Parameters
P = ClusterOutput(divide.Points)
