# Grasshopper definition Internal thread milling.gh (Grasshopper 1.0.7)

# ---- group: Get all curves in current rhino document and filter circles
pipeline = GeometryPipeline(
    GroupByLayer=False,
    GroupByType=False,
    IncludeHidden=False,
    IncludeLocked=False,
    LayerFilter="*",
    NameFilter="*",
    SublayerFiltering=True,
    TypeFilter=4)
circle = Circle(pipeline)
clean = CleanTree(RemoveNulls=True, RemoveInvalid=True, RemoveEmpty=True, Tree=circle)

# ---- group: Input the diamter of your holes to thread milled here
diameter_of_holes_to_be_thread_milled = Panel("4.3")

# ---- group: Filter to specified diamter
pi = Pi(Factor=1)
len = Length(Curve=clean)
multiplication = Multiplication(A=diameter_of_holes_to_be_thread_milled, B=pi)
equals = Equality(FirstNumber=len, SecondNumber=multiplication)  # -> Equality, Inequality
dispatch = Dispatch(List=clean, DispatchPattern=equals.Equality)  # -> ListA, ListB
filtered_circles = Curve(dispatch.ListA)

# ----
pitch = Panel("0.8")
thread_depth = Panel("12")
tool_diameter = Panel("3.9")
thread_top_margin = Panel("0.6")
thread_diameter = Panel("5.1")
thread_bottom_margin = Panel("0.4")

# ---- group: Add curves here
curve_holes_to_thread_mill = Curve(filtered_circles)

# ---- group: Create planes at center of curves
area = Area(Geometry=curve_holes_to_thread_mill)  # -> Area, Centroid
xy = XYPlane(Origin=flatten(area.Centroid))

# ---- group: Find helix radius
subtraction = Subtraction(A=thread_diameter, B=tool_diameter)
division = Division(A=subtraction, B="2")

# ---- group: Select one plane to generate helix on
item = ListItem(List=xy, Index=0, Wrap=True)
helix_working_plane = Plane(item)

# ---- group: Create base circle for helix
cir = Circle(Plane=helix_working_plane, Radius=division)
flip = FlipCurve(Curve=cir)  # -> Curve, Flag
divide = DivideCurve(Curve=flip.Curve, Count=10, Kinks=False)  # -> Points, Tangents, Parameters

# ---- group: Find helix lenght and max turns
addition = Addition(A=thread_depth, B=thread_top_margin, C=thread_bottom_margin)
division_2 = Division(A=addition, B=pitch)
round = Round(Number=division_2)  # -> Nearest, Floor, Ceiling

# ---- group: Add start point to end
item_2 = ListItem(List=flatten(divide.Points), Index=0, Wrap=True)
merge = Merge(Data1=flatten(divide.Points), Data2=flatten(item_2))

# ---- group: Create move vectors for helix points
lng = ListLength(List=merge)
subtraction_2 = Subtraction(A=lng, B="1")
division_3 = Division(A=pitch, B=subtraction_2)
series = Series(Start=0, Step=division_3, Count=lng)
neg = Negative(Value=series)
Z = UnitZ(Factor=neg)

# ---- group: Create helix trim plane
addition_2 = Addition(A=thread_depth, B=thread_bottom_margin)
neg_2 = Negative(Value=addition_2)
Z_2 = UnitZ(Factor=neg_2)
move = Move(Geometry=helix_working_plane, Motion=Z_2)  # -> Geometry, Transform

# ---- group: Create vectors for copying helixes downwards
series_2 = Series(Start=0, Step=pitch, Count=round.Ceiling)
neg_3 = Negative(Value=series_2)
Z_3 = UnitZ(Factor=neg_3)

# ---- group: Make helix
move_2 = Move(Geometry=merge, Motion=Z)  # -> Geometry, Transform
intcrv = Interpolate(Vertices=move_2.Geometry, Degree=3, Periodic=False, KnotStyle=1)  # -> Curve, Length, Domain

# ---- group: Move to start height and
Z_4 = UnitZ(Factor=thread_top_margin)
move_3 = Move(Geometry=intcrv.Curve, Motion=Z_4)  # -> Geometry, Transform
move_4 = Move(Geometry=move_3.Geometry, Motion=Z_3)  # -> Geometry, Transform

# ---- group: Trim helix to correct length inc. margin
join = JoinCurves(Curves=move_4.Geometry, Preserve=False)
pcx = CurvePlane(Curve=join, Plane=move.Geometry)  # -> Points, ParamsC, ParamsP
shatter = Shatter(Curve=join, Parameters=pcx.ParamsC)
item_3 = ListItem(List=shatter, Index=0, Wrap=True)

# ---- group: Create top exit point
deplane = DeconstructPlane(Plane=helix_working_plane)  # -> Origin, XAxis, YAxis, ZAxis
pdecon = Deconstruct(Point=deplane.Origin)  # -> XComponent, YComponent, ZComponent
addition_3 = Addition(A=pdecon.ZComponent, B=thread_top_margin)
pt = ConstructPoint(XCoordinate=pdecon.XComponent, YCoordinate=pdecon.YComponent, ZCoordinate=addition_3)

# ---- group: Create bottom exit point
end = EndPoints(Curve=item_3)  # -> Start, End
pdecon_2 = Deconstruct(Point=end.End)  # -> XComponent, YComponent, ZComponent
pt_2 = ConstructPoint(XCoordinate=pdecon.XComponent, YCoordinate=pdecon.YComponent, ZCoordinate=pdecon_2.ZComponent)

# ---- group: Create exit path and join
ln = Line(StartPoint=end.End, EndPoint=pt_2)
ln_2 = Line(StartPoint=pt_2, EndPoint=pt)
merge_2 = Merge(Data1=item_3, Data2=ln, Data3=ln_2)
join_2 = JoinCurves(Curves=merge_2, Preserve=False)

# ---- group: Finsihed path
thread_milling_path = Curve(join_2)

# ---- group: Copy helix path tp all holes and group for concenient selecting
orient = Orient(Geometry=thread_milling_path, Source=helix_working_plane, Target=xy)  # -> Geometry, Transform
group = Group(Objects=flatten(orient.Geometry))
thread_milling_paths = Geometry(group)

# ---- group: Bake these
thread_milling_paths_2 = Geometry(thread_milling_paths)

# ----
preview = CustomPreview(Geometry=group, Material=ColourSwatch(SwatchColor=RGB(0, 255, 229)))
