# Grasshopper definition automill from brep dev.gh (Grasshopper 1.0.7)
# plug-ins: Clipper

# Work on automatically detecting pocket surfaces and extending them were possible. Requires clipper plugin
pipeline = GeometryPipeline(
    GroupByLayer=False,
    GroupByType=False,
    IncludeHidden=True,
    IncludeLocked=True,
    LayerFilter="CNC 3D",
    NameFilter="*",
    SublayerFiltering=True,
    TypeFilter=1073741848)
xz = XZPlane(Origin=Point(0, 0, 0))
yz = YZPlane(Origin=Point(0, 0, 0))
xy = XYPlane(Origin=Point(0, 0, 0))
operation_zero_plane = Plane(xy)
# To do: add cutout
# add dogbones
# add 3D surfaces
# cluster if works well
# add ignore surfaces at z zero height?
brep_to_mill = Brep(pipeline)
skip_pockets_on_stock_surface = Panel(Toggle(True))
cutting_direction_is_climb = Panel(Toggle(False))
bit_diameter = Panel("6")
tolerance = Panel("0.01")
clean = CleanTree(RemoveNulls=True, RemoveInvalid=True, RemoveEmpty=False, Tree=brep_to_mill)
deplane = DeconstructPlane(Plane=operation_zero_plane)  # -> Origin, XAxis, YAxis, ZAxis
debrep = DeconstructBrep(Brep=clean)  # -> Faces, Edges, Vertices
z_axis_vector_for_operation_normal = Vector(deplane.ZAxis)
planar = IsPlanar(Surface=debrep.Faces, Interior=True)  # -> Planar, Plane
dispatch = Dispatch(List=debrep.Faces, DispatchPattern=planar.Planar)  # -> ListA, ListB
dispatch_2 = Dispatch(List=planar.Plane, DispatchPattern=planar.Planar)  # -> ListA, ListB
pln = Plane(dispatch_2.ListA)
srf = Surface(dispatch.ListA)
deplane_2 = DeconstructPlane(Plane=pln)  # -> Origin, XAxis, YAxis, ZAxis
srf_cp = SurfaceClosestPoint(Point=deplane_2.Origin, Surface=srf)  # -> Point, UVPoint, Distance
evalsrf = EvaluateSurface(Surface=srf, Point=srf_cp.UVPoint)  # -> Point, Normal, UDirection, VDirection, Frame
deplane_3 = DeconstructPlane(Plane=evalsrf.Frame)  # -> Origin, XAxis, YAxis, ZAxis
angle = Angle(VectorA=deplane_3.ZAxis, VectorB=z_axis_vector_for_operation_normal)  # -> Angle, Reflex
deg = Degrees(Radians=angle.Angle)
smaller = SmallerThan(FirstNumber=deg, SecondNumber="0.001")  # -> SmallerThan, OrEqualTo
dispatch_3 = Dispatch(List=srf, DispatchPattern=smaller.SmallerThan)  # -> ListA, ListB

# ---- group: Filter out pockets that are on the surface of the stock
operation_zero_plane_2 = Plane(operation_zero_plane)
skip_pockets_on_stock_surface_2 = Panel(skip_pockets_on_stock_surface)
brep = Brep(dispatch_3.ListA)
tolerance_2 = Panel(tolerance)
planar_2 = IsPlanar(Surface=brep, Interior=True)  # -> Planar, Plane
deplane_4 = DeconstructPlane(Plane=planar_2.Plane)  # -> Origin, XAxis, YAxis, ZAxis
cp = PlaneClosestPoint(Point=operation_zero_plane_2, Plane=deplane_4.Origin)  # -> Point, UVPoint, Distance
smaller_2 = SmallerThan(FirstNumber=cp.Distance, SecondNumber=tolerance_2)  # -> SmallerThan, OrEqualTo
filter = StreamFilter(Gate=skip_pockets_on_stock_surface_2, Stream0=Toggle(False), Stream1=smaller_2.SmallerThan)
# Remove inside holes or teat separetely?
dispatch_4 = Dispatch(List=brep, DispatchPattern=filter)  # -> ListA, ListB

# ----
srf_2 = Surface(dispatch_3.ListA)  # disabled
clean_2 = CleanTree(RemoveNulls=True, RemoveInvalid=True, RemoveEmpty=True, Tree=srf_2)  # disabled
sort_srf_to_crv = SortSrfToCrv(srf=dispatch_4.ListB)  # -> outside_curves_2, inside_curves_2
inner_curves_for_pocket = Curve(simplify(sort_srf_to_crv.inside_curves_2))
wires = BrepWireframe(Brep=clean_2, Density=-1)  # disabled
operation_zero_plane_3 = Plane(operation_zero_plane)  # disabled
bit_diameter_2 = Panel(bit_diameter)
join = JoinCurves(Curves=wires, Preserve=False)  # disabled
operation_zero_plane_4 = Plane(operation_zero_plane)
tolerance_3 = Panel(tolerance)
cutting_direction_is_climb_2 = Panel(cutting_direction_is_climb)
topoly = CurveToPolyline(Curve=join, ToleranceDistance=tolerance_3, ToleranceAngle=0)  # -> Polyline, Segments; disabled
allowence_offset = Panel("0")
cir = Circle(Plane=operation_zero_plane_4, Radius=1)
project = Project(Geometry=topoly.Polyline, Plane=operation_zero_plane_3)  # -> Geometry, Transform; disabled
division = Division(A=bit_diameter_2, B=2)
flip = FlipCurve(Curve=cir)  # -> Curve, Flag
simplify = SimplifyTree(Tree=project.Geometry, Front=False)  # disabled
addition = Addition(A=division, B=allowence_offset)
custom_mesh_settings = SettingsCustom(
    StitchSeams=True,
    SimplePlanes=False,
    Refine=True,
    MinCount=16,
    MaxCount=400,
    AspectRatio=20,
    MaxDistance=tolerance,
    MaxAngle=20,
    MinEdge=0,
    MaxEdge=0)
filter_2 = StreamFilter(Gate=cutting_direction_is_climb_2, Stream0=flip.Curve, Stream1=cir)
filter_3 = StreamFilter(Gate=cutting_direction_is_climb_2, Stream0=cir, Stream1=flip.Curve)
pshift = ShiftPaths(Data=simplify, Offset=-1)  # disabled
bit_diameter_3 = Panel(bit_diameter)
polyboolean = PolylineBoolean(A=pshift, BooleanType=1, Plane=Plane(origin=(0, 0, 0), x=(0, 0, 0), y=(0, 0, 0)), Tolerance=0.001, EvenOdd=True)  # disabled
mesh = MeshBrep(Brep=clean, Settings=custom_mesh_settings)
tolerance_4 = Panel(tolerance)
redpline = Reduce(Polyline=polyboolean, Tolerance=tolerance_3)  # -> Polyline, Reduction; disabled
mshadow = MeshShadow(Mesh=mesh, Light=z_axis_vector_for_operation_normal, Plane=operation_zero_plane)
number_slider = Slider(1.1, range=0..10)
outer_curves_for_pocket = Curve(simplify(sort_srf_to_crv.outside_curves_2))
outlines = Curve(mshadow)
brep_to_mill_2 = Brep(clean)
bbox = BoundingBox(Content=outlines, Plane=PlaneXY(0, 0, 0), UnionBox=False)  # -> Box, Box_2
division_2 = Division(A=bit_diameter_3, B=Slider(1, range=0..10))
cir_2 = Circle(Plane=PlaneXY(0, 0, 0), Radius=1)
z_axis_vector_for_operation_normal_2 = Vector(z_axis_vector_for_operation_normal)
area = Area(Geometry=bbox.Box)  # -> Area, Centroid
offset_distance = Panel(division_2)
operation_zero_plane_5 = Plane(operation_zero_plane)
sort = SortList(Keys=area.Area, ValuesA=outlines)  # -> Keys, ValuesA
flip_2 = FlipCurve(Curve=outer_curves_for_pocket, Guide=cir_2)  # -> Curve, Flag
rev = ReverseList(List=sort.ValuesA)
dogbone_angle_threshold = Panel("100")
cull_i = CullIndex(List=rev, Indices=0, Wrap=True)
item = ListItem(List=rev, Index=0, Wrap=True)
operation_zero_plane_6 = Plane(operation_zero_plane)
flip_3 = FlipCurve(Curve=cull_i, Guide=flip.Curve)  # -> Curve, Flag
flip_4 = FlipCurve(Curve=item, Guide=cir)  # -> Curve, Flag
mesh_2 = MeshBrep(
    Brep=brep_to_mill_2,
    Settings={GridMaxCount=0, GridMinCount=16, JaggedSeams=False, MaxEdgeLength=0, MinEdgeLength=0.0001, MinTolerance=0, Refine=True, RefineAngle=0, RelativeTolerance=0.65, SimplePlanes=True, Tolerance=0})
explode = Explode(Curve=flip_2.Curve, Recursive=True)  # -> Segments, Vertices
division_3 = Division(A=bit_diameter_3, B=2)
outside_curves = Curve(flip_4.Curve)
crv = Curve(outside_curves)
flip_5 = FlipCurve(Curve=crv)  # -> Curve, Flag
mjoin = MeshJoin(Meshes=flatten(mesh_2))
disc = Discontinuity(Curve=crv, Level=1)  # -> Points, Parameters
inside_curves = Curve(flip_3.Curve)
offset = OffsetCurve(Curve=explode.Segments, Distance=offset_distance, Plane=operation_zero_plane_6, Corners=1)
offset_2 = OffsetCurve(Curve=explode.Segments, Distance=division_3, Plane=operation_zero_plane_6, Corners=1)
shift = ShiftList(List=disc.Points, Shift=1, Wrap=True)
shift_2 = ShiftList(List=disc.Points, Shift=1, Wrap=True)
polyoffset = PolylineOffset(
    Polylines=outside_curves,
    Distance=addition,
    Plane=Plane(origin=(0, 0, 0), x=(0, 0, 0), y=(0, 0, 0)),
    Tolerance=tolerance_3,
    ClosedFillet=0,
    OpenFillet=1,
    Miter=2)  # -> Contour, Holes
polyoffset_2 = PolylineOffset(
    Polylines=inside_curves,
    Distance=addition,
    Plane=Plane(origin=(0, 0, 0), x=(0, 0, 0), y=(0, 0, 0)),
    Tolerance=tolerance_3,
    ClosedFillet=0,
    OpenFillet=1,
    Miter=2)  # -> Contour, Holes
subtraction = Subtraction(A="180", B=dogbone_angle_threshold)
vec2pt = Vector2Pt(PointA=disc.Points, PointB=shift, Unitize=False)  # -> Vector, Length
subtraction_2 = Subtraction(A="360", B=subtraction)
end = EndPoints(Curve=offset)  # -> Start, End; disabled
curvepoint = PointOnCurve(offset_2, parameter=0.5)
end_2 = EndPoints(Curve=polyoffset.Holes)  # -> Start, End
null = NullItem(Item=offset)  # -> NullFlags, InvalidFlags, Description
shift_3 = ShiftList(List=vec2pt.Vector, Shift=1, Wrap=True)
redpline_2 = Reduce(Polyline=polyoffset_2.Holes, Tolerance=tolerance_3)  # -> Polyline, Reduction
redpline_3 = Reduce(Polyline=polyoffset.Contour, Tolerance=tolerance_3)  # -> Polyline, Reduction
merge = Merge(Data1=end.Start, Data2=end.End)  # disabled
z_axis_vector_for_operation_normal_3 = Vector(z_axis_vector_for_operation_normal)
vdis = VectorDisplay(Anchor=disc.Points, Vector=vec2pt.Vector)
incurve = PointInCurve(Point=end_2.Start, Curve=outside_curves)  # -> Relationship, Point
angle_2 = Angle(VectorA=vec2pt.Vector, VectorB=shift_3, Plane=operation_zero_plane_4)  # -> Angle, Reflex
brepinc = PointInBrep(Brep=brep_to_mill_2, Point=merge, Strict=False)  # disabled
pl = PlaneNormal(Origin=curvepoint, ZAxis=z_axis_vector_for_operation_normal_3)
bool = Boolean(incurve.Relationship)
deg_2 = Degrees(Radians=angle_2.Angle)
avr = Average(Input=brepinc)  # disabled
dispatch_5 = Dispatch(List=polyoffset.Holes, DispatchPattern=bool)  # -> ListA, ListB
smaller_3 = SmallerThan(FirstNumber=deg_2, SecondNumber=subtraction)  # -> SmallerThan, OrEqualTo
bool_2 = Boolean(avr)  # disabled
larger = LargerThan(FirstNumber=deg_2, SecondNumber=subtraction_2)  # -> LargerThan, OrEqualTo
redpline_4 = Reduce(Polyline=dispatch_5.ListB, Tolerance=tolerance_3)  # -> Polyline, Reduction
or = GateOr(A=smaller_3.SmallerThan, B=larger.LargerThan)
dispatch_6 = Dispatch(List=shift_2, DispatchPattern=or)  # -> ListA, ListB
flip_6 = FlipCurve(Curve=redpline_3.Polyline, Guide=filter_3)  # -> Curve, Flag
flip_7 = FlipCurve(Curve=redpline_4.Polyline, Guide=filter_2)  # -> Curve, Flag
flip_8 = FlipCurve(Curve=redpline_2.Polyline, Guide=filter_2)  # -> Curve, Flag
pt = Point(dispatch_6.ListB)
simplify_2 = SimplifyTree(Tree=flip_6.Curve, Front=False)
simplify_3 = SimplifyTree(Tree=flip_7.Curve, Front=False)
simplify_4 = SimplifyTree(Tree=flip_8.Curve, Front=False)
Z = UnitZ(Factor=-8)
merge_2 = Merge(Data1=simplify_4, Data2=simplify_3, Data3=simplify_2)
cutout_passes = Curve(merge_2)
move = Move(Geometry=cutout_passes, Motion=Z)  # -> Geometry, Transform
tolerance_5 = Panel(tolerance_4)
neg = Negative(Value=tolerance_5)
z_axis_vector_for_operation_normal_4 = Vector(z_axis_vector_for_operation_normal)
brep_to_mill_3 = Brep(brep_to_mill_2)
tolerance_6 = Panel(tolerance_4)
allowence_offset_2 = Panel("0")
addition_2 = Addition(A=allowence_offset_2, B=tolerance_6)
cleanup_pass_width_factor = Panel("0.25")
stepover = Panel("0.8")
bit_diameter_4 = Panel(bit_diameter_3)
tolerance_7 = Panel(tolerance_4)
allowence_offset_3 = Panel(addition_2)
multiplication = Multiplication(A=bit_diameter_4, B=stepover)
multiplication_2 = Multiplication(A=bit_diameter_4, B=cleanup_pass_width_factor)
division_4 = Division(A=bit_diameter_4, B=2)
subtraction_3 = Subtraction(A=division_4, B=allowence_offset_3)
cleanup_pass_width = Panel(multiplication_2)
operation_zero_plane_7 = Plane(operation_zero_plane)
toggle = BooleanToggle(False)
stepover_distance = Panel(multiplication)
z_axis_vector_for_operation_normal_5 = Vector(z_axis_vector_for_operation_normal)
subtraction_4 = Subtraction(A="1", B=toggle)
amp = Amplitude(Vector=z_axis_vector_for_operation_normal_5, Amplitude="2")
amp_2 = Amplitude(Vector=z_axis_vector_for_operation_normal_5, Amplitude="-1")
multiplication_3 = Multiplication(A="0.01", B=2)
neg_2 = Negative(Value="0.01")
tolerance_8 = Panel(tolerance_4)
max_raster_connectiction_length_factor = Panel(Slider(1.5, range=0..10))
stepover_distance_2 = Panel(stepover_distance)
cleanup_pass_width_2 = Panel(multiplication_2)
multiplication_4 = Multiplication(A=cleanup_pass_width_2, B=max_raster_connectiction_length_factor)
multiplication_5 = Multiplication(A=stepover_distance_2, B=max_raster_connectiction_length_factor)
len = Length()
larger_2 = LargerThan(FirstNumber=len, SecondNumber=0)  # -> LargerThan, OrEqualTo
and = GateAnd(B=larger_2.LargerThan)
max_raster_to_cleanup_pass_connection_di = Panel(multiplication_4)  # "Max raster to cleanup pass connection distance"

margin = Panel("20")
margin_2 = Panel("0.001")
multiplication_6 = Multiplication(A=bit_diameter_3, B=margin_2)
multiplication_7 = Multiplication(A=bit_diameter_3, B=margin)
pt_2 = ConstructPoint(XCoordinate=0, YCoordinate=0, ZCoordinate=multiplication_6)
subtraction_5 = Subtraction(A=bit_diameter_3, B=multiplication_6)
xy_2 = XYPlane(Origin=Point(0, 0, 0))
xy_3 = XYPlane(Origin=pt_2)
multiplication_8 = Multiplication(A=subtraction_5, B=0.5)

amp_3 = Amplitude(Vector=z_axis_vector_for_operation_normal_2, Amplitude=multiplication_6)
move_2 = Move(Geometry=operation_zero_plane_5, Motion=amp_3)  # -> Geometry, Transform

cyl = Cylinder(Base=move_2.Geometry, Radius=multiplication_8, Length=multiplication_7)
cap = CapHoles(Brep=cyl)
mesh_3 = MeshBrep(
    Brep=cap,
    Settings={GridMaxCount=0, GridMinCount=16, JaggedSeams=False, MaxEdgeLength=0, MinEdgeLength=0.0001, MinTolerance=0, Refine=True, RefineAngle=0, RelativeTolerance=0.65, SimplePlanes=True, Tolerance=0})

orient = Orient(Geometry=mesh_3, Source=operation_zero_plane_5, Target=pl)  # -> Geometry, Transform
colom = CollisionOneMany(Collider=orient.Geometry, Obstacles=mjoin)  # -> Collision, Index
or_2 = GateOr(A=null.NullFlags, C=colom.Collision)
dispatch_7 = Dispatch(List=orient.Geometry, DispatchPattern=colom.Collision)  # -> ListA, ListB; disabled
match = MatchTree(Tree=graft(explode.Segments), Guide=or_2)
mesh_4 = Mesh(dispatch_7.ListA)  # disabled
p_n_c = PickNChoose(Pattern=or_2, Stream0=offset, Stream1=match)
curves_for_join = Curve(p_n_c)
pshift_2 = ShiftPaths(Data=curves_for_join, Offset=-1)
shift_4 = ShiftList(List=pshift_2, Shift=1, Wrap=True)
end_3 = EndPoints(Curve=shift_4)  # -> Start, End
end_4 = EndPoints(Curve=pshift_2)  # -> Start, End
ln = Line(StartPoint=end_4.End, EndPoint=end_3.Start)
match_2 = MatchTree(Tree=pshift_2, Guide=ln)
merge_3 = Merge(Data1=match_2, Data2=ln)
join_2 = JoinCurves(Curves=merge_3, Preserve=False)
simplify_5 = SimplifyTree(Tree=join_2, Front=False)

# ---- group: Extra boundary surface needed to clean up
boundary = BoundarySurfaces(Edges=simplify_5)

# ----
offset_3 = OffsetCurve(Curve=boundary, Distance=neg, Plane=PlaneXY(0, 0, 0), Corners=1)
boundary_2 = BoundarySurfaces(Edges=offset_3)
pocket_surfaces = Surface(boundary_2)
crv_2 = Curve(ln)
len_2 = Length(Curve=crv_2)
margin_from_bit_size = Panel(multiplication_6)
pocket_surfaces_2 = Surface(pocket_surfaces)
amp_4 = Amplitude(Vector=z_axis_vector_for_operation_normal_4, Amplitude=margin_from_bit_size)
move_3 = Move(Geometry=pocket_surfaces_2, Motion=amp_4)  # -> Geometry, Transform

# ---- group: removes some inside pockets if pre offset is not used
trim = TrimSolid(Shape=move_3.Geometry, Cutters=brep_to_mill_3)

# ----
rev_2 = Reverse(Vector=amp_4)
move_4 = Move(Geometry=trim, Motion=rev_2)  # -> Geometry, Transform
pocket_surfaces_3 = Surface(simplify(move_4.Geometry))
pocket_surfaces_4 = Surface(pocket_surfaces_3)
wires_2 = BrepWireframe(Brep=pocket_surfaces_4, Density=-1)
join_3 = JoinCurves(Curves=wires_2, Preserve=False)
simplify_6 = SimplifyTree(Tree=join_3, Front=False)
topoly_2 = CurveToPolyline(Curve=simplify_6, ToleranceDistance=tolerance_7, ToleranceAngle=0)  # -> Polyline, Segments
bbox_2 = BoundingBox(Content=simplify_6, Plane=PlaneXY(0, 0, 0), UnionBox=False)  # -> Box, Box_2
area_2 = Area(Geometry=bbox_2.Box)  # -> Area, Centroid
polyoffset_3 = PolylineOffset(
    Polylines=topoly_2.Polyline,
    Distance=subtraction_3,
    Plane=Plane(origin=(0, 0, 0), x=(0, 0, 0), y=(0, 0, 0)),
    Tolerance=allowence_offset_3,
    ClosedFillet=0,
    OpenFillet=1,
    Miter=2)  # -> Contour, Holes
sort_2 = SortList(Keys=area_2.Area, ValuesA=simplify_6)  # -> Keys, ValuesA
merge_4 = Merge(Data1=polyoffset_3.Contour, Data2=polyoffset_3.Holes)
rev_3 = ReverseList(List=sort_2.ValuesA)
simplify_7 = SimplifyTree(Tree=merge_4, Front=False)
cull_i_2 = CullIndex(List=rev_3, Indices=0, Wrap=True)
item_2 = ListItem(List=rev_3, Index=0, Wrap=True)
end_5 = EndPoints(Curve=simplify_7)  # -> Start, End
outside_curves_2 = Curve(simplify(item_2))
inside_curves_2 = Curve(simplify(cull_i_2))
simplify_8 = SimplifyTree(Tree=end_5.Start, Front=False)
incurve_2 = PointInCurve(Point=simplify_8, Curve=outside_curves_2)  # -> Relationship, Point
incurve_3 = PointInCurve(Point=simplify_8, Curve=inside_curves_2)  # -> Relationship, Point
bool_3 = Boolean(incurve_2.Relationship)
bool_4 = Boolean(incurve_3.Relationship)
subtraction_6 = Subtraction(A="1", B=bool_4)
and_2 = GateAnd(A=bool_3, B=subtraction_6)
dispatch_8 = Dispatch(List=simplify_7, DispatchPattern=and_2)  # -> ListA, ListB
simplify_9 = SimplifyTree(Tree=dispatch_8.ListA, Front=False)
redpline_5 = Reduce(Polyline=simplify_9, Tolerance=tolerance_7)  # -> Polyline, Reduction
cleanup_pass = Curve(redpline_5.Polyline)
bbox_3 = BoundingBox(Content=cleanup_pass, Plane=PlaneXY(0, 0, 0), UnionBox=False)  # -> Box, Box_2
area_3 = Area(Geometry=bbox_3.Box)  # -> Area, Centroid
polyoffset_4 = PolylineOffset(
    Polylines=cleanup_pass,
    Distance=cleanup_pass_width,
    Plane=Plane(origin=(0, 0, 0), x=(0, 0, 0), y=(0, 0, 0)),
    Tolerance=allowence_offset_3,
    ClosedFillet=0,
    OpenFillet=1,
    Miter=2)  # -> Contour, Holes
sort_3 = SortList(Keys=area_3.Area, ValuesA=cleanup_pass)  # -> Keys, ValuesA
merge_5 = Merge(Data1=polyoffset_4.Contour, Data2=polyoffset_4.Holes)
rev_4 = ReverseList(List=sort_3.ValuesA)
simplify_10 = SimplifyTree(Tree=merge_5, Front=False)
cull_i_3 = CullIndex(List=rev_4, Indices=0, Wrap=True)
item_3 = ListItem(List=rev_4, Index=0, Wrap=True)
end_6 = EndPoints(Curve=simplify_10)  # -> Start, End
outside_curves_3 = Curve(simplify(item_3))
inside_curves_3 = Curve(simplify(cull_i_3))
simplify_11 = SimplifyTree(Tree=end_6.Start, Front=False)
incurve_4 = PointInCurve(Point=simplify_11, Curve=outside_curves_3)  # -> Relationship, Point
incurve_5 = PointInCurve(Point=simplify_11, Curve=inside_curves_3)  # -> Relationship, Point
bool_5 = Boolean(incurve_4.Relationship)
bool_6 = Boolean(incurve_5.Relationship)
subtraction_7 = Subtraction(A="1", B=bool_6)
and_3 = GateAnd(A=bool_5, B=subtraction_7)
dispatch_9 = Dispatch(List=simplify_10, DispatchPattern=and_3)  # -> ListA, ListB
redpline_6 = Reduce(Polyline=dispatch_9.ListA, Tolerance=tolerance_7)  # -> Polyline, Reduction
raster_lines_boundary_curves = Curve(redpline_6.Polyline)
boundary_3 = BoundarySurfaces(Edges=raster_lines_boundary_curves)
bbox_4 = BoundingBox(Content=boundary_3, Plane=operation_zero_plane_7)  # -> Box, Box_2
wires_3 = BrepWireframe(Brep=bbox_4.Box, Density=-1)
item_4 = ListItem(List=wires_3, Index=subtraction_4, Wrap=True)
item_5 = ListItem(List=wires_3, Index=toggle, Wrap=True)
len_3 = Length(Curve=item_4)
subtraction_8 = Subtraction(A=len_3, B=multiplication_3)
division_5 = Division(A=subtraction_8, B=stepover_distance)
round = Round(Number=division_5)  # -> Nearest, Floor, Ceiling
subtraction_9 = Subtraction(A=round.Ceiling, B="1")
extr = Extrude(Base=boundary_3, Direction=amp)
division_6 = Division(A=subtraction_8, B=round.Ceiling)
end_7 = EndPoints(Curve=item_4)  # -> Start, End
addition_3 = Addition(A=round.Ceiling, B="1")
ext = ExtendCurve(Curve=item_5, Type=0, Start=neg_2, End=neg_2)
move_5 = Move(Geometry=extr, Motion=amp_2)  # -> Geometry, Transform
vec2pt_2 = Vector2Pt(PointA=end_7.Start, PointB=end_7.End, Unitize=False)  # -> Vector, Length
series = Series(Start=0, Step=division_6, Count=addition_3)
rev_5 = Reverse(Vector=vec2pt_2.Vector)
addition_4 = Addition(A=series, B="0.01")
filter_4 = StreamFilter(Gate=toggle, Stream0=vec2pt_2.Vector, Stream1=rev_5)
amp_5 = Amplitude(Vector=filter_4, Amplitude=addition_4)
move_6 = Move(Geometry=ext, Motion=amp_5)  # -> Geometry, Transform
simplify_12 = SimplifyTree(Tree=move_6.Geometry, Front=False)
simplify_13 = SimplifyTree(Tree=move_5.Geometry, Front=False)
tstat = TreeStatistics(Tree=simplify_12)  # -> Paths, Length, Count
item_6 = ListItem(List=tstat.Paths, Index=0, Wrap=True)

# ----
# Got stuck trying to make trim operations of raster lines work when an object has two or more pockets
pshift_3 = ShiftPaths(Data=simplify_13, Offset=-1)
item_7 = ListItem(List=flatten(pshift_3), Index=0, Wrap=True)
null_2 = NullItem(Item=item_7)  # -> NullFlags, InvalidFlags, Description
graft = GraftTree(Tree=simplify_13, IncludeEmptyLists=True, IncludeNullItems=True)
filter_5 = StreamFilter(Gate=null_2.NullFlags, Stream0=simplify_13, Stream1=graft)

split = TextSplit(Text=item_6, Separators=";")
lng = ListLength(List=split)
pshift_4 = ShiftPaths(Data=simplify_12, Offset=-1)
larger_3 = LargerThan(FirstNumber=lng, SecondNumber="2")  # -> LargerThan, OrEqualTo
filter_6 = StreamFilter(Gate=larger_3.LargerThan, Stream0=simplify_12, Stream1=pshift_4)
trim_2 = TrimWithBrep(Curve=filter_6, Brep=filter_5)  # -> Inside, Outside
len_4 = Length(Curve=trim_2.Inside)
smaller_4 = SmallerThan(FirstNumber=len_4, SecondNumber=tolerance_8)  # -> SmallerThan, OrEqualTo
dispatch_10 = Dispatch(List=trim_2.Inside, DispatchPattern=smaller_4.SmallerThan)  # -> ListA, ListB
raster_lines = Curve(dispatch_10.ListB)
cull_i_4 = CullIndex(List=raster_lines, Indices="0", Wrap=True)
pshift_5 = ShiftPaths(Data=cull_i_4, Offset=-1)
item_8 = ListItem(List=raster_lines, Index=0, Wrap=True)
pshift_6 = ShiftPaths(Data=pshift_5, Offset=-1)
pshift_7 = ShiftPaths(Data=item_8, Offset=-1)
dispatch_11 = Dispatch(List=pshift_6, DispatchPattern=[True, False])  # -> ListA, ListB
dispatch_12 = Dispatch(List=pshift_7, DispatchPattern=[True, False])  # -> ListA, ListB
lng_2 = ListLength(List=dispatch_11.ListA)
lng_3 = ListLength(List=dispatch_11.ListB)
lng_4 = ListLength(List=dispatch_12.ListA)
lng_5 = ListLength(List=dispatch_12.ListB)
subtraction_10 = Subtraction(A=lng_2, B=lng_3)
subtraction_11 = Subtraction(A=lng_4, B=lng_5)
lng_6 = ListLength(List=dispatch_11.ListA)
lng_7 = ListLength(List=dispatch_11.ListB)
lng_8 = ListLength(List=dispatch_12.ListA)
lng_9 = ListLength(List=dispatch_12.ListB)
not = GateNot(A=subtraction_10)
not_2 = GateNot(A=subtraction_11)
subtraction_12 = Subtraction(A=lng_6, B=lng_7)
subtraction_13 = Subtraction(A=lng_8, B=lng_9)
neg_3 = Negative(Value=not)
neg_4 = Negative(Value=not_2)
neg_5 = Negative(Value=subtraction_12)
neg_6 = Negative(Value=subtraction_13)
shift_5 = ShiftList(List=dispatch_11.ListA, Shift=1, Wrap=False)
shift_6 = ShiftList(List=dispatch_11.ListB, Shift=neg_3, Wrap=False)
shift_7 = ShiftList(List=dispatch_12.ListA, Shift=1, Wrap=False)
shift_8 = ShiftList(List=dispatch_12.ListB, Shift=neg_4, Wrap=False)
shift_9 = ShiftList(List=dispatch_11.ListA, Shift=neg_5, Wrap=False)
shift_10 = ShiftList(List=dispatch_12.ListA, Shift=neg_6, Wrap=False)
end_8 = EndPoints(Curve=dispatch_11.ListB)  # -> Start, End
end_9 = EndPoints(Curve=shift_6)  # -> Start, End
end_10 = EndPoints(Curve=shift_9)  # -> Start, End
end_11 = EndPoints(Curve=shift_5)  # -> Start, End
end_12 = EndPoints(Curve=dispatch_12.ListB)  # -> Start, End
end_13 = EndPoints(Curve=shift_8)  # -> Start, End
end_14 = EndPoints(Curve=shift_10)  # -> Start, End
end_15 = EndPoints(Curve=shift_7)  # -> Start, End
ln_2 = Line(StartPoint=end_10.End, EndPoint=end_8.End)
ln_3 = Line(StartPoint=end_9.Start, EndPoint=end_11.Start)
ln_4 = Line(StartPoint=end_14.End, EndPoint=end_12.End)
ln_5 = Line(StartPoint=end_13.Start, EndPoint=end_15.Start)
weave = Weave(Pattern=[0, 1], Stream0=ln_2, Stream1=ln_3, NullGaps=False)
weave_2 = Weave(Pattern=[0, 1], Stream0=ln_4, Stream1=ln_5, NullGaps=False)
len_5 = Length(Curve=weave)
len_6 = Length(Curve=weave_2)
larger_4 = LargerThan(FirstNumber=len_5, SecondNumber=multiplication_5)  # -> LargerThan, OrEqualTo
larger_5 = LargerThan(FirstNumber=len_6, SecondNumber=multiplication_5)  # -> LargerThan, OrEqualTo
cleanup_pass_2 = Curve(cleanup_pass)
cleanup_pass_3 = Curve(cleanup_pass)
dispatch_13 = Dispatch(List=weave, DispatchPattern=larger_4.LargerThan)  # -> ListA, ListB
dispatch_14 = Dispatch(List=weave_2, DispatchPattern=larger_5.LargerThan)  # -> ListA, ListB
colom_2 = CollisionOneMany(Collider=dispatch_13.ListA, Obstacles=cleanup_pass_2)  # -> Collision, Index
colom_3 = CollisionOneMany(Collider=dispatch_14.ListA, Obstacles=cleanup_pass_3)  # -> Collision, Index
dispatch_15 = Dispatch(List=dispatch_13.ListA, DispatchPattern=colom_2.Collision)  # -> ListA, ListB
dispatch_16 = Dispatch(List=dispatch_14.ListA, DispatchPattern=colom_3.Collision)  # -> ListA, ListB
simplify_14 = SimplifyTree(Tree=dispatch_13.ListB, Front=False)
simplify_15 = SimplifyTree(Tree=pshift_6, Front=False)
simplify_16 = SimplifyTree(Tree=dispatch_15.ListB, Front=False)
simplify_17 = SimplifyTree(Tree=dispatch_14.ListB, Front=False)
simplify_18 = SimplifyTree(Tree=pshift_7, Front=False)
simplify_19 = SimplifyTree(Tree=dispatch_16.ListB, Front=False)
merge_6 = Merge(Data1=simplify_15, Data2=simplify_14, Data3=simplify_16)
merge_7 = Merge(Data1=simplify_18, Data2=simplify_17, Data3=simplify_19)
join_4 = JoinCurves(Curves=merge_6, Preserve=False)
join_5 = JoinCurves(Curves=merge_7, Preserve=False)
merge_8 = Merge(Data1=join_5, Data2=join_4)
raster_toolpath = Curve(merge_8)
cleanup_pass_4 = Curve(cleanup_pass)
pshift_8 = ShiftPaths(Data=raster_toolpath, Offset=-1)
rev_6 = ReverseList(List=pshift_8)
item_9 = ListItem(List=cleanup_pass_4, Index=0, Wrap=True)
cull_i_5 = CullIndex(List=cleanup_pass_4, Indices=0, Wrap=True)
item_10 = ListItem(List=rev_6, Index=0, Wrap=True)
cull_i_6 = CullIndex(List=rev_6, Indices=0, Wrap=True)
end_16 = EndPoints(Curve=item_10)  # -> Start, End
crv_cp = CurveClosestPoint(Point=end_16.End, Curve=item_9)  # -> Point, Parameter, Distance
nullrep = ReplaceNulls(Items=crv_cp.Parameter, Replacements="0")  # -> Items, Count
simplify_20 = SimplifyTree(Tree=cull_i_5, Front=False)
rev_7 = ReverseList(List=cull_i_6)
seam = Seam(Curve=item_9, Seam=nullrep.Items)
# fix tree structure when one brep?
merge_9 = Merge(Data1=seam, Data2=simplify_20)
ln_6 = Line(StartPoint=end_16.End, EndPoint=crv_cp.Point)
dist = Distance(PointA=end_16.End, PointB=crv_cp.Point)
larger_6 = LargerThan(FirstNumber=dist, SecondNumber=max_raster_to_cleanup_pass_connection_di)  # -> LargerThan, OrEqualTo
dispatch_17 = Dispatch(List=ln_6, DispatchPattern=larger_6.LargerThan)  # -> ListA, ListB
crv_3 = Curve(dispatch_17.ListB)
merge_10 = Merge(Data1=item_10, Data2=crv_3)
join_6 = JoinCurves(Curves=merge_10, Preserve=False)
merge_11 = Merge(Data1=rev_7, Data2=join_6)
merge_12 = Merge(Data1=simplify(merge_11), Data2=simplify(merge_9))
pocket_toolpaths = Curve(merge_12)

pocket_surfaces_5 = Surface(pocket_surfaces)
outer_curves_for_pocket_2 = Curve(outer_curves_for_pocket)
disc_2 = Discontinuity(Curve=simplify(pocket_surfaces_5), Level=1)  # -> Points, Parameters
disc_3 = Discontinuity(Curve=outer_curves_for_pocket_2, Level=1)  # -> Points, Parameters
pshift_9 = ShiftPaths(Data=disc_2.Points, Offset=-1)

larger_7 = LargerThan(FirstNumber=len_2, SecondNumber="0.1")  # -> LargerThan, OrEqualTo
dispatch_18 = Dispatch(List=crv_2, DispatchPattern=larger_7.LargerThan)  # -> ListA, ListB
disc_4 = Discontinuity(Curve=dispatch_18.ListA, Level=1)  # -> Points, Parameters
flatten = FlattenTree(Tree=disc_4.Points, Path="{0}")
cp_2 = ClosestPoint(Point=disc_3.Points, Cloud=flatten)  # -> ClosestPoint, CPIndex, Distance
larger_8 = LargerThan(FirstNumber=cp_2.Distance, SecondNumber="0.1")  # -> LargerThan, OrEqualTo
dispatch_19 = Dispatch(List=disc_3.Points, DispatchPattern=larger_8.LargerThan)  # -> ListA, ListB
points_away_from_moved_edges = Point(dispatch_19.ListA)

cp_3 = ClosestPoint(Point=points_away_from_moved_edges, Cloud=pshift_9)  # -> ClosestPoint, CPIndex, Distance
larger_9 = LargerThan(FirstNumber=cp_3.Distance, SecondNumber="0.1")  # -> LargerThan, OrEqualTo
dispatch_20 = Dispatch(List=points_away_from_moved_edges, DispatchPattern=larger_9.LargerThan)  # -> ListA, ListB
points_for_dogbone_detection = Point(dispatch_20.ListB)

# ==== cluster SortSrfToCrv
srf = ClusterInput()
srf_2 = Surface(srf)
wires = BrepWireframe(Brep=srf_2, Density=-1)
join = JoinCurves(Curves=wires, Preserve=False)
bbox = BoundingBox(Content=join, Plane=PlaneXY(0, 0, 0), UnionBox=False)  # -> Box, Box_2
area = Area(Geometry=bbox.Box)  # -> Area, Centroid
sort = SortList(Keys=area.Area, ValuesA=join)  # -> Keys, ValuesA
rev = ReverseList(List=sort.ValuesA)
cull_i = CullIndex(List=rev, Indices=0, Wrap=True)
item = ListItem(List=rev, Index=0, Wrap=True)
outside_curves = Curve(item)
inside_curves = Curve(cull_i)
inside_curves_2 = ClusterOutput(inside_curves)
outside_curves_2 = ClusterOutput(outside_curves)
