# Grasshopper definition bark brain - next gen autosettings dev.gh (Grasshopper 1.0.7)

material_to_cut = ValueList({"MDF": "mdf", "Wood": "wood", "Hardwood": "hardwood", "Foam or wax": "foam_or_wax", "Plastic - roughing": "plastic_roughing", "Plastic - finishing": "plastic_finishing", "Aluminum - roughing": "aluminum_roughing", "Aluminum - finishing": "aluminum_finishing", "Steel - roughing": "steel_roughing", "Steel - finishing": "steel_finishing"}, selected="MDF")
# Bark brain repo:
# https://github.com/leomcelroy/bark-brain/blob/master/calculator.py
number_slider = Slider(6, range=0..50)
# Code change1 (change inputs python object inputs by commenting out):: def calculateSettings(
#   input,
#   plungRateReductionFactor = 0.6,
#   presets6mm = PRESETS_6MM,
#   presetDiameter = 6,
# ):
# #  materialToCut = input["materialToCut"]
# #  millingBitDiameter = input["millingBitDiameter"]
# #  numberOfFlutes = input["numberOfFlutes"]
# #  rpm = input["rpm"]
# #  stiffness = input["stiffness"]
# Code change2 (change variable names to previous inputs and comment out redundant inputs):: def adjust(input):
#   material = materialToCut
#   bitDiameter = millingBitDiameter
#   flutes = numberOfFlutes
# #  rpm = input["rpm"]
# #  stiffness = input["stiffness"]
number_slider_2 = Slider(1500, range=0..10000)
bark_brain = GhPythonScript(
    materialToCut=material_to_cut,
    millingBitDiameter=number_slider,
    numberOfFlutes=Slider(1, range=1..5),
    rpm=Slider(18000, range=100..24000),
    stiffness=number_slider_2)  # -> out
# ---------- bark_brain: Python ----------
__author__ = "Jens"
__version__ = "2021.05.12"

import rhinoscriptsyntax as rs

BIT_CHOICE = {
  "mdf": {
    "2": {
      "diameter": 2,
      "type": "down-cut"
    },
    "3": {
      "diameter": 2,
      "type": "down-cut"
    },
    "4": {
      "diameter": 3,
      "type": "down-cut"
    },
    "6": {
      "diameter": 3,
      "type": "up-cut"
    },
    "7": {
      "diameter": 3,
      "type": "up-cut"
    },
    "8": {
      "diameter": 3,
      "type": "up-cut"
    },
    "10": {
      "diameter": 3,
      "type": "up-cut"
    },
    "12": {
      "diameter": 4,
      "type": "up-cut"
    },
    "15": {
      "diameter": 4,
      "type": "up-cut"
    },
    "16": {
      "diameter": 6,
      "type": "up-cut"
    },
    "18": {
      "diameter": 6,
      "type": "up-cut"
    },
    "20": {
      "diameter": 8,
      "type": "up-cut"
    },
    "25": {
      "diameter": 8,
      "type": "up-cut"
    },
    "30": {
      "diameter": 10,
      "type": "up-cut"
    },
    "40": {
      "diameter": 12,
      "type": "up-cut"
    },
  },
  "plywood": {
    "2": {
      "diameter": 2,
      "type": "up-cut"
    },
    "3": {
      "diameter": 2,
      "type": "up-cut"
    },
    "4": {
      "diameter": 3,
      "type": "compression"
    },
    "6": {
      "diameter": 3,
      "type": "compression"
    },
    "8": {
      "diameter": 3,
      "type": "compression"
    },
    "10": {
      "diameter": 3,
      "type": "compression"
    },
    "12": {
      "diameter": 4,
      "type": "compression"
    },
    "15": {
      "diameter": 4,
      "type": "compression"
    },
    "16": {
      "diameter": 6,
      "type": "compression"
    },
    "18": {
      "diameter": 6,
      "type": "compression"
    },
    "20": {
      "diameter": 8,
      "type": "compression"
    },
    "25": {
      "diameter": 8,
      "type": "compression"
    },
    "30": {
      "diameter": 10,
      "type": "compression"
    },
    "40": {
      "diameter": 12,
      "type": "compression"
    },
  },
  "plastic": {
    "2": {
      "diameter": 2,
      "type": "down-cut"
    },
    "3": {
      "diameter": 2,
      "type": "up-cut"
    },
    "4": {
      "diameter": 3,
      "type": "up-cut"
    },
    "6": {
      "diameter": 4,
      "type": "up-cut"
    },
    "8": {
      "diameter": 4,
      "type": "up-cut"
    },
    "10": {
      "diameter": 4,
      "type": "up-cut"
    },
    "12": {
      "diameter": 6,
      "type": "up-cut"
    },
    "15": {
      "diameter": 6,
      "type": "up-cut"
    },
    "16": {
      "diameter": 8,
      "type": "up-cut"
    },
    "18": {
      "diameter": 8,
      "type": "up-cut"
    },
    "20": {
      "diameter": 10,
      "type": "up-cut"
    },
    "25": {
      "diameter": 12,
      "type": "up-cut"
    },
    "30": {
      "diameter": 14,
      "type": "up-cut"
    },
    "40": {
      "diameter": 16,
      "type": "up-cut"
    },
  },
  "aluminum": {
    "2": {
      "diameter": 2,
      "type": "up-cut"
    },
    "3": {
      "diameter": 2,
      "type": "up-cut"
    },
    "4": {
      "diameter": 3,
      "type": "up-cut"
    },
    "6": {
      "diameter": 4,
      "type": "up-cut"
    },
    "8": {
      "diameter": 6,
      "type": "up-cut"
    },
    "10": {
      "diameter": 6,
      "type": "up-cut"
    },
    "12": {
      "diameter": 8,
      "type": "up-cut"
    },
    "15": {
      "diameter": 10,
      "type": "up-cut"
    },
    "16": {
      "diameter": 12,
      "type": "up-cut"
    },
    "18": {
      "diameter": 16,
      "type": "up-cut"
    },
    "20": {
      "diameter": 16,
      "type": "up-cut"
    },
    "25": {
      "diameter": 20,
      "type": "up-cut"
    },
    "30": {
      "diameter": 20,
      "type": "up-cut"
    },
    "40": {
      "diameter": 25,
      "type": "up-cut"
    },
  },
  "steel": {
    "2": {
      "diameter": 3,
      "type": "up-cut"
    },
    "3": {
      "diameter": 4,
      "type": "up-cut"
    },
    "4": {
      "diameter": 4,
      "type": "up-cut"
    },
    "6": {
      "diameter": 6,
      "type": "up-cut"
    },
    "8": {
      "diameter": 8,
      "type": "up-cut"
    },
    "10": {
      "diameter": 10,
      "type": "up-cut"
    },
    "12": {
      "diameter": 12,
      "type": "up-cut"
    },
    "15": {
      "diameter": 16,
      "type": "up-cut"
    },
    "16": {
      "diameter": 16,
      "type": "up-cut"
    },
    "18": {
      "diameter": 20,
      "type": "up-cut"
    },
    "20": {
      "diameter": 20,
      "type": "up-cut"
    },
    "25": {
      "diameter": 25,
      "type": "up-cut"
    },
    "30": {
      "diameter": 30,
      "type": "up-cut"
    },
    "40": {
      "diameter": 40,
      "type": "up-cut"
    },
  }
}


SHOPBOT_STIFFNESS = 1500
PRESETS_6MM = {
  "mdf": {
    "chiploads": 0.25,
    "passdepths": 17,
    "rampAngle": 90,
    "hardness": SHOPBOT_STIFFNESS/3000000 
  },
  "wood": {
    "chiploads": 0.2,
    "passdepths": 16,
    "rampAngle": 90,
    "hardness": SHOPBOT_STIFFNESS/1360000
  },
  "hardwood": {
    "chiploads": 0.133,
    "passdepths": 12,
    "rampAngle": 45,
    "hardness": SHOPBOT_STIFFNESS/347289
  },
  "foam_or_wax": {
    "chiploads": 0.3,
    "passdepths": 19,
    "rampAngle": 90,
    "hardness": SHOPBOT_STIFFNESS/19379999
  },
  "plastic_roughing": {
    "chiploads": 0.15,
    "passdepths": 8, 
    "rampAngle": 18,
    "hardness": SHOPBOT_STIFFNESS/371790
  },
  "plastic_finishing": {
    "chiploads": 0.073,
    "passdepths": 8,
    "rampAngle": 18,
    "hardness": SHOPBOT_STIFFNESS/371790
  },
  "aluminum_roughing": {
    "chiploads": 0.12,
    "passdepths": 1.8,
    "rampAngle": 12,
    "hardness": SHOPBOT_STIFFNESS/20000
  },
  "aluminum_finishing": {
    "chiploads": 0.06,
    "passdepths": 1.8,
    "rampAngle": 12,
    "hardness": SHOPBOT_STIFFNESS/20000

  },
  "steel_roughing": {
    "chiploads": 0.08,
    "passdepths": 0.6,
    "rampAngle": 5,
    "hardness": SHOPBOT_STIFFNESS/2000
  },
  "steel_finishing": {
    "chiploads": 0.04,
    "passdepths": 0.6,
    "rampAngle": 5,
    "hardness": SHOPBOT_STIFFNESS/2000
  }
}

def calculateSettings(
  input, 
  plungRateReductionFactor = 0.6, 
  presets6mm = PRESETS_6MM, 
  presetDiameter = 6,
):
#  materialToCut = input["materialToCut"]
#  millingBitDiameter = input["millingBitDiameter"]
#  numberOfFlutes = input["numberOfFlutes"]
#  rpm = input["rpm"]
#  stiffness = input["stiffness"]

  feedrate = (presets6mm[materialToCut]["chiploads"] * rpm * numberOfFlutes * millingBitDiameter)/presetDiameter
  plungerate = feedrate * plungRateReductionFactor

  fluteReduction = 1-(numberOfFlutes-1)*.15

  preset = presets6mm[materialToCut]["passdepths"]


  passDepth = (preset/presetDiameter*millingBitDiameter)*fluteReduction
  rampAngle = presets6mm[materialToCut]["rampAngle"]

  return {
    "feedrate": feedrate,
    "plungerate": plungerate,
    "passDepth": passDepth,
    "rampAngle": rampAngle
  }

def close(bitChoice, materialThickness):
  counts = [ int(k) for k in bitChoice.keys() ]
  goal = materialThickness

  found = False
  for count in counts:
    if count >= goal and not found:
      found = True
      materialThickness = count

    if goal > counts[len(counts)-1]:
      materialThickness = count

  return materialThickness

def chooseBit(material, materialThickness):
    if material == "wood": 
      material = "plywood"
    elif material == "hardwood": 
      material = "plywood"
    elif material == "plastic_roughing" or material == "plastic_finishing": 
      material = "plastic"
    elif material == "aluminum_roughing" or material == "aluminum_finishing": 
      material = "aluminum"
    elif material == "steel_roughing" or material == "steel_finishing": 
      material = "steel"
    elif material == "foam_or_wax" or material == "mdf": 
      material = "mdf"

    materialThickness = close(BIT_CHOICE[material], materialThickness)
    return BIT_CHOICE[material][str(materialThickness)]


def r(x):
  return round(x, 2)


def adjust(input):
  material = materialToCut
  bitDiameter = millingBitDiameter
  flutes = numberOfFlutes
#  rpm = input["rpm"]
#  stiffness = input["stiffness"]

  default = calculateSettings(input)

  materialRemovalRate = default["feedrate"]*default["passDepth"]*bitDiameter
  hardness = PRESETS_6MM[material]["hardness"]

  
  mrr = stiffness/hardness

  fluteReduction = 1-(flutes-1)*.15
  rpmFactor = 18000/rpm
  maxPassDepth = mrr/default["feedrate"]/bitDiameter*flutes*fluteReduction/rpmFactor

  pd = maxPassDepth if default["passDepth"] > maxPassDepth else default["passDepth"]

  return {
    "feedrate": r(default["feedrate"]),
    "plungerate": r(default["plungerate"]),
    "passDepth": r(pd),
    "rampAngle": default["rampAngle"],
    "type": chooseBit(material, bitDiameter)["type"]
  }

testChooseBit = chooseBit("hardwood", 4)

testSettings = adjust({
  "materialToCut": "hardwood",
  "millingBitDiameter": 3,
  "numberOfFlutes": 1,
  "rpm": 18000,
  "stiffness": 547
})

print(testChooseBit)
print(testSettings)
# ---------- end bark_brain ----------
item = ListItem(List=bark_brain, Index=1, Wrap=True)
item_2 = ListItem(List=bark_brain, Index=0, Wrap=True)
# Code improvment whishlist:
# 
# - Variables to be change could be nice to have in the start of the code
# - alsoe for tuning paramters for stifness etc.
# - Bit suggestor logic is confusing. Unsure how to improve
panel = Panel(", ")
bit_suggestion_not_yet_implemented = Panel(item_2)
split = TextSplit(Text=item, Separators=panel)
item_3 = ListItem(List=flatten(split), Index="1", Wrap=True)
item_4 = ListItem(List=flatten(split), Index="4", Wrap=True)
item_5 = ListItem(List=flatten(split), Index="7", Wrap=True)
item_6 = ListItem(List=flatten(split), Index="10", Wrap=True)
num = Number(item_3)
num_2 = Number(item_4)
num_3 = Number(item_5)
num_4 = Number(item_6)
smaller = SmallerThan(FirstNumber=num_4, SecondNumber=0)  # -> SmallerThan, OrEqualTo
feedrate = Panel(num)
plungerate = Panel(num_2)
pass_depth = Panel(num_3)
ramp_angle = Panel(num_4)
ramp_plunges_boolean = Panel(smaller.SmallerThan)
