# Grasshopper definition Bark beetle - Basic high speed CNC milling.gh (Grasshopper 0.9.76)
# Copyright: none

pipeline = GeometryPipeline(
    GroupByLayer=False,
    GroupByType=False,
    IncludeHidden=True,
    IncludeLocked=True,
    LayerFilter="CNC Engrave",
    NameFilter="*",
    TypeFilter=4)
jograte = Panel("250")
stepover = Panel("0.15")
toolpath_curves = Curve(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)
toolpath_curves_2 = Curve([toolpath_curves, pipeline])
feedrate_calculator = FeedrateCalculator(
    spindle_rpm=18000,
    milling_bit_diameter=6,
    number_of_flutes=1,
    chip_load=0.2,
    max_stepover=stepover,
    ramp_feed_reduction_factor=0.5)  # -> feedrate_4, ramp_feedrate_2, feedback_3
panel = Panel(feedrate_calculator.feedrate_4)
panel_2 = Panel(feedrate_calculator.ramp_feedrate_2)
panel_3 = Panel(feedrate_calculator.feedback_3)
trochoidal_high_speed_milling = TrochoidalHighSpeedMilling(
    toolpath_curves=toolpath_curves_2,
    milling_bit_diameter=6,
    arc_diameter_factor=3,
    stepover=stepover,
    feedrate=panel,
    jograte=jograte,
    ramp_entry_feedrate=panel_2,
    make_helical_entry=True,
    ramp_angle=4,
    jog_z_lift_factor=0.1,
    use_climb_milling=True,
    straight_arc_extensions=True)  # -> toolpaths_3, feedrates_3, feedback_3
toolpaths = Curve(trochoidal_high_speed_milling.toolpaths_3)
panel_4 = Panel(trochoidal_high_speed_milling.feedback_3)
feedrates = Number(trochoidal_high_speed_milling.feedrates_3)
num = Number(jograte)
feedrates_2 = Panel(feedrates)
feedrate = Panel(panel)
jograte_2 = Panel(num)
ramp_feedrate = Panel(panel_2)
toolpaths_2 = Curve(toolpaths)

# ---- group: Make toolpath preview
flatten = FlattenTree(Tree=toolpaths_2, Path="{0}")
flatten_2 = FlattenTree(Tree=feedrates_2, Path="{0}")
mindex = MemberIndex(Set=flatten_2, Member=feedrate)  # -> Index, Count
mindex_2 = MemberIndex(Set=flatten_2, Member=jograte_2)  # -> Index, Count
mindex_3 = MemberIndex(Set=flatten_2, Member=ramp_feedrate)  # -> Index, Count
item = ListItem(List=flatten, Index=mindex.Index, Wrap=True)
item_2 = ListItem(List=flatten, Index=mindex_2.Index, Wrap=True)
item_3 = ListItem(List=flatten, Index=mindex_3.Index, Wrap=True)
preview = CustomPreview(Geometry=item_2, Shader=ColourSwatch(SwatchColor=RGB(89, 64, 47)))
preview_2 = CustomPreview(Geometry=item, Shader=ColourSwatch(SwatchColor=RGB(112, 238, 255)))
preview_3 = CustomPreview(Geometry=item_3, Shader=ColourSwatch(SwatchColor=RGB(0, 88, 99)))

# ----
len = Length(Curve=item_3)
len_2 = Length(Curve=item_2)
len_3 = Length(Curve=item)
ma = MassAddition(Input=len)  # -> Result, PartialResults
ma_2 = MassAddition(Input=len_2)  # -> Result, PartialResults
ma_3 = MassAddition(Input=len_3)  # -> Result, PartialResults
division = Division(A=ma.Result, B=ramp_feedrate)
division_2 = Division(A=ma_2.Result, B=jograte_2)
division_3 = Division(A=ma_3.Result, B=feedrate)
plunge_time = Panel(division)
jog_time = Panel(division_2)
cut_time = Panel(division_3)
acceleration_factor = Panel("2")
multiplication = Multiplication(A=jog_time, B=acceleration_factor)
addition = Addition(A=cut_time, B=multiplication, C=plunge_time)
total_job_time = Panel(addition)
division_4 = Division(A=total_job_time, B="60")
total_job_minutes = Panel(division_4)
estimated_job_time = Number(total_job_minutes)
estimated_job_time_2 = Number(estimated_job_time)

# ==== cluster FeedrateCalculator: Calculates a feedrate matching chipload and rpm. Can take chip thining into account. Input the maxium stepover the tool will encounter. Normal pockets and profiles will have a full stepover of 1, while the Arc Based High speed milling givve constant low stepovers as speciified.
ramp_feed_reduction_factor = ClusterInput()
milling_bit_diameter = ClusterInput()
number_of_flutes = ClusterInput()
spindle_rpm = ClusterInput()
max_stepover = ClusterInput()
chip_load = ClusterInput()
ramp_feed_reduction_factor_2 = Number(ramp_feed_reduction_factor)
milling_bit_diameter_2 = Number(milling_bit_diameter)
number_of_flutes_2 = Number(number_of_flutes)
spindle_rpm_2 = Number(spindle_rpm)
max_stepover_2 = Number(max_stepover)
chip_load_2 = Number(chip_load)
spindle_rpm_3 = Panel(spindle_rpm_2)
milling_bit_diameter_3 = Panel(milling_bit_diameter_2)
number_of_flutes_3 = Panel(number_of_flutes_2)
chip_load_3 = Panel(chip_load_2)
max_stepover_3 = Panel(max_stepover_2)
ramp_feedrate_reduction_factor = Panel(ramp_feed_reduction_factor_2)

# ---- group: Calulate chip thining
larger = LargerThan(FirstNumber=max_stepover_3, SecondNumber="0.5")  # -> LargerThan, OrEqualTo
filter = StreamFilter(Gate=larger.LargerThan, Stream0=max_stepover_3, Stream1="0.5")
multiplication = Multiplication(A=milling_bit_diameter_3, B=filter)
multiplication_2 = Multiplication(A="0.5", B=milling_bit_diameter_3)
subtraction = Subtraction(A=multiplication_2, B=multiplication)
neg = Negative(Value=subtraction)
pt = ConstructPoint(XCoordinate=milling_bit_diameter_3, YCoordinate=neg, ZCoordinate=0)
pt_2 = ConstructPoint(XCoordinate=0, YCoordinate=neg, ZCoordinate=0)
xy = XYPlane(Origin=Point(0, 0, 0))
ln = Line(StartPoint=pt_2, EndPoint=pt)
cir = Circle(Plane=xy, Radius=multiplication_2)
ccx = CurveCurve(CurveA=cir, CurveB=ln)  # -> Points, ParamsA, ParamsB
pt_3 = ConstructPoint(XCoordinate=0, YCoordinate=0, ZCoordinate=0)
chip_load_4 = Panel(chip_load_3)
vec2pt = Vector2Pt(PointA=pt_3, PointB=ccx.Points, Unitize=False)  # -> Vector, Length
amp = Amplitude(Vector=vec2pt.Vector, Amplitude=chip_load_4)
move = Move(Geometry=ccx.Points, Motion=amp)  # -> Geometry, Transform
pdecon = Deconstruct(Point=move.Geometry)  # -> XComponent, YComponent, ZComponent
pt_4 = ConstructPoint(XCoordinate=0, YCoordinate=pdecon.YComponent, ZCoordinate=pdecon.ZComponent)
ln_2 = Line(StartPoint=move.Geometry, EndPoint=pt_4)
ccx_2 = CurveCurve(CurveA=cir, CurveB=ln_2)  # -> Points, ParamsA, ParamsB
dist = Distance(PointA=flatten(ccx_2.Points), PointB=flatten(move.Geometry))
move_distance_needed_for_chipload = Panel(dist)
chip_load_5 = Panel(chip_load_3)
division = Division(A=move_distance_needed_for_chipload, B=chip_load_5)

# ---- group: Calculate feedrate
multiplication_3 = Multiplication(A=spindle_rpm_3, B=number_of_flutes_3)
multiplication_4 = Multiplication(A=multiplication_3, B=chip_load_3)
division_2 = Division(A=multiplication_4, B="60")
feedrate = Panel(division_2)

# ---- group: Safatey in case of too extreme values
backup_feedrate_multiplaication_factor = Panel("2")
feedrate_multiplaication_factor = Panel(division)
null = NullItem(Item=ccx_2.Points)  # -> NullFlags, InvalidFlags, Description
filter_2 = StreamFilter(Gate=null.NullFlags, Stream0=feedrate_multiplaication_factor, Stream1=backup_feedrate_multiplaication_factor)

# ---- group: Visualize chip size
X = UnitX(Factor=dist)
ln_3 = Line(StartPoint=ccx.Points, EndPoint=pt)
ln_4 = Line(StartPoint=ccx.Points, EndPoint=move.Geometry)
move_2 = Move(Geometry=cir, Motion=X)  # -> Geometry, Transform
chip_load_cross_section = Curve(ln_4)
new_bit_position = Curve(move_2.Geometry)
old_bit_position = Curve(cir)
material_edge = Curve(ln_3)

# ----
panel = Panel("Stepover to small or chipload to high. Unable to compute optimal feedrate multiplication factor.")
filter_3 = StreamFilter(Gate=null.NullFlags, Stream0="All good", Stream1=panel)
ramp_feedrate_reduction_factor_2 = Panel(ramp_feedrate_reduction_factor)
feedrate_multiplication_factor = Panel(filter_2)
feedrate_2 = Panel(feedrate)
feedback = Panel(filter_3)
multiplication_5 = Multiplication(A=feedrate_2, B=feedrate_multiplication_factor)
multiplication_6 = Multiplication(A=multiplication_5, B=ramp_feedrate_reduction_factor_2)
feedback_2 = Text(feedback)
int = Integer(multiplication_5)
int_2 = Integer(multiplication_6)
feedback_3 = ClusterOutput(feedback_2)
feedrate_3 = Number(int)
ramp_feedrate = Number(int_2)
feedrate_4 = ClusterOutput(feedrate_3)
ramp_feedrate_2 = ClusterOutput(ramp_feedrate)

# ==== cluster TrochoidalHighSpeedMilling: Makes highspeed toolpaths for deep and fast cutting in metal. Input toolpath curves for the arcs to follow. Be careful about feedrates and stepovers. Prioritize deep passes and small stepovers (0.05 to 0.2). This technique is known as high speed feed machining.
straight_arc_extensions = ClusterInput()
ramp_entry_feedrate = ClusterInput()
milling_bit_diameter = ClusterInput()
arc_diameter_factor = ClusterInput()
make_helical_entry = ClusterInput()
toolpath_curves = ClusterInput()
use_climb_milling = ClusterInput()
jog_z_lift_factor = ClusterInput()
ramp_angle = ClusterInput()
stepover = ClusterInput()
feedrate = ClusterInput()
jograte = ClusterInput()
ramp_entry_feedrate_2 = Number(ramp_entry_feedrate)
milling_bit_diameter_2 = Number(milling_bit_diameter)
arc_diameter_factor_2 = Number(arc_diameter_factor)
straight_arc_extensions_2 = Boolean(straight_arc_extensions)
make_helical_entry_2 = Boolean(make_helical_entry)
toolpath_curves_2 = Curve(toolpath_curves)
use_climb_milling_2 = Boolean(use_climb_milling)
jog_z_lift_factor_2 = Number(jog_z_lift_factor)
ramp_angle_2 = Number(ramp_angle)
stepover_2 = Number(stepover)
feedrate_2 = Number(feedrate)
jograte_2 = Number(jograte)
make_straight_arc_extensions = Panel(straight_arc_extensions_2)
milling_bit_diameter_3 = Panel(milling_bit_diameter_2)
arc_diameter_factor_3 = Panel(arc_diameter_factor_2)
stepover_3 = Panel(stepover_2)
feedrate_3 = Panel(feedrate_2)
jograte_3 = Panel(jograte_2)
ramp_feedrate = Panel(ramp_entry_feedrate_2)
make_helical_entry_ramp = Panel(make_helical_entry_2)
ramp_angle_3 = Panel(ramp_angle_2)
jog_z_lift_factor_3 = Panel(jog_z_lift_factor_2)
use_climb_milling_3 = Panel(use_climb_milling_2)

# ---- group: Shetter curves at corners and shatter closed curves
disc = Discontinuity(Curve=toolpath_curves_2, Level=1)  # -> Points, Parameters
lng = ListLength(List=disc.Parameters)
smaller = SmallerThan(FirstNumber=lng, SecondNumber="1")  # -> SmallerThan, OrEqualTo
weave = Weave(Pattern=smaller.SmallerThan, Stream0=disc.Parameters, Stream1="0", NullGaps=False)
shatter = Shatter(Curve=graft(toolpath_curves_2), Parameters=weave)

# ----
straight = Panel("0")
smooth = Panel("2")
filter = StreamFilter(Gate=make_straight_arc_extensions, Stream0=smooth, Stream1=straight)
multiplication = Multiplication(A=milling_bit_diameter_3, B=arc_diameter_factor_3)
multiplication_2 = Multiplication(A=milling_bit_diameter_3, B=jog_z_lift_factor_3)
multiplication_3 = Multiplication(A=milling_bit_diameter_3, B=stepover_3)
arc_extension_type = Panel(filter)
subtraction = Subtraction(A=multiplication, B=milling_bit_diameter_3)
stepover_distance = Panel(multiplication_3)
z_lift_distance = Panel(multiplication_2)
arc_diameter = Panel(subtraction)
shattered_toolpath_curves = Curve(shatter)

# ---- group: Check if all curves consist of singel line, can give errors in data weaving
lng_2 = ListLength(List=shattered_toolpath_curves)
sort = SortList(Keys=flatten(lng_2))  # -> Keys, ValuesA
rev = ReverseList(List=sort.Keys)
item = ListItem(List=rev, Index=0, Wrap=True)
smaller_2 = SmallerThan(FirstNumber=item, SecondNumber="2")  # -> SmallerThan, OrEqualTo
all_toolpaths_are_single_curve = Panel(smaller_2.SmallerThan)

# ---- group: Make oriented planes for toolpah arcs
len = Length(Curve=shattered_toolpath_curves)
division = Division(A=len, B=stepover_distance)
int = Integer(division)
divide = DivideCurve(Curve=shattered_toolpath_curves, Count=int, Kinks=False)  # -> Points, Tangents, Parameters
cull_i = CullIndex(List=divide.Tangents, Indices="0", Wrap=True)
cull_i_2 = CullIndex(List=divide.Points, Indices="0", Wrap=True)
xy = XYPlane(Origin=cull_i_2)
align = AlignPlane(Plane=xy, Direction=cull_i)  # -> Plane, Angle
simplify = SimplifyTree(Tree=align.Plane, Front=False)
toolpath_planes = Plane(simplify)

# ---- group: Make toolpath arcs
arc_diameter_2 = Panel(arc_diameter)
use_climb_milling_4 = Panel(use_climb_milling_3)
arc_extension_type_2 = Panel(arc_extension_type)
stepover_distance_2 = Panel(stepover_distance)
pi = Pi(Factor=1)
pi_2 = Pi(Factor=1)
multiplication_4 = Multiplication(A=arc_diameter_2, B="0.5")
multiplication_5 = Multiplication(A=pi, B="0.5")
multiplication_6 = Multiplication(A=pi_2, B="-0.5")
xy_2 = XYPlane(Origin=Point(0, 0, 0))
dom = ConstructDomain(DomainStart=multiplication_6, DomainEnd=multiplication_5)
arc = Arc(Plane=xy_2, Radius=multiplication_4, Angle=dom)  # -> Arc, Length
ext = ExtendCurve(Curve=arc.Arc, Type=arc_extension_type_2, Start=stepover_distance_2, End=stepover_distance_2)
gate = StreamGate(Stream=ext, Gate=use_climb_milling_4)  # -> Target0, Target1
flip = FlipCurve(Curve=gate.Target0)  # -> Curve, Flag
filter_2 = StreamFilter(Gate=use_climb_milling_4, Stream0=flip.Curve, Stream1=gate.Target1)
orient = Orient(Geometry=filter_2, Source=xy_2, Target=toolpath_planes)  # -> Geometry, Transform
toolpath_arcs = Curve(orient.Geometry)

# ---- group: Tests for 3D projection
brep = Brep(<brep referenced from the Rhino model>)
toolpath_arcs_2 = Curve()
smooth_2 = SettingsQuality()
topoly = CurveToPolyline(Curve=toolpath_arcs_2, ToleranceDistance="0.01", ToleranceAngle=0)  # -> Polyline, Segments
mesh = MeshBrep(
    Brep=brep,
    Settings={GridMaxCount=0, GridMinCount=16, JaggedSeams=False, MaxEdgeLength=0, MinEdgeLength=0.0001, MinTolerance=0, Refine=True, RefineAngle=0, RelativeTolerance=0.65, SimplePlanes=True, Tolerance=0})
cp = ControlPoints(Curve=topoly.Polyline)  # -> Points, Weights, Knots
Z = UnitZ(Factor=Slider(100, range=0..100))
meshcp = MeshClosestPoint(Point=cp.Points, Mesh=mesh)  # -> Point, Index, Parameter
Z_2 = UnitZ(Factor=1)
move = Move(Geometry=cp.Points, Motion=Z)  # -> Geometry, Transform
dist = Distance(PointA=meshcp.Point, PointB=cp.Points)
neg = Negative(Value=Z_2)
multiplication_7 = Multiplication(A=dist, B=Slider(0.9, range=0..1))
vec2pt = Vector2Pt(PointA=cp.Points, PointB=meshcp.Point, Unitize=False)  # -> Vector, Length
simplify_2 = SimplifyTree(Tree=move.Geometry, Front=False)
amp = Amplitude(Vector=vec2pt.Vector, Amplitude=multiplication_7)
meshray = MeshRay(Mesh=mesh, Point=simplify_2, Direction=neg)  # -> Point, Hit
Z_3 = UnitZ(Factor=Slider(100, range=0..100))
move_2 = Move(Geometry=cp.Points, Motion=amp)  # -> Geometry, Transform
Z_4 = UnitZ(Factor=1)
move_3 = Move(Geometry=toolpath_arcs_2, Motion=Z_3)  # -> Geometry, Transform
neg_2 = Negative(Value=Z_4)
intcrv = Interpolate(Vertices=move_2.Geometry, Degree=3, Periodic=False, KnotStyle=1)  # -> Curve, Length, Domain
pline = PolyLine(Vertices=meshray.Point, Closed=False)
pline_2 = PolyLine(Vertices=move_2.Geometry, Closed=False)
project = Project(Curve=move_3.Geometry, Brep=brep, Direction=neg_2)
smoothpline = SmoothPolyline(Polyline=pline, Strength=1, Times=1)
smoothpline_2 = SmoothPolyline(Polyline=pline_2, Strength=1, Times=1)
item_2 = ListItem(List=project, Index=0, Wrap=True)
smoothpline_3 = SmoothPolyline(Polyline=smoothpline, Strength=1, Times=1)
smoothpline_4 = SmoothPolyline(Polyline=smoothpline_2, Strength=1, Times=1)
simplify_3 = SimplifyTree(Tree=item_2, Front=False)
crv = Curve(smoothpline_4)
crv_2 = Curve(simplify_3)
pshift = ShiftPaths(Data=crv, Offset=-1)

# ----
all_toolpaths_are_single_curve_2 = Panel(all_toolpaths_are_single_curve)
all_toolpaths_are_single_curve_3 = Panel(all_toolpaths_are_single_curve)

# ---- group: Make transition jog arcs for corner transitions
z_lift_distance_2 = Panel(z_lift_distance)
toolpath_arcs_3 = Curve(toolpath_arcs)
rev_2 = ReverseList(List=toolpath_arcs_3)
number_slider = Slider(0.5, range=0..1)
item_3 = ListItem(List=rev_2, Index=0, Wrap=True)
item_4 = ListItem(List=toolpath_arcs_3, Index=0, Wrap=True)
flatten = FlattenTree(Tree=item_4, Path="{0}")
pshift_2 = ShiftPaths(Data=item_3, Offset=-1)
flatten_2 = FlattenTree(Tree=item_3, Path="{0}")
pshift_3 = ShiftPaths(Data=item_4, Offset=-1)
flatten_3 = FlattenTree(Tree=pshift_2, Path="{0}")
clean = CleanTree(RemoveNulls=True, RemoveInvalid=True, RemoveEmpty=False, Tree=flatten_3)
item_5 = ListItem(List=clean, Index=0, Wrap=True)
null = NullItem(Item=item_5)  # -> NullFlags, InvalidFlags, Description
filter_3 = StreamFilter(Gate=null.NullFlags, Stream0=pshift_2, Stream1=flatten_2)
filter_4 = StreamFilter(Gate=null.NullFlags, Stream0=pshift_3, Stream1=flatten)
shift = ShiftList(List=filter_4, Shift=1, Wrap=False)
shift_2 = ShiftList(List=filter_3, Shift=-1, Wrap=False)
blendc = BlendCurve(CurveA=shift_2, CurveB=shift, BulgeA=number_slider, BulgeB=number_slider, Continuity=1)
reb = RebuildCurve(Curve=blendc, Count="5", Tangents=False)
multiplication_8 = Multiplication(A="5", B="0.5")
cp_2 = ControlPoints(Curve=reb)  # -> Points, Weights, Knots
int_2 = Integer(multiplication_8)
Z_5 = UnitZ(Factor=z_lift_distance_2)
item_6 = ListItem(List=cp_2.Points, Index=int_2, Wrap=True)
move_4 = Move(Geometry=item_6, Motion=Z_5)  # -> Geometry, Transform
replace = ReplaceItems(List=cp_2.Points, Item=move_4.Geometry, Indices=int_2, Wrap=False)
nurbs = NurbsCurve(Vertices=replace, Degree=3, Periodic=False)  # -> Curve, Length, Domain
all_toolpaths_are_single_curve_4 = Panel(all_toolpaths_are_single_curve_3)
simplify_4 = SimplifyTree(Tree=nurbs.Curve, Front=False)
gate_2 = StreamGate(Stream=simplify_4, Gate=all_toolpaths_are_single_curve_4)  # -> Target0, Target1

# ---- group: Make fancy jog to surface ending
last_arcs_in_list = Curve(filter_3)
rev_3 = ReverseList(List=last_arcs_in_list)
item_7 = ListItem(List=rev_3, Index=0, Wrap=True)
end = EndPoints(Curve=item_7)  # -> Start, End
crv_cp = CurveClosestPoint(Point=end.End, Curve=item_7)  # -> Point, Parameter, Distance
ln = Line(StartPoint=end.Start, EndPoint=end.End)
dist_2 = Distance(PointA=end.Start, PointB=end.End)
eval = EvaluateLength(Curve=ln, Length="0.3", Normalized=True)  # -> Point, Tangent, Parameter
eval_2 = EvaluateCurve(Curve=item_7, Parameter=crv_cp.Parameter)  # -> Point, Tangent, Angle
multiplication_9 = Multiplication(A=dist_2, B="0.5")
end_point_tangent = Vector(eval_2.Tangent)
arc_center_point = Point(eval.Point)
arc_end_point = Point(end.End)
arc_radius = Panel(multiplication_9)
arc_2 = ArcSED(Start=arc_end_point, End=arc_center_point, Direction=end_point_tangent)  # -> Arc, Plane, Radius
reb_2 = RebuildCurve(Curve=arc_2.Arc, Count="5", Tangents=False)
multiplication_10 = Multiplication(A="5", B="0.5")
cp_3 = ControlPoints(Curve=reb_2)  # -> Points, Weights, Knots
multiplication_11 = Multiplication(A=arc_radius, B="0.1")
multiplication_12 = Multiplication(A=arc_radius, B="0.7")
multiplication_13 = Multiplication(A=arc_radius, B="0.3")
int_3 = Integer(multiplication_10)
addition = Addition(A=int_3, B="1")
Z_6 = UnitZ(Factor=multiplication_13)
Z_7 = UnitZ(Factor=multiplication_11)
item_8 = ListItem(List=cp_3.Points, Index=int_3, Wrap=True)
Z_8 = UnitZ(Factor=arc_radius)
Z_9 = UnitZ(Factor=multiplication_12)
move_5 = Move(Geometry=item_8, Motion=Z_7)  # -> Geometry, Transform
replace_2 = ReplaceItems(List=cp_3.Points, Item=move_5.Geometry, Indices=int_3, Wrap=False)
item_9 = ListItem(List=replace_2, Index=addition, Wrap=True)
move_6 = Move(Geometry=item_9, Motion=Z_6)  # -> Geometry, Transform
subtraction_2 = Subtraction(A="5", B="1")
replace_3 = ReplaceItems(List=replace_2, Item=move_6.Geometry, Indices=addition, Wrap=False)
item_10 = ListItem(List=replace_3, Index=subtraction_2, Wrap=True)
move_7 = Move(Geometry=item_10, Motion=Z_9)  # -> Geometry, Transform
move_8 = Move(Geometry=item_10, Motion=Z_8)  # -> Geometry, Transform
replace_4 = ReplaceItems(List=replace_3, Item=move_7.Geometry, Indices=subtraction_2, Wrap=False)
ins = InsertItems(List=replace_4, Item=move_8.Geometry, Indices="5", Wrap=True)
nurbs_2 = NurbsCurve(Vertices=ins, Degree=3, Periodic=False)  # -> Curve, Length, Domain
simplify_5 = SimplifyTree(Tree=nurbs_2.Curve, Front=False)
end_jog_arcs = Curve(simplify_5)

# ---- group: Make jog arcs, transtion between each semicircular cut
z_lift_distance_3 = Panel(z_lift_distance)
toolpath_arcs_4 = Curve(toolpath_arcs)
number_slider_2 = Slider(0.5, range=0..1)
shift_3 = ShiftList(List=toolpath_arcs_4, Shift=1, Wrap=False)
shift_4 = ShiftList(List=toolpath_arcs_4, Shift=-1, Wrap=False)
blendc_2 = BlendCurve(CurveA=shift_4, CurveB=shift_3, BulgeA=number_slider_2, BulgeB=number_slider_2, Continuity=1)
blended_transitions = Curve(blendc_2)
reb_3 = RebuildCurve(Curve=blended_transitions, Count="5", Tangents=False)
multiplication_14 = Multiplication(A="5", B="0.5")
cp_4 = ControlPoints(Curve=reb_3)  # -> Points, Weights, Knots
int_4 = Integer(multiplication_14)
Z_10 = UnitZ(Factor=z_lift_distance_3)
item_11 = ListItem(List=cp_4.Points, Index=int_4, Wrap=True)
move_9 = Move(Geometry=item_11, Motion=Z_10)  # -> Geometry, Transform
replace_5 = ReplaceItems(List=cp_4.Points, Item=move_9.Geometry, Indices=int_4, Wrap=False)
nurbs_3 = NurbsCurve(Vertices=replace_5, Degree=3, Periodic=False)  # -> Curve, Length, Domain
jog_arcs = Curve(nurbs_3.Curve)

# ---- group: Inser fancy end jog to surface
corner_jog_arcs = Curve(gate_2.Target0)
end_jog_arcs_2 = Curve(end_jog_arcs)
pshift_4 = ShiftPaths(Data=corner_jog_arcs, Offset=-1)
flatten_4 = FlattenTree(Tree=corner_jog_arcs, Path="{0}")
flatten_5 = FlattenTree(Tree=pshift_4, Path="{0}")
flatten_6 = FlattenTree(Tree=end_jog_arcs_2, Path="{0}")
clean_2 = CleanTree(RemoveNulls=True, RemoveInvalid=True, RemoveEmpty=False, Tree=flatten_5)
item_12 = ListItem(List=clean_2, Index=0, Wrap=True)
null_2 = NullItem(Item=item_12)  # -> NullFlags, InvalidFlags, Description
filter_5 = StreamFilter(Gate=null_2.NullFlags, Stream0=pshift_4, Stream1=flatten_4)
filter_6 = StreamFilter(Gate=null_2.NullFlags, Stream0=end_jog_arcs_2, Stream1=flatten_6)
merge = Merge(Data1=filter_5, Data2=filter_6)
graft = GraftTree(Tree=merge, IncludeEmptyLists=True, IncludeNullItems=True)
clean_3 = CleanTree(RemoveNulls=True, RemoveInvalid=True, RemoveEmpty=True, Tree=graft)
transition_jog_arcs = Curve(clean_3)

# ---- group: Insert jog corner transitions
corner_jog_arcs_2 = Curve(transition_jog_arcs)
jog_arcs_2 = Curve(jog_arcs)
simplify_6 = SimplifyTree(Tree=jog_arcs_2, Front=False)
pshift_5 = ShiftPaths(Data=simplify_6, Offset=-1)
flatten_7 = FlattenTree(Tree=simplify_6, Path="{0}")
flatten_8 = FlattenTree(Tree=pshift_5, Path="{0}")
clean_4 = CleanTree(RemoveNulls=True, RemoveInvalid=True, RemoveEmpty=False, Tree=flatten_8)
item_13 = ListItem(List=clean_4, Index=0, Wrap=True)
null_3 = NullItem(Item=item_13)  # -> NullFlags, InvalidFlags, Description
filter_7 = StreamFilter(Gate=null_3.NullFlags, Stream0=pshift_5, Stream1=flatten_7)
lng_3 = ListLength(List=filter_7)
ins_2 = InsertItems(List=filter_7, Item=corner_jog_arcs_2, Indices=lng_3, Wrap=False)
jog_arcs_3 = Curve(ins_2)

# ---- group: Weave cuts and jogs
toolpath_arcs_5 = Curve(toolpath_arcs)
jog_arcs_4 = Curve(jog_arcs_3)
jograte_4 = Panel(jograte_3)
feedrate_4 = Panel(feedrate_3)
lng_4 = ListLength(List=toolpath_arcs_5)
lng_5 = ListLength(List=jog_arcs_4)
dup = DuplicateData(Data=feedrate_4, Number=lng_4, Order=True)
dup_2 = DuplicateData(Data=jograte_4, Number=lng_5, Order=True)
simplify_7 = SimplifyTree(Tree=dup_2, Front=False)
simplify_8 = SimplifyTree(Tree=dup, Front=False)
simplify_9 = SimplifyTree(Tree=jog_arcs_4, Front=False)
simplify_10 = SimplifyTree(Tree=toolpath_arcs_5, Front=False)
match = MatchTree(Tree=simplify_7, Guide=simplify_8)
match_2 = MatchTree(Tree=simplify_9, Guide=simplify_10)
weave_2 = Weave(Pattern=[0, 1], Stream0=simplify_8, Stream1=match, NullGaps=False)
weave_3 = Weave(Pattern=[0, 1], Stream0=simplify_10, Stream1=match_2, NullGaps=False)
shift_paths_if_possible = ShiftPathsIfPossible(data_paths_to_shifts=weave_2)
shift_paths_if_possible_2 = ShiftPathsIfPossible(data_paths_to_shifts=weave_3)

# ----
all_toolpaths_are_single_curve_5 = Panel(all_toolpaths_are_single_curve)
feedback = Panel("All good")
feedback_2 = Text(feedback)
feedback_3 = ClusterOutput(feedback_2)

# ---- group: Make helical entry plunge
stepover_distance_3 = Panel(stepover_distance)
make_helical_entry_ramp_2 = Panel(make_helical_entry_ramp)
inner_diameter_overlap = Panel("0.05")
ramp_extra_start_height = Panel("1")
milling_bit_diameter_4 = Panel(milling_bit_diameter_3)
ramp_angle_4 = Panel(ramp_angle_3)
start_arcs = Curve(filter_4)
filter_8 = StreamFilter(Gate=make_helical_entry_ramp_2, Stream1=start_arcs)
rad = Radians(Degrees=ramp_angle_4)
subtraction_3 = Subtraction(A="1", B=inner_diameter_overlap)
rtrig = RightTrigonometry(Beta=rad, PLength=stepover_distance_3)  # -> Alpha, Beta, PLength, QLength, RLength
multiplication_15 = Multiplication(A=milling_bit_diameter_4, B=subtraction_3)
multiplication_16 = Multiplication(A=multiplication_15, B="0.5")
eleveation_per_stepover_distance = Panel(rtrig.QLength)
inner_circle_radius = Panel(multiplication_16)
stepover_distance_4 = Panel(stepover_distance_3)
division_2 = Division(A="1", B="12")
Z_11 = UnitZ(Factor=1)
eleveation_per_stepover_distance_2 = Panel(eleveation_per_stepover_distance)
stepover_distance_5 = Panel(stepover_distance_3)
Z_12 = UnitZ(Factor=1)
xy_3 = XYPlane(Origin=Point(0, 0, 0))
rad_2 = Radians(Degrees="5")
rad_3 = Radians(Degrees="360")
dom_2 = ConstructDomain(DomainStart=rad_2, DomainEnd=rad_3)

# ----
graft_2 = GraftTree(Tree=filter_8, IncludeEmptyLists=True, IncludeNullItems=True)
filter_9 = StreamFilter(Gate=all_toolpaths_are_single_curve_2, Stream0=filter_8, Stream1=graft_2)

# ---- group: Make helical entry plunge (continued)
item_14 = ListItem(List=filter_9, Index=0, Wrap=True)
end_2 = EndPoints(Curve=item_14)  # -> Start, End
dist_3 = Distance(PointA=end_2.Start, PointB=end_2.End)
ln_2 = Line(StartPoint=end_2.Start, EndPoint=end_2.End)
pdecon = Deconstruct(Point=end_2.Start)  # -> XComponent, YComponent, ZComponent
vec2pt_2 = Vector2Pt(PointA=end_2.Start, PointB=end_2.End, Unitize=False)  # -> Vector, Length
multiplication_17 = Multiplication(A=dist_3, B="0.5")
eval_3 = EvaluateLength(Curve=ln_2, Length="0.5", Normalized=True)  # -> Point, Tangent, Parameter
abs = Absolute(Value=pdecon.ZComponent)
start_point = Point(eval_3.Point)
addition_2 = Addition(A=abs, B=ramp_extra_start_height)
rev_4 = Reverse(Vector=vec2pt_2.Vector)
xy_4 = XYPlane(Origin=start_point)
cut_depths = Panel(addition_2)
arc_radius_2 = Panel(multiplication_17)
pl = ConstructPlane(Origin=start_point, XAxis=rev_4, YAxis=Vector(0, 1, 0))
align_2 = AlignPlane(Plane=xy_4, Direction=rev_4)  # -> Plane, Angle
cir = Circle(Plane=align_2.Plane, Radius=multiplication_17)
arc_radius_3 = Panel(arc_radius_2)
flip_2 = FlipCurve(Curve=cir)  # -> Curve, Flag
subtraction_4 = Subtraction(A=arc_radius_3, B=inner_circle_radius)
horizontal_spiral_distance = Panel(subtraction_4)
divide_2 = DivideCurve(Curve=flip_2.Curve, Count="12", Kinks=False)  # -> Points, Tangents, Parameters
division_3 = Division(A=horizontal_spiral_distance, B=stepover_distance_4)
multiplication_18 = Multiplication(A="12", B=division_3)
number_of_spiral_points = Panel(multiplication_18)
series = Series(Start=0, Step=1, Count=number_of_spiral_points)
series_2 = Series(Start=0, Step=division_2, Count=number_of_spiral_points)
item_15 = ListItem(List=divide_2.Points, Index=series, Wrap=True)
multiplication_19 = Multiplication(A=series_2, B=stepover_distance_4)
vec2pt_3 = Vector2Pt(PointA=item_15, PointB=start_point, Unitize=False)  # -> Vector, Length
amp_2 = Amplitude(Vector=vec2pt_3.Vector, Amplitude=multiplication_19)
move_10 = Move(Geometry=item_15, Motion=amp_2)  # -> Geometry, Transform
intcrv_2 = Interpolate(Vertices=move_10.Geometry, Degree=3, Periodic=False, KnotStyle=1)  # -> Curve, Length, Domain
flip_3 = FlipCurve(Curve=intcrv_2.Curve)  # -> Curve, Flag
bottom_flat_spiral = Curve(flip_3.Curve)
end_3 = EndPoints(Curve=bottom_flat_spiral)  # -> Start, End
start_point_2 = Point(start_point)
vec2pt_4 = Vector2Pt(PointA=start_point_2, PointB=end_3.Start, Unitize=False)  # -> Vector, Length
pl_2 = ConstructPlane(Origin=start_point_2, XAxis=vec2pt_4.Vector, YAxis=Z_11)
mirror = Mirror(Geometry=bottom_flat_spiral, Plane=pl_2)  # -> Geometry, Transform
divide_curve_even_lenght = DivideCurveEvenLenght(crv=mirror.Geometry, B=stepover_distance_5)
lng_6 = ListLength(List=divide_curve_even_lenght)
series_3 = Series(Start=0, Step=eleveation_per_stepover_distance_2, Count=lng_6)
Z_13 = UnitZ(Factor=series_3)
move_11 = Move(Geometry=divide_curve_even_lenght, Motion=Z_13)  # -> Geometry, Transform
intcrv_3 = Interpolate(Vertices=move_11.Geometry, Degree=3, Periodic=False, KnotStyle=1)  # -> Curve, Length, Domain
flip_4 = FlipCurve(Curve=intcrv_3.Curve)  # -> Curve, Flag
lower_plunge_helix = Curve(flip_4.Curve)
start_point_3 = Point(start_point)
end_4 = EndPoints(Curve=lower_plunge_helix)  # -> Start, End
vec2pt_5 = Vector2Pt(PointA=start_point_3, PointB=end_4.Start, Unitize=False)  # -> Vector, Length
pl_3 = ConstructPlane(Origin=end_4.Start, XAxis=vec2pt_5.Vector, YAxis=Z_12)
mirror_2 = Mirror(Geometry=lower_plunge_helix, Plane=pl_3)  # -> Geometry, Transform
flip_5 = FlipCurve(Curve=mirror_2.Geometry)  # -> Curve, Flag
xy_5 = XYPlane(Origin=end_4.Start)
mirror_3 = Mirror(Geometry=flip_5.Curve, Plane=xy_5)  # -> Geometry, Transform
upper_plunge_helix = Curve(mirror_3.Geometry)
lower_plunge_helix_2 = Curve(lower_plunge_helix)
merge_2 = Merge(Data1=upper_plunge_helix, Data2=lower_plunge_helix_2)
join = JoinCurves(Curves=merge_2, Preserve=False)
simplify_11 = SimplifyTree(Tree=join, Front=False)
plunge_helix = Curve(simplify_11)
end_5 = EndPoints(Curve=plunge_helix)  # -> Start, End
pdecon_2 = Deconstruct(Point=end_5.Start)  # -> XComponent, YComponent, ZComponent
pdecon_3 = Deconstruct(Point=end_5.End)  # -> XComponent, YComponent, ZComponent
pt = ConstructPoint(XCoordinate=0, YCoordinate=0, ZCoordinate=pdecon_2.ZComponent)
pt_2 = ConstructPoint(XCoordinate=0, YCoordinate=0, ZCoordinate=pdecon_3.ZComponent)
dist_4 = Distance(PointA=pt, PointB=pt_2)
cut_depths_2 = Panel(cut_depths)
plunge_helix_height = Panel(dist_4)
division_4 = Division(A=cut_depths_2, B=plunge_helix_height)
round = Round(Number=division_4)  # -> Nearest, Floor, Ceiling
addition_3 = Addition(A=division_4, B="0.5")
start_point_4 = Point(start_point)
end_6 = EndPoints(Curve=plunge_helix)  # -> Start, End
project_2 = Project(Geometry=end_6.Start, Plane=xy_3)  # -> Geometry, Transform
project_3 = Project(Geometry=start_point_4, Plane=xy_3)  # -> Geometry, Transform
project_4 = Project(Geometry=end_6.End, Plane=xy_3)  # -> Geometry, Transform
vec2pt_6 = Vector2Pt(PointA=project_3.Geometry, PointB=project_4.Geometry, Unitize=False)  # -> Vector, Length
vec2pt_7 = Vector2Pt(PointA=project_3.Geometry, PointB=project_2.Geometry, Unitize=False)  # -> Vector, Length
angle = Angle(VectorA=vec2pt_7.Vector, VectorB=vec2pt_6.Vector, Plane=xy_3)  # -> Angle, Reflex
series_4 = Series(Start=0, Step=plunge_helix_height, Count=round.Ceiling)
series_5 = Series(Start=0, Step=angle.Reflex, Count=round.Ceiling)
Z_14 = UnitZ(Factor=series_4)
move_12 = Move(Geometry=plunge_helix, Motion=Z_14)  # -> Geometry, Transform
xy_6 = XYPlane(Origin=start_point_4)
rotate = Rotate(Geometry=move_12.Geometry, Angle=series_5, Plane=xy_6)  # -> Geometry, Transform
cut_depths_3 = Panel(cut_depths)
join_2 = JoinCurves(Curves=rotate.Geometry, Preserve=False)
bottom_flat_spiral_2 = Curve(bottom_flat_spiral)
simplify_12 = SimplifyTree(Tree=join_2, Front=False)
Z_15 = UnitZ(Factor=cut_depths_3)
plunge_helix_tower = Curve(simplify_12)
move_13 = Move(Geometry=xy_6, Motion=Z_15)  # -> Geometry, Transform
flatten_9 = FlattenTree(Tree=bottom_flat_spiral_2, Path="{0}")
lng_7 = ListLength(List=flatten_9)
pcx = CurvePlane(Curve=plunge_helix_tower, Plane=move_13.Geometry)  # -> Points, ParamsC, ParamsP
arc_radius_4 = Panel(arc_radius_2)
smaller_3 = SmallerThan(FirstNumber=lng_7, SecondNumber="2")  # -> SmallerThan, OrEqualTo
shatter_2 = Shatter(Curve=plunge_helix_tower, Parameters=pcx.ParamsC)
start_point_plane = Plane(align_2.Plane)
rev_5 = ReverseList(List=shatter_2)
filter_10 = StreamFilter(Gate=smaller_3.SmallerThan, Stream0=bottom_flat_spiral_2, Stream1=flatten_9)
item_16 = ListItem(List=rev_5, Index=0, Wrap=True)
rotate_2 = Rotate(Geometry=filter_10, Angle=rad_2, Plane=start_point_plane)  # -> Geometry, Transform
arc_3 = Arc(Plane=start_point_plane, Radius=arc_radius_4, Angle=dom_2)  # -> Arc, Length
rev_6 = ReverseList(List=item_16)
simplify_13 = SimplifyTree(Tree=rotate_2.Geometry, Front=False)
simplify_14 = SimplifyTree(Tree=arc_3.Arc, Front=False)
rotate_3 = Rotate(Geometry=rev_6, Angle=rad_2, Plane=start_point_plane)  # -> Geometry, Transform
join_3 = JoinCurves(Curves=[simplify_13, simplify_14], Preserve=False)
simplify_15 = SimplifyTree(Tree=rotate_3.Geometry, Front=False)
simplify_16 = SimplifyTree(Tree=join_3, Front=False)
flatten_10 = FlattenTree(Tree=simplify_16, Path="{0}")
flatten_11 = FlattenTree(Tree=simplify_15, Path="{0}")
filter_11 = StreamFilter(Gate=smaller_3.SmallerThan, Stream0=simplify_16, Stream1=flatten_10)
filter_12 = StreamFilter(Gate=smaller_3.SmallerThan, Stream0=simplify_15, Stream1=flatten_11)
join_4 = JoinCurves(Curves=[filter_12, filter_11], Preserve=False)
cut_entry_plunges = Curve(join_4)

# ---- group: Prepare ramp for insert
make_helical_entry_ramp_3 = Panel(make_helical_entry_ramp)
ramp_feedrate_2 = Panel(ramp_feedrate)
cut_entry_plunges_2 = Curve(cut_entry_plunges)
lng_8 = ListLength(List=cut_entry_plunges_2)
dup_3 = DuplicateData(Data=ramp_feedrate_2, Number=lng_8, Order=True)
simplify_17 = SimplifyTree(Tree=cut_entry_plunges_2, Front=False)
simplify_18 = SimplifyTree(Tree=dup_3, Front=False)
flatten_12 = FlattenTree(Tree=simplify_18, Path="{0}")
flatten_13 = FlattenTree(Tree=simplify_17, Path="{0}")
filter_13 = StreamFilter(Gate=all_toolpaths_are_single_curve_5, Stream0=simplify_18, Stream1=flatten_12)
filter_14 = StreamFilter(Gate=all_toolpaths_are_single_curve_5, Stream0=simplify_17, Stream1=flatten_13)

# ---- group: Insert ramp feedrates
ins_3 = InsertItems(List=shift_paths_if_possible, Item=filter_13, Indices="0", Wrap=True)
simplify_19 = SimplifyTree(Tree=ins_3, Front=False)
filter_15 = StreamFilter(Gate=make_helical_entry_ramp_3, Stream0=shift_paths_if_possible, Stream1=simplify_19)

# ---- group: Insert ramp geometry
ins_4 = InsertItems(List=shift_paths_if_possible_2, Item=filter_14, Indices="0", Wrap=True)
simplify_20 = SimplifyTree(Tree=ins_4, Front=False)
filter_16 = StreamFilter(Gate=make_helical_entry_ramp_3, Stream0=shift_paths_if_possible_2, Stream1=simplify_20)

# ----
toolpaths = Curve(filter_16)
feedrates = Panel(filter_15)

# ---- group: Preview toolpaths
preview_toolpath = Slider(0, range=0..1)
shift_paths_if_possible_3 = ShiftPathsIfPossible(data_paths_to_shifts=toolpaths)  # disabled
join_5 = JoinCurves(Curves=shift_paths_if_possible_3, Preserve=False)
milling_bit_diameter_5 = Panel(milling_bit_diameter_3)
eval_4 = EvaluateLength(Curve=graft(join_5), Length=preview_toolpath, Normalized=True)  # -> Point, Tangent, Parameter
shatter_3 = Shatter(Curve=graft(join_5), Parameters=eval_4.Parameter)
multiplication_20 = Multiplication(A=milling_bit_diameter_5, B="0.5")
pt_3 = Point(eval_4.Point)
xy_7 = XYPlane(Origin=eval_4.Point)
xy_8 = XYPlane(Origin=Point(0, 0, 0))
item_17 = ListItem(List=shatter_3, Index=0, Wrap=True)
cyl = Cylinder(Base=xy_8, Radius=multiplication_20, Length=Slider(40, range=0..100))
orient_2 = Orient(Geometry=cyl, Source=xy_8, Target=xy_7)  # -> Geometry, Transform
preview = CustomPreview(Geometry=orient_2.Geometry, Shader=ColourSwatch(SwatchColor=RGB(79, 79, 79)))

# ----
feedrates_2 = Number(feedrates)
toolpaths_2 = Curve(toolpaths)
feedrates_3 = ClusterOutput(feedrates_2)
toolpaths_3 = ClusterOutput(toolpaths_2)

# ==== cluster ShiftPathsIfPossible
data_paths_to_shifts = ClusterInput()
pshift = ShiftPaths(Data=data_paths_to_shifts, Offset=-1)
flatten = FlattenTree(Tree=data_paths_to_shifts, Path="{0}")
flatten_2 = FlattenTree(Tree=pshift, Path="{0}")
clean = CleanTree(RemoveNulls=True, RemoveInvalid=True, RemoveEmpty=False, Tree=flatten_2)
item = ListItem(List=clean, Index=0, Wrap=True)
null = NullItem(Item=item)  # -> NullFlags, InvalidFlags, Description
filter = StreamFilter(Gate=null.NullFlags, Stream0=pshift, Stream1=flatten)
safely_shifted_paths = ClusterOutput(filter)  # Safely shifted paths

# ==== cluster DivideCurveEvenLenght: Calculates approximate curve length for even division
crv = ClusterInput()
crv_2 = Curve(crv)
B = ClusterInput()
len = Length(Curve=crv_2)
division = Division(A=len, B=B)
int = Integer(division)
divide = DivideCurve(Curve=crv_2, Count=int, Kinks=False)  # -> Points, Tangents, Parameters
P = ClusterOutput(divide.Points)
