# Grasshopper definition Bark beetle - CNC milling - Custom setup Siemen.gh (Grasshopper 1.0.4)
# Copyright: Co-de-iT
# Copyright: Creative commons BY-SA

# ---- group: Material
# CNC mill settings:
list = ValueList({"Foam / wax": 0, "Soft wood": 1, "Hard wood": 2, "Plastic": 3, "Aluminium / brass": 4}, selected="Soft wood")

# ---- group: Depths
engrave_depth = Slider(1, range=0..40)
pocket_depth = Slider(1, range=0..40)
drill_depth = Slider(1, range=0..40)
cut_depth = Slider(1, range=0..40)

# ---- group: Tricks
# Developed by Jens Dyvik / Fellesverkstedet
# 
# License: Creative Commons Attribution ShareAllike (cc-by-sa)
# bugs:
# 
# ramp plunge not working on 3d moves - fixed
# 
# roughing not always to the edge. - almost fixed
# 
# dognone of more than 90 degrees can not fit the bit
# dogbone not stable with only one object
# dogbone filter open curves
# 
# toolpaths completely inside tabs must be deleted - fixed, but not proerly tested,difficult to replicate problem
# 
# mini topp ved kule fres
# 
# sort z order finish milling
# 
# bad pocket raster from pocket in pocket. pockets offset overshoot
# 
# bad small fillet finsih paths
# 
# what to do when pocket with ball nose in 3d job? how to avoid edge in surface overlap?
# 
# Fix project to cplane or check if flat - make warning in case of not flat?
# 
# Fix pocket bit offset - make tool diam based?
# 
# Make pocket go full depth per pocket
# 
# fix cut inside inside inside
# fix surface rebuild for 3D mill
# fix pocket raster
# 
# fix errors when curve count is not matching depth count in autmill pocket and cut
# 
# Unenev stepover with surfaces from curves with uneevn distrubution of control points.
# fix by rebbuilding or reparemtrizing?
# To add:
# Choose if post processor should make g-code, shopbot code or rml
# Check if offset has gone bad - give feedback
# Differnt colers for differnt toolpaths - fixed
# Choose g-code or sbp output
# Auto rough from surface depth?
# variable speed depending on cut depth
# Make autopocket automatically extend over edges?
# Detect too naoor edge pockets, ad instead add profile if possible?
# Automaticcaly choose bit size?
# Add separte interface window with HumanUI
use_inside_cutting = BooleanToggle(False)
make_dogbones = BooleanToggle(False)

# ---- group: Bit diameter
list_2 = ValueList({"2mm": 0, "3mm": 1, "4mm": 2, "6mm": 3, "8mm": 4, "10mm": 5}, selected="6mm")

# ---- group: Bit type
value_list = ValueList({"Up-cut": 0, "Down-cut": 1, "Ball nose": 2, "V-bit": 3}, selected="Up-cut")

# ---- group: Override
speed = ControlKnob(Decimals=0, Limit=True, Maximum=200, Minimum=10, Range=50, Value=100)

# ----
feed_rate_calculator = FeedRateCalculator(material_id=list, bit_diameter_id=list_2, bit_type_id=value_list, speed_factor=speed)  # -> feed_rate_4, plunge_rate_4, pass_depth_4, ramp_plunges_4, ramp_angle_4

# ---- group: Check if ball nose is current bit
bit_type_id = Panel(value_list)
ball_nose_id = Panel("2")
equals = Equality(FirstNumber=bit_type_id, SecondNumber=ball_nose_id)  # -> Equality, Inequality
ball_nose_is_current_bit = Panel(equals.Equality)

# ----
bit_id_s = Panel("""2
3
4
6
8
10""")
bit_id_from_easy_interface = Panel(list_2)

# ---- group: Make fastest directoin when ballnose milling
prioritize_fastest_direction = BooleanToggle(False)
prioritize_fastest_direction_2 = BooleanToggle(True)
filter = StreamFilter(Gate=ball_nose_is_current_bit, Stream0=prioritize_fastest_direction, Stream1=prioritize_fastest_direction_2)

# ---- group: Make vertical milling direction when end mill cutting
make_horizontal_finsihing = BooleanToggle(False)
make_horizontal_finishing = BooleanToggle(True)
filter_2 = StreamFilter(Gate=ball_nose_is_current_bit, Stream0=make_horizontal_finsihing, Stream1=make_horizontal_finishing)

# ----
item = ListItem(List=bit_id_s, Index=bit_id_from_easy_interface, Wrap=True)
bit_diameter_from_easy_interface = Panel(item)
feed_rate_from_easy_interface = Panel(feed_rate_calculator.feed_rate_4)
plunge_rate_from_easy_interface = Panel(feed_rate_calculator.plunge_rate_4)
drill_depth_from_easy_interface = Panel(drill_depth)
pocket_depth_from_easy_interface = Panel(pocket_depth)
engrave_depth_from_easy_interface = Panel(engrave_depth)
cut_depth_from_easy_interface = Panel(cut_depth)
pass_depth_from_easy_interface = Panel(feed_rate_calculator.pass_depth_4)
make_dogbones_from_easy_interface = Panel(make_dogbones)
ramp_angle_from_easy_interface = Panel(feed_rate_calculator.ramp_angle_4)
use_inside_cutting_from_easy_interface = Panel(use_inside_cutting)
ramp_plunges_from_easy_interface = Panel(feed_rate_calculator.ramp_plunges_4)

use_ballnose_for_3d_finishing = BooleanToggle(False)
use_auto_settings = BooleanToggle(True)
filter_3 = StreamFilter(Gate=use_auto_settings, Stream0=use_ballnose_for_3d_finishing, Stream1=ball_nose_is_current_bit)
use_ballnose_for_3d_milling = Panel(filter_3)

milling_bit_diameter = Slider(1, range=0..10)
use_auto_settings_2 = BooleanToggle(True)
filter_4 = StreamFilter(Gate=use_auto_settings_2, Stream0=milling_bit_diameter, Stream1=bit_diameter_from_easy_interface)
# 2D
# Main settings:
milling_bit_diameter_2 = Panel(filter_4)

plunge_rate = Slider(8, range=6..80)
use_auto_settings_3 = BooleanToggle(True)
filter_5 = StreamFilter(Gate=use_auto_settings_3, Stream0=plunge_rate, Stream1=plunge_rate_from_easy_interface)
plunge_rate_2 = Panel(filter_5)

engrave_depth_2 = Slider(0, range=0..20)
use_auto_settings_4 = BooleanToggle(True)
filter_6 = StreamFilter(Gate=use_auto_settings_4, Stream0=engrave_depth_2, Stream1=pocket_depth_from_easy_interface)
pocket_depth_2 = Panel(filter_6)

pocket_depth_3 = Slider(10, range=0..25)
use_auto_settings_5 = BooleanToggle(True)
filter_7 = StreamFilter(Gate=use_auto_settings_5, Stream0=pocket_depth_3, Stream1=engrave_depth_from_easy_interface)
engrave_depth_3 = Panel(filter_7)

pass_depth = Slider(10, range=0.4..20)
use_auto_settings_6 = BooleanToggle(True)
filter_8 = StreamFilter(Gate=use_auto_settings_6, Stream0=pass_depth, Stream1=pass_depth_from_easy_interface)
pass_depth_2 = Panel(filter_8)

cutout_depth = Slider(19.6, range=0.2..45)
use_auto_settings_7 = BooleanToggle(True)
filter_9 = StreamFilter(Gate=use_auto_settings_7, Stream0=cutout_depth, Stream1=cut_depth_from_easy_interface)
cutout_depth_2 = Panel(filter_9)

feed_rate = Slider(20, range=6..150)
use_auto_settings_8 = BooleanToggle(True)
filter_10 = StreamFilter(Gate=use_auto_settings_8, Stream0=feed_rate, Stream1=feed_rate_from_easy_interface)
feed_rate_2 = Panel(filter_10)

drill_depth_2 = Slider(10, range=0..20)
use_auto_settings_9 = BooleanToggle(True)
filter_11 = StreamFilter(Gate=use_auto_settings_9, Stream0=drill_depth_2, Stream1=drill_depth_from_easy_interface)
drill_depth_3 = Panel(filter_11)

use_ballnose_for_3d_roughing = BooleanToggle(False)
use_auto_settings_10 = BooleanToggle(True)
filter_12 = StreamFilter(Gate=use_auto_settings_10, Stream0=use_ballnose_for_3d_roughing, Stream1=ball_nose_is_current_bit)
use_ballnose_for_3d_roughing_2 = Panel(filter_12)

make_horizontal_finishing_2 = BooleanToggle(False)
use_auto_settings_11 = BooleanToggle(True)
filter_13 = StreamFilter(Gate=use_auto_settings_11, Stream0=make_horizontal_finishing_2, Stream1=filter_2)
make_horizontal_finishing_3 = Panel(filter_13)

prioritize_fastest_direction_3 = BooleanToggle(False)
use_auto_settings_12 = BooleanToggle(True)
filter_14 = StreamFilter(Gate=use_auto_settings_12, Stream0=prioritize_fastest_direction_3, Stream1=filter)
prioritize_fastest_direction_4 = Panel(filter_14)

dogbone_corner_angle_threshold = Slider(121, range=0..1000)
dogbone_corner_angle_threshold_2 = Panel(dogbone_corner_angle_threshold)

ramp_angle = Slider(45, range=0..100)
use_auto_settings_13 = BooleanToggle(True)
filter_15 = StreamFilter(Gate=use_auto_settings_13, Stream0=ramp_angle, Stream1=ramp_angle_from_easy_interface)
ramp_angle_2 = Panel(filter_15)

roughing_material_leftover = Slider(0.5, range=0..1)
roughing_material_leftover_2 = Panel(roughing_material_leftover)

use_inside_cutting_2 = BooleanToggle(False)
use_auto_settings_14 = BooleanToggle(True)
filter_16 = StreamFilter(Gate=use_auto_settings_14, Stream0=use_inside_cutting_2, Stream1=use_inside_cutting_from_easy_interface)
use_inside_cutting_3 = Panel(filter_16)

use_auto_settings_15 = BooleanToggle(True)
ramp_plunges = BooleanToggle(False)
filter_17 = StreamFilter(Gate=use_auto_settings_15, Stream0=ramp_plunges, Stream1=ramp_plunges_from_easy_interface)
ramp_plunges_2 = Panel(filter_17)

ramp_plunges_3 = Panel(ramp_plunges_2)
ramp_plunges_4 = Panel(ramp_plunges_2)
not = GateNot(A=ramp_plunges_4)
not_2 = GateNot(A=ramp_plunges_3)

connect_toolpaths_levels = BooleanToggle(True)
use_auto_settings_16 = BooleanToggle(True)
filter_18 = StreamFilter(Gate=use_auto_settings_16, Stream0=connect_toolpaths_levels, Stream1=not)
connect_toolpaths_levels_2 = Panel(filter_18)

connect_toolpaths_levels_3 = BooleanToggle(True)
use_auto_settings_17 = BooleanToggle(True)
filter_19 = StreamFilter(Gate=use_auto_settings_17, Stream0=connect_toolpaths_levels_3, Stream1=not_2)
connect_toolpaths_levels_4 = Panel(filter_19)

use_auto_settings_18 = BooleanToggle(True)
make_dogbones_2 = BooleanToggle(False)
filter_20 = StreamFilter(Gate=use_auto_settings_18, Stream0=make_dogbones_2, Stream1=make_dogbones_from_easy_interface)
make_dogbones_3 = Panel(filter_20)

deviation_tolerance = Slider(0.01, range=0.01..0.1)

roughing_stepover = Slider(0.6, range=0.05..0.9)
roughing_stepover_2 = Panel(roughing_stepover)

finishing_stepover = Slider(0.2, range=0.05..0.9)
finishing_stepover_2 = Panel(finishing_stepover)

make_safety_pass_from_cutout = BooleanToggle(False)
make_safety_pass_from_cutout_2 = Panel(make_safety_pass_from_cutout)

spindle_speed = Slider(18000, range=6000..18000)

cutout_tolerance = Slider(0, range=-0.5..0.5)
cutout_tolerance_2 = Panel(cutout_tolerance)

# ----
# Advanced 2D settings:
pocket_stepover = Slider(0.8, range=0..1)
pocket_stepover_2 = Panel(pocket_stepover)

make_horizontal_roughing = BooleanToggle(True)
make_horizontal_roughing_2 = Panel(make_horizontal_roughing)

prioritize_fastest_direction_5 = BooleanToggle(False)
prioritize_fastest_direction_6 = Panel(prioritize_fastest_direction_5)

use_custom_jog_home = BooleanToggle(True)
safe_z = Slider(6, range=0..20)

raster_direction_along_y = BooleanToggle(False)
raster_direction_along_y_2 = Panel(raster_direction_along_y)

include_surface_edges = BooleanToggle(True)
include_surface_edges_2 = Panel(include_surface_edges)

include_surface_edges_3 = BooleanToggle(False)
include_surface_edges_4 = Panel(include_surface_edges_3)

generate_cutout = BooleanToggle(False)
# Cutout:
generate_cutout_2 = Panel(generate_cutout)

# ----
# fix - slice objects true triggers camera to be set to 1:1 location
generate_pockets = BooleanToggle(False)
generate_pockets_2 = Panel(generate_pockets)

generate_roughing = BooleanToggle(True)
# 3D
# Roughing:
generate_3d_roughing = Panel(generate_roughing)

use_climb_direction = BooleanToggle(False)
use_climb_direction_2 = Panel(use_climb_direction)

generate_finishing = BooleanToggle(True)
# Finishing:
generate_3d_finishing = Panel(generate_finishing)

use_spindle = BooleanToggle(True)

# ---- group: CNC mill input geometery
pipeline = GeometryPipeline(
    GroupByLayer=False,
    GroupByType=False,
    IncludeHidden=True,
    IncludeLocked=True,
    LayerFilter="CNC engrave",
    NameFilter="*",
    TypeFilter=4)
pipeline_2 = GeometryPipeline(
    GroupByLayer=False,
    GroupByType=False,
    IncludeHidden=True,
    IncludeLocked=True,
    LayerFilter="CNC 3D",
    NameFilter="*",
    TypeFilter=32)
pipeline_3 = GeometryPipeline(
    GroupByLayer=False,
    GroupByType=False,
    IncludeHidden=True,
    IncludeLocked=True,
    LayerFilter="CNC 3D",
    NameFilter="*",
    TypeFilter=1073741848)
# Developed by Jens Dyvik / Fellesverkstedet
# 
# License: Creative Commons Attribution ShareAllike (cc-by-sa)
# GEOMETRY
# Add rhino geometry in the corresponding layers, or right click  to set geometry
pipeline_4 = GeometryPipeline(
    GroupByLayer=False,
    GroupByType=False,
    IncludeHidden=True,
    IncludeLocked=True,
    LayerFilter="CNC drill",
    NameFilter="*",
    TypeFilter=4)
pipeline_5 = GeometryPipeline(
    GroupByLayer=False,
    GroupByType=False,
    IncludeHidden=True,
    IncludeLocked=True,
    LayerFilter="CNC pocket",
    NameFilter="*",
    TypeFilter=4)
pipeline_6 = GeometryPipeline(
    GroupByLayer=False,
    GroupByType=False,
    IncludeHidden=True,
    IncludeLocked=True,
    LayerFilter="CNC cut",
    NameFilter="*",
    TypeFilter=4)
pipeline_7 = GeometryPipeline(
    GroupByLayer=False,
    GroupByType=False,
    IncludeHidden=True,
    IncludeLocked=True,
    LayerFilter="CNC tabs",
    NameFilter="*",
    TypeFilter=1073741848)

# ----
tolerance = Panel("0.01")
overshoot_margin_mm = Panel("0.5")
tolerance_2 = Panel("0.01")
overshoot_margin_mm_2 = Panel("0.1")

# ---- group: Make preview colors
number_of_color_types_to_make = Panel("5")
number_slider = Slider(0.88, range=0..1)
# Preview generation:
series = Series(Start=Slider(0.39, range=0..1), Step=Slider(0.073, range=0..1), Count=number_of_color_types_to_make)
rev = ReverseList(List=series)
item_2 = ListItem(List=rev, Index="3", Wrap=True)
item_3 = ListItem(List=rev, Index="4", Wrap=True)
item_4 = ListItem(List=rev, Index="1", Wrap=True)
item_5 = ListItem(List=rev, Index="2", Wrap=True)
item_6 = ListItem(List=rev, Index="0", Wrap=True)
hsl = ColourHSL(Alpha=1, Hue=item_4, Saturation=1, Luminance=number_slider)
hsl_2 = ColourHSL(Alpha=1, Hue=item_5, Saturation=1, Luminance=number_slider)
hsl_3 = ColourHSL(Alpha=1, Hue=item_2, Saturation=1, Luminance=number_slider)
hsl_4 = ColourHSL(Alpha=1, Hue=item_6, Saturation=1, Luminance=number_slider)
hsl_5 = ColourHSL(Alpha=1, Hue=item_3, Saturation=1, Luminance=number_slider)
_3d_rough_color = Colour(hsl_3)
_3d_finish_color = Colour(hsl_5)
pocket_color = Colour(hsl_4)
engrave_color = Colour(hsl)
cut_color = Colour(hsl_2)

# ----
height_tabs = Slider(2, range=0..10)
width_tabs = Slider(6, range=0..10)
auto_tabbing_curves = Curve()
auto_tabbing_ex = AutoTabbingEx(
    curves=auto_tabbing_curves,
    angle=10,
    width_tabs=width_tabs,
    diameter_bit=milling_bit_diameter_2,
    increase_distance_from_corner=0,
    minimum_curve_length_for_tabbing=0)

cnc_engrave_curves = Curve()
cnc_pocket_curves = Curve()
meshes_for_3d_mill = Mesh()
cnc_cutout_curves = Curve(auto_tabbing_curves)
breps_for_3d_mill = Brep(<brep referenced from the Rhino model>)
cnc_drill_curves = Curve()

tab_maker_ex = TabMaker(
    geo=auto_tabbing_ex,
    cutout_curves=cnc_cutout_curves,
    height_tabs=height_tabs,
    width_tabs=width_tabs,
    tolerance=0.1,
    diameter_milling_bit=milling_bit_diameter_2,
    cutting_depth=cutout_depth_2)

tab_breps = Brep(tab_maker_ex)

horizontal_3d_mill_from_mesh_wip = Horizontal3DMillFromMeshWIP(
    meshes_for_3d_mill=[pipeline_2, meshes_for_3d_mill],
    milling_bit_diameter=milling_bit_diameter_2,
    roughing_stepover=roughing_stepover_2,
    finishing_stepover=finishing_stepover_2,
    pass_depth_roughing=pass_depth_2,
    roughing_material_leftover=roughing_material_leftover_2,
    generate_3d_roughing=generate_3d_roughing,
    generate_3d_finishing=generate_3d_finishing)  # -> rouging_toolpaths_5, finishing_toolpaths_6, cutout_curves_4, cutout_depths_3
automill_wip = AutomillWIP(breps_to_mill=[pipeline_3, breps_for_3d_mill])  # -> pocket_curves_4, pocket_depths_4, cutout_curves_3, cutout_depths_2, _3d_mill_surfaces_2, collision_detect_mesh_2

item_7 = ListItem(List=automill_wip.pocket_curves_4, Index=0, Wrap=True)
null = NullItem(Item=item_7)  # -> NullFlags, InvalidFlags, Description
filter_21 = StreamFilter(Gate=null.NullFlags, Stream0=automill_wip.pocket_curves_4, Stream1=[pipeline_5, cnc_pocket_curves])

# ---- group: Make finishing from automill
generate_3d_finishing_2 = Panel(generate_3d_finishing)
finishing_stepover_3 = Panel(finishing_stepover_2)
filter_22 = StreamFilter(Gate=generate_3d_finishing_2, Stream1=automill_wip.collision_detect_mesh_2)
filter_23 = StreamFilter(Gate=generate_3d_finishing_2, Stream1=automill_wip._3d_mill_surfaces_2)
surface_3d_mill = Surface3DMill(
    surfaces_for_3d_mill=filter_23,
    collision_mesh=filter_22,
    milling_bit_diameter=milling_bit_diameter_2,
    stepover=finishing_stepover_3,
    overshoot_margin_mm=overshoot_margin_mm_2,
    make_horizontal_toolpaths=make_horizontal_finishing_3,
    prioritize_fastest_milling_direction=prioritize_fastest_direction_4,
    include_surface_edges=include_surface_edges_4,
    use_ballnose_for_3d_milling=use_ballnose_for_3d_milling,
    connect_toolpaths_levels=connect_toolpaths_levels_2,
    tolerance=tolerance_2)
surface_3d_finishing_toolpaths = Curve(surface_3d_mill)

# ---- group: Make roughing from automill
generate_3d_roughing_2 = Panel(generate_3d_roughing)
roughing_material_leftover_3 = Panel(roughing_material_leftover_2)
roughing_stepover_3 = Panel(roughing_stepover_2)
multiplication = Multiplication(A=roughing_material_leftover_3, B="2")
filter_24 = StreamFilter(Gate=generate_3d_roughing_2, Stream1=automill_wip.cutout_curves_3)
filter_25 = StreamFilter(Gate=generate_3d_roughing_2, Stream1=automill_wip.collision_detect_mesh_2)
filter_26 = StreamFilter(Gate=generate_3d_roughing_2, Stream1=automill_wip._3d_mill_surfaces_2)
addition = Addition(A=milling_bit_diameter_2, B=multiplication)
addition_2 = Addition(A=overshoot_margin_mm, B=roughing_material_leftover_3)
surface_3d_mill_2 = Surface3DMill(
    surfaces_for_3d_mill=filter_26,
    collision_mesh=filter_25,
    milling_bit_diameter=addition,
    stepover=roughing_stepover_2,
    overshoot_margin_mm=addition_2,
    make_horizontal_toolpaths=make_horizontal_roughing_2,
    prioritize_fastest_milling_direction=prioritize_fastest_direction_6,
    include_surface_edges=include_surface_edges_2,
    use_ballnose_for_3d_milling=use_ballnose_for_3d_roughing_2,
    connect_toolpaths_levels=connect_toolpaths_levels_4,
    tolerance=tolerance)
roughing_material_leftover_4 = Number(roughing_material_leftover_2)
_3d_roughing_toolpaths = Curve(surface_3d_mill_2)
pass_depth_3 = Number(pass_depth_2)
make_pass_depths = MakePassDepths(
    toolpaths=_3d_roughing_toolpaths,
    pass_depth=pass_depth_3,
    roughing_material_leftover=roughing_material_leftover_4,
    outline_curves=filter_24,
    milling_bit_diameter=milling_bit_diameter_2,
    make_safety_pass_from_cutout=make_safety_pass_from_cutout_2)
surface_3d_roughing_toolpaths = Curve(make_pass_depths)

# ----
pocket_depths_from_automill = Number(automill_wip.pocket_depths_4)
item_8 = ListItem(List=pocket_depths_from_automill, Index=0, Wrap=True)
null_2 = NullItem(Item=item_8)  # -> NullFlags, InvalidFlags, Description
filter_27 = StreamFilter(Gate=null_2.NullFlags, Stream0=pocket_depths_from_automill, Stream1=pocket_depth_2)

cnc_drill_curves_2 = Curve(reparameterize(flatten([pipeline_4, cnc_drill_curves])))
drill = Drill(drill_curves=cnc_drill_curves_2, I=drill_depth_3, I_2=milling_bit_diameter_2)  # -> drill_toolpaths_3, drill_preview_geometry_3

cnc_line_engrave_curves = Curve(reparameterize(flatten([pipeline, cnc_engrave_curves])))
engrave = Engrave(engrave_curves=cnc_line_engrave_curves, cut_depth=engrave_depth_3, pass_depth=pass_depth_2)

surface_3d_roughing_toolpaths_2 = Curve(surface_3d_roughing_toolpaths)
rouging_toolpaths_3d_mesh = Curve(horizontal_3d_mill_from_mesh_wip.rouging_toolpaths_5)
surface_3d_finishing_toolpaths_2 = Curve(surface_3d_finishing_toolpaths)
finishing_toolpaths_3d_mesh = Curve(horizontal_3d_mill_from_mesh_wip.finishing_toolpaths_6)
merge = Merge(Data1=flatten(surface_3d_roughing_toolpaths_2), Data2=flatten(rouging_toolpaths_3d_mesh))
merge_2 = Merge(Data1=flatten(surface_3d_finishing_toolpaths_2), Data2=flatten(finishing_toolpaths_3d_mesh))

# ---- group: Home position
custom_jog_home_x = Slider(200, range=0..2440)
custom_jog_home_y = Slider(500, range=0..1000)
use_own_point = BooleanToggle(False)
pt = Point(Point(1935.636989, 102.2831628, 0))

# ----
pdecon = Deconstruct(Point=pt)  # -> XComponent, YComponent, ZComponent
int = Integer(pdecon.XComponent)
int_2 = Integer(pdecon.YComponent)

# ---- group: Home position (continued)
X = Panel(int)
Y = Panel(int_2)

# ----
filter_28 = StreamFilter(Gate=use_own_point, Stream0=custom_jog_home_x, Stream1=pdecon.XComponent)
filter_29 = StreamFilter(Gate=use_own_point, Stream0=custom_jog_home_y, Stream1=pdecon.YComponent)
bridge_preview = BridgePreview(custom_jog_home_x=filter_28, custom_jog_home_y=filter_29, colour="lightgray")

# ---- group: ShopBot PostProcessor settings
# PP
safe_z_height = Panel(safe_z)
job_name = Panel("Bark beetle stream")
use_spindle_2 = Panel(use_spindle)
spindle_speed_2 = Panel(spindle_speed)
use_custom_jog_home_2 = Panel(use_custom_jog_home)
custom_jog_home_x_2 = Panel(filter_28)
custom_jog_home_y_2 = Panel(filter_29)
deviation_tolerance_2 = Panel(deviation_tolerance)

# ----
cutout_curves_from_3d_mesh = Curve(flatten(horizontal_3d_mill_from_mesh_wip.cutout_curves_4))
cutout_curves_from_automill = Curve(flatten(automill_wip.cutout_curves_3))
cutout_depths_from_automill = Number(automill_wip.cutout_depths_2)
cutout_depths_from_3d_mesh = Number(horizontal_3d_mill_from_mesh_wip.cutout_depths_3)
merge_3 = Merge(Data1=flatten(cutout_curves_from_automill), Data2=flatten(cutout_curves_from_3d_mesh))
merge_4 = Merge(Data1=flatten(cutout_depths_from_automill), Data2=flatten(cutout_depths_from_3d_mesh))
cut_depths_from_automill_and_3d_mesh = Number(merge_4)
tab_breps_2 = Brep(flatten([pipeline_7, tab_breps]))
use_inside_cutting_from_easy_interface_2 = Panel(use_inside_cutting)
milling_bit_diameter_3 = Panel(milling_bit_diameter_2)
make_dogbones_4 = Panel(make_dogbones_3)
corner_angle_threshold = Panel(dogbone_corner_angle_threshold_2)
filter_30 = StreamFilter(Gate=use_inside_cutting_from_easy_interface_2, Stream0=Toggle(False), Stream1=Toggle(True))

item_9 = ListItem(List=merge_3, Index=0, Wrap=True)
null_3 = NullItem(Item=item_9)  # -> NullFlags, InvalidFlags, Description
filter_31 = StreamFilter(Gate=null_3.NullFlags, Stream0=merge_3, Stream1=[pipeline_6, cnc_cutout_curves])

cut_depths_from_automill_and_3d_mesh_2 = Number(cut_depths_from_automill_and_3d_mesh)
item_10 = ListItem(List=cut_depths_from_automill_and_3d_mesh_2, Index=0, Wrap=True)
null_4 = NullItem(Item=item_10)  # -> NullFlags, InvalidFlags, Description
filter_32 = StreamFilter(Gate=null_4.NullFlags, Stream0=cut_depths_from_automill_and_3d_mesh_2, Stream1=cutout_depth_2)

cnc_cutout_curves_2 = Curve(reparameterize(flatten(filter_31)))
gate = StreamGate(Stream=cnc_cutout_curves_2, Gate=make_dogbones_4)  # -> Target0, Target1
dogbone_maker = DogboneMaker(
    curves_to_dogbone=gate.Target1,
    milling_bit_diameter=milling_bit_diameter_3,
    corner_angle_threshold=corner_angle_threshold,
    flip_cornes_boolean=filter_30)
filter_33 = StreamFilter(Gate=make_dogbones_4, Stream0=gate.Target0, Stream1=dogbone_maker)
cutout = Cutout(
    curves_for_cutout=filter_33,
    cut_depth=filter_32,
    pass_depth=pass_depth_2,
    tool_diameter=milling_bit_diameter_2,
    cutout_tolerance=cutout_tolerance_2,
    use_climb_direction=use_climb_direction_2,
    use_inside_cutting=use_inside_cutting_3)

shopbot_code_postprocessor = ShopBotCodePostProcessor(
    toolpath_curves=merge_2,
    tab_breps=tab_breps_2,
    feed_rate=feed_rate_2,
    plunge_rate=plunge_rate_2,
    safe_z_height=safe_z_height,
    use_spindle=use_spindle_2,
    spindle_speed=spindle_speed_2,
    ramp_plunges=ramp_plunges_2,
    ramp_angle=ramp_angle_2,
    use_custom_jog_home=use_custom_jog_home_2,
    custom_home_x=custom_jog_home_x_2,
    custom_home_y=custom_jog_home_y_2,
    deviation_tolerance=deviation_tolerance_2,
    milling_bit_diameter=milling_bit_diameter_2,
    job_name=job_name)  # -> toolpath_preview_curves_2, tab_cleanup_preview_curves_2, cut_transition_preview_lines_2, cut_entry_preview_lines_2, cut_exit_preview_lines_2, shopbot_code_connect_panel_stream_and_sa, tab_cleanup_code_connect_panel_stream_an
# Post processing, set output directory here:
shopbot_code_postprocessor_2 = ShopBotCodePostProcessor(
    toolpath_curves=drill.drill_toolpaths_3,
    tab_breps=tab_breps_2,
    feed_rate=feed_rate_2,
    plunge_rate=plunge_rate_2,
    safe_z_height=safe_z_height,
    use_spindle=use_spindle_2,
    spindle_speed=spindle_speed_2,
    ramp_plunges=ramp_plunges_2,
    ramp_angle=ramp_angle_2,
    use_custom_jog_home=use_custom_jog_home_2,
    custom_home_x=custom_jog_home_x_2,
    custom_home_y=custom_jog_home_y_2,
    deviation_tolerance=deviation_tolerance_2,
    milling_bit_diameter=milling_bit_diameter_2,
    job_name=job_name)  # -> toolpath_preview_curves_2, tab_cleanup_preview_curves_2, cut_transition_preview_lines_2, cut_entry_preview_lines_2, cut_exit_preview_lines_2, shopbot_code_connect_panel_stream_and_sa, tab_cleanup_code_connect_panel_stream_an
shopbot_code_postprocessor_3 = ShopBotCodePostProcessor(
    toolpath_curves=engrave,
    tab_breps=tab_breps_2,
    feed_rate=feed_rate_2,
    plunge_rate=plunge_rate_2,
    safe_z_height=safe_z_height,
    use_spindle=use_spindle_2,
    spindle_speed=spindle_speed_2,
    ramp_plunges=ramp_plunges_2,
    ramp_angle=ramp_angle_2,
    use_custom_jog_home=use_custom_jog_home_2,
    custom_home_x=custom_jog_home_x_2,
    custom_home_y=custom_jog_home_y_2,
    deviation_tolerance=deviation_tolerance_2,
    milling_bit_diameter=milling_bit_diameter_2,
    job_name=job_name)  # -> toolpath_preview_curves_2, tab_cleanup_preview_curves_2, cut_transition_preview_lines_2, cut_entry_preview_lines_2, cut_exit_preview_lines_2, shopbot_code_connect_panel_stream_and_sa, tab_cleanup_code_connect_panel_stream_an
shopbot_code_postprocessor_4 = ShopBotCodePostProcessor(
    toolpath_curves=cutout,
    tab_breps=tab_breps_2,
    feed_rate=feed_rate_2,
    plunge_rate=plunge_rate_2,
    safe_z_height=safe_z_height,
    use_spindle=use_spindle_2,
    spindle_speed=spindle_speed_2,
    ramp_plunges=ramp_plunges_2,
    ramp_angle=ramp_angle_2,
    use_custom_jog_home=use_custom_jog_home_2,
    custom_home_x=custom_jog_home_x_2,
    custom_home_y=custom_jog_home_y_2,
    deviation_tolerance=deviation_tolerance_2,
    milling_bit_diameter=milling_bit_diameter_2,
    job_name=job_name)  # -> toolpath_preview_curves_2, tab_cleanup_preview_curves_2, cut_transition_preview_lines_2, cut_entry_preview_lines_2, cut_exit_preview_lines_2, shopbot_code_connect_panel_stream_and_sa, tab_cleanup_code_connect_panel_stream_an
shopbot_code_postprocessor_5 = ShopBotCodePostProcessor(
    toolpath_curves=merge,
    tab_breps=tab_breps_2,
    feed_rate=feed_rate_2,
    plunge_rate=plunge_rate_2,
    safe_z_height=safe_z_height,
    use_spindle=use_spindle_2,
    spindle_speed=spindle_speed_2,
    ramp_plunges=ramp_plunges_2,
    ramp_angle=ramp_angle_2,
    use_custom_jog_home=use_custom_jog_home_2,
    custom_home_x=custom_jog_home_x_2,
    custom_home_y=custom_jog_home_y_2,
    deviation_tolerance=deviation_tolerance_2,
    milling_bit_diameter=milling_bit_diameter_2,
    job_name=job_name)  # -> toolpath_preview_curves_2, tab_cleanup_preview_curves_2, cut_transition_preview_lines_2, cut_entry_preview_lines_2, cut_exit_preview_lines_2, shopbot_code_connect_panel_stream_and_sa, tab_cleanup_code_connect_panel_stream_an

# ---- group: Engrave ShopBot code
stream_and_save_as_sbp = Panel(shopbot_code_postprocessor_3.shopbot_code_connect_panel_stream_and_sa)

# ---- group: 3D roughing shopbot code
stream_and_save_as_sbp_2 = Panel(shopbot_code_postprocessor_5.shopbot_code_connect_panel_stream_and_sa)

# ---- group: Drill ShopBot code
stream_and_save_as_sbp_3 = Panel(shopbot_code_postprocessor_2.shopbot_code_connect_panel_stream_and_sa)

# ---- group: Cut ShopBot code
stream_and_save_as_sbp_4 = Panel(shopbot_code_postprocessor_4.shopbot_code_connect_panel_stream_and_sa)

# ---- group: Tab cleanup ShopBot code
stream_and_save_as_sbp_5 = Panel(shopbot_code_postprocessor_4.tab_cleanup_code_connect_panel_stream_an)

# ---- group: 3D finishing Shopbot code
stream_and_save_as_sbp_6 = Panel(shopbot_code_postprocessor.shopbot_code_connect_panel_stream_and_sa)

# ----
tab_cleanup_preview_lines = Curve(shopbot_code_postprocessor_4.tab_cleanup_preview_curves_2)

cnc_pocket_curves_2 = Curve(reparameterize(flatten(filter_21)))

# ---- group: Add dogbones to pockets
milling_bit_diameter_4 = Panel(milling_bit_diameter_2)
# Toolpath generation:
make_dogbones_5 = Panel(make_dogbones_3)
corner_angle_threshold_2 = Panel(dogbone_corner_angle_threshold_2)
gate_2 = StreamGate(Stream=cnc_pocket_curves_2, Gate=make_dogbones_5)  # -> Target0, Target1
dogbone_maker_2 = DogboneMaker(
    curves_to_dogbone=gate_2.Target1,
    milling_bit_diameter=milling_bit_diameter_4,
    corner_angle_threshold=corner_angle_threshold_2,
    flip_cornes_boolean=Toggle(True))
filter_34 = StreamFilter(Gate=make_dogbones_5, Stream0=gate_2.Target0, Stream1=dogbone_maker_2)

# ----
pocket = Pocket(
    curves_for_raster_pocket=filter_34,
    cut_depth_pocket=filter_27,
    pass_depth=pass_depth_2,
    tool_diameter=milling_bit_diameter_2,
    stepover_0_1=pocket_stepover_2,
    raster_along_y_0_1=raster_direction_along_y_2)  # -> pocket_toolpaths_2, feed_rate_multiplier_4

optimize_feedrate = OptimizeFeedrate(feed_rate=feed_rate_2, feed_rate_multiplier=pocket.feed_rate_multiplier_4)  # disabled
boosted_feed_rate = Number(optimize_feedrate)
shopbot_code_postprocessor_6 = ShopBotCodePostProcessor(
    toolpath_curves=pocket.pocket_toolpaths_2,
    tab_breps=tab_breps_2,
    feed_rate=feed_rate_2,
    plunge_rate=plunge_rate_2,
    safe_z_height=safe_z_height,
    use_spindle=use_spindle_2,
    spindle_speed=spindle_speed_2,
    ramp_plunges=ramp_plunges_2,
    ramp_angle=ramp_angle_2,
    use_custom_jog_home=use_custom_jog_home_2,
    custom_home_x=custom_jog_home_x_2,
    custom_home_y=custom_jog_home_y_2,
    deviation_tolerance=deviation_tolerance_2,
    milling_bit_diameter=milling_bit_diameter_2,
    job_name=job_name)  # -> toolpath_preview_curves_2, tab_cleanup_preview_curves_2, cut_transition_preview_lines_2, cut_entry_preview_lines_2, cut_exit_preview_lines_2, shopbot_code_connect_panel_stream_and_sa, tab_cleanup_code_connect_panel_stream_an

# ---- group: Pocket ShopBot code
stream_and_save_as_sbp_7 = Panel(shopbot_code_postprocessor_6.shopbot_code_connect_panel_stream_and_sa)

# ---- group: Make .svg file for projector preview
surface_3d_roughing_toolpaths_3 = Curve(surface_3d_roughing_toolpaths)
surface_3d_finishing_toolpaths_3 = Curve(surface_3d_finishing_toolpaths)
measured_projected_size = Slider(279, range=0..1000)
expected_projected_size = Slider(300, range=0..1000)
scale_overide_x = Panel(".965")
scale_overide_y = Panel("1")
position_y = Panel("-1276")
rotation_correction = Panel("90.6")
position_x = Panel("16")
drill_preview_geometry = Curve(drill.drill_preview_geometry_3)
engrave_toolpaths = Curve(flatten(engrave))
cutout_toolpaths = Curve(flatten(cutout))
_3d_mill_toolpaths = Curve(flatten([surface_3d_roughing_toolpaths_3, surface_3d_finishing_toolpaths_3]))
pocket_toolpaths = Curve(flatten(pocket.pocket_toolpaths_2))
cutting_curves = Curve(filter_33)
pocket_curves = Curve(filter_34)
preview_graphic_for_1_1_projection_on_ma = PreviewGraphicFor11ProjectionOnMachine(
    toolpath_curves=[pocket_toolpaths, cutout_toolpaths, engrave_toolpaths, _3d_mill_toolpaths],
    cutting_curves=cutting_curves,
    pocket_curves=pocket_curves,
    drill_preview_curves=drill_preview_geometry,
    expected_projected_size=expected_projected_size,
    measured_projected_size=measured_projected_size,
    position_correction_x=position_x,
    position_correction_y=position_y,
    rotation_correction=rotation_correction,
    svg_px_width="1279",
    svg_px_heigth="719",
    scale_overide_x=scale_overide_x,
    scale_overide_y=scale_overide_y)  # "Preview graphic for 1:1 projection on machine"
stream_and_save_as_svg = Panel(preview_graphic_for_1_1_projection_on_ma)

# ---- group: Toolpath preview
pocket_toolpaths_2 = Curve(shopbot_code_postprocessor_6.toolpath_preview_curves_2)
cut_toolpaths = Curve(shopbot_code_postprocessor_4.toolpath_preview_curves_2)
_3d_rough_toolpaths = Curve(shopbot_code_postprocessor_5.toolpath_preview_curves_2)
use_inside_cutting_4 = Panel(use_inside_cutting_3)
engrave_toolpaths_2 = Curve(shopbot_code_postprocessor_3.toolpath_preview_curves_2)
_3d_finish_toolpaths = Curve(shopbot_code_postprocessor.toolpath_preview_curves_2)
cut_exit_preview_lines = Curve([shopbot_code_postprocessor_2.cut_exit_preview_lines_2, shopbot_code_postprocessor_4.cut_exit_preview_lines_2, shopbot_code_postprocessor_5.cut_exit_preview_lines_2, shopbot_code_postprocessor.cut_exit_preview_lines_2, shopbot_code_postprocessor_6.cut_exit_preview_lines_2, shopbot_code_postprocessor_3.cut_exit_preview_lines_2])
cut_transition_preview_lines = Curve([shopbot_code_postprocessor_2.cut_transition_preview_lines_2, shopbot_code_postprocessor_4.cut_transition_preview_lines_2, shopbot_code_postprocessor_5.cut_transition_preview_lines_2, shopbot_code_postprocessor.cut_transition_preview_lines_2, shopbot_code_postprocessor_6.cut_transition_preview_lines_2, shopbot_code_postprocessor_3.cut_transition_preview_lines_2])
cut_entry_preview_lines = Curve([shopbot_code_postprocessor_2.cut_entry_preview_lines_2, shopbot_code_postprocessor_4.cut_entry_preview_lines_2, shopbot_code_postprocessor_5.cut_entry_preview_lines_2, shopbot_code_postprocessor.cut_entry_preview_lines_2, shopbot_code_postprocessor_6.cut_entry_preview_lines_2, shopbot_code_postprocessor_3.cut_entry_preview_lines_2])
engrave_color_2 = Colour(engrave_color)
_3d_rough_color_2 = Colour(_3d_rough_color)
_3d_finish_color_2 = Colour(_3d_finish_color)
pocket_color_2 = Colour(pocket_color)
cut_color_2 = Colour(cut_color)
jog_transitions = ColourSwatch(SwatchColor=RGB(71, 61, 38))
drill_preview_geometry_2 = Curve(drill.drill_preview_geometry_3)
tab_cleanup = ColourSwatch(SwatchColor=RGB(74, 74, 74))
hold_down = ColourSwatch(SwatchColor=RGB(255, 191, 0))
cut_entries = ColourSwatch(SwatchColor=RGB(145, 193, 194))
cut_exits = ColourSwatch(SwatchColor=RGB(61, 88, 89))
filter_35 = StreamFilter(Gate=use_inside_cutting_4, Stream0=_3d_finish_color_2, Stream1=ColourSwatch(SwatchColor=RGB(255, 61, 155)))
filter_36 = StreamFilter(Gate=use_inside_cutting_4, Stream0=engrave_color_2, Stream1=ColourSwatch(SwatchColor=RGB(255, 61, 155)))
filter_37 = StreamFilter(Gate=use_inside_cutting_4, Stream0=pocket_color_2, Stream1=ColourSwatch(SwatchColor=RGB(255, 61, 155)))
filter_38 = StreamFilter(Gate=use_inside_cutting_4, Stream0=cut_color_2, Stream1=ColourSwatch(SwatchColor=RGB(255, 61, 155)))
filter_39 = StreamFilter(Gate=use_inside_cutting_4, Stream0=_3d_rough_color_2, Stream1=ColourSwatch(SwatchColor=RGB(255, 61, 155)))
preview = CustomPreview(Geometry=_3d_finish_toolpaths, Shader=filter_35)
preview_2 = CustomPreview(Geometry=cut_transition_preview_lines, Shader=jog_transitions)
preview_3 = CustomPreview(Geometry=cut_entry_preview_lines, Shader=cut_entries)
preview_4 = CustomPreview(Geometry=cut_exit_preview_lines, Shader=cut_exits)
preview_5 = CustomPreview(Geometry=drill_preview_geometry_2, Shader=hold_down)
preview_6 = CustomPreview(Geometry=engrave_toolpaths_2, Shader=filter_36)
preview_7 = CustomPreview(Geometry=tab_cleanup_preview_lines, Shader=tab_cleanup)
preview_8 = CustomPreview(Geometry=pocket_toolpaths_2, Shader=filter_37)
preview_9 = CustomPreview(Geometry=cut_toolpaths, Shader=filter_38)
preview_10 = CustomPreview(Geometry=_3d_rough_toolpaths, Shader=filter_39)

# ----
all_toolpath_preview_curves = Curve([shopbot_code_postprocessor_2.toolpath_preview_curves_2, shopbot_code_postprocessor_4.toolpath_preview_curves_2, shopbot_code_postprocessor_5.toolpath_preview_curves_2, shopbot_code_postprocessor.toolpath_preview_curves_2, shopbot_code_postprocessor_6.toolpath_preview_curves_2, shopbot_code_postprocessor_3.toolpath_preview_curves_2])

len = Length(Curve=cut_transition_preview_lines)
jog_rate = Panel("150")
ma = MassAddition(Input=len)  # -> Result, PartialResults
panel = Panel(ma.Result)
division = Division(A=panel, B=jog_rate)
division_2 = Division(A=division, B="60")
estimated_time = Panel(division_2)

len_2 = Length(Curve=all_toolpath_preview_curves)
feed_rate_3 = Panel(feed_rate_2)
ma_2 = MassAddition(Input=len_2)  # -> Result, PartialResults
panel_2 = Panel(ma_2.Result)
division_3 = Division(A=panel_2, B=feed_rate_3)
division_4 = Division(A=division_3, B="60")
estimated_time_2 = Panel(division_4)

len_3 = Length(Curve=[cut_entry_preview_lines, cut_exit_preview_lines])
feed_rate_4 = Panel(feed_rate_2)
ma_3 = MassAddition(Input=len_3)  # -> Result, PartialResults
panel_3 = Panel(ma_3.Result)
division_5 = Division(A=panel_3, B=feed_rate_4)
division_6 = Division(A=division_5, B="60")
estimated_time_3 = Panel(division_6)

# ---- group: find deepest Z for summary info
find_deepest_z = FindDeepestZ(toolpaths=all_toolpath_preview_curves)
deepest_z = Panel(find_deepest_z)

# ----
ma_4 = MassAddition(Input=[estimated_time_2, estimated_time, estimated_time_3])  # -> Result, PartialResults
estimated_job_minutes = Integer(ma_4.Result)
estimated_time_4 = Panel(estimated_job_minutes)
compile_settings = CompileSettings(
    estimated_job_time=estimated_time_4,
    feed_rate=feed_rate_2,
    plunge_rate=plunge_rate_2,
    spindle_rpm=spindle_speed_2,
    pass_depth=pass_depth_2,
    ramp_plunges=ramp_plunges_2,
    ramp_angle=ramp_angle_2,
    deepest_z=find_deepest_z)  # -> complete_settings, crucial_settings

# ---- group: Current settings
panel_4 = Panel(compile_settings.complete_settings)

# ==== cluster Pocket
curves_for_raster_pocket = ClusterInput()
cut_depth_pocket = ClusterInput()
raster_along_y_0_1 = ClusterInput()
tool_diameter = ClusterInput()
stepover_0_1 = ClusterInput()
pass_depth = ClusterInput()
cut_depth_pocket_2 = Number(flatten(cut_depth_pocket))

# ---- group: Filter out open curves
curves_for_raster_pocket_2 = Curve(flatten(curves_for_raster_pocket))
cls = Closed(Curve=curves_for_raster_pocket_2)  # -> Closed, Periodic
dispatch = Dispatch(List=curves_for_raster_pocket_2, DispatchPattern=cls.Closed)  # -> ListA, ListB
dispatch_2 = Dispatch(List=cut_depth_pocket_2, DispatchPattern=cls.Closed)  # -> ListA, ListB

# ----
raster_trim_safety_distance = Panel("0.09")
raster_along_y_0_1_2 = Integer(raster_along_y_0_1)
tool_diameter_2 = Number(tool_diameter)
stepover_0_1_2 = Number(stepover_0_1)
pass_depth_2 = Number(pass_depth)
xy = XYPlane(Origin=Point(0, 0, 0))
multiplication = Multiplication(A=tool_diameter_2, B="0.5")
multiplication_2 = Multiplication(A=tool_diameter_2, B=stepover_0_1_2)
operation_plane = Plane(xy)
tool_radius = Panel(multiplication)
stepover_distance = Panel(multiplication_2)
tool_radius_2 = Panel(tool_radius)

# ---- group: Merge overlapping curves //removed for alowing multiple side by side pocket depths
curves_for_merging_overlap = Curve()
mcx = MultipleCurves(Curves=curves_for_merging_overlap)  # -> Points, IndexA, IndexB, ParamA, ParamB
dcon = DeleteConsecutive(Set=[mcx.IndexA, mcx.IndexB], Wrap=False)  # -> Set, Count
item = ListItem(List=curves_for_merging_overlap, Index=dcon.Set, Wrap=True)
cull_i = CullIndex(List=curves_for_merging_overlap, Indices=dcon.Set, Wrap=True)
runion = RegionUnion(Curves=item, Plane=operation_plane)
merged_overlapping_curves = Curve([runion, cull_i])

# ---- group: Align curve directions
curves_for_aligned_direction = Curve(dispatch.ListA)
graft = GraftTree(Tree=curves_for_aligned_direction, IncludeEmptyLists=True, IncludeNullItems=True)
offset = Offset(Curve=graft, Distance="0.01", Plane=PlaneXY(0, 0, 0), Corners=2)
end = EndPoints(Curve=offset)  # -> Start, End
pshift = ShiftPaths(Data=end.Start, Offset=-1)
incurve = PointInCurve(Point=pshift, Curve=graft)  # -> Relationship, Point
multiplication_3 = Multiplication(A=incurve.Relationship, B="0.5")
round = Round(Number=multiplication_3)  # -> Nearest, Floor, Ceiling
crv = Curve(graft)
int = Integer(round.Nearest)
flip = FlipCurve(Curve=crv)  # -> Curve, Flag
weave = Weave(Pattern=int, Stream0=flip.Curve, Stream1=crv, NullGaps=False)
pshift_2 = ShiftPaths(Data=weave, Offset=-1)
aligned_curves = Curve(pshift_2)

# ---- group: Detect curves inside curves
aligned_curves_2 = Curve(aligned_curves)
area = Area(Geometry=aligned_curves_2)  # -> Area, Centroid
graft_2 = GraftTree(Tree=aligned_curves_2, IncludeEmptyLists=True, IncludeNullItems=True)
end_2 = EndPoints(Curve=aligned_curves_2)  # -> Start, End
crv_cp = CurveClosestPoint(Point=area.Centroid, Curve=aligned_curves_2)  # -> Point, Parameter, Distance
incurve_2 = PointInCurve(Point=crv_cp.Point, Curve=graft_2)  # -> Relationship, Point
multiplication_4 = Multiplication(A=incurve_2.Relationship, B="0.5")
round_2 = Round(Number=multiplication_4)  # -> Nearest, Floor, Ceiling
int_2 = Integer(round_2.Floor)
flip_2 = FlipMatrix(Data=int_2)
cut_depth_pocket_3 = Number(dispatch_2.ListA)
ma = MassAddition(Input=flip_2)  # -> Result, PartialResults
pshift_3 = ShiftPaths(Data=ma.Result, Offset=-1)
dispatch_3 = Dispatch(List=cut_depth_pocket_3, DispatchPattern=pshift_3)  # -> ListA, ListB
dispatch_4 = Dispatch(List=aligned_curves_2, DispatchPattern=pshift_3)  # -> ListA, ListB
cut_depths_outer_pocket = Number(cut_depth_pocket_3)
curves_outside = Curve(dispatch_4.ListB)
curves_inside = Curve(dispatch_4.ListA)

# ----
curves_for_offset_outwards = Curve(curves_inside)
curves_for_offset_inwards = Curve(curves_outside)
operation_plane_2 = Plane(operation_plane)
neg = Negative(Value=tool_radius_2)
offset_2 = Offset(Curve=curves_for_offset_inwards, Distance=tool_radius_2, Plane=operation_plane_2, Corners=2)
offset_3 = Offset(Curve=curves_for_offset_outwards, Distance=neg, Plane=operation_plane_2, Corners=2)
pshift_4 = ShiftPaths(Data=offset_3, Offset=-1)
pshift_5 = ShiftPaths(Data=offset_2, Offset=-1)

# ---- group: Merge overlapping inside curves
curves_for_merging_overlap_2 = Curve(pshift_4)
mcx_2 = MultipleCurves(Curves=curves_for_merging_overlap_2)  # -> Points, IndexA, IndexB, ParamA, ParamB
dcon_2 = DeleteConsecutive(Set=[mcx_2.IndexA, mcx_2.IndexB], Wrap=False)  # -> Set, Count
item_2 = ListItem(List=curves_for_merging_overlap_2, Index=dcon_2.Set, Wrap=True)
runion_2 = RegionUnion(Curves=item_2, Plane=operation_plane_2)
cull_i_2 = CullIndex(List=curves_for_merging_overlap_2, Indices=dcon_2.Set, Wrap=True)
merged_overlapping_curves_2 = Curve([runion_2, cull_i_2])

# ----
operation_plane_3 = Plane(operation_plane_2)

# ---- group: Detect narrow gaps
graft_3 = GraftTree(Tree=merged_overlapping_curves_2, IncludeEmptyLists=True, IncludeNullItems=True)
ccx = CurveCurve(CurveA=flatten(pshift_5), CurveB=graft_3)  # -> Points, ParamsA, ParamsB
lng = ListLength(List=ccx.ParamsB)
larger = LargerThan(FirstNumber=lng, SecondNumber="0")  # -> LargerThan, OrEqualTo
pshift_6 = ShiftPaths(Data=larger.LargerThan, Offset=-1)
ma_2 = MassAddition(Input=pshift_6)  # -> Result, PartialResults
pshift_7 = ShiftPaths(Data=ma_2.Result, Offset=-1)
dispatch_5 = Dispatch(List=merged_overlapping_curves_2, DispatchPattern=pshift_7)  # -> ListA, ListB
rdiff = RegionDifference(CurvesA=pshift_5, CurvesB=dispatch_5.ListA, Plane=operation_plane_3)
inside_outline_curves = Curve(dispatch_5.ListB)
fixed_outline_curves = Curve(rdiff)

# ----
curves_for_raster_generation = Curve(fixed_outline_curves)
raster_direction_bollean = Integer(raster_along_y_0_1_2)

oultine_curve = Curve(curves_for_raster_generation)
X = UnitX(Factor=1)
Y = UnitY(Factor=1)
bbox = BoundingBox(Content=oultine_curve, Plane=PlaneXY(0, 0, 0))  # -> Box, Box_2
rev = Reverse(Vector=Y)
edges = BrepEdges(Brep=bbox.Box)  # -> Naked, Interior, NonManifold
filter = StreamFilter(Gate=raster_direction_bollean, Stream0="2", Stream1="3")
filter_2 = StreamFilter(Gate=raster_direction_bollean, Stream0="3", Stream1="2")
filter_3 = StreamFilter(Gate=raster_direction_bollean, Stream0=rev, Stream1=X)
item_3 = ListItem(List=edges.Naked, Index=filter_2, Wrap=True)
item_4 = ListItem(List=edges.Naked, Index=filter, Wrap=True)
len = Length(Curve=item_3)
stepover_distance_2 = Panel(stepover_distance)
division = Division(A=len, B=stepover_distance_2)
round_3 = Round(Number=division)  # -> Nearest, Floor, Ceiling
series = Series(Start=stepover_distance_2, Step=stepover_distance_2, Count=round_3.Floor)
amp = Amplitude(Vector=filter_3, Amplitude=series)
move = Move(Geometry=item_4, Motion=amp)  # -> Geometry, Transform
raster_curves = Curve(move.Geometry)

raster_cutoff_safety_factor = Panel("0.05")
raster_trim_safety_distance_2 = Panel(raster_trim_safety_distance)

# ---- group: Trim raster curves
dispatch_6 = Dispatch(List=flatten(raster_curves), DispatchPattern=[True, False])  # -> ListA, ListB
operation_plane_4 = Plane(operation_plane)
oultine_curve_2 = Curve(curves_for_raster_generation)
flip_3 = FlipCurve(Curve=dispatch_6.ListA)  # -> Curve, Flag
weave_2 = Weave(Pattern=[0, 1], Stream0=flip_3.Curve, Stream1=dispatch_6.ListB, NullGaps=False)
raster_curves_2 = Curve(weave_2)
offset_4 = Offset(Curve=oultine_curve_2, Distance=raster_trim_safety_distance_2, Plane=operation_plane_4, Corners=1)
trim = TrimWithRegion(Curve=raster_curves_2, Region=offset_4, Plane=operation_plane_4)  # -> Inside, Outside
simplify = SimplifyTree(Tree=trim.Inside, Front=False)
trimmed_raster_curves = Curve(simplify)

# ----
multiplication_5 = Multiplication(A=tool_radius_2, B=raster_cutoff_safety_factor)

# ---- group: Filter short curves
stepover_distance_3 = Panel(stepover_distance_2)
len_2 = Length(Curve=trimmed_raster_curves)
multiplication_6 = Multiplication(A=stepover_distance_3, B="0.8")
smaller = SmallerThan(FirstNumber=len_2, SecondNumber=multiplication_6)  # -> SmallerThan, OrEqualTo
dispatch_7 = Dispatch(List=trimmed_raster_curves, DispatchPattern=smaller.SmallerThan)  # -> ListA, ListB
trimmed_and_filtered_raster_curves = Curve(dispatch_7.ListB)

# ---- group: Create line connections
oultine_curve_3 = Curve(oultine_curve_2)
lng_2 = ListLength(List=flatten(oultine_curve_3))
smaller_2 = SmallerThan(FirstNumber=lng_2, SecondNumber="2")  # -> SmallerThan, OrEqualTo
flatten = FlattenTree(Tree=trimmed_and_filtered_raster_curves, Path="{0}")
pshift_8 = ShiftPaths(Data=trimmed_and_filtered_raster_curves, Offset=-1)
filter_4 = StreamFilter(Gate=smaller_2.SmallerThan, Stream0=pshift_8, Stream1=flatten)
crv_2 = Curve(filter_4)
shift = ShiftList(List=crv_2, Shift="-1", Wrap=False)
shift_2 = ShiftList(List=crv_2, Shift="1", Wrap=False)
end_3 = EndPoints(Curve=shift)  # -> Start, End
end_4 = EndPoints(Curve=shift_2)  # -> Start, End
ln = Line(StartPoint=end_3.End, EndPoint=end_4.Start)

# ---- group: Collsion detect innside outline curves
inside_outline_curves_2 = Curve(inside_outline_curves)
curves_for_offset_inwards_2 = Curve(curves_for_offset_inwards)
colom = CollisionOneMany(Collider=graft(inside_outline_curves_2), Obstacles=curves_for_offset_inwards_2)  # -> Collision, Index
dispatch_8 = Dispatch(List=graft(inside_outline_curves_2), DispatchPattern=colom.Collision)  # -> ListA, ListB
pshift_9 = ShiftPaths(Data=dispatch_8.ListB, Offset=-1)
collsion_detected_inside_outline_curves = Curve(pshift_9)

# ----
cut_depths_outer_pocket_2 = Number(flatten(cut_depths_outer_pocket))

# ---- group: Filter intersecting curves
line_connections = Curve(ln)
inside_outline_curves_3 = Curve(inside_outline_curves)
oultine_curve_4 = Curve(oultine_curve_2)
colom_2 = CollisionOneMany(Collider=line_connections, Obstacles=oultine_curve_4)  # -> Collision, Index
dispatch_9 = Dispatch(List=line_connections, DispatchPattern=colom_2.Collision)  # -> ListA, ListB
colom_3 = CollisionOneMany(Collider=dispatch_9.ListB, Obstacles=inside_outline_curves_3)  # -> Collision, Index
dispatch_10 = Dispatch(List=line_connections, DispatchPattern=colom_3.Collision)  # -> ListA, ListB

# ----
eval = EvaluateLength(Curve=dispatch_10.ListB, Length="0.5", Normalized=True)  # -> Point, Tangent, Parameter
incurve_3 = PointInCurve(Point=eval.Point, Curve=oultine_curve_4)  # -> Relationship, Point
multiplication_7 = Multiplication(A=incurve_3.Relationship, B="0.5")
bool = Boolean(multiplication_7)
dispatch_11 = Dispatch(List=dispatch_10.ListB, DispatchPattern=bool)  # -> ListA, ListB

# ---- group: Filter intersecting curves (continued)
connection_lines = Curve(dispatch_11.ListA)

# ---- group: Trim with inside outline curves
connection_lines_2 = Curve(connection_lines)
trimmed_and_filtered_raster_curves_2 = Curve(trimmed_and_filtered_raster_curves)
inside_outline_curves_4 = Curve(inside_outline_curves)
operation_plane_5 = Plane(operation_plane)
neg_2 = Negative(Value=raster_trim_safety_distance_2)
offset_5 = Offset(Curve=inside_outline_curves_4, Distance=neg_2, Plane=operation_plane_5, Corners=1)
oultine_curve_5 = Curve(oultine_curve_2)
lng_3 = ListLength(List=flatten(oultine_curve_5))
smaller_3 = SmallerThan(FirstNumber=lng_3, SecondNumber="2")  # -> SmallerThan, OrEqualTo
pshift_10 = ShiftPaths(Data=trimmed_and_filtered_raster_curves_2, Offset=-1)
flatten_2 = FlattenTree(Tree=trimmed_and_filtered_raster_curves_2, Path="{0}")
filter_5 = StreamFilter(Gate=smaller_3.SmallerThan, Stream0=pshift_10, Stream1=flatten_2)
pshift_11 = ShiftPaths(Data=offset_5, Offset=-1)
lng_4 = ListLength(List=flatten(inside_outline_curves_4))
smaller_4 = SmallerThan(FirstNumber=lng_4, SecondNumber="1")  # -> SmallerThan, OrEqualTo
trim_2 = TrimWithRegions(Curve=filter_5, Regions=pshift_11, Plane=operation_plane_4)  # -> Inside, Outside

# ----
filter_6 = StreamFilter(Gate=smaller_4.SmallerThan, Stream0=trim_2.Outside, Stream1=filter_5)

# ---- group: Trim with inside outline curves (continued)
crv_3 = Curve(filter_6)
join = JoinCurves(Curves=flatten([connection_lines_2, crv_3]), Preserve=True)
raster_curves_3 = Curve(join)

# ----
end_5 = EndPoints(Curve=raster_curves_3)  # -> Start, End
cps = ClosestPoints(Point=end_5.End, Cloud=end_5.Start, Count=2)  # -> ClosestPoint, CPIndex, Distance
dist = Distance(PointA=graft(end_5.Start), PointB=cps.ClosestPoint)
equals = Equality(FirstNumber=dist, SecondNumber="0")  # -> Equality, Inequality
dispatch_12 = Dispatch(List=cps.ClosestPoint, DispatchPattern=equals.Equality)  # -> ListA, ListB
item_5 = ListItem(List=dispatch_12.ListB, Index=0, Wrap=True)
ln_2 = Line(StartPoint=item_5, EndPoint=graft(end_5.End))

merge = Merge(Data1=inside_outline_curves_4, Data2=oultine_curve_4)
insied_and_outside_outline_curves = Curve(flatten(merge))
line_connections_2 = Curve(ln_2)
colom_4 = CollisionOneMany(Collider=line_connections_2, Obstacles=insied_and_outside_outline_curves)  # -> Collision, Index
dispatch_13 = Dispatch(List=line_connections_2, DispatchPattern=colom_4.Collision)  # -> ListA, ListB
stepover_distance_4 = Panel(stepover_distance_2)
len_3 = Length(Curve=dispatch_13.ListB)
multiplication_8 = Multiplication(A=stepover_distance_4, B="3")
larger_2 = LargerThan(FirstNumber=len_3, SecondNumber=multiplication_8)  # -> LargerThan, OrEqualTo
dispatch_14 = Dispatch(List=dispatch_13.ListB, DispatchPattern=larger_2.LargerThan)  # -> ListA, ListB
extra_connection_lines = Curve(dispatch_14.ListB)

extra_connection_lines_2 = Curve(extra_connection_lines)
raster_curves_4 = Curve(join)
join_2 = JoinCurves(Curves=flatten([raster_curves_4, extra_connection_lines_2]), Preserve=False)
raster_curves_5 = Curve(join_2)

inside_outline_curves_5 = Curve(collsion_detected_inside_outline_curves)
oultine_curve_6 = Curve(curves_for_raster_generation)
raster_curves_6 = Curve(raster_curves_5)
flatten_3 = FlattenTree(Tree=oultine_curve_6, Path="{0}")
end_6 = EndPoints(Curve=inside_outline_curves_5)  # -> Start, End
incurves = PointInCurves(Point=end_6.Start, Curves=flatten_3)  # -> Relationship, Index, Point
addition = Addition(A=incurves.Index, B="1")
# fix curve order fail when no raster lines
# fix offset from when 1 line becomes more ? (narrow channels)
ins = InsertItems(List=flatten_3, Item=inside_outline_curves_5, Indices=addition, Wrap=True)
end_7 = EndPoints(Curve=raster_curves_6)  # -> Start, End
incurves_2 = PointInCurves(Point=end_7.Start, Curves=ins)  # -> Relationship, Index, Point
ins_2 = InsertItems(List=ins, Item=raster_curves_6, Indices=incurves_2.Index, Wrap=True)
flatten_4 = FlattenTree(Tree=ins_2, Path="{0}")
item_6 = ListItem(List=flatten_4, Index=0, Wrap=True)
null = NullItem(Item=item_6)  # -> NullFlags, InvalidFlags, Description
filter_7 = StreamFilter(Gate=null.NullFlags, Stream0=ins_2, Stream1=flatten_3)
sorted_raster_and_outline_routes = Curve(flatten(filter_7))

# ---- group: Sort curves
aligned_curves_3 = Curve(sorted_raster_and_outline_routes)
curves_outside_2 = Curve(flatten(dispatch_4.ListB))
graft_4 = GraftTree(Tree=curves_outside_2, IncludeEmptyLists=True, IncludeNullItems=True)
end_8 = EndPoints(Curve=aligned_curves_3)  # -> Start, End
lng_5 = ListLength(List=curves_outside_2)
incurve_4 = PointInCurve(Point=end_8.Start, Curve=graft_4)  # -> Relationship, Point
dup = DuplicateData(Data=graft(aligned_curves_3), Number=lng_5, Order=True)
multiplication_9 = Multiplication(A=incurve_4.Relationship, B="0.5")
pshift_12 = ShiftPaths(Data=dup, Offset=-1)
round_4 = Round(Number=multiplication_9)  # -> Nearest, Floor, Ceiling
flip_4 = FlipMatrix(Data=pshift_12)
int_3 = Integer(round_4.Floor)
cull = CullPattern(List=flip_4, CullPattern=int_3)
sorted_curves = Curve(cull)

# ---- group: Move pocket toolpaths to cut depths
pass_depth_3 = Panel(pass_depth_2)
cut_depth_pocket_4 = Panel(cut_depths_outer_pocket_2)
sorted_raster_and_outline_routes_2 = Curve(sorted_curves)
division_2 = Division(A=cut_depth_pocket_4, B=pass_depth_3)
round_5 = Round(Number=division_2)  # -> Nearest, Floor, Ceiling
division_3 = Division(A=cut_depth_pocket_4, B=round_5.Ceiling)
actual_pass_depth = Panel(division_3)
series_2 = Series(Start=actual_pass_depth, Step=actual_pass_depth, Count=round_5.Ceiling)
neg_3 = Negative(Value=series_2)
item_7 = ListItem(List=neg_3, Index=0, Wrap=True)
null_2 = NullItem(Item=item_7)  # -> NullFlags, InvalidFlags, Description
filter_8 = StreamFilter(Gate=null_2.NullFlags, Stream0=neg_3, Stream1="0")
Z = UnitZ(Factor=filter_8)

# ----
group = Group(Objects=sorted_raster_and_outline_routes_2)

# ---- group: Fix curve order
rev_2 = ReverseList(List=sorted_raster_and_outline_routes_2)  # disabled
item_8 = ListItem(List=rev_2, Index=0, Wrap=True)
pshift_13 = ShiftPaths(Data=item_8, Offset=-1)
curves_for_raster_pocket_3 = Curve(dispatch.ListA)  # disabled
end_9 = EndPoints(Curve=pshift_13)  # -> Start, End
incurves_3 = PointInCurves(Point=end_9.Start, Curves=curves_for_raster_pocket_3)  # -> Relationship, Index, Point
pshift_14 = ShiftPaths(Data=group, Offset=-1)
item_9 = ListItem(List=pshift_14, Index=incurves_3.Index, Wrap=True)
item_10 = ListItem(List=item_9, Index=0, Wrap=True)

# ---- group: Calculate cut load
actual_pass_depth_2 = Panel(actual_pass_depth)
pass_depth_4 = Panel(pass_depth_2)
division_4 = Division(A=pass_depth_4, B=actual_pass_depth_2)
feed_rate_multiplier = Panel(division_4)

# ---- group: Move pocket toolpaths to cut depths (continued)
move_2 = Move(Geometry=group, Motion=Z)  # -> Geometry, Transform
ungroup = Ungroup(Group=move_2.Geometry)
flatten_5 = FlattenTree(Tree=ungroup, Path="{0}")

# ----
feed_rate_multiplier_2 = Panel(feed_rate_multiplier)
feed_rate_multiplier_3 = Number(feed_rate_multiplier_2)
pocket_toolpaths = Curve(flatten_5)
feed_rate_multiplier_4 = ClusterOutput(feed_rate_multiplier_3)
pocket_toolpaths_2 = ClusterOutput(pocket_toolpaths)

# ==== cluster Drill
I = ClusterInput()
I_2 = ClusterInput()
default_tool_diameter = Panel("6")
default_drill_depth = Panel("10")
null = NullItem(Item=I_2)  # -> NullFlags, InvalidFlags, Description
null_2 = NullItem(Item=I)  # -> NullFlags, InvalidFlags, Description
drill_curves = ClusterInput()
filter = StreamFilter(Gate=null.NullFlags, Stream0=I_2, Stream1=default_tool_diameter)
filter_2 = StreamFilter(Gate=null_2.NullFlags, Stream0=I, Stream1=default_drill_depth)

# ---- group: Creat hold down drill lines
drill_curves_2 = Curve(drill_curves)
drill_depth = Number(filter_2)
area = Area(Geometry=drill_curves_2)  # -> Area, Centroid
drill_depth_2 = Panel(drill_depth)
pdecon = Deconstruct(Point=area.Centroid)  # -> XComponent, YComponent, ZComponent
pt = ConstructPoint(XCoordinate=pdecon.XComponent, YCoordinate=pdecon.YComponent, ZCoordinate=0)
neg = Negative(Value=drill_depth_2)
Z = UnitZ(Factor=neg)
move = Move(Geometry=pt, Motion=Z)  # -> Geometry, Transform
ln = Line(StartPoint=pt, EndPoint=move.Geometry)

# ----
tool_diameter_for_preview = Number(filter)

# ---- group: Create hold down preview circles
drill_toolpaths = Curve(ln)
tool_diameter = Panel(tool_diameter_for_preview)
end = EndPoints(Curve=drill_toolpaths)  # -> Start, End
multiplication = Multiplication(A=tool_diameter, B="0.5")
pt_2 = Point(end.Start)
neg_2 = Negative(Value=multiplication)
neg_3 = Negative(Value=multiplication)
X = UnitX(Factor=multiplication)
X_2 = UnitX(Factor=neg_3)
Y = UnitY(Factor=neg_2)
Y_2 = UnitY(Factor=multiplication)
move_2 = Move(Geometry=pt_2, Motion=Y)  # -> Geometry, Transform
xy = XYPlane(Origin=pt_2)
move_3 = Move(Geometry=pt_2, Motion=X_2)  # -> Geometry, Transform
move_4 = Move(Geometry=pt_2, Motion=Y_2)  # -> Geometry, Transform
move_5 = Move(Geometry=pt_2, Motion=X)  # -> Geometry, Transform
cir = Circle(Plane=xy, Radius=multiplication)
ln_2 = Line(StartPoint=move_4.Geometry, EndPoint=move_2.Geometry)
ln_3 = Line(StartPoint=move_5.Geometry, EndPoint=move_3.Geometry)
drill_preview_geometry = Curve([ln_3, ln_2, cir])

# ----
drill_preview_geometry_2 = Curve(drill_preview_geometry)
drill_toolpaths_2 = Curve(ln)
drill_preview_geometry_3 = ClusterOutput(drill_preview_geometry_2)
drill_toolpaths_3 = ClusterOutput(drill_toolpaths_2)

# ==== cluster Engrave
engrave_curves = ClusterInput()
pass_depth = ClusterInput()
cut_depth = ClusterInput()
engrave_curves_2 = Curve(engrave_curves)
pass_depth_2 = Number(pass_depth)
cut_depth_2 = Number(cut_depth)
pass_depth_3 = Panel(pass_depth_2)
cut_depth_line_engrave = Panel(cut_depth_2)
division = Division(A=cut_depth_line_engrave, B=pass_depth_3)
round = Round(Number=division)  # -> Nearest, Floor, Ceiling
division_2 = Division(A=cut_depth_line_engrave, B=round.Ceiling)
actual_pass_depth = Panel(division_2)
series = Series(Start=actual_pass_depth, Step=actual_pass_depth, Count=round.Ceiling)
neg = Negative(Value=series)
null = NullItem(Item=division_2)  # -> NullFlags, InvalidFlags, Description
filter = StreamFilter(Gate=null.NullFlags, Stream0=neg, Stream1="0")
Z = UnitZ(Factor=filter)
move = Move(Geometry=graft(engrave_curves_2), Motion=Z)  # -> Geometry, Transform
flatten = FlattenTree(Tree=move.Geometry, Path="{0}")
clean = CleanTree(RemoveNulls=True, RemoveInvalid=True, RemoveEmpty=False, Tree=flatten)
engrave_toolpaths = Curve(clean)
engrave_toolpaths_2 = ClusterOutput(engrave_toolpaths)

# ==== cluster Cutout
use_climb_direction = ClusterInput()
use_inside_cutting = ClusterInput()
curves_for_cutout = ClusterInput()
cutout_tolerance = ClusterInput()
tool_diameter = ClusterInput()
pass_depth = ClusterInput()
cut_depth = ClusterInput()
use_climb_direction_2 = Integer(use_climb_direction)
use_inside_cutting_2 = Integer(use_inside_cutting)
curves_for_cutout_2 = Curve(curves_for_cutout)
cutout_tolerance_2 = Number(cutout_tolerance)
tool_diameter_2 = Number(tool_diameter)
pass_depth_2 = Number(pass_depth)
cut_depth_2 = Number(cut_depth)
tool_diameter_3 = Panel(tool_diameter_2)
use_climb_direction_3 = Panel(use_climb_direction_2)
use_inside_cutting_3 = Panel(use_inside_cutting_2)

# ---- group: Filter out open curves
curves_for_cutout_3 = Curve(curves_for_cutout_2)
cls = Closed(Curve=curves_for_cutout_3)  # -> Closed, Periodic
dispatch = Dispatch(List=curves_for_cutout_3, DispatchPattern=cls.Closed)  # -> ListA, ListB

# ----
xy = XYPlane(Origin=Point(0, 0, 0))
operation_plane = Plane(xy)
multiplication = Multiplication(A=tool_diameter_3, B="0.5")
cutout_tolerance_3 = Panel(cutout_tolerance_2)
tool_radius = Panel(multiplication)

# ---- group: Re-join to assist in offsetting
explode = Explode(Curve=dispatch.ListA, Recursive=True)  # -> Segments, Vertices
join = JoinCurves(Curves=explode.Segments, Preserve=False)
cls_2 = Closed(Curve=join)  # -> Closed, Periodic
crv = Curve(graft(dispatch.ListA))
p_n_c = PickNChoose(Pattern=cls_2.Closed, Stream0=crv, Stream1=join)
flatten = FlattenTree(Tree=p_n_c, Path="{0}")

# ----
addition = Addition(A=tool_radius, B=cutout_tolerance_3)
compensated_tool_radius = Panel(addition)

# ---- group: Merge overlapping curves
curves_for_merging_overlap = Curve(flatten)
mcx = MultipleCurves(Curves=curves_for_merging_overlap)  # -> Points, IndexA, IndexB, ParamA, ParamB
dcon = DeleteConsecutive(Set=[mcx.IndexA, mcx.IndexB], Wrap=False)  # -> Set, Count
item = ListItem(List=curves_for_merging_overlap, Index=dcon.Set, Wrap=True)
cull_i = CullIndex(List=curves_for_merging_overlap, Indices=dcon.Set, Wrap=True)
runion = RegionUnion(Curves=item, Plane=operation_plane)
merged_overlapping_curves = Curve([runion, cull_i])

# ----
use_inside_cutting_4 = Panel(use_inside_cutting_3)
operation_plane_2 = Plane(operation_plane)
neg = Negative(Value=compensated_tool_radius)
pass_depth_3 = Number(pass_depth_2)
cut_depth_3 = Number(cut_depth_2)

# ---- group: Align curve directions
curves_for_aligned_direction = Curve(merged_overlapping_curves)
graft = GraftTree(Tree=curves_for_aligned_direction, IncludeEmptyLists=True, IncludeNullItems=True)
offset = Offset(Curve=graft, Distance="0.01", Plane=PlaneXY(0, 0, 0), Corners=2)
end = EndPoints(Curve=offset)  # -> Start, End
pshift = ShiftPaths(Data=end.Start, Offset=-1)
incurve = PointInCurve(Point=pshift, Curve=graft)  # -> Relationship, Point
multiplication_2 = Multiplication(A=incurve.Relationship, B="0.5")
round = Round(Number=multiplication_2)  # -> Nearest, Floor, Ceiling
crv_2 = Curve(graft)
int = Integer(round.Nearest)
flip = FlipCurve(Curve=crv_2)  # -> Curve, Flag
weave = Weave(Pattern=int, Stream0=flip.Curve, Stream1=crv_2, NullGaps=False)
pshift_2 = ShiftPaths(Data=weave, Offset=-1)

# ----
flip_2 = FlipCurve(Curve=pshift_2)  # -> Curve, Flag
filter = StreamFilter(Gate=use_inside_cutting_4, Stream0=pshift_2, Stream1=flip_2.Curve)

# ---- group: Align curve directions (continued)
aligned_curves = Curve(filter)

# ---- group: Detect curves inside curves
aligned_curves_2 = Curve(aligned_curves)
graft_2 = GraftTree(Tree=aligned_curves_2, IncludeEmptyLists=True, IncludeNullItems=True)
end_2 = EndPoints(Curve=aligned_curves_2)  # -> Start, End
incurve_2 = PointInCurve(Point=end_2.Start, Curve=graft_2)  # -> Relationship, Point
multiplication_3 = Multiplication(A=incurve_2.Relationship, B="0.5")
round_2 = Round(Number=multiplication_3)  # -> Nearest, Floor, Ceiling
int_2 = Integer(round_2.Floor)
flip_3 = FlipMatrix(Data=int_2)
ma = MassAddition(Input=flip_3)  # -> Result, PartialResults
pshift_3 = ShiftPaths(Data=ma.Result, Offset=-1)
dispatch_2 = Dispatch(List=aligned_curves_2, DispatchPattern=pshift_3)  # -> ListA, ListB
curves_outside = Curve(dispatch_2.ListB)
curves_inside = Curve(dispatch_2.ListA)

# ----
curves_for_offset_outwards = Curve(curves_outside)
curves_for_offset_inwards = Curve(curves_inside)
offset_2 = Offset(Curve=curves_for_offset_outwards, Distance=neg, Plane=operation_plane_2, Corners=2)
offset_3 = Offset(Curve=curves_for_offset_inwards, Distance=compensated_tool_radius, Plane=operation_plane_2, Corners=2)
pshift_4 = ShiftPaths(Data=offset_3, Offset=-1)
pshift_5 = ShiftPaths(Data=offset_2, Offset=-1)
flip_4 = FlipCurve(Curve=pshift_4)  # -> Curve, Flag
outside_cutout_curves = Curve(pshift_5)
inside_cutout_curves = Curve(flip_4.Curve)

outside_cutout_curves_2 = Curve(outside_cutout_curves)
inside_cutout_curves_2 = Curve(inside_cutout_curves)
inside_outline_curves = Curve(inside_cutout_curves_2)
flatten_2 = FlattenTree(Tree=outside_cutout_curves_2, Path="{0}")
end_3 = EndPoints(Curve=inside_outline_curves)  # -> Start, End
incurves = PointInCurves(Point=end_3.Start, Curves=flatten_2)  # -> Relationship, Index, Point
addition_2 = Addition(A=incurves.Index, B="1")
ins = InsertItems(List=flatten_2, Item=inside_outline_curves, Indices=incurves.Index, Wrap=True)

# ---- group: Flip curves for climb direction
sorted_inside_and_outside_curves = Curve(ins)
use_climb_direction_4 = Panel(use_climb_direction_3)
flip_5 = FlipCurve(Curve=sorted_inside_and_outside_curves)  # -> Curve, Flag
filter_2 = StreamFilter(Gate=use_climb_direction_4, Stream0=flip_5.Curve, Stream1=sorted_inside_and_outside_curves)
sorted_inside_and_outside_curves_2 = Curve(filter_2)

# ---- group: Move cutout toolpaths to cut depths
sorted_inside_and_outside_curves_3 = Curve(sorted_inside_and_outside_curves_2)
pass_depth_4 = Panel(pass_depth_3)
cut_depth_cutout = Panel(cut_depth_3)
division = Division(A=cut_depth_cutout, B=pass_depth_4)
graft_3 = GraftTree(Tree=sorted_inside_and_outside_curves_3, IncludeEmptyLists=True, IncludeNullItems=True)
round_3 = Round(Number=division)  # -> Nearest, Floor, Ceiling
division_2 = Division(A=cut_depth_cutout, B=round_3.Ceiling)
actual_pass_depth = Panel(division_2)
series = Series(Start=actual_pass_depth, Step=actual_pass_depth, Count=round_3.Ceiling)
neg_2 = Negative(Value=series)
Z = UnitZ(Factor=neg_2)
simplify = SimplifyTree(Tree=graft_3, Front=False)
simplify_2 = SimplifyTree(Tree=Z, Front=False)
move = Move(Geometry=simplify, Motion=simplify_2)  # -> Geometry, Transform
flatten_3 = FlattenTree(Tree=move.Geometry, Path="{0}")

# ----
cutout_toolpaths = Curve(flatten_3)
cutout_toolpaths_2 = ClusterOutput(cutout_toolpaths)

# ==== cluster PreviewGraphicFor11ProjectionOnMachine
measured_projected_size = ClusterInput()
expected_projected_size = ClusterInput()
position_correction_x = ClusterInput()
position_correction_y = ClusterInput()
scale_overide_x = ClusterInput()
scale_overide_y = ClusterInput()
drill_preview_curves = ClusterInput()
rotation_correction = ClusterInput()
toolpath_curves = ClusterInput()
cutting_curves = ClusterInput()
svg_px_heigth = ClusterInput()
pocket_curves = ClusterInput()
svg_px_width = ClusterInput()
scale_overide_x_2 = Panel(scale_overide_x)
toolpath_curves_2 = Curve(flatten(toolpath_curves))
cutting_curves_2 = Curve(cutting_curves)
pocket_curves_2 = Curve(pocket_curves)
svg_px_width_2 = Number(svg_px_width)
svg_px_heigth_2 = Number(svg_px_heigth)
drill_preview_curves_2 = Curve(drill_preview_curves)
expected_projected_size_2 = Number(expected_projected_size)
measured_projected_size_2 = Number(measured_projected_size)
position_correction_x_2 = Number(position_correction_x)
position_correction_y_2 = Number(position_correction_y)
rotation_correction_2 = Number(rotation_correction)
scale_overide_y_2 = Panel(scale_overide_y)
background_color = ColourSwatch(SwatchColor=RGB(0, 0, 0))
explode = Explode(Curve=toolpath_curves_2, Recursive=True)  # -> Segments, Vertices
pt = ConstructPoint(XCoordinate=position_correction_x_2, YCoordinate=position_correction_y_2, ZCoordinate=0)
division = Division(A=expected_projected_size_2, B=measured_projected_size_2)
pt_2 = ConstructPoint(XCoordinate="0", YCoordinate="0", ZCoordinate=0)
vec2pt = Vector2Pt(PointA=pt_2, PointB=pt, Unitize=False)  # -> Vector, Length
xy = XYPlane(Origin=pt_2)
pocket_curves_3 = Curve(flatten(pocket_curves_2))
cutting_curves_3 = Curve(flatten(cutting_curves_2))
x_y_and_z_axis_indicators = Curve([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])
drill_preview_curves_3 = Curve(drill_preview_curves_2)
toolpath_curves_3 = Curve(flatten(explode.Segments))
xy_2 = XYPlane(Origin=pt_2)
multiplication = Multiplication(A=division, B=scale_overide_y_2)
multiplication_2 = Multiplication(A=division, B=scale_overide_x_2)
scale_nu = ScaleNU(Geometry=pocket_curves_3, Plane=xy_2, ScaleX=multiplication_2, ScaleY=multiplication, ScaleZ=1)  # -> Geometry, Transform
scale_nu_2 = ScaleNU(Geometry=cutting_curves_3, Plane=xy_2, ScaleX=multiplication_2, ScaleY=multiplication, ScaleZ=1)  # -> Geometry, Transform
scale = Scale(Geometry=flatten(x_y_and_z_axis_indicators), Center=pt_2, Factor=division)  # -> Geometry, Transform
scale_nu_3 = ScaleNU(Geometry=drill_preview_curves_3, Plane=xy_2, ScaleX=multiplication_2, ScaleY=multiplication, ScaleZ=1)  # -> Geometry, Transform
scale_nu_4 = ScaleNU(Geometry=toolpath_curves_3, Plane=xy_2, ScaleX=multiplication_2, ScaleY=multiplication, ScaleZ=1)  # -> Geometry, Transform
scale_2 = Scale(Geometry=toolpath_curves_3, Center=pt_2, Factor=division)  # -> Geometry, Transform; disabled
move = Move(Geometry=scale_nu.Geometry, Motion=vec2pt.Vector)  # -> Geometry, Transform
move_2 = Move(Geometry=scale_nu_2.Geometry, Motion=vec2pt.Vector)  # -> Geometry, Transform
move_3 = Move(Geometry=scale.Geometry, Motion=vec2pt.Vector)  # -> Geometry, Transform
move_4 = Move(Geometry=scale_nu_3.Geometry, Motion=vec2pt.Vector)  # -> Geometry, Transform
move_5 = Move(Geometry=scale_nu_4.Geometry, Motion=vec2pt.Vector)  # -> Geometry, Transform
rotate = Rotate(Geometry=move_2.Geometry, Angle=degrees(rotation_correction_2), Plane=xy)  # -> Geometry, Transform
rotate_2 = Rotate(Geometry=move.Geometry, Angle=degrees(rotation_correction_2), Plane=xy)  # -> Geometry, Transform
rotate_3 = Rotate(Geometry=move_4.Geometry, Angle=degrees(rotation_correction_2), Plane=xy)  # -> Geometry, Transform
rotate_4 = Rotate(Geometry=move_3.Geometry, Angle=degrees(rotation_correction_2), Plane=xy)  # -> Geometry, Transform
rotate_5 = Rotate(Geometry=move_5.Geometry, Angle=degrees(rotation_correction_2), Plane=xy)  # -> Geometry, Transform
topoly = CurveToPolyline(Curve=rotate_3.Geometry, ToleranceDistance=Slider(0.25, range=0..1), ToleranceAngle=0)  # -> Polyline, Segments
topoly_2 = CurveToPolyline(Curve=rotate_2.Geometry, ToleranceDistance=Slider(0.25, range=0..1), ToleranceAngle=0)  # -> Polyline, Segments
topoly_3 = CurveToPolyline(Curve=rotate.Geometry, ToleranceDistance=Slider(0.25, range=0..1), ToleranceAngle=0)  # -> Polyline, Segments
topoly_4 = CurveToPolyline(Curve=rotate_4.Geometry, ToleranceDistance=Slider(0.25, range=0..1), ToleranceAngle=0)  # -> Polyline, Segments
topoly_5 = CurveToPolyline(Curve=rotate_5.Geometry, ToleranceDistance=Slider(0.25, range=0..1), ToleranceAngle=0)  # -> Polyline, Segments
explode_2 = Explode(Curve=topoly_4.Polyline, Recursive=True)  # -> Segments, Vertices
crv = Curve(topoly.Polyline)
int = Integer(svg_px_heigth_2)
int_2 = Integer(svg_px_heigth_2)
crv_2 = Curve(topoly_2.Polyline)
crv_3 = Curve(flatten(explode_2.Segments))
int_3 = Integer(svg_px_heigth_2)
crv_4 = Curve(topoly_3.Polyline)
int_4 = Integer(svg_px_heigth_2)
crv_5 = Curve(topoly_5.Polyline)
int_5 = Integer(svg_px_heigth_2)
cluster = Cluster_2(
    background_height=int,
    polyline=crv,
    stroke_color=ColourSwatch(SwatchColor=RGB(255, 219, 112)),
    stroke_width=Slider(0.8, range=0..5))
cluster_2 = Cluster_2(
    background_height=int_2,
    polyline=crv_2,
    stroke_color=ColourSwatch(SwatchColor=RGB(254, 171, 255)),
    stroke_width=Slider(0.8, range=0..5))
cluster_3 = Cluster_2(
    background_height=int_3,
    polyline=crv_4,
    stroke_color=ColourSwatch(SwatchColor=RGB(178, 221, 255)),
    stroke_width=Slider(0.8, range=0..5))
cluster_4 = Cluster_2(
    background_height=int_4,
    polyline=crv_3,
    stroke_color=ColourSwatch(SwatchColor=RGB(106, 150, 158)),
    stroke_width=Slider(0.8, range=0..5))
cluster_5 = Cluster_2(
    background_height=int_5,
    polyline=crv_5,
    stroke_color=ColourSwatch(SwatchColor=RGB(242, 254, 255)),
    stroke_width=Slider(0.8, range=0..5))
flatten = FlattenTree(Tree=cluster, Path="{0}")
flatten_2 = FlattenTree(Tree=cluster_2, Path="{0}")
flatten_3 = FlattenTree(Tree=cluster_3, Path="{0}")
flatten_4 = FlattenTree(Tree=cluster_4, Path="{0}")
flatten_5 = FlattenTree(Tree=cluster_5, Path="{0}")
flatten_6 = FlattenTree(Tree=[flatten_5, flatten_3, flatten, flatten_2, flatten_4], Path="{0}")
cluster_6 = Cluster(background_width=svg_px_width_2, background_height=svg_px_heigth_2, background_color=background_color, data=flatten_6)
stream_save_as_svg = Panel(cluster_6)
composed_svg_stream_save_as_svg = ClusterOutput(cluster_6)

# ==== cluster ShopBotCodePostProcessor
use_custom_jog_home = ClusterInput()
milling_bit_diameter = ClusterInput()
deviation_tolerance = ClusterInput()
custom_home_x = ClusterInput()
toolpath_curves = ClusterInput()
custom_home_y = ClusterInput()
ramp_plunges = ClusterInput()
spindle_speed = ClusterInput()
safe_z_height = ClusterInput()
ramp_angle = ClusterInput()
use_spindle = ClusterInput()
plunge_rate = ClusterInput()
tab_breps = ClusterInput()
job_name = ClusterInput()
feed_rate = ClusterInput()

convert_to_inches = BooleanToggle(False)
tab_breps_2 = Brep(tab_breps)
feed_rate_2 = Number(feed_rate)
use_spindle_2 = Integer(use_spindle)
ramp_angle_2 = Number(ramp_angle)
job_name_2 = Text(job_name)
plunge_rate_2 = Number(plunge_rate)
safe_z_height_2 = Number(safe_z_height)
spindle_speed_2 = Number(spindle_speed)
ramp_plunges_2 = Integer(ramp_plunges)
custom_home_x_2 = Number(custom_home_x)
custom_home_y_2 = Number(custom_home_y)
toolpath_curves_2 = Curve(toolpath_curves)
use_custom_jog_home_2 = Integer(use_custom_jog_home)
deviation_tolerance_2 = Number(deviation_tolerance)
milling_bit_diameter_2 = Number(milling_bit_diameter)
use_inches_boolean = Panel(convert_to_inches)
flatten = FlattenTree(Tree=toolpath_curves_2, Path="{0}")
flatten_2 = FlattenTree(Tree=tab_breps_2, Path="{0}")
clean = CleanTree(RemoveNulls=True, RemoveInvalid=True, RemoveEmpty=False, Tree=flatten)
filter = StreamFilter(Gate=use_inches_boolean, Stream0="1", Stream1="25.4")
division = Division(A=custom_home_x_2, B=filter)
division_2 = Division(A=custom_home_y_2, B=filter)
join = TextJoin(Text=flatten(["'", job_name_2]))
topoly = CurveToPolyline(Curve=clean, ToleranceDistance=deviation_tolerance_2, ToleranceAngle=0)  # -> Polyline, Segments
division_3 = Division(A=feed_rate_2, B=filter)
division_4 = Division(A=plunge_rate_2, B=filter)
division_5 = Division(A=safe_z_height_2, B=filter)
polyline_toolpaths = Curve(topoly.Polyline)

# ---- group: Eliminate unecessary jog Z
connect_overlapping_toolpaths = ConnectOverlappingToolpaths(polyline_toolpaths=polyline_toolpaths)

# ----
ramp_plunges_3 = Integer(ramp_plunges_2)
filter_2 = StreamFilter(Gate=ramp_plunges_3, Stream0=connect_overlapping_toolpaths, Stream1=polyline_toolpaths)

# ---- group: Adds tabs to toolpaths
tab_toolpaths = TabToolpaths(polyline_toolpaths=filter_2, tab_breps=flatten_2, milling_bit_diamter=milling_bit_diameter_2)  # -> tabbed_toolpaths_3, tab_cleanup_toolpaths_4

# ----
tab_cleanup_toolpaths = Curve(tab_toolpaths.tab_cleanup_toolpaths_4)

# ---- group: Add ramps to toolpaths
ramp_toolpath_plunges = RampToolpathPlunges(toolpaths_to_ramp=tab_toolpaths.tabbed_toolpaths_3, ramp_angle=ramp_angle_2)
ramp_plunges_4 = Integer(ramp_plunges_2)
filter_3 = StreamFilter(Gate=flatten(ramp_plunges_4), Stream0=flatten(tab_toolpaths.tabbed_toolpaths_3), Stream1=flatten(ramp_toolpath_plunges))

# ---- group: Add ramps to cleanup toolpaths
ramp_toolpath_plunges_2 = RampToolpathPlunges(toolpaths_to_ramp=tab_cleanup_toolpaths, ramp_angle=ramp_angle_2)
ramp_plunges_5 = Integer(ramp_plunges_2)
filter_4 = StreamFilter(Gate=ramp_plunges_5, Stream0=tab_cleanup_toolpaths, Stream1=ramp_toolpath_plunges_2)

# ----
connect_overlapping_toolpaths_2 = ConnectOverlappingToolpaths(polyline_toolpaths=filter_3)
connect_overlapping_toolpaths_3 = ConnectOverlappingToolpaths(polyline_toolpaths=filter_4)

# ---- group: Create safe Z transtions
cp = ControlPoints(Curve=connect_overlapping_toolpaths_2)  # -> Points, Weights, Knots
rev = ReverseList(List=cp.Points)
safe_z_height_3 = Number(division_5)
item = ListItem(List=cp.Points, Index=0, Wrap=True)
item_2 = ListItem(List=rev, Index=0, Wrap=True)
pdecon = Deconstruct(Point=item)  # -> XComponent, YComponent, ZComponent
pdecon_2 = Deconstruct(Point=item_2)  # -> XComponent, YComponent, ZComponent
pt = ConstructPoint(XCoordinate=pdecon.XComponent, YCoordinate=pdecon.YComponent, ZCoordinate=safe_z_height_3)
pt_2 = ConstructPoint(XCoordinate=pdecon_2.XComponent, YCoordinate=pdecon_2.YComponent, ZCoordinate=safe_z_height_3)
safe_z_end_point = Point(pt_2)
safe_z_start_point = Point(pt)

# ----
flatten_3 = FlattenTree(Tree=cp.Points, Path="{0}")  # disabled

cp_2 = ControlPoints(Curve=connect_overlapping_toolpaths_3)  # -> Points, Weights, Knots
safe_z_height_4 = Number(division_5)

lng = ListLength(List=flatten_3)
multiplication = Multiplication(A=lng, B=Slider(0.048775, range=0..1))
item_3 = ListItem(List=flatten_3, Index=multiplication, Wrap=True)
toolpath_points = Point(cp.Points)
toolpath_points_2 = Point(cp_2.Points)
pdecon_3 = Deconstruct(Point=toolpath_points)  # -> XComponent, YComponent, ZComponent

# ---- group: Optional MM to inch conversion
convert_to_inches_boolean = Panel(convert_to_inches)
filter_5 = StreamFilter(Gate=convert_to_inches_boolean, Stream0="1", Stream1="25.4")
division_6 = Division(A=pdecon_3.XComponent, B=filter_5)
division_7 = Division(A=pdecon_3.YComponent, B=filter_5)
division_8 = Division(A=pdecon_3.ZComponent, B=filter_5)

# ----
lng_2 = ListLength(List=toolpath_points)
pdecon_4 = Deconstruct(Point=toolpath_points_2)  # -> XComponent, YComponent, ZComponent

# ---- group: Optional MM to inch conversion
convert_to_inches_boolean_2 = Panel(convert_to_inches)
filter_6 = StreamFilter(Gate=convert_to_inches_boolean_2, Stream0="1", Stream1="25.4")
division_9 = Division(A=pdecon_4.XComponent, B=filter_6)
division_10 = Division(A=pdecon_4.YComponent, B=filter_6)
division_11 = Division(A=pdecon_4.ZComponent, B=filter_6)

# ----
lng_3 = ListLength(List=toolpath_points_2)
flatten_4 = FlattenTree(Tree=lng_2, Path="{0}")
flatten_5 = FlattenTree(Tree=lng_3, Path="{0}")
merge = Merge(Data1=Slider(0, range=0..100), Data2=flatten_4)
panel = Panel(division_6)
panel_2 = Panel(division_7)
panel_3 = Panel(division_8)
merge_2 = Merge(Data1=Slider(0, range=0..100), Data2=flatten_5)
panel_4 = Panel(division_9)
panel_5 = Panel(division_10)
panel_6 = Panel(division_11)

# ---- group: Jog to safe Z
safe_z_height_5 = Number(flatten(safe_z_height_3))
text = Text("JZ,")
graft = GraftTree(Tree=safe_z_height_5, IncludeEmptyLists=True, IncludeNullItems=True)
graft_2 = GraftTree(Tree=text, IncludeEmptyLists=True, IncludeNullItems=True)
lng_4 = ListLength(List=flatten(merge))
join_2 = TextJoin(Text=[graft_2, graft])
dup = DuplicateData(Data=join_2, Number=lng_4, Order=True)

# ---- group: Name
panel_7 = Panel(join)

# ---- group: Set spindle speed
spindle_speed_3 = Number(spindle_speed_2)
int = Integer(spindle_speed_3)
join_3 = TextJoin(Text=["TR,", int, ",1"])

# ---- group: Turn off spindle
filter_7 = StreamFilter(Gate=use_spindle_2, Stream1="SO,1,0")

# ---- group: Toolpath coordinates
text_2 = Text("M3,")
text_3 = Text(",")
text_4 = Text(",")
dup_2 = DuplicateData(Data=text_4, Number=lng_2, Order=True)
dup_3 = DuplicateData(Data=text_3, Number=lng_2, Order=True)
dup_4 = DuplicateData(Data=text_2, Number=lng_2, Order=True)
simplify = SimplifyTree(Tree=flatten(dup_4), Front=False)
simplify_2 = SimplifyTree(Tree=flatten(panel), Front=False)
simplify_3 = SimplifyTree(Tree=flatten(dup_3), Front=False)
simplify_4 = SimplifyTree(Tree=flatten(panel_2), Front=False)
simplify_5 = SimplifyTree(Tree=flatten(dup_2), Front=False)
simplify_6 = SimplifyTree(Tree=flatten(panel_3), Front=False)
graft_3 = GraftTree(Tree=simplify, IncludeEmptyLists=True, IncludeNullItems=True)
graft_4 = GraftTree(Tree=simplify_2, IncludeEmptyLists=True, IncludeNullItems=True)
graft_5 = GraftTree(Tree=simplify_3, IncludeEmptyLists=True, IncludeNullItems=True)
graft_6 = GraftTree(Tree=simplify_4, IncludeEmptyLists=True, IncludeNullItems=True)
graft_7 = GraftTree(Tree=simplify_5, IncludeEmptyLists=True, IncludeNullItems=True)
graft_8 = GraftTree(Tree=simplify_6, IncludeEmptyLists=True, IncludeNullItems=True)
join_4 = TextJoin(Text=[graft_3, graft_4, graft_5, graft_6, graft_7, graft_8])
flatten_6 = FlattenTree(Tree=join_4, Path="{0}")

# ---- group: Start spindle
panel_8 = Panel("PAUSE 1")
filter_8 = StreamFilter(Gate=use_spindle_2, Stream1="SO,1,1")

# ---- group: Set Feed rate (X Y speed) and plunge rate (Z speed)
feed_rate_3 = Number(division_3)
plunge_rate_3 = Number(division_4)
plunge_rate_4 = Number(plunge_rate_3)
feed_rate_4 = Number(feed_rate_3)
text_5 = Text("MS,")
text_6 = Text(",")
join_5 = TextJoin(Text=flatten([text_5, feed_rate_4, text_6, plunge_rate_4]))

# ---- group: Jog to safe Z
safe_z_height_6 = Number(flatten(safe_z_height_4))
text_7 = Text("JZ,")
graft_9 = GraftTree(Tree=safe_z_height_6, IncludeEmptyLists=True, IncludeNullItems=True)
graft_10 = GraftTree(Tree=text_7, IncludeEmptyLists=True, IncludeNullItems=True)
lng_5 = ListLength(List=flatten(merge_2))
join_6 = TextJoin(Text=[graft_10, graft_9])
dup_5 = DuplicateData(Data=join_6, Number=lng_5, Order=True)

# ---- group: Name
panel_9 = Panel(join)

# ---- group: Set spindle speed
spindle_speed_4 = Number(spindle_speed_2)
int_2 = Integer(spindle_speed_4)
join_7 = TextJoin(Text=["TR,", int_2, ",1"])

# ---- group: Turn off spindle
filter_9 = StreamFilter(Gate=use_spindle_2, Stream1="SO,1,0")

# ---- group: Toolpath coordinates
text_8 = Text("M3,")
text_9 = Text(",")
text_10 = Text(",")
dup_6 = DuplicateData(Data=text_10, Number=lng_3, Order=True)
dup_7 = DuplicateData(Data=text_9, Number=lng_3, Order=True)
dup_8 = DuplicateData(Data=text_8, Number=lng_3, Order=True)
simplify_7 = SimplifyTree(Tree=flatten(dup_8), Front=False)
simplify_8 = SimplifyTree(Tree=flatten(panel_4), Front=False)
simplify_9 = SimplifyTree(Tree=flatten(dup_7), Front=False)
simplify_10 = SimplifyTree(Tree=flatten(panel_5), Front=False)
simplify_11 = SimplifyTree(Tree=flatten(dup_6), Front=False)
simplify_12 = SimplifyTree(Tree=flatten(panel_6), Front=False)
graft_11 = GraftTree(Tree=simplify_7, IncludeEmptyLists=True, IncludeNullItems=True)
graft_12 = GraftTree(Tree=simplify_8, IncludeEmptyLists=True, IncludeNullItems=True)
graft_13 = GraftTree(Tree=simplify_9, IncludeEmptyLists=True, IncludeNullItems=True)
graft_14 = GraftTree(Tree=simplify_10, IncludeEmptyLists=True, IncludeNullItems=True)
graft_15 = GraftTree(Tree=simplify_11, IncludeEmptyLists=True, IncludeNullItems=True)
graft_16 = GraftTree(Tree=simplify_12, IncludeEmptyLists=True, IncludeNullItems=True)
join_8 = TextJoin(Text=[graft_11, graft_12, graft_13, graft_14, graft_15, graft_16])
flatten_7 = FlattenTree(Tree=join_8, Path="{0}")

# ---- group: Start spindle
panel_10 = Panel("PAUSE 1")
filter_10 = StreamFilter(Gate=use_spindle_2, Stream1="SO,1,1")

# ---- group: Set Feed rate (X Y speed) and plunge rate (Z speed)
feed_rate_5 = Number(division_3)
plunge_rate_5 = Number(division_4)
plunge_rate_6 = Number(plunge_rate_5)
feed_rate_6 = Number(feed_rate_5)
text_11 = Text("MS,")
text_12 = Text(",")
join_9 = TextJoin(Text=flatten([text_11, feed_rate_6, text_12, plunge_rate_6]))

# ----
filter_11 = StreamFilter(Gate=use_spindle_2, Stream1=join_3)
filter_12 = StreamFilter(Gate=use_spindle_2, Stream1=join_7)
text_13 = Text("J2,")
text_14 = Text(",")
text_15 = Text("J2,")
text_16 = Text(",")
join_10 = TextJoin(Text=[text_13, division, text_14, division_2])
join_11 = TextJoin(Text=[text_15, division, text_16, division_2])

# ---- group: Insert JZ commands
ma = MassAddition(Input=merge)  # -> Result, PartialResults
ins = InsertItems(List=flatten_6, Item=dup, Indices=ma.PartialResults, Wrap=True)

ma_2 = MassAddition(Input=merge_2)  # -> Result, PartialResults
ins_2 = InsertItems(List=flatten_7, Item=dup_5, Indices=ma_2.PartialResults, Wrap=True)

# ---- group: Create toolpath preview
rev_2 = ReverseList(List=flatten(safe_z_end_point))
cull_i = CullIndex(List=flatten(safe_z_start_point), Indices=0, Wrap=True)
cull_i_2 = CullIndex(List=rev_2, Indices=0, Wrap=True)
rev_3 = ReverseList(List=flatten(cull_i_2))
ln = Line(StartPoint=rev_3, EndPoint=cull_i)
ln_2 = Line(StartPoint=safe_z_start_point, EndPoint=item)
ln_3 = Line(StartPoint=item_2, EndPoint=safe_z_end_point)
tab_cleanup_preview_curves = Curve(connect_overlapping_toolpaths_3)
cut_transition_preview_lines = Curve(flatten(ln))
cut_entry_preview_lines = Curve(flatten(ln_2))
cut_exit_preview_lines = Curve(flatten(ln_3))
toolpath_preview_curves = Curve(connect_overlapping_toolpaths_2)

# ----
tab_cleanup_preview_curves_2 = ClusterOutput(tab_cleanup_preview_curves)
cut_transition_preview_lines_2 = ClusterOutput(cut_transition_preview_lines)
cut_exit_preview_lines_2 = ClusterOutput(cut_exit_preview_lines)
toolpath_preview_curves_2 = ClusterOutput(toolpath_preview_curves)
cut_entry_preview_lines_2 = ClusterOutput(cut_entry_preview_lines)

# ---- group: Jog to startpoints
item_4 = ListItem(List=division_6, Index=0, Wrap=True)
item_5 = ListItem(List=division_7, Index=0, Wrap=True)
lng_6 = ListLength(List=flatten(item_4))
text_17 = Text(",")
text_18 = Text("J2,")
dup_9 = DuplicateData(Data=text_18, Number=lng_6, Order=True)
dup_10 = DuplicateData(Data=text_17, Number=lng_6, Order=True)
simplify_13 = SimplifyTree(Tree=flatten(dup_9), Front=False)
simplify_14 = SimplifyTree(Tree=flatten(item_4), Front=False)
simplify_15 = SimplifyTree(Tree=flatten(dup_10), Front=False)
simplify_16 = SimplifyTree(Tree=flatten(item_5), Front=False)
graft_17 = GraftTree(Tree=simplify_13, IncludeEmptyLists=True, IncludeNullItems=True)
graft_18 = GraftTree(Tree=simplify_14, IncludeEmptyLists=True, IncludeNullItems=True)
graft_19 = GraftTree(Tree=simplify_15, IncludeEmptyLists=True, IncludeNullItems=True)
graft_20 = GraftTree(Tree=simplify_16, IncludeEmptyLists=True, IncludeNullItems=True)
join_12 = TextJoin(Text=[graft_17, graft_18, graft_19, graft_20])
jh = Text("JH")
flatten_8 = FlattenTree(Tree=join_12, Path="{0}")

# ----
filter_13 = StreamFilter(Gate=use_custom_jog_home_2, Stream0=jh, Stream1=flatten(join_10))

# ---- group: Jog to startpoints (continued)
merge_3 = Merge(Data1=flatten_8, Data2=filter_13)

# ---- group: Insert J2 commands
lng_7 = ListLength(List=merge_3)
dup_11 = DuplicateData(Data=Slider(1, range=0..1), Number=lng_7, Order=True)
addition = Addition(A=dup_11, B=merge)
ma_3 = MassAddition(Input=addition)  # -> Result, PartialResults
ins_3 = InsertItems(List=ins, Item=merge_3, Indices=ma_3.PartialResults, Wrap=True)

# ----
flatten_9 = FlattenTree(Tree=ins_3, Path="{0}")
merge_4 = Merge(Data1=panel_7, Data3=filter_11, Data4=filter_8, Data5=panel_8, Data6=join_5, Data7=flatten_9, Data8=filter_7)
shopbot_code_connect_panel_stream_and_sa = ClusterOutput(merge_4)  # "ShopBot code - Connect panel, stream and save as .sbp"
stream_and_save_as_sbp = Panel(merge_4)

# ---- group: Jog to startpoints
item_6 = ListItem(List=division_9, Index=0, Wrap=True)
item_7 = ListItem(List=division_10, Index=0, Wrap=True)
lng_8 = ListLength(List=flatten(item_6))
text_19 = Text(",")
text_20 = Text("J2,")
dup_12 = DuplicateData(Data=text_20, Number=lng_8, Order=True)
dup_13 = DuplicateData(Data=text_19, Number=lng_8, Order=True)
simplify_17 = SimplifyTree(Tree=flatten(dup_12), Front=False)
simplify_18 = SimplifyTree(Tree=flatten(item_6), Front=False)
simplify_19 = SimplifyTree(Tree=flatten(dup_13), Front=False)
simplify_20 = SimplifyTree(Tree=flatten(item_7), Front=False)
graft_21 = GraftTree(Tree=simplify_17, IncludeEmptyLists=True, IncludeNullItems=True)
graft_22 = GraftTree(Tree=simplify_18, IncludeEmptyLists=True, IncludeNullItems=True)
graft_23 = GraftTree(Tree=simplify_19, IncludeEmptyLists=True, IncludeNullItems=True)
graft_24 = GraftTree(Tree=simplify_20, IncludeEmptyLists=True, IncludeNullItems=True)
join_13 = TextJoin(Text=[graft_21, graft_22, graft_23, graft_24])
jh_2 = Text("JH")
flatten_10 = FlattenTree(Tree=join_13, Path="{0}")

# ----
filter_14 = StreamFilter(Gate=use_custom_jog_home_2, Stream0=jh_2, Stream1=flatten(join_11))

# ---- group: Jog to startpoints (continued)
merge_5 = Merge(Data1=flatten_10, Data2=filter_14)

# ---- group: Insert J2 commands
lng_9 = ListLength(List=merge_5)
dup_14 = DuplicateData(Data=Slider(1, range=0..1), Number=lng_9, Order=True)
addition_2 = Addition(A=dup_14, B=merge_2)
ma_4 = MassAddition(Input=addition_2)  # -> Result, PartialResults
ins_4 = InsertItems(List=ins_2, Item=merge_5, Indices=ma_4.PartialResults, Wrap=True)

# ----
flatten_11 = FlattenTree(Tree=ins_4, Path="{0}")
merge_6 = Merge(Data1=panel_9, Data3=filter_12, Data4=filter_10, Data5=panel_10, Data6=join_9, Data7=flatten_11, Data8=filter_9)
tab_cleanup_code_connect_panel_stream_an = ClusterOutput(merge_6)  # "Tab cleanup code - Connect panel, stream and save as .sbp"
stream_and_save_as_sbp_2 = Panel(merge_6)

# ==== cluster DogboneMaker
corner_angle_threshold = ClusterInput()
milling_bit_diameter = ClusterInput()
flip_cornes_boolean = ClusterInput()
curves_to_dogbone = ClusterInput()
flip_cornes_boolean_2 = Integer(flip_cornes_boolean)
radius_margin = Panel("0.1")

milling_bit_diameter_2 = Number(milling_bit_diameter)
multiplication = Multiplication(A=milling_bit_diameter_2, B="0.5")
addition = Addition(A=multiplication, B=radius_margin)
dogbone_radius = Panel(addition)

corner_angle_threshold_2 = Number(corner_angle_threshold)
dom = ConstructDomain(DomainStart="1", DomainEnd="179")
smaller = SmallerThan(FirstNumber=corner_angle_threshold_2, SecondNumber="1")  # -> SmallerThan, OrEqualTo
filter = StreamFilter(Gate=smaller.SmallerThan, Stream0=corner_angle_threshold_2, Stream1="1")
larger = LargerThan(FirstNumber=filter, SecondNumber="179")  # -> LargerThan, OrEqualTo
filter_2 = StreamFilter(Gate=larger.LargerThan, Stream0=corner_angle_threshold_2, Stream1="179")
subtraction = Subtraction(A="360", B=filter_2)
division = Division(A=subtraction, B="360")
dogbone_minium_angle = Panel(division)

curves_to_dogbone_2 = Curve(curves_to_dogbone)
flatten = FlattenTree(Tree=curves_to_dogbone_2, Path="{0}")

# ---- group: Merge overlapping curves //removed to alow neighbouring pockets
mcx = MultipleCurves(Curves=flatten)  # -> Points, IndexA, IndexB, ParamA, ParamB; disabled
dcon = DeleteConsecutive(Set=[mcx.IndexA, mcx.IndexB], Wrap=False)  # -> Set, Count
item = ListItem(List=flatten, Index=dcon.Set, Wrap=True)
cull_i = CullIndex(List=flatten, Indices=dcon.Set, Wrap=True)
runion = RegionUnion(Curves=item)
merged_overlapping_curves = Curve([runion, cull_i])

# ---- group: Detect curves inside curves
aligned_curves = Curve(flatten)
graft = GraftTree(Tree=aligned_curves, IncludeEmptyLists=True, IncludeNullItems=True)
end = EndPoints(Curve=aligned_curves)  # -> Start, End
incurve = PointInCurve(Point=end.Start, Curve=graft)  # -> Relationship, Point
multiplication_2 = Multiplication(A=incurve.Relationship, B="0.5")
round = Round(Number=multiplication_2)  # -> Nearest, Floor, Ceiling
int = Integer(round.Floor)
flip = FlipMatrix(Data=int)
ma = MassAddition(Input=flip)  # -> Result, PartialResults
pshift = ShiftPaths(Data=ma.Result, Offset=-1)
dispatch = Dispatch(List=aligned_curves, DispatchPattern=pshift)  # -> ListA, ListB
curves_outside = Curve(dispatch.ListB)
curves_inside = Curve(dispatch.ListA)

# ----
xy = XYPlane(Origin=Point(0, 0, 0))
cir = Circle(Plane=xy, Radius="0.01")
dogbone_minium_angle_2 = Panel(dogbone_minium_angle)
len = Length(Curve=cir)
multiplication_3 = Multiplication(A=len, B=dogbone_minium_angle_2)

xy_2 = XYPlane(Origin=Point(0, 0, 0))
cir_2 = Circle(Plane=xy_2, Radius="0.01")
dogbone_minium_angle_3 = Panel(dogbone_minium_angle)
len_2 = Length(Curve=cir_2)
multiplication_4 = Multiplication(A=len_2, B=dogbone_minium_angle_3)

flip_cornes_boolean_3 = Panel(flip_cornes_boolean_2)
flip_cornes_boolean_4 = Panel(flip_cornes_boolean_2)
curves_to_dogbone_3 = Curve(flatten)
lng = ListLength(List=curves_to_dogbone_3)

curves_for_dogbone = Curve(curves_inside)
cp = ControlPoints(Curve=curves_for_dogbone)  # -> Points, Weights, Knots

disc = Discontinuity(Curve=curves_for_dogbone, Level=1)  # -> Points, Parameters

curves_for_dogbone_2 = Curve(curves_outside)
cp_2 = ControlPoints(Curve=curves_for_dogbone_2)  # -> Points, Weights, Knots

disc_2 = Discontinuity(Curve=curves_for_dogbone_2, Level=1)  # -> Points, Parameters

xy_3 = XYPlane(Origin=disc.Points)
cir_3 = Circle(Plane=xy_3, Radius="0.01")
trim = TrimWithRegion(Curve=cir_3, Region=graft(curves_for_dogbone), Plane=xy_3)  # -> Inside, Outside

filter_3 = StreamFilter(Gate=flip_cornes_boolean_4, Stream0=trim.Outside, Stream1=trim.Inside)

pshift_2 = ShiftPaths(Data=filter_3, Offset=-1)
len_3 = Length(Curve=pshift_2)

xy_4 = XYPlane(Origin=disc_2.Points)
cir_4 = Circle(Plane=xy_4, Radius="0.01")
trim_2 = TrimWithRegion(Curve=cir_4, Region=graft(curves_for_dogbone_2), Plane=xy_4)  # -> Inside, Outside

filter_4 = StreamFilter(Gate=flip_cornes_boolean_3, Stream0=trim_2.Inside, Stream1=trim_2.Outside)

pshift_3 = ShiftPaths(Data=filter_4, Offset=-1)
len_4 = Length(Curve=pshift_3)

larger_2 = LargerThan(FirstNumber=len_3, SecondNumber=multiplication_3)  # -> LargerThan, OrEqualTo
dogbone_radius_2 = Panel(dogbone_radius)
dispatch_2 = Dispatch(List=disc.Points, DispatchPattern=larger_2.LargerThan)  # -> ListA, ListB
dispatch_3 = Dispatch(List=pshift_2, DispatchPattern=larger_2.LargerThan)  # -> ListA, ListB
eval = EvaluateLength(Curve=dispatch_3.ListA, Length="0.5", Normalized=True)  # -> Point, Tangent, Parameter
pt = Point(dispatch_2.ListA)
pln = Plane(dispatch_2.ListA)
pt_2 = Point(eval.Point)
vec2pt = Vector2Pt(PointA=pt_2, PointB=pt, Unitize=False)  # -> Vector, Length

amp = Amplitude(Vector=vec2pt.Vector, Amplitude=dogbone_radius_2)

move = Move(Geometry=pln, Motion=amp)  # -> Geometry, Transform
cir_5 = Circle(Plane=move.Geometry, Radius=dogbone_radius_2)

lng_2 = ListLength(List=cir_5)
larger_3 = LargerThan(FirstNumber=lng_2, SecondNumber="0.01")  # -> LargerThan, OrEqualTo
pshift_4 = ShiftPaths(Data=larger_3.LargerThan, Offset=-1)
ma_2 = MassAddition(Input=pshift_4)  # -> Result, PartialResults
dispatch_4 = Dispatch(List=curves_for_dogbone, DispatchPattern=pshift_4)  # -> ListA, ListB
crv = Curve(dispatch_4.ListB)
smaller_2 = SmallerThan(FirstNumber=ma_2.Result, SecondNumber="0.5")  # -> SmallerThan, OrEqualTo
clean = CleanTree(RemoveNulls=True, RemoveInvalid=True, RemoveEmpty=False, Tree=crv)

crv_2 = Curve(curves_for_dogbone)
graft_2 = GraftTree(Tree=crv_2, IncludeEmptyLists=True, IncludeNullItems=True)
runion_2 = RegionUnion(Curves=[cir_5, graft_2])
pshift_5 = ShiftPaths(Data=runion_2, Offset=-1)
pshift_6 = ShiftPaths(Data=pshift_5, Offset=-1)

filter_5 = StreamFilter(Gate=smaller_2.SmallerThan, Stream0=pshift_6)
merge = Merge(Data1=filter_5, Data2=clean)
dogboned_inside_curves = Curve(merge)

larger_4 = LargerThan(FirstNumber=len_4, SecondNumber=multiplication_4)  # -> LargerThan, OrEqualTo
dogbone_radius_3 = Panel(dogbone_radius)
dispatch_5 = Dispatch(List=disc_2.Points, DispatchPattern=larger_4.LargerThan)  # -> ListA, ListB
dispatch_6 = Dispatch(List=pshift_3, DispatchPattern=larger_4.LargerThan)  # -> ListA, ListB
eval_2 = EvaluateLength(Curve=dispatch_6.ListA, Length="0.5", Normalized=True)  # -> Point, Tangent, Parameter
pln_2 = Plane(dispatch_5.ListA)
pt_3 = Point(dispatch_5.ListA)
pt_4 = Point(eval_2.Point)
vec2pt_2 = Vector2Pt(PointA=pt_4, PointB=pt_3, Unitize=False)  # -> Vector, Length

amp_2 = Amplitude(Vector=vec2pt_2.Vector, Amplitude=dogbone_radius_3)

move_2 = Move(Geometry=pln_2, Motion=amp_2)  # -> Geometry, Transform
cir_6 = Circle(Plane=move_2.Geometry, Radius=dogbone_radius_3)

crv_3 = Curve(curves_for_dogbone_2)
flip_cornes_boolean_5 = Panel(flip_cornes_boolean_2)
graft_3 = GraftTree(Tree=crv_3, IncludeEmptyLists=True, IncludeNullItems=True)
gate = StreamGate(Stream=[graft_3, cir_6], Gate=flip_cornes_boolean_5)  # -> Target0, Target1
gate_2 = StreamGate(Stream=graft_3, Gate=flip_cornes_boolean_5)  # -> Target0, Target1
gate_3 = StreamGate(Stream=cir_6, Gate=flip_cornes_boolean_5)  # -> Target0, Target1
runion_3 = RegionUnion(Curves=gate.Target1)
rdiff = RegionDifference(CurvesA=gate_2.Target0, CurvesB=gate_3.Target0)
filter_6 = StreamFilter(Gate=flip_cornes_boolean_5, Stream0=rdiff, Stream1=runion_3)
pshift_7 = ShiftPaths(Data=filter_6, Offset=-1)
pshift_8 = ShiftPaths(Data=pshift_7, Offset=-1)

lng_3 = ListLength(List=cir_6)
larger_5 = LargerThan(FirstNumber=lng_3, SecondNumber="0.01")  # -> LargerThan, OrEqualTo
pshift_9 = ShiftPaths(Data=larger_5.LargerThan, Offset=-1)
ma_3 = MassAddition(Input=pshift_9)  # -> Result, PartialResults
dispatch_7 = Dispatch(List=curves_for_dogbone_2, DispatchPattern=pshift_9)  # -> ListA, ListB
crv_4 = Curve(dispatch_7.ListB)
smaller_3 = SmallerThan(FirstNumber=ma_3.Result, SecondNumber="0.5")  # -> SmallerThan, OrEqualTo
clean_2 = CleanTree(RemoveNulls=True, RemoveInvalid=True, RemoveEmpty=False, Tree=crv_4)

filter_7 = StreamFilter(Gate=smaller_3.SmallerThan, Stream0=pshift_8)
merge_2 = Merge(Data1=filter_7, Data2=clean_2)
dogboned_outside_curves = Curve(merge_2)
merge_3 = Merge(Data1=dogboned_inside_curves, Data2=dogboned_outside_curves)
flatten_2 = FlattenTree(Tree=merge_3, Path="{0}")
end_2 = EndPoints(Curve=flatten_2)  # -> Start, End
dup = DuplicateData(Data=graft(flatten_2), Number=lng, Order=True)
flip_2 = FlipMatrix(Data=dup)
crv_cp = CurveClosestPoint(Point=end_2.Start, Curve=graft(curves_to_dogbone_3))  # -> Point, Parameter, Distance
pshift_10 = ShiftPaths(Data=flip_2, Offset=-1)
sort = SortList(Keys=crv_cp.Distance, ValuesA=pshift_10)  # -> Keys, ValuesA
item_2 = ListItem(List=sort.ValuesA, Index=0, Wrap=True)
flatten_3 = FlattenTree(Tree=item_2, Path="{0}")
dogboned_curves = Curve(flatten_3)
dogboned_curves_2 = ClusterOutput(dogboned_curves)

# ==== cluster AutomillWIP
breps_to_mill = ClusterInput()
extra_cut_depth = Panel("0.6")
breps_to_mill_2 = Brep(breps_to_mill)
clean = CleanTree(RemoveNulls=True, RemoveInvalid=True, RemoveEmpty=False, Tree=breps_to_mill_2)

# ---- group: Detect surfaces for robo fab finishing pass
number_slider = Slider(5, range=0..10)
surfaces_from_brep = Surface()
identifier_surfaces = Surface(<surface referenced from the Rhino model>)
sdivide = DivideSurface(Surface=identifier_surfaces, UCount=number_slider, VCount=number_slider)  # -> Points, Normals, Parameters
graft = GraftTree(Tree=surfaces_from_brep, IncludeEmptyLists=True, IncludeNullItems=True)
srf_cp = SurfaceClosestPoint(Point=sdivide.Points, Surface=graft)  # -> Point, UVPoint, Distance
avr = Average(Input=srf_cp.Distance)
simplify = SimplifyTree(Tree=avr, Front=False)
equals = Equality(FirstNumber=simplify, SecondNumber="0")  # -> Equality, Inequality
dispatch = Dispatch(List=graft, DispatchPattern=equals.Equality)  # -> ListA, ListB
identified_surfaces = Surface(dispatch.ListA)

# ----
bbox = BoundingBox(Content=clean, Plane=PlaneXY(0, 0, 0))  # -> Box, Box_2
debrep = DeconstructBrep(Brep=bbox.Box)  # -> Faces, Edges, Vertices
item = ListItem(List=debrep.Edges, Index="8", Wrap=True)
pshift = ShiftPaths(Data=item, Offset=-1)
end = EndPoints(Curve=pshift)  # -> Start, End
len = Length(Curve=pshift)
pt = Point(end.End)
pdecon = Deconstruct(Point=pt)  # -> XComponent, YComponent, ZComponent
object_heights = Panel(len)
lovest_points = Panel(pdecon.ZComponent)

tolerance = Panel("0.01")

debrep_2 = DeconstructBrep(Brep=clean)  # -> Faces, Edges, Vertices
planar = IsPlanar(Surface=debrep_2.Faces, Interior=True)  # -> Planar, Plane
dispatch_2 = Dispatch(List=debrep_2.Faces, DispatchPattern=planar.Planar)  # -> ListA, ListB
dispatch_3 = Dispatch(List=planar.Plane, DispatchPattern=planar.Planar)  # -> ListA, ListB
curving_surfaces = Surface(dispatch_2.ListB)
planar_surfaces = Surface(dispatch_2.ListA)
Z = UnitZ(Factor=1)
align = AlignPlane(Plane=dispatch_3.ListA, Direction=Z)  # -> Plane, Angle
deplane = DeconstructPlane(Plane=align.Plane)  # -> Origin, XAxis, YAxis, ZAxis
angle = Angle(VectorA=deplane.XAxis, VectorB=Z)  # -> Angle, Reflex
larger = LargerThan(FirstNumber=angle.Angle, SecondNumber="0.01")  # -> LargerThan, OrEqualTo
pi = Pi(Factor=1)
dispatch_4 = Dispatch(List=planar_surfaces, DispatchPattern=larger.LargerThan)  # -> ListA, ListB
multiplication = Multiplication(A="0.5", B=pi)
dispatch_5 = Dispatch(List=angle.Angle, DispatchPattern=larger.LargerThan)  # -> ListA, ListB
non_vertical_surfaces = Surface(dispatch_4.ListA)

multiplication_2 = Multiplication(A=multiplication, B="10000")
multiplication_3 = Multiplication(A=dispatch_5.ListA, B="10000")
int = Integer(multiplication_3)
int_2 = Integer(multiplication_2)

equals_2 = Equality(FirstNumber=int, SecondNumber=int_2)  # -> Equality, Inequality

dispatch_6 = Dispatch(List=non_vertical_surfaces, DispatchPattern=equals_2.Equality)  # -> ListA, ListB

horizontal_surfaces = Surface(dispatch_6.ListA)
breps_to_mill_3 = Brep(clean)
graft_2 = GraftTree(Tree=breps_to_mill_3, IncludeEmptyLists=True, IncludeNullItems=True)
area = Area(Geometry=horizontal_surfaces)  # -> Area, Centroid
mesh = MeshBrep(
    Brep=graft_2,
    Settings={GridMaxCount=0, GridMinCount=16, JaggedSeams=False, MaxEdgeLength=0, MinEdgeLength=0.0001, MinTolerance=0, Refine=True, RefineAngle=0, RelativeTolerance=0.65, SimplePlanes=True, Tolerance=0})
srf_cp_2 = SurfaceClosestPoint(Point=area.Centroid, Surface=horizontal_surfaces)  # -> Point, UVPoint, Distance
vec2pt = Vector2Pt(PointA=area.Centroid, PointB=srf_cp_2.Point, Unitize=False)  # -> Vector, Length
addition = Addition(A=srf_cp_2.Distance, B="0.1")
amp = Amplitude(Vector=vec2pt.Vector, Amplitude=addition)
move = Move(Geometry=area.Centroid, Motion=amp)  # -> Geometry, Transform
meshcp = MeshClosestPoint(Point=move.Geometry, Mesh=mesh)  # -> Point, Index, Parameter
meval = MeshEval(Mesh=mesh, Parameter=meshcp.Parameter)  # -> Point, Normal, Colour
Z_2 = UnitZ(Factor=1)
angle_2 = Angle(VectorA=meval.Normal, VectorB=Z_2)  # -> Angle, Reflex
larger_2 = LargerThan(FirstNumber=angle_2.Angle, SecondNumber=multiplication)  # -> LargerThan, OrEqualTo
dispatch_7 = Dispatch(List=horizontal_surfaces, DispatchPattern=larger_2.LargerThan)  # -> ListA, ListB
upward_pointing_surfaces = Surface(dispatch_7.ListB)

downward_pointing_surfaces = Surface(dispatch_7.ListA)

upward_pointing_surfaces_2 = Surface(upward_pointing_surfaces)
planar_2 = IsPlanar(Surface=upward_pointing_surfaces_2, Interior=True)  # -> Planar, Plane
deplane_2 = DeconstructPlane(Plane=planar_2.Plane)  # -> Origin, XAxis, YAxis, ZAxis
pdecon_2 = Deconstruct(Point=deplane_2.Origin)  # -> XComponent, YComponent, ZComponent
multiplication_4 = Multiplication(A=pdecon_2.ZComponent, B="100")
int_3 = Integer(multiplication_4)
equals_3 = Equality(FirstNumber=int_3, SecondNumber="0")  # -> Equality, Inequality
dispatch_8 = Dispatch(List=upward_pointing_surfaces_2, DispatchPattern=equals_3.Equality)  # -> ListA, ListB
lower_surfaces = Surface(dispatch_8.ListB)

tolerance_2 = Panel(tolerance)
lovest_points_2 = Panel(lovest_points)
breps_to_mill_4 = Brep(clean)
non_vertical_surfaces_2 = Surface(non_vertical_surfaces)
custom_mesh_settings = SettingsCustom(
    StitchSeams=True,
    SimplePlanes=False,
    Refine=True,
    MinCount=16,
    MaxCount=400,
    AspectRatio=20,
    MaxDistance=tolerance_2,
    MaxAngle=20,
    MinEdge=0,
    MaxEdge=0)
smooth = SettingsQuality()
mesh_2 = MeshBrep(Brep=breps_to_mill_4, Settings=smooth)
mesh_3 = MeshBrep(Brep=breps_to_mill_4, Settings=custom_mesh_settings)
meshes_from_breps = Mesh(mesh_2)
xy = XYPlane(Origin=Point(0, 0, 0))
meshes_from_breps_2 = Mesh(mesh_3)
xy_2 = XYPlane(Origin=Point(0, 0, 0))
abs = Absolute(Value=lovest_points_2)
mshadow = MeshShadow(Mesh=meshes_from_breps, Light=Vector(0, 0, -1), Plane=xy)
mshadow_2 = MeshShadow(Mesh=meshes_from_breps_2, Light=Vector(0, 0, -1), Plane=xy_2)
join = JoinCurves(Curves=mshadow, Preserve=False)
join_2 = JoinCurves(Curves=mshadow_2, Preserve=False)
area_2 = Area(Geometry=join)  # -> Area, Centroid
area_3 = Area(Geometry=join_2)  # -> Area, Centroid
smaller = SmallerThan(FirstNumber=area_3.Area, SecondNumber=area_2.Area)  # -> SmallerThan, OrEqualTo
p_n_c = PickNChoose(Pattern=smaller.SmallerThan, Stream0=join_2, Stream1=join)
simplify_2 = SimplifyTree(Tree=p_n_c, Front=False)
master_shadow_curve = Curve(simplify_2)

master_shadow_curve_2 = Curve(master_shadow_curve)
flatten = FlattenTree(Tree=master_shadow_curve_2, Path="{0}")
null = NullItem(Item=flatten)  # -> NullFlags, InvalidFlags, Description
filter = StreamFilter(Gate=null.NullFlags, Stream0=master_shadow_curve_2, Stream1=mshadow)
master_shadow_curve_3 = Curve(filter)

ma = MassAddition(Input=area_2.Area)  # -> Result, PartialResults
ma_2 = MassAddition(Input=area_3.Area)  # -> Result, PartialResults
smaller_2 = SmallerThan(FirstNumber=ma_2.Result, SecondNumber=ma.Result)  # -> SmallerThan, OrEqualTo
simplify_3 = SimplifyTree(Tree=smaller_2.SmallerThan, Front=False)
weave = Weave(Pattern=simplify_3, Stream0=graft(meshes_from_breps_2), Stream1=graft(meshes_from_breps), NullGaps=False)
flatten_2 = FlattenTree(Tree=weave, Path="{0}")
mjoin = MeshJoin(Meshes=flatten_2)
joined_mesh_mesh_from_breps = Mesh(mjoin)

curving_surfaces_2 = Surface(curving_surfaces)
slanted_surfaces = Surface(dispatch_6.ListB)
merge = Merge(Data1=flatten(slanted_surfaces), Data2=flatten(curving_surfaces_2))
_3d_mill_surfaces = Surface(reparameterize(merge))
collision_detect_mesh = Mesh(joined_mesh_mesh_from_breps)
collision_detect_mesh_2 = ClusterOutput(collision_detect_mesh)
_3d_mill_surfaces_2 = ClusterOutput(_3d_mill_surfaces)

lower_surfaces_2 = Surface(dispatch_8.ListB)
edges = BrepEdges(Brep=lower_surfaces_2)  # -> Naked, Interior, NonManifold
join_3 = JoinCurves(Curves=edges.Naked, Preserve=False)
pshift_2 = ShiftPaths(Data=join_3, Offset=-1)
pshift_3 = ShiftPaths(Data=pshift_2, Offset=-1)
clean_2 = CleanTree(RemoveNulls=True, RemoveInvalid=True, RemoveEmpty=Toggle(True), Tree=pshift_3)
pocket_curves = Curve(clean_2)
xy_3 = XYPlane(Origin=Point(0, 0, 0))

extended_pocket_curves = Curve(reparameterize(pocket_curves))

graft_3 = GraftTree(Tree=abs, IncludeEmptyLists=True, IncludeNullItems=True)
lng = ListLength(List=master_shadow_curve_3)
pshift_4 = ShiftPaths(Data=lng, Offset=-1)
pshift_5 = ShiftPaths(Data=pshift_4, Offset=-1)
redpline = Reduce(Polyline=master_shadow_curve_3, Tolerance=tolerance_2)  # -> Polyline, Reduction
extra_cut_depth_2 = Panel(extra_cut_depth)
flatten_3 = FlattenTree(Tree=redpline.Polyline, Path="{0}")
cutout_curves = Curve(flatten_3)

simplify_4 = SimplifyTree(Tree=graft_3, Front=False)

dup = DuplicateData(Data=simplify_4, Number=lng, Order=True)
cut_depths = Panel(dup)
addition_2 = Addition(A=cut_depths, B=extra_cut_depth_2)
flatten_4 = FlattenTree(Tree=addition_2, Path="{0}")
item_2 = ListItem(List=cut_depths, Index=0, Wrap=True)
cut_depths_with_margin = Panel(flatten_4)
null_2 = NullItem(Item=item_2)  # -> NullFlags, InvalidFlags, Description
filter_2 = StreamFilter(Gate=null_2.NullFlags, Stream0=cut_depths_with_margin, Stream1=cut_depths)

cutout_curves_2 = Curve(cutout_curves)
cutout_depths = Number(filter_2)
cutout_depths_2 = ClusterOutput(cutout_depths)
cutout_curves_3 = ClusterOutput(cutout_curves_2)

end_2 = EndPoints(Curve=extended_pocket_curves)  # -> Start, End
pdecon_3 = Deconstruct(Point=end_2.Start)  # -> XComponent, YComponent, ZComponent
abs_2 = Absolute(Value=pdecon_3.ZComponent)
project = Project(Geometry=extended_pocket_curves, Plane=xy_3)  # -> Geometry, Transform
flatten_5 = FlattenTree(Tree=project.Geometry, Path="{0}")
clean_3 = CleanTree(RemoveNulls=True, RemoveInvalid=True, RemoveEmpty=False, Tree=flatten_5)
pocket_curves_2 = Curve(clean_3)

clean_4 = CleanTree(RemoveNulls=True, RemoveInvalid=True, RemoveEmpty=False, Tree=abs_2)

pocket_depths = Panel(clean_4)

flatten_6 = FlattenTree(Tree=pocket_depths, Path="{0}")
pocket_depths_2 = Panel(flatten_6)
pocket_curves_3 = Curve(pocket_curves_2)
pocket_depths_3 = Number(pocket_depths_2)
pocket_curves_4 = ClusterOutput(pocket_curves_3)
pocket_depths_4 = ClusterOutput(pocket_depths_3)

# ==== cluster Surface3DMill
prioritize_fastest_milling_direction = ClusterInput()
surfaces_for_3d_mill = ClusterInput()
collision_mesh = ClusterInput()
milling_bit_diameter = ClusterInput()
stepover = ClusterInput()
overshoot_margin_mm = ClusterInput()
make_horizontal_toolpaths = ClusterInput()
include_surface_edges = ClusterInput()
use_ballnose_for_3d_milling = ClusterInput()
connect_toolpaths_levels = ClusterInput()
tolerance = ClusterInput()
prioritize_fastest_milling_direction_2 = Boolean(prioritize_fastest_milling_direction)
toggle = BooleanToggle(True)
toggle_2 = BooleanToggle(True)
toggle_3 = BooleanToggle(True)
toggle_4 = BooleanToggle(True)
overshoot_margin_mm_2 = Number(overshoot_margin_mm)
make_horizontal_toolpaths_2 = Boolean(make_horizontal_toolpaths)
use_ballnose_for_3d_milling_2 = Boolean(use_ballnose_for_3d_milling)
toggle_5 = BooleanToggle(True)
connect_toolpaths_levels_2 = Boolean(connect_toolpaths_levels)
include_surface_edges_2 = Boolean(include_surface_edges)
milling_bit_diameter_2 = Number(milling_bit_diameter)
stepover_2 = Number(stepover)
tolerance_2 = Number(tolerance)
surfaces_for_3d_mill_2 = Surface(surfaces_for_3d_mill)
collision_mesh_2 = Mesh(collision_mesh)
prioritize_fastest_milling_direction_3 = Panel(prioritize_fastest_milling_direction_2)
connect_toolpath_tolerance_factor = Panel("4")
number_of_iso_curve_samples = Panel("10")
make_horizontal_toolpaths_3 = Panel(make_horizontal_toolpaths_2)
connect_toolpaths_levels_3 = Panel(connect_toolpaths_levels_2)
include_surface_edges_3 = Panel(include_surface_edges_2)
use_ballnose_for_3d_milling_3 = Panel(use_ballnose_for_3d_milling_2)
tolerance_3 = Panel(tolerance_2)
overshoot_margin_mm_3 = Panel(overshoot_margin_mm_2)
millling_bit_diameter = Panel(milling_bit_diameter_2)
stepover_3 = Panel(stepover_2)
flatten = FlattenTree(Tree=collision_mesh_2, Path="{0}")
mjoin = MeshJoin(Meshes=flatten)
multiplication = Multiplication(A=millling_bit_diameter, B=stepover_3)
stepover_distance = Panel(multiplication)
multiplication_2 = Multiplication(A=millling_bit_diameter, B="0.5")
millling_bit_radius = Panel(multiplication_2)
srf = Surface(surfaces_for_3d_mill_2)
stepover_distance_2 = Panel(stepover_distance)
stepover_distance_3 = Panel(stepover_distance)
prioritize_fastest_milling_direction_4 = Panel(prioritize_fastest_milling_direction_3)
use_ballnose_for_3d_milling_4 = Panel(use_ballnose_for_3d_milling_3)
use_ballnose_for_3d_milling_5 = Panel(use_ballnose_for_3d_milling_3)
connect_toolpaths_levels_booloean = Boolean(connect_toolpaths_levels_3)
lng = ListLength(List=srf)
smaller = SmallerThan(FirstNumber=lng, SecondNumber="2")  # -> SmallerThan, OrEqualTo
connect_toolpaths_levels_booloean_2 = Boolean(connect_toolpaths_levels_booloean)

# ---- group: Rebuild planar surfaces to help make horizontal milling diractions
flatten_2 = FlattenTree(Tree=surfaces_for_3d_mill_2, Path="{0}")  # disabled
planar = IsPlanar(Surface=flatten_2, Interior=True)  # -> Planar, Plane
dispatch = Dispatch(List=flatten_2, DispatchPattern=planar.Planar)  # -> ListA, ListB
edges = BrepEdges(Brep=dispatch.ListA)  # -> Naked, Interior, NonManifold
boundary = BoundarySurfaces(Edges=edges.Naked)
pshift = ShiftPaths(Data=boundary, Offset=-1)
srf_2 = Surface(flatten_2)
weave = Weave(Pattern=planar.Planar, Stream0=dispatch.ListB, Stream1=srf_2, NullGaps=False)

# ----
srf_3 = Surface(pshift)
area = Area(Geometry=srf_3)  # -> Area, Centroid
srf_cp = SurfaceClosestPoint(Point=area.Centroid, Surface=srf_3)  # -> Point, UVPoint, Distance
evalsrf = EvaluateSurface(Surface=srf_3, Point=srf_cp.UVPoint)  # -> Point, Normal, Frame
amp = Amplitude(Vector=evalsrf.Normal, Amplitude=Slider(1, range=0..1))
move = Move(Geometry=evalsrf.Point, Motion=amp)  # -> Geometry, Transform
pdecon = Deconstruct(Point=evalsrf.Point)  # -> XComponent, YComponent, ZComponent
pdecon_2 = Deconstruct(Point=move.Geometry)  # -> XComponent, YComponent, ZComponent
smaller_2 = SmallerThan(FirstNumber=pdecon_2.ZComponent, SecondNumber=pdecon.ZComponent)  # -> SmallerThan, OrEqualTo
dispatch_2 = Dispatch(List=srf_3, DispatchPattern=smaller_2.SmallerThan)  # -> ListA, ListB
flip = Flip(Surface=dispatch_2.ListA)  # -> Surface, Result
weave_2 = Weave(Pattern=smaller_2.SmallerThan, Stream0=dispatch_2.ListB, Stream1=flip.Surface, NullGaps=False)

# ---- group: Rebuild planar surfaces to help make horizontal milling diractions (continued)
srf_4 = Surface(weave_2)

# ---- group: Surface isocurve extraction
surfaces_for_3d_mill_3 = Surface(reparameterize(srf))
number_of_iso_curve_samples_2 = Panel(number_of_iso_curve_samples)
collision_mesh_3 = Mesh(mjoin)
make_horizontal_isocurves = Panel(make_horizontal_toolpaths_3)
include_surface_edges_boolean = Panel(include_surface_edges_3)
untrim = Untrim(Surface=surfaces_for_3d_mill_3)
surfaces_for_isocurve_extraction = Surface(untrim)
panel = Panel(number_of_iso_curve_samples_2)
subtraction = Subtraction(A="1", B="0.01")
subtraction_2 = Subtraction(A=subtraction, B="0.01")
subtraction_3 = Subtraction(A=panel, B="1")
division = Division(A=subtraction_2, B=subtraction_3)
series = Series(Start="0.01", Step=division, Count=panel)
pt = ConstructPoint(XCoordinate=series, YCoordinate=series, ZCoordinate=0)
iso = IsoCurve(Surface=surfaces_for_isocurve_extraction, UVPoint=graft(pt))  # -> UIsocurve, VIsocurve
pshift_2 = ShiftPaths(Data=iso.VIsocurve, Offset=-1)
pshift_3 = ShiftPaths(Data=iso.UIsocurve, Offset=-1)
flip_2 = FlipMatrix(Data=pshift_2)
flip_3 = FlipMatrix(Data=pshift_3)
bbox = BoundingBox(Content=flip_3, Plane=PlaneXY(0, 0, 0))  # -> Box, Box_2
bbox_2 = BoundingBox(Content=flip_2, Plane=PlaneXY(0, 0, 0))  # -> Box, Box_2
debox = DeconstructBox(Box=bbox.Box)  # -> Plane, X, Y, Z
debox_2 = DeconstructBox(Box=bbox_2.Box)  # -> Plane, X, Y, Z
dedomain = DeconstructDomain(Domain=debox.Z)  # -> Start, End
dedomain_2 = DeconstructDomain(Domain=debox_2.Z)  # -> Start, End
pt_2 = ConstructPoint(XCoordinate=0, YCoordinate=0, ZCoordinate=dedomain.End)
pt_3 = ConstructPoint(XCoordinate=0, YCoordinate=0, ZCoordinate=dedomain.Start)
pt_4 = ConstructPoint(XCoordinate=0, YCoordinate=0, ZCoordinate=dedomain_2.End)
pt_5 = ConstructPoint(XCoordinate=0, YCoordinate=0, ZCoordinate=dedomain_2.Start)
ln = Line(StartPoint=pt_3, EndPoint=pt_2)
ln_2 = Line(StartPoint=pt_5, EndPoint=pt_4)
len = Length(Curve=ln)
len_2 = Length(Curve=ln_2)
avr = Average(Input=len)
avr_2 = Average(Input=len_2)
larger = LargerThan(FirstNumber=avr, SecondNumber=avr_2)  # -> LargerThan, OrEqualTo
make_horizontal_isocurves_boolean = Boolean(make_horizontal_isocurves)
stepover_distance_4 = Panel(stepover_distance)
surfaces_for_3d_mill_4 = Surface(reparameterize(surfaces_for_3d_mill_3))
edges_2 = BrepEdges(Brep=surfaces_for_3d_mill_4)  # -> Naked, Interior, NonManifold
crv = Curve([edges_2.Naked, edges_2.Interior])
include_surface_edges_boolean_2 = Panel(include_surface_edges_boolean)

# ----
bbox_3 = BoundingBox(Content=collision_mesh_3, Plane=PlaneXY(0, 0, 0))  # -> Box, Box_2
debrep = DeconstructBrep(Brep=bbox_3.Box)  # -> Faces, Edges, Vertices
item = ListItem(List=debrep.Edges, Index="8", Wrap=True)
pshift_4 = ShiftPaths(Data=item, Offset=-1)
len_3 = Length(Curve=pshift_4)
object_height = Panel(len_3)

u_or_v_boolean = Boolean(larger.LargerThan)

# ---- group: Surface isocurve extraction (continued)
not = GateNot(A=u_or_v_boolean)
filter = StreamFilter(Gate=make_horizontal_isocurves_boolean, Stream0=u_or_v_boolean, Stream1=not)
u_or_v_slice_booleans = Panel(filter)
weave_3 = Weave(Pattern=u_or_v_slice_booleans, Stream0=flip_3, Stream1=flip_2, NullGaps=False)
simplify = SimplifyTree(Tree=weave_3, Front=False)
crv_2 = Curve(simplify)
len_4 = Length(Curve=crv_2)
u_or_v_slice_booleans_2 = Panel(u_or_v_slice_booleans)
simplify_2 = SimplifyTree(Tree=u_or_v_slice_booleans_2, Front=False)

avr_3 = Average(Input=len_4)
division_2 = Division(A=len_4, B=avr_3)
sort = SortList(Keys=division_2)  # -> Keys, ValuesA
rev = ReverseList(List=sort.Keys)
item_2 = ListItem(List=rev, Index=0, Wrap=True)
division_3 = Division(A=division_2, B=item_2)
graph = GraphMapper(division_3, x0=0, x1=1, y0=0, y1=1, container_name="Bezier", cpx=[0, 0, 0, 1], cpy=[0, 1, 1, 1])
multiplication_3 = Multiplication(A=graph, B=item_2)
multiplication_4 = Multiplication(A=avr_3, B=multiplication_3)
avr_4 = Average(Input=multiplication_4)

base_lenghts_for_stepover_distance = Panel(avr_4)
division_4 = Division(A=base_lenghts_for_stepover_distance, B=stepover_distance_4)
round = Round(Number=division_4)  # -> Nearest, Floor, Ceiling
number_of_iscourves = Panel(round.Ceiling)
panel_2 = Panel(number_of_iscourves)
subtraction_4 = Subtraction(A=panel_2, B="1")
division_5 = Division(A="1", B=subtraction_4)
series_2 = Series(Start=0, Step=division_5, Count=panel_2)
pt_6 = ConstructPoint(XCoordinate=series_2, YCoordinate=series_2, ZCoordinate=0)
pshift_5 = ShiftPaths(Data=pt_6, Offset=-1)
iso_2 = IsoCurve(Surface=graft(surfaces_for_3d_mill_4), UVPoint=pshift_5)  # -> UIsocurve, VIsocurve
pshift_6 = ShiftPaths(Data=iso_2.UIsocurve, Offset=-1)
pshift_7 = ShiftPaths(Data=iso_2.VIsocurve, Offset=-1)
weave_4 = Weave(Pattern=simplify_2, Stream0=pshift_7, Stream1=pshift_6, NullGaps=False)
merge = Merge(Data1=crv, Data2=weave_4)
filter_2 = StreamFilter(Gate=include_surface_edges_boolean_2, Stream0=weave_4, Stream1=merge)
toolpaths_from_isocurves = Curve(filter_2)

# ----
toolpaths_from_isocurves_2 = Curve(toolpaths_from_isocurves)

not_2 = GateNot(A=filter)
u_or_v_slice_booleans_3 = Panel(not_2)
weave_5 = Weave(Pattern=u_or_v_slice_booleans_3, Stream0=flip_3, Stream1=flip_2, NullGaps=False)
simplify_3 = SimplifyTree(Tree=weave_5, Front=False)
crv_3 = Curve(simplify_3)
len_5 = Length(Curve=crv_3)
stepover_distance_5 = Panel(stepover_distance)
surfaces_for_3d_mill_5 = Surface(reparameterize(surfaces_for_3d_mill_3))
u_or_v_slice_booleans_4 = Panel(u_or_v_slice_booleans_3)
edges_3 = BrepEdges(Brep=surfaces_for_3d_mill_5)  # -> Naked, Interior, NonManifold
crv_4 = Curve([edges_3.Naked, edges_3.Interior])
simplify_4 = SimplifyTree(Tree=u_or_v_slice_booleans_4, Front=False)
include_surface_edges_boolean_3 = Panel(include_surface_edges_boolean)

avr_5 = Average(Input=len_5)
division_6 = Division(A=len_5, B=avr_5)
sort_2 = SortList(Keys=division_6)  # -> Keys, ValuesA
rev_2 = ReverseList(List=sort_2.Keys)
item_3 = ListItem(List=rev_2, Index=0, Wrap=True)
division_7 = Division(A=division_6, B=item_3)
graph_2 = GraphMapper(division_7, x0=0, x1=1, y0=0, y1=1, container_name="Bezier", cpx=[0, 0, 0, 1], cpy=[0, 1, 1, 1])
multiplication_5 = Multiplication(A=graph_2, B=item_3)
multiplication_6 = Multiplication(A=avr_5, B=multiplication_5)
avr_6 = Average(Input=multiplication_6)

base_lenghts_for_stepover_distance_2 = Panel(avr_6)
division_8 = Division(A=base_lenghts_for_stepover_distance_2, B=stepover_distance_5)
round_2 = Round(Number=division_8)  # -> Nearest, Floor, Ceiling
number_of_iscourves_2 = Panel(round_2.Ceiling)
panel_3 = Panel(number_of_iscourves_2)
subtraction_5 = Subtraction(A=panel_3, B="1")
division_9 = Division(A="1", B=subtraction_5)
series_3 = Series(Start=0, Step=division_9, Count=panel_3)
pt_7 = ConstructPoint(XCoordinate=series_3, YCoordinate=series_3, ZCoordinate=0)
pshift_8 = ShiftPaths(Data=pt_7, Offset=-1)
iso_3 = IsoCurve(Surface=graft(surfaces_for_3d_mill_5), UVPoint=pshift_8)  # -> UIsocurve, VIsocurve
pshift_9 = ShiftPaths(Data=iso_3.UIsocurve, Offset=-1)
pshift_10 = ShiftPaths(Data=iso_3.VIsocurve, Offset=-1)
weave_6 = Weave(Pattern=simplify_4, Stream0=pshift_10, Stream1=pshift_9, NullGaps=False)
merge_2 = Merge(Data1=crv_4, Data2=weave_6)
filter_3 = StreamFilter(Gate=include_surface_edges_boolean_3, Stream0=weave_6, Stream1=merge_2)
opposite_toolpaths_from_isocurves = Curve(filter_3)

# ---- group: Dicover fastest milling direction
opposite_toolpaths_from_isocurves_2 = Curve(reparameterize(opposite_toolpaths_from_isocurves))
toolpaths_from_isocurves_3 = Curve(reparameterize(filter_2))
len_6 = Length(Curve=toolpaths_from_isocurves_3)
len_7 = Length(Curve=opposite_toolpaths_from_isocurves_2)
ma = MassAddition(Input=len_6)  # -> Result, PartialResults
ma_2 = MassAddition(Input=len_7)  # -> Result, PartialResults
group = Group(Objects=opposite_toolpaths_from_isocurves_2)
group_2 = Group(Objects=toolpaths_from_isocurves_3)

# ----
lng_2 = ListLength(List=toolpaths_from_isocurves_3)
lng_3 = ListLength(List=opposite_toolpaths_from_isocurves_2)
multiplication_7 = Multiplication(A=lng_2, B=stepover_distance_2)
multiplication_8 = Multiplication(A=lng_3, B=stepover_distance_3)
addition = Addition(A=ma_2.Result, B=multiplication_8)
addition_2 = Addition(A=ma.Result, B=multiplication_7)
lng_4 = ListLength(List=toolpaths_from_isocurves_3)
lng_5 = ListLength(List=opposite_toolpaths_from_isocurves_2)
larger_2 = LargerThan(FirstNumber=addition_2, SecondNumber=addition)  # -> LargerThan, OrEqualTo
larger_3 = LargerThan(FirstNumber=lng_4, SecondNumber=lng_5)  # -> LargerThan, OrEqualTo

# ---- group: Dicover fastest milling direction (continued)
p_n_c = PickNChoose(Pattern=larger_3.LargerThan, Stream0=group_2, Stream1=group)
ungroup = Ungroup(Group=p_n_c)
simplify_5 = SimplifyTree(Tree=ungroup, Front=False)
shortest_toolpaths_from_isocurves = Curve(simplify_5)

# ----
shortest_toolpaths_from_isocurves_2 = Curve(shortest_toolpaths_from_isocurves)
filter_4 = StreamFilter(
    Gate=prioritize_fastest_milling_direction_4,
    Stream0=toolpaths_from_isocurves_2,
    Stream1=shortest_toolpaths_from_isocurves_2)

# ---- group: Remove undercut points
surfaces_for_3d_mill_6 = Surface(reparameterize(surfaces_for_3d_mill_3))
toolpaths_from_isocurves_4 = Curve(filter_4)
tolerance_4 = Panel(tolerance_3)
topoly = CurveToPolyline(Curve=toolpaths_from_isocurves_4, ToleranceDistance=tolerance_4, ToleranceAngle=0)  # -> Polyline, Segments
surfaces_for_3d_mill_7 = Surface(reparameterize(surfaces_for_3d_mill_6))
cp = ControlPoints(Curve=topoly.Polyline)  # -> Points, Weights, Knots
pshift_11 = ShiftPaths(Data=cp.Points, Offset=-1)
srf_cp_2 = SurfaceClosestPoint(Point=pshift_11, Surface=graft(surfaces_for_3d_mill_7))  # -> Point, UVPoint, Distance
evalsrf_2 = EvaluateSurface(Surface=graft(surfaces_for_3d_mill_7), Point=srf_cp_2.UVPoint)  # -> Point, Normal, Frame
unflatten = UnflattenTree(Tree=evalsrf_2.Point, Guide=cp.Points)
unflatten_2 = UnflattenTree(Tree=evalsrf_2.Normal, Guide=cp.Points)
amp_2 = Amplitude(Vector=unflatten_2, Amplitude="1")
move_2 = Move(Geometry=unflatten, Motion=amp_2)  # -> Geometry, Transform
pt_8 = Point(unflatten)
neg = Negative(Value="0.0001")
Z = UnitZ(Factor=neg)
move_3 = Move(Geometry=move_2.Geometry, Motion=Z)  # -> Geometry, Transform
pt_9 = Point(unflatten)
pdecon_3 = Deconstruct(Point=move_3.Geometry)  # -> XComponent, YComponent, ZComponent
pdecon_4 = Deconstruct(Point=pt_8)  # -> XComponent, YComponent, ZComponent
smaller_3 = SmallerThan(FirstNumber=pdecon_3.ZComponent, SecondNumber=pdecon_4.ZComponent)  # -> SmallerThan, OrEqualTo
dispatch_3 = Dispatch(List=pt_9, DispatchPattern=smaller_3.OrEqualTo)  # -> ListA, ListB
dispatch_4 = Dispatch(List=amp_2, DispatchPattern=smaller_3.OrEqualTo)  # -> ListA, ListB
undercut_free_points = Point(dispatch_3.ListB)
point_normals = Vector(dispatch_4.ListB)

# ----
undercut_free_points_2 = Point(dispatch_3.ListB)
point_normals_2 = Vector(dispatch_4.ListB)
undercut_free_points_3 = Point(undercut_free_points_2)
point_normals_3 = Vector(point_normals_2)
gate = StreamGate(Stream=point_normals_3, Gate=use_ballnose_for_3d_milling_4)  # -> Target0, Target1
gate_2 = StreamGate(Stream=undercut_free_points_3, Gate=use_ballnose_for_3d_milling_4)  # -> Target0, Target1

# ---- group: Offset compenstate with end mill radius
millling_bit_radius_2 = Panel(millling_bit_radius)
undercut_free_points_4 = Point(gate_2.Target0)
point_normals_4 = Vector(gate.Target0)
move_4 = Move(Geometry=undercut_free_points_4, Motion=point_normals_4)  # -> Geometry, Transform
xy = XYPlane(Origin=Point(0, 0, 0))
project = Project(Geometry=move_4.Geometry, Plane=xy)  # -> Geometry, Transform
project_2 = Project(Geometry=undercut_free_points_4, Plane=xy)  # -> Geometry, Transform
ln_3 = Line(StartPoint=project_2.Geometry, EndPoint=project.Geometry)
len_8 = Length(Curve=ln_3)
vec2pt = Vector2Pt(PointA=project_2.Geometry, PointB=project.Geometry, Unitize=False)  # -> Vector, Length
smaller_4 = SmallerThan(FirstNumber=len_8, SecondNumber="0.001")  # -> SmallerThan, OrEqualTo
millling_bit_radius_3 = Panel(millling_bit_radius_2)
dispatch_5 = Dispatch(List=undercut_free_points_4, DispatchPattern=smaller_4.SmallerThan)  # -> ListA, ListB
dispatch_6 = Dispatch(List=vec2pt.Vector, DispatchPattern=smaller_4.SmallerThan)  # -> ListA, ListB
top_points = Point(dispatch_5.ListA)
side_points = Point(dispatch_5.ListB)
amp_3 = Amplitude(Vector=dispatch_6.ListB, Amplitude=millling_bit_radius_3)
move_5 = Move(Geometry=side_points, Motion=amp_3)  # -> Geometry, Transform
end_mill_compensated_points = Point(move_5.Geometry)

# ----
end_mill_compensated_points_2 = Point(end_mill_compensated_points)

# ---- group: Offset compensate with ball nose radius
millling_bit_radius_4 = Panel(millling_bit_radius)
undercut_free_points_5 = Point(gate_2.Target1)
point_normals_5 = Vector(gate.Target1)
amp_4 = Amplitude(Vector=point_normals_5, Amplitude=millling_bit_radius_4)
move_6 = Move(Geometry=undercut_free_points_5, Motion=amp_4)  # -> Geometry, Transform
neg_2 = Negative(Value=millling_bit_radius_4)
Z_2 = UnitZ(Factor=neg_2)

# ----
move_7 = Move(Geometry=move_6.Geometry, Motion=Z_2)  # -> Geometry, Transform

# ---- group: Offset compensate with ball nose radius (continued)
ball_nose_compensated_points = Point(move_7.Geometry)

# ----
ball_nose_compensated_points_2 = Point(ball_nose_compensated_points)
filter_5 = StreamFilter(Gate=use_ballnose_for_3d_milling_5, Stream0=end_mill_compensated_points_2, Stream1=ball_nose_compensated_points_2)

# ---- group: Overshoot extend toolpaths
# Bug:
# Polyline sometimes intersects with object
toolpath_points_for_overshoot = Point(filter_5)
overshoot_margin = Panel(overshoot_margin_mm_3)
pline = PolyLine(Vertices=toolpath_points_for_overshoot, Closed=False)
ext = ExtendCurve(Curve=pline, Type=0, Start=overshoot_margin, End=overshoot_margin)
simplify_6 = SimplifyTree(Tree=ext, Front=False)
extended_toolpaths = Curve(simplify_6)

# ---- group: Check toolpaths for air miling (necessary in case of allowing toolpath points from the 90deg side on a surface)
toolpaths_to_check_for_air_milling = Curve(extended_toolpaths)
planar_2 = Planar(Curve=toolpaths_to_check_for_air_milling)  # -> Planar, Plane, Deviation
deplane = DeconstructPlane(Plane=planar_2.Plane)  # -> Origin, XAxis, YAxis, ZAxis
Z_3 = UnitZ(Factor=1)
pdecon_5 = Deconstruct(Point=deplane.Origin)  # -> XComponent, YComponent, ZComponent
angle = Angle(VectorA=deplane.ZAxis, VectorB=Z_3)  # -> Angle, Reflex
multiplication_9 = Multiplication(A=pdecon_5.ZComponent, B="1000")
round_3 = Round(Number=multiplication_9)  # -> Nearest, Floor, Ceiling
equals = Equality(FirstNumber=angle.Angle, SecondNumber="0.0")  # -> Equality, Inequality
equals_2 = Equality(FirstNumber=round_3.Nearest, SecondNumber="0.0")  # -> Equality, Inequality
and = GateAnd(A=equals_2.Equality, B=equals.Equality)
dispatch_7 = Dispatch(List=toolpaths_to_check_for_air_milling, DispatchPattern=and)  # -> ListA, ListB
toolpaths_checked_for_air_milling = Curve(dispatch_7.ListB)

# ---- group: Collision correct toolpaths
millling_bit_radius_5 = Panel(millling_bit_radius)
use_ballnose_for_3d_milling_6 = Panel(use_ballnose_for_3d_milling_3)
collsion_mesh_tolerance_factor = Panel("0.5")
object_height_2 = Panel(object_height)
toolpath_subdivide_factor = Panel("0.2")
tolerance_5 = Panel(tolerance_3)
make_horizontal_isocurves_boolean_2 = Boolean(make_horizontal_isocurves)
meshes_from_breps = Mesh(collision_mesh_3)
toolpaths = Curve(toolpaths_checked_for_air_milling)
mjoin_2 = MeshJoin(Meshes=flatten(meshes_from_breps))
division_10 = Division(A=tolerance_5, B="1")
sort_3 = SortList(Keys=object_height_2)  # -> Keys, ValuesA
geometry_collision_detect_mesh = Mesh(mjoin_2)
xy_2 = XYPlane(Origin=Point(0, 0, 0))
rev_3 = ReverseList(List=sort_3.Keys)
multiplication_10 = Multiplication(A=millling_bit_radius_5, B=collsion_mesh_tolerance_factor)
item_4 = ListItem(List=rev_3, Index=0, Wrap=True)
panel_4 = Panel("0.01")
Z_4 = UnitZ(Factor=item_4)
multiplication_11 = Multiplication(A=tolerance_5, B="6")
custom_mesh_settings = SettingsCustom(
    StitchSeams=True,
    SimplePlanes=False,
    Refine=True,
    MinCount=16,
    MaxCount=400,
    AspectRatio=20,
    MaxDistance=0,
    MaxAngle=20,
    MinEdge=multiplication_10,
    MaxEdge=0)
Z_5 = UnitZ(Factor=multiplication_11)
xy_3 = XYPlane(Origin=Point(0, 0, 0))
move_8 = Move(Geometry=toolpaths, Motion=Z_5)  # -> Geometry, Transform
multiplication_12 = Multiplication(A=millling_bit_radius_5, B=toolpath_subdivide_factor)
use_ballnose_for_3d_milling_7 = Panel(use_ballnose_for_3d_milling_6)
geometry_collision_detect_mesh_2 = Mesh(geometry_collision_detect_mesh)
xy_4 = XYPlane(Origin=Point(0, 0, 0))
neg_3 = Negative(Value=multiplication_11)
Z_6 = UnitZ(Factor=neg_3)
tolerance_6 = Panel(tolerance_5)

# ----
multiplication_13 = Multiplication(A=tolerance_5, B="10")
subtraction_6 = Subtraction(A=millling_bit_radius_5, B=multiplication_13)
len_9 = Length(Curve=move_8.Geometry)
division_11 = Division(A=len_9, B=multiplication_12)
round_4 = Round(Number=division_11)  # -> Nearest, Floor, Ceiling
addition_3 = Addition(A=round_4.Ceiling, B="1")
division_12 = Division(A=len_9, B=round_4.Ceiling)
series_4 = Series(Start=0, Step=division_12, Count=addition_3)
eval = EvaluateLength(Curve=move_8.Geometry, Length=series_4, Normalized=False)  # -> Point, Tangent, Parameter
toolpath_points_for_collsion_detect = Point(eval.Point)
make_horizontal_isocurves_boolean_3 = Boolean(make_horizontal_isocurves_boolean_2)
make_horizontal_isocurves_boolean_4 = Boolean(make_horizontal_isocurves_boolean_2)

# ---- group: Collision correct toolpaths (continued)
cir = Circle(Plane=xy_2, Radius=subtraction_6)
extr = Extrude(Base=cir, Direction=Z_4)
cap = CapHoles(Brep=extr)
sph = Sphere(Base=xy_3, Radius=subtraction_6)
sunion = SolidUnion(Breps=flatten([sph, cap]))
Z_7 = UnitZ(Factor=subtraction_6)
move_9 = Move(Geometry=sunion, Motion=Z_7)  # -> Geometry, Transform
filter_6 = StreamFilter(Gate=use_ballnose_for_3d_milling_7, Stream0=extr, Stream1=move_9.Geometry)
mesh = MeshBrep(Brep=filter_6, Settings=custom_mesh_settings)
bit_collison_detection_mesh = Mesh(mesh)
xy_5 = XYPlane(Origin=toolpath_points_for_collsion_detect)
orient = Orient(Geometry=bit_collison_detection_mesh, Source=xy_4, Target=xy_5)  # -> Geometry, Transform
colom = CollisionOneMany(Collider=orient.Geometry, Obstacles=geometry_collision_detect_mesh_2)  # -> Collision, Index
dispatch_8 = Dispatch(List=toolpath_points_for_collsion_detect, DispatchPattern=colom.Collision)  # -> ListA, ListB
move_10 = Move(Geometry=dispatch_8.ListB, Motion=Z_6)  # -> Geometry, Transform

# ---- group: Detect breaks from collsion and create disconnected polylines
toolpath_points_for_collsion_detect_2 = Point(toolpath_points_for_collsion_detect)
collsion_results = Boolean(colom.Collision)
lng_6 = ListLength(List=toolpath_points_for_collsion_detect_2)
series_5 = Series(Start=0, Step=1, Count=lng_6)
pt_10 = ConstructPoint(XCoordinate=series_5, YCoordinate=0, ZCoordinate=0)
dispatch_9 = Dispatch(List=toolpath_points_for_collsion_detect_2, DispatchPattern=collsion_results)  # -> ListA, ListB
X = UnitX(Factor="0.5")
dispatch_10 = Dispatch(List=pt_10, DispatchPattern=collsion_results)  # -> ListA, ListB
Y = UnitY(Factor="0.5")
pline_2 = PolyLine(Vertices=dispatch_9.ListB, Closed=False)
pt_11 = Point(dispatch_9.ListA)
pline_3 = PolyLine(Vertices=dispatch_10.ListB, Closed=False)
move_11 = Move(Geometry=dispatch_10.ListA, Motion=X)  # -> Geometry, Transform
explode = Explode(Curve=pline_2, Recursive=True)  # -> Segments, Vertices
explode_2 = Explode(Curve=pline_3, Recursive=True)  # -> Segments, Vertices
neg_4 = Negative(Value=Y)
move_12 = Move(Geometry=move_11.Geometry, Motion=Y)  # -> Geometry, Transform
move_13 = Move(Geometry=move_11.Geometry, Motion=neg_4)  # -> Geometry, Transform
ln_4 = Line(StartPoint=move_12.Geometry, EndPoint=move_13.Geometry)
colom_2 = CollisionOneMany(Collider=explode_2.Segments, Obstacles=ln_4)  # -> Collision, Index
dispatch_11 = Dispatch(List=explode.Segments, DispatchPattern=colom_2.Collision)  # -> ListA, ListB
crv_5 = Curve(dispatch_11.ListB)
join = JoinCurves(Curves=crv_5, Preserve=Toggle(True))
collsion_free_toolpaths = Curve(join)

# ----
gate_3 = StreamGate(Stream=move_10.Geometry, Gate=make_horizontal_isocurves_boolean_3)  # -> Target0, Target1
collsion_free_toolpaths_2 = Curve(collsion_free_toolpaths)
pline_4 = PolyLine(Vertices=gate_3.Target1, Closed=False)
move_14 = Move(Geometry=collsion_free_toolpaths_2, Motion=Z_6)  # -> Geometry, Transform

# ---- group: Collision correct toolpaths (continued)
pline_5 = PolyLine(Vertices=gate_3.Target0, Closed=False)
redpline = Reduce(Polyline=move_14.Geometry, Tolerance=tolerance_6)  # -> Polyline, Reduction
collision_corrected_toolpaths = Curve(redpline.Polyline)

# ----
filter_7 = StreamFilter(Gate=make_horizontal_isocurves_boolean_4, Stream0=pline_5, Stream1=pline_4)
gate_4 = StreamGate(Stream=collision_corrected_toolpaths, Gate=connect_toolpaths_levels_booloean)  # -> Target0, Target1
non_woven_toolpaths = Curve(gate_4.Target0)

# ---- group: Weave toolpaths
toolpaths_to_weave = Curve(gate_4.Target1)
simplify_7 = SimplifyTree(Tree=toolpaths_to_weave, Front=False)
flatten_3 = FlattenTree(Tree=simplify_7, Path="{0}")

# ----
pshift_12 = ShiftPaths(Data=simplify_7, Offset=-1)
flatten_4 = FlattenTree(Tree=pshift_12, Path="{0}")
item_5 = ListItem(List=flatten_4, Index=0, Wrap=True)
null = NullItem(Item=item_5)  # -> NullFlags, InvalidFlags, Description
filter_8 = StreamFilter(Gate=null.NullFlags, Stream0=pshift_12, Stream1=flatten_3)
filter_9 = StreamFilter(Gate=smaller.SmallerThan, Stream0=filter_8, Stream1=flatten_3)

# ---- group: Weave toolpaths (continued)
dispatch_12 = Dispatch(List=filter_9, DispatchPattern=[True, False])  # -> ListA, ListB
flip_4 = FlipCurve(Curve=dispatch_12.ListB)  # -> Curve, Flag
weave_7 = Weave(Pattern=[0, 1], Stream0=dispatch_12.ListA, Stream1=flip_4.Curve, NullGaps=False)
simplify_8 = SimplifyTree(Tree=weave_7, Front=False)
woven_toolpaths = Curve(simplify_8)

# ---- group: Create connection lines
stepover_distance_6 = Panel(stepover_distance)
toolpaths_to_connect = Curve(woven_toolpaths)
connect_toolpath_tolerance_factor_2 = Panel(connect_toolpath_tolerance_factor)
end = EndPoints(Curve=toolpaths_to_connect)  # -> Start, End
shift = ShiftList(List=end.Start, Shift="1", Wrap=True)
multiplication_14 = Multiplication(A=stepover_distance_6, B=connect_toolpath_tolerance_factor_2)
ln_5 = Line(StartPoint=end.End, EndPoint=shift)
len_10 = Length(Curve=ln_5)
larger_4 = LargerThan(FirstNumber=len_10, SecondNumber=multiplication_14)  # -> LargerThan, OrEqualTo
lng_7 = ListLength(List=toolpaths_to_connect)
series_6 = Series(Start=0, Step=1, Count=lng_7)
dispatch_13 = Dispatch(List=series_6, DispatchPattern=larger_4.LargerThan)  # -> ListA, ListB
replace = ReplaceItems(List=ln_5, Indices=dispatch_13.ListA, Wrap=False)

# ---- group: Collision detect connection lines
connection_lines_to_collision_check = Curve(replace)
geometry_collision_detect_mesh_3 = Mesh(geometry_collision_detect_mesh)
bit_collison_detection_mesh_2 = Mesh(mesh)
eval_2 = EvaluateLength(Curve=connection_lines_to_collision_check, Length="0.5", Normalized=True)  # -> Point, Tangent, Parameter
xy_6 = XYPlane(Origin=eval_2.Point)
xy_7 = XYPlane(Origin=Point(0, 0, 0))
lng_8 = ListLength(List=toolpaths_to_connect)
orient_2 = Orient(Geometry=bit_collison_detection_mesh_2, Source=xy_7, Target=xy_6)  # -> Geometry, Transform
series_7 = Series(Start=0, Step=1, Count=lng_8)
colom_3 = CollisionOneMany(Collider=orient_2.Geometry, Obstacles=geometry_collision_detect_mesh_3)  # -> Collision, Index
dispatch_14 = Dispatch(List=series_7, DispatchPattern=colom_3.Collision)  # -> ListA, ListB
replace_2 = ReplaceItems(List=replace, Indices=dispatch_14.ListA, Wrap=False)

# ---- group: Create connection lines (continued)
weave_8 = Weave(Pattern=[0, 1], Stream0=toolpaths_to_connect, Stream1=replace_2, NullGaps=False)
clean = CleanTree(RemoveNulls=True, RemoveInvalid=True, RemoveEmpty=False, Tree=weave_8)
simplify_9 = SimplifyTree(Tree=clean, Front=False)
connected_toolpaths = Curve(simplify_9)

# ----
connected_toolpaths_2 = Curve(connected_toolpaths)
filter_10 = StreamFilter(Gate=connect_toolpaths_levels_booloean_2, Stream0=non_woven_toolpaths, Stream1=connected_toolpaths_2)
flatten_5 = FlattenTree(Tree=filter_10, Path="{0}")

# ---- group: Make sure connected toolpath start at top
connect_toolpaths_levels_booloean_3 = Boolean(connect_toolpaths_levels_3)
gate_5 = StreamGate(Stream=flatten_5, Gate=connect_toolpaths_levels_booloean_3)  # -> Target0, Target1
toolaptahs = Curve(gate_5.Target1)
end_2 = EndPoints(Curve=toolaptahs)  # -> Start, End
pdecon_6 = Deconstruct(Point=end_2.Start)  # -> XComponent, YComponent, ZComponent
pdecon_7 = Deconstruct(Point=end_2.End)  # -> XComponent, YComponent, ZComponent
smaller_5 = SmallerThan(FirstNumber=pdecon_6.ZComponent, SecondNumber=pdecon_7.ZComponent)  # -> SmallerThan, OrEqualTo
dispatch_15 = Dispatch(List=toolaptahs, DispatchPattern=smaller_5.SmallerThan)  # -> ListA, ListB
flip_5 = FlipCurve(Curve=dispatch_15.ListA)  # -> Curve, Flag
weave_9 = Weave(Pattern=smaller_5.SmallerThan, Stream0=dispatch_15.ListB, Stream1=dispatch_15.ListA, NullGaps=False)
toolpaths_with_highest_z_starting_point = Curve(weave_9)
connect_toolpaths_levels_booloean_4 = Boolean(connect_toolpaths_levels_3)
filter_11 = StreamFilter(Gate=connect_toolpaths_levels_booloean_4, Stream0=gate_5.Target0, Stream1=toolpaths_with_highest_z_starting_point)

# ----
clean_2 = CleanTree(RemoveNulls=True, RemoveInvalid=True, RemoveEmpty=True, Tree=filter_11)
surface_3d_mill_toolpaths = Curve(clean_2)
surface_3d_mill_toolpaths_2 = ClusterOutput(surface_3d_mill_toolpaths)

# ---- group: Create second round fo connection lines
panel_5 = Panel("""1
1
0
0""")
toolaptaths_for_additional_weaving = Curve(connected_toolpaths)  # disabled
dispatch_16 = Dispatch(List=toolaptaths_for_additional_weaving, DispatchPattern=panel_5)  # -> ListA, ListB
stepover_distance_7 = Panel(stepover_distance)
connect_toolpath_tolerance_factor_3 = Panel(connect_toolpath_tolerance_factor)
flip_6 = FlipCurve(Curve=dispatch_16.ListB)  # -> Curve, Flag
weave_10 = Weave(Pattern=panel_5, Stream0=flip_6.Curve, Stream1=dispatch_16.ListA, NullGaps=False)
toolpaths_to_connect_2 = Curve(weave_10)
end_3 = EndPoints(Curve=weave_10)  # -> Start, End
cp_2 = ClosestPoint(Point=end_3.Start, Cloud=end_3.End)  # -> ClosestPoint, CPIndex, Distance
ln_6 = Line(StartPoint=end_3.Start, EndPoint=cp_2.ClosestPoint)
line = Line(ln_6)
ln_7 = Line(StartPoint=end_3.Start, EndPoint=end_3.End)
multiplication_15 = Multiplication(A=stepover_distance_7, B=connect_toolpath_tolerance_factor_3)
len_11 = Length(Curve=line)
eval_3 = EvaluateLength(Curve=ln_7, Length="0.5", Normalized=True)  # -> Point, Tangent, Parameter
eval_4 = EvaluateLength(Curve=line, Length="0.5", Normalized=True)  # -> Point, Tangent, Parameter
larger_5 = LargerThan(FirstNumber=len_11, SecondNumber=multiplication_15)  # -> LargerThan, OrEqualTo
lng_9 = ListLength(List=toolpaths_to_connect_2)
cp_3 = ClosestPoint(Point=eval_3.Point, Cloud=eval_4.Point)  # -> ClosestPoint, CPIndex, Distance
series_8 = Series(Start=0, Step=1, Count=lng_9)
smaller_6 = SmallerThan(FirstNumber=cp_3.Distance, SecondNumber="0.01")  # -> SmallerThan, OrEqualTo
dispatch_17 = Dispatch(List=series_8, DispatchPattern=smaller_6.SmallerThan)  # -> ListA, ListB
dispatch_18 = Dispatch(List=series_8, DispatchPattern=larger_5.LargerThan)  # -> ListA, ListB
replace_3 = ReplaceItems(List=line, Indices=dispatch_17.ListA, Wrap=False)
replace_4 = ReplaceItems(List=replace_3, Indices=dispatch_18.ListA, Wrap=False)

# ---- group: Collision detect connection lines
connection_lines_to_collision_check_2 = Curve(replace_4)
geometry_collision_detect_mesh_4 = Mesh(geometry_collision_detect_mesh)
bit_collison_detection_mesh_3 = Mesh(mesh)
eval_5 = EvaluateLength(Curve=connection_lines_to_collision_check_2, Length="0.5", Normalized=True)  # -> Point, Tangent, Parameter
xy_8 = XYPlane(Origin=eval_5.Point)
xy_9 = XYPlane(Origin=Point(0, 0, 0))
lng_10 = ListLength(List=toolpaths_to_connect_2)
orient_3 = Orient(Geometry=bit_collison_detection_mesh_3, Source=xy_9, Target=xy_8)  # -> Geometry, Transform
series_9 = Series(Start=0, Step=1, Count=lng_10)
colom_4 = CollisionOneMany(Collider=orient_3.Geometry, Obstacles=geometry_collision_detect_mesh_4)  # -> Collision, Index
dispatch_19 = Dispatch(List=series_9, DispatchPattern=colom_4.Collision)  # -> ListA, ListB
replace_5 = ReplaceItems(List=replace_4, Indices=dispatch_19.ListA, Wrap=False)

# ---- group: Create second round fo connection lines (continued)
weave_11 = Weave(Pattern=[0, 1], Stream0=toolpaths_to_connect_2, Stream1=replace_5, NullGaps=False)
clean_3 = CleanTree(RemoveNulls=True, RemoveInvalid=True, RemoveEmpty=False, Tree=weave_11)
simplify_10 = SimplifyTree(Tree=clean_3, Front=False)
connected_toolpaths_3 = Curve(simplify_10)

# ----
join_2 = JoinCurves(Curves=clean_3, Preserve=False)  # disabled
second_round_conected_toolpaths = Curve(connected_toolpaths_3)

# ==== cluster MakePassDepths
make_safety_pass_from_cutout = ClusterInput()
roughing_material_leftover = ClusterInput()
milling_bit_diameter = ClusterInput()
outline_curves = ClusterInput()
pass_depth = ClusterInput()
toolpaths = ClusterInput()
toolpaths_2 = Curve(toolpaths)
pass_depth_2 = Number(pass_depth)
outline_curves_2 = Curve(outline_curves)
milling_bit_diameter_2 = Number(milling_bit_diameter)
roughing_material_leftover_2 = Number(roughing_material_leftover)
make_safety_pass_from_cutout_2 = Boolean(make_safety_pass_from_cutout)
pass_depth_3 = Panel(pass_depth_2)
roughing_material_leftover_3 = Panel(roughing_material_leftover_2)
flatten = FlattenTree(Tree=toolpaths_2, Path="{0}")

# ---- group: Find deepest toolapth coordinate
_3d_roughing_toolpaths = Curve(flatten)
bbox = BoundingBox(Content=_3d_roughing_toolpaths, Plane=PlaneXY(0, 0, 0), UnionBox=True)  # -> Box, Box_2
debrep = DeconstructBrep(Brep=bbox.Box)  # -> Faces, Edges, Vertices
item = ListItem(List=debrep.Vertices, Index=0, Wrap=True)
pdecon = Deconstruct(Point=item)  # -> XComponent, YComponent, ZComponent
pt = ConstructPoint(XCoordinate=pdecon.XComponent, YCoordinate=pdecon.YComponent, ZCoordinate=0)
ln = Line(StartPoint=item, EndPoint=pt)
len = Length(Curve=ln)
flatten_2 = FlattenTree(Tree=len, Path="{0}")
deepest_toolapth_coordinate = Panel(flatten_2)

# ---- group: Make safety cleanup pass
multiplication = Multiplication(A=roughing_material_leftover_3, B="2")
deepest_toolapth_coordinate_2 = Panel(deepest_toolapth_coordinate)
filter = StreamFilter(Gate=make_safety_pass_from_cutout_2, Stream1=outline_curves_2)
addition = Addition(A=milling_bit_diameter_2, B=multiplication)
cutout = Cutout_2(
    curves_for_cutout=filter,
    cut_depth=deepest_toolapth_coordinate_2,
    pass_depth=pass_depth_3,
    tool_diameter=addition,
    cutout_tolerance=roughing_material_leftover_3,
    use_climb_direction=Toggle(False),
    use_inside_cutting=Toggle(False))
safety_cleanup_pass = Curve(cutout)

# ---- group: Find roughing depths
deepest_toolapth_coordinate_3 = Panel(deepest_toolapth_coordinate)
pass_depth_4 = Panel(pass_depth_3)
division = Division(A=deepest_toolapth_coordinate_3, B=pass_depth_4)
round = Round(Number=division)  # -> Nearest, Floor, Ceiling
division_2 = Division(A=deepest_toolapth_coordinate_3, B=round.Ceiling)
roughing_material_leftover_4 = Panel(roughing_material_leftover_3)
roughing_pass_depth = Panel(division_2)
number_of_roughing_passes = Panel(round.Ceiling)
addition_2 = Addition(A=roughing_material_leftover_4, B=roughing_pass_depth)
subtraction = Subtraction(A=number_of_roughing_passes, B="1")
series = Series(Start=addition_2, Step=roughing_pass_depth, Count=subtraction)
rough_depths = Number(series)

# ----
roughing_material_leftover_5 = Panel(roughing_material_leftover_3)
_3d_roughing_toolpaths_2 = Curve(flatten)
Z = UnitZ(Factor=roughing_material_leftover_5)
move = Move(Geometry=_3d_roughing_toolpaths_2, Motion=Z)  # -> Geometry, Transform
final_roughing_pass = Curve(move.Geometry)

# ---- group: Sort lower pass
final_roughing_pass_2 = Curve(final_roughing_pass)  # disabled
end = EndPoints(Curve=final_roughing_pass_2)  # -> Start, End
merge = Merge(Data1=end.Start, Data2=end.End)
xy = XYPlane(Origin=Point(0, 0, 0))
hull = ConvexHull(Points=merge, Plane=xy)  # -> Hull, HullZ, Indices
outline_curves_3 = Curve(hull.HullZ)
end_2 = EndPoints(Curve=final_roughing_pass_2)  # -> Start, End
simplify = SimplifyTree(Tree=outline_curves_3, Front=False)
alongcrv = SortAlongCurve(Points=end_2.End, Curve=simplify)  # -> Points, Indices
item_2 = ListItem(List=final_roughing_pass_2, Index=alongcrv.Indices, Wrap=True)
flatten_3 = FlattenTree(Tree=item_2, Path="{0}")
sorted_final_roughing_pass = Curve(flatten_3)

# ----
final_roughing_pass_3 = Curve(final_roughing_pass)
safety_cleanup_pass_2 = Curve(safety_cleanup_pass)
safety_cleanup_pass_3 = Curve(safety_cleanup_pass)
final_roughing_pass_4 = Curve(sorted_final_roughing_pass)

# ---- group: Z position and trim upper toolpaths
deepest_toolapth_coordinate_4 = Panel(deepest_toolapth_coordinate)
_3d_roughing_toolpaths_3 = Curve(flatten)
rough_depths_2 = Number(rough_depths)
rev = ReverseList(List=rough_depths_2)
bbox_2 = BoundingBox(Content=_3d_roughing_toolpaths_3, Plane=PlaneXY(0, 0, 0), UnionBox=True)  # -> Box, Box_2
Z_2 = UnitZ(Factor=rev)
debrep_2 = DeconstructBrep(Brep=bbox_2.Box)  # -> Faces, Edges, Vertices
item_3 = ListItem(List=debrep_2.Faces, Index="5", Wrap=True)
edges = BrepEdges(Brep=item_3)  # -> Naked, Interior, NonManifold
xy_2 = XYPlane(Origin=Point(0, 0, 0))
join = JoinCurves(Curves=edges.Naked, Preserve=False)
project = Project(Geometry=join, Plane=xy_2)  # -> Geometry, Transform
deepest_toolapth_coordinate_5 = Panel(deepest_toolapth_coordinate_4)
offset = Offset(Curve=project.Geometry, Distance="1", Plane=xy_2, Corners=1)
addition_3 = Addition(A=deepest_toolapth_coordinate_5, B="1")
neg = Negative(Value=addition_3)
Z_3 = UnitZ(Factor=neg)
extr = Extrude(Base=offset, Direction=Z_3)
cap = CapHoles(Brep=extr)

# ----
group = Group(Objects=_3d_roughing_toolpaths_3)

# ---- group: Z position and trim upper toolpaths (continued)
move_2 = Move(Geometry=group, Motion=Z_2)  # -> Geometry, Transform

# ----
ungroup = Ungroup(Group=move_2.Geometry)

# ---- group: Z position and trim upper toolpaths (continued)
trim = TrimWithBrep(Curve=ungroup, Brep=cap)  # -> Inside, Outside
z_positioned_and_trimed_toolpaths = Curve(trim.Inside)

# ---- group: Sort upper pass
toolpaths_for_connection = Curve(z_positioned_and_trimed_toolpaths)  # disabled
end_3 = EndPoints(Curve=toolpaths_for_connection)  # -> Start, End
pass_depth_5 = Panel(pass_depth_3)
cp = ClosestPoint(Point=end_3.Start, Cloud=end_3.End)  # -> ClosestPoint, CPIndex, Distance
ln_2 = Line(StartPoint=end_3.Start, EndPoint=cp.ClosestPoint)
multiplication_2 = Multiplication(A=pass_depth_5, B="0.5")
len_2 = Length(Curve=ln_2)
larger = LargerThan(FirstNumber=len_2, SecondNumber=multiplication_2)  # -> LargerThan, OrEqualTo
merge_2 = Merge(Data1=end_3.Start, Data2=end_3.End)
xy_3 = XYPlane(Origin=Point(0, 0, 0))
dispatch = Dispatch(List=ln_2, DispatchPattern=larger.LargerThan)  # -> ListA, ListB
pshift = ShiftPaths(Data=merge_2, Offset=-1)
join_2 = JoinCurves(Curves=[dispatch.ListB, toolpaths_for_connection], Preserve=False)
hull_2 = ConvexHull(Points=pshift, Plane=xy_3)  # -> Hull, HullZ, Indices
simplify_2 = SimplifyTree(Tree=toolpaths_for_connection, Front=False)
outline_curves_4 = Curve(hull_2.HullZ)
pshift_2 = ShiftPaths(Data=simplify_2, Offset=-1)
simplify_3 = SimplifyTree(Tree=outline_curves_4, Front=False)
end_4 = EndPoints(Curve=pshift_2)  # -> Start, End
alongcrv_2 = SortAlongCurve(Points=end_4.End, Curve=simplify_3)  # -> Points, Indices
item_4 = ListItem(List=pshift_2, Index=alongcrv_2.Indices, Wrap=True)
flatten_4 = FlattenTree(Tree=item_4, Path="{0}")
sorted_upper_roughing_passes = Curve(flatten_4)

# ----
cp_2 = ClosestPoint(Point=end_3.Start, Cloud=end_3.End)  # -> ClosestPoint, CPIndex, Distance
flatten_5 = FlattenTree(Tree=z_positioned_and_trimed_toolpaths, Path="{0}")
z_positioned_and_trimed_toolpaths_2 = Curve(flatten(flatten_5))
upper_roughing_passes = Curve(sorted_upper_roughing_passes)
merge_3 = Merge(Data1=z_positioned_and_trimed_toolpaths_2, Data2=final_roughing_pass_3, Data3=safety_cleanup_pass_2)
merge_4 = Merge(Data1=upper_roughing_passes, Data2=final_roughing_pass_4, Data3=safety_cleanup_pass_3)
lng = ListLength(List=merge_4)
multiplication_3 = Multiplication(A=lng, B=Slider(0.775, range=0..1))
toolpaths_with_pass_depth = Curve(merge_3)
item_5 = ListItem(List=merge_4, Index=multiplication_3, Wrap=True)
toolpaths_with_pass_depth_2 = ClusterOutput(toolpaths_with_pass_depth)

# ==== cluster FindDeepestZ
toolpaths = ClusterInput()
toolpaths_2 = Geometry(toolpaths)
bbox = BoundingBox(Content=flatten(toolpaths_2), Plane=PlaneXY(0, 0, 0), UnionBox=True)  # -> Box, Box_2
box_corners = BoxCorners(Box=bbox.Box)  # -> CornerA, CornerB, CornerC, CornerD, CornerE, CornerF, CornerG, CornerH
pt = Point(box_corners.CornerA)
pdecon = Deconstruct(Point=pt)  # -> XComponent, YComponent, ZComponent
deepest_z = Number(pdecon.ZComponent)
deepest_z_2 = ClusterOutput(deepest_z)

# ==== cluster FeedRateCalculator
bit_diameter_id = ClusterInput()
bit_type_id = ClusterInput()
material_id = ClusterInput()
speed_factor = ClusterInput()
number_of_material_types = Panel("5")
material_min_speed_at_pass_depth = Panel("""60
50
35
22
11""")
material_max_speed_close_to_surface = Panel("""150
80
50
50
20""")
plunge_rate_reduction_factor_up_cut = Panel("0.5")
bit_reduction_factor_material_type = Panel("""0.7
0.8
0.9
1
1""")
plunge_rate_reduction_factor_up_cut_2 = Panel("0.7")
material_ramp_angles = Panel("""40
30
25
18
12""")
bit_type_id_2 = Number(bit_type_id)
bit_diameter_id_2 = Number(bit_diameter_id)
speed_factor_2 = Number(speed_factor)
material_id_2 = Integer(material_id)
bit_diameter_id_3 = Panel(bit_diameter_id_2)
bit_type_id_3 = Panel(bit_type_id_2)
material_type_id = Panel(material_id_2)
larger = LargerThan(FirstNumber=bit_type_id_3, SecondNumber="0")  # -> LargerThan, OrEqualTo
int = Integer(larger.LargerThan)

# ---- group: Calculate feed rate
number_of_material_types_2 = Panel(number_of_material_types)
number_of_material_types_3 = Panel(number_of_material_types)
dup = DuplicateData(Data=graft(material_max_speed_close_to_surface), Number=number_of_material_types_2, Order=True)
dup_2 = DuplicateData(Data=graft(material_min_speed_at_pass_depth), Number=number_of_material_types_3, Order=True)
flip = FlipMatrix(Data=dup)
flip_2 = FlipMatrix(Data=dup_2)
simplify = SimplifyTree(Tree=flip, Front=False)
simplify_2 = SimplifyTree(Tree=flip_2, Front=False)
multiplication = Multiplication(A=simplify, B=graft(bit_reduction_factor_material_type))
multiplication_2 = Multiplication(A=simplify_2, B=graft(bit_reduction_factor_material_type))
feed_rates_max = Panel(multiplication)
feed_rates_min = Panel(multiplication_2)

# ----
bit_type_simple = Panel(int)

# ---- group: Calculate pass depth
bit_type_id_4 = Panel(bit_type_id_3)
pass_depth_6mm_downcut_ball_straight = Panel("""15
13
8
4
2""")
bit_type_simple_2 = Panel(bit_type_simple)
pass_depth_6mm_upcut = Panel("""19.8
15
11
8
2.5""")
bit_reduction_factor_pass_depths = Panel("""0.28
0.5
0.66
1
1""")
v_bit_reduction_factor = Panel("0.5")
v_bit_identifier = Panel("3")
number_of_bit_diameters = Panel("5")
number_of_bit_diameters_2 = Panel(number_of_bit_diameters)
number_of_bit_diameters_3 = Panel(number_of_bit_diameters)
dup_3 = DuplicateData(Data=graft(pass_depth_6mm_upcut), Number=number_of_bit_diameters_3, Order=True)
dup_4 = DuplicateData(Data=graft(pass_depth_6mm_downcut_ball_straight), Number=number_of_bit_diameters_2, Order=True)
flip_3 = FlipMatrix(Data=dup_3)
flip_4 = FlipMatrix(Data=dup_4)
simplify_3 = SimplifyTree(Tree=flip_3, Front=False)
simplify_4 = SimplifyTree(Tree=flip_4, Front=False)
multiplication_3 = Multiplication(A=simplify_3, B=graft(bit_reduction_factor_pass_depths))
multiplication_4 = Multiplication(A=simplify_4, B=graft(bit_reduction_factor_pass_depths))
pass_depths_up_cut = Panel(multiplication_3)
pass_depths_down_cut_ball_nose_straight = Panel(multiplication_4)
bit_type_simple_3 = Panel(bit_type_simple_2)
bit_diameter = Panel(bit_diameter_id_3)
filter = StreamFilter(Gate=bit_type_simple_3, Stream0=pass_depths_up_cut, Stream1=pass_depths_down_cut_ball_nose_straight)
flip_5 = FlipMatrix(Data=filter)
item = ListItem(List=flip_5, Index=bit_diameter, Wrap=True)
material_type = Panel(material_type_id)
panel = Panel(item)
flatten = FlattenTree(Tree=panel, Path="{0}")
item_2 = ListItem(List=flatten, Index=material_type, Wrap=True)
v_bit_reduction_factor_2 = Panel(v_bit_reduction_factor)
bit_type_id_5 = Panel(bit_type_id_4)
v_bit_identifier_2 = Panel(v_bit_identifier)
multiplication_5 = Multiplication(A=item_2, B="10")
int_2 = Integer(multiplication_5)
v_bit_reduction_factor_3 = Panel(v_bit_reduction_factor_2)
division = Division(A=int_2, B="10")
equals = Equality(FirstNumber=bit_type_id_5, SecondNumber=v_bit_identifier_2)  # -> Equality, Inequality
multiplication_6 = Multiplication(A=division, B=v_bit_reduction_factor_3)
filter_2 = StreamFilter(Gate=equals.Equality, Stream0=division, Stream1=multiplication_6)
pass_depth = Panel(filter_2)

# ---- group: Make feed rate domain
int_3 = Integer(feed_rates_max)
int_4 = Integer(feed_rates_min)
dom = ConstructDomain(DomainStart=int_4, DomainEnd=int_3)
feed_rates_domains = Panel(dom)
bit_diameter_2 = Panel(bit_diameter_id_3)
flip_6 = FlipMatrix(Data=feed_rates_domains)
item_3 = ListItem(List=flip_6, Index=bit_diameter_2, Wrap=True)
panel_2 = Panel(item_3)
material_type_2 = Panel(material_type_id)
flatten_2 = FlattenTree(Tree=panel_2, Path="{0}")
item_4 = ListItem(List=flatten_2, Index=material_type_2, Wrap=True)
feed_rate_domain = Panel(item_4)

# ---- group: Select feedrate
bit_diameter_3 = Panel(bit_diameter_id_3)
flip_7 = FlipMatrix(Data=feed_rates_min)
item_5 = ListItem(List=flip_7, Index=bit_diameter_3, Wrap=True)
panel_3 = Panel(item_5)
material_type_3 = Panel(material_type_id)
flatten_3 = FlattenTree(Tree=panel_3, Path="{0}")
item_6 = ListItem(List=flatten_3, Index=material_type_3, Wrap=True)
feed_rate = Panel(item_6)

# ---- group: Map ramp and ramp angles
material_type_4 = Panel(material_type_id)
bit_type_simple_4 = Panel(int)
material_ramp_angles_2 = Panel(material_ramp_angles)
material_type_5 = Panel(material_type_id)
larger_2 = LargerThan(FirstNumber=material_type_4, SecondNumber="1")  # -> LargerThan, OrEqualTo
bool = Boolean(bit_type_simple_4)
larger_3 = LargerThan(FirstNumber=material_type_5, SecondNumber="2")  # -> LargerThan, OrEqualTo
item_7 = ListItem(List=material_ramp_angles_2, Index=material_type_5, Wrap=True)
ramp_because_of_special_bit_in_material = Panel(larger_2.LargerThan)
ramp_because_of_bit_type = Panel(bool)
ramp_because_of_material = Panel(larger_3.LargerThan)
and = GateAnd(A=ramp_because_of_bit_type, B=ramp_because_of_special_bit_in_material)
or = GateOr(A=ramp_because_of_material, B=and)
ramp_angle = Panel(item_7)
ramp_plunges = Panel(or)

# ---- group: Calculate plunge rate
plunge_rate_reduction_factor_up_cut_3 = Panel(plunge_rate_reduction_factor_up_cut)
bit_type = Panel(bit_type_simple)
plunge_rate_reduction_factor_up_cut_4 = Panel(plunge_rate_reduction_factor_up_cut_2)
filter_3 = StreamFilter(Gate=bit_type, Stream0=plunge_rate_reduction_factor_up_cut_4, Stream1=plunge_rate_reduction_factor_up_cut_3)
multiplication_7 = Multiplication(A=feed_rate, B=filter_3)
int_5 = Integer(multiplication_7)
num = Number(int_5)
plunge_rate = Panel(num)

# ----
pass_depth_2 = Panel(pass_depth)
feed_rate_domain_2 = Panel(feed_rate_domain)
plunge_rate_2 = Panel(plunge_rate)
feed_rate_2 = Panel(feed_rate)
ramp_angle_2 = Panel(ramp_angle)
ramp_plunges_2 = Panel(ramp_plunges)
ramp_plunges_3 = Boolean(ramp_plunges_2)
ramp_angle_3 = Integer(ramp_angle_2)
ramp_angle_4 = ClusterOutput(ramp_angle_3)
ramp_plunges_4 = ClusterOutput(ramp_plunges_3)

# ---- group: Speed mod
speed_factor_3 = Number(speed_factor_2)
subtraction = Subtraction(A=speed_factor_3, B="100")
division_2 = Division(A=subtraction, B="100")
dedomain = DeconstructDomain(Domain=feed_rate_domain_2)  # -> Start, End
division_3 = Division(A=subtraction, B="100")
division_4 = Division(A=subtraction, B="100")
larger_4 = LargerThan(FirstNumber=division_2, SecondNumber="0")  # -> LargerThan, OrEqualTo
multiplication_8 = Multiplication(A=pass_depth_2, B=division_2)
multiplication_9 = Multiplication(A=plunge_rate_2, B=division_4)
multiplication_10 = Multiplication(A=division_3, B=dedomain.Start)
multiplication_11 = Multiplication(A=division_3, B=dedomain.End)
filter_4 = StreamFilter(Gate=larger_4.LargerThan, Stream0=multiplication_8, Stream1="0")
addition = Addition(A=multiplication_9, B=plunge_rate_2)
addition_2 = Addition(A=multiplication_11, B=dedomain.End)
addition_3 = Addition(A=multiplication_10, B=dedomain.Start)
addition_4 = Addition(A=filter_4, B=pass_depth_2)
int_6 = Integer(addition)
int_7 = Integer(addition_3)
int_8 = Integer(addition_2)
dom_2 = ConstructDomain(DomainStart=int_7, DomainEnd=int_8)
num_2 = Number(addition_4)
speed_mod_pass_depth = Panel(num_2)

# ----
multiplication_12 = Multiplication(A=division_3, B=feed_rate_2)
addition_5 = Addition(A=multiplication_12, B=feed_rate_2)
int_9 = Integer(addition_5)
num_3 = Number(int_6)
speed_mod_feed_rate = Panel(dom_2)

# ---- group: Speed mod (continued)
speed_mod_plunge_rate = Panel(num_3)
speed_mod_feed_rate_2 = Panel(int_9)

# ----
feed_rate_domain_3 = Domain(speed_mod_feed_rate)
plunge_rate_3 = Number(speed_mod_plunge_rate)
pass_depth_3 = Number(speed_mod_pass_depth)
feed_rate_3 = Integer(speed_mod_feed_rate_2)
plunge_rate_4 = ClusterOutput(plunge_rate_3)
feed_rate_4 = ClusterOutput(feed_rate_3)
pass_depth_4 = ClusterOutput(pass_depth_3)

# ==== cluster OptimizeFeedrate
feed_rate_multiplier = ClusterInput()
feed_rate = ClusterInput()
boost_reduction = Panel("0.4")
max_multiplaction_factor = Panel("2.5")
feed_rate_multiplier_2 = Number(feed_rate_multiplier)
feed_rate_2 = Number(feed_rate)
subtraction = Subtraction(A=feed_rate_multiplier_2, B="1")
panel = Panel(max_multiplaction_factor)
multiplication = Multiplication(A=subtraction, B=boost_reduction)
dom = ConstructDomain(DomainStart="1", DomainEnd=panel)
addition = Addition(A="1", B=multiplication)
feed_rate_3 = Panel(feed_rate_2)
feed_rate_multiplier_3 = Panel("4")
multiplication_2 = Multiplication(A=feed_rate_3, B=feed_rate_multiplier_3)
int = Integer(multiplication_2)
boosted_feed_rate = Panel(int)
boosted_feed_rate_2 = Number(boosted_feed_rate)
boosted_feed_rate_3 = ClusterOutput(boosted_feed_rate_2)

# ==== cluster Horizontal3DMillFromMeshWIP
use_end_mill_for_cutout = BooleanToggle(True)
slice_at_full_depth = BooleanToggle(True)
cutout_tolerance = Slider(0, range=-0.5..0.5)
cutout_to_full_material_depth = BooleanToggle(False)
make_flea_jump_transitions = BooleanToggle(False)
connect_toolpaths_levels = BooleanToggle(True)
generate_cutout = BooleanToggle(True)
curve_sample_slice_reduction = Panel("2")
generate_cutout_2 = Panel(generate_cutout)
cutout_tolerance_2 = Panel(cutout_tolerance)
cutout_to_full_material_depth_2 = Panel(cutout_to_full_material_depth)
material_thickness = Panel("19")
extra_cut_depth = Panel("0.6")
reduction_tolerance = Panel("0.02")
top_layer_pocket_threshold = Panel("5")
inital_sample_slice_spacing = Panel("1")
sample_top_value_percentage = Panel("0.25")
top_slice_thickness = Panel("0.01")
# Make max depth value
# Make use cutout for last roughing pass boolean
# Fix roughing selection pattern
connect_toolpath_tolerance_factor = Panel("2")
slice_at_full_depth_2 = Panel(slice_at_full_depth)
vertical_angle_cutoff = Panel("89")
make_flea_jump_transitions_2 = Integer(make_flea_jump_transitions)
connect_toolpaths_levels_2 = Integer(connect_toolpaths_levels)
max_angle_limit = Panel("1")
lowes_slice_leftover_thickness = Panel("0.01")
roughing_material_leftover = ClusterInput()
generate_3d_roughing = ClusterInput()
generate_3d_finishing = ClusterInput()
pass_depth_roughing = ClusterInput()
milling_bit_diameter = ClusterInput()
roughing_stepover = ClusterInput()
meshes_for_3d_mill = ClusterInput()
finishing_stepover = ClusterInput()
roughing_material_leftover_2 = Number(roughing_material_leftover)
generate_3d_roughing_2 = Boolean(generate_3d_roughing)
generate_3d_finishing_2 = Boolean(generate_3d_finishing)
pass_depth_roughing_2 = Number(pass_depth_roughing)
milling_bit_diameter_2 = Number(milling_bit_diameter)
roughing_stepover_2 = Number(roughing_stepover)
meshes_for_3d_mill_2 = Mesh(meshes_for_3d_mill)
finishing_stepover_2 = Number(finishing_stepover)
breps_for_3d_mill = Brep()  # disabled
number_slider = Slider(2, range=0..10)
multiplication = Multiplication(A=milling_bit_diameter_2, B=finishing_stepover_2)
multiplication_2 = Multiplication(A=milling_bit_diameter_2, B=roughing_stepover_2)
multiplication_3 = Multiplication(A=milling_bit_diameter_2, B="0.5")
custom_mesh_settings = SettingsCustom(
    StitchSeams=True,
    SimplePlanes=False,
    Refine=True,
    MinCount=16,
    MaxCount=400,
    AspectRatio=20,
    MaxDistance=0,
    MaxAngle=20,
    MinEdge=number_slider,
    MaxEdge=number_slider)
smooth = SettingsQuality()
jagged = SettingsSpeed()
stepover_distance_roughing = Panel(multiplication_2)
milling_bit_radius = Panel(multiplication_3)
stepover_distance = Panel(multiplication)
mesh = MeshBrep(Brep=breps_for_3d_mill, Settings=custom_mesh_settings)
# Horizontal slice from bottom.
# Start with tool dimater spacing.
# Evalute max angle of surface between slices.
# Generate additional slices based on inclination
# make guide graph with points position from average inclination of slices
# (average of top 25%)
# 
# cull sampling points colliding with mesh
# 
# rebuild graph with even distance for slice density positions
# 
# pocket last top 0.1mm slice if needed
filter = StreamFilter(Gate=use_end_mill_for_cutout, Stream0=milling_bit_radius)
merge = Merge(Data1=flatten(mesh), Data2=flatten(meshes_for_3d_mill_2))
addition = Addition(A=filter, B=extra_cut_depth)
flatten = FlattenTree(Tree=merge, Path="{0}")
meshes_for_3d_milling = Mesh(flatten)
mjoin = MeshJoin(Meshes=meshes_for_3d_milling)
joined_meshes_for_3d_milling = Mesh(mjoin)
bbox = BoundingBox(Content=meshes_for_3d_milling, Plane=PlaneXY(0, 0, 0), UnionBox=False)  # -> Box, Box_2
debrep = DeconstructBrep(Brep=bbox.Box)  # -> Faces, Edges, Vertices
bbox_2 = BoundingBox(Content=meshes_for_3d_milling, Plane=PlaneXY(0, 0, 0), UnionBox=False)  # -> Box, Box_2
meshes_without_offset = Mesh(meshes_for_3d_milling)
item = ListItem(List=debrep.Vertices, Index="0", Wrap=True)
item_2 = ListItem(List=debrep.Vertices, Index="4", Wrap=True)
debrep_2 = DeconstructBrep(Brep=bbox_2.Box)  # -> Faces, Edges, Vertices
xy = XYPlane(Origin=item_2)
bbox_3 = BoundingBox(Content=meshes_without_offset, Plane=PlaneXY(0, 0, 0), UnionBox=False)  # -> Box, Box_2
item_3 = ListItem(List=debrep_2.Vertices, Index="0", Wrap=True)
item_4 = ListItem(List=debrep_2.Vertices, Index="4", Wrap=True)
pshift = ShiftPaths(Data=xy, Offset=-1)
debrep_3 = DeconstructBrep(Brep=bbox_3.Box)  # -> Faces, Edges, Vertices
dist = Distance(PointA=item_4, PointB=item_3)
mshadow = MeshShadow(Mesh=meshes_for_3d_milling, Light=Vector(0, 0, -1), Plane=pshift)
item_5 = ListItem(List=debrep_3.Vertices, Index="4", Wrap=True)
model_height = Panel(dist)
top_slice_sample_thickness = Panel("0.01")
lng = ListLength(List=mshadow)
simplify = SimplifyTree(Tree=item_5, Front=False)
Z = UnitZ(Factor=1)
cp = ControlPoints(Curve=mshadow)  # -> Points, Weights, Knots
sort = SortList(Keys=flatten(lng))  # -> Keys, ValuesA
pdecon = Deconstruct(Point=simplify)  # -> XComponent, YComponent, ZComponent
rev = Reverse(Vector=Z)
simplify_2 = SimplifyTree(Tree=model_height, Front=False)
item_6 = ListItem(List=sort.Keys, Index=0, Wrap=True)
milling_bit_diameter_3 = Panel(milling_bit_diameter_2)
top_layer_pocket_threshold_2 = Panel(top_layer_pocket_threshold)
subtraction = Subtraction(A=pdecon.ZComponent, B=top_slice_sample_thickness)
cutout_to_full_material_depth_3 = Panel(cutout_to_full_material_depth_2)
meshray = MeshRay(Mesh=joined_meshes_for_3d_milling, Point=cp.Points, Direction=rev)  # -> Point, Hit
model_height_2 = Panel(simplify_2)
material_thickness_2 = Panel(material_thickness)
not = GateNot(A=item_6)
pt = ConstructPoint(XCoordinate=pdecon.XComponent, YCoordinate=pdecon.YComponent, ZCoordinate=subtraction)
pline = PolyLine(Vertices=meshray.Point, Closed=False)
failed_mesh_shadow_boolean = Panel(not)
# make grid?
slice_at_full_depth_boolean = Panel(slice_at_full_depth_2)
xy_2 = XYPlane(Origin=pt)
pshift_2 = ShiftPaths(Data=pline, Offset=-1)
multiplication_4 = Multiplication(A=milling_bit_diameter_3, B=top_layer_pocket_threshold_2)
filter_2 = StreamFilter(Gate=cutout_to_full_material_depth_3, Stream0=model_height_2, Stream1=material_thickness_2)
sec = MeshPlane(Mesh=graft(meshes_without_offset), Plane=xy_2)
bbox_4 = BoundingBox(Content=pshift_2, Plane=PlaneXY(0, 0, 0), UnionBox=True)  # -> Box, Box_2
top_layer_pocket_threshold_area = Panel(multiplication_4)
top_slice_location_point = Point(item_2)
or = GateOr(A=slice_at_full_depth_boolean, B=failed_mesh_shadow_boolean)
join = JoinCurves(Curves=sec, Preserve=False)
debrep_4 = DeconstructBrep(Brep=bbox_4.Box)  # -> Faces, Edges, Vertices
cutout_depth = Panel(filter_2)
top_slice_thickness_2 = Panel(top_slice_thickness)
item_7 = ListItem(List=join, Index=0, Wrap=True)
panel = Panel(or)
top_layer_slice = Curve(sec)
item_8 = ListItem(List=debrep_4.Vertices, Index=0, Wrap=True)
lng_2 = ListLength(List=join)
area = Area(Geometry=item_7)  # -> Area, Centroid
filter_3 = StreamFilter(Gate=panel, Stream0=item_8, Stream1=item)
larger = LargerThan(FirstNumber=lng_2, SecondNumber="1")  # -> LargerThan, OrEqualTo
simplify_3 = SimplifyTree(Tree=top_slice_location_point, Front=False)
stepover_distance_2 = Panel(stepover_distance)
larger_2 = LargerThan(FirstNumber=area.Area, SecondNumber=top_layer_pocket_threshold_area)  # -> LargerThan, OrEqualTo
lowes_slice_leftover_thickness_2 = Panel(lowes_slice_leftover_thickness)
simplify_4 = SimplifyTree(Tree=filter_3, Front=False)
pdecon_2 = Deconstruct(Point=simplify_3)  # -> XComponent, YComponent, ZComponent
pdecon_3 = Deconstruct(Point=simplify_4)  # -> XComponent, YComponent, ZComponent
xor = GateXor(A=larger.LargerThan, B=larger_2.LargerThan)
subtraction_2 = Subtraction(A=pdecon_2.ZComponent, B=top_slice_thickness_2)
addition_2 = Addition(A=pdecon_3.ZComponent, B=lowes_slice_leftover_thickness_2)
pt_2 = ConstructPoint(XCoordinate=pdecon_2.XComponent, YCoordinate=pdecon_2.YComponent, ZCoordinate=subtraction_2)
skip_top_slices_boolean = Integer(xor)
pt_3 = ConstructPoint(XCoordinate=pdecon_2.XComponent, YCoordinate=pdecon_2.YComponent, ZCoordinate=addition_2)
skip_top_slices_boolean_2 = Integer(skip_top_slices_boolean)
stepover_distance_3 = Panel(stepover_distance)
simplify_5 = SimplifyTree(Tree=skip_top_slices_boolean_2, Front=False)
multiplication_5 = Multiplication(A=stepover_distance_3, B="0.33")
pdecon_4 = Deconstruct(Point=pt_2)  # -> XComponent, YComponent, ZComponent
multiplication_6 = Multiplication(A=simplify_5, B=multiplication_5)
subtraction_3 = Subtraction(A=pdecon_4.ZComponent, B=multiplication_6)
pt_4 = ConstructPoint(XCoordinate=pdecon_4.XComponent, YCoordinate=pdecon_4.YComponent, ZCoordinate=subtraction_3)
upper_boundary_point = Point(pt_4)
lower_boundary_point = Point(pt_3)
inital_sample_slice_spacing_2 = Panel(inital_sample_slice_spacing)
ln = Line(StartPoint=upper_boundary_point, EndPoint=lower_boundary_point)
master_graph_line = Line(ln)
divide_curve_even_lenght = DivideCurveEvenLenght(crv=master_graph_line, B=inital_sample_slice_spacing_2)
meshes_for_3d_milling_2 = Mesh(meshes_for_3d_milling)
master_graph_points = Point(divide_curve_even_lenght)
xy_3 = XYPlane(Origin=master_graph_points)
multiplication_7 = Multiplication(A=inital_sample_slice_spacing_2, B=curve_sample_slice_reduction)
graft = GraftTree(Tree=meshes_for_3d_milling_2, IncludeEmptyLists=True, IncludeNullItems=True)
pshift_3 = ShiftPaths(Data=xy_3, Offset=-1)
inital_sample_slice_spacing_3 = Panel(multiplication_7)
sec_2 = MeshPlane(Mesh=graft, Plane=pshift_3)
divlength = DivideLength(Curve=sec_2, Length=inital_sample_slice_spacing_3)  # -> Points, Tangents, Parameters
Z_2 = UnitZ(Factor="0.1")
move = Move(Geometry=divlength.Points, Motion=Z_2)  # -> Geometry, Transform
pshift_4 = ShiftPaths(Data=move.Geometry, Offset=-1)
Z_3 = UnitZ(Factor=1)
mjoin_2 = MeshJoin(Meshes=meshes_for_3d_milling_2)
simplify_6 = SimplifyTree(Tree=pshift_4, Front=False)
meshray_2 = MeshRay(Mesh=mjoin_2, Point=simplify_6, Direction=Z_3)  # -> Point, Hit
dispatch = Dispatch(List=simplify_6, DispatchPattern=meshray_2.Hit)  # -> ListA, ListB
pt_5 = Point(dispatch.ListB)
clean = CleanTree(RemoveNulls=True, RemoveInvalid=True, RemoveEmpty=True, Tree=pt_5)
meshcp = MeshClosestPoint(Point=clean, Mesh=mjoin_2)  # -> Point, Index, Parameter
meval = MeshEval(Mesh=mjoin_2, Parameter=meshcp.Parameter)  # -> Point, Normal, Colour
vdis = VectorDisplay(Anchor=clean, Vector=meval.Normal)
Z_4 = UnitZ(Factor=1)
angle = Angle(VectorA=meval.Normal, VectorB=Z_4)  # -> Angle, Reflex
deg = Degrees(Radians=angle.Angle)
lng_3 = ListLength(List=deg)
sort_2 = SortList(Keys=deg)  # -> Keys, ValuesA
panel_2 = Panel(sort_2.Keys)
multiplication_8 = Multiplication(A=lng_3, B=sample_top_value_percentage)
round = Round(Number=multiplication_8)  # -> Nearest, Floor, Ceiling
split = SplitList(List=sort_2.Keys, Index=round.Ceiling)  # -> ListA, ListB
panel_3 = Panel(split.ListA)
avr = Average(Input=split.ListA)
panel_4 = Panel(avr)
lng_4 = ListLength(List=meshes_for_3d_milling)
pshift_5 = ShiftPaths(Data=avr, Offset=-1)
larger_3 = LargerThan(FirstNumber=lng_4, SecondNumber="1")  # -> LargerThan, OrEqualTo
pshift_6 = ShiftPaths(Data=pshift_5, Offset=-1)
pshift_7 = ShiftPaths(Data=avr, Offset=1)
max_angle_limit_2 = Panel(max_angle_limit)
filter_4 = StreamFilter(Gate=larger_3.LargerThan, Stream0=pshift_7, Stream1=pshift_6)
smaller = SmallerThan(FirstNumber=filter_4, SecondNumber=max_angle_limit_2)  # -> SmallerThan, OrEqualTo
dispatch_2 = Dispatch(List=filter_4, DispatchPattern=smaller.SmallerThan)  # -> ListA, ListB
lng_5 = ListLength(List=dispatch_2.ListA)
dup = DuplicateData(Data=max_angle_limit_2, Number=lng_5, Order=True)
master_graph_points_2 = Point(master_graph_points)
master_graph_line_2 = Line(master_graph_line)
pshift_8 = ShiftPaths(Data=dup, Offset=-1)
weave = Weave(Pattern=smaller.SmallerThan, Stream0=dispatch_2.ListB, Stream1=pshift_8, NullGaps=False)
average_surface_angle = Panel(weave)
lng_6 = ListLength(List=master_graph_points_2)
len = Length(Curve=master_graph_line_2)
subtraction_4 = Subtraction(A=lng_6, B="1")
division = Division(A=len, B=subtraction_4)
division_2 = Division(A=division, B="2")
neg = Negative(Value=division_2)
Z_5 = UnitZ(Factor=neg)
Z_6 = UnitZ(Factor=division_2)
move_2 = Move(Geometry=master_graph_points_2, Motion=Z_6)  # -> Geometry, Transform
move_3 = Move(Geometry=master_graph_points_2, Motion=Z_5)  # -> Geometry, Transform
xy_4 = XYPlane(Origin=master_graph_points_2)
subtraction_5 = Subtraction(A="90", B=average_surface_angle)
xz = XZPlane(Origin=master_graph_points_2)
neg_2 = Negative(Value=division_2)
ln_2 = Line(StartPoint=move_2.Geometry, EndPoint=move_3.Geometry)
neg_3 = Negative(Value=subtraction_5)
Z_7 = UnitZ(Factor=neg_2)
Z_8 = UnitZ(Factor=division_2)
move_4 = Move(Geometry=xy_4, Motion=Z_8)  # -> Geometry, Transform
move_5 = Move(Geometry=xy_4, Motion=Z_7)  # -> Geometry, Transform
rotate = Rotate(Geometry=ln_2, Angle=degrees(neg_3), Plane=xz)  # -> Geometry, Transform
plx = LinePlane(Line=rotate.Geometry, Plane=move_4.Geometry)  # -> Point, ParamL, ParamP
plx_2 = LinePlane(Line=rotate.Geometry, Plane=move_5.Geometry)  # -> Point, ParamL, ParamP
xy_5 = XYPlane(Origin=Point(0, 0, 0))
ln_3 = Line(StartPoint=plx.Point, EndPoint=plx_2.Point)
project = Project(Geometry=ln_3, Plane=xy_5)  # -> Geometry, Transform
bbox_5 = BoundingBox(Content=ln_3, Plane=PlaneXY(0, 0, 0))  # -> Box, Box_2; disabled
len_2 = Length(Curve=project.Geometry)
dim = Dimensions(Surface=bbox_5.Box)  # -> UDimension, VDimension; disabled
line_width = Number(len_2)
ma = MassAddition(Input=line_width)  # -> Result, PartialResults
division_3 = Division(A=line_width, B="2")
neg_4 = Negative(Value=ma.PartialResults)
X = UnitX(Factor=division_3)
X_2 = UnitX(Factor=neg_4)
move_6 = Move(Geometry=ln_3, Motion=X)  # -> Geometry, Transform
move_7 = Move(Geometry=move_6.Geometry, Motion=X_2)  # -> Geometry, Transform
milling_bit_radius_2 = Panel(multiplication_3)
curvepoint = PointOnCurve(move_7.Geometry, parameter=0.5)
intcrv = Interpolate(Vertices=curvepoint, Degree=3, Periodic=False, KnotStyle=1)  # -> Curve, Length, Domain
neg_5 = Negative(Value=milling_bit_radius_2)
xz_2 = XZPlane(Origin=Point(0, 0, 0))
offset = Offset(Curve=intcrv.Curve, Distance=milling_bit_radius_2, Plane=xz_2, Corners=1)
crv = Curve(intcrv.Curve)
end = EndPoints(Curve=master_graph_line_2)  # -> Start, End
end_2 = EndPoints(Curve=crv)  # -> Start, End
vec2pt = Vector2Pt(PointA=end_2.End, PointB=end.End, Unitize=False)  # -> Vector, Length
move_8 = Move(Geometry=crv, Motion=vec2pt.Vector)  # -> Geometry, Transform
stepover = Panel(stepover_distance)
simplify_7 = SimplifyTree(Tree=crv, Front=False)
divide_curve_even_lenght_2 = DivideCurveEvenLenght(crv=simplify_7, B=stepover)
pshift_9 = ShiftPaths(Data=divide_curve_even_lenght_2, Offset=-1)
pt_6 = Point(end.End)
pdecon_5 = Deconstruct(Point=pshift_9)  # -> XComponent, YComponent, ZComponent
pdecon_6 = Deconstruct(Point=pt_6)  # -> XComponent, YComponent, ZComponent
pt_7 = ConstructPoint(XCoordinate=pdecon_6.XComponent, YCoordinate=pdecon_5.YComponent, ZCoordinate=pdecon_5.ZComponent)
stepover_distance_4 = Panel(stepover_distance)
milling_bit_radius_3 = Panel(multiplication_3)
top_slice_location_point_2 = Point(item_2)
pt_8 = Point(pt_7)
skip_top_slices_boolean_3 = Integer(skip_top_slices_boolean)
top_layer_slice_2 = Curve(top_layer_slice)
subtraction_6 = Subtraction(A=milling_bit_radius_3, B=stepover_distance_4)
pdecon_7 = Deconstruct(Point=top_slice_location_point_2)  # -> XComponent, YComponent, ZComponent
pdecon_8 = Deconstruct(Point=pt_8)  # -> XComponent, YComponent, ZComponent
addition_3 = Addition(A=pdecon_7.ZComponent, B=subtraction_6)
item_9 = ListItem(List=pdecon_8.ZComponent, Index=0, Wrap=True)
crv_2 = Curve(top_layer_slice_2)
p_n_c = PickNChoose(Pattern=skip_top_slices_boolean_3, Stream1=crv_2)
p_n_c_2 = PickNChoose(Pattern=skip_top_slices_boolean_3, Stream0=item_9, Stream1=addition_3)
Z_9 = UnitZ(Factor=top_slice_sample_thickness)
pshift_10 = ShiftPaths(Data=p_n_c_2, Offset=-1)
move_9 = Move(Geometry=p_n_c, Motion=Z_9)  # -> Geometry, Transform
larger_4 = LargerThan(FirstNumber=pdecon_8.ZComponent, SecondNumber=pshift_10)  # -> LargerThan, OrEqualTo
top_slice_section_for_pocket = Curve(move_9.Geometry)
dispatch_3 = Dispatch(List=pt_8, DispatchPattern=larger_4.LargerThan)  # -> ListA, ListB
pt_9 = Point(dispatch_3.ListB)
meshes_for_3d_milling_3 = Mesh(graft(meshes_for_3d_milling))
meshes_for_3d_milling_4 = Mesh(joined_meshes_for_3d_milling)
milling_bit_radius_4 = Panel(multiplication_3)
initial_sample_lenght = Panel("0.2")
samples_per_circle = Panel("24")
xy_6 = XYPlane(Origin=pt_9)
reduction_tolerance_2 = Panel(reduction_tolerance)
sec_3 = MeshPlane(Mesh=meshes_for_3d_milling_3, Plane=xy_6)
join_2 = JoinCurves(Curves=sec_3, Preserve=False)
clean_2 = CleanTree(RemoveNulls=True, RemoveInvalid=True, RemoveEmpty=True, Tree=join_2)
simplify_8 = SimplifyTree(Tree=clean_2, Front=False)
redpline = Reduce(Polyline=simplify_8, Tolerance=reduction_tolerance_2)  # -> Polyline, Reduction
cp_2 = ControlPoints(Curve=redpline.Polyline)  # -> Points, Weights, Knots
crv_3 = Curve(redpline.Polyline)
xy_7 = XYPlane(Origin=cp_2.Points)
cir = Circle(Plane=xy_7, Radius=initial_sample_lenght)
ccx = CurveCurve(CurveA=cir, CurveB=graft(crv_3))  # -> Points, ParamsA, ParamsB
ccx_2 = CurveCurve(CurveA=crv_3, CurveB=cir)  # -> Points, ParamsA, ParamsB; disabled
pshift_11 = ShiftPaths(Data=ccx.Points, Offset=-1)
crv_4 = Curve(crv_3)
alongcrv = SortAlongCurve(Points=pshift_11, Curve=graft(crv_4))  # -> Points, Indices
pshift_12 = ShiftPaths(Data=alongcrv.Points, Offset=-1)
meshes_for_3d_milling_5 = Mesh(meshes_for_3d_milling_4)
sample_points_for_offset = Point(pshift_12)
milling_bit_radius_5 = Panel(milling_bit_radius_4)
sample_points_for_offset_2 = Point(sample_points_for_offset)
meshcp_2 = MeshClosestPoint(Point=sample_points_for_offset_2, Mesh=meshes_for_3d_milling_5)  # -> Point, Index, Parameter
meval_2 = MeshEval(Mesh=meshes_for_3d_milling_5, Parameter=meshcp_2.Parameter)  # -> Point, Normal, Colour
amp = Amplitude(Vector=meval_2.Normal, Amplitude=milling_bit_radius_5)
move_10 = Move(Geometry=meshcp_2.Point, Motion=amp)  # -> Geometry, Transform
pt_10 = Point(move_10.Geometry)
Z_10 = UnitZ(Factor="0.1")
meshcp_3 = MeshClosestPoint(Point=pt_10, Mesh=meshes_for_3d_milling_5)  # -> Point, Index, Parameter
vec2pt_2 = Vector2Pt(PointA=meshcp_3.Point, PointB=pt_10, Unitize=False)  # -> Vector, Length
mjoin_3 = MeshJoin(Meshes=meshes_for_3d_milling_2)
amp_2 = Amplitude(Vector=vec2pt_2.Vector, Amplitude=milling_bit_radius_5)
Z_11 = UnitZ(Factor=1)
move_11 = Move(Geometry=meshcp_3.Point, Motion=amp_2)  # -> Geometry, Transform
neg_6 = Negative(Value="0.1")
Z_12 = UnitZ(Factor=neg_6)
reduction_tolerance_3 = Panel(reduction_tolerance_2)
crv_5 = Curve(crv_3)
joined_meshes = Mesh(joined_meshes_for_3d_milling)
neg_7 = Negative(Value="0.01")
Z_13 = UnitZ(Factor=neg_7)
cullpt = CullDuplicates(Points=move_11.Geometry, Tolerance=reduction_tolerance_3, CullMode=3)  # -> Points, Indices, Valence
alongcrv_2 = SortAlongCurve(Points=cullpt.Points, Curve=graft(crv_5))  # -> Points, Indices
pline_2 = PolyLine(Vertices=cullpt.Points, Closed=True)
vertical_angle_cutoff_2 = Panel(vertical_angle_cutoff)
pline_3 = PolyLine(Vertices=alongcrv_2.Points, Closed=True)
Z_14 = UnitZ(Factor=1)
redpline_2 = Reduce(Polyline=pline_3, Tolerance=reduction_tolerance_3)  # -> Polyline, Reduction
corner_sample_angle_threshold = Slider(9, range=0..100)
simplify_9 = SimplifyTree(Tree=redpline_2.Polyline, Front=False)
crv_6 = Curve(simplify_9)
cp_3 = ControlPoints(Curve=crv_6)  # -> Points, Weights, Knots
Z_15 = UnitZ(Factor=1)
simplify_10 = SimplifyTree(Tree=cp_3.Points, Front=False)
panel_5 = Panel(corner_sample_angle_threshold)
cullpt_2 = CullDuplicates(Points=simplify_10, Tolerance=reduction_tolerance_3, CullMode=3)  # -> Points, Indices, Valence
pt_11 = Point(cullpt_2.Points)
crv_cp = CurveClosestPoint(Point=pt_11, Curve=crv_6)  # -> Point, Parameter, Distance
eval = EvaluateCurve(Curve=crv_6, Parameter=crv_cp.Parameter)  # -> Point, Tangent, Angle
xy_8 = XYPlane(Origin=Point(0, 0, 0))
rad = Radians(Degrees=panel_5)
samples_per_circle_2 = Panel(samples_per_circle)
pt_12 = Point(cullpt_2.Points)
cir_2 = Circle(Plane=xy_8, Radius=milling_bit_radius_5)
larger_5 = LargerThan(FirstNumber=eval.Angle, SecondNumber=rad)  # -> LargerThan, OrEqualTo
len_3 = Length(Curve=cir_2)
p_n_c_3 = PickNChoose(Pattern=larger_5.LargerThan, Stream1=pt_11)
pt_13 = Point(p_n_c_3)
cps = ClosestPoints(Point=pt_13, Cloud=pt_13, Count="2")  # -> ClosestPoint, CPIndex, Distance
item_10 = ListItem(List=cps.Distance, Index="1", Wrap=True)
division_4 = Division(A=len_3, B=samples_per_circle_2)
pshift_13 = ShiftPaths(Data=item_10, Offset=-1)
multiplication_9 = Multiplication(A=pshift_13, B="0.49")
division_5 = Division(A=multiplication_9, B=division_4)
milling_bit_radius_6 = Panel(multiplication_3)
round_2 = Round(Number=division_5)  # -> Nearest, Floor, Ceiling
joined_meshes_2 = Mesh(joined_meshes_for_3d_milling)
pt_14 = Point(p_n_c_3)
pt_15 = Point(cullpt_2.Points)
division_6 = Division(A=multiplication_9, B=round_2.Ceiling)
xy_9 = XYPlane(Origin=pt_14)
series = Series(Start=division_6, Step=division_6, Count=round_2.Ceiling)
graft_2 = GraftTree(Tree=xy_9, IncludeEmptyLists=True, IncludeNullItems=True)
sph = Sphere(Base=graft_2, Radius=series)
pshift_14 = ShiftPaths(Data=sph, Offset=-1)
bcx = BrepCurve(Brep=pshift_14, Curve=crv_6)  # -> Curves, Points
series_2 = Series(Start=0, Step=Slider(45, range=0..100), Count=Slider(8, range=0..10))
pshift_15 = ShiftPaths(Data=bcx.Points, Offset=-1)
merge_2 = Merge(Data1=cullpt_2.Points, Data2=pshift_15)
rad_2 = Radians(Degrees=series_2)
reduction_tolerance_4 = Panel(reduction_tolerance_2)
alongcrv_3 = SortAlongCurve(Points=merge_2, Curve=graft(crv_6))  # -> Points, Indices
Z_16 = UnitZ(Factor=1)
pline_4 = PolyLine(Vertices=alongcrv_3.Points, Closed=True)
smoothpline = SmoothPolyline(Polyline=pline_4, Strength="1", Times="2")
redpline_3 = Reduce(Polyline=smoothpline, Tolerance=reduction_tolerance_4)  # -> Polyline, Reduction; disabled
cp_4 = ControlPoints(Curve=smoothpline)  # -> Points, Weights, Knots
pshift_16 = ShiftPaths(Data=cp_4.Points, Offset=-1)
meshcp_4 = MeshClosestPoint(Point=pshift_16, Mesh=meshes_for_3d_milling_5)  # -> Point, Index, Parameter
mesh_2 = Mesh(meshes_for_3d_milling)
vec2pt_3 = Vector2Pt(PointA=meshcp_4.Point, PointB=pshift_16, Unitize=False)  # -> Vector, Length
bbox_6 = BoundingBox(Content=mesh_2, Plane=PlaneXY(0, 0, 0), UnionBox=False)  # -> Box, Box_2
amp_3 = Amplitude(Vector=vec2pt_3.Vector, Amplitude=milling_bit_radius_5)
xy_10 = XYPlane(Origin=Point(0, 0, 0))
simplify_11 = SimplifyTree(Tree=top_layer_slice_2, Front=False)
move_12 = Move(Geometry=meshcp_4.Point, Motion=amp_3)  # -> Geometry, Transform
debrep_5 = DeconstructBrep(Brep=bbox_6.Box)  # -> Faces, Edges, Vertices
project_2 = Project(Geometry=simplify_11, Plane=xy_10)  # -> Geometry, Transform
item_11 = ListItem(List=debrep_5.Vertices, Index="4", Wrap=True)
pline_5 = PolyLine(Vertices=move_12.Geometry, Closed=True)
crv_7 = Curve(pline_5)
xy_11 = XYPlane(Origin=item_11)
pshift_17 = ShiftPaths(Data=xy_11, Offset=-1)
area_cull = Panel("10")
milling_bit_radius_7 = Panel(milling_bit_radius)
mshadow_2 = MeshShadow(Mesh=mesh_2, Light=Vector(0, 0, -1), Plane=pshift_17)
joined_meshes_3 = Mesh(joined_meshes_for_3d_milling)
joined_meshes_for_3d_milling_2 = Mesh(joined_meshes_for_3d_milling)
# do mesh inclusion test?
toolpath_for_mesh_inclusion_test = Curve(pline_5)
area_2 = Area(Geometry=mshadow_2)  # -> Area, Centroid
multiplication_10 = Multiplication(A=milling_bit_radius_7, B=area_cull)
cp_5 = ControlPoints(Curve=toolpath_for_mesh_inclusion_test)  # -> Points, Weights, Knots
smaller_2 = SmallerThan(FirstNumber=area_2.Area, SecondNumber=multiplication_10)  # -> SmallerThan, OrEqualTo
# fix: select failed shadow and tringulate for speed
dispatch_4 = Dispatch(List=mshadow_2, DispatchPattern=smaller_2.SmallerThan)  # -> ListA, ListB
minc = MeshInclusion(Mesh=joined_meshes_for_3d_milling_2, Point=cp_5.Points, Strict=False)
dispatch_5 = Dispatch(List=cp_5.Points, DispatchPattern=minc)  # -> ListA, ListB
pt_16 = Point(dispatch_5.ListB)
pline_6 = PolyLine(Vertices=pt_16, Closed=False)
collsion_corrected_toolpaths = Curve(pline_6)
collsion_corrected_toolpaths_2 = Curve(collsion_corrected_toolpaths)
explode = Explode(Curve=collsion_corrected_toolpaths_2, Recursive=True)  # -> Segments, Vertices
cp_6 = ControlPoints(Curve=explode.Segments)  # -> Points, Weights, Knots
# Fix undercut based on points on surface
simplify_12 = SimplifyTree(Tree=cp_6.Points, Front=False)
move_13 = Move(Geometry=simplify_12, Motion=Z_10)  # -> Geometry, Transform
simplify_13 = SimplifyTree(Tree=move_13.Geometry, Front=False)
meshray_3 = MeshRay(Mesh=mjoin_3, Point=simplify_13, Direction=Z_11)  # -> Point, Hit
dispatch_6 = Dispatch(List=simplify_13, DispatchPattern=meshray_3.Hit)  # -> ListA, ListB
move_14 = Move(Geometry=dispatch_6.ListB, Motion=Z_12)  # -> Geometry, Transform
pt_17 = Point(move_14.Geometry)
meshcp_5 = MeshClosestPoint(Point=pt_17, Mesh=joined_meshes)  # -> Point, Index, Parameter
move_15 = Move(Geometry=meshcp_5.Point, Motion=Z_13)  # -> Geometry, Transform
meshcp_6 = MeshClosestPoint(Point=move_15.Geometry, Mesh=joined_meshes)  # -> Point, Index, Parameter
meval_3 = MeshEval(Mesh=joined_meshes, Parameter=meshcp_6.Parameter)  # -> Point, Normal, Colour
angle_2 = Angle(VectorA=meval_3.Normal, VectorB=Z_14)  # -> Angle, Reflex
deg_2 = Degrees(Radians=angle_2.Angle)
larger_6 = LargerThan(FirstNumber=deg_2, SecondNumber=vertical_angle_cutoff_2)  # -> LargerThan, OrEqualTo
vec2pt_4 = Vector2Pt(PointA=meshcp_6.Point, PointB=pt_17, Unitize=False)  # -> Vector, Length
dispatch_7 = Dispatch(List=pt_17, DispatchPattern=larger_6.LargerThan)  # -> ListA, ListB
dispatch_8 = Dispatch(List=vec2pt_4.Vector, DispatchPattern=larger_6.LargerThan)  # -> ListA, ListB
angle_3 = Angle(VectorA=dispatch_8.ListB, VectorB=Z_15)  # -> Angle, Reflex
deg_3 = Degrees(Radians=angle_3.Angle)
larger_7 = LargerThan(FirstNumber=deg_3, SecondNumber="90")  # -> LargerThan, OrEqualTo
dispatch_9 = Dispatch(List=dispatch_7.ListB, DispatchPattern=larger_7.LargerThan)  # -> ListA, ListB
pt_18 = Point(dispatch_9.ListB)
pt_19 = Point(pt_18)
meshcp_7 = MeshClosestPoint(Point=pt_19, Mesh=joined_meshes_2)  # -> Point, Index, Parameter
pdecon_9 = Deconstruct(Point=pt_19)  # -> XComponent, YComponent, ZComponent
pdecon_10 = Deconstruct(Point=meshcp_7.Point)  # -> XComponent, YComponent, ZComponent
pt_20 = ConstructPoint(XCoordinate=pdecon_10.XComponent, YCoordinate=pdecon_10.YComponent, ZCoordinate=pdecon_9.ZComponent)
vec2pt_5 = Vector2Pt(PointA=pt_19, PointB=pt_20, Unitize=False)  # -> Vector, Length
amp_4 = Amplitude(Vector=vec2pt_5.Vector, Amplitude=milling_bit_radius_6)
move_16 = Move(Geometry=pt_19, Motion=amp_4)  # -> Geometry, Transform
xy_12 = XYPlane(Origin=pt_19)
rotate_2 = Rotate(Geometry=move_16.Geometry, Angle=rad_2, Plane=xy_12)  # -> Geometry, Transform
meshray_4 = MeshRay(Mesh=joined_meshes_2, Point=rotate_2.Geometry, Direction=Z_16)  # -> Point, Hit
sort_3 = SortList(Keys=meshray_4.Hit)  # -> Keys, ValuesA
rev_2 = ReverseList(List=sort_3.Keys)
item_12 = ListItem(List=rev_2, Index=0, Wrap=True)
dispatch_10 = Dispatch(List=pt_19, DispatchPattern=item_12)  # -> ListA, ListB
pt_21 = Point(dispatch_10.ListB)
pt_22 = Point(pt_21)
pline_7 = PolyLine(Vertices=pt_22, Closed=False)
clean_3 = CleanTree(RemoveNulls=True, RemoveInvalid=True, RemoveEmpty=True, Tree=pline_7)
crv_8 = Curve(clean_3)
explode_2 = Explode(Curve=crv_8, Recursive=True)  # -> Segments, Vertices
project_3 = Project(Geometry=explode_2.Segments, Plane=xy_10)  # -> Geometry, Transform
colom = CollisionOneMany(Collider=explode_2.Segments, Obstacles=flatten(joined_meshes_3))  # -> Collision, Index
colom_2 = CollisionOneMany(Collider=project_3.Geometry, Obstacles=flatten(project_2.Geometry))  # -> Collision, Index
or_2 = GateOr(A=colom.Collision, B=colom_2.Collision)
dispatch_11 = Dispatch(List=explode_2.Segments, DispatchPattern=or_2)  # -> ListA, ListB
crv_9 = Curve(dispatch_11.ListB)
explode_3 = Explode(Curve=crv_9, Recursive=True)  # -> Segments, Vertices; disabled
simplify_14 = SimplifyTree(Tree=explode_3.Segments, Front=False)
curvepoint_2 = PointOnCurve(simplify_14, parameter=0.5)
project_4 = Project(Geometry=curvepoint_2, Plane=xy_10)  # -> Geometry, Transform; disabled
# Fix: make slices from donut shape work
panel_6 = Panel("0.6")
oultine_curve_for_cutout = Curve(dispatch_4.ListB)
incurves = PointInCurves(Point=project_4.Geometry, Curves=flatten(project_2.Geometry))  # -> Relationship, Index, Point
tool_diameter = Panel(milling_bit_diameter_2)
multiplication_11 = Multiplication(A=incurves.Relationship, B=panel_6)
simplify_15 = SimplifyTree(Tree=oultine_curve_for_cutout, Front=False)
int = Integer(multiplication_11)
dispatch_12 = Dispatch(List=simplify_14, DispatchPattern=int)  # -> ListA, ListB
tool_diameter_2 = Panel(tool_diameter)
xy_13 = XYPlane(Origin=Point(0, 0, 0))
curves_for_cutout = Curve(simplify_15)
collison_free_polylines = Curve(crv_9)
operation_plane = Plane(xy_13)
multiplication_12 = Multiplication(A=tool_diameter_2, B="0.5")
cls = Closed(Curve=curves_for_cutout)  # -> Closed, Periodic
explode_4 = Explode(Curve=collison_free_polylines, Recursive=True)  # -> Segments, Vertices
number_of_checking_points_per_segment = Panel("4")
tool_radius = Panel(multiplication_12)
cutout_tolerance_3 = Panel(cutout_tolerance_2)
dispatch_13 = Dispatch(List=curves_for_cutout, DispatchPattern=cls.Closed)  # -> ListA, ListB
simplify_16 = SimplifyTree(Tree=explode_4.Segments, Front=False)
addition_4 = Addition(A=tool_radius, B=cutout_tolerance_3)
divide = DivideCurve(Curve=simplify_16, Count=number_of_checking_points_per_segment, Kinks=False)  # -> Points, Tangents, Parameters
mesh_3 = Mesh(mjoin_3)
compensated_tool_radius = Panel(addition_4)
cull_i = CullIndex(List=divide.Points, Indices="0", Wrap=True)
rev_3 = ReverseList(List=cull_i)
curves_for_merging_overlap = Curve(dispatch_13.ListA)
cull_i_2 = CullIndex(List=rev_3, Indices="0", Wrap=True)
simplify_17 = SimplifyTree(Tree=cull_i_2, Front=False)
mcx = MultipleCurves(Curves=curves_for_merging_overlap)  # -> Points, IndexA, IndexB, ParamA, ParamB
pt_23 = Point(simplify_17)
dcon = DeleteConsecutive(Set=[mcx.IndexA, mcx.IndexB], Wrap=False)  # -> Set, Count
meshcp_8 = MeshClosestPoint(Point=pt_23, Mesh=mesh_3)  # -> Point, Index, Parameter
milling_bit_radius_8 = Panel(milling_bit_radius)
dist_2 = Distance(PointA=pt_23, PointB=meshcp_8.Point)
item_13 = ListItem(List=curves_for_merging_overlap, Index=dcon.Set, Wrap=True)
subtraction_7 = Subtraction(A=dist_2, B=milling_bit_radius_8)
abs = Absolute(Value=subtraction_7)
cull_i_3 = CullIndex(List=curves_for_merging_overlap, Indices=dcon.Set, Wrap=True)
runion = RegionUnion(Curves=item_13, Plane=operation_plane)
ratio_for_cull = Panel("0.5")
ratio_for_cull_2 = Panel("1")
sort_4 = SortList(Keys=abs)  # -> Keys, ValuesA
rev_4 = ReverseList(List=sort_4.Keys)
merged_overlapping_curves = Curve([runion, cull_i_3])
multiplication_13 = Multiplication(A=milling_bit_radius_8, B=ratio_for_cull)
item_14 = ListItem(List=rev_4, Index=0, Wrap=True)
larger_8 = LargerThan(FirstNumber=item_14, SecondNumber=multiplication_13)  # -> LargerThan, OrEqualTo
threshold_for_rebuild = Panel("0.1")
dispatch_14 = Dispatch(List=item_14, DispatchPattern=larger_8.LargerThan)  # -> ListA, ListB
dispatch_15 = Dispatch(List=simplify_16, DispatchPattern=larger_8.LargerThan)  # -> ListA, ListB
# For higher sampling number fix bridge curves beeing pulled under overhangs
larger_9 = LargerThan(FirstNumber=dispatch_14.ListB, SecondNumber=threshold_for_rebuild)  # -> LargerThan, OrEqualTo
crv_10 = Curve(dispatch_15.ListB)
curves_for_aligned_direction = Curve(merged_overlapping_curves)
dispatch_16 = Dispatch(List=crv_10, DispatchPattern=larger_9.LargerThan)  # -> ListA, ListB
# fix bad corner cull and angle check. use obr test triangle
panel_7 = Panel("2")
multiplication_14 = Multiplication(A=number_of_checking_points_per_segment, B=panel_7)
divide_2 = DivideCurve(Curve=dispatch_16.ListA, Count="1", Kinks=False)  # -> Points, Tangents, Parameters
graft_3 = GraftTree(Tree=curves_for_aligned_direction, IncludeEmptyLists=True, IncludeNullItems=True)
pline_8 = PolyLine(Vertices=divide_2.Points, Closed=False)
clean_4 = CleanTree(RemoveNulls=True, RemoveInvalid=True, RemoveEmpty=False, Tree=pline_8)
offset_2 = Offset(Curve=graft_3, Distance="0.01", Plane=PlaneXY(0, 0, 0), Corners=2)
pshift_18 = ShiftPaths(Data=clean_4, Offset=-1)
end_3 = EndPoints(Curve=offset_2)  # -> Start, End
pshift_19 = ShiftPaths(Data=end_3.Start, Offset=-1)
curvepoint_3 = PointOnCurve(pshift_18, parameter=0.496)
Z_17 = UnitZ(Factor="0.1")
incurve = PointInCurve(Point=pshift_19, Curve=graft_3)  # -> Relationship, Point
move_17 = Move(Geometry=curvepoint_3, Motion=Z_17)  # -> Geometry, Transform
mjoin_4 = MeshJoin(Meshes=meshes_for_3d_milling_2)
multiplication_15 = Multiplication(A=incurve.Relationship, B="0.5")
simplify_18 = SimplifyTree(Tree=move_17.Geometry, Front=False)
round_3 = Round(Number=multiplication_15)  # -> Nearest, Floor, Ceiling
Z_18 = UnitZ(Factor=1)
meshray_5 = MeshRay(Mesh=mjoin_4, Point=simplify_18, Direction=Z_18)  # -> Point, Hit
crv_11 = Curve(graft_3)
int_2 = Integer(round_3.Nearest)
flip = FlipCurve(Curve=crv_11)  # -> Curve, Flag
dispatch_17 = Dispatch(List=pshift_18, DispatchPattern=meshray_5.Hit)  # -> ListA, ListB
weave_2 = Weave(Pattern=int_2, Stream0=flip.Curve, Stream1=crv_11, NullGaps=False)
lng_7 = ListLength(List=dispatch_17.ListA)
crv_12 = Curve(dispatch_17.ListB)
pshift_20 = ShiftPaths(Data=weave_2, Offset=-1)
dup_2 = DuplicateData(Data="0", Number=lng_7, Order=True)
use_inside_cutting = Panel("0")
pshift_21 = ShiftPaths(Data=dup_2, Offset=-1)
flip_2 = FlipCurve(Curve=pshift_20)  # -> Curve, Flag
weave_3 = Weave(Pattern=[0, 1], Stream0=crv_12, Stream1=pshift_21, NullGaps=False)
weave_4 = Weave(Pattern=larger_9.LargerThan, Stream0=dispatch_16.ListB, Stream1=weave_3, NullGaps=False)
filter_5 = StreamFilter(Gate=use_inside_cutting, Stream0=pshift_20, Stream1=flip_2.Curve)
crv_13 = Curve(weave_4)
aligned_curves = Curve(filter_5)
clean_5 = CleanTree(RemoveNulls=True, RemoveInvalid=True, RemoveEmpty=False, Tree=crv_13)
crv_14 = Curve(clean_5)
simplify_19 = SimplifyTree(Tree=aligned_curves, Front=False)
pshift_22 = ShiftPaths(Data=crv_14, Offset="-2")
null = NullItem(Item=pshift_22)  # -> NullFlags, InvalidFlags, Description
aligned_curves_2 = Curve(simplify_19)
flatten_2 = FlattenTree(Tree=crv_14, Path="{0}")
item_15 = ListItem(List=flatten(null.InvalidFlags), Index=0, Wrap=True)
end_4 = EndPoints(Curve=aligned_curves_2)  # -> Start, End
graft_4 = GraftTree(Tree=aligned_curves_2, IncludeEmptyLists=True, IncludeNullItems=True)
filter_6 = StreamFilter(Gate=item_15, Stream0=pshift_22, Stream1=flatten_2)
flatten_3 = FlattenTree(Tree=end_4.Start, Path="{0}")
join_3 = JoinCurves(Curves=filter_6, Preserve=False)
incurve_2 = PointInCurve(Point=flatten_3, Curve=graft_4)  # -> Relationship, Point
cp_7 = ControlPoints(Curve=join_3)  # -> Points, Weights, Knots
pdecon_11 = Deconstruct(Point=cp_7.Points)  # -> XComponent, YComponent, ZComponent
multiplication_16 = Multiplication(A=incurve_2.Relationship, B="0.5")
nblur = BlurNumbers(
    Numbers=pdecon_11.ZComponent,
    Strength=Slider(1, range=0..1),
    Iterations=Slider(10, range=0..10),
    Lock=Toggle(True),
    Wrap=False)
generate_roughing = Panel(generate_3d_roughing_2)
milling_bit_radius_9 = Panel(milling_bit_radius)
mesh_4 = Mesh(joined_meshes_for_3d_milling)
points_to_offset_with_tool_radius = Point(cp_7.Points)
avr_2 = Average(Input=pdecon_11.ZComponent)
round_4 = Round(Number=multiplication_16)  # -> Nearest, Floor, Ceiling
int_3 = Integer(round_4.Floor)
pt_24 = ConstructPoint(XCoordinate=pdecon_11.XComponent, YCoordinate=pdecon_11.YComponent, ZCoordinate=nblur)
sort_5 = SortList(Keys=int_3)  # -> Keys, ValuesA
pline_9 = PolyLine(Vertices=pt_24, Closed=False)
meshcp_9 = MeshClosestPoint(Point=points_to_offset_with_tool_radius, Mesh=mesh_4)  # -> Point, Index, Parameter
rev_5 = ReverseList(List=sort_5.Keys)
dist_3 = Distance(PointA=points_to_offset_with_tool_radius, PointB=meshcp_9.Point)
smoothpline_2 = SmoothPolyline(Polyline=pline_9, Strength=1, Times=Slider(5, range=0..10))
item_16 = ListItem(List=rev_5, Index=0, Wrap=True)
redpline_4 = Reduce(Polyline=smoothpline_2, Tolerance="0.02")  # -> Polyline, Reduction
vec2pt_6 = Vector2Pt(PointA=meshcp_9.Point, PointB=points_to_offset_with_tool_radius, Unitize=False)  # -> Vector, Length
subtraction_8 = Subtraction(A=milling_bit_radius_9, B=dist_3)
pshift_23 = ShiftPaths(Data=item_16, Offset=-1)
cp_8 = ControlPoints(Curve=redpline_4.Polyline)  # -> Points, Weights, Knots
pt_25 = Point(cp_8.Points)
lng_8 = ListLength(List=pshift_23)
smaller_3 = SmallerThan(FirstNumber=lng_8, SecondNumber="2")  # -> SmallerThan, OrEqualTo
amp_5 = Amplitude(Vector=vec2pt_6.Vector, Amplitude=subtraction_8)
dispatch_18 = Dispatch(List=pshift_23, DispatchPattern=smaller_3.SmallerThan)  # -> ListA, ListB
move_18 = Move(Geometry=points_to_offset_with_tool_radius, Motion=amp_5)  # -> Geometry, Transform
not_2 = GateNot(A=dispatch_18.ListA)
points_at_tool_radius_distance_from_mesh = Point(move_18.Geometry)
weave_5 = Weave(Pattern=[0, 1], Stream0=dispatch_18.ListB, Stream1=not_2, NullGaps=False)
dispatch_19 = Dispatch(List=aligned_curves_2, DispatchPattern=weave_5)  # -> ListA, ListB
curves_outside = Curve(dispatch_19.ListA)
curves_inside = Curve(dispatch_19.ListB)
simplify_20 = SimplifyTree(Tree=points_at_tool_radius_distance_from_mesh, Front=False)
mjoin_5 = MeshJoin(Meshes=meshes_for_3d_milling_2)
Z_19 = UnitZ(Factor=1)
meshray_6 = MeshRay(Mesh=mjoin_5, Point=simplify_20, Direction=Z_19)  # -> Point, Hit
curves_for_offset_outwards = Curve(curves_outside)
dispatch_20 = Dispatch(List=simplify_20, DispatchPattern=meshray_6.Hit)  # -> ListA, ListB
curves_for_offset_inwards = Curve(curves_inside)
operation_plane_2 = Plane(operation_plane)
pt_26 = Point(dispatch_20.ListB)
neg_8 = Negative(Value=compensated_tool_radius)
redpline_5 = Reduce(Polyline=curves_for_offset_outwards, Tolerance="0.02")  # -> Polyline, Reduction
redpline_6 = Reduce(Polyline=curves_for_offset_inwards, Tolerance="0.02")  # -> Polyline, Reduction
finish_stepover = Panel(finishing_stepover_2)
roughing_stepover_3 = Panel(roughing_stepover_2)
milling_bit_radius_10 = Panel(milling_bit_radius)
reduction_tolerance_5 = Panel(reduction_tolerance)
offset_3 = Offset(Curve=redpline_5.Polyline, Distance=neg_8, Plane=operation_plane_2, Corners=2)
offset_4 = Offset(Curve=redpline_6.Polyline, Distance=compensated_tool_radius, Plane=operation_plane_2, Corners=2)
pline_10 = PolyLine(Vertices=pt_26, Closed=False)
cls_2 = Closed(Curve=offset_3)  # -> Closed, Periodic
cls_3 = Closed(Curve=offset_4)  # -> Closed, Periodic
redpline_7 = Reduce(Polyline=pline_10, Tolerance=reduction_tolerance_5)  # -> Polyline, Reduction
division_7 = Division(A=roughing_stepover_3, B=finish_stepover)
multiplication_17 = Multiplication(A=milling_bit_radius_10, B="1")
round_5 = Round(Number=division_7)  # -> Nearest, Floor, Ceiling
len_4 = Length(Curve=redpline_7.Polyline)
# Use cutout as last roughing pass?
# Fix: cull logic. not always true. make possible use all finsih for roughing
toggle = BooleanToggle(True)
smaller_4 = SmallerThan(FirstNumber=len_4, SecondNumber=multiplication_17)  # -> SmallerThan, OrEqualTo
smaller_5 = SmallerThan(FirstNumber=round_5.Floor, SecondNumber="2")  # -> SmallerThan, OrEqualTo
dup_3 = DuplicateData(Data=Toggle(False), Number=round_5.Floor, Order=True)
safe_offset_curve = SafeOffsetCurve(offset_amount=compensated_tool_radius, curves_to_offset=redpline_5.Polyline)  # -> error_corrected_curves_outside_2, error_corrected_curves_inside_2
safe_offset_curve_2 = SafeOffsetCurve(offset_amount=compensated_tool_radius, curves_to_offset=redpline_6.Polyline)  # -> error_corrected_curves_outside_2, error_corrected_curves_inside_2
dispatch_21 = Dispatch(List=redpline_7.Polyline, DispatchPattern=smaller_4.SmallerThan)  # -> ListA, ListB
crv_15 = Curve(dispatch_21.ListB)
filter_7 = StreamFilter(Gate=generate_roughing, Stream1=crv_15)
len_5 = Length(Curve=flatten(dispatch_21.ListB))
simplify_21 = SimplifyTree(Tree=filter_7, Front=False)
ma_2 = MassAddition(Input=len_5)  # -> Result, PartialResults
panel_8 = Panel(ma_2.Result)
pshift_24 = ShiftPaths(Data=simplify_21, Offset=-1)
null_2 = NullItem(Item=pshift_24)  # -> NullFlags, InvalidFlags, Description
flatten_4 = FlattenTree(Tree=null_2.NullFlags, Path="{0}")
item_17 = ListItem(List=flatten_4, Index=0, Wrap=True)
filter_8 = StreamFilter(Gate=item_17, Stream0=pshift_24, Stream1=simplify_21)
pshift_25 = ShiftPaths(Data=filter_8, Offset=-1)
null_3 = NullItem(Item=pshift_25)  # -> NullFlags, InvalidFlags, Description
flatten_5 = FlattenTree(Tree=null_3.NullFlags, Path="{0}")
item_18 = ListItem(List=flatten_5, Index=0, Wrap=True)
filter_9 = StreamFilter(Gate=item_18, Stream0=pshift_25, Stream1=filter_8)
flatten_6 = FlattenTree(Tree=filter_9, Path="{0}")
pshift_26 = ShiftPaths(Data=filter_9, Offset=-1)
null_4 = NullItem(Item=pshift_26)  # -> NullFlags, InvalidFlags, Description
flatten_7 = FlattenTree(Tree=null_4.NullFlags, Path="{0}")
item_19 = ListItem(List=flatten_7, Index=0, Wrap=True)
filter_10 = StreamFilter(Gate=item_19, Stream0=pshift_26, Stream1=flatten_6)
rev_6 = ReverseList(List=filter_10)
# Fix: pick correct bottom lines when opn toolpaths in bottom
divide_3 = DivideCurve(Curve=rev_6, Count=10, Kinks=False)  # -> Points, Tangents, Parameters; disabled
pdecon_12 = Deconstruct(Point=divide_3.Points)  # -> XComponent, YComponent, ZComponent
avr_3 = Average(Input=pdecon_12.ZComponent)
merge_3 = Merge(Data1=flatten(toggle), Data2=flatten(dup_3))
generate_finishing = Panel(generate_3d_finishing_2)
pshift_27 = ShiftPaths(Data=avr_3, Offset=-1)
cull = CullPattern(List=rev_6, CullPattern=merge_3)
panel_9 = Panel(pshift_27)
filter_11 = StreamFilter(Gate=smaller_5.SmallerThan, Stream0=cull, Stream1=rev_6)
flip_3 = FlipCurve(Curve=safe_offset_curve.error_corrected_curves_outside_2)  # -> Curve, Flag
p_n_c_4 = PickNChoose(Pattern=cls_3.Closed, Stream0=safe_offset_curve_2.error_corrected_curves_inside_2, Stream1=offset_4)
p_n_c_5 = PickNChoose(Pattern=cls_2.Closed, Stream0=flip_3.Curve, Stream1=offset_3)
clean_6 = CleanTree(RemoveNulls=True, RemoveInvalid=True, RemoveEmpty=True, Tree=filter_11)
flip_4 = FlipCurve(Curve=p_n_c_4)  # -> Curve, Flag
rev_7 = ReverseList(List=clean_6)
outside_cutout_curves = Curve(p_n_c_5)
inside_cutout_curves = Curve(flip_4.Curve)
neg_9 = Negative(Value=milling_bit_radius_10)
filter_12 = StreamFilter(Gate=generate_finishing, Stream1=dispatch_21.ListB)
Z_20 = UnitZ(Factor=neg_9)
crv_16 = Curve(rev_7)
outside_cutout_curves_2 = Curve(outside_cutout_curves)
inside_cutout_curves_2 = Curve(inside_cutout_curves)
move_19 = Move(Geometry=filter_12, Motion=Z_20)  # -> Geometry, Transform
cp_9 = ControlPoints(Curve=crv_16)  # -> Points, Weights, Knots
clean_7 = CleanTree(RemoveNulls=True, RemoveInvalid=True, RemoveEmpty=False, Tree=move_19.Geometry)
points_to_offset_with_tool_radius_2 = Point(cp_9.Points)
mesh_5 = Mesh(joined_meshes_for_3d_milling)
milling_bit_radius_11 = Panel(milling_bit_radius)
roughing_material_leftover_3 = Panel(roughing_material_leftover_2)
inside_outline_curves = Curve(inside_cutout_curves_2)
simplify_22 = SimplifyTree(Tree=clean_7, Front=False)
lng_9 = ListLength(List=meshes_for_3d_milling)
addition_5 = Addition(A=milling_bit_radius_11, B=roughing_material_leftover_3)
end_5 = EndPoints(Curve=inside_outline_curves)  # -> Start, End
smaller_6 = SmallerThan(FirstNumber=lng_9, SecondNumber="2")  # -> SmallerThan, OrEqualTo
flatten_8 = FlattenTree(Tree=simplify_22, Path="{0}")
pshift_28 = ShiftPaths(Data=simplify_22, Offset="-1")
pshift_29 = ShiftPaths(Data=simplify_22, Offset="-2")
meshcp_10 = MeshClosestPoint(Point=points_to_offset_with_tool_radius_2, Mesh=mesh_5)  # -> Point, Index, Parameter
incurves_2 = PointInCurves(Point=end_5.Start, Curves=outside_cutout_curves_2)  # -> Relationship, Index, Point
dist_4 = Distance(PointA=points_to_offset_with_tool_radius_2, PointB=meshcp_10.Point)
item_20 = ListItem(List=flatten(pshift_29), Index=0, Wrap=True)
addition_6 = Addition(A=incurves_2.Index, B="1")
vec2pt_7 = Vector2Pt(PointA=meshcp_10.Point, PointB=points_to_offset_with_tool_radius_2, Unitize=False)  # -> Vector, Length
null_5 = NullItem(Item=item_20)  # -> NullFlags, InvalidFlags, Description
merge_4 = Merge(Data1=outside_cutout_curves, Data2=inside_cutout_curves)  # disabled
subtraction_9 = Subtraction(A=addition_5, B=dist_4)
ins = InsertItems(List=outside_cutout_curves_2, Item=inside_outline_curves, Indices=incurves_2.Index, Wrap=True)
filter_13 = StreamFilter(Gate=null_5.NullFlags, Stream0=pshift_29, Stream1=pshift_28)
filter_14 = StreamFilter(Gate=smaller_6.SmallerThan, Stream0=filter_13, Stream1=flatten_8)
finishing_toolpaths = Curve(filter_14)
cls_4 = Closed(Curve=finishing_toolpaths)  # -> Closed, Periodic
sorted_inside_and_outside_curves = Curve(ins)
amp_6 = Amplitude(Vector=vec2pt_7.Vector, Amplitude=subtraction_9)
dispatch_22 = Dispatch(List=finishing_toolpaths, DispatchPattern=cls_4.Closed)  # -> ListA, ListB
move_20 = Move(Geometry=points_to_offset_with_tool_radius_2, Motion=amp_6)  # -> Geometry, Transform
xz_3 = XZPlane(Origin=Point(0, 0, 0))
end_6 = EndPoints(Curve=dispatch_22.ListB)  # -> Start, End
use_climb_direction = Panel("0")
rotate_3 = Rotate(Geometry=end_6.Start, Angle=1.570796327, Plane=xz_3)  # -> Geometry, Transform
points_at_tool_radius_distance_from_mesh_2 = Point(move_20.Geometry)
flip_5 = FlipCurve(Curve=sorted_inside_and_outside_curves)  # -> Curve, Flag
flatten_9 = FlattenTree(Tree=rotate_3.Geometry, Path="{0}")
filter_15 = StreamFilter(Gate=use_climb_direction, Stream0=flip_5.Curve, Stream1=sorted_inside_and_outside_curves)
item_21 = ListItem(List=flatten_9, Index=0, Wrap=True)
sort_pt = SortPoints(Points=rotate_3.Geometry)  # -> Points, Indices
null_6 = NullItem(Item=item_21)  # -> NullFlags, InvalidFlags, Description
pline_11 = PolyLine(Vertices=points_at_tool_radius_distance_from_mesh_2, Closed=False)
sorted_inside_and_outside_curves_2 = Curve(filter_15)
item_22 = ListItem(List=dispatch_22.ListB, Index=sort_pt.Indices, Wrap=True)
milling_bit_radius_12 = Panel(milling_bit_radius)
generate_cutout_3 = Panel(generate_cutout_2)
rev_8 = ReverseList(List=pt_9)
rev_9 = ReverseList(List=item_22)
milling_bit_radius_13 = Panel(milling_bit_radius)
item_23 = ListItem(List=rev_8, Index=0, Wrap=True)
extra_cut_depth_2 = Panel(addition)
dispatch_23 = Dispatch(List=item_22, DispatchPattern=[True, False])  # -> ListA, ListB
cutout_depth_2 = Panel(cutout_depth)
neg_10 = Negative(Value=milling_bit_radius_12)
generate_roughing_2 = Panel(generate_3d_roughing_2)
filter_16 = StreamFilter(Gate=generate_cutout_3, Stream1=sorted_inside_and_outside_curves_2)
devec = DeconstructVector(Vector=item_23)  # -> XComponent, YComponent, ZComponent
flip_6 = FlipCurve(Curve=dispatch_23.ListB)  # -> Curve, Flag
pshift_30 = ShiftPaths(Data=pline_11, Offset=-1)
Z_21 = UnitZ(Factor=neg_10)
weave_6 = Weave(Pattern=[0, 1], Stream0=dispatch_23.ListA, Stream1=flip_6.Curve, NullGaps=False)
cls_5 = Closed(Curve=outside_cutout_curves)  # -> Closed, Periodic
subtraction_10 = Subtraction(A=devec.ZComponent, B=milling_bit_radius_13)
move_21 = Move(Geometry=pshift_30, Motion=Z_21)  # -> Geometry, Transform
xz_4 = XZPlane(Origin=Point(0, 0, 0))
filter_17 = StreamFilter(Gate=generate_roughing_2, Stream1=sorted_inside_and_outside_curves_2)
abs_2 = Absolute(Value=subtraction_10)
weave_7 = Weave(Pattern=cls_4.Closed, Stream0=weave_6, Stream1=dispatch_22.ListA, NullGaps=False)
pass_depth = Panel(pass_depth_roughing_2)
cull_2 = CullPattern(List=cutout_depth_2, CullPattern=cls_5.Closed)
x_tremez = Extremes(Curve=move_21.Geometry, Plane=xz_4)  # -> Highest, Lowest
filter_18 = StreamFilter(Gate=null_6.NullFlags, Stream0=weave_7, Stream1=finishing_toolpaths)
simplify_23 = SimplifyTree(Tree=filter_16, Front=False)
clean_8 = CleanTree(RemoveNulls=True, RemoveInvalid=True, RemoveEmpty=True, Tree=cull_2)
extra_cut_depth_3 = Panel(addition)
roughing_material_leftover_4 = Panel(roughing_material_leftover_2)
cutout_depth_3 = Panel(abs_2)
simplify_24 = SimplifyTree(Tree=filter_17, Front=False)
devec_2 = DeconstructVector(Vector=x_tremez.Lowest)  # -> XComponent, YComponent, ZComponent
flatten_10 = FlattenTree(Tree=filter_18, Path="{0}")
clean_9 = CleanTree(RemoveNulls=True, RemoveInvalid=True, RemoveEmpty=False, Tree=simplify_23)
simplify_25 = SimplifyTree(Tree=clean_8, Front=False)
clean_10 = CleanTree(RemoveNulls=True, RemoveInvalid=True, RemoveEmpty=False, Tree=flatten_10)
clean_11 = CleanTree(RemoveNulls=True, RemoveInvalid=True, RemoveEmpty=False, Tree=simplify_24)
# Fix roughing to be at full depth, not pass depth distance from surface
division_8 = Division(A=devec_2.ZComponent, B=pass_depth)
cls_6 = Closed(Curve=outside_cutout_curves)  # -> Closed, Periodic
round_6 = Round(Number=division_8)  # -> Nearest, Floor, Ceiling
addition_7 = Addition(A=simplify_25, B=extra_cut_depth_2)
offset_5 = Offset(Curve=clean_11, Distance=roughing_material_leftover_4, Plane=PlaneXY(0, 0, 0), Corners=1)
sorted_inside_and_outside_curves_3 = Curve(clean_9)
cull_3 = CullPattern(List=cutout_depth_3, CullPattern=cls_6.Closed)
neg_11 = Negative(Value=round_6.Floor)
finishing_toolpaths_2 = Curve(clean_10)
stepover_distance_5 = Panel(stepover_distance)
connect_toolpaths_levels_3 = Integer(connect_toolpaths_levels_2)
connect_toolpath_tolerance_factor_2 = Panel(connect_toolpath_tolerance_factor)
make_flea_jump_transitions_3 = Integer(make_flea_jump_transitions_2)
cut_depth_cutout = Panel(addition_7)
pass_depth_cutout = Panel(pass_depth_roughing_2)
clean_12 = CleanTree(RemoveNulls=True, RemoveInvalid=True, RemoveEmpty=True, Tree=cull_3)
unflatten = UnflattenTree(Tree=offset_5, Guide=clean_11)
smaller_7 = SmallerThan(FirstNumber=neg_11, SecondNumber="2")  # -> SmallerThan, OrEqualTo
simplify_26 = SimplifyTree(Tree=clean_12, Front=False)
dispatch_24 = Dispatch(List=neg_11, DispatchPattern=smaller_7.SmallerThan)  # -> ListA, ListB
division_9 = Division(A=cut_depth_cutout, B=pass_depth_cutout)
graft_5 = GraftTree(Tree=sorted_inside_and_outside_curves_3, IncludeEmptyLists=True, IncludeNullItems=True)
crv_17 = Curve(move_21.Geometry)
subtraction_11 = Subtraction(A=dispatch_24.ListB, B="1")
panel_10 = Panel("0")
round_7 = Round(Number=division_9)  # -> Nearest, Floor, Ceiling
addition_8 = Addition(A=simplify_26, B=extra_cut_depth_3)
dispatch_25 = Dispatch(List=crv_17, DispatchPattern=smaller_7.SmallerThan)  # -> ListA, ListB
sorted_inside_and_outside_curves_4 = Curve(unflatten)
series_3 = Series(Start=pass_depth, Step=pass_depth, Count=subtraction_11)
multiplication_18 = Multiplication(A=stepover_distance_5, B=connect_toolpath_tolerance_factor_2)
end_7 = EndPoints(Curve=finishing_toolpaths_2)  # -> Start, End
division_10 = Division(A=cut_depth_cutout, B=round_7.Ceiling)
crv_18 = Curve(dispatch_25.ListB)
pass_depth_2 = Panel(pass_depth_roughing_2)
cut_depth_cutout_2 = Panel(addition_8)
clean_13 = CleanTree(RemoveNulls=True, RemoveInvalid=True, RemoveEmpty=True, Tree=series_3)
actual_pass_depth = Panel(division_10)
lng_10 = ListLength(List=sorted_inside_and_outside_curves_3)
Z_22 = UnitZ(Factor=clean_13)
shift = ShiftList(List=end_7.Start, Shift="1", Wrap=True)
division_11 = Division(A=cut_depth_cutout_2, B=pass_depth_2)
move_22 = Move(Geometry=graft(crv_18), Motion=Z_22)  # -> Geometry, Transform
dup_4 = DuplicateData(Data=cut_depth_cutout, Number=lng_10, Order=True)
ln_4 = Line(StartPoint=end_7.End, EndPoint=shift)
flatten_11 = FlattenTree(Tree=sorted_inside_and_outside_curves_3, Path="{0}")
round_8 = Round(Number=division_11)  # -> Nearest, Floor, Ceiling
series_4 = Series(Start=actual_pass_depth, Step=actual_pass_depth, Count=round_7.Ceiling)
flatten_12 = FlattenTree(Tree=dup_4, Path="{0}")
rev_10 = ReverseList(List=move_22.Geometry)
neg_12 = Negative(Value=series_4)
division_12 = Division(A=cut_depth_cutout_2, B=round_8.Ceiling)
cut_depths_for_cutout = Panel(flatten_12)
flatten_13 = FlattenTree(Tree=rev_10, Path="{0}")
len_6 = Length(Curve=ln_4)
Z_23 = UnitZ(Factor=neg_12)
crv_19 = Curve(flatten_13)
actual_pass_depth_2 = Panel(division_12)
subtraction_12 = Subtraction(A=round_8.Ceiling, B="1")
larger_10 = LargerThan(FirstNumber=len_6, SecondNumber=multiplication_18)  # -> LargerThan, OrEqualTo
lng_11 = ListLength(List=finishing_toolpaths_2)
move_23 = Move(Geometry=graft_5, Motion=Z_23)  # -> Geometry, Transform; disabled
cls_7 = Closed(Curve=crv_19)  # -> Closed, Periodic
cutout_depths = Number(cut_depths_for_cutout)
cutout_curves = Curve(flatten_11)
dispatch_26 = Dispatch(List=crv_19, DispatchPattern=cls_7.Closed)  # -> ListA, ListB
series_5 = Series(Start=0, Step=1, Count=lng_11)
flatten_14 = FlattenTree(Tree=move_23.Geometry, Path="{0}")
series_6 = Series(Start=actual_pass_depth_2, Step=actual_pass_depth_2, Count=round_8.Ceiling)
dispatch_27 = Dispatch(List=dispatch_26.ListB, DispatchPattern=[True, False])  # -> ListA, ListB
neg_13 = Negative(Value=series_6)
dispatch_28 = Dispatch(List=series_5, DispatchPattern=larger_10.LargerThan)  # -> ListA, ListB
cutout_curves_2 = Curve(flatten_14)
flip_7 = FlipCurve(Curve=dispatch_27.ListB)  # -> Curve, Flag
Z_24 = UnitZ(Factor=neg_13)
stepover_distance_6 = Panel(stepover_distance_5)
replace = ReplaceItems(List=ln_4, Indices=dispatch_28.ListA, Wrap=False)
weave_8 = Weave(Pattern=[0, 1], Stream0=dispatch_27.ListA, Stream1=flip_7.Curve, NullGaps=False)
move_24 = Move(Geometry=sorted_inside_and_outside_curves_4, Motion=Z_24)  # -> Geometry, Transform
end_8 = EndPoints(Curve=graft(replace))  # -> Start, End
weave_9 = Weave(Pattern=cls_7.Closed, Stream0=weave_8, Stream1=dispatch_26.ListA, NullGaps=False)
flatten_15 = FlattenTree(Tree=move_24.Geometry, Path="{0}")
Z_25 = UnitZ(Factor=stepover_distance_6)
rouging_toolpaths = Curve(weave_9)
move_25 = Move(Geometry=end_8.Start, Motion=Z_25)  # -> Geometry, Transform
move_26 = Move(Geometry=end_8.End, Motion=Z_25)  # -> Geometry, Transform
item_24 = ListItem(List=weave_9, Index=Slider(0, range=0..100), Wrap=False)
final_roughing_passes = Curve(flatten_15)
nurbs = NurbsCurve(Vertices=[end_8.Start, move_26.Geometry, move_25.Geometry, end_8.End], Degree=3, Periodic=False)  # -> Curve, Length, Domain
pshift_31 = ShiftPaths(Data=nurbs.Curve, Offset=-1)
filter_19 = StreamFilter(Gate=make_flea_jump_transitions_3, Stream0=replace, Stream1=pshift_31)
flatten_16 = FlattenTree(Tree=simplify_22, Path="{0}")
weave_10 = Weave(Pattern=[0, 1], Stream0=finishing_toolpaths_2, Stream1=filter_19, NullGaps=False)
final_roughing_passes_2 = Curve(final_roughing_passes)
rouging_toolpaths_2 = Curve(rouging_toolpaths)
clean_14 = CleanTree(RemoveNulls=True, RemoveInvalid=True, RemoveEmpty=False, Tree=flatten_16)
clean_15 = CleanTree(RemoveNulls=True, RemoveInvalid=True, RemoveEmpty=False, Tree=weave_10)
merge_5 = Merge(Data1=rouging_toolpaths_2, Data2=final_roughing_passes_2)
connected_finishing_toolpaths = Curve(clean_15)
finishing_toolpaths_3 = Curve(clean_14)
rouging_toolpaths_3 = Curve(merge_5)
filter_20 = StreamFilter(Gate=connect_toolpaths_levels_3, Stream0=finishing_toolpaths_3, Stream1=connected_finishing_toolpaths)
finishing_toolpaths_4 = Curve(filter_20)
len_7 = Length(Curve=flatten(finishing_toolpaths_4))  # disabled
ma_3 = MassAddition(Input=len_7)  # -> Result, PartialResults
division_13 = Division(A=ma_3.Result, B=Slider(30, range=0..100))
division_14 = Division(A=division_13, B=Slider(60, range=0..100))
panel_11 = Panel(division_14)
finishing_toolpaths_5 = Curve(finishing_toolpaths_4)
rouging_toolpaths_4 = Curve(rouging_toolpaths_3)
cutout_curves_3 = Curve(cutout_curves)
cutout_depths_2 = Number(cutout_depths)
cutout_curves_4 = ClusterOutput(cutout_curves_3)
cutout_depths_3 = ClusterOutput(cutout_depths_2)
rouging_toolpaths_5 = ClusterOutput(rouging_toolpaths_4)
finishing_toolpaths_6 = ClusterOutput(finishing_toolpaths_5)

# ==== cluster CompileSettings
estimated_job_time = ClusterInput()
plunge_rate = ClusterInput()
spindle_rpm = ClusterInput()
deepest_z = ClusterInput()
ramp_angle = ClusterInput()
ramp_plunges = ClusterInput()
feed_rate = ClusterInput()
pass_depth = ClusterInput()
estimated_job_time_2 = Number(estimated_job_time)
plunge_rate_2 = Number(plunge_rate)
ramp_plunges_2 = Boolean(ramp_plunges)
pass_depth_2 = Number(pass_depth)
feed_rate_2 = Number(feed_rate)
spindle_rpm_2 = Number(spindle_rpm)
ramp_angle_2 = Integer(ramp_angle)
deepest_z_2 = Number(deepest_z)
int = Integer(plunge_rate_2)
int_2 = Integer(estimated_job_time_2)
int_3 = Integer(feed_rate_2)
int_4 = Integer(spindle_rpm_2)
spindle_rpm_3 = Panel(int_4)
join = TextJoin(Text=["Spindle RPM: ", spindle_rpm_3])

# ---- group: Format for settings display
estimated_job_time_3 = Panel(int_2)
feed_rate_3 = Panel(int_3)
plunge_rate_3 = Panel(int)
pass_depth_3 = Panel(pass_depth_2)
ramp_plunges_3 = Panel(ramp_plunges_2)
ramp_angle_3 = Panel(ramp_angle_2)
deepest_point = Panel(deepest_z_2)
join_2 = TextJoin(Text=["Estimated job time: ", estimated_job_time_3, " minutes"])
join_3 = TextJoin(Text=["Feed rate: ", feed_rate_3])
join_4 = TextJoin(Text=["Plunge rate: ", plunge_rate_3])
join_5 = TextJoin(Text=["Pass depth: ", pass_depth_3])
join_6 = TextJoin(Text=["Ramp plunges: ", ramp_plunges_3])
join_7 = TextJoin(Text=["Ramp angle:", ramp_angle_3])
join_8 = TextJoin(Text=["Deepest Z: ", deepest_point])
merge = Merge(
    Data1=join_2,
    Data2=" ",
    Data3=join_3,
    Data4=" ",
    Data5=join_4,
    Data6=" ",
    Data7=join,
    Data8=" ",
    Data9=join_5,
    Data10=" ",
    Data11=join_6,
    Data12=" ",
    Data13=join_7,
    Data14=" ",
    Data15=join_8)
merge_2 = Merge(Data1=join_3, Data2=" ", Data3=join_4, Data4=" ", Data5=join_5, Data6=" ", Data7=join_8, Data8=" ")

# ----
crucial_settings = ClusterOutput(merge_2)
complete_settings = ClusterOutput(merge)

# ==== cluster AutoTabbingEx
width_tabs = ClusterInput()
diameter_bit = ClusterInput()
increase_distance_from_corner = ClusterInput()
minimum_curve_length_for_tabbing = ClusterInput()
curves = ClusterInput()
angle = ClusterInput()  # Angle of curves to consider for placing tabs
curves_2 = Curve(curves)
diameter_bit_2 = Number(diameter_bit)
angle_limit = Number(angle)
width_tabs_2 = Number(width_tabs)
simplify = SimplifyCurve(Curve=curves_2)  # -> Curve, Simplified
increase_distance_from_corner_2 = Number(increase_distance_from_corner)
minimum_curve_length_for_tabbing_2 = Number(minimum_curve_length_for_tabbing)
explode = Explode(Curve=simplify.Curve, Recursive=True)  # -> Segments, Vertices
txt = Text(explode.Segments)
eval = Evaluate(F="Contains (x, \"Line\")", x=txt)
int = Integer(eval)
ma = MassAddition(Input=int)  # -> Result, PartialResults
larger = LargerThan(FirstNumber=ma.Result, SecondNumber="0")  # -> flatten(LargerThan), OrEqualTo
dispatch = Dispatch(List=simplify.Curve, DispatchPattern=larger.LargerThan)  # -> ListA, ListB
crv = Curve(dispatch.ListA)
area = Area(Geometry=crv)  # -> Area, Centroid
incurve = PointInCurve(Point=area.Centroid, Curve=graft(crv))  # -> Relationship, Point
flip = FlipMatrix(Data=incurve.Relationship)
ma_2 = MassAddition(Input=flip)  # -> Result, PartialResults
larger_2 = LargerThan(FirstNumber=ma_2.Result, SecondNumber="2")  # -> flatten(LargerThan), OrEqualTo
dispatch_2 = Dispatch(List=crv, DispatchPattern=larger_2.LargerThan)  # -> ListA, ListB
crv_2 = Curve(dispatch_2.ListB)
explode_2 = Explode(Curve=crv_2, Recursive=True)  # -> Segments, Vertices
vec = VectorXYZ(XComponent=1, YComponent=0, ZComponent=0)  # -> Vector, Length
addition = Addition(A=width_tabs_2, B=diameter_bit_2)
angle_2 = Angle(VectorA=vec.Vector, VectorB=explode_2.Segments)  # -> Angle, Reflex
eval_2 = Evaluate(F="x+y", x=addition, y=increase_distance_from_corner_2)
len = Length(Curve=explode_2.Segments)
deg = Degrees(Radians=angle_2.Angle)
subtraction = Subtraction(A="180", B=angle_limit)
larger_3 = LargerThan(FirstNumber=len, SecondNumber=eval_2)  # -> LargerThan, OrEqualTo
larger_4 = LargerThan(FirstNumber=angle_limit, SecondNumber=deg)  # -> LargerThan, OrEqualTo
larger_5 = LargerThan(FirstNumber=deg, SecondNumber=subtraction)  # -> LargerThan, OrEqualTo
larger_6 = LargerThan(FirstNumber=len, SecondNumber=minimum_curve_length_for_tabbing_2)  # -> LargerThan, OrEqualTo
bbox = BoundingBox(Content=crv_2, Plane=PlaneXY(0, 0, 0))  # -> Box, Box_2
or = GateOr(A=larger_5.LargerThan, B=larger_4.LargerThan)
edges = BrepEdges(Brep=bbox.Box)  # -> Naked, Interior, NonManifold
and = GateAnd(A=or, B=larger_3.LargerThan, C=larger_6.LargerThan)
merge = Merge(Data1=edges.Naked, Data2=edges.Interior)
cull = CullPattern(List=explode_2.Segments, CullPattern=and)
end = EndPoints(Curve=cull)  # -> Start, End
item = ListItem(List=merge, Index="0", Wrap=True)
item_2 = ListItem(List=merge, Index="2", Wrap=True)
end_2 = EndPoints(Curve=item)  # -> Start, End
end_3 = EndPoints(Curve=item_2)  # -> Start, End
pt = Point(end.Start)
pt_2 = Point(end_2.Start)
pt_3 = Point(end_2.End)
pt_4 = Point(end_3.Start)
pt_5 = Point(end_3.End)
dist = Distance(PointA=pt_2, PointB=pt)
dist_2 = Distance(PointA=pt_3, PointB=pt)
dist_3 = Distance(PointA=pt_2, PointB=end.End)
dist_4 = Distance(PointA=pt_3, PointB=end.End)
dist_5 = Distance(PointA=pt_4, PointB=pt)
dist_6 = Distance(PointA=pt_4, PointB=end.End)
dist_7 = Distance(PointA=pt_5, PointB=pt)
dist_8 = Distance(PointA=pt_5, PointB=end.End)
sort = SortList(Keys=dist, ValuesA=cull)  # -> Keys, ValuesA
sort_2 = SortList(Keys=dist_3, ValuesA=cull)  # -> Keys, ValuesA
sort_3 = SortList(Keys=dist_2, ValuesA=cull)  # -> Keys, ValuesA
sort_4 = SortList(Keys=dist_4, ValuesA=cull)  # -> Keys, ValuesA
sort_5 = SortList(Keys=dist_5, ValuesA=cull)  # -> Keys, ValuesA
sort_6 = SortList(Keys=dist_6, ValuesA=cull)  # -> Keys, ValuesA
sort_7 = SortList(Keys=dist_7, ValuesA=cull)  # -> Keys, ValuesA
sort_8 = SortList(Keys=dist_8, ValuesA=cull)  # -> Keys, ValuesA
item_3 = ListItem(List=sort.ValuesA, Index=0, Wrap=True)
item_4 = ListItem(List=sort_3.ValuesA, Index=0, Wrap=True)
item_5 = ListItem(List=sort.Keys, Index=0, Wrap=True)
item_6 = ListItem(List=sort_2.Keys, Index=0, Wrap=True)
item_7 = ListItem(List=sort_3.Keys, Index=0, Wrap=True)
item_8 = ListItem(List=sort_4.Keys, Index=0, Wrap=True)
item_9 = ListItem(List=sort_2.ValuesA, Index=0, Wrap=True)
item_10 = ListItem(List=sort_4.ValuesA, Index=0, Wrap=True)
item_11 = ListItem(List=sort_5.ValuesA, Index=0, Wrap=True)
item_12 = ListItem(List=sort_5.Keys, Index=0, Wrap=True)
item_13 = ListItem(List=sort_6.Keys, Index=0, Wrap=True)
item_14 = ListItem(List=sort_6.ValuesA, Index=0, Wrap=True)
item_15 = ListItem(List=sort_7.ValuesA, Index=0, Wrap=True)
item_16 = ListItem(List=sort_7.Keys, Index=0, Wrap=True)
item_17 = ListItem(List=sort_8.Keys, Index=0, Wrap=True)
item_18 = ListItem(List=sort_8.ValuesA, Index=0, Wrap=True)
larger_7 = LargerThan(FirstNumber=item_5, SecondNumber=item_6)  # -> LargerThan, OrEqualTo
larger_8 = LargerThan(FirstNumber=item_7, SecondNumber=item_8)  # -> LargerThan, OrEqualTo
larger_9 = LargerThan(FirstNumber=item_12, SecondNumber=item_13)  # -> LargerThan, OrEqualTo
larger_10 = LargerThan(FirstNumber=item_16, SecondNumber=item_17)  # -> LargerThan, OrEqualTo
cull_2 = CullPattern(List=item_3, CullPattern=invert(larger_7.LargerThan))
cull_3 = CullPattern(List=item_4, CullPattern=invert(larger_8.LargerThan))
cull_4 = CullPattern(List=item_11, CullPattern=invert(larger_9.LargerThan))
cull_5 = CullPattern(List=item_15, CullPattern=invert(larger_10.LargerThan))
division = Division(A=eval_2, B=2)
division_2 = Division(A=eval_2, B=2)
division_3 = Division(A=eval_2, B=2)
division_4 = Division(A=eval_2, B=2)
cull_6 = CullPattern(List=item_9, CullPattern=larger_7.LargerThan)
cull_7 = CullPattern(List=item_10, CullPattern=larger_8.LargerThan)
cull_8 = CullPattern(List=item_14, CullPattern=larger_9.LargerThan)
cull_9 = CullPattern(List=item_18, CullPattern=larger_10.LargerThan)
eval_3 = EvaluateCurve(Curve=cull_2, Parameter=division)  # -> Point, Tangent, Angle
eval_4 = EvaluateCurve(Curve=cull_3, Parameter=division_2)  # -> Point, Tangent, Angle
eval_5 = EvaluateCurve(Curve=cull_4, Parameter=division_3)  # -> Point, Tangent, Angle
division_5 = Division(A=eval_2, B=2)
division_6 = Division(A=eval_2, B=2)
len_2 = Length(Curve=cull_6)
len_3 = Length(Curve=cull_7)
eval_6 = EvaluateCurve(Curve=cull_5, Parameter=division_4)  # -> Point, Tangent, Angle
division_7 = Division(A=eval_2, B=2)
len_4 = Length(Curve=cull_8)
division_8 = Division(A=eval_2, B=2)
len_5 = Length(Curve=cull_9)
subtraction_2 = Subtraction(A=len_2, B=division_5)
subtraction_3 = Subtraction(A=len_3, B=division_6)
subtraction_4 = Subtraction(A=len_4, B=division_7)
subtraction_5 = Subtraction(A=len_5, B=division_8)
eval_7 = EvaluateCurve(Curve=cull_6, Parameter=subtraction_2)  # -> Point, Tangent, Angle
eval_8 = EvaluateCurve(Curve=cull_7, Parameter=subtraction_3)  # -> Point, Tangent, Angle
eval_9 = EvaluateCurve(Curve=cull_8, Parameter=subtraction_4)  # -> Point, Tangent, Angle
eval_10 = EvaluateCurve(Curve=cull_9, Parameter=subtraction_5)  # -> Point, Tangent, Angle
merge_2 = Merge(Data1=eval_3.Point, Data2=eval_7.Point)
merge_3 = Merge(Data1=eval_4.Point, Data2=eval_8.Point)
merge_4 = Merge(Data1=eval_5.Point, Data2=eval_9.Point)
merge_5 = Merge(Data1=eval_6.Point, Data2=eval_10.Point)
merge_6 = Merge(Data1=merge_2, Data2=merge_3, Data3=merge_4, Data4=merge_5)
clean = CleanTree(RemoveNulls=True, RemoveInvalid=True, RemoveEmpty=False, Tree=merge_6)
flatten = FlattenTree(Tree=clean, Path="{0}")
tab_points = ClusterOutput(flatten)  # point location for tabs. Input into tab maker

# ==== cluster BridgePreview
colour = ClusterInput()
custom_jog_home_x = ClusterInput()
custom_jog_home_y = ClusterInput()
colour_2 = Data(colour)
col = Colour(colour_2)
custom_jog_home_x_2 = Number(custom_jog_home_x)
custom_jog_home_y_2 = Number(custom_jog_home_y)
merge = Merge(Data1=col, Data2=colour_2)
clean = CleanTree(RemoveNulls=True, RemoveInvalid=True, RemoveEmpty=False, Tree=merge)
pt = ConstructPoint(XCoordinate=custom_jog_home_x_2, YCoordinate=custom_jog_home_y_2, ZCoordinate=0)
X = UnitX(Factor=custom_jog_home_x_2)
item = ListItem(List=clean, Index=0, Wrap=True)
cir = Circle(Plane=pt, Radius=35)
rectangle = Rectangle(Plane=pt, XSize=Domain(-130, 400), YSize=Domain(-90, 90), Radius=0)  # -> Rectangle, Length
rectangle_2 = Rectangle(Plane=X, XSize=Domain(150, 270), YSize=Domain(-100, 1350), Radius=0)  # -> Rectangle, Length
merge_2 = Merge(Data1=cir, Data2=rectangle.Rectangle, Data3=rectangle_2.Rectangle, Data4=pt)
preview = CustomPreview(Geometry=merge_2, Shader=item)

# ==== cluster TabMaker: Automatically creates tab boxes along your cutting geometry
diameter_milling_bit = ClusterInput()
cutout_curves = ClusterInput()
width_tabs = ClusterInput()
tolerance = ClusterInput()
cutting_depth = ClusterInput()
height_tabs = ClusterInput()
geo = ClusterInput()
diameter_milling_bit_2 = Number(diameter_milling_bit)
tolerance_2 = Number(tolerance)
cutting_depth_2 = Number(cutting_depth)
geo_2 = Geometry(geo)
cutout_curves_2 = Curve(cutout_curves)
width_tabs_2 = Number(width_tabs)
height_tabs_2 = Number(height_tabs)
clean = CleanTree(RemoveNulls=True, RemoveInvalid=True, RemoveEmpty=False, Tree=geo_2)

# ---- group: Filters points
bbox = BoundingBox(Content=clean, Plane=PlaneXY(0, 0, 0))  # -> Box, Box_2
debox = DeconstructBox(Box=bbox.Box)  # -> Plane, X, Y, Z
num = Number(debox.X)
num_2 = Number(debox.Y)
num_3 = Number(debox.Z)
equals = Equality(FirstNumber="0", SecondNumber=num)  # -> Equality, Inequality
equals_2 = Equality(FirstNumber="0", SecondNumber=num_2)  # -> Equality, Inequality
equals_3 = Equality(FirstNumber="0", SecondNumber=num_3)  # -> Equality, Inequality
and = GateAnd(A=equals.Equality, B=equals_2.Equality, C=equals_3.Equality)
cull = CullPattern(List=clean, CullPattern=and)

# ----
lng = ListLength(List=cull)
crv_cp = CurveClosestPoint(Point=cull, Curve=graft(cutout_curves_2))  # -> Point, Parameter, Distance
lng_2 = ListLength(List=cutout_curves_2)
series = Series(Start=0, Step=1, Count=lng_2)  # -> graft(Series)
dup = DuplicateData(Data=series, Number=lng, Order=True)
flip = FlipMatrix(Data=dup)
flip_2 = FlipMatrix(Data=crv_cp.Distance)
flip_3 = FlipMatrix(Data=crv_cp.Parameter)
sort = SortList(Keys=flip_2, ValuesA=flip, ValuesB=flip_3)  # -> Keys, ValuesA, ValuesB
item = ListItem(List=sort.Keys, Index=0, Wrap=True)
larger = LargerThan(FirstNumber=item, SecondNumber=tolerance_2)  # -> LargerThan, OrEqualTo
item_2 = ListItem(List=sort.ValuesA, Index=0, Wrap=True)
cull_2 = CullPattern(List=item_2, CullPattern=invert(larger.LargerThan))
item_3 = ListItem(List=sort.ValuesB, Index=0, Wrap=True)
cull_3 = CullPattern(List=item_3, CullPattern=invert(larger.LargerThan))
item_4 = ListItem(List=cutout_curves_2, Index=cull_2, Wrap=True)
pframe = PerpFrame(Curve=item_4, Parameter=cull_3)
box = CenterBox(Base=pframe, X=diameter_milling_bit_2, Y=expr("x/2", height_tabs_2), Z=expr("(x/2)+.01", width_tabs_2))
bbox_2 = BoundingBox(Content=box, Plane=PlaneXY(0, 0, 0))  # -> Box, Box_2
debox_2 = DeconstructBox(Box=bbox_2.Box)  # -> Plane, X, Y, Z
num_4 = Number(debox_2.Z)
larger_2 = LargerThan(FirstNumber=num_4, SecondNumber=expr("x+.1", height_tabs_2))  # -> LargerThan, OrEqualTo
division = Division(A=height_tabs_2, B=2)
cull_4 = CullPattern(List=box, CullPattern=invert(larger_2.LargerThan))
cull_5 = CullPattern(List=box, CullPattern=larger_2.LargerThan)
cull_6 = CullPattern(List=pframe, CullPattern=larger_2.LargerThan)
subtraction = Subtraction(A=cutting_depth_2, B=division)
Z = UnitZ(Factor=expr("x+.01", subtraction))
rotate = Rotate(Geometry=cull_5, Angle=1.570796327, Plane=cull_6)  # -> Geometry, Transform
neg = Negative(Value=Z)
merge = Merge(Data1=rotate.Geometry, Data2=cull_4)  # -> simplify(Result)
move = Move(Geometry=merge, Motion=neg)  # -> flatten(Geometry), Transform
sunion = SolidUnion(Breps=move.Geometry)
clean_2 = CleanTree(RemoveNulls=True, RemoveInvalid=True, RemoveEmpty=False, Tree=sunion)
T = ClusterOutput(clean_2)

# ==== cluster Cluster
background_details = Panel("<svg xmlns=\"http://www.w3.org/2000/svg\" version=\"1.1\" width=\"W\" height=\"H\" style=\"background-color:rgb(C)\">")
background_width = ClusterInput()
rep = ReplaceText(Text=background_details, Find="W", BackgroundWidth=background_width, RecursiveReplace=False)
background_height = ClusterInput()
rep_2 = ReplaceText(Text=rep, Find="H", BackgroundHeight=background_height, RecursiveReplace=False)
background_color = ClusterInput()
rep_3 = ReplaceText(Text=rep_2, Find="C", BackgroundColor=background_color, RecursiveReplace=False)
data = ClusterInput()
data_2 = Data(data)
merge = Merge(Data1=rep_3, Data2=data_2, Data3="</svg>")
svg_composer = ClusterOutput(merge)

# ==== cluster Cluster_2
polyline = ClusterInput()
disc = Discontinuity(Polyline=polyline, Level=1)  # -> Points, Parameters
pdecon = Deconstruct(Point=disc.Points)  # -> XComponent, YComponent, ZComponent
background_height = ClusterInput()
polyline_string = Panel("<polyline points=\"C\" stroke=\"rgb(S)\" stroke-width=\"W\" stroke-dasharray=\"A\" fill=\"none\" />")
subtraction = Subtraction(BackgroundHeight=background_height, B=pdecon.YComponent)
concat = Concatenate(FragmentA=pdecon.XComponent, FragmentB=",", FragmentC=subtraction, FragmentD=" ")
join = TextJoin(Text=concat)
stroke_color = ClusterInput()
rep = ReplaceText(Text=polyline_string, Find="C", Replace=join, RecursiveReplace=False)
stroke_width = ClusterInput()
rep_2 = ReplaceText(Text=rep, Find="S", StrokeColor=stroke_color, RecursiveReplace=False)
rep_3 = ReplaceText(Text=rep_2, Find="W", StrokeWidth=stroke_width, RecursiveReplace=False)
stroke_dasharray = ClusterInput()
rep_4 = ReplaceText(Text=rep_3, Find="A", StrokeDasharray=stroke_dasharray, RecursiveReplace=False)
polyline_svg = ClusterOutput(rep_4)

# ==== cluster ConnectOverlappingToolpaths
polyline_toolpaths = ClusterInput()
polyline_toolpaths_2 = Curve(polyline_toolpaths)
clean = CleanTree(RemoveNulls=True, RemoveInvalid=True, RemoveEmpty=False, Tree=polyline_toolpaths_2)
crv = Curve(clean)
cp = ControlPoints(Curve=crv)  # -> Points, Weights, Knots
cp_2 = ControlPoints(Curve=crv)  # -> Points, Weights, Knots
end = EndPoints(Curve=crv)  # -> Start, End
lng = ListLength(List=cp.Points)
pshift = ShiftPaths(Data=cp_2.Points, Offset=-1)
shift = ShiftList(List=end.Start, Shift=1, Wrap=False)
shift_2 = ShiftList(List=end.End, Shift=-1, Wrap=False)
pshift_2 = ShiftPaths(Data=lng, Offset=-1)
pline = PolyLine(Vertices=pshift, Closed=False)
pdecon = Deconstruct(Point=shift)  # -> XComponent, YComponent, ZComponent
pdecon_2 = Deconstruct(Point=shift_2)  # -> XComponent, YComponent, ZComponent
ma = MassAddition(Input=pshift_2)  # -> Result, PartialResults
cp_3 = ControlPoints(Curve=pline)  # -> Points, Weights, Knots
pshift_3 = ShiftPaths(Data=cp_2.Points, Offset=-1)
flatten = FlattenTree(Tree=ma.PartialResults, Path="{0}")
multiplication = Multiplication(A=pdecon.YComponent, B="100")
multiplication_2 = Multiplication(A=pdecon.XComponent, B="100")
multiplication_3 = Multiplication(A=pdecon_2.XComponent, B="100")
multiplication_4 = Multiplication(A=pdecon_2.YComponent, B="100")
lng_2 = ListLength(List=pshift_3)
lng_3 = ListLength(List=cp_3.Points)
int = Integer(multiplication)
int_2 = Integer(multiplication_2)
int_3 = Integer(multiplication_3)
int_4 = Integer(multiplication_4)
smaller = SmallerThan(FirstNumber=lng_3, SecondNumber=lng_2)  # -> SmallerThan, OrEqualTo
division = Division(A=int, B="100")
division_2 = Division(A=int_2, B="100")
division_3 = Division(A=int_3, B="100")
division_4 = Division(A=int_4, B="100")
unreialiable_result_boolean = Panel(smaller.SmallerThan)
equals = Equality(FirstNumber=division_2, SecondNumber=division_3)  # -> Equality, Inequality
equals_2 = Equality(FirstNumber=division, SecondNumber=division_4)  # -> Equality, Inequality
and = GateAnd(A=equals.Equality, B=equals_2.Equality)

# ---- group: Line connection viz for troubleshooting
dispatch = Dispatch(List=shift_2, DispatchPattern=and)  # -> ListA, ListB
dispatch_2 = Dispatch(List=shift, DispatchPattern=and)  # -> ListA, ListB
ln = Line(StartPoint=dispatch_2.ListA, EndPoint=dispatch.ListA)  # disabled

# ----
rev = ReverseList(List=flatten)
rev_2 = ReverseList(List=flatten)
cull_i = CullIndex(List=rev, Indices="0", Wrap=True)
item = ListItem(List=rev, Index="0", Wrap=True)
cull_i_2 = CullIndex(List=rev_2, Indices="0", Wrap=True)
pshift_4 = ShiftPaths(Data=and, Offset=-1)
pshift_5 = ShiftPaths(Data=cull_i, Offset=-1)
pshift_6 = ShiftPaths(Data=cull_i_2, Offset=-1)
lng_4 = ListLength(List=pshift_4)
rev_3 = ReverseList(List=pshift_5)
rev_4 = ReverseList(List=pshift_6)
ins = InsertItems(List=pshift_4, Item=Toggle(False), Indices="0", Wrap=True)
ins_2 = InsertItems(List=pshift_4, Item=Toggle(False), Indices=lng_4, Wrap=True)
subtraction = Subtraction(A=rev_3, B="1")
cp_4 = ControlPoints(Curve=pline)  # -> Points, Weights, Knots
flatten_2 = FlattenTree(Tree=pshift, Path="{0}")
pshift_7 = ShiftPaths(Data=ins, Offset=-1)
merge = Merge(Data1=subtraction, Data2=item)
merge_2 = Merge(Data1="0", Data2=rev_4)
pshift_8 = ShiftPaths(Data=ins_2, Offset=-1)
dispatch_3 = Dispatch(List=merge_2, DispatchPattern=pshift_7)  # -> ListA, ListB
dispatch_4 = Dispatch(List=merge, DispatchPattern=pshift_8)  # -> ListA, ListB
dom = ConstructDomain(DomainStart=dispatch_3.ListB, DomainEnd=dispatch_4.ListB)
subset = SubList(List=flatten_2, Domain=dom, Wrap=False)  # -> List, Index
pline_2 = PolyLine(Vertices=subset.List, Closed=False)
unreialiable_result_boolean_2 = Panel(unreialiable_result_boolean)
flatten_3 = FlattenTree(Tree=pline_2, Path="{0}")
pshift_9 = ShiftPaths(Data=pline_2, Offset=-2)
filter = StreamFilter(Gate=unreialiable_result_boolean_2, Stream0=pshift_9)
item_2 = ListItem(List=flatten_3, Index=0, Wrap=True)
polyline_toolpaths_3 = Curve(polyline_toolpaths_2)
null = NullItem(Item=item_2)  # -> NullFlags, InvalidFlags, Description
filter_2 = StreamFilter(Gate=null.NullFlags, Stream0=flatten_3, Stream1=polyline_toolpaths_3)
z_connected_polyline_toolpaths = Curve(filter_2)
z_connected_polyline_toolpaths_2 = ClusterOutput(z_connected_polyline_toolpaths)

# ==== cluster TabToolpaths
polyline_toolpaths = ClusterInput()
milling_bit_diamter = ClusterInput()
tab_breps = ClusterInput()
tab_cleanup_overshoot_lenght = Panel("1")
tab_breps_2 = Brep(tab_breps)
polyline_toolpaths_2 = Curve(polyline_toolpaths)
milling_bit_diamter_2 = Number(milling_bit_diamter)
flatten = FlattenTree(Tree=tab_breps_2, Path="{0}")
clean = CleanTree(RemoveNulls=True, RemoveInvalid=True, RemoveEmpty=False, Tree=polyline_toolpaths_2)
bbox = BoundingBox(Content=clean, Plane=PlaneXY(0, 0, 0), UnionBox=True)  # -> Box, Box_2

# ---- group: Check if any tab volumes break material surface
bbox_2 = BoundingBox(Content=flatten, Plane=PlaneXY(0, 0, 0))  # -> Box, Box_2
debrep = DeconstructBrep(Brep=bbox_2.Box)  # -> Faces, Edges, Vertices
item = ListItem(List=debrep.Vertices, Index="4", Wrap=True)
pdecon = Deconstruct(Point=item)  # -> XComponent, YComponent, ZComponent
sort = SortList(Keys=flatten(pdecon.ZComponent))  # -> Keys, ValuesA
rev = ReverseList(List=sort.Keys)
item_2 = ListItem(List=rev, Index=0, Wrap=True)
larger = LargerThan(FirstNumber=item_2, SecondNumber="0")  # -> LargerThan, OrEqualTo
make_severed_toolapths = Panel(larger.LargerThan)

# ---- group: Check for input tab breps
item_3 = ListItem(List=flatten, Index=0, Wrap=True)
null = NullItem(Item=item_3)  # -> NullFlags, InvalidFlags, Description
no_tab_brep_input_boolean = Panel(null.NullFlags)

# ----
debrep_2 = DeconstructBrep(Brep=bbox.Box)  # -> Faces, Edges, Vertices
item_4 = ListItem(List=debrep_2.Vertices, Index="0", Wrap=True)
pdecon_2 = Deconstruct(Point=flatten(item_4))  # -> XComponent, YComponent, ZComponent
subtraction = Subtraction(A=pdecon_2.ZComponent, B="0.1")
lowes_toolpath_point = Panel(subtraction)
polyline_toolpaths_3 = Curve(clean)
tab_breps_3 = Brep(flatten)

# ---- group: Bit diameter compensate tab breps (for tab cleanup)
tab_cleanup_overshoot_lenght_2 = Panel(tab_cleanup_overshoot_lenght)
milling_bit_diamter_3 = Number(milling_bit_diamter_2)
tab_breps_4 = Brep(tab_breps_3)
multiplication = Multiplication(A=milling_bit_diamter_3, B="0.5")
debrep_3 = DeconstructBrep(Brep=tab_breps_4)  # -> Faces, Edges, Vertices
bbox_3 = BoundingBox(Content=tab_breps_4, Plane=PlaneXY(0, 0, 0))  # -> Box, Box_2
addition = Addition(A=multiplication, B=tab_cleanup_overshoot_lenght_2)
debrep_4 = DeconstructBrep(Brep=bbox_3.Box)  # -> Faces, Edges, Vertices
planar = IsPlanar(Surface=debrep_3.Faces, Interior=True)  # -> Planar, Plane
deplane = DeconstructPlane(Plane=planar.Plane)  # -> Origin, XAxis, YAxis, ZAxis
lowes_toolpath_point_2 = Panel(lowes_toolpath_point)
pdecon_3 = Deconstruct(Point=deplane.Origin)  # -> XComponent, YComponent, ZComponent
item_5 = ListItem(List=debrep_4.Vertices, Index=4, Wrap=True)
sort_2 = SortList(Keys=pdecon_3.ZComponent, ValuesA=debrep_3.Faces)  # -> Keys, ValuesA
pt = ConstructPoint(XCoordinate=0, YCoordinate=0, ZCoordinate=lowes_toolpath_point_2)
item_6 = ListItem(List=sort_2.ValuesA, Index=0, Wrap=True)
xy = XYPlane(Origin=pt)
edges = BrepEdges(Brep=item_6)  # -> Naked, Interior, NonManifold
cp = PlaneClosestPoint(Point=item_5, Plane=xy)  # -> Point, UVPoint, Distance
pshift = ShiftPaths(Data=edges.Naked, Offset=-1)
join = JoinCurves(Curves=pshift, Preserve=False)
Z = UnitZ(Factor=cp.Distance)
simplify = SimplifyTree(Tree=join, Front=False)
simplify_2 = SimplifyTree(Tree=Z, Front=False)
milling_bit_radius = Panel(addition)
project = Project(Geometry=simplify, Plane=xy)  # -> Geometry, Transform
neg = Negative(Value=milling_bit_radius)
offset = Offset(Curve=project.Geometry, Distance=milling_bit_radius, Plane=PlaneXY(0, 0, 0), Corners=1)
offset_2 = Offset(Curve=project.Geometry, Distance=neg, Plane=PlaneXY(0, 0, 0), Corners=1)
len = Length(Curve=offset)
len_2 = Length(Curve=offset_2)
smaller = SmallerThan(FirstNumber=len, SecondNumber=len_2)  # -> SmallerThan, OrEqualTo
weave = Weave(Pattern=smaller.SmallerThan, Stream0=offset, Stream1=offset_2, NullGaps=False)
extr = Extrude(Base=weave, Direction=simplify_2)
cap = CapHoles(Brep=extr)
bit_diameter_compensated_tab_breps = Brep(flatten(cap))

# ---- group: Bit diameter compensate tab breps
milling_bit_diamter_4 = Number(milling_bit_diamter_2)
tab_breps_5 = Brep(tab_breps_3)
multiplication_2 = Multiplication(A=milling_bit_diamter_4, B="0.5")
debrep_5 = DeconstructBrep(Brep=tab_breps_5)  # -> Faces, Edges, Vertices
bbox_4 = BoundingBox(Content=tab_breps_5, Plane=PlaneXY(0, 0, 0))  # -> Box, Box_2
milling_bit_radius_2 = Panel(multiplication_2)
debrep_6 = DeconstructBrep(Brep=bbox_4.Box)  # -> Faces, Edges, Vertices
planar_2 = IsPlanar(Surface=debrep_5.Faces, Interior=True)  # -> Planar, Plane
deplane_2 = DeconstructPlane(Plane=planar_2.Plane)  # -> Origin, XAxis, YAxis, ZAxis
lowes_toolpath_point_3 = Panel(lowes_toolpath_point)
item_7 = ListItem(List=debrep_6.Vertices, Index=4, Wrap=True)
pdecon_4 = Deconstruct(Point=deplane_2.Origin)  # -> XComponent, YComponent, ZComponent
sort_3 = SortList(Keys=pdecon_4.ZComponent, ValuesA=debrep_5.Faces)  # -> Keys, ValuesA
pt_2 = ConstructPoint(XCoordinate=0, YCoordinate=0, ZCoordinate=lowes_toolpath_point_3)
item_8 = ListItem(List=sort_3.ValuesA, Index=0, Wrap=True)
xy_2 = XYPlane(Origin=pt_2)
edges_2 = BrepEdges(Brep=item_8)  # -> Naked, Interior, NonManifold
cp_2 = PlaneClosestPoint(Point=item_7, Plane=xy_2)  # -> Point, UVPoint, Distance
pshift_2 = ShiftPaths(Data=edges_2.Naked, Offset=-1)
join_2 = JoinCurves(Curves=pshift_2, Preserve=False)
Z_2 = UnitZ(Factor=cp_2.Distance)
simplify_3 = SimplifyTree(Tree=join_2, Front=False)
# FIX BUG: Tabs equal to bit diamter makes offset and select error
simplify_4 = SimplifyTree(Tree=Z_2, Front=False)
milling_bit_radius_3 = Panel(milling_bit_radius_2)
project_2 = Project(Geometry=simplify_3, Plane=xy_2)  # -> Geometry, Transform
neg_2 = Negative(Value=milling_bit_radius_3)
offset_3 = Offset(Curve=project_2.Geometry, Distance=milling_bit_radius_3, Plane=PlaneXY(0, 0, 0), Corners=1)
offset_4 = Offset(Curve=project_2.Geometry, Distance=neg_2, Plane=PlaneXY(0, 0, 0), Corners=1)
len_3 = Length(Curve=offset_3)
len_4 = Length(Curve=offset_4)
smaller_2 = SmallerThan(FirstNumber=len_3, SecondNumber=len_4)  # -> SmallerThan, OrEqualTo
weave_2 = Weave(Pattern=smaller_2.SmallerThan, Stream0=offset_3, Stream1=offset_4, NullGaps=False)
extr_2 = Extrude(Base=weave_2, Direction=simplify_4)
cap_2 = CapHoles(Brep=extr_2)
bit_diameter_compensated_tab_breps_2 = Brep(flatten(cap_2))

# ---- group: Check for invalid boxes
flatten_2 = FlattenTree(Tree=bit_diameter_compensated_tab_breps_2, Path="{0}")
item_9 = ListItem(List=flatten_2, Index=0, Wrap=True)
null_2 = NullItem(Item=item_9)  # -> NullFlags, InvalidFlags, Description
filter = StreamFilter(Gate=null_2.NullFlags, Stream0=bit_diameter_compensated_tab_breps_2, Stream1=tab_breps_3)

flatten_3 = FlattenTree(Tree=bit_diameter_compensated_tab_breps, Path="{0}")
item_10 = ListItem(List=flatten_3, Index=0, Wrap=True)
null_3 = NullItem(Item=item_10)  # -> NullFlags, InvalidFlags, Description
filter_2 = StreamFilter(Gate=null_3.NullFlags, Stream0=bit_diameter_compensated_tab_breps, Stream1=tab_breps_3)

# ----
mesh = MeshBrep(
    Brep=filter_2,
    Settings={GridMaxCount=0, GridMinCount=16, JaggedSeams=False, MaxEdgeLength=0, MinEdgeLength=0.0001, MinTolerance=0, Refine=True, RefineAngle=0, RelativeTolerance=0.65, SimplePlanes=True, Tolerance=0})
mjoin = MeshJoin(Meshes=mesh)
tab_cleanup_volume_mesh = Mesh(mjoin)

make_severed_toolapths_2 = Panel(make_severed_toolapths)
no_tab_brep_input_boolean_2 = Panel(no_tab_brep_input_boolean)
polyline_toolpaths_4 = Curve(clean)

mesh_2 = MeshBrep(
    Brep=filter,
    Settings={GridMaxCount=0, GridMinCount=16, JaggedSeams=False, MaxEdgeLength=0, MinEdgeLength=0.0001, MinTolerance=0, Refine=True, RefineAngle=0, RelativeTolerance=0.65, SimplePlanes=True, Tolerance=0})
mjoin_2 = MeshJoin(Meshes=mesh_2)
tab_volume_mesh = Mesh(mjoin_2)
colom = CollisionOneMany(Collider=tab_volume_mesh, Obstacles=graft(polyline_toolpaths_3))  # -> Collision, Index
pshift_3 = ShiftPaths(Data=colom.Collision, Offset=-1)

tab_or_no_tab_booleans = Integer(pshift_3)

dispatch = Dispatch(List=polyline_toolpaths_3, DispatchPattern=tab_or_no_tab_booleans)  # -> ListA, ListB
toolpaths_without_tabs = Curve(dispatch.ListB)
toolpaths_for_tabbing = Curve(dispatch.ListA)

bbox_5 = BoundingBox(Content=mesh_2, Plane=PlaneXY(0, 0, 0))  # -> Box, Box_2
volume = Volume(Geometry=bbox_5.Box)  # -> Volume, Centroid
xy_3 = XYPlane(Origin=volume.Centroid)
scale_nu = ScaleNU(Geometry=bbox_5.Box, Plane=xy_3, ScaleX="1.01", ScaleY="1.01", ScaleZ=1)  # -> Geometry, Transform
mjoin_3 = MeshJoin(Meshes=scale_nu.Geometry)
tab_control_point_intersect_mesh = Mesh(mjoin_3)

# ---- group: Filter toolpaths entirely inside tabs
toolpaths_without_tabs_2 = Curve(dispatch.ListB)
tab_breps_6 = Brep(filter)
shapein = ShapeInBrep(Brep=tab_breps_6, Shape=toolpaths_without_tabs_2)
lng = ListLength(List=toolpaths_without_tabs_2)
bool = Boolean(shapein)
series = Series(Start=0, Step=1, Count=lng)
dispatch_2 = Dispatch(List=series, DispatchPattern=bool)  # -> ListA, ListB
replace = ReplaceItems(List=toolpaths_without_tabs_2, Indices=dispatch_2.ListB, Wrap=False)
toolpaths_without_tabs_3 = Curve(replace)

# ---- group: Test closing
cls = Closed(Curve=toolpaths_for_tabbing)  # -> Closed, Periodic
graft = GraftTree(Tree=cls.Closed, IncludeEmptyLists=True, IncludeNullItems=True)

# ----
tab_or_no_tab_booleans_2 = Integer(tab_or_no_tab_booleans)
toolpaths_without_tabs_4 = Curve(replace)

# ---- group: Cut toolpaths with extended tab volumes for tab cleanup
tab_cleanup_volume_mesh_2 = Mesh(tab_cleanup_volume_mesh)
mcx = MeshCurve(Mesh=tab_cleanup_volume_mesh_2, Curve=toolpaths_for_tabbing)  # -> Points, Faces

# ----
cullpt = CullDuplicates(Points=mcx.Points, Tolerance="0.01", CullMode=3)  # -> Points, Indices, Valence
pshift_4 = ShiftPaths(Data=cullpt.Points, Offset=-1)

# ---- group: Cut toolpaths with extended tab volumes for tab cleanup (continued)
crv_cp = CurveClosestPoint(Point=pshift_4, Curve=graft(toolpaths_for_tabbing))  # -> Point, Parameter, Distance
shatter = Shatter(Curve=graft(toolpaths_for_tabbing), Parameters=crv_cp.Parameter)
curvepoint = PointOnCurve(shatter, parameter=0.5)
minc = MeshInclusion(Mesh=tab_cleanup_volume_mesh_2, Point=curvepoint, Strict=False)
dispatch_3 = Dispatch(List=shatter, DispatchPattern=minc)  # -> ListA, ListB
tab_cleanup_toolpaths = Curve(dispatch_3.ListA)
toolpath_outside_tabs = Curve(dispatch_3.ListB)

# ----
tab_cleanup_toolpaths_2 = Curve(tab_cleanup_toolpaths)
flatten_4 = FlattenTree(Tree=tab_cleanup_toolpaths_2, Path="{0}")
tab_cleanup_toolpaths_3 = Curve(flatten_4)
tab_cleanup_toolpaths_4 = ClusterOutput(tab_cleanup_toolpaths_3)

# ---- group: Cut toolpaths with tab volumes
tab_volume_mesh_2 = Mesh(tab_volume_mesh)
mcx_2 = MeshCurve(Mesh=tab_volume_mesh_2, Curve=toolpaths_for_tabbing)  # -> Points, Faces

# ----
cullpt_2 = CullDuplicates(Points=mcx_2.Points, Tolerance="0.01", CullMode=3)  # -> Points, Indices, Valence
pshift_5 = ShiftPaths(Data=cullpt_2.Points, Offset=-1)

# ---- group: Cut toolpaths with tab volumes (continued)
crv_cp_2 = CurveClosestPoint(Point=pshift_5, Curve=graft(toolpaths_for_tabbing))  # -> Point, Parameter, Distance
shatter_2 = Shatter(Curve=graft(toolpaths_for_tabbing), Parameters=crv_cp_2.Parameter)
curvepoint_2 = PointOnCurve(shatter_2, parameter=0.5)
minc_2 = MeshInclusion(Mesh=tab_volume_mesh_2, Point=curvepoint_2, Strict=False)
dispatch_4 = Dispatch(List=shatter_2, DispatchPattern=minc_2)  # -> ListA, ListB
toolpaths_inside_tabs = Curve(dispatch_4.ListA)
toolpath_outside_tabs_2 = Curve(dispatch_4.ListB)

# ----
cp_3 = ControlPoints(Curve=toolpaths_inside_tabs)  # -> Points, Weights, Knots
Z_3 = UnitZ(Factor=1)
meshray = MeshRay(Mesh=tab_control_point_intersect_mesh, Point=cp_3.Points, Direction=Z_3)  # -> Point, Hit
pline = PolyLine(Vertices=meshray.Point, Closed=False)
pshift_6 = ShiftPaths(Data=pline, Offset=-1)

weave_3 = Weave(Pattern=minc_2, Stream0=toolpath_outside_tabs_2, Stream1=pshift_6, NullGaps=False)
cp_4 = ControlPoints(Curve=weave_3)  # -> Points, Weights, Knots
pshift_7 = ShiftPaths(Data=cp_4.Points, Offset=-1)
pline_2 = PolyLine(Vertices=pshift_7, Closed=graft)
pshift_8 = ShiftPaths(Data=pline_2, Offset="-2")
toolpath_outside_tabs_3 = Curve(toolpath_outside_tabs_2)
group = Group(Objects=toolpath_outside_tabs_3)

# ---- group: Check
flatten_5 = FlattenTree(Tree=pline_2, Path="{0}")
flatten_6 = FlattenTree(Tree=group, Path="{0}")

# ----
toolpaths_with_tabs = Curve(flatten_5)
pshift_9 = ShiftPaths(Data=group, Offset="-2")
filter_3 = StreamFilter(Gate=make_severed_toolapths_2, Stream0=toolpaths_with_tabs, Stream1=flatten_6)
tabbed_toolpaths = Geometry(filter_3)
weave_4 = Weave(Pattern=tab_or_no_tab_booleans_2, Stream0=toolpaths_without_tabs_4, Stream1=tabbed_toolpaths, NullGaps=False)
ungroup = Ungroup(Group=weave_4)
pshift_10 = ShiftPaths(Data=ungroup, Offset=-1)

polyline_toolpaths_5 = Curve(clean)
end = EndPoints(Curve=pshift_10)  # -> Start, End

end_2 = EndPoints(Curve=polyline_toolpaths_5)  # -> Start, End
crv_cp_3 = CurveClosestPoint(Point=end_2.End, Curve=pshift_10)  # -> Point, Parameter, Distance
pt_3 = Point(end_2.End)

dist = Distance(PointA=end.End, PointB=pt_3)
smaller_3 = SmallerThan(FirstNumber=dist, SecondNumber="0.01")  # -> SmallerThan, OrEqualTo
dispatch_5 = Dispatch(List=crv_cp_3.Parameter, DispatchPattern=smaller_3.SmallerThan)  # -> ListA, ListB
dispatch_6 = Dispatch(List=pshift_10, DispatchPattern=smaller_3.SmallerThan)  # -> ListA, ListB
seam = Seam(Curve=dispatch_6.ListB, Seam=dispatch_5.ListB)
weave_5 = Weave(Pattern=smaller_3.SmallerThan, Stream0=seam, Stream1=dispatch_6.ListA, NullGaps=False)

filter_4 = StreamFilter(Gate=no_tab_brep_input_boolean_2, Stream0=weave_5, Stream1=polyline_toolpaths_4)
clean_2 = CleanTree(RemoveNulls=True, RemoveInvalid=False, RemoveEmpty=False, Tree=filter_4)
flatten_7 = FlattenTree(Tree=clean_2, Path="{0}")
tabbed_toolpaths_2 = Curve(flatten_7)
tabbed_toolpaths_3 = ClusterOutput(tabbed_toolpaths_2)

# ==== cluster RampToolpathPlunges
toolpaths_to_ramp = ClusterInput()
ramp_angle = ClusterInput()
toolpaths_to_ramp_2 = Curve(toolpaths_to_ramp)
ramp_angle_2 = Number(ramp_angle)

# ---- group: Constrain angle input to sane values
ramp_angle_3 = Panel(ramp_angle_2)
minimum_angle = Panel("1")
maximum_angle = Panel("89")
smaller = SmallerThan(FirstNumber=ramp_angle_3, SecondNumber=minimum_angle)  # -> SmallerThan, OrEqualTo
filter = StreamFilter(Gate=smaller.SmallerThan, Stream0=ramp_angle_3, Stream1=minimum_angle)
larger = LargerThan(FirstNumber=filter, SecondNumber=maximum_angle)  # -> LargerThan, OrEqualTo
filter_2 = StreamFilter(Gate=larger.LargerThan, Stream0=filter, Stream1=maximum_angle)

# ----
end = EndPoints(Curve=toolpaths_to_ramp_2)  # -> Start, End
pdecon = Deconstruct(Point=end.Start)  # -> XComponent, YComponent, ZComponent
# Fix values that make angle to create correct angle in case P beeing longer than curve length
abs = Absolute(Value=pdecon.ZComponent)
rad = Radians(Degrees=filter_2)
len = Length(Curve=toolpaths_to_ramp_2)
rtrig = RightTrigonometry(Beta=rad, QLength=abs)  # -> Alpha, Beta, PLength, QLength, RLength
smaller_2 = SmallerThan(FirstNumber=len, SecondNumber=rtrig.PLength)  # -> SmallerThan, OrEqualTo
dispatch = Dispatch(List=len, DispatchPattern=smaller_2.OrEqualTo)  # -> ListA, ListB
dispatch_2 = Dispatch(List=rtrig.PLength, DispatchPattern=smaller_2.OrEqualTo)  # -> ListA, ListB
division = Division(A=dispatch_2.ListA, B=dispatch.ListA)
weave = Weave(Pattern=smaller_2.OrEqualTo, Stream0=dispatch_2.ListB, Stream1=dispatch.ListA, NullGaps=False)

cls = Closed(Curve=toolpaths_to_ramp_2)  # -> Closed, Periodic
dispatch_3 = Dispatch(List=toolpaths_to_ramp_2, DispatchPattern=cls.Closed)  # -> ListA, ListB
flip = FlipCurve(Curve=dispatch_3.ListA)  # -> Curve, Flag
weave_2 = Weave(Pattern=cls.Closed, Stream0=dispatch_3.ListB, Stream1=flip.Curve, NullGaps=False)

round = Round(Number=division)  # -> Nearest, Floor, Ceiling
use_ceiling_or_nearest = Panel(round.Ceiling)
division_2 = Division(A=weave, B="0.1")
dispatch_4 = Dispatch(List=abs, DispatchPattern=smaller_2.OrEqualTo)  # -> ListA, ListB
int = Integer(division_2)
division_3 = Division(A=dispatch_4.ListA, B=round.Nearest)
int_2 = Integer(division_2)
division_4 = Division(A=weave, B=int)
weave_3 = Weave(Pattern=smaller_2.OrEqualTo, Stream0=dispatch_4.ListB, Stream1=division_3, NullGaps=False)
addition = Addition(A=int, B="1")
division_5 = Division(A=weave_3, B=int_2)
series = Series(Start=0, Step=division_4, Count=addition)
series_2 = Series(Start=0, Step=division_5, Count=addition)
eval = EvaluateLength(Curve=graft(weave_2), Length=series, Normalized=False)  # -> Point, Tangent, Parameter
Z = UnitZ(Factor=series_2)
move = Move(Geometry=eval.Point, Motion=Z)  # -> Geometry, Transform

# ---- group: Make ram path points curve at specified angle or steeper
pt = Point(move.Geometry)
graft = GraftTree(Tree=division_5, IncludeEmptyLists=True, IncludeNullItems=True)
pdecon_2 = Deconstruct(Point=pt)  # -> XComponent, YComponent, ZComponent
shift = ShiftList(List=pdecon_2.ZComponent, Shift=1, Wrap=False)
shift_2 = ShiftList(List=pdecon_2.ZComponent, Shift="-1", Wrap=False)
panel = Panel(shift_2)
panel_2 = Panel(shift)
subtraction = Subtraction(A=shift, B=shift_2)
simplify = SimplifyTree(Tree=graft, Front=False)
simplify_2 = SimplifyTree(Tree=subtraction, Front=False)
subtraction_2 = Subtraction(A=simplify_2, B=simplify)
lng = ListLength(List=subtraction_2)
smaller_3 = SmallerThan(FirstNumber=subtraction_2, SecondNumber="0")  # -> SmallerThan, OrEqualTo
dup = DuplicateData(Data="0", Number=lng, Order=True)
simplify_3 = SimplifyTree(Tree=dup, Front=False)
p_n_c = PickNChoose(Pattern=smaller_3.SmallerThan, Stream0=simplify_3, Stream1=subtraction_2)
abs_2 = Absolute(Value=p_n_c)
ma = MassAddition(Input=abs_2)  # -> Result, PartialResults
Z_2 = UnitZ(Factor=ma.PartialResults)
move_2 = Move(Geometry=move.Geometry, Motion=Z_2)  # -> Geometry, Transform
pt_2 = Point(move_2.Geometry)

# ----
pline = PolyLine(Vertices=pt_2, Closed=False)
pshift = ShiftPaths(Data=pline, Offset=-1)
redpline = Reduce(Polyline=pshift, Tolerance="0.02")  # -> Polyline, Reduction
flip_2 = FlipCurve(Curve=redpline.Polyline)  # -> Curve, Flag
first_ramp_curve = Curve(flip_2.Curve)
end_2 = EndPoints(Curve=first_ramp_curve)  # -> Start, End
pdecon_3 = Deconstruct(Point=end_2.Start)  # -> XComponent, YComponent, ZComponent
smaller_4 = SmallerThan(FirstNumber=pdecon_3.ZComponent, SecondNumber="0")  # -> SmallerThan, OrEqualTo

dispatch_5 = Dispatch(List=first_ramp_curve, DispatchPattern=smaller_2.OrEqualTo)  # -> ListA, ListB
end_3 = EndPoints(Curve=dispatch_5.ListA)  # -> Start, End
pdecon_4 = Deconstruct(Point=end_3.End)  # -> XComponent, YComponent, ZComponent
pdecon_5 = Deconstruct(Point=end_3.Start)  # -> XComponent, YComponent, ZComponent
pt_3 = ConstructPoint(XCoordinate=0, YCoordinate=0, ZCoordinate=pdecon_4.ZComponent)
pt_4 = ConstructPoint(XCoordinate=0, YCoordinate=0, ZCoordinate=pdecon_5.ZComponent)
dist = Distance(PointA=pt_4, PointB=pt_3)
series_3 = Series(Start=0, Step=dist, Count=round.Nearest)
Z_3 = UnitZ(Factor=series_3)
move_3 = Move(Geometry=graft(dispatch_5.ListA), Motion=Z_3)  # -> Geometry, Transform

clean = CleanTree(RemoveNulls=True, RemoveInvalid=True, RemoveEmpty=False, Tree=move_3.Geometry)
join = JoinCurves(Curves=move_3.Geometry, Preserve=False)
flip_3 = FlipMatrix(Data=clean)
lng_2 = ListLength(List=join)
dispatch_6 = Dispatch(List=flip_3, DispatchPattern=cls.Closed)  # -> ListA, ListB
larger_2 = LargerThan(FirstNumber=lng_2, SecondNumber="1")  # -> LargerThan, OrEqualTo
flip_4 = FlipMatrix(Data=dispatch_6.ListB)
dispatch_7 = Dispatch(List=join, DispatchPattern=larger_2.LargerThan)  # -> ListA, ListB
simplify_4 = SimplifyTree(Tree=dispatch_7.ListA, Front=False)
dispatch_8 = Dispatch(List=flip_4, DispatchPattern=[True, False])  # -> ListA, ListB
flatten = FlattenTree(Tree=dispatch_7.ListB, Path="{0}")
dispatch_9 = Dispatch(List=simplify_4, DispatchPattern=[True, False])  # -> ListA, ListB
crv = Curve(dispatch_9.ListB)
bbox = BoundingBox(Content=dispatch_9.ListB, Plane=PlaneXY(0, 0, 0))  # -> Box, Box_2
xy = XYPlane(Origin=Point(0, 0, 0))
cp = ControlPoints(Curve=dispatch_8.ListB)  # -> Points, Weights, Knots
x_tremez = Extremes(Curve=crv, Plane=xy)  # -> Highest, Lowest
cp_2 = ControlPoints(Curve=dispatch_9.ListB)  # -> Points, Weights, Knots; disabled
pshift_2 = ShiftPaths(Data=bbox.Box, Offset=-1)
pdecon_6 = Deconstruct(Point=cp.Points)  # -> XComponent, YComponent, ZComponent
ln = Line(StartPoint=x_tremez.Highest, EndPoint=x_tremez.Lowest)
debrep = DeconstructBrep(Brep=pshift_2)  # -> Faces, Edges, Vertices
rev = ReverseList(List=pdecon_6.ZComponent)
pdecon_7 = Deconstruct(Point=cp_2.Points)  # -> XComponent, YComponent, ZComponent
pt_5 = ConstructPoint(XCoordinate=pdecon_6.XComponent, YCoordinate=pdecon_6.YComponent, ZCoordinate=rev)
item = ListItem(List=debrep.Edges, Index="8", Wrap=True)
rev_2 = ReverseList(List=pdecon_7.ZComponent)
eval_2 = EvaluateLength(Curve=ln, Length="0.5", Normalized=True)  # -> Point, Tangent, Parameter
pline_2 = PolyLine(Vertices=pt_5, Closed=False)
pt_6 = ConstructPoint(XCoordinate=pdecon_7.XComponent, YCoordinate=pdecon_7.YComponent, ZCoordinate=rev_2)
pshift_3 = ShiftPaths(Data=eval_2.Point, Offset=-1)  # disabled
pshift_4 = ShiftPaths(Data=pline_2, Offset=-1)
pline_3 = PolyLine(Vertices=pt_6, Closed=False)
xy_2 = XYPlane(Origin=eval_2.Point)
flip_5 = FlipCurve(Curve=pshift_4)  # -> Curve, Flag
pshift_5 = ShiftPaths(Data=pline_3, Offset=-1)
mirror = Mirror(Geometry=crv, Plane=xy_2)  # -> Geometry, Transform
weave_4 = Weave(Pattern=[0, 1], Stream0=dispatch_8.ListA, Stream1=flip_5.Curve, NullGaps=False)
flip_6 = FlipCurve(Curve=pshift_5)  # -> Curve, Flag
flip_7 = FlipMatrix(Data=weave_4)
flip_8 = FlipCurve(Curve=mirror.Geometry)  # -> Curve, Flag
weave_5 = Weave(Pattern=[0, 1], Stream0=dispatch_9.ListA, Stream1=flip_8.Curve, NullGaps=False)
weave_6 = Weave(Pattern=cls.Closed, Stream0=flip_7, Stream1=dispatch_6.ListA, NullGaps=False)
join_2 = JoinCurves(Curves=weave_5, Preserve=False)
flip_9 = FlipMatrix(Data=weave_6)
simplify_5 = SimplifyTree(Tree=join_2, Front=False)
join_3 = JoinCurves(Curves=flip_9, Preserve=False)
number_slider = Slider(4, range=0..10)
weave_7 = Weave(Pattern=flatten(larger_2.LargerThan), Stream0=flatten(flatten), Stream1=flatten(simplify_5), NullGaps=False)
pshift_6 = ShiftPaths(Data=join_3, Offset=-1)
pshift_7 = ShiftPaths(Data=pshift_6, Offset=-1)
weave_8 = Weave(Pattern=smaller_2.OrEqualTo, Stream0=dispatch_5.ListB, Stream1=weave_7, NullGaps=False)
item_2 = ListItem(List=toolpaths_to_ramp_2, Index=number_slider, Wrap=True)
item_3 = ListItem(List=weave_8, Index=number_slider, Wrap=True)
weave_9 = Weave(Pattern=[0, 1], Stream0=weave_8, Stream1=toolpaths_to_ramp_2, NullGaps=False)
join_4 = JoinCurves(Curves=weave_9, Preserve=Toggle(True))  # disabled
ramped_toolpaths = Curve(weave_9)

# ---- group: Trim ramps that go aboce zero plane
ramped_toolpaths_2 = Curve(reparameterize(ramped_toolpaths))
xy_3 = XYPlane(Origin=Point(0, 0, 0))
pcx = CurvePlane(Curve=ramped_toolpaths_2, Plane=xy_3)  # -> Points, ParamsC, ParamsP
lng_3 = ListLength(List=pcx.ParamsC)
larger_3 = LargerThan(FirstNumber=lng_3, SecondNumber="0")  # -> LargerThan, OrEqualTo
int_3 = Integer(larger_3.LargerThan)
p_n_c_2 = PickNChoose(Pattern=larger_3.LargerThan, Stream0=int_3, Stream1=pcx.ParamsC)
shatter = Shatter(Curve=graft(ramped_toolpaths_2), Parameters=p_n_c_2)
eval_3 = EvaluateLength(Curve=shatter, Length="0.5", Normalized=True)  # -> Point, Tangent, Parameter
pdecon_8 = Deconstruct(Point=eval_3.Point)  # -> XComponent, YComponent, ZComponent
larger_4 = LargerThan(FirstNumber=pdecon_8.ZComponent, SecondNumber="0")  # -> LargerThan, OrEqualTo
dispatch_10 = Dispatch(List=shatter, DispatchPattern=larger_4.LargerThan)  # -> ListA, ListB
pshift_8 = ShiftPaths(Data=dispatch_10.ListB, Offset=-1)
pshift_9 = ShiftPaths(Data=pshift_8, Offset=-1)
ramped_toolpaths_3 = Curve(pshift_9)

# ----
panel_3 = Panel(pcx.ParamsC)
ramped_toolpaths_4 = ClusterOutput(ramped_toolpaths_3)

# ==== cluster Cutout_2
use_climb_direction = ClusterInput()
use_inside_cutting = ClusterInput()
curves_for_cutout = ClusterInput()
cutout_tolerance = ClusterInput()
tool_diameter = ClusterInput()
pass_depth = ClusterInput()
cut_depth = ClusterInput()
use_climb_direction_2 = Integer(use_climb_direction)
use_inside_cutting_2 = Integer(use_inside_cutting)
curves_for_cutout_2 = Curve(curves_for_cutout)
cutout_tolerance_2 = Number(cutout_tolerance)
tool_diameter_2 = Number(tool_diameter)
pass_depth_2 = Number(pass_depth)
cut_depth_2 = Number(cut_depth)
tool_diameter_3 = Panel(tool_diameter_2)
use_climb_direction_3 = Panel(use_climb_direction_2)
use_inside_cutting_3 = Panel(use_inside_cutting_2)

# ---- group: Filter out open curves
curves_for_cutout_3 = Curve(curves_for_cutout_2)
cls = Closed(Curve=curves_for_cutout_3)  # -> Closed, Periodic
dispatch = Dispatch(List=curves_for_cutout_3, DispatchPattern=cls.Closed)  # -> ListA, ListB

# ----
xy = XYPlane(Origin=Point(0, 0, 0))
operation_plane = Plane(xy)
multiplication = Multiplication(A=tool_diameter_3, B="0.5")
cutout_tolerance_3 = Panel(cutout_tolerance_2)
tool_radius = Panel(multiplication)

explode = Explode(Curve=dispatch.ListA, Recursive=True)  # -> Segments, Vertices
join = JoinCurves(Curves=explode.Segments, Preserve=False)
flatten = FlattenTree(Tree=join, Path="{0}")

addition = Addition(A=tool_radius, B=cutout_tolerance_3)
compensated_tool_radius = Panel(addition)

# ---- group: Merge overlapping curves
curves_for_merging_overlap = Curve(flatten)
mcx = MultipleCurves(Curves=curves_for_merging_overlap)  # -> Points, IndexA, IndexB, ParamA, ParamB
dcon = DeleteConsecutive(Set=[mcx.IndexA, mcx.IndexB], Wrap=False)  # -> Set, Count
item = ListItem(List=curves_for_merging_overlap, Index=dcon.Set, Wrap=True)
cull_i = CullIndex(List=curves_for_merging_overlap, Indices=dcon.Set, Wrap=True)
runion = RegionUnion(Curves=item, Plane=operation_plane)
merged_overlapping_curves = Curve([runion, cull_i])

# ----
use_inside_cutting_4 = Panel(use_inside_cutting_3)
operation_plane_2 = Plane(operation_plane)
neg = Negative(Value=compensated_tool_radius)
pass_depth_3 = Number(pass_depth_2)
cut_depth_3 = Number(cut_depth_2)

# ---- group: Align curve directions
curves_for_aligned_direction = Curve(merged_overlapping_curves)
graft = GraftTree(Tree=curves_for_aligned_direction, IncludeEmptyLists=True, IncludeNullItems=True)
offset = Offset(Curve=graft, Distance="0.01", Plane=PlaneXY(0, 0, 0), Corners=2)
end = EndPoints(Curve=offset)  # -> Start, End
pshift = ShiftPaths(Data=end.Start, Offset=-1)
incurve = PointInCurve(Point=pshift, Curve=graft)  # -> Relationship, Point
multiplication_2 = Multiplication(A=incurve.Relationship, B="0.5")
round = Round(Number=multiplication_2)  # -> Nearest, Floor, Ceiling
crv = Curve(graft)
int = Integer(round.Nearest)
flip = FlipCurve(Curve=crv)  # -> Curve, Flag
weave = Weave(Pattern=int, Stream0=flip.Curve, Stream1=crv, NullGaps=False)
pshift_2 = ShiftPaths(Data=weave, Offset=-1)

# ----
flip_2 = FlipCurve(Curve=pshift_2)  # -> Curve, Flag
filter = StreamFilter(Gate=use_inside_cutting_4, Stream0=pshift_2, Stream1=flip_2.Curve)

# ---- group: Align curve directions (continued)
aligned_curves = Curve(filter)

# ---- group: Detect curves inside curves
aligned_curves_2 = Curve(aligned_curves)
graft_2 = GraftTree(Tree=aligned_curves_2, IncludeEmptyLists=True, IncludeNullItems=True)
end_2 = EndPoints(Curve=aligned_curves_2)  # -> Start, End
incurve_2 = PointInCurve(Point=end_2.Start, Curve=graft_2)  # -> Relationship, Point
multiplication_3 = Multiplication(A=incurve_2.Relationship, B="0.5")
round_2 = Round(Number=multiplication_3)  # -> Nearest, Floor, Ceiling
int_2 = Integer(round_2.Floor)
flip_3 = FlipMatrix(Data=int_2)
ma = MassAddition(Input=flip_3)  # -> Result, PartialResults
pshift_3 = ShiftPaths(Data=ma.Result, Offset=-1)
dispatch_2 = Dispatch(List=aligned_curves_2, DispatchPattern=pshift_3)  # -> ListA, ListB
curves_outside = Curve(dispatch_2.ListB)
curves_inside = Curve(dispatch_2.ListA)

# ----
curves_for_offset_outwards = Curve(curves_outside)
curves_for_offset_inwards = Curve(curves_inside)
offset_2 = Offset(Curve=curves_for_offset_outwards, Distance=neg, Plane=operation_plane_2, Corners=2)
offset_3 = Offset(Curve=curves_for_offset_inwards, Distance=compensated_tool_radius, Plane=operation_plane_2, Corners=2)
pshift_4 = ShiftPaths(Data=offset_3, Offset=-1)
pshift_5 = ShiftPaths(Data=offset_2, Offset=-1)
flip_4 = FlipCurve(Curve=pshift_4)  # -> Curve, Flag
outside_cutout_curves = Curve(pshift_5)
inside_cutout_curves = Curve(flip_4.Curve)

outside_cutout_curves_2 = Curve(outside_cutout_curves)
inside_cutout_curves_2 = Curve(inside_cutout_curves)
inside_outline_curves = Curve(inside_cutout_curves_2)
flatten_2 = FlattenTree(Tree=outside_cutout_curves_2, Path="{0}")
end_3 = EndPoints(Curve=inside_outline_curves)  # -> Start, End
incurves = PointInCurves(Point=end_3.Start, Curves=flatten_2)  # -> Relationship, Index, Point
addition_2 = Addition(A=incurves.Index, B="1")
ins = InsertItems(List=flatten_2, Item=inside_outline_curves, Indices=incurves.Index, Wrap=True)

# ---- group: Flip curves for climb direction
sorted_inside_and_outside_curves = Curve(ins)
use_climb_direction_4 = Panel(use_climb_direction_3)
flip_5 = FlipCurve(Curve=sorted_inside_and_outside_curves)  # -> Curve, Flag
filter_2 = StreamFilter(Gate=use_climb_direction_4, Stream0=flip_5.Curve, Stream1=sorted_inside_and_outside_curves)
sorted_inside_and_outside_curves_2 = Curve(filter_2)

# ---- group: Move cutout toolpaths to cut depths
sorted_inside_and_outside_curves_3 = Curve(sorted_inside_and_outside_curves_2)
pass_depth_4 = Panel(pass_depth_3)
cut_depth_cutout = Panel(cut_depth_3)
division = Division(A=cut_depth_cutout, B=pass_depth_4)
graft_3 = GraftTree(Tree=sorted_inside_and_outside_curves_3, IncludeEmptyLists=True, IncludeNullItems=True)
round_3 = Round(Number=division)  # -> Nearest, Floor, Ceiling
division_2 = Division(A=cut_depth_cutout, B=round_3.Ceiling)
actual_pass_depth = Panel(division_2)
series = Series(Start=actual_pass_depth, Step=actual_pass_depth, Count=round_3.Ceiling)
neg_2 = Negative(Value=series)
Z = UnitZ(Factor=neg_2)
simplify = SimplifyTree(Tree=graft_3, Front=False)
simplify_2 = SimplifyTree(Tree=Z, Front=False)
move = Move(Geometry=simplify, Motion=simplify_2)  # -> Geometry, Transform
flatten_3 = FlattenTree(Tree=move.Geometry, Path="{0}")

# ----
cutout_toolpaths = Curve(flatten_3)
cutout_toolpaths_2 = ClusterOutput(cutout_toolpaths)

# ==== cluster DivideCurveEvenLenght: Calculates approximate curve length for even division
crv = ClusterInput()
crv_2 = Curve(crv)
B = ClusterInput()
len = Length(Curve=crv_2)
division = Division(A=len, B=B)
int = Integer(division)
divide = DivideCurve(Curve=crv_2, Count=int, Kinks=False)  # -> Points, Tangents, Parameters
P = ClusterOutput(divide.Points)

# ==== cluster SafeOffsetCurve: Always makes closed non intersecting curves from offset. Can handle extreme offset values.
curves_to_offset = ClusterInput()
offset_amount = ClusterInput()
curves_to_offset_2 = Curve(curves_to_offset)
offset_amount_2 = Number(offset_amount)
multiplication = Multiplication(A=offset_amount_2, B=Slider(0.05, range=0..1))
multiplication_2 = Multiplication(A=offset_amount_2, B=Slider(0.1, range=0..1))
curve_reduction_tolerance = Number(multiplication)
offset_fix_sample_distance = Number(multiplication_2)
topoly = CurveToPolyline(Curve=curves_to_offset_2, ToleranceDistance=curve_reduction_tolerance, ToleranceAngle=0)  # -> Polyline, Segments
neg = Negative(Value=offset_amount_2)
graft = GraftTree(Tree=topoly.Polyline, IncludeEmptyLists=True, IncludeNullItems=True)
num = Number([offset_amount_2, neg])
offset_l = OffsetLoose(Curve=graft, Distance=num)
crv = Curve(offset_l)
cp = ControlPoints(Curve=crv)  # -> Points, Weights, Knots
hull = ConvexHull(Points=cp.Points, Plane=PlaneXY(0, 0, 0))  # -> Hull, HullZ, Indices
number_slider = Slider(500, range=0..10000)
len = Length(Curve=hull.Hull)
division = Division(A=len, B=offset_fix_sample_distance)
int = Integer(division)
larger = LargerThan(FirstNumber=int, SecondNumber=number_slider)  # -> LargerThan, OrEqualTo
filter = StreamFilter(Gate=larger.LargerThan, Stream0=int, Stream1=number_slider)
pframes = PerpFrames(Curve=hull.Hull, Count=filter, Align=True)  # -> Frames, Parameters
deplane = DeconstructPlane(Plane=pframes.Frames)  # -> Origin, XAxis, YAxis, ZAxis
pcx = CurvePlane(Curve=graft(crv), Plane=pframes.Frames)  # -> Points, ParamsC, ParamsP
dist = Distance(PointA=graft(deplane.Origin), PointB=pcx.Points)
sort = SortList(Keys=dist, ValuesA=pcx.Points)  # -> Keys, ValuesA
item = ListItem(List=sort.ValuesA, Index=0, Wrap=True)
pshift = ShiftPaths(Data=item, Offset=-1)
pline = PolyLine(Vertices=pshift, Closed=True)
pshift_2 = ShiftPaths(Data=pline, Offset=2)
flip = FlipMatrix(Data=pshift_2)
len_2 = Length(Curve=flip)
sort_2 = SortList(Keys=len_2, ValuesA=flip)  # -> Keys, ValuesA
rev = ReverseList(List=sort_2.ValuesA)
curve_reduction_tolerance_2 = Number(curve_reduction_tolerance)
item_2 = ListItem(List=sort_2.ValuesA, Index=0, Wrap=True)
item_3 = ListItem(List=rev, Index=0, Wrap=True)
redpline = Reduce(Polyline=item_3, Tolerance=curve_reduction_tolerance_2)  # -> Polyline, Reduction
redpline_2 = Reduce(Polyline=item_2, Tolerance=curve_reduction_tolerance_2)  # -> Polyline, Reduction
flip_2 = FlipCurve(Curve=redpline_2.Polyline)  # -> Curve, Flag
error_corrected_curves_outside = Curve(redpline.Polyline)
error_corrected_curves_inside = Curve(flip_2.Curve)
error_corrected_curves_outside_2 = ClusterOutput(error_corrected_curves_outside)
error_corrected_curves_inside_2 = ClusterOutput(error_corrected_curves_inside)
