# Grasshopper definition Bark beetle - SLA 3D print.gh (Grasshopper 0.9.76)
# plug-ins: setFlounderCamera

number_slider = Slider(800, range=0..1000)
projected_image_width_mm = Panel("96")
projector_reolution_width_px = Panel("1920")
division = Division(A=projected_image_width_mm, B=projector_reolution_width_px)
multiplication = Multiplication(A=division, B=Slider(1080, range=0..10000))
multiplication_2 = Multiplication(A=division, B=Slider(800, range=0..1000))
panel = Panel(multiplication)
panel_2 = Panel(multiplication_2)
multiplication_3 = Multiplication(A=division, B="1000")
size_of_pixel_micron = Panel(multiplication_3)
overhang_degree_threshold = Slider(70, range=5..90)
support_spacing_distance = Slider(3, range=2..10)
# fix - slice objects true triggers camera to be set to 1:1 location
support_diameter = Slider(0.8, range=0.4..2)
sample_reolution = Slider(0.5, range=0..1)
edge_fade_distnce = Slider(4, range=0..100)
layer_height = Slider(0.05, range=0.05..0.2)
camera_height_factor = Slider(2.248, range=1.6..2.3)
_3d_view_rotation_z = Slider(57, range=10..170)
_3d_view_rotation = Slider(0, range=0..360)
# 1:1 AR
cycle_view = Button()
button = Button()  # "2D/3D"

# ---- group: SLA slice settings
camera_distance_79_for_50_micron = Panel("79")
layer_height_2 = Panel(layer_height)
gradient_sample_resolution = Panel(sample_reolution)
edge_fade_count = Panel(edge_fade_distnce)

# ---- group: SLA support settings
support_start_height = Panel("5.4")
support_spacing_distance_2 = Panel(support_spacing_distance)
support_diameter_2 = Panel(support_diameter)
overhang_degree_threshold_2 = Panel(overhang_degree_threshold)
foundation_plate_thickness = Panel("0.5")
release_tab_length = Panel("5")
release_tab_angle = Panel("30")

# ---- group: SLA 3D print input geometry
# Developed by Jens Dyvik / Fellesverkstedet
# 
# License: Creative Commons Attribution ShareAllike (cc-by-sa)
pipeline = GeometryPipeline(
    GroupByLayer=False,
    GroupByType=False,
    IncludeHidden=True,
    IncludeLocked=True,
    LayerFilter="SLA 3D print",
    NameFilter="*",
    TypeFilter=1073741848)
# 3D SLA
pipeline_2 = GeometryPipeline(
    GroupByLayer=False,
    GroupByType=False,
    IncludeHidden=True,
    IncludeLocked=True,
    LayerFilter="SLA 3D print",
    NameFilter="*",
    TypeFilter=32)

# ----
laser_and_cnc_bed = Curve(<curve referenced from the Rhino model>)
sla_3d_print_bed = Curve(<curve referenced from the Rhino model>)
fff_3d_print_bed = Curve(<curve referenced from the Rhino model>)
Y = UnitY(Factor=Slider(63, range=50..450))
Y_2 = UnitY(Factor=Slider(11, range=0..450))
Y_3 = UnitY(Factor=Slider(391, range=350..450))
move = Move(Geometry=fff_3d_print_bed, Motion=Y)  # -> Geometry, Transform
move_2 = Move(Geometry=sla_3d_print_bed, Motion=Y_2)  # -> Geometry, Transform
move_3 = Move(Geometry=laser_and_cnc_bed, Motion=Y_3)  # -> Geometry, Transform
area = Area(Geometry=flatten(sla_3d_print_bed))  # -> Area, Centroid
area_2 = Area(Geometry=flatten(move_3.Geometry))  # -> Area, Centroid
dim = Dimensions(Surface=flatten(move_3.Geometry))  # -> UDimension, VDimension
area_3 = Area(Geometry=flatten(move.Geometry))  # -> Area, Centroid
dim_2 = Dimensions(Surface=flatten(move.Geometry))  # -> UDimension, VDimension
area_4 = Area(Geometry=flatten(move_2.Geometry))  # -> Area, Centroid
dim_3 = Dimensions(Surface=flatten(move_2.Geometry))  # -> UDimension, VDimension
center_point_of_sla_bed = Point(area.Centroid)
multiplication_4 = Multiplication(A=dim.VDimension, B=camera_height_factor)
multiplication_5 = Multiplication(A=dim_3.VDimension, B=camera_height_factor)
multiplication_6 = Multiplication(A=dim_2.VDimension, B=camera_height_factor)
Z = UnitZ(Factor=multiplication_4)
Z_2 = UnitZ(Factor=multiplication_5)
Z_3 = UnitZ(Factor=multiplication_6)
move_4 = Move(Geometry=area_2.Centroid, Motion=Z)  # -> Geometry, Transform
move_5 = Move(Geometry=area_4.Centroid, Motion=Z_2)  # -> Geometry, Transform
move_6 = Move(Geometry=area_3.Centroid, Motion=Z_3)  # -> Geometry, Transform

center_point_of_sla_bed_2 = Point(center_point_of_sla_bed)
smooth = SettingsQuality()
mesh = Mesh(pipeline_2)
mesh_2 = MeshBrep(Brep=pipeline, Settings=smooth)
mjoin = MeshJoin(Meshes=flatten([mesh_2, mesh]))
Y_4 = UnitY(Factor=1)
num = Number(_3d_view_rotation)
Y_5 = UnitY(Factor=1)
up_vector_render_sla = Vector(Y_5)
support_diameter_3 = Panel(support_diameter_2)
support_diameter_4 = Panel(support_diameter_2)
multiplication_7 = Multiplication(A=support_diameter_4, B="1.5")

# ---- group: Create support tip
pt = ConstructPoint(XCoordinate=0, YCoordinate=0, ZCoordinate=multiplication_7)
pt_2 = ConstructPoint(XCoordinate=0, YCoordinate=0, ZCoordinate=0)
ln = Line(StartPoint=pt_2, EndPoint=pt)
multiplication_8 = Multiplication(A=support_diameter_4, B="0.25")
multiplication_9 = Multiplication(A=support_diameter_4, B="0.5")
panel_3 = Panel("""0
1""")
vpipe = PipeVariable(Curve=ln, Parameters=panel_3, Radii=[multiplication_8, multiplication_9], Caps="2")
custom_mesh_settings = SettingsCustom(
    StitchSeams=True,
    SimplePlanes=False,
    Refine=True,
    MinCount=16,
    MaxCount=400,
    AspectRatio=20,
    MaxDistance=0,
    MaxAngle=20,
    MinEdge="0.1",
    MaxEdge=0)
mesh_3 = MeshBrep(Brep=vpipe, Settings=custom_mesh_settings)
support_tip_mesh = Mesh(mesh_3)

# ----
mesh_for_sla_print = Mesh(mjoin)
render_distance_from_workspace = Slider(10000, range=0..10000)
number_slider_2 = Slider(0.01, range=0..0.1)
center_point_of_sla_bed_3 = Point(center_point_of_sla_bed_2)
pdecon = Deconstruct(Point=center_point_of_sla_bed_3)  # -> XComponent, YComponent, ZComponent
material = CreateMaterial(
    Diffuse=ColourSwatch(SwatchColor=RGB(33, 108, 112)),
    Specular=RGB(255, 255, 255),
    Emission=RGB(0, 0, 0),
    Transparency=0,
    Shine=Slider(70, range=0..100))
neg = Negative(Value=render_distance_from_workspace)
number_slider_3 = Slider(1000, range=0..1000)
Z_4 = UnitZ(Factor=1)
Y_6 = UnitY(Factor=neg)
neg_2 = Negative(Value=Z_4)
neg_3 = Negative(Value=number_slider_3)
dom = ConstructDomain(DomainStart=neg_3, DomainEnd=number_slider_3)
swatch = ColourSwatch(SwatchColor=RGB(0, 0, 0))
material_2 = CreateMaterial(Diffuse=swatch, Specular=swatch, Emission=swatch, Transparency=0, Shine=0)

# ---- group: SLA export slider
# How to render SLA slices:: -Set Render slice to "True"
# 
# -Rigth click Curent slice slider and choose "Animate..."
# 
# -Make file name extension .png
# 
# -Choose correct viewport name (Default Fellesverkstedet)
# 
# -Fill in correct number of slices in frame count
# 
# -Click OK
current_slice = Slider(0.71172, range=0..1)
generate_suport = BooleanToggle(True)
render_slice = BooleanToggle(True)

# ----
filter = StreamFilter(Gate=generate_suport, Stream1=mjoin)

mesh_for_sla_print_2 = Mesh(filter)
bbox = BoundingBox(Content=mesh_for_sla_print_2, Plane=PlaneXY(0, 0, 0), UnionBox=True)  # -> Box, Box_2
debrep = DeconstructBrep(Brep=bbox.Box)  # -> Faces, Edges, Vertices
support_start_height_2 = Panel(support_start_height)
support_spacing_distance_3 = Panel(support_spacing_distance_2)
item = ListItem(List=debrep.Faces, Index="10", Wrap=True)
neg_4 = Negative(Value=support_start_height_2)
area_5 = Area(Geometry=item)  # -> Area, Centroid
xy = XYPlane(Origin=area_5.Centroid)
Z_5 = UnitZ(Factor=neg_4)
move_7 = Move(Geometry=xy, Motion=Z_5)  # -> Geometry, Transform
build_platform_plane = Plane(move_7.Geometry)
mshadow = MeshShadow(Mesh=mesh_for_sla_print_2, Light=Vector(0, 0, -1), Plane=build_platform_plane)
divide_curve_even_lenght = DivideCurveEvenLenght(crv=mshadow, B=support_spacing_distance_3)
pline = PolyLine(Vertices=divide_curve_even_lenght, Closed=Toggle(True))

# ---- group: Align curve directions
curves_for_aligned_direction = Curve(pline)
graft = GraftTree(Tree=curves_for_aligned_direction, IncludeEmptyLists=True, IncludeNullItems=True)
offset = Offset(Curve=graft, Distance="0.01", Plane=PlaneXY(0, 0, 0), Corners=2)
end = EndPoints(Curve=offset)  # -> Start, End
pshift = ShiftPaths(Data=end.Start, Offset=-1)
incurve = PointInCurve(Point=pshift, Curve=graft)  # -> Relationship, Point
multiplication_10 = Multiplication(A=incurve.Relationship, B="0.5")
round = Round(Number=multiplication_10)  # -> Nearest, Floor, Ceiling
crv = Curve(graft)
int = Integer(round.Nearest)
flip = FlipCurve(Curve=crv)  # -> Curve, Flag
weave = Weave(Pattern=int, Stream0=flip.Curve, Stream1=crv, NullGaps=False)
pshift_2 = ShiftPaths(Data=weave, Offset=-1)
aligned_curves = Curve(pshift_2)

# ----
render_slice_boolean = Boolean(render_slice)

# ---- group: Generate support points on lowes location on model
layer_height_3 = Panel(layer_height_2)
support_start_height_3 = Panel(support_start_height_2)
support_spacing_distance_4 = Panel(support_spacing_distance_3)
build_platform_plane_2 = Plane(build_platform_plane)
mesh_for_sla_print_3 = Mesh(filter)
multiplication_11 = Multiplication(A=layer_height_3, B="0.1")
offset_2 = Offset(Curve=aligned_curves, Distance=multiplication_11, Plane=PlaneXY(0, 0, 0), Corners=1)
boundary = BoundarySurfaces(Edges=offset_2)
mesh_4 = MeshBrep(
    Brep=boundary,
    Settings={GridMaxCount=0, GridMinCount=16, JaggedSeams=False, MaxEdgeLength=0, MinEdgeLength=0.0001, MinTolerance=0, Refine=True, RefineAngle=0, RelativeTolerance=0.65, SimplePlanes=True, Tolerance=0})
addition = Addition(A=support_start_height_3, B="0.02")
Z_6 = UnitZ(Factor=addition)
move_8 = Move(Geometry=mesh_4, Motion=Z_6)  # -> Geometry, Transform
mmx = MeshMesh(MeshA=move_8.Geometry, MeshB=mesh_for_sla_print_3, UseMeshMeshFast=True)
divdist = DivideDistance(Curve=mmx, Distance=support_spacing_distance_4)  # -> Points, Tangents, Parameters
pt_3 = Point(divdist.Points)
multiplication_12 = Multiplication(A=support_spacing_distance_4, B="0.6")
pshift_3 = ShiftPaths(Data=pt_3, Offset=-1)
cullpt = CullDuplicates(Points=pshift_3, Tolerance=multiplication_12, CullMode=1)  # -> Points, Indices, Valence
simplify = SimplifyTree(Tree=cullpt.Points, Front=False)
project = Project(Geometry=simplify, Plane=build_platform_plane_2)  # -> Geometry, Transform
lowest_point_on_model_loactions = Point(project.Geometry)

# ---- group: Generate platfrom with release tap
boundary_curves = Curve(pline)
release_tab_length_2 = Panel(release_tab_length)
release_tab_angle_2 = Panel(release_tab_angle)
foundation_plate_thickness_2 = Panel(foundation_plate_thickness)
pshift_4 = ShiftPaths(Data=boundary_curves, Offset=-1)
runion = RegionUnion(Curves=pshift_4)
lng = ListLength(List=runion)
flatten = FlattenTree(Tree=lng, Path="{0}")
sort = SortList(Keys=flatten)  # -> Keys, ValuesA
smaller = SmallerThan(FirstNumber=sort.Keys, SecondNumber="1")  # -> SmallerThan, OrEqualTo
filter_2 = StreamFilter(Gate=smaller.SmallerThan, Stream0=runion, Stream1=pshift_4)
crv_2 = Curve(filter_2)
explode = Explode(Curve=crv_2, Recursive=True)  # -> Segments, Vertices
pshift_5 = ShiftPaths(Data=explode.Segments, Offset=-1)
boundary_2 = BoundarySurfaces(Edges=crv_2)
neg_5 = Negative(Value=release_tab_length_2)
Z_7 = UnitZ(Factor=foundation_plate_thickness_2)
item_2 = ListItem(List=explode.Segments, Index=0, Wrap=True)
offset_3 = Offset(Curve=item_2, Distance=neg_5, Plane=PlaneXY(0, 0, 0), Corners=1)
extr = Extrude(Base=boundary_2, Direction=Z_7)
pshift_6 = ShiftPaths(Data=offset_3, Offset=-1)
loft = Loft(
    Curves=[item_2, pshift_6],
    Options={Adjust=False, Closed=False, LoftEnds=0, LoftSimp=0, LoftType=0, Rebuild=10, Refit=0.01})
extr_2 = Extrude(Base=loft, Direction=Z_7)
rad = Radians(Degrees=release_tab_angle_2)
rotax = RotateAxis(Geometry=extr_2, Angle=rad, Axis=item_2)  # -> Geometry, Transform
mesh_5 = MeshBrep(
    Brep=flatten([extr, rotax.Geometry]),
    Settings={GridMaxCount=0, GridMinCount=16, JaggedSeams=False, MaxEdgeLength=0, MinEdgeLength=0.0001, MinTolerance=0, Refine=True, RefineAngle=0, RelativeTolerance=0.65, SimplePlanes=True, Tolerance=0})
supprt_platform = Mesh(mesh_5)

# ----
build_platform_plane_3 = Plane(build_platform_plane)
supprt_platform_2 = Mesh(supprt_platform)

number_slider_4 = Slider(25, range=0..100)

larger = LargerThan(SecondNumber=number_slider_4)  # -> LargerThan, OrEqualTo
filter_3 = StreamFilter(Gate=larger.LargerThan, Stream1=number_slider_4)

panel_4 = Panel(filter_3)
subtraction = Subtraction(A=number_slider_4, B=panel_4)
division_2 = Division(A=subtraction, B=number_slider_4)
graph = GraphMapper(division_2, x0=0, x1=1, y0=0, y1=1, container_name="Bezier", cpx=[0, 0.3626089692, 0.494587332, 1], cpy=[0, 0, 1, 1])

panel_5 = Panel(graph)

# ----
# used to be state detect
# used to be state detect
panel_6 = Panel(button)
larger_2 = LargerThan(FirstNumber=panel_6, SecondNumber=Slider(0, range=0..100))  # -> LargerThan, OrEqualTo
subtraction_2 = Subtraction(A=Slider(1, range=0..1), B=graph)
filter_4 = StreamFilter(Gate=larger_2.LargerThan, Stream0=graph, Stream1=subtraction_2)
Z_8 = UnitZ(Factor=1)
round_2 = Round(Number=filter_4)  # -> Nearest, Floor, Ceiling
multiplication_13 = Multiplication(A=_3d_view_rotation_z, B=filter_4)
filter_5 = StreamFilter(Gate=round_2.Ceiling, Stream0=Y_4, Stream1=Z_8)
panel_7 = Panel(multiplication_13)

up_vector_table_projection = Vector(filter_5)
filter_6 = StreamFilter(Gate=render_slice_boolean, Stream0=up_vector_table_projection, Stream1=up_vector_render_sla)

number_slider_5 = Slider(25, range=0..100)

larger_3 = LargerThan(SecondNumber=number_slider_5)  # -> LargerThan, OrEqualTo
filter_7 = StreamFilter(Gate=larger_3.LargerThan, Stream1=number_slider_5)

panel_8 = Panel(filter_7)
subtraction_3 = Subtraction(A=number_slider_5, B=panel_8)
division_3 = Division(A=subtraction_3, B=number_slider_5)
graph_2 = GraphMapper(division_3, x0=0, x1=1, y0=0, y1=1, container_name="Bezier", cpx=[0, 0.3626089692, 0.494587332, 1], cpy=[0, 0, 1, 1])

pt_4 = Point(flatten([move_4.Geometry, move_6.Geometry, move_5.Geometry]))
pt_5 = Point(flatten([area_2.Centroid, area_3.Centroid, area_4.Centroid]))
pline_2 = PolyLine(Vertices=pt_5, Closed=False)
pline_3 = PolyLine(Vertices=pt_4, Closed=False)
# used to be state detect
disc = Discontinuity(Curve=pline_2, Level=2)  # -> Points, Parameters
panel_9 = Panel(cycle_view)
item_3 = ListItem(List=disc.Parameters, Index=panel_9, Wrap=True)
subtraction_4 = Subtraction(A=item_3, B=graph_2)
smaller_2 = SmallerThan(FirstNumber=subtraction_4, SecondNumber=Slider(0, range=0..100))  # -> SmallerThan, OrEqualTo
lng_2 = ListLength(List=pt_5)
subtraction_5 = Subtraction(A=lng_2, B=Slider(1, range=0..1))
multiplication_14 = Multiplication(A=subtraction_4, B=subtraction_5)
neg_6 = Negative(Value=multiplication_14)
filter_8 = StreamFilter(Gate=smaller_2.SmallerThan, Stream0=subtraction_4, Stream1=neg_6)
eval = EvaluateCurve(Curve=pline_2, Parameter=filter_8)  # -> Point, Tangent, Angle
eval_2 = EvaluateCurve(Curve=pline_3, Parameter=filter_8)  # -> Point, Tangent, Angle
yz = YZPlane(Origin=eval.Point)
xy_2 = XYPlane(Origin=eval.Point)

rotate = Rotate(Geometry=eval_2.Point, Angle=degrees(panel_7), Plane=yz)  # -> Geometry, Transform
rotate_2 = Rotate(Geometry=rotate.Geometry, Angle=degrees(num), Plane=xy_2)  # -> Geometry, Transform
target_position_table_projection = Point(eval.Point)
camera_position_table_projection = Point(rotate_2.Geometry)

support_spacing_distance_5 = Panel(support_spacing_distance_3)
oultines_for_support_grid = Curve(aligned_curves)
multiplication_15 = Multiplication(A=support_diameter_3, B="0.6")
flatten_2 = FlattenTree(Tree=oultines_for_support_grid, Path="{0}")
offset_4 = Offset(Curve=flatten_2, Distance=multiplication_15, Plane=PlaneXY(0, 0, 0), Corners=1)
pshift_7 = ShiftPaths(Data=offset_4, Offset=-1)
boundary_3 = BoundarySurfaces(Edges=pshift_7)
edges = BrepEdges(Brep=boundary_3)  # -> Naked, Interior, NonManifold
join = JoinCurves(Curves=edges.Naked, Preserve=False)
dim_4 = Dimensions(Surface=boundary_3)  # -> UDimension, VDimension
divide_curve_even_lenght_2 = DivideCurveEvenLenght(crv=join, B=support_spacing_distance_3)
division_4 = Division(A=dim_4.UDimension, B=support_spacing_distance_5)
division_5 = Division(A=dim_4.VDimension, B=support_spacing_distance_5)
sdivide = DivideSurface(Surface=boundary_3, UCount=division_4, VCount=division_5)  # -> Points, Normals, Parameters
pline_4 = PolyLine(Vertices=divide_curve_even_lenght_2, Closed=Toggle(True))
pshift_8 = ShiftPaths(Data=sdivide.Points, Offset=-1)
clean = CleanTree(RemoveNulls=True, RemoveInvalid=True, RemoveEmpty=False, Tree=pshift_8)

pshift_9 = ShiftPaths(Data=pline_4, Offset=-1)
pt_6 = Point(clean)
multiplication_16 = Multiplication(A=support_spacing_distance_5, B="0.6")

cp = ControlPoints(Curve=pshift_9)  # -> Points, Weights, Knots
cp_2 = ClosestPoint(Point=pt_6, Cloud=cp.Points)  # -> ClosestPoint, CPIndex, Distance
smaller_3 = SmallerThan(FirstNumber=cp_2.Distance, SecondNumber=multiplication_16)  # -> SmallerThan, OrEqualTo
dispatch = Dispatch(List=pt_6, DispatchPattern=smaller_3.SmallerThan)  # -> ListA, ListB
merge = Merge(Data1=dispatch.ListB, Data2=cp.Points)

lowest_point_on_model_loactions_2 = Point(lowest_point_on_model_loactions)
pt_7 = Point(merge)
multiplication_17 = Multiplication(A=support_spacing_distance_5, B="0.5")
cp_3 = ClosestPoint(Point=pt_7, Cloud=lowest_point_on_model_loactions_2)  # -> ClosestPoint, CPIndex, Distance
smaller_4 = SmallerThan(FirstNumber=cp_3.Distance, SecondNumber=multiplication_17)  # -> SmallerThan, OrEqualTo
dispatch_2 = Dispatch(List=pt_7, DispatchPattern=smaller_4.SmallerThan)  # -> ListA, ListB
grid_of_points = Point(dispatch_2.ListB)

lowest_point_on_model_loactions_3 = Point(lowest_point_on_model_loactions)
mesh_for_sla_print_4 = Mesh(mesh_for_sla_print_2)
mesh_for_sla_print_5 = Mesh(mesh_for_sla_print_2)
overhang_degree_threshold_3 = Panel(overhang_degree_threshold_2)
grid_of_points_2 = Point(grid_of_points)
Z_9 = UnitZ(Factor=1)
meshray = MeshRay(Mesh=mesh_for_sla_print_4, Point=grid_of_points_2, Direction=Z_9)  # -> Point, Hit
meshray_2 = MeshRay(Mesh=mesh_for_sla_print_5, Point=lowest_point_on_model_loactions_3, Direction=Z_9)  # -> Point, Hit
meshcp = MeshClosestPoint(Point=meshray.Point, Mesh=mesh_for_sla_print_4)  # -> Point, Index, Parameter
meval = MeshEval(Mesh=mesh_for_sla_print_4, Parameter=meshcp.Parameter)  # -> Point, Normal, Colour
Z_10 = UnitZ(Factor=1)
rev = Reverse(Vector=Z_10)
angle = Angle(VectorA=meval.Normal, VectorB=rev)  # -> Angle, Reflex
deg = Degrees(Radians=angle.Angle)
larger_4 = LargerThan(FirstNumber=deg, SecondNumber=overhang_degree_threshold_3)  # -> LargerThan, OrEqualTo
meshcp_2 = MeshClosestPoint(Point=meshray_2.Point, Mesh=mesh_for_sla_print_4)  # -> Point, Index, Parameter
meval_2 = MeshEval(Mesh=mesh_for_sla_print_4, Parameter=meshcp_2.Parameter)  # -> Point, Normal, Colour
dispatch_3 = Dispatch(List=meval.Normal, DispatchPattern=larger_4.LargerThan)  # -> ListA, ListB
dispatch_4 = Dispatch(List=meshray.Point, DispatchPattern=larger_4.LargerThan)  # -> ListA, ListB
clean_2 = CleanTree(RemoveNulls=True, RemoveInvalid=True, RemoveEmpty=False, Tree=dispatch_4.ListB)
clean_3 = CleanTree(RemoveNulls=True, RemoveInvalid=True, RemoveEmpty=False, Tree=dispatch_3.ListB)
clean_4 = CleanTree(RemoveNulls=True, RemoveInvalid=True, RemoveEmpty=False, Tree=meshray_2.Point)
clean_5 = CleanTree(RemoveNulls=True, RemoveInvalid=True, RemoveEmpty=False, Tree=meval_2.Normal)
merge_2 = Merge(Data1=clean_2, Data2=clean_4)
merge_3 = Merge(Data1=clean_3, Data2=clean_5)
support_location_normals = Vector(merge_3)
support_locations = Point(merge_2)

support_location_normals_2 = Vector(support_location_normals)
support_locations_2 = Point(support_locations)

# ---- group: Create suport stems
amp = Amplitude(Vector=support_location_normals_2, Amplitude=multiplication_7)
move_9 = Move(Geometry=support_locations_2, Motion=amp)  # -> Geometry, Transform
project_2 = Project(Geometry=move_9.Geometry, Plane=build_platform_plane_3)  # -> Geometry, Transform
ln_2 = Line(StartPoint=project_2.Geometry, EndPoint=move_9.Geometry)
multiplication_18 = Multiplication(A=support_diameter_4, B="1.5")
multiplication_19 = Multiplication(A=support_diameter_4, B="0.5")
multiplication_20 = Multiplication(A=support_diameter_4, B="0.5")
panel_10 = Panel("""0
0.3
1""")
vpipe_2 = PipeVariable(Curve=ln_2, Parameters=panel_10, Radii=[multiplication_18, multiplication_19, multiplication_20], Caps="0")
custom_mesh_settings_2 = SettingsCustom(
    StitchSeams=True,
    SimplePlanes=False,
    Refine=True,
    MinCount=16,
    MaxCount=400,
    AspectRatio=20,
    MaxDistance=0,
    MaxAngle=20,
    MinEdge="0.1",
    MaxEdge=0)
pshift_10 = ShiftPaths(Data=vpipe_2, Offset=-1)
mesh_6 = MeshBrep(Brep=pshift_10, Settings=custom_mesh_settings_2)
support_stem_mesh = Mesh(mesh_6)

# ---- group: Position support tips
pl = PlaneNormal(Origin=support_locations_2, ZAxis=support_location_normals_2)
xy_3 = XYPlane(Origin=Point(0, 0, 0))
orient = Orient(Geometry=support_tip_mesh, Source=xy_3, Target=pl)  # -> Geometry, Transform

# ---- group: Check for stem collisions with print object
mesh_for_sla_print_6 = Mesh(mesh_for_sla_print_2)
merge_4 = Merge(Data1=orient.Geometry, Data2=support_stem_mesh)
colom = CollisionOneMany(Collider=support_stem_mesh, Obstacles=mesh_for_sla_print_6)  # -> Collision, Index
dispatch_5 = Dispatch(List=merge_4, DispatchPattern=colom.Collision)  # -> ListA, ListB

# ---- group: Create support connectors
support_spacing_distance_6 = Panel(support_spacing_distance_3)
ln_3 = Line(StartPoint=project_2.Geometry, EndPoint=move_9.Geometry)
dispatch_6 = Dispatch(List=ln_3, DispatchPattern=colom.Collision)  # -> ListA, ListB
divlength = DivideLength(Curve=flatten(dispatch_6.ListB), Length=support_spacing_distance_6)  # -> Points, Tangents, Parameters
cull_i = CullIndex(List=divlength.Points, Indices="0", Wrap=True)
pshift_11 = ShiftPaths(Data=cull_i, Offset=-1)
flip_2 = FlipMatrix(Data=pshift_11)
con = DelaunayEdges(Points=flip_2, Plane=PlaneXY(0, 0, 0))  # -> Connectivity, Edges
clean_6 = CleanTree(RemoveNulls=True, RemoveInvalid=True, RemoveEmpty=False, Tree=flatten(con.Edges))
line = Line(clean_6)
len = Length(Curve=line)
multiplication_21 = Multiplication(A=support_spacing_distance_6, B="2")
mesh_for_sla_print_7 = Mesh(mesh_for_sla_print_2)
larger_5 = LargerThan(FirstNumber=len, SecondNumber=multiplication_21)  # -> LargerThan, OrEqualTo
dispatch_7 = Dispatch(List=line, DispatchPattern=larger_5.LargerThan)  # -> ListA, ListB
colom_2 = CollisionOneMany(Collider=dispatch_7.ListB, Obstacles=mesh_for_sla_print_7)  # -> Collision, Index
dispatch_8 = Dispatch(List=dispatch_7.ListB, DispatchPattern=colom_2.Index)  # -> ListA, ListB
multiplication_22 = Multiplication(A=support_diameter_4, B="0.4")
line_2 = Line(dispatch_8.ListA)
pipe = Pipe(Curve=line_2, Radius=multiplication_22, Caps="1")
custom_mesh_settings_3 = SettingsCustom(
    StitchSeams=True,
    SimplePlanes=False,
    Refine=True,
    MinCount=16,
    MaxCount=400,
    AspectRatio=20,
    MaxDistance=0,
    MaxAngle=20,
    MinEdge="1",
    MaxEdge=0)
mesh_7 = MeshBrep(Brep=pipe, Settings=custom_mesh_settings_3)

# ----
support_stems = Mesh(dispatch_5.ListB)
support_beams = Mesh(mesh_7)
support_mesh = Mesh(flatten([support_stems, support_beams, supprt_platform_2]))
support_meshes_for_sla_print = Mesh(flatten(support_mesh))
mesh_8 = Mesh(support_meshes_for_sla_print)
gate = StreamGate(Stream=mesh_8, Gate=render_slice)  # -> Target0, Target1
preview = CustomPreview(Geometry=mesh_8, Shader=material)

enable_view_control = BooleanToggle(True)
int_2 = Integer(Slider(35, range=0..100))

# ---- group: Create slice plane positions
bbox_2 = BoundingBox(Content=[mesh_for_sla_print, support_meshes_for_sla_print], Plane=PlaneXY(0, 0, 0), UnionBox=True)  # -> Box, Box_2
layer_height_4 = Panel(layer_height_2)
debrep_2 = DeconstructBrep(Brep=bbox_2.Box)  # -> Faces, Edges, Vertices
item_4 = ListItem(List=debrep_2.Edges, Index="9", Wrap=True)
item_5 = ListItem(List=debrep_2.Faces, Index="4", Wrap=True)
area_6 = Area(Geometry=item_5)  # -> Area, Centroid

# ----
end_2 = EndPoints(Curve=item_4)  # -> Start, End

# ---- group: Create slice plane positions (continued)
vec2pt = Vector2Pt(PointA=end_2.Start, PointB=area_6.Centroid, Unitize=False)  # -> Vector, Length
move_10 = Move(Geometry=item_4, Motion=vec2pt.Vector)  # -> Geometry, Transform
divlength_2 = DivideLength(Curve=move_10.Geometry, Length=layer_height_4)  # -> Points, Tangents, Parameters
lng_3 = ListLength(List=divlength_2.Points)
subtraction_6 = Subtraction(A=lng_3, B="1")

# ---- group: SLA export slider (continued)
number_of_slices = Panel(subtraction_6)

# ----
division_6 = Division(A="1", B=number_of_slices)
subtraction_7 = Subtraction(A="1", B=division_6)
multiplication_23 = Multiplication(A=current_slice, B=subtraction_7)
panel_11 = Panel(multiplication_23)

# ---- group: Create slice plane positions (continued)
current_slice_2 = Panel(panel_11)
multiplication_24 = Multiplication(A=lng_3, B=current_slice_2)
item_6 = ListItem(List=divlength_2.Points, Index=multiplication_24, Wrap=True)
xy_4 = XYPlane(Origin=item_6)

# ----
sec = MeshPlane(Mesh=mesh_for_sla_print, Plane=xy_4)
sec_2 = MeshPlane(Mesh=support_meshes_for_sla_print, Plane=xy_4)
redpline = Reduce(Polyline=sec, Tolerance=number_slider_2)  # -> Polyline, Reduction
redpline_2 = Reduce(Polyline=sec_2, Tolerance=number_slider_2)  # -> Polyline, Reduction
gate_2 = StreamGate(Stream=redpline.Polyline, Gate=render_slice)  # -> Target0, Target1
gate_3 = StreamGate(Stream=redpline_2.Polyline, Gate=render_slice)  # -> Target0, Target1

# ---- group: Create surfaces and remove overlpping edges
boundary_4 = BoundarySurfaces(Edges=gate_2.Target1)
sunion = SolidUnion(Breps=boundary_4)
lng_4 = ListLength(List=sunion)
flatten_3 = FlattenTree(Tree=lng_4, Path="{0}")
sort_2 = SortList(Keys=flatten_3)  # -> Keys, ValuesA
fmerge = MergeFaces(Brep=sunion)  # -> Breps, Before, After
item_7 = ListItem(List=sort_2.Keys, Index=0, Wrap=True)
smaller_5 = SmallerThan(FirstNumber=item_7, SecondNumber="1")  # -> SmallerThan, OrEqualTo
filter_9 = StreamFilter(Gate=smaller_5.SmallerThan, Stream0=fmerge.Breps, Stream1=boundary_4)
srf = Surface(filter_9)

# ---- group: Create slices for support
boundary_5 = BoundarySurfaces(Edges=gate_3.Target1)
jagged = SettingsSpeed()
mesh_9 = MeshBrep(Brep=boundary_5, Settings=jagged)
support_slices = Mesh(mesh_9)

# ----
preview_2 = CustomPreview(Geometry=[redpline.Polyline, redpline_2.Polyline], Shader=ColourSwatch(SwatchColor=RGB(0, 242, 255)))

# ---- group: Create mesh grid and analyze grdis position distance from nearest edge
custom_mesh_settings_4 = SettingsCustom(
    StitchSeams=True,
    SimplePlanes=False,
    Refine=True,
    MinCount=16,
    MaxCount=400,
    AspectRatio=20,
    MaxDistance=0,
    MaxAngle=20,
    MinEdge=0,
    MaxEdge=gradient_sample_resolution)
mesh_10 = MeshBrep(Brep=srf, Settings=custom_mesh_settings_4)
demesh = DeconstructMesh(Mesh=mesh_10)  # -> Vertices, Faces, Colours, Normals
meshcp_3 = MeshClosestPoint(Point=demesh.Vertices, Mesh=mesh_for_sla_print)  # -> Point, Index, Parameter
dist = Distance(PointA=demesh.Vertices, PointB=meshcp_3.Point)

# ---- group: Colur mesh with grdient colours
division_7 = Division(A=dist, B=edge_fade_count)
subtraction_8 = Subtraction(A=Slider(1, range=0..1), B=division_7)
swatch_2 = ColourSwatch(SwatchColor=RGB(255, 255, 255))
white_overexpose_factor = ColourSwatch(SwatchColor=RGB(87, 87, 87))
multiplication_25 = Multiplication(A=swatch_2, B=subtraction_8)
addition_2 = Addition(A=multiplication_25, B=white_overexpose_factor)
conmesh = ConstructMesh(Vertices=demesh.Vertices, Faces=demesh.Faces, Colours=addition_2)

# ----
support_slices_2 = Mesh(support_slices)
mcol = MeshColours(Mesh=support_slices_2, Colours=swatch_2)
mesh_slice_with_gradient = Mesh(flatten([conmesh, mcol]))
move_11 = Move(Geometry=mesh_slice_with_gradient, Motion=Y_6)  # -> Geometry, Transform
mesh_slice_with_gradient_moved_for_rende = Mesh(move_11.Geometry)  # "Mesh slice with gradient - moved for render"

plane_from_object_slice = Plane(xy_4)
camera_distance = Panel(camera_distance_79_for_50_micron)
deplane = DeconstructPlane(Plane=plane_from_object_slice)  # -> Origin, XAxis, YAxis, ZAxis
amp_2 = Amplitude(Vector=deplane.ZAxis, Amplitude=camera_distance)

pdecon_2 = Deconstruct(Point=deplane.Origin)  # -> XComponent, YComponent, ZComponent
pt_8 = ConstructPoint(XCoordinate=pdecon.XComponent, YCoordinate=pdecon.YComponent, ZCoordinate=pdecon_2.ZComponent)
pt_9 = Point(pt_8)
move_12 = Move(Geometry=pt_9, Motion=Y_6)  # -> Geometry, Transform
move_13 = Move(Geometry=move_12.Geometry, Motion=neg_2)  # -> Geometry, Transform; disabled
xy_5 = XYPlane(Origin=move_13.Geometry)
rectangle = Rectangle(Plane=xy_5, XSize=dom, YSize=dom, Radius=0)  # -> Rectangle, Length
boundary_6 = BoundarySurfaces(Edges=rectangle.Rectangle)
preview_3 = CustomPreview(Geometry=boundary_6, Shader=material_2)

move_14 = Move(Geometry=pt_9, Motion=amp_2)  # -> Geometry, Transform
target_position_render_sla = Point(move_12.Geometry)

target_position_render_sla_2 = Point(target_position_render_sla)
filter_10 = StreamFilter(Gate=render_slice_boolean, Stream0=target_position_table_projection, Stream1=target_position_render_sla_2)
move_15 = Move(Geometry=move_14.Geometry, Motion=Y_6)  # -> Geometry, Transform

camera_position_render_sla = Point(move_15.Geometry)

camera_position_render_sla_2 = Point(camera_position_render_sla)
filter_11 = StreamFilter(Gate=render_slice_boolean, Stream0=camera_position_table_projection, Stream1=camera_position_render_sla_2)

syncfloundercamera = SyncFlounderCamera(
    Activate=enable_view_control,
    ViewportName="Fellesverkstedet",
    Location=filter_11,
    Target=filter_10,
    Lens=int_2,
    Up=filter_6)

# ==== cluster DivideCurveEvenLenght: Calculates approximate curve length for even division
crv = ClusterInput()
crv_2 = Curve(crv)
B = ClusterInput()
len = Length(Curve=crv_2)
division = Division(A=len, B=B)
int = Integer(division)
divide = DivideCurve(Curve=crv_2, Count=int, Kinks=False)  # -> Points, Tangents, Parameters
P = ClusterOutput(divide.Points)
