# Grasshopper definition V-bit-3D-engrave-visualizer.gh (Grasshopper 0.9.76)

pipeline = GeometryPipeline(
    GroupByLayer=False,
    GroupByType=False,
    IncludeHidden=True,
    IncludeLocked=True,
    LayerFilter="CNC engrave",
    NameFilter="*",
    TypeFilter=4)
pipeline_2 = GeometryPipeline(
    GroupByLayer=False,
    GroupByType=False,
    IncludeHidden=True,
    IncludeLocked=True,
    LayerFilter="CNC engrave",
    NameFilter="*",
    TypeFilter=1)
material_color = Colour(ColourSwatch(SwatchColor=RGB(0, 0, 0)))
sample_resolution = Number(Slider(2, range=0..10))
v_bit_angle = Number(Slider(90, range=0..100))
engrave_curves = Curve(pipeline)
engrave_points = Point(pipeline_2)
cluster = Cluster(
    engrave_curves=engrave_curves,
    engrave_points=engrave_points,
    v_bit_angle=v_bit_angle,
    sample_resolution=sample_resolution)  # -> meshes_2, outlines_2, surfaces_2
preview = CustomPreview(Geometry=cluster.meshes_2, Shader=material_color)

# ==== cluster Cluster
v_bit_angle = ClusterInput()
engrave_curves = ClusterInput()
engrave_points = ClusterInput()
sample_resolution = ClusterInput()
sample_resolution_2 = Number(sample_resolution)
engrave_points_2 = Point(engrave_points)
v_bit_angle_2 = Number(v_bit_angle)
engrave_curves_2 = Curve(engrave_curves)

# ---- group: Shetter curves at corners and shatter closed curves
engrave_curves_3 = Curve(engrave_curves_2)
disc = Discontinuity(Curve=engrave_curves_3, Level=1)  # -> Points, Parameters
lng = ListLength(List=disc.Parameters)
smaller = SmallerThan(FirstNumber=lng, SecondNumber="1")  # -> SmallerThan, OrEqualTo
weave = Weave(Pattern=smaller.SmallerThan, Stream0=disc.Parameters, Stream1="0", NullGaps=False)
shatter = Shatter(Curve=graft(engrave_curves_3), Parameters=weave)
flatten = FlattenTree(Tree=shatter, Path="{0}")

# ---- group: Add start and end of curves to points list (for rounded start and stops of lines)
end = EndPoints(Curve=flatten)  # -> Start, End
merge = Merge(Data1=end.Start, Data2=end.End, Data3=engrave_points_2)

# ---- group: Discard points bellow Z zero
engrave_points_3 = Point(merge)
pdecon = Deconstruct(Point=engrave_points_3)  # -> XComponent, YComponent, ZComponent
larger = LargerThan(FirstNumber=pdecon.ZComponent, SecondNumber="0")  # -> LargerThan, OrEqualTo
dispatch = Dispatch(List=engrave_points_3, DispatchPattern=larger.OrEqualTo)  # -> ListA, ListB
points_below_z_zero = Point(dispatch.ListB)

# ----
points_below_z_zero_2 = Point(points_below_z_zero)
v_bit_angle_3 = Number(v_bit_angle_2)
multiplication = Multiplication(A=v_bit_angle_3, B="0.5")
xy = XYPlane(Origin=Point(0, 0, 0))
rad = Radians(Degrees=multiplication)
pdecon_2 = Deconstruct(Point=points_below_z_zero_2)  # -> XComponent, YComponent, ZComponent
project = Project(Geometry=points_below_z_zero_2, Plane=xy)  # -> Geometry, Transform
abs = Absolute(Value=pdecon_2.ZComponent)
rtrig = RightTrigonometry(Alpha=rad, QLength=abs)  # -> Alpha, Beta, PLength, QLength, RLength
dot_radius = Panel(rtrig.PLength)

# ---- group: Make dots
dot_radius_2 = Panel(dot_radius)
points_below_z_zero_3 = Point(points_below_z_zero)
xy_2 = XYPlane(Origin=Point(0, 0, 0))
project_2 = Project(Geometry=points_below_z_zero_3, Plane=xy_2)  # -> Geometry, Transform
xy_3 = XYPlane(Origin=project_2.Geometry)
cir = Circle(Plane=xy_3, Radius=dot_radius_2)
boundary = BoundarySurfaces(Edges=cir)
mesh = MeshBrep(
    Brep=boundary,
    Settings={GridMaxCount=0, GridMinCount=16, JaggedSeams=False, MaxEdgeLength=0, MinEdgeLength=0.0001, MinTolerance=0, Refine=True, RefineAngle=0, RelativeTolerance=0.65, SimplePlanes=True, Tolerance=0})
dots = Mesh(mesh)

# ----
panel = Panel("0.5")  # disabled
nurbs = NurbsCurve(Degree=3, Periodic=False)  # -> Curve, Length, Domain; disabled
nurbs_2 = NurbsCurve(Degree=3, Periodic=False)  # -> Curve, Length, Domain; disabled
nurbs_3 = NurbsCurve(Degree=3, Periodic=False)  # -> Curve, Length, Domain; disabled
merge_2 = Merge(Data1=nurbs_3.Curve, Data2=nurbs.Curve)  # disabled
merge_3 = Merge(Data1=nurbs_3.Curve, Data2=nurbs_2.Curve)  # disabled
loft = Loft(Curves=merge_2, Options={Adjust=False, Closed=False, LoftEnds=0, LoftSimp=0, LoftType=0, Rebuild=10, Refit=0.01})  # disabled
loft_2 = Loft(Curves=merge_3, Options={Adjust=False, Closed=False, LoftEnds=0, LoftSimp=0, LoftType=0, Rebuild=10, Refit=0.01})  # disabled

# ---- group: Create sample points and find distance to offset
v_bit_angle_4 = Number(v_bit_angle_2)
sample_resolution_3 = Number(sample_resolution_2)
engrave_curves_4 = Curve(flatten)
multiplication_2 = Multiplication(A=v_bit_angle_4, B="0.5")
divide_curve_even_lenght = DivideCurveEvenLenght(crv=graft(engrave_curves_4), B=sample_resolution_3)
rad_2 = Radians(Degrees=multiplication_2)
xy_4 = XYPlane(Origin=Point(0, 0, 0))
project_3 = Project(Geometry=graft(engrave_curves_4), Plane=xy_4)  # -> Geometry, Transform
pdecon_3 = Deconstruct(Point=divide_curve_even_lenght)  # -> XComponent, YComponent, ZComponent

# ----
larger_2 = LargerThan(FirstNumber=pdecon_3.ZComponent, SecondNumber="0")  # -> LargerThan, OrEqualTo
dispatch_2 = Dispatch(List=divide_curve_even_lenght, DispatchPattern=larger_2.OrEqualTo)  # -> ListA, ListB
dispatch_3 = Dispatch(List=pdecon_3.ZComponent, DispatchPattern=larger_2.OrEqualTo)  # -> ListA, ListB
distances_for_points_bellow_z_zero = Number(dispatch_3.ListB)
points_below_z_zero_4 = Point(dispatch_2.ListB)

# ---- group: Create sample points and find distance to offset (continued)
pshift = ShiftPaths(Data=points_below_z_zero_4, Offset=-1)
crv_cp = CurveClosestPoint(Point=pshift, Curve=project_3.Geometry)  # -> Point, Parameter, Distance
abs_2 = Absolute(Value=distances_for_points_bellow_z_zero)
hframe = HorizontalFrame(Curve=project_3.Geometry, Parameter=crv_cp.Parameter)
rtrig_2 = RightTrigonometry(Alpha=simplify(rad_2), QLength=simplify(abs_2))  # -> Alpha, Beta, PLength, QLength, RLength
deplane = DeconstructPlane(Plane=hframe)  # -> Origin, XAxis, YAxis, ZAxis
half_of_line_width = Panel(rtrig_2.PLength)

# ----
amp = Amplitude(Vector=simplify(deplane.YAxis), Amplitude=simplify(half_of_line_width))  # disabled

# ---- group: Make surfaces with varying line width from point depth
amp_2 = Amplitude(Vector=simplify(deplane.YAxis), Amplitude=simplify(half_of_line_width))
rev = Reverse(Vector=amp_2)
move = Move(Geometry=simplify(deplane.Origin), Motion=amp_2)  # -> Geometry, Transform
move_2 = Move(Geometry=simplify(deplane.Origin), Motion=rev)  # -> Geometry, Transform
pline = PolyLine(Vertices=move.Geometry, Closed=False)
pline_2 = PolyLine(Vertices=move_2.Geometry, Closed=False)
end_2 = EndPoints(Curve=pline)  # -> Start, End
end_3 = EndPoints(Curve=pline_2)  # -> Start, End
ln = Line(StartPoint=end_2.End, EndPoint=end_3.End)
ln_2 = Line(StartPoint=end_2.Start, EndPoint=end_3.Start)
join = JoinCurves(Curves=[pline, pline_2, ln, ln_2], Preserve=False)
boundary_2 = BoundarySurfaces(Edges=join)
mesh_2 = MeshBrep(
    Brep=flatten(boundary_2),
    Settings={GridMaxCount=0, GridMinCount=16, JaggedSeams=False, MaxEdgeLength=0, MinEdgeLength=0.0001, MinTolerance=0, Refine=True, RefineAngle=0, RelativeTolerance=0.65, SimplePlanes=True, Tolerance=0})
strokes = Mesh(mesh_2)

# ----
rev_2 = Reverse(Vector=amp)  # disabled
edges = BrepEdges(Brep=boundary_2)  # -> Naked, Interior, NonManifold; disabled
move_3 = Move(Geometry=simplify(deplane.Origin), Motion=rev_2)  # -> Geometry, Transform; disabled
move_4 = Move(Geometry=simplify(deplane.Origin), Motion=amp)  # -> Geometry, Transform; disabled
simplify = SimplifyTree(Tree=pshift, Front=False)  # disabled
simplify_2 = SimplifyTree(Tree=edges.Naked, Front=False)  # disabled
item = ListItem(List=move_3.Geometry, Index=0, Wrap=True)  # disabled
eval = EvaluateLength(Curve=simplify_2, Length=panel, Normalized=True)  # -> Point, Tangent, Parameter; disabled
crv_cp_2 = CurveClosestPoint(Point=move_3.Geometry, Curve=simplify_2)  # -> Point, Parameter, Distance; disabled
cp = ClosestPoint(Point=eval.Point, Cloud=item)  # -> ClosestPoint, CPIndex, Distance; disabled

# ---- group: Make preview
dots_2 = Mesh(dots)
strokes_2 = Mesh(strokes)
merge_4 = Merge(Data1=strokes_2, Data2=dots_2)

# ----
surfaces = Surface([boundary_2, boundary])
surfaces_2 = ClusterOutput(surfaces)
outlines = Curve([join, cir])
outlines_2 = ClusterOutput(outlines)
meshes = Mesh(merge_4)
meshes_2 = ClusterOutput(meshes)

# ==== cluster DivideCurveEvenLenght: Calculates approximate curve length for even division
crv = ClusterInput()
crv_2 = Curve(crv)
B = ClusterInput()
len = Length(Curve=crv_2)
division = Division(A=len, B=B)
int = Integer(division)
divide = DivideCurve(Curve=crv_2, Count=int, Kinks=False)  # -> Points, Tangents, Parameters
P = ClusterOutput(divide.Points)
